# Dynamo graph About Design.dyn (Dynamo 2.12.1.8246)
# packages: Data-Shapes 2021.2.92

code_block = CodeBlock { "Cancel"; true; "Got it!"; }
code_block_2 = CodeBlock { "ACG Design:"; }
string = StringInput("""
ACG Design is a collection of tools which help users to create of process various types of information within the Revit model. Some of panels included in this tab are:

Capacity Studies contains tools which generate schedule elements or check for unit compliance. Should be used only with ACG’s capacity template.

Rooms & Areas allows users to quickly process room data ensuring any room or NDSS schedules correctly reflect what is build inside the Revit model.

Miscellaneous contains wide range of tools to help with small everyday tasks.

For more information on how the tools work please watch the Revit Tutorials, speak with the nearest BIM staff or attend BIM workshops as and when organized.

Thank you.
""")
ui_textnote_data = Custom[UI.TextNote Data](Title=code_block_2, TextNote=string)  # package Data-Shapes; Create Data for TextNote input in UI.MultipleInputForm ++ . Check out www.data-shapes.net for more informations
ui_multipleinputform = Custom[UI.MultipleInputForm ++](ButtonText_optional=code_block.out2, Inputs=ui_textnote_data, Toggle=code_block.out1)  # package Data-Shapes; Create a form with multiple inputs. see www.data-shapes.net for tutorials and infos!
