# Dynamo graph Mixed Use Schedule.dyn "Schedule Mixed Use" (Dynamo 2.12.1.8246)
# packages: archi-lab.net 2021.25.2521, Data-Shapes 2021.2.92, SteamNodes 1.2.3, Rhythm 2021.1.1, Orchid 260.1.0.7729, archi-lab.net 2022.210.2522

# group: THIS OR THAT
# note: THIS OR THAT

# group: THIS OR THAT
# note: THIS OR THAT

# group: Input
file_path = Filename("..\ACGLogo.jpg")
file_from_path = FileObject(path=file_path)
readFromFile = Image.ReadFromFile(file=file_from_path)

# group: Input
code_block = CodeBlock()
# ---------- code_block.designscript (3 lines) ----------
"Note:";

"Please fill in the required input, click Select Schedule Element button and make a selection in the active sheet.";
# ----------------------------------------
textnote_data = Custom[TextNote Data](Title=code_block.out0, TextNote=code_block.out1)  # package Data-Shapes; Create Data for TextNote input in UI.MultipleInputForm ++ . Check out www.data-shapes.net for more informations

# group: Input
get_design_options = Custom[Get Design Options]()  # package archi-lab.net; Queries all of the design options currently in the project.
# note: get design option's set
code_block_2 = CodeBlock { "Design Option Set Id"; }
getParameterValueByName = Element.GetParameterValueByName(element=get_design_options.designOptions, parameterName=code_block_2)
name = Element.Name(element=getParameterValueByName)

# group: Input
code_block_3 = CodeBlock { "Select Schedule Element"; "Cancel"; 700; 350; }
code_block_4 = CodeBlock { "Select a Design Option"; }
code_block_5 = CodeBlock(designOption=get_design_options.designOptions, set=name, name=get_design_options.names) { designOption; DOname=set+" - "+name; }
ui_dropdown_data = Custom[UI.DropDown Data](InputName=code_block_4, Keys=code_block_5.DOname, Values=code_block_5.designOption)  # package Data-Shapes; Create data for DropDown input in UI.MultiInputForm ++ . Check out www.data-shapes.net for more infos.
code_block_6 = CodeBlock { "Common Property Lines for Design Options?"; true; }
ui_boolean_input = Custom[UI.Boolean input](InputName=code_block_6.out0, DefaultValue=code_block_6.out1)  # package Data-Shapes; Creates a boolean input for UI.MultipleInputForm ++ . Check out www.data-shapes.net for more infos!
code_block_7 = CodeBlock { "Calculate GIA from floors?"; false; }
ui_boolean_input_2 = Custom[UI.Boolean input](InputName=code_block_7.out0, DefaultValue=code_block_7.out1)
list_create = List.Create(item0=textnote_data, item1=ui_dropdown_data, item2=ui_boolean_input, item3=ui_boolean_input_2)
ui_multipleinputform = Custom[UI.MultipleInputForm ++](Logo_optional=readFromFile, ButtonText_optional=code_block_3.out0, Inputs=list_create, Toggle=code_block_6.out1, CancelButtonText_optional=code_block_3.out1, Width_optional=code_block_3.out2, LabelWidth_optional=code_block_3.out3)  # package Data-Shapes; Create a form with multiple inputs. see www.data-shapes.net for tutorials and infos!

# group: Input
code_block_8 = CodeBlock { true; }
end = Revit.Transaction.Transaction.End(input=ui_multipleinputform.User_Inputs)
await_ = Orchid.Common.DataStream.Await(pass=code_block_8, waitFor=end)
ʳʰʸᵗʰᵐ_selection_pick = Rhythm.Revit.Selection.Selection.Pick(runIt=await_, singleSelection=await_)
end_2 = Revit.Transaction.Transaction.End(input=ʳʰʸᵗʰᵐ_selection_pick)

# group: Control
isEmpty = List.IsEmpty(list=getParameterValueByName)

# group: Processing
code_block_9 = CodeBlock { "Phase Created"; catGM=Revit.Elements.Category.ByName("Generic Models"); allGM = ElementQueries.OfCategory(catGM); }
getParameterValueByName_2 = Element.GetParameterValueByName(element=code_block_9.allGM, parameterName=code_block_9.out0)
code_block_10 = CodeBlock(p=getParameterValueByName_2) { p.Name=="New Construction"; }
filterByBoolMask = List.FilterByBoolMask(list=code_block_9.allGM, mask=code_block_10)
flatten = List.Flatten(list=filterByBoolMask.in)

code_block_11 = CodeBlock { Revit.Elements.Category.ByName("Generic Models"); Revit.Elements.Category.ByName("Parking"); }

# group: Visualisation
code_block_12 = CodeBlock(x=ui_multipleinputform.User_Inputs) { designOption=x[0]; }
code_block_13 = CodeBlock(x=ui_multipleinputform.User_Inputs) { commonPlotBoundary=x[1]; }
code_block_14 = CodeBlock(x=ui_multipleinputform.User_Inputs) { floorsGIA=x[2]; }

# note: Collect all unit elements from Design option
byCategoryAndDesignOption = archilab.Revit.Selection.Select.ByCategoryAndDesignOption(category=code_block_11.out0, designOption=code_block_12)
flatten_2 = List.Flatten(list=byCategoryAndDesignOption)
code_block_15 = CodeBlock { "Family: ACG-4510-ResidentialUnit-"; }
code_block_16 = CodeBlock { "Tenure"; }
code_block_17 = CodeBlock { "M"; "A"; "S"; }
code_block_18 = CodeBlock { "Unit Type"; }
code_block_19 = CodeBlock { "GIArea"; }
code_block_20 = CodeBlock { 0; }
code_block_21 = CodeBlock { "Use"; }
code_block_22 = CodeBlock { null; }
code_block_23 = CodeBlock { "Commercial"; "Hotel"; }
code_block_24 = CodeBlock { "Unit Type"; }
code_block_25 = CodeBlock { "Room"; true; "true"; }
code_block_26 = CodeBlock { "."; }
code_block_27 = CodeBlock { "Total:"; ""; }
code_block_28 = CodeBlock { "."; }
code_block_29 = CodeBlock { "."; }
code_block_30 = CodeBlock { "Residential Units"; "Total:"; "Riser"; }
code_block_31 = CodeBlock { "Project Name"; }
categories = Categories("OST_BridgeFoundationTags")
all_elements_of_category = ElementsOfCategory(Category=categories)
getParameterValueByName_3 = Element.GetParameterValueByName(element=all_elements_of_category, parameterName=code_block_31)
# note: Fill in Project name
setParameterByName = Element.SetParameterByName(element=end_2, parameterName=code_block_31, value=getParameterValueByName_3)
code_block_32 = CodeBlock { "Number parking spaces"; "Parking-Achieved"; "No. Required Parking Spaces"; "."; "Parking-Required"; }

# group: Processing
code_block_33 = CodeBlock { "Phase Created"; catP=Revit.Elements.Category.ByName("Parking"); allP = ElementQueries.OfCategory(catP); }
getParameterValueByName_4 = Element.GetParameterValueByName(element=code_block_33.allP, parameterName=code_block_33.out0)
code_block_34 = CodeBlock(p=getParameterValueByName_4) { p.Name=="New Construction"; }
filterByBoolMask_2 = List.FilterByBoolMask(list=code_block_33.allP, mask=code_block_34)
flatten_3 = List.Flatten(list=filterByBoolMask_2.in)

byCategoryAndDesignOption_2 = archilab.Revit.Selection.Select.ByCategoryAndDesignOption(category=code_block_11.out1, designOption=code_block_12)

# group: Control
code_block_35 = CodeBlock(hasDO=isEmpty, a=flatten, b=flatten_2) { hasDO?a:b; }
code_block_36 = CodeBlock(hasDO=isEmpty, a=flatten_3, b=byCategoryAndDesignOption_2) { hasDO?a:b; }

getFamily = FamilyInstance.GetFamily(familyInstance=code_block_35)
string_from_object = FromObject(obj=getFamily)
# note: Filter only residential units
startsWith = String.StartsWith(string=string_from_object, searchFor=code_block_15)
filterByBoolMask_3 = List.FilterByBoolMask(list=code_block_35, mask=startsWith)
getParameterValueByName_5 = Element.GetParameterValueByName(element=filterByBoolMask_3.out, parameterName=code_block_16)
# note: Make sure only Market & Affordable units are selected (only Circulation and Ancillary)
groupByKey = List.GroupByKey(list=filterByBoolMask_3.out, keys=getParameterValueByName_5)
startsWith_2 = String.StartsWith(string=groupByKey.uniqueKeys, searchFor=code_block_17.out0)
filterByBoolMask_4 = List.FilterByBoolMask(list=groupByKey.groups, mask=startsWith_2)
flatten_4 = List.Flatten(list=filterByBoolMask_4.in)
startsWith_3 = String.StartsWith(string=groupByKey.uniqueKeys, searchFor=code_block_17.out1)
filterByBoolMask_5 = List.FilterByBoolMask(list=groupByKey.groups, mask=startsWith_3)
flatten_5 = List.Flatten(list=filterByBoolMask_5.in)
startsWith_4 = String.StartsWith(string=groupByKey.uniqueKeys, searchFor=code_block_17.out2)
filterByBoolMask_6 = List.FilterByBoolMask(list=groupByKey.groups, mask=startsWith_4)
flatten_6 = List.Flatten(list=filterByBoolMask_6.in)
list_create_2 = List.Create(item0=flatten_4, item1=flatten_5, item2=flatten_6)
flatten_7 = List.Flatten(list=list_create_2)
get_type_parameter = Custom[Get Type Parameter](element=flatten_7, parameterName=code_block_18)  # package archi-lab.net; This node will retrieve a type parameter by its name.
# note: Group units by type
groupByKey_2 = List.GroupByKey(list=flatten_7, keys=get_type_parameter)
getParameterValueByName_6 = Element.GetParameterValueByName(element=groupByKey_2.groups@@L2, parameterName=code_block_19)
sum = Math.Sum(values=getParameterValueByName_6)

# group: Processing
code_block_37 = CodeBlock { "Tenure"; }
getParameterValueByName_7 = Element.GetParameterValueByName(element=filterByBoolMask_3.in, parameterName=code_block_37)
code_block_38 = CodeBlock { "Mark"; "0Mark"; "Afford"; "1Afford"; "Share"; "2Share"; "Ret"; "3Ret"; }
replace = String.Replace(string=getParameterValueByName_7, searchFor=code_block_38.out0, replaceWith=code_block_38.out1, lacing=Longest)
replace_2 = String.Replace(string=replace, searchFor=code_block_38.out2, replaceWith=code_block_38.out3)
replace_3 = String.Replace(string=replace_2, searchFor=code_block_38.out4, replaceWith=code_block_38.out5)
replace_4 = String.Replace(string=replace_3, searchFor=code_block_38.out6, replaceWith=code_block_38.out7)

# group: Processing
sortByKey = List.SortByKey(list=filterByBoolMask_3.in, keys=replace_4)
# note: Group units by tenure:
# Marker
# Affordable
# Shared
# Retirement
# ....rest
groupByKey_3 = List.GroupByKey(list=sortByKey.sortedList, keys=sortByKey.sortedKeys)
code_block_39 = CodeBlock { 0; 1; }
remove = String.Remove(string=groupByKey_3.uniqueKeys, startIndex=code_block_39.out0, count=code_block_39.out1)

flatten_8 = List.Flatten(list=groupByKey_3.groups)
getParameterValueByName_8 = Element.GetParameterValueByName(element=flatten_8, parameterName=code_block_19)
sum_2 = Math.Sum(values=getParameterValueByName_8)
list_create_3 = List.Create(item0=sum, item1=sum_2)
# note: Usage schedule
flatten_9 = List.Flatten(list=list_create_3)
round = Math.Round(number=flatten_9, digits=code_block_20)
sum_3 = Math.Sum(values=round)
list_create_4 = List.Create(item0=round, item1=sum_3)
flatten_10 = List.Flatten(list=list_create_4)
count = List.Count(list=flatten_10)
code_block_40 = CodeBlock(count=count)
# ---------- code_block_40.designscript (15 lines) ----------
number=1..count;

"Resi-UseNIA"+number;
"Resi-Use"+number;

visible=1..count;
notVisible=count+1..10;

"Resi no Rows Use";

"Usage Vis Row "+visible;
"Usage Vis Row "+notVisible;

1;
0;
# ----------------------------------------
# note: Usage schedule - number of rows
setParameterByName_2 = Element.SetParameterByName(element=end_2, parameterName=code_block_40.out5, value=count)
setParameterByName_3 = Element.SetParameterByName(element=end_2, parameterName=code_block_40.out6, value=code_block_40.out8)
setParameterByName_4 = Element.SetParameterByName(element=end_2, parameterName=code_block_40.out7, value=code_block_40.out9)
# note: Group unit elements by Use
get_type_parameter_2 = Custom[Get Type Parameter](element=code_block_35, parameterName=code_block_21)
eq = get_type_parameter_2 == code_block_22
filterByBoolMask_7 = List.FilterByBoolMask(list=code_block_35, mask=eq)
get_type_parameter_3 = Custom[Get Type Parameter](element=filterByBoolMask_7.out, parameterName=code_block_21)
groupByKey_4 = List.GroupByKey(list=filterByBoolMask_7.out, keys=get_type_parameter_3)
python_script_get_index_of = Python(IN[0]=groupByKey_4.uniqueKeys, IN[1]=code_block_23.out1)  # IronPython2
# ---------- python_script_get_index_of.python (10 lines) ----------
input = IN[0]
testvalue = IN[1]
output = []
a = 0
for i in input:
	if i == testvalue:
		output.append(a)
	a = a+1		
#Assign your output to the OUT variable.
OUT = output
# ----------------------------------------
getItemAtIndex = List.GetItemAtIndex(list=groupByKey_4.groups, index=python_script_get_index_of)
# note: Get Hotel Units
flatten_11 = List.Flatten(list=getItemAtIndex)
get_type_parameter_4 = Custom[Get Type Parameter](element=flatten_11, parameterName=code_block_24)
groupByKey_5 = List.GroupByKey(list=flatten_11, keys=get_type_parameter_4)
# note: Calculate number of each room type and percentages.
contains = String.Contains(string=groupByKey_5.uniqueKeys, searchFor=code_block_25.out0, ignoreCase=code_block_25.out1)
string_from_object_2 = FromObject(obj=contains)
python_script_get_index_of_2 = Python(IN[0]=string_from_object_2, IN[1]=code_block_25.out2)  # IronPython2; same code as python_script_get_index_of
flatten_12 = List.Flatten(list=python_script_get_index_of_2)
getItemAtIndex_2 = List.GetItemAtIndex(list=groupByKey_5.uniqueKeys, index=flatten_12)
list_count_types_of_rooms = List.Count(list=getItemAtIndex_2)
code_block_41 = CodeBlock(count=list_count_types_of_rooms)
# ---------- code_block_41.designscript (11 lines) ----------
"Hotel-No.Rows-UnitTypes";

noRowsUnitTypes=count+1;
lstVisible=1..count+1;
lstNotVisible=count+2..5;

"Hotel-VisRow"+lstVisible;
"Hotel-VisRow"+lstNotVisible;

1;
0;
# ----------------------------------------
setParameterByName_5 = Element.SetParameterByName(element=end_2, parameterName=code_block_41.out5, value=code_block_41.out7)
setParameterByName_6 = Element.SetParameterByName(element=end_2, parameterName=code_block_41.out4, value=code_block_41.out6)
# note: Unit types (rooms - names, numbers and %)
code_block_42 = CodeBlock(count=list_count_types_of_rooms) { count; lst=1..(count+1); "Hotel-UnitType"+lst; "Hotel no Units"+lst; "Hotel-Percent"+lst; }
getItemAtIndex_3 = List.GetItemAtIndex(list=groupByKey_5.groups, index=flatten_12)
list_count_no_of_rooms = List.Count(list=getItemAtIndex_3@@L2)
sum_4 = Math.Sum(values=list_count_no_of_rooms)
code_block_43 = CodeBlock(count=list_count_no_of_rooms, total=sum_4) { count/total*100; }
string_from_object_3 = FromObject(obj=code_block_43)
split = String.Split(string=string_from_object_3, separator0=code_block_26)
transpose = List.Transpose(lists=split)
code_block_44 = CodeBlock(x=transpose) { x[0]; }
list_create_5 = List.Create(item0=code_block_44, item1=code_block_27.out1)
flatten_13 = List.Flatten(list=list_create_5)
setParameterByName_7 = Element.SetParameterByName(element=end_2, parameterName=code_block_42.out4, value=flatten_13)
list_create_6 = List.Create(item0=list_count_no_of_rooms, item1=sum_4)
flatten_14 = List.Flatten(list=list_create_6)
string_from_object_4 = FromObject(obj=flatten_14)
split_2 = String.Split(string=string_from_object_4, separator0=code_block_28)
transpose_2 = List.Transpose(lists=split_2)
code_block_45 = CodeBlock(x=transpose_2) { x[0]; }
flatten_15 = List.Flatten(list=code_block_45)
setParameterByName_8 = Element.SetParameterByName(element=end_2, parameterName=code_block_42.out3, value=flatten_15)
list_create_7 = List.Create(item0=getItemAtIndex_2, item1=code_block_27.out0)
flatten_16 = List.Flatten(list=list_create_7)
setParameterByName_9 = Element.SetParameterByName(element=end_2, parameterName=code_block_42.out2, value=flatten_16)
string_from_object_5 = FromObject(obj=flatten_10)
split_3 = String.Split(string=string_from_object_5, separator0=code_block_29)
transpose_3 = List.Transpose(lists=split_3)
code_block_46 = CodeBlock(x=transpose_3) { x[0]; }
setParameterByName_10 = Element.SetParameterByName(element=end_2, parameterName=code_block_40.out1, value=code_block_46)
list_create_8 = List.Create(item0=code_block_30.out0, item1=groupByKey_2.uniqueKeys, item2=code_block_30.out1)
flatten_17 = List.Flatten(list=list_create_8)
setParameterByName_11 = Element.SetParameterByName(element=end_2, parameterName=code_block_40.out2, value=flatten_17)

# group: Filtering
code_block_47 = CodeBlock(e=code_block_36) { tp=e.Type; tp.Name; "Car"; "Bike"; }
contains_2 = String.Contains(string=code_block_47.out1, searchFor=code_block_47.out2)
filterByBoolMask_8 = List.FilterByBoolMask(list=code_block_36, mask=contains_2)
contains_3 = String.Contains(string=code_block_47.out1, searchFor=code_block_47.out3)
filterByBoolMask_9 = List.FilterByBoolMask(list=code_block_36, mask=contains_3)

getParameterValueByName_9 = Element.GetParameterValueByName(element=filterByBoolMask_8.in, parameterName=code_block_32.out0)
code_block_48 = CodeBlock { ""; }
eq_2 = getParameterValueByName_9 == code_block_48
filterByBoolMask_10 = List.FilterByBoolMask(list=getParameterValueByName_9, mask=eq_2)
sum_5 = Math.Sum(values=filterByBoolMask_10.out)
string_from_object_6 = FromObject(obj=sum_5)
split_4 = String.Split(string=string_from_object_6, separator0=code_block_32.out3)
transpose_4 = List.Transpose(lists=split_4)
code_block_49 = CodeBlock(x=transpose_4) { x[0]; }
setParameterByName_12 = Element.SetParameterByName(element=end_2, parameterName=code_block_32.out1, value=code_block_49)
type = archilab.Revit.Elements.Elements.Type(element=code_block_35)
getParameterValueByName_10 = Element.GetParameterValueByName(element=type, parameterName=code_block_32.out2)
code_block_50 = CodeBlock { ""; }
eq_3 = getParameterValueByName_10 == code_block_50
filterByBoolMask_11 = List.FilterByBoolMask(list=getParameterValueByName_10, mask=eq_3)
sum_6 = Math.Sum(values=filterByBoolMask_11.out)
string_from_object_7 = FromObject(obj=sum_6)
split_5 = String.Split(string=string_from_object_7, separator0=code_block_32.out3)
transpose_5 = List.Transpose(lists=split_5)
code_block_51 = CodeBlock(x=transpose_5) { x[0]; }
setParameterByName_13 = Element.SetParameterByName(element=end_2, parameterName=code_block_32.out4, value=code_block_51)
code_block_52 = CodeBlock()
# ---------- code_block_52.designscript (12 lines) ----------
["Resi Tenure1 - NIA",
"Resi Tenure2 - NIA",
"Resi Tenure3 - NIA",
"Resi Tenure Total - NIA",
"Resi Tenure1 - Unit no.",
"Resi Tenure2 - Unit no.",
"Resi Tenure3 - Unit no.",
"Resi Tenure Total - Unit no.",
"Resi Tenure1 - Mix",
"Resi Tenure2 - Mix",
"Resi Tenure3 - Mix"
];
# ----------------------------------------
code_block_53 = CodeBlock { "NIArea"; }
getParameterValueByName_11 = Element.GetParameterValueByName(element=groupByKey_3.groups@@L2, parameterName=code_block_53)
math_sum_all_tenures = Math.Sum(values=getParameterValueByName_11)
string_from_object_8 = FromObject(obj=math_sum_all_tenures)
code_block_54 = CodeBlock(x=string_from_object_8) { x=="null"; 0; }
if_ = If(test=code_block_54.out0, true=code_block_54.out1, false=math_sum_all_tenures)
round_2 = Math.Round(number=if_)
sum_7 = Math.Sum(values=round_2)
count_2 = List.Count(list=groupByKey_3.groups@L2)
sum_8 = Math.Sum(values=count_2)
# note: Tenure schedule
sum_9 = Math.Sum(values=if_)
code_block_55 = CodeBlock(numTenure=if_, numTotal=sum_9) { numTenure/numTotal*100; }
round_3 = Math.Round(number=code_block_55)
list_create_9 = List.Create(item0=round_2, item1=sum_7, item2=count_2, item3=sum_8, item4=round_3)
flatten_18 = List.Flatten(list=list_create_9)
string_from_object_9 = FromObject(obj=flatten_18)
code_block_56 = CodeBlock { "."; }
split_6 = String.Split(string=string_from_object_9, separator0=code_block_56)
transpose_6 = List.Transpose(lists=split_6)
code_block_57 = CodeBlock(x=transpose_6) { x[0]; }
setParameterByName_14 = Element.SetParameterByName(element=end_2, parameterName=code_block_52, value=code_block_57)
flatten_19 = List.Flatten(list=groupByKey_3.groups)
code_block_58 = CodeBlock { "Unit Type"; }
get_type_parameter_5 = Custom[Get Type Parameter](element=flatten_19, parameterName=code_block_58)
sortByKey_2 = List.SortByKey(list=flatten_19, keys=get_type_parameter_5)
get_type_parameter_6 = Custom[Get Type Parameter](element=sortByKey_2.sortedList, parameterName=code_block_58)
groupByKey_6 = List.GroupByKey(list=sortByKey_2.sortedList, keys=get_type_parameter_6)
list_count_unittypes = List.Count(list=groupByKey_6.uniqueKeys)
# note: Unit Types Table - Number of Rows
code_block_59 = CodeBlock(count=list_count_unittypes)
# ---------- code_block_59.designscript (9 lines) ----------
visible=1..count+1;
1;
notVisible=count+2..10;
0;
count+1;

"Resi no Rows Unit Types";
"Vis Row "+visible;
"Vis Row "+notVisible;
# ----------------------------------------
setParameterByName_15 = Element.SetParameterByName(element=end_2, parameterName=code_block_59.out7, value=code_block_59.out3)
setParameterByName_16 = Element.SetParameterByName(element=end_2, parameterName=code_block_59.out6, value=code_block_59.out1)
setParameterByName_17 = Element.SetParameterByName(element=end_2, parameterName=code_block_59.out5, value=code_block_59.out4)
code_block_60 = CodeBlock(count=list_count_unittypes)
# ---------- code_block_60.designscript (12 lines) ----------
numUnits=1..count+1..1;

"Resi Tenure1 Percent Row"+numUnits;
"Resi Tenure1 no Row"+numUnits;

"Resi Tenure2 Percent Row"+numUnits;
"Resi Tenure2 no Row"+numUnits;

"Resi Tenure3 Percent Row"+numUnits;
"Resi Tenure3 no Row"+numUnits;

"Resi Unit Type"+numUnits;
# ----------------------------------------
code_block_61 = CodeBlock { "Total:"; }
list_create_10 = List.Create(item0=groupByKey_6.uniqueKeys, item1=code_block_61)
flatten_20 = List.Flatten(list=list_create_10)
element_setparameterbyname = Element.SetParameterByName(element=end_2, parameterName=code_block_60.out7, value=flatten_20)  # "Element.SetParameterByName(Market Total Count)"
code_block_62 = CodeBlock { "Tenure"; }
getParameterValueByName_12 = Element.GetParameterValueByName(element=groupByKey_6.groups@@L2, parameterName=code_block_62)

# group: Visualisation
code_block_63 = CodeBlock(x=remove) { x[0]; x[1]; x[2]; }

eq_4 = getParameterValueByName_12@@L2 == code_block_63.out2
# note: Unit type count Tenure3
list_counttrue_marketbytype = List.CountTrue(list=eq_4@@L2)
list_counttrue_market = List.CountTrue(list=eq_4)
percentagemarket = CodeBlock(count=list_counttrue_marketbytype, total=list_counttrue_market) { count/total*100; " "; }
round_4 = Math.Round(number=percentagemarket.out0)
list_create_11 = List.Create(item0=round_4, item1=percentagemarket.out1)
flatten_21 = List.Flatten(list=list_create_11)
string_from_object_10 = FromObject(obj=flatten_21)
code_block_64 = CodeBlock { "NaN"; "0.000"; "."; }
replace_5 = String.Replace(string=string_from_object_10, searchFor=code_block_64.out0, replaceWith=code_block_64.out1)
# note: Format the result - S/O
split_7 = String.Split(string=replace_5, separator0=code_block_64.out2)
transpose_7 = List.Transpose(lists=split_7)
code_block_65 = CodeBlock(x=transpose_7) { x[0]; }
element_setparameterbyname_2 = Element.SetParameterByName(element=end_2, parameterName=code_block_60.out5, value=code_block_65)  # "Element.SetParameterByName(Market Percentage)"
list_create_12 = List.Create(item0=list_counttrue_marketbytype, item1=list_counttrue_market)
flatten_22 = List.Flatten(list=list_create_12)
string_from_object_11 = FromObject(obj=flatten_22)
code_block_66 = CodeBlock { "NaN"; "0.000"; "."; }
replace_6 = String.Replace(string=string_from_object_11, searchFor=code_block_66.out0, replaceWith=code_block_66.out1)
split_8 = String.Split(string=replace_6, separator0=code_block_66.out2)
transpose_8 = List.Transpose(lists=split_8)
code_block_67 = CodeBlock(x=transpose_8) { x[0]; }
element_setparameterbyname_3 = Element.SetParameterByName(element=end_2, parameterName=code_block_60.out6, value=code_block_67)  # "Element.SetParameterByName(Market Total Count)"
eq_5 = getParameterValueByName_12@@L2 == code_block_63.out1
# note: Unit type count Tenure2
list_counttrue_marketbytype_2 = List.CountTrue(list=eq_5@@L2)
list_counttrue_market_2 = List.CountTrue(list=eq_5)
percentagemarket_2 = CodeBlock(count=list_counttrue_marketbytype_2, total=list_counttrue_market_2) { count/total*100; " "; }
round_5 = Math.Round(number=percentagemarket_2.out0)
list_create_13 = List.Create(item0=round_5, item1=percentagemarket_2.out1)
flatten_23 = List.Flatten(list=list_create_13)
string_from_object_12 = FromObject(obj=flatten_23)
code_block_68 = CodeBlock { "NaN"; "0.000"; "."; }
replace_7 = String.Replace(string=string_from_object_12, searchFor=code_block_68.out0, replaceWith=code_block_68.out1)
# note: Format the result - Affordable
split_9 = String.Split(string=replace_7, separator0=code_block_68.out2)
transpose_9 = List.Transpose(lists=split_9)
code_block_69 = CodeBlock(x=transpose_9) { x[0]; }
element_setparameterbyname_4 = Element.SetParameterByName(element=end_2, parameterName=code_block_60.out3, value=code_block_69)  # "Element.SetParameterByName(Market Percentage)"
list_create_14 = List.Create(item0=list_counttrue_marketbytype_2, item1=list_counttrue_market_2)
flatten_24 = List.Flatten(list=list_create_14)
string_from_object_13 = FromObject(obj=flatten_24)
code_block_70 = CodeBlock { "NaN"; "0.000"; "."; }
replace_8 = String.Replace(string=string_from_object_13, searchFor=code_block_70.out0, replaceWith=code_block_70.out1)
split_10 = String.Split(string=replace_8, separator0=code_block_70.out2)
transpose_10 = List.Transpose(lists=split_10)
code_block_71 = CodeBlock(x=transpose_10) { x[0]; }
element_setparameterbyname_5 = Element.SetParameterByName(element=end_2, parameterName=code_block_60.out4, value=code_block_71)  # "Element.SetParameterByName(Market Total Count)"
eq_6 = getParameterValueByName_12@@L2 == code_block_63.out0
# note: Unit type count Tenure1
list_counttrue_marketbytype_3 = List.CountTrue(list=eq_6@@L2)
list_counttrue_market_3 = List.CountTrue(list=eq_6)
list_create_15 = List.Create(item0=list_counttrue_marketbytype_3, item1=list_counttrue_market_3)
flatten_25 = List.Flatten(list=list_create_15)
string_from_object_14 = FromObject(obj=flatten_25)
code_block_72 = CodeBlock { "NaN"; "0.000"; "."; }
replace_9 = String.Replace(string=string_from_object_14, searchFor=code_block_72.out0, replaceWith=code_block_72.out1)
# note: Format the result - Market
split_11 = String.Split(string=replace_9, separator0=code_block_72.out2)
transpose_11 = List.Transpose(lists=split_11)
code_block_73 = CodeBlock(x=transpose_11) { x[0]; }
element_setparameterbyname_6 = Element.SetParameterByName(element=end_2, parameterName=code_block_60.out2, value=code_block_73)  # "Element.SetParameterByName(Market Total Count)"
percentagemarket_3 = CodeBlock(count=list_counttrue_marketbytype_3, total=list_counttrue_market_3) { count/total*100; " "; }
round_6 = Math.Round(number=percentagemarket_3.out0)
list_create_16 = List.Create(item0=round_6, item1=percentagemarket_3.out1)
flatten_26 = List.Flatten(list=list_create_16)
string_from_object_15 = FromObject(obj=flatten_26)
code_block_74 = CodeBlock { "NaN"; "0.000"; "."; }
replace_10 = String.Replace(string=string_from_object_15, searchFor=code_block_74.out0, replaceWith=code_block_74.out1)
split_12 = String.Split(string=replace_10, separator0=code_block_74.out2)
transpose_12 = List.Transpose(lists=split_12)
code_block_75 = CodeBlock(x=transpose_12) { x[0]; }
element_setparameterbyname_7 = Element.SetParameterByName(element=end_2, parameterName=code_block_60.out1, value=code_block_75)  # "Element.SetParameterByName(Market Percentage)"
code_block_76 = CodeBlock { " (primary)"; ""; n-1; "Design Option"; }  # unwired: n
name_2 = Element.Name(element=code_block_12)
replace_11 = String.Replace(string=name_2, searchFor=code_block_76.out0, replaceWith=code_block_76.out1)

# group: Control
code_block_77 = CodeBlock(hasDO=isEmpty, b=replace_11) { hasDO?"":b; }

# note: Fill in Design option header
setParameterByName_18 = Element.SetParameterByName(element=end_2, parameterName=code_block_76.out3, value=code_block_77)
code_block_78 = CodeBlock { "."; "Units Per Ha"; }
code_block_79 = CodeBlock { Revit.Elements.Category.ByName("Site - Property Lines"); "Area"; }
all_elements_of_category_2 = ElementsOfCategory(Category=code_block_79.out0)
getParameterValueByName_13 = Element.GetParameterValueByName(element=all_elements_of_category_2, parameterName=code_block_79.out1)
byCategoryAndDesignOption_3 = archilab.Revit.Selection.Select.ByCategoryAndDesignOption(category=code_block_79.out0, designOption=code_block_12)
getParameterValueByName_14 = Element.GetParameterValueByName(element=byCategoryAndDesignOption_3, parameterName=code_block_79.out1)
code_block_80 = CodeBlock(x=getParameterValueByName_13, y=getParameterValueByName_14) { x[0]; y[0]; }
code_block_81 = CodeBlock(x=code_block_13, a=code_block_80.out0, b=code_block_80.out1) { x?a:b; }
code_block_82 = CodeBlock(numberunits=sum_8, plotsize=code_block_81) { numberunits/(plotsize/10000); }
string_from_object_16 = FromObject(obj=code_block_82)
split_13 = String.Split(string=string_from_object_16, separator0=code_block_78.out0)
# note: Calculate Units/Ha
transpose_13 = List.Transpose(lists=split_13)
code_block_83 = CodeBlock(x=transpose_13) { x[0]; }
setParameterByName_19 = Element.SetParameterByName(element=end_2, parameterName=code_block_78.out1, value=code_block_83)
runMe = Custom[Tool.RunMe](Boolean=code_block_14, ThingToDo=end_2)  # package SteamNodes; Use Boolean to perform an action

# group: Processing
code_block_84 = CodeBlock { Revit.Elements.Category.ByName("Floors"); }
byCategoryAndDesignOption_4 = archilab.Revit.Selection.Select.ByCategoryAndDesignOption(category=code_block_84, designOption=code_block_12)
code_block_85 = CodeBlock { "Phase Created"; catF=Revit.Elements.Category.ByName("Floors"); allF = ElementQueries.OfCategory(catF); }
getParameterValueByName_15 = Element.GetParameterValueByName(element=code_block_85.allF, parameterName=code_block_85.out0)
code_block_86 = CodeBlock(p=getParameterValueByName_15) { p.Name=="New Construction"; }
filterByBoolMask_12 = List.FilterByBoolMask(list=code_block_85.allF, mask=code_block_86)
# note: Collect GIA floors
code_block_87 = CodeBlock(floors1=byCategoryAndDesignOption_4, floors2=filterByBoolMask_12.in) { DSCore.List.Flatten(floors1); DSCore.List.Flatten(floors2); }

# group: Control
# note: Are floors executed?
code_block_88 = CodeBlock(hasDO=isEmpty, a=code_block_87.out1, b=code_block_87.out0) { hasDO?a:b; }
runMe_2 = Custom[Tool.RunMe](Boolean=code_block_14, ThingToDo=code_block_88)

code_block_89 = CodeBlock { "Comments"; "GIA"; }
getParameterValueByName_16 = Element.GetParameterValueByName(element=runMe_2, parameterName=code_block_89.out0)
contains_4 = String.Contains(string=getParameterValueByName_16, searchFor=code_block_89.out1)
filterByBoolMask_13 = List.FilterByBoolMask(list=runMe_2, mask=contains_4)
code_block_90 = CodeBlock { "Use"; "Hotel"; }
getParameterValueByName_17 = Element.GetParameterValueByName(element=filterByBoolMask_13.in, parameterName=code_block_90.out0)
contains_5 = String.Contains(string=getParameterValueByName_17, searchFor=code_block_90.out1)
filterByBoolMask_14 = List.FilterByBoolMask(list=filterByBoolMask_13.in, mask=contains_5)
code_block_91 = CodeBlock { "Unit Type"; }
getParameterValueByName_18 = Element.GetParameterValueByName(element=filterByBoolMask_14.in, parameterName=code_block_91)
groupByKey_7 = List.GroupByKey(list=filterByBoolMask_14.in, keys=getParameterValueByName_18)
code_block_92 = CodeBlock { "Area"; }
# note: Group by unit type
getParameterValueByName_19 = Element.GetParameterValueByName(element=groupByKey_7.groups@@L2, parameterName=code_block_92)
sum_10 = Math.Sum(values=getParameterValueByName_19)
# note: Sort by area size
sortByKey_3 = List.SortByKey(list=groupByKey_7.uniqueKeys, keys=sum_10)
reverse = List.Reverse(list=sortByKey_3.sortedList)
code_block_93 = CodeBlock { "Total:"; }
list_create_17 = List.Create(item0=reverse, item1=code_block_93)
code_block_94 = CodeBlock(names=list_create_17) { DSCore.List.Flatten(names); }
reverse_2 = List.Reverse(list=sortByKey_3.sortedKeys)
code_block_95 = CodeBlock(areas=reverse_2) { DSCore.Math.Round(areas); }
sum_11 = Math.Sum(values=code_block_95)
list_create_18 = List.Create(item0=code_block_95, item1=sum_11)
code_block_96 = CodeBlock(names=code_block_94, areas=list_create_18) { DSCore.List.Flatten(names); DSCore.List.Flatten(areas); "."; DSCore.List.Count(names); }
code_block_97 = CodeBlock(count=code_block_96.out3)
# ---------- code_block_97.designscript (14 lines) ----------
lst=1..count;
lstInvisible=count+1..10;
count;

"Hotel-Use"+lst;
"Hotel-UseNIA"+lst;

"Hotel-No.Rows-Tenure";

"Hotel-VisRow-Tenure"+lst;
"Hotel-VisRow-Tenure"+lstInvisible;

visible=1;
invisible=0;
# ----------------------------------------
string_from_object_17 = FromObject(obj=code_block_96.out1)
split_14 = String.Split(string=string_from_object_17, separator0=code_block_96.out2)
transpose_14 = List.Transpose(lists=split_14)
code_block_98 = CodeBlock(areas=transpose_14) { areas[0]; }
setParameterByName_20 = Element.SetParameterByName(element=runMe, parameterName=code_block_97.out4, value=code_block_98)
# note: Values
setParameterByName_21 = Element.SetParameterByName(element=runMe, parameterName=code_block_97.out3, value=code_block_96.out0)
# note: Number of rows
setParameterByName_22 = Element.SetParameterByName(element=runMe, parameterName=code_block_97.out5, value=code_block_97.count)
# note: Whick rows are visible/invisible
setParameterByName_23 = Element.SetParameterByName(element=runMe, parameterName=code_block_97.out6, value=code_block_97.visible)
setParameterByName_24 = Element.SetParameterByName(element=runMe, parameterName=code_block_97.out7, value=code_block_97.invisible)
code_block_99 = CodeBlock { false; true; }
if_2 = If(test=code_block_14, true=code_block_99.out0, false=code_block_99.out1)
# note: Are floors executed?
runMe_3 = Custom[Tool.RunMe](Boolean=if_2, ThingToDo=end_2)
code_block_100 = CodeBlock { "Unit Type"; "Room"; }
get_type_parameter_7 = Custom[Get Type Parameter](element=flatten_11, parameterName=code_block_100.out0)
groupByKey_8 = List.GroupByKey(list=flatten_11, keys=get_type_parameter_7)
contains_6 = String.Contains(string=groupByKey_8.uniqueKeys, searchFor=code_block_100.out1)
string_from_object_18 = FromObject(obj=contains_6)
# note: Calculate GIA per each unit type (rooms/circulation/lobby)
code_block_101 = CodeBlock { "false"; "true"; }
python_script_get_index_of_3 = Python(IN[0]=string_from_object_18, IN[1]=code_block_101.out0)  # IronPython2; same code as python_script_get_index_of
flatten_27 = List.Flatten(list=python_script_get_index_of_3)
getItemAtIndex_4 = List.GetItemAtIndex(list=groupByKey_8.uniqueKeys, index=flatten_27)
code_block_102 = CodeBlock { "Rooms"; "Total:"; }
list_create_19 = List.Create(item0=getItemAtIndex_4, item1=code_block_102.out0)
python_script_get_index_of_4 = Python(IN[0]=string_from_object_18, IN[1]=code_block_101.out0)  # IronPython2; same code as python_script_get_index_of
python_script_get_index_of_5 = Python(IN[0]=string_from_object_18, IN[1]=code_block_101.out1)  # IronPython2; same code as python_script_get_index_of
code_block_103 = CodeBlock(other=python_script_get_index_of_4, rooms=python_script_get_index_of_5) { DSCore.List.Flatten(other); DSCore.List.Flatten(rooms); }
getItemAtIndex_5 = List.GetItemAtIndex(list=groupByKey_8.groups, index=code_block_103.out0)
code_block_104 = CodeBlock { "GIArea"; }
getParameterValueByName_20 = Element.GetParameterValueByName(element=getItemAtIndex_5@@L2, parameterName=code_block_104)
sum_12 = Math.Sum(values=getParameterValueByName_20)
getItemAtIndex_6 = List.GetItemAtIndex(list=groupByKey_8.groups, index=code_block_103.out1)
flatten_28 = List.Flatten(list=getItemAtIndex_6)
getParameterValueByName_21 = Element.GetParameterValueByName(element=flatten_28, parameterName=code_block_104)
sum_13 = Math.Sum(values=getParameterValueByName_21)
list_create_20 = List.Create(item0=sum_12, item1=sum_13)
count_3 = List.Count(list=getParameterValueByName_20@L2)
count_4 = List.Count(list=getParameterValueByName_21)
list_create_21 = List.Create(item0=count_3, item1=count_4)
code_block_105 = CodeBlock(names=list_create_19, areas=list_create_20, count=list_create_21) { DSCore.List.Flatten(names); DSCore.List.Flatten(areas); DSCore.List.Flatten(count); }
sortByKey_4 = List.SortByKey(list=code_block_105.out0, keys=code_block_105.out1)
reverse_3 = List.Reverse(list=sortByKey_4.sortedList)
code_block_106 = CodeBlock { "Total:"; }
list_create_22 = List.Create(item0=reverse_3, item1=code_block_106)
code_block_107 = CodeBlock(names=list_create_22) { DSCore.List.Flatten(names); }
reverse_4 = List.Reverse(list=sortByKey_4.sortedKeys)
code_block_108 = CodeBlock(areas=reverse_4) { DSCore.Math.Round(areas); }
sum_14 = Math.Sum(values=code_block_108)
list_create_23 = List.Create(item0=code_block_108, item1=sum_14)
code_block_109 = CodeBlock(names=code_block_107, areas=list_create_23) { DSCore.List.Flatten(names); DSCore.List.Flatten(areas); "."; DSCore.List.Count(names); }
code_block_110 = CodeBlock(count=code_block_109.out3)  # same code as code_block_97
string_from_object_19 = FromObject(obj=code_block_109.out1)
split_15 = String.Split(string=string_from_object_19, separator0=code_block_109.out2)
transpose_15 = List.Transpose(lists=split_15)
code_block_111 = CodeBlock(areas=transpose_15) { areas[0]; }
setParameterByName_25 = Element.SetParameterByName(element=runMe_3, parameterName=code_block_110.out4, value=code_block_111)
setParameterByName_26 = Element.SetParameterByName(element=runMe_3, parameterName=code_block_110.out3, value=code_block_109.out0)
setParameterByName_27 = Element.SetParameterByName(element=runMe_3, parameterName=code_block_110.out5, value=code_block_110.count)
setParameterByName_28 = Element.SetParameterByName(element=runMe_3, parameterName=code_block_110.out6, value=code_block_110.visible)
setParameterByName_29 = Element.SetParameterByName(element=runMe_3, parameterName=code_block_110.out7, value=code_block_110.invisible)
sortByKey_5 = List.SortByKey(list=code_block_105.out2, keys=code_block_105.out1)
reverse_5 = List.Reverse(list=sortByKey_5.sortedList)
code_block_112 = CodeBlock { " "; }
list_create_24 = List.Create(item0=reverse_5, item1=code_block_112)
code_block_113 = CodeBlock(count=list_create_24) { output=DSCore.List.Flatten(count); lst=DSCore.List.Count(output); array=1..lst; "Hotel-UseNo.Units"+array; "."; }
string_from_object_20 = FromObject(obj=code_block_113.output)
split_16 = String.Split(string=string_from_object_20, separator0=code_block_113.out4)
transpose_16 = List.Transpose(lists=split_16)
code_block_114 = CodeBlock(x=transpose_16) { x[0]; }
# note: Number of units per Use
setParameterByName_30 = Element.SetParameterByName(element=end_2, parameterName=code_block_113.out3, value=code_block_114)
# note: Remove Hotel & Commercial
python_script_get_index_of_6 = Python(IN[0]=groupByKey_4.uniqueKeys, IN[1]=code_block_23.out0)  # IronPython2; same code as python_script_get_index_of
getItemAtIndex_7 = List.GetItemAtIndex(list=groupByKey_4.groups, index=python_script_get_index_of_6)
# note: Get Commercial Units
flatten_29 = List.Flatten(list=getItemAtIndex_7)
code_block_115 = CodeBlock { "Unit Type"; }
get_type_parameter_8 = Custom[Get Type Parameter](element=flatten_29, parameterName=code_block_115)
groupByKey_9 = List.GroupByKey(list=flatten_29, keys=get_type_parameter_8)
code_block_116 = CodeBlock { "GIArea"; }
getParameterValueByName_22 = Element.GetParameterValueByName(element=groupByKey_9.groups@@L2, parameterName=code_block_116)
sum_15 = Math.Sum(values=getParameterValueByName_22)
count_5 = List.Count(list=getParameterValueByName_22@L2)
code_block_117 = CodeBlock(names=groupByKey_9.uniqueKeys, areas=sum_15, count=count_5) { DSCore.List.Flatten(names); DSCore.List.Flatten(areas); DSCore.List.Flatten(count); }
sortByKey_6 = List.SortByKey(list=code_block_117.out2, keys=code_block_117.out1)
reverse_6 = List.Reverse(list=sortByKey_6.sortedList)
code_block_118 = CodeBlock { " "; }
list_create_25 = List.Create(item0=reverse_6, item1=code_block_118)
code_block_119 = CodeBlock(count=list_create_25) { output=DSCore.List.Flatten(count); lst=DSCore.List.Count(output); array=1..lst; "Comm no Units"+array; "."; }
string_from_object_21 = FromObject(obj=code_block_119.output)
split_17 = String.Split(string=string_from_object_21, separator0=code_block_119.out4)
transpose_17 = List.Transpose(lists=split_17)
code_block_120 = CodeBlock(nums=transpose_17) { DSCore.List.Flatten(nums); }
setParameterByName_31 = Element.SetParameterByName(element=end_2, parameterName=code_block_119.out3, value=code_block_120)
runMe_4 = Custom[Tool.RunMe](Boolean=code_block_14, ThingToDo=end_2)

# group: Processing
code_block_121 = CodeBlock { Revit.Elements.Category.ByName("Floors"); }
byCategoryAndDesignOption_5 = archilab.Revit.Selection.Select.ByCategoryAndDesignOption(category=code_block_121, designOption=code_block_12)
code_block_122 = CodeBlock { "Phase Created"; catF=Revit.Elements.Category.ByName("Floors"); allF = ElementQueries.OfCategory(catF); }
getParameterValueByName_23 = Element.GetParameterValueByName(element=code_block_122.allF, parameterName=code_block_122.out0)
code_block_123 = CodeBlock(p=getParameterValueByName_23) { p.Name=="New Construction"; }
filterByBoolMask_15 = List.FilterByBoolMask(list=code_block_122.allF, mask=code_block_123)
# note: Collect GIA floors
code_block_124 = CodeBlock(floors1=byCategoryAndDesignOption_5, floors2=filterByBoolMask_15.in) { DSCore.List.Flatten(floors1); DSCore.List.Flatten(floors2); }

# group: Control
# note: Are floors executed?
code_block_125 = CodeBlock(hasDO=isEmpty, a=code_block_124.out1, b=code_block_124.out0) { hasDO?a:b; }
runMe_5 = Custom[Tool.RunMe](Boolean=code_block_14, ThingToDo=code_block_125)

# note: Collect GIA floors
code_block_126 = CodeBlock { "Comments"; "GIA"; }
getParameterValueByName_24 = Element.GetParameterValueByName(element=runMe_5, parameterName=code_block_126.out0)
contains_7 = String.Contains(string=getParameterValueByName_24, searchFor=code_block_126.out1)
filterByBoolMask_16 = List.FilterByBoolMask(list=runMe_5, mask=contains_7)
code_block_127 = CodeBlock { "Use"; "Commercial"; }
getParameterValueByName_25 = Element.GetParameterValueByName(element=filterByBoolMask_16.in, parameterName=code_block_127.out0)
contains_8 = String.Contains(string=getParameterValueByName_25, searchFor=code_block_127.out1)
filterByBoolMask_17 = List.FilterByBoolMask(list=filterByBoolMask_16.in, mask=contains_8)
code_block_128 = CodeBlock { "Unit Type"; }
getParameterValueByName_26 = Element.GetParameterValueByName(element=filterByBoolMask_17.in, parameterName=code_block_128)
groupByKey_10 = List.GroupByKey(list=filterByBoolMask_17.in, keys=getParameterValueByName_26)
code_block_129 = CodeBlock { "Area"; }
getParameterValueByName_27 = Element.GetParameterValueByName(element=groupByKey_10.groups@@L2, parameterName=code_block_129)
sum_16 = Math.Sum(values=getParameterValueByName_27)
sortByKey_7 = List.SortByKey(list=groupByKey_10.uniqueKeys, keys=sum_16)
reverse_7 = List.Reverse(list=sortByKey_7.sortedList)
code_block_130 = CodeBlock { "Total:"; }
list_create_26 = List.Create(item0=reverse_7, item1=code_block_130)
code_block_131 = CodeBlock(names=list_create_26) { DSCore.List.Flatten(names); }
reverse_8 = List.Reverse(list=sortByKey_7.sortedKeys)
code_block_132 = CodeBlock(areas=reverse_8) { DSCore.Math.Round(areas); }
sum_17 = Math.Sum(values=code_block_132)
list_create_27 = List.Create(item0=code_block_132, item1=sum_17)
code_block_133 = CodeBlock(names=code_block_131, areas=list_create_27) { DSCore.List.Flatten(names); DSCore.List.Flatten(areas); "."; DSCore.List.Count(names); }
code_block_134 = CodeBlock(count=code_block_133.out3)
# ---------- code_block_134.designscript (14 lines) ----------
lst=1..count;
lstInvisible=count+1..5;
count;

"Comm Unit Type"+lst;
"Comm GIA"+lst;

"Comm no Rows";

"Comm Vis Row"+lst;
"Comm Vis Row"+lstInvisible;

visible=1;
invisible=0;
# ----------------------------------------
string_from_object_22 = FromObject(obj=code_block_133.out1)
split_18 = String.Split(string=string_from_object_22, separator0=code_block_133.out2)
transpose_18 = List.Transpose(lists=split_18)
code_block_135 = CodeBlock(areas=transpose_18) { areas[0]; }
setParameterByName_32 = Element.SetParameterByName(element=runMe_4, parameterName=code_block_134.out4, value=code_block_135)
setParameterByName_33 = Element.SetParameterByName(element=runMe_4, parameterName=code_block_134.out3, value=code_block_133.out0)
setParameterByName_34 = Element.SetParameterByName(element=runMe_4, parameterName=code_block_134.out5, value=code_block_134.count)
setParameterByName_35 = Element.SetParameterByName(element=runMe_4, parameterName=code_block_134.out6, value=code_block_134.visible)
code_block_136 = CodeBlock { false; true; }
if_3 = If(test=code_block_14, true=code_block_136.out0, false=code_block_136.out1)
runMe_6 = Custom[Tool.RunMe](Boolean=if_3, ThingToDo=end_2)
sortByKey_8 = List.SortByKey(list=code_block_117.out0, keys=code_block_117.out1)
reverse_9 = List.Reverse(list=sortByKey_8.sortedList)
code_block_137 = CodeBlock { "Total:"; }
list_create_28 = List.Create(item0=reverse_9, item1=code_block_137)
code_block_138 = CodeBlock(names=list_create_28) { DSCore.List.Flatten(names); }
reverse_10 = List.Reverse(list=sortByKey_8.sortedKeys)
code_block_139 = CodeBlock(areas=reverse_10) { DSCore.Math.Round(areas); }
sum_18 = Math.Sum(values=code_block_139)
list_create_29 = List.Create(item0=code_block_139, item1=sum_18)
code_block_140 = CodeBlock(names=code_block_138, areas=list_create_29) { DSCore.List.Flatten(names); DSCore.List.Flatten(areas); "."; DSCore.List.Count(names); }
code_block_141 = CodeBlock(count=code_block_140.out3)  # same code as code_block_134
string_from_object_23 = FromObject(obj=code_block_140.out1)
split_19 = String.Split(string=string_from_object_23, separator0=code_block_140.out2)
transpose_19 = List.Transpose(lists=split_19)
code_block_142 = CodeBlock(areas=transpose_19) { areas[0]; }
setParameterByName_36 = Element.SetParameterByName(element=runMe_6, parameterName=code_block_141.out4, value=code_block_142)
setParameterByName_37 = Element.SetParameterByName(element=runMe_6, parameterName=code_block_141.out3, value=code_block_140.out0)
setParameterByName_38 = Element.SetParameterByName(element=runMe_6, parameterName=code_block_141.out5, value=code_block_141.count)
setParameterByName_39 = Element.SetParameterByName(element=runMe_6, parameterName=code_block_141.out6, value=code_block_141.visible)
setParameterByName_40 = Element.SetParameterByName(element=runMe_6, parameterName=code_block_141.out7, value=code_block_141.invisible)
setParameterByName_41 = Element.SetParameterByName(element=runMe_4, parameterName=code_block_134.out7, value=code_block_134.invisible)
watch = Watch(code_block_42.out2)
watch_2 = Watch(code_block_42.out3)
watch_3 = Watch(code_block_42.out4)
watch_4 = Watch(code_block_113.out3)
watch_5 = Watch(flatten_16)
watch_6 = Watch(flatten_15)
watch_7 = Watch(flatten_13)
watch_8 = Watch(code_block_114)

# group: Usage
code_block_143 = CodeBlock { "Schedule Mixed Use"; }
acg_script_usage = Custom[ACG Script Usage](scriptName=code_block_143)  # Adds an entry to Excel document every time a script is run. The document is located in S:\Dynamo\05-UsageStats

code_block_144 = CodeBlock { "Number parking spaces"; "Bikes-Achieved"; "No. Required Bike Racks"; "."; "Bikes-Required"; }
getParameterValueByName_28 = Element.GetParameterValueByName(element=filterByBoolMask_9.in, parameterName=code_block_144.out0)
code_block_145 = CodeBlock { ""; }
eq_7 = getParameterValueByName_28 == code_block_145
filterByBoolMask_18 = List.FilterByBoolMask(list=getParameterValueByName_28, mask=eq_7)
sum_19 = Math.Sum(values=filterByBoolMask_18.out)
string_from_object_24 = FromObject(obj=sum_19)
split_20 = String.Split(string=string_from_object_24, separator0=code_block_144.out3)
transpose_20 = List.Transpose(lists=split_20)
code_block_146 = CodeBlock(x=transpose_20) { x[0]; }
setParameterByName_42 = Element.SetParameterByName(element=end_2, parameterName=code_block_144.out1, value=code_block_146)
type_2 = archilab.Revit.Elements.Elements.Type()  # unwired: element
getParameterValueByName_29 = Element.GetParameterValueByName(element=type_2, parameterName=code_block_144.out2)
code_block_147 = CodeBlock { ""; }
eq_8 = getParameterValueByName_29 == code_block_147
filterByBoolMask_19 = List.FilterByBoolMask(list=getParameterValueByName_29, mask=eq_8)
sum_20 = Math.Sum(values=filterByBoolMask_19.out)
string_from_object_25 = FromObject(obj=sum_20)
split_21 = String.Split(string=string_from_object_25, separator0=code_block_144.out3)
transpose_21 = List.Transpose(lists=split_21)
code_block_148 = CodeBlock(x=transpose_21) { x[0]; }
setParameterByName_43 = Element.SetParameterByName(element=end_2, parameterName=code_block_144.out4, value=code_block_148)

# group: Visualisation
code_block_149 = CodeBlock { numb=1..3; "Resi Tenure"+numb+" - Name"; }
# note: Assigh tenure names
element_setparameterbyname_8 = Element.SetParameterByName(element=end_2, parameterName=code_block_149.out1, value=remove)  # "Element.SetParameterByName(Market Percentage)"

code_block_150 = CodeBlock { "Resi Net To Gross"; }
sum_21 = Math.Sum(values=if_)
code_block_151 = CodeBlock(NIA=sum_21, GIA=sum_3) { NIA/GIA; }
code_block_efficiency = CodeBlock { 3; "00"; }
round_7 = Math.Round(number=code_block_151, digits=code_block_efficiency.out0)
string_from_object_26 = FromObject(obj=round_7)
split_22 = String.Split(string=string_from_object_26, separator0=code_block_efficiency.out1)
code_block_152 = CodeBlock(lst=split_22) { DSCore.List.Flatten(lst); }
code_block_153 = CodeBlock(x=code_block_152) { x[0]; }
setParameterByName_44 = Element.SetParameterByName(element=end_2, parameterName=code_block_150, value=code_block_153)
# note: Build base schedule - number of rows
setParameterByName_45 = Element.SetParameterByName(element=end_2, parameterName=code_block_41.out0, value=code_block_41.noRowsUnitTypes)
