# Dynamo graph Report Unit Aspect.dyn "Units - Report Aspect_py" (Dynamo 2.12.1.8246)
# packages: Data-Shapes 2018.12.1, archi-lab.net 2020.22.7, Data-Shapes 2021.2.92

# group: Usage
code_block = CodeBlock { "Units - Report Aspect"; }
acg_script_usage = Custom[ACG Script Usage](scriptName=code_block)  # Adds an entry to Excel document every time a script is run. The document is located in S:\Dynamo\05-UsageStats

# group: Input
get_design_options = Custom[Get Design Options]()  # package archi-lab.net; Queries all of the design options currently in the project.
# note: get design option's set
code_block_2 = CodeBlock { "Design Option Set Id"; }
getParameterValueByName = Element.GetParameterValueByName(element=get_design_options.designOptions, parameterName=code_block_2)
code_block_3 = CodeBlock { "Select a Design Option"; }
name = Element.Name(element=getParameterValueByName)
code_block_4 = CodeBlock(designOption=get_design_options.designOptions, set=name, name=get_design_options.names) { designOption; DOname=set+" - "+name; }

# group: Control
isEmpty = List.IsEmpty(list=getParameterValueByName)

# group: Input
code_block_5 = CodeBlock { "Note:"; }
string = StringInput("""This tool will report the number of single, dual and triple aspect residential units from a given Design Option. It will also override them in the active 3D view as follows:

Single aspect units   :   GREEN
Dual aspect units   :   LIME
Triple aspect units	   :   AMBER
Quadruple aspect units   :   RED
Non-residential units   :   HALFTONE

Please note that for the In-Place units to be processed, the Side Wall X External instance parameters need to ticked manually. By default the script will assume that each unit has at least one external wall. For example, single aspect In-Place units should not have a Side Wall X External parameter ticked, dual aspect In-Place units should have one Side Wall X External parameter ticked, etc.
Best to prepare a dedicated 3D view. To remove the overrides, please select all elements and use the EOD shortcut to reset.
""")
textnote_data = Custom[TextNote Data](Title=code_block_5, TextNote=string)  # package Data-Shapes; Create Data for TextNote input in UI.MultipleInputForm ++ . Check out www.data-shapes.net for more informations
ui_dropdown_data = Custom[UI.DropDown Data](InputName=code_block_3, Keys=code_block_4.DOname, Values=code_block_4.designOption)  # package Data-Shapes; Create data for DropDown input in UI.MultiInputForm ++ . Check out www.data-shapes.net for more infos.
code_block_6 = CodeBlock { "Filter units by instance parameter (parameter name):"; "Unit Zone"; }
textbox_data = Custom[TextBox Data](InputName=code_block_6.out0, DefaultText=code_block_6.out1)  # package Data-Shapes; Create Data for TextBox input in UI.MultipleInputForm ++ . Check out www.data-shapes.net for more informations
code_block_7 = CodeBlock { "Parameter value equals:"; ""; }
textbox_data_2 = Custom[TextBox Data](InputName=code_block_7.out0, DefaultText=code_block_7.out1)

# group: Input
code_block_8 = CodeBlock { "Select Phase"; }
python_script = Python()  # IronPython2
# ---------- python_script.python (44 lines) ----------
# Load the Python Standard and DesignScript Libraries
import clr
import sys
import os.path
from datetime import datetime
from System import Environment
sys.path.append('C:\Program Files (x86)\IronPython 2.7\Lib')
import System
from System import Array
from System.Collections.Generic import *
clr.AddReference('ProtoGeometry')
from Autodesk.DesignScript.Geometry import *
clr.AddReference("RevitNodes")
import Revit
clr.ImportExtensions(Revit.Elements)
clr.ImportExtensions(Revit.GeometryConversion)
clr.AddReference("RevitServices")
import RevitServices
from RevitServices.Persistence import DocumentManager 
from RevitServices.Transactions import TransactionManager 

clr.AddReference("RevitAPI")
clr.AddReference("RevitAPIUI")

import Autodesk 
from Autodesk.Revit.DB import *
from Autodesk.Revit.UI import *
import time

doc = DocumentManager.Instance.CurrentDBDocument
uiapp = DocumentManager.Instance.CurrentUIApplication 
app = uiapp.Application 
uidoc = uiapp.ActiveUIDocument

phases = doc.Phases
Ids = []
names = []

for i in doc.Phases:
	Ids.append(i.Id)
	names.append(i.Name)
	
	
OUT = names, Ids, len(Ids)-1
# ----------------------------------------
# note: get all phases in the ducument
code_block_9 = CodeBlock(x=python_script) { names = x[0]; ids = x[1]; lastIndex = x[2]; }
ui_dropdown_data_2 = Custom[UI.DropDown Data](InputName=code_block_8, Keys=code_block_9.names, Values=code_block_9.ids, DefaultValueIndex=code_block_9.lastIndex)

# group: Input
code_block_10 = CodeBlock { "Run"; "Cancel"; 700; 350; }
list_create = List.Create(item0=textnote_data, item1=ui_dropdown_data, item2=textbox_data, item3=textbox_data_2, item4=ui_dropdown_data_2)
code_block_11 = CodeBlock { true; }
ui_multipleinputform = Custom[UI.MultipleInputForm ++](ButtonText_optional=code_block_10.out0, Inputs=list_create, Toggle=code_block_11, CancelButtonText_optional=code_block_10.out1, Width_optional=code_block_10.out2, LabelWidth_optional=code_block_10.out3)  # package Data-Shapes; Create a form with multiple inputs. see www.data-shapes.net for tutorials and infos!
code_block_12 = CodeBlock(x=ui_multipleinputform.User_Inputs) { designOption = x[0]; paramName = x[1]; paramValue = x[2]; phaseId = x[3]; }
not_ = Not()  # unwired: x

# group: Visualisation
python_script_2 = Python(IN[0]=ui_multipleinputform.Was_Cancelled, IN[1]=code_block_12.designOption, IN[2]=code_block_12.phaseId, IN[3]=code_block_12.paramName, IN[4]=code_block_12.paramValue)  # IronPython2
# ---------- python_script_2.python (111 lines) ----------
# Load the Python Standard and DesignScript Libraries
import clr
import sys
import os.path
from datetime import datetime
from System import Environment
sys.path.append('C:\Program Files (x86)\IronPython 2.7\Lib')
import System
from System import Array
from System.Collections.Generic import *
clr.AddReference('ProtoGeometry')
from Autodesk.DesignScript.Geometry import *
clr.AddReference("RevitNodes")
import Revit
clr.ImportExtensions(Revit.Elements)
clr.ImportExtensions(Revit.GeometryConversion)
clr.AddReference("RevitServices")
import RevitServices
from RevitServices.Persistence import DocumentManager 
from RevitServices.Transactions import TransactionManager 

clr.AddReference("RevitAPI")
clr.AddReference("RevitAPIUI")

import Autodesk 
from Autodesk.Revit.DB import *
from Autodesk.Revit.UI import *
import time

doc = DocumentManager.Instance.CurrentDBDocument
uiapp = DocumentManager.Instance.CurrentUIApplication 
app = uiapp.Application 
uidoc = uiapp.ActiveUIDocument

cancelled = IN[0]
dOpt = IN[1]
phaseId = IN[2]
paramName = str(IN[3])
paramValue = IN[4]

# define colours
amber = Color(252,192,32)
red = Color(232,60,77)
yellow = Color(255,255,128)
white = Color(255,255,255)
black = Color(0,0,0)

if not cancelled:
	gModels = FilteredElementCollector(doc).OfCategory(BuiltInCategory.OST_GenericModel).WhereElementIsNotElementType().ToElements()

	# collect units from the given design option or units from the model / units from given phase
	unitsToProcess = []
	if dOpt == None:
		for i in gModels:
			if i.DesignOption == None and str(i.CreatedPhaseId) == str(phaseId):
				unitsToProcess.append(i)
	else:	
		for i in gModels:
			if i.DesignOption != None:
				dOptId = dOpt.Id
				if str(i.DesignOption.Id) == str(dOptId) and str(i.CreatedPhaseId) == str(phaseId):
					unitsToProcess.append(i)

# get only the resi units
resiUnits = []
nonResiUnits = []
for i in unitsToProcess:
	typeId = i.GetTypeId()
	type = doc.GetElement(typeId)
	if 'ACG-4510-Resi' in type.Family.Name and str(paramValue) in i.LookupParameter(paramName).AsString():
		resiUnits.append(i)
	else:
		nonResiUnits.append(i)

# get the aspects for each resi unit
numbAspects = []
for i in resiUnits:
	aspect = 1
	if i.LookupParameter('Side Wall A External'):
		aspect += i.LookupParameter('Side Wall A External').AsInteger()
	if i.LookupParameter('Side Wall B External'):
		aspect += i.LookupParameter('Side Wall B External').AsInteger()
	if i.LookupParameter('Side Wall C External'):
		aspect += i.LookupParameter('Side Wall C External').AsInteger()
	if i.LookupParameter('Side Wall D External'):
		aspect += i.LookupParameter('Side Wall D External').AsInteger()
	if i.LookupParameter('Rear Wall External'):
		aspect += i.LookupParameter('Rear Wall External').AsInteger()
	numbAspects.append(aspect)
	
# group by number of aspects
noAspect = []
singleAspect = []
dualAspect = []
tripleAspect = []
quadAspect = []
for unit, aspect in zip(resiUnits, numbAspects):
	if aspect == 0:
		noAspect.append(unit)
	if aspect == 1:
		singleAspect.append(unit)
	if aspect == 2:
		dualAspect.append(unit)
	if aspect == 3:
		tripleAspect.append(unit)
	if aspect == 4:
		quadAspect.append(unit)
		
report = 'There are:\n' +(str(len(singleAspect)))+ '\t single aspect units,\n' +(str(len(dualAspect)))+ '\t dual aspect units,\n' +(str(len(tripleAspect)))+ '\t triple aspect units and \n' +(str(len(quadAspect)))+ '\t quadruple aspect units.'

OUT = noAspect, singleAspect, dualAspect, tripleAspect, quadAspect, nonResiUnits, report
# ----------------------------------------
python_script_3 = Python(IN[0]=python_script_2)  # IronPython2
# ---------- python_script_3.python (79 lines) ----------
# Load the Python Standard and DesignScript Libraries
import clr
import sys
import os.path
from datetime import datetime
from System import Environment
sys.path.append('C:\Program Files (x86)\IronPython 2.7\Lib')
import System
from System import Array
from System.Collections.Generic import *
clr.AddReference('ProtoGeometry')
from Autodesk.DesignScript.Geometry import *
clr.AddReference("RevitNodes")
import Revit
clr.ImportExtensions(Revit.Elements)
clr.ImportExtensions(Revit.GeometryConversion)
clr.AddReference("RevitServices")
import RevitServices
from RevitServices.Persistence import DocumentManager 
from RevitServices.Transactions import TransactionManager 

clr.AddReference("RevitAPI")
clr.AddReference("RevitAPIUI")

import Autodesk 
from Autodesk.Revit.DB import *
from Autodesk.Revit.UI import *
import time

doc = DocumentManager.Instance.CurrentDBDocument
uiapp = DocumentManager.Instance.CurrentUIApplication 
app = uiapp.Application 
uidoc = uiapp.ActiveUIDocument


noAspect = IN[0][0]
singleAspect = IN[0][1]
dualAspect = IN[0][2]
tripleAspect = IN[0][3]
quadAspect = IN[0][4]
nonResiUnits = IN[0][5]


osg = OverrideGraphicSettings()
osg.SetSurfaceForegroundPatternColor(Color(50,60,80))
osg.SetSurfaceForegroundPatternId(ElementId(19))

white = Color(255,255,255)
black = Color(0,0,0)
green = Color(0,175,182)
yellow = Color(255,255,128)
amber = Color(252,192,32)
red = Color(232,60,77)

result = 'All seems ok'

TransactionManager.Instance.EnsureInTransaction(doc)

if len(noAspect) > 0 :
	for i in noAspect:
		doc.ActiveView.SetElementOverrides(ElementId(i.Id), osg.SetSurfaceForegroundPatternColor(white))
if len(singleAspect) > 0 :		
	for i in singleAspect:
		doc.ActiveView.SetElementOverrides(ElementId(i.Id), osg.SetSurfaceForegroundPatternColor(green))
if len(dualAspect) > 0 :	
	for i in dualAspect:	
		doc.ActiveView.SetElementOverrides(ElementId(i.Id), osg.SetSurfaceForegroundPatternColor(yellow))
if len(tripleAspect) > 0 :	
	for i in tripleAspect:	
		doc.ActiveView.SetElementOverrides(ElementId(i.Id), osg.SetSurfaceForegroundPatternColor(amber))
if len(quadAspect) > 0 :	
	for i in quadAspect:	
		doc.ActiveView.SetElementOverrides(ElementId(i.Id), osg.SetSurfaceForegroundPatternColor(red))
if len(nonResiUnits) > 0 :	
	for i in nonResiUnits:	
		doc.ActiveView.SetElementOverrides(ElementId(i.Id), osg.SetHalftone(True))
	

TransactionManager.Instance.TransactionTaskDone()
# ----------------------------------------

# group: Input
code_block_13 = CodeBlock { "Okay"; 600; }
code_block_14 = CodeBlock(x=python_script_2) { "Result:"; x[6]; }
textnote_data_2 = Custom[TextNote Data](Title=code_block_14.out0, TextNote=code_block_14.out1)
list_create_2 = List.Create(item0=textnote_data_2)
ui_multipleinputform_2 = Custom[UI.MultipleInputForm ++](ButtonText_optional=code_block_13.out0, Inputs=list_create_2, Toggle=not_)

code_block_15 = CodeBlock(x=code_block_4.designOption) { x[0]; }
