# Dynamo graph Residential Schedule.dyn "Schedule Residential" (Dynamo 2.12.1.8246)
# packages: archi-lab.net 2020.22.7, Data-Shapes 2018.12.1, SteamNodes 1.2.3, Orchid 230.0.3.7501, archi-lab.net 2021.25.2521, Rhythm 2021.1.1, Orchid 260.1.0.7729, Data-Shapes 2021.2.92

# group: Input
file_path = Filename("..\ACG_logo.png")
# note: Pick Design Option and Schedule element
file_from_path = FileObject(path=file_path)
readFromFile = Image.ReadFromFile(file=file_from_path)

# group: Input
code_block = CodeBlock { "Select a Design Option"; }
get_design_options = Custom[Get Design Options]()  # package archi-lab.net; Queries all of the design options currently in the project.
# note: get design option's set
code_block_2 = CodeBlock { "Design Option Set Id"; }
getParameterValueByName = Element.GetParameterValueByName(element=get_design_options.designOptions, parameterName=code_block_2)
name = Element.Name(element=getParameterValueByName)
code_block_3 = CodeBlock(designOption=get_design_options.designOptions, set=name, name=get_design_options.names) { designOption; DOname=set+" - "+name; }

# group: Input
code_block_4 = CodeBlock()
# ---------- code_block_4.designscript (3 lines) ----------
"Note:";

"Please fill in the required input, click Select Schedule Element button and make a selection in the active sheet. If there are no Design Options in the model, just leave the dropdown menu blank. The script will pick up all elements created in the New Construction phase. ";
# ----------------------------------------
textnote_data = Custom[TextNote Data](Title=code_block_4.out0, TextNote=code_block_4.out1)  # package Data-Shapes; Create Data for TextNote input in UI.MultipleInputForm ++ . Check out www.data-shapes.net for more informations
ui_dropdown_data = Custom[UI.DropDown Data](InputName=code_block, Keys=code_block_3.DOname, Values=code_block_3.designOption)  # package Data-Shapes; Create data for DropDown input in UI.MultiInputForm ++ . Check out www.data-shapes.net for more infos.
code_block_5 = CodeBlock { "Common Property Lines for Design Options?"; true; }
ui_boolean_input = Custom[UI.Boolean input](InputName=code_block_5.out0, DefaultValue=code_block_5.out1)  # package Data-Shapes; Creates a boolean input for UI.MultipleInputForm ++ . Check out www.data-shapes.net for more infos!
code_block_6 = CodeBlock { "Calculate GIA from floors?"; false; }
ui_boolean_input_2 = Custom[UI.Boolean input](InputName=code_block_6.out0, DefaultValue=code_block_6.out1)
code_block_7 = CodeBlock { "Filter units by instance parameter (parameter name):"; "Unit Zone"; }
textbox_data = Custom[TextBox Data](InputName=code_block_7.out0, DefaultText=code_block_7.out1)  # package Data-Shapes; Create Data for TextBox input in UI.MultipleInputForm ++ . Check out www.data-shapes.net for more informations
code_block_8 = CodeBlock { "Parameter value contains:"; ""; }
textbox_data_2 = Custom[TextBox Data](InputName=code_block_8.out0, DefaultText=code_block_8.out1)
code_block_9 = CodeBlock { Revit.Elements.Category.ByName("Generic Annotations"); }

# group: Input
code_block_10 = CodeBlock { "Select Schedule Element"; "Cancel"; 700; 350; }
list_create = List.Create(item0=textnote_data, item1=ui_dropdown_data, item2=ui_boolean_input, item3=ui_boolean_input_2, item4=textbox_data, item5=textbox_data_2)
ui_multipleinputform = Custom[UI.MultipleInputForm ++](Logo_optional=readFromFile, ButtonText_optional=code_block_10.out0, Inputs=list_create, Toggle=code_block_5.out1, CancelButtonText_optional=code_block_10.out1, Width_optional=code_block_10.out2, LabelWidth_optional=code_block_10.out3)  # package Data-Shapes; Create a form with multiple inputs. see www.data-shapes.net for tutorials and infos!

# group: Input
code_block_11 = CodeBlock { true; }
end = Revit.Transaction.Transaction.End(input=ui_multipleinputform.User_Inputs)
await_ = Orchid.Common.DataStream.Await(pass=code_block_11, waitFor=end)
# note: select schedule element
ʳʰʸᵗʰᵐ_selection_pick = Rhythm.Revit.Selection.Selection.Pick(runIt=await_, category=code_block_9, singleSelection=await_)
end_2 = Revit.Transaction.Transaction.End(input=ʳʰʸᵗʰᵐ_selection_pick)

# group: Visualisation
code_block_12 = CodeBlock(scheduleElement=end_2) { scheduleElement; }
code_block_13 = CodeBlock(x=ui_multipleinputform.User_Inputs) { paramName = x[3]; paramValue = x[4]; }
code_block_14 = CodeBlock(designOption=ui_multipleinputform.User_Inputs) { designOption[0]; }
code_block_15 = CodeBlock(floorGIA=ui_multipleinputform.User_Inputs) { floorGIA[2]; }
code_block_16 = CodeBlock(propertyLine=ui_multipleinputform.User_Inputs) { propertyLine[1]; }

# group: Control
isEmpty = List.IsEmpty(list=getParameterValueByName)

# group: Visualisation
code_block_17 = CodeBlock()
# ---------- code_block_17.designscript (4 lines) ----------
catGM=Revit.Category.ByName("Generic Models");
allGM=ElementQueries.OfCategory(catGM);
catP=Revit.Category.ByName("Parking");
allP=ElementQueries.OfCategory(catP);
# ----------------------------------------
code_block_18 = CodeBlock { "Phase Created"; }
getParameterValueByName_2 = Element.GetParameterValueByName(element=code_block_17.allGM, parameterName=code_block_18)
code_block_19 = CodeBlock(ph=getParameterValueByName_2) { ph.Name=="New Construction"; }
# note: Collect the Generic Models to be processed
filterByBoolMask = List.FilterByBoolMask(list=code_block_17.allGM, mask=code_block_19)
getParameterValueByName_3 = Element.GetParameterValueByName(element=code_block_17.allP, parameterName=code_block_18)
code_block_20 = CodeBlock(ph=getParameterValueByName_3) { ph.Name=="New Construction"; }
# note: Collect the Parking to be processed
filterByBoolMask_2 = List.FilterByBoolMask(list=code_block_17.allP, mask=code_block_20)

# group: Control
getParameterValueByName_4 = Element.GetParameterValueByName(element=filterByBoolMask.in, parameterName=code_block_13.paramName)
code_block_21 = CodeBlock(v=getParameterValueByName_4, lookFor=code_block_13.paramValue) { v == lookFor; }
filterByBoolMask_3 = List.FilterByBoolMask(list=filterByBoolMask.in, mask=code_block_21)
code_block_22 = CodeBlock(v=code_block_13.paramValue, a=filterByBoolMask.in, b=filterByBoolMask_3.in) { v == ""?a:b; }

# group: Visualisation
code_block_23 = CodeBlock { catGM=Revit.Category.ByName("Generic Models"); catP=Revit.Category.ByName("Parking"); }
byCategoryAndDesignOption = archilab.Revit.Selection.Select.ByCategoryAndDesignOption(category=code_block_23.catGM, designOption=code_block_14)
# note: Collect the Generic Models to be processed
flatten = List.Flatten(list=byCategoryAndDesignOption)
# note: Collect the Parking to be processed
byCategoryAndDesignOption_2 = archilab.Revit.Selection.Select.ByCategoryAndDesignOption(category=code_block_23.catP, designOption=code_block_14)

# group: Control
getParameterValueByName_5 = Element.GetParameterValueByName(element=flatten, parameterName=code_block_13.paramName)
code_block_24 = CodeBlock(v=getParameterValueByName_5, lookFor=code_block_13.paramValue) { v == lookFor; }
filterByBoolMask_4 = List.FilterByBoolMask(list=flatten, mask=code_block_24)
code_block_25 = CodeBlock(v=code_block_13.paramValue, a=flatten, b=filterByBoolMask_4.in) { v == ""?a:b; }

code_block_26 = CodeBlock { "Unit Type"; "Garage"; true; }
code_block_27 = CodeBlock { "NIArea"; }
code_block_28 = CodeBlock { ""; }
code_block_29 = CodeBlock { "Family: ACG-4510-ResidentialUnit-"; }
code_block_30 = CodeBlock { "Unit Type"; }
code_block_31 = CodeBlock { "Tenure"; }
code_block_32 = CodeBlock { "NaN"; "0.000"; "."; }
code_block_33 = CodeBlock(input=code_block_15) { input==true?false:true; }
runMe = Custom[Tool.RunMe](Boolean=code_block_33, ThingToDo=code_block_12)  # package SteamNodes; Use Boolean to perform an action
code_block_34 = CodeBlock { "Use"; }
code_block_35 = CodeBlock { null; }
code_block_36 = CodeBlock { "Total:"; }
code_block_37 = CodeBlock { "GIArea"; }
code_block_38 = CodeBlock { 0; }
code_block_39 = CodeBlock { "."; }
code_block_40 = CodeBlock { "NaN"; "0.000"; "."; }

# group: Assing
code_block_41 = CodeBlock(n=code_block_14) { " (primary)"; ""; n-1; "Design Option"; }
name_2 = Element.Name(element=code_block_14)
# note: Design Option name pushed to the schedule element
replace = String.Replace(string=name_2, searchFor=code_block_41.out0, replaceWith=code_block_41.out1)

# group: Control
code_block_42 = CodeBlock(hasDO=isEmpty, a=replace) { hasDO==true?"":a; }

# group (continued): Assing
setParameterByName = Element.SetParameterByName(element=code_block_12, parameterName=code_block_41.out3, value=code_block_42)

code_block_43 = CodeBlock { "Site - Property Lines"; }
byName = Category.ByName(name=code_block_43)
all_elements_of_category = ElementsOfCategory(Category=byName)
code_block_44 = CodeBlock { "Area"; }
getParameterValueByName_6 = Element.GetParameterValueByName(element=all_elements_of_category, parameterName=code_block_44)
code_block_45 = CodeBlock(x=getParameterValueByName_6) { x[0]; }
byCategoryAndDesignOption_3 = archilab.Revit.Selection.Select.ByCategoryAndDesignOption(category=byName, designOption=code_block_14)
getParameterValueByName_7 = Element.GetParameterValueByName(element=byCategoryAndDesignOption_3, parameterName=code_block_44)
code_block_46 = CodeBlock(x=getParameterValueByName_7) { x[0]; }
code_block_47 = CodeBlock(x=code_block_16, a=code_block_45, b=code_block_46) { x?a:b; }
code_block_48 = CodeBlock { "Number parking spaces"; "Parking-Achieved"; "No. Required Parking Spaces"; "."; "Parking-Required"; }

# group: Control
getParameterValueByName_8 = Element.GetParameterValueByName(element=filterByBoolMask_2.in, parameterName=code_block_13.paramName)
code_block_49 = CodeBlock(v=getParameterValueByName_8, lookFor=code_block_13.paramValue) { v == lookFor; }
filterByBoolMask_5 = List.FilterByBoolMask(list=filterByBoolMask_2.in, mask=code_block_49)
code_block_50 = CodeBlock(v=code_block_13.paramValue, a=filterByBoolMask_2.in, b=filterByBoolMask_5.in) { v == ""?a:b; }

# group: Control
code_block_51 = CodeBlock(hasDO=isEmpty, a=code_block_22, b=code_block_25) { hasDO==true?a:b; }
code_block_52 = CodeBlock(hasDO=isEmpty, a=code_block_50, b=byCategoryAndDesignOption_2) { hasDO==true?a:b; }

type = archilab.Revit.Elements.Elements.Type(element=code_block_51)
getParameterValueByName_9 = Element.GetParameterValueByName(element=type, parameterName=code_block_26.out0)
# note: Filter Garages
string_from_object = FromObject(obj=getParameterValueByName_9)
contains = Orchid.Common.String.Contains(string=string_from_object, searchFor=code_block_26.out1, ignoreCase=code_block_26.out2)
filterByBoolMask_6 = List.FilterByBoolMask(list=code_block_51, mask=contains)
getParameterValueByName_10 = Element.GetParameterValueByName(element=filterByBoolMask_6.out, parameterName=code_block_27)
# note: Filter elements that have NIA
string_from_object_2 = FromObject(obj=getParameterValueByName_10)
eq = string_from_object_2 == code_block_28
filterByBoolMask_7 = List.FilterByBoolMask(list=filterByBoolMask_6.out, mask=eq)
watch = Watch(filterByBoolMask_7.out)
getFamily = FamilyInstance.GetFamily(familyInstance=watch)
string_from_object_3 = FromObject(obj=getFamily)
# note: Filter only residential units
startsWith = String.StartsWith(string=string_from_object_3, searchFor=code_block_29)
filterByBoolMask_8 = List.FilterByBoolMask(list=watch, mask=startsWith)

# group: Processing
code_block_53 = CodeBlock { "Tenure"; }
getParameterValueByName_11 = Element.GetParameterValueByName(element=filterByBoolMask_8.in, parameterName=code_block_53)
code_block_54 = CodeBlock { "Mark"; "0Mark"; "Afford"; "1Afford"; "Share"; "2Share"; "Ret"; "3Ret"; }
replace_2 = String.Replace(string=getParameterValueByName_11, searchFor=code_block_54.out0, replaceWith=code_block_54.out1, lacing=Longest)
replace_3 = String.Replace(string=replace_2, searchFor=code_block_54.out2, replaceWith=code_block_54.out3)
replace_4 = String.Replace(string=replace_3, searchFor=code_block_54.out4, replaceWith=code_block_54.out5)
replace_5 = String.Replace(string=replace_4, searchFor=code_block_54.out6, replaceWith=code_block_54.out7)

# group: Processing
sortByKey = List.SortByKey(list=filterByBoolMask_8.in, keys=replace_5)
# note: Group units by tenure:
# Marker
# Affordable
# Shared
# Retirement
# ....rest
groupByKey = List.GroupByKey(list=sortByKey.sortedList, keys=sortByKey.sortedKeys)
code_block_55 = CodeBlock { 0; 1; }
remove = String.Remove(string=groupByKey.uniqueKeys, startIndex=code_block_55.out0, count=code_block_55.out1)

flatten_2 = List.Flatten(list=groupByKey.groups)
get_type_parameter = Custom[Get Type Parameter](element=flatten_2, parameterName=code_block_30)  # package archi-lab.net; This node will retrieve a type parameter by its name.
sortByKey_2 = List.SortByKey(list=flatten_2, keys=get_type_parameter)
# note: Group units by type
get_type_parameter_2 = Custom[Get Type Parameter](element=sortByKey_2.sortedList, parameterName=code_block_30)
groupByKey_2 = List.GroupByKey(list=sortByKey_2.sortedList, keys=get_type_parameter_2)
list_count_unittypes = List.Count(list=groupByKey_2.uniqueKeys)
code_block_56 = CodeBlock(count=list_count_unittypes)
# ---------- code_block_56.designscript (12 lines) ----------
numUnits=1..count+1..1;

"Tenure1 Percent Row "+numUnits;
"Tenure1 no. Row "+numUnits;

"Tenure2 Percent Row "+numUnits;
"Tenure2 no. Row "+numUnits;

"Tenure3 Percent Row "+numUnits;
"Tenure3 no. Row "+numUnits;

"Unit Type "+numUnits;
# ----------------------------------------
getParameterValueByName_12 = Element.GetParameterValueByName(element=groupByKey_2.groups@@L2, parameterName=code_block_31)
code_block_57 = CodeBlock(x=remove) { x[0]; x[1]; x[2]; }
eq_2 = getParameterValueByName_12@@L2 == code_block_57.out0
list_counttrue_marketbytype = List.CountTrue(list=eq_2@@L2)
list_counttrue_market = List.CountTrue(list=eq_2)
percentagemarket = CodeBlock(count=list_counttrue_marketbytype, total=list_counttrue_market) { count/total*100; " "; }
round = Math.Round(number=percentagemarket.out0)
list_create_2 = List.Create(item0=round, item1=percentagemarket.out1)
flatten_3 = List.Flatten(list=list_create_2)
string_from_object_4 = FromObject(obj=flatten_3)
replace_6 = String.Replace(string=string_from_object_4, searchFor=code_block_32.out0, replaceWith=code_block_32.out1)
# note: Format the result - Market
split = String.Split(string=replace_6, separator0=code_block_32.out2)
transpose = List.Transpose(lists=split)
code_block_58 = CodeBlock(x=transpose) { x[0]; }
element_setparameterbyname = Element.SetParameterByName(element=code_block_12, parameterName=code_block_56.out1, value=code_block_58)  # "Element.SetParameterByName(Market Percentage)"
# note: Group unit elements by Use
get_type_parameter_3 = Custom[Get Type Parameter](element=watch, parameterName=code_block_34)
eq_3 = get_type_parameter_3 == code_block_35
filterByBoolMask_9 = List.FilterByBoolMask(list=watch, mask=eq_3)
get_type_parameter_4 = Custom[Get Type Parameter](element=filterByBoolMask_9.out, parameterName=code_block_34)
groupByKey_3 = List.GroupByKey(list=filterByBoolMask_9.out, keys=get_type_parameter_4)
list_create_3 = List.Create(item0=groupByKey_3.uniqueKeys, item1=code_block_36)
flatten_4 = List.Flatten(list=list_create_3)
list_count_countusages = List.Count(list=flatten_4)
code_block_59 = CodeBlock(count=list_count_countusages) { 1..count; 1; count+1..10; 0; count; }
code_block_60 = CodeBlock(number=code_block_59.out0) { "Usage NIA "+number; }
getParameterValueByName_13 = Element.GetParameterValueByName(element=groupByKey_3.groups@@L2, parameterName=code_block_37)
code_block_61 = CodeBlock(value=getParameterValueByName_13) { value==""; }
filterByBoolMask_10 = List.FilterByBoolMask(list=getParameterValueByName_13, mask=code_block_61)
sum = Math.Sum(values=filterByBoolMask_10.out@@L2)
# note: Usage schedule
round_2 = Math.Round(number=sum@@L2, digits=code_block_38)
sum_2 = Math.Sum(values=round_2)
list_create_4 = List.Create(item0=round_2, item1=sum_2)
flatten_5 = List.Flatten(list=list_create_4)
string_from_object_5 = FromObject(obj=flatten_5)
split_2 = String.Split(string=string_from_object_5, separator0=code_block_39)
transpose_2 = List.Transpose(lists=split_2)
code_block_62 = CodeBlock(x=transpose_2) { x[0]; }
# note: Use GIA (false=by unit /true=by floor )
# note: Units
setParameterByName_2 = Element.SetParameterByName(element=runMe, parameterName=code_block_60, value=code_block_62)
list_create_5 = List.Create(item0=list_counttrue_marketbytype, item1=list_counttrue_market)
flatten_6 = List.Flatten(list=list_create_5)
string_from_object_6 = FromObject(obj=flatten_6)
replace_7 = String.Replace(string=string_from_object_6, searchFor=code_block_40.out0, replaceWith=code_block_40.out1)
split_3 = String.Split(string=replace_7, separator0=code_block_40.out2)
transpose_3 = List.Transpose(lists=split_3)
code_block_63 = CodeBlock(x=transpose_3) { x[0]; }
element_setparameterbyname_2 = Element.SetParameterByName(element=code_block_12, parameterName=code_block_56.out2, value=code_block_63)  # "Element.SetParameterByName(Market Total Count)"
# note: Use Table - Number of Rows
code_block_64 = CodeBlock(count1=code_block_59.out0, count2=code_block_59.out2) { "Number of Rows - Usage"; "Usage Vis Row "+count1; "Usage Vis Row "+count2; }
setParameterByName_3 = Element.SetParameterByName(element=code_block_12, parameterName=code_block_64.out0, value=code_block_59.count)
setParameterByName_4 = Element.SetParameterByName(element=code_block_12, parameterName=code_block_64.out1, value=code_block_59.out1)
setParameterByName_5 = Element.SetParameterByName(element=code_block_12, parameterName=code_block_64.out2, value=code_block_59.out3)
# note: Unit Types Table - Number of Rows
code_block_65 = CodeBlock(count=list_count_unittypes)
# ---------- code_block_65.designscript (9 lines) ----------
visible=1..count+1;
1;
notVisible=count+2..15;
0;
count+1;

"Number of Rows - Unit Types";
"Vis Row "+visible;
"Vis Row "+notVisible;
# ----------------------------------------
setParameterByName_6 = Element.SetParameterByName(element=code_block_12, parameterName=code_block_65.out7, value=code_block_65.out3)
setParameterByName_7 = Element.SetParameterByName(element=code_block_12, parameterName=code_block_65.out6, value=code_block_65.out1)
setParameterByName_8 = Element.SetParameterByName(element=code_block_12, parameterName=code_block_65.out5, value=code_block_65.out4)

# group: Processing
count = List.Count(list=groupByKey.groups@L2)
sum_3 = Math.Sum(values=count)

# group: Assing
code_block_66 = CodeBlock { "."; "Units Per Ha"; }
code_block_67 = CodeBlock(numberunits=sum_3, plotsize=code_block_47) { numberunits/(plotsize/10000); }
string_from_object_7 = FromObject(obj=code_block_67)
split_4 = String.Split(string=string_from_object_7, separator0=code_block_66.out0)
transpose_4 = List.Transpose(lists=split_4)
code_block_68 = CodeBlock(x=transpose_4) { x[0]; }
setParameterByName_9 = Element.SetParameterByName(element=code_block_12, parameterName=code_block_66.out1, value=code_block_68)

# group: Filtering
code_block_69 = CodeBlock(e=code_block_52) { tp=e.Type; tp.Name; "Car"; "Bike"; }
contains_2 = String.Contains(string=code_block_69.out1, searchFor=code_block_69.out2)
filterByBoolMask_11 = List.FilterByBoolMask(list=code_block_52, mask=contains_2)
contains_3 = String.Contains(string=code_block_69.out1, searchFor=code_block_69.out3)
filterByBoolMask_12 = List.FilterByBoolMask(list=code_block_52, mask=contains_3)

# group: Processing - car parking achieved
getParameterValueByName_14 = Element.GetParameterValueByName(element=filterByBoolMask_11.in, parameterName=code_block_48.out0)
code_block_70 = CodeBlock(e=filterByBoolMask_11.in) { e.Type; }
getParameterValueByName_15 = Element.GetParameterValueByName(element=code_block_70, parameterName=code_block_48.out0)
code_block_71 = CodeBlock(value=getParameterValueByName_14, a=getParameterValueByName_15, b=getParameterValueByName_14) { value==""?a:b; }
code_block_72 = CodeBlock(value=code_block_71) { value>0; }
filterByBoolMask_13 = List.FilterByBoolMask(list=code_block_71, mask=code_block_72)
sum_4 = Math.Sum(values=filterByBoolMask_13.in)
string_from_object_8 = FromObject(obj=sum_4)
split_5 = String.Split(string=string_from_object_8, separator0=code_block_48.out3)
transpose_5 = List.Transpose(lists=split_5)
code_block_73 = CodeBlock(x=transpose_5) { x[0]; }
setParameterByName_10 = Element.SetParameterByName(element=code_block_12, parameterName=code_block_48.out1, value=code_block_73)

# group: Processing - car parking spaces required
type_2 = archilab.Revit.Elements.Elements.Type(element=watch)
getParameterValueByName_16 = Element.GetParameterValueByName(element=type_2, parameterName=code_block_48.out2)
code_block_74 = CodeBlock { ""; }
eq_4 = getParameterValueByName_16 == code_block_74
filterByBoolMask_14 = List.FilterByBoolMask(list=getParameterValueByName_16, mask=eq_4)
sum_5 = Math.Sum(values=filterByBoolMask_14.out)
string_from_object_9 = FromObject(obj=sum_5)
split_6 = String.Split(string=string_from_object_9, separator0=code_block_48.out3)
transpose_6 = List.Transpose(lists=split_6)
code_block_75 = CodeBlock(x=transpose_6) { x[0]; }
setParameterByName_11 = Element.SetParameterByName(element=code_block_12, parameterName=code_block_48.out4, value=code_block_75)

# group: Processing
code_block_76 = CodeBlock { Revit.Elements.Category.ByName("Floors"); }
byCategoryAndDesignOption_4 = archilab.Revit.Selection.Select.ByCategoryAndDesignOption(category=code_block_76, designOption=code_block_14)

# group: Processing
code_block_77 = CodeBlock { "Phase Created"; catF=Revit.Category.ByName("Floors"); allF=ElementQueries.OfCategory(catF); }
getParameterValueByName_17 = Element.GetParameterValueByName(element=code_block_77.allF, parameterName=code_block_77.out0)
code_block_78 = CodeBlock(ph=getParameterValueByName_17) { ph.Name=="New Construction"; }
# note: Collect the Foors to be processed
filterByBoolMask_15 = List.FilterByBoolMask(list=code_block_77.allF, mask=code_block_78)

# group: Visualisation
code_block_79 = CodeBlock(lstA=byCategoryAndDesignOption_4, lstB=filterByBoolMask_15.in) { DSCore.List.Flatten(lstA); DSCore.List.Flatten(lstB); }

# group: Control
code_block_80 = CodeBlock(hasDO=isEmpty, a=code_block_79.out1, b=code_block_79.out0) { hasDO==true?a:b; }

# group: Control
getParameterValueByName_18 = Element.GetParameterValueByName(element=code_block_80, parameterName=code_block_13.paramName)
code_block_81 = CodeBlock(v=getParameterValueByName_18, lookFor=code_block_13.paramValue) { v == lookFor; }
filterByBoolMask_16 = List.FilterByBoolMask(list=code_block_80, mask=code_block_81)
code_block_82 = CodeBlock(v=code_block_13.paramValue, a=code_block_80, b=filterByBoolMask_16.in) { v == ""?a:b; }

code_block_83 = CodeBlock { "Comments"; "GIA"; }
getParameterValueByName_19 = Element.GetParameterValueByName(element=code_block_82, parameterName=code_block_83.out0)
code_block_84 = CodeBlock { "GEA"; }
contains_4 = String.Contains(string=getParameterValueByName_19, searchFor=code_block_84)
filterByBoolMask_17 = List.FilterByBoolMask(list=code_block_82, mask=contains_4)
code_block_85 = CodeBlock { "Area"; }
getParameterValueByName_20 = Element.GetParameterValueByName(element=filterByBoolMask_17.in, parameterName=code_block_85)
sum_6 = Math.Sum(values=getParameterValueByName_20)
round_3 = Math.Round(number=sum_6)
string_from_object_10 = FromObject(obj=round_3)
code_block_86 = CodeBlock { "."; }
split_7 = String.Split(string=string_from_object_10, separator0=code_block_86)
transpose_7 = List.Transpose(lists=split_7)
code_block_87 = CodeBlock(x=transpose_7) { x[0]; }
code_block_88 = CodeBlock(number=code_block_59.out0) { "Usage "+number; }
# note: Use name (false=by unit /true=by floor )
setParameterByName_12 = Element.SetParameterByName(element=runMe, parameterName=code_block_88, value=flatten_4)
code_block_89 = CodeBlock { "NIArea"; }
getParameterValueByName_21 = Element.GetParameterValueByName(element=groupByKey.groups@@L2, parameterName=code_block_89)
math_sum_all_tenures = Math.Sum(values=getParameterValueByName_21)
string_from_object_11 = FromObject(obj=math_sum_all_tenures)
code_block_90 = CodeBlock(x=string_from_object_11) { x=="null"; 0; }
code_block_91 = CodeBlock(x=code_block_90.out0, a=code_block_90.out1, b=math_sum_all_tenures) { x?a:b; }
# note: Tenure schedule
sum_7 = Math.Sum(values=code_block_91)
code_block_92 = CodeBlock(numTenure=code_block_91, numTotal=sum_7) { numTenure/numTotal*100; }
round_4 = Math.Round(number=code_block_92)

# group: Control
string_from_object_12 = FromObject(object=round_4)
code_block_93 = CodeBlock { "."; 0; }
split_8 = String.Split(string=string_from_object_12, separator0=code_block_93.out0)
getItemAtIndex = List.GetItemAtIndex(list=split_8@L2, index=code_block_93.out1)

# group: Processing
code_block_94 = CodeBlock()
# ---------- code_block_94.designscript (5 lines) ----------
[
"Tenure1 - Mix",
"Tenure2 - Mix",
"Tenure3 - Mix"
];
# ----------------------------------------
setParameterByName_13 = Element.SetParameterByName(element=code_block_12, parameterName=code_block_94, value=getItemAtIndex)

eq_5 = getParameterValueByName_12@@L2 == code_block_57.out1
list_counttrue_marketbytype_2 = List.CountTrue(list=eq_5@@L2)
list_counttrue_market_2 = List.CountTrue(list=eq_5)
percentagemarket_2 = CodeBlock(count=list_counttrue_marketbytype_2, total=list_counttrue_market_2) { count/total*100; " "; }
round_5 = Math.Round(number=percentagemarket_2.out0)
list_create_6 = List.Create(item0=round_5, item1=percentagemarket_2.out1)
flatten_7 = List.Flatten(list=list_create_6)
string_from_object_13 = FromObject(obj=flatten_7)
code_block_95 = CodeBlock { "NaN"; "0.000"; "."; }
replace_8 = String.Replace(string=string_from_object_13, searchFor=code_block_95.out0, replaceWith=code_block_95.out1)
# note: Format the result - Affordable
split_9 = String.Split(string=replace_8, separator0=code_block_95.out2)
transpose_8 = List.Transpose(lists=split_9)
code_block_96 = CodeBlock(x=transpose_8) { x[0]; }
element_setparameterbyname_3 = Element.SetParameterByName(element=code_block_12, parameterName=code_block_56.out3, value=code_block_96)  # "Element.SetParameterByName(Market Percentage)"
list_create_7 = List.Create(item0=list_counttrue_marketbytype_2, item1=list_counttrue_market_2)
flatten_8 = List.Flatten(list=list_create_7)
string_from_object_14 = FromObject(obj=flatten_8)
code_block_97 = CodeBlock { "NaN"; "0.000"; "."; }
replace_9 = String.Replace(string=string_from_object_14, searchFor=code_block_97.out0, replaceWith=code_block_97.out1)
split_10 = String.Split(string=replace_9, separator0=code_block_97.out2)
transpose_9 = List.Transpose(lists=split_10)
code_block_98 = CodeBlock(x=transpose_9) { x[0]; }
element_setparameterbyname_4 = Element.SetParameterByName(element=code_block_12, parameterName=code_block_56.out4, value=code_block_98)  # "Element.SetParameterByName(Market Total Count)"
eq_6 = getParameterValueByName_12@@L2 == code_block_57.out2
list_counttrue_marketbytype_3 = List.CountTrue(list=eq_6@@L2)
list_counttrue_market_3 = List.CountTrue(list=eq_6)
percentagemarket_3 = CodeBlock(count=list_counttrue_marketbytype_3, total=list_counttrue_market_3) { count/total*100; " "; }
round_6 = Math.Round(number=percentagemarket_3.out0)
list_create_8 = List.Create(item0=round_6, item1=percentagemarket_3.out1)
flatten_9 = List.Flatten(list=list_create_8)
string_from_object_15 = FromObject(obj=flatten_9)
code_block_99 = CodeBlock { "NaN"; "0.000"; "."; }
replace_10 = String.Replace(string=string_from_object_15, searchFor=code_block_99.out0, replaceWith=code_block_99.out1)
# note: Format the result - S/O
split_11 = String.Split(string=replace_10, separator0=code_block_99.out2)
transpose_10 = List.Transpose(lists=split_11)
code_block_100 = CodeBlock(x=transpose_10) { x[0]; }
element_setparameterbyname_5 = Element.SetParameterByName(element=code_block_12, parameterName=code_block_56.out5, value=code_block_100)  # "Element.SetParameterByName(Market Percentage)"
list_create_9 = List.Create(item0=list_counttrue_marketbytype_3, item1=list_counttrue_market_3)
flatten_10 = List.Flatten(list=list_create_9)
string_from_object_16 = FromObject(obj=flatten_10)
code_block_101 = CodeBlock { "NaN"; "0.000"; "."; }
replace_11 = String.Replace(string=string_from_object_16, searchFor=code_block_101.out0, replaceWith=code_block_101.out1)
split_12 = String.Split(string=replace_11, separator0=code_block_101.out2)
transpose_11 = List.Transpose(lists=split_12)
code_block_102 = CodeBlock(x=transpose_11) { x[0]; }
element_setparameterbyname_6 = Element.SetParameterByName(element=code_block_12, parameterName=code_block_56.out6, value=code_block_102)  # "Element.SetParameterByName(Market Total Count)"
code_block_103 = CodeBlock { "Total:"; }
list_create_10 = List.Create(item0=groupByKey_2.uniqueKeys, item1=code_block_103)
flatten_11 = List.Flatten(list=list_create_10)
element_setparameterbyname_7 = Element.SetParameterByName(element=code_block_12, parameterName=code_block_56.out7, value=flatten_11)  # "Element.SetParameterByName(Market Total Count)"

# group: Assing
code_block_104 = CodeBlock { Revit.Elements.Category.ByName("Project Information"); "Project Name"; }
all_elements_of_category_2 = ElementsOfCategory(Category=code_block_104.out0)
# note: Collect project name
getParameterValueByName_22 = Element.GetParameterValueByName(element=all_elements_of_category_2, parameterName=code_block_104.out1)
setParameterByName_14 = Element.SetParameterByName(element=code_block_12, parameterName=code_block_104.out1, value=getParameterValueByName_22)

watch_2 = Watch(code_block_65.out6)
watch_3 = Watch(code_block_65.out7)
watch_4 = Watch(code_block_60)
watch_5 = Watch(code_block_62)
watch_6 = Watch()  # unwired: arg0
contains_5 = String.Contains(string=getParameterValueByName_19, searchFor=code_block_83.out1)
filterByBoolMask_18 = List.FilterByBoolMask(list=code_block_82, mask=contains_5)
getParameterValueByName_23 = Element.GetParameterValueByName(element=filterByBoolMask_18.in, parameterName=code_block_83.out0)
groupByKey_4 = List.GroupByKey(list=filterByBoolMask_18.in, keys=getParameterValueByName_23)
code_block_105 = CodeBlock { "Area"; }
getParameterValueByName_24 = Element.GetParameterValueByName(element=groupByKey_4.groups@@L2, parameterName=code_block_105)
sum_8 = Math.Sum(values=getParameterValueByName_24)
round_7 = Math.Round(number=sum_8)
sum_9 = Math.Sum(values=round_7)
list_create_11 = List.Create(item0=round_7, item1=sum_9)
code_block_106 = CodeBlock(lst=list_create_11) { DSCore.List.Flatten(lst); }
string_from_object_17 = FromObject(obj=code_block_106)
code_block_107 = CodeBlock { "."; }
split_13 = String.Split(string=string_from_object_17, separator0=code_block_107)
transpose_12 = List.Transpose(lists=split_13)
code_block_108 = CodeBlock(x=transpose_12) { x[0]; }
watch_7 = Watch(code_block_108)
runMe_2 = Custom[Tool.RunMe](Boolean=code_block_15, ThingToDo=code_block_12)
# note: Floors
setParameterByName_15 = Element.SetParameterByName(element=runMe_2, parameterName=code_block_60, value=code_block_108)
code_block_109 = CodeBlock { " "; }
split_14 = String.Split(string=groupByKey_4.uniqueKeys, separator0=code_block_109)
transpose_13 = List.Transpose(lists=split_14)
code_block_110 = CodeBlock(x=transpose_13) { x[1]; "Total :"; }
list_create_12 = List.Create(item0=code_block_110.out0, item1=code_block_110.out1)
code_block_111 = CodeBlock(lst=list_create_12) { DSCore.List.Flatten(lst); }
setParameterByName_16 = Element.SetParameterByName(element=runMe_2, parameterName=code_block_88, value=code_block_111)

# group: Usage
code_block_112 = CodeBlock { "Schedule Residential"; }
acg_script_usage = Custom[ACG Script Usage](scriptName=code_block_112)  # Adds an entry to Excel document every time a script is run. The document is located in S:\Dynamo\05-UsageStats

code_block_113 = CodeBlock { "Number parking spaces"; "Bikes-Achieved"; "No. Required Bike Racks"; "."; "Bikes-Required"; }

# group: Processing
getParameterValueByName_25 = Element.GetParameterValueByName(element=filterByBoolMask_12.in, parameterName=code_block_113.out0)
getParameterValueByName_26 = Element.GetParameterValueByName(element=filterByBoolMask_12.in, parameterName=code_block_48.out0)
code_block_114 = CodeBlock(value=getParameterValueByName_25, a=getParameterValueByName_26, b=getParameterValueByName_25) { value==""?a:b; }
code_block_115 = CodeBlock(value=code_block_114) { value>0; }
filterByBoolMask_19 = List.FilterByBoolMask(list=code_block_114, mask=code_block_115)
sum_10 = Math.Sum(values=filterByBoolMask_19.in)
string_from_object_18 = FromObject(obj=sum_10)
split_15 = String.Split(string=string_from_object_18, separator0=code_block_113.out3)
transpose_14 = List.Transpose(lists=split_15)
code_block_116 = CodeBlock(x=transpose_14) { x[0]; }
setParameterByName_17 = Element.SetParameterByName(element=code_block_12, parameterName=code_block_113.out1, value=code_block_116)
code_block_117 = CodeBlock(e=filterByBoolMask_11.in) { e.Type; }

# group: Processing - bike racks required
type_3 = archilab.Revit.Elements.Elements.Type(element=watch)
getParameterValueByName_27 = Element.GetParameterValueByName(element=type_3, parameterName=code_block_113.out2)
code_block_118 = CodeBlock { ""; }
eq_7 = getParameterValueByName_27 == code_block_118
filterByBoolMask_20 = List.FilterByBoolMask(list=getParameterValueByName_27, mask=eq_7)
sum_11 = Math.Sum(values=filterByBoolMask_20.out)
string_from_object_19 = FromObject(obj=sum_11)
split_16 = String.Split(string=string_from_object_19, separator0=code_block_113.out3)
transpose_15 = List.Transpose(lists=split_16)
code_block_119 = CodeBlock(x=transpose_15) { x[0]; }
setParameterByName_18 = Element.SetParameterByName(element=code_block_12, parameterName=code_block_113.out4, value=code_block_119)

# group: Visualisation
code_block_120 = CodeBlock { numb=1..3; "Tenure"+numb+" - Name"; }
# note: Assigh tenure names
element_setparameterbyname_8 = Element.SetParameterByName(element=code_block_12, parameterName=code_block_120.out1, value=remove)  # "Element.SetParameterByName(Market Percentage)"

# group: Control
code_block_121 = CodeBlock { "Resi"; }
contains_6 = String.Contains(string=groupByKey_4.uniqueKeys, searchFor=code_block_121)
# note: GET ONLY RESI GIA
filterByBoolMask_21 = List.FilterByBoolMask(list=sum_8, mask=contains_6)
code_block_122 = CodeBlock { 0; }
insert = List.Insert(list=filterByBoolMask_21.in, element=code_block_122, index=code_block_122)
# note: output 0 in there are no floors and the list is empty
reverse = List.Reverse(list=insert)
code_block_123 = CodeBlock(x=reverse) { x[0]; }

# group: Control
flatten_12 = List.Flatten(list=round_2)
code_block_124 = CodeBlock { "Resi"; }
contains_7 = String.Contains(string=groupByKey_3.uniqueKeys, searchFor=code_block_124)
# note: GET ONLY RESI GIA
filterByBoolMask_22 = List.FilterByBoolMask(list=flatten_12, mask=contains_7)

# note: Combined GIA (false=by unit /true=by floor )
code_block_125 = CodeBlock(input=code_block_15, a=code_block_123, b=filterByBoolMask_22.in) { input==true?a:b; }

# group: Processing
sum_12 = Math.Sum(values=code_block_91)
code_block_126 = CodeBlock(NIA=sum_12, GIA=code_block_125) { NIA/GIA; }
code_block_efficiency = CodeBlock { 3; "00"; }
round_8 = Math.Round(number=code_block_126, digits=code_block_efficiency.out0)
string_from_object_20 = FromObject(obj=round_8)
split_17 = String.Split(string=string_from_object_20, separator0=code_block_efficiency.out1)
code_block_127 = CodeBlock(lst=split_17) { DSCore.List.Flatten(lst); }
code_block_128 = CodeBlock(x=code_block_127) { "Net To Gross Ratio"; x[0]; }
setParameterByName_19 = Element.SetParameterByName(element=code_block_12, parameterName=code_block_128.out0, value=code_block_128.out1)

# group: Control
string_from_object_21 = FromObject(object=count)
code_block_129 = CodeBlock { "."; 0; }
split_18 = String.Split(string=string_from_object_21, separator0=code_block_129.out0)
getItemAtIndex_2 = List.GetItemAtIndex(list=split_18@L2, index=code_block_129.out1)

# group: Control
string_from_object_22 = FromObject(object=sum_3)
code_block_130 = CodeBlock { "."; }
split_19 = String.Split(string=string_from_object_22, separator0=code_block_130)
code_block_131 = CodeBlock(x=split_19) { x[0]; }

# group: Processing
code_block_132 = CodeBlock()
# ---------- code_block_132.designscript (6 lines) ----------
[
"Tenure1 - Unit no.",
"Tenure2 - Unit no.",
"Tenure3 - Unit no."
];
"Tenure Total - Unit no.";
# ----------------------------------------
setParameterByName_20 = Element.SetParameterByName(element=code_block_12, parameterName=code_block_132.out0, value=getItemAtIndex_2)
setParameterByName_21 = Element.SetParameterByName(element=code_block_12, parameterName=code_block_132.out1, value=code_block_131)

# group: Control
string_from_object_23 = FromObject(object=code_block_91)
code_block_133 = CodeBlock { "."; 0; }
split_20 = String.Split(string=string_from_object_23, separator0=code_block_133.out0)
getItemAtIndex_3 = List.GetItemAtIndex(list=split_20@L2, index=code_block_133.out1)

round_9 = Math.Round(number=code_block_91)
sum_13 = Math.Sum(values=round_9)

# group: Control
string_from_object_24 = FromObject(object=sum_13)
code_block_134 = CodeBlock { "."; }
split_21 = String.Split(string=string_from_object_24, separator0=code_block_134)
code_block_135 = CodeBlock(x=split_21) { x[0]; }

# group: Processing
code_block_136 = CodeBlock()
# ---------- code_block_136.designscript (6 lines) ----------
[
"Tenure1 - NIA",
"Tenure2 - NIA",
"Tenure3 - NIA"
];
"Tenure Total - NIA";
# ----------------------------------------
setParameterByName_22 = Element.SetParameterByName(element=code_block_12, parameterName=code_block_136.out0, value=getItemAtIndex_3)
setParameterByName_23 = Element.SetParameterByName(element=code_block_12, parameterName=code_block_136.out1, value=code_block_135)
