# Dynamo graph Annotations At Wall Intersections.dyn "Annotation - Place At Wall Intersection_py" (Dynamo 2.12.1.8246)
# packages: Data-Shapes 2021.2.92

file_path = Filename("..\ACG_logo.png")
file_from_path = FileObject(path=file_path)
readFromFile = Image.ReadFromFile(file=file_from_path)

# group: Input
code_block = CodeBlock { "Note:"; }
string = StringInput("This tool will place Generic Annotations of a given type to the intersection point between external and party walls.")
textnote_data = Custom[TextNote Data](Title=code_block, TextNote=string)  # package Data-Shapes; Create Data for TextNote input in UI.MultipleInputForm ++ . Check out www.data-shapes.net for more informations

# group: Input
code_block_2 = CodeBlock { "External wall code/key word (as part of type name):"; "Ext"; }
textbox_data = Custom[TextBox Data](InputName=code_block_2.out0, DefaultText=code_block_2.out1)  # package Data-Shapes; Create Data for TextBox input in UI.MultipleInputForm ++ . Check out www.data-shapes.net for more informations
code_block_3 = CodeBlock { "Party wall code/key word (as part of type name):"; "Party"; }
textbox_data_2 = Custom[TextBox Data](InputName=code_block_3.out0, DefaultText=code_block_3.out1)
code_block_4 = CodeBlock { "Generic annotation type:"; }
python_script = Python()  # IronPython2
# ---------- python_script.python (47 lines) ----------
# Load the Python Standard and DesignScript Libraries
import clr
import sys
import os.path
from datetime import datetime
from System import Environment
sys.path.append('C:\Program Files (x86)\IronPython 2.7\Lib')
import System
from System import Array
from System.Collections.Generic import *
clr.AddReference('ProtoGeometry')
from Autodesk.DesignScript.Geometry import *
clr.AddReference("RevitNodes")
import Revit
clr.ImportExtensions(Revit.Elements)
clr.ImportExtensions(Revit.GeometryConversion)
clr.AddReference("RevitServices")
import RevitServices
from RevitServices.Persistence import DocumentManager 
from RevitServices.Transactions import TransactionManager 

clr.AddReference("RevitAPI")
clr.AddReference("RevitAPIUI")

import Autodesk 
from Autodesk.Revit.DB import *
from Autodesk.Revit.UI import *
import time

doc = DocumentManager.Instance.CurrentDBDocument
uiapp = DocumentManager.Instance.CurrentUIApplication 
app = uiapp.Application 
uidoc = uiapp.ActiveUIDocument

keys = []
values = []


col = FilteredElementCollector(doc).OfClass(FamilySymbol).ToElements()
for i in col:
	if i.Category.Name == 'Generic Annotations':
		famName = i.FamilyName
		typeName = i.get_Parameter(BuiltInParameter.SYMBOL_NAME_PARAM).AsString()
		keys.append(famName +  ' : ' +typeName)
		values.append(i.Id)
		
OUT = keys, values
# ----------------------------------------
code_block_5 = CodeBlock(x=python_script) { keys = x[0]; values = x[1]; }
dropdown_data = Custom[DropDown Data](InputName=code_block_4, Keys=code_block_5.keys, Values=code_block_5.values)  # package Data-Shapes; Create data for DropDown input in UI.MultiInputForm ++ . Check out www.data-shapes.net for more infos.

# group: Input
code_block_6 = CodeBlock { true; "Run"; "Cancel"; false; 800; 400; }
list_create = List.Create(item0=textnote_data, item1=textbox_data, item2=textbox_data_2, item3=dropdown_data)
ui_multipleinputform = Custom[UI.MultipleInputForm ++](Logo_optional=readFromFile, ButtonText_optional=code_block_6.out1, Inputs=list_create, Toggle=code_block_6.out0, CancelButtonText_optional=code_block_6.out2, Width_optional=code_block_6.out4, LabelWidth_optional=code_block_6.out5)  # package Data-Shapes; Create a form with multiple inputs. see www.data-shapes.net for tutorials and infos!
code_block_7 = CodeBlock(x=ui_multipleinputform.User_Inputs) { extCode = x[0]; partyCode = x[1]; annoId = x[2]; }

# group: Visualisation
python_script_2 = Python(IN[0]=code_block_7.extCode, IN[1]=code_block_7.partyCode)  # IronPython2
# ---------- python_script_2.python (55 lines) ----------
# Load the Python Standard and DesignScript Libraries
import clr
import sys
import os.path
from datetime import datetime
from System import Environment
sys.path.append('C:\Program Files (x86)\IronPython 2.7\Lib')
import System
from System import Array
from System.Collections.Generic import *
clr.AddReference('ProtoGeometry')
from Autodesk.DesignScript.Geometry import *
clr.AddReference("RevitNodes")
import Revit
clr.ImportExtensions(Revit.Elements)
clr.ImportExtensions(Revit.GeometryConversion)
clr.AddReference("RevitServices")
import RevitServices
from RevitServices.Persistence import DocumentManager 
from RevitServices.Transactions import TransactionManager 

clr.AddReference("RevitAPI")
clr.AddReference("RevitAPIUI")

import Autodesk 
from Autodesk.Revit.DB import *
from Autodesk.Revit.UI import *
import time

doc = DocumentManager.Instance.CurrentDBDocument
uiapp = DocumentManager.Instance.CurrentUIApplication 
app = uiapp.Application 
uidoc = uiapp.ActiveUIDocument

codeEXT = IN[0]
codePRTY = IN[1]

ext = []
party = []
temp = []


col = FilteredElementCollector(doc, doc.ActiveView.Id).OfCategory(BuiltInCategory.OST_Walls).WhereElementIsNotElementType().ToElements()

for w in col:
	typeName = w.WallType.get_Parameter(BuiltInParameter.SYMBOL_NAME_PARAM).AsString()
	temp.append(typeName)
	if codePRTY in typeName:
		party.append(w)
	elif codeEXT in typeName:
		ext.append(w)
	else:
		continue
		
OUT = party, ext, temp
# ----------------------------------------
# note: Get the intersection points between walls with 'Ext' in their type name and walls with 'Party' in their type name
code_block_8 = CodeBlock(wall=python_script_2) { wall[0].GetLocation(); }
code_block_9 = CodeBlock(wall=python_script_2) { wall[1].GetLocation(); }
python_script_3 = Python(IN[0]=code_block_8, IN[1]=code_block_9, IN[2]=code_block_7.annoId)  # IronPython2
# ---------- python_script_3.python (69 lines) ----------
# Load the Python Standard and DesignScript Libraries
import clr
import sys
import os.path
from datetime import datetime
from System import Environment
sys.path.append('C:\Program Files (x86)\IronPython 2.7\Lib')
import System
from System import Array
from System.Collections.Generic import *
clr.AddReference('ProtoGeometry')
from Autodesk.DesignScript.Geometry import *
clr.AddReference("RevitNodes")
import Revit
clr.ImportExtensions(Revit.Elements)
clr.ImportExtensions(Revit.GeometryConversion)
clr.AddReference("RevitServices")
import RevitServices
from RevitServices.Persistence import DocumentManager 
from RevitServices.Transactions import TransactionManager 

clr.AddReference("RevitAPI")
clr.AddReference("RevitAPIUI")

import Autodesk 
from Autodesk.Revit.DB import *
from Autodesk.Revit.UI import *
import time

doc = DocumentManager.Instance.CurrentDBDocument
uiapp = DocumentManager.Instance.CurrentUIApplication 
app = uiapp.Application 
uidoc = uiapp.ActiveUIDocument

points = []
output = []

def get_intersection(line1, line2):
	try:
		results = clr.Reference[IntersectionResultArray]()		
		result = line1.Intersect(line2)[0]
		return result
	except:
		result = 'no intersection'
		
pWalls = IN[0]
extWalls = IN[1]
familyId = IN[2]

temp = []

for pWall in pWalls:
	for extWall in extWalls:
		points.append(get_intersection(pWall, extWall))

count = 0
fam = doc.GetElement(familyId)
for i in points:
	if i != None:
		temp.append(i)
		TransactionManager.Instance.EnsureInTransaction(doc)
		
		loc = i.ToXyz()
		doc.Create.NewFamilyInstance(loc, fam, doc.ActiveView)
		count += 1
		
		TransactionManager.Instance.TransactionTaskDone()
		
OUT = temp, str(count) + ' families placed in the active view'
# ----------------------------------------

# group: Control
code_block_10 = CodeBlock { "Annotation - Place At Wall Intersection"; }
acg_script_usage = Custom[ACG Script Usage](scriptName=code_block_10)  # Adds an entry to Excel document every time a script is run. The document is located in S:\Dynamo\05-UsageStats

code_block_11 = CodeBlock(c=code_block_7.partyCode) { c; }
code_block_12 = CodeBlock(c=code_block_7.extCode) { c; }
