# Dynamo graph Create Floors From Rooms_d.dyn (Dynamo 2.17.1.4055)
# packages: Topologic 1.4.0, archi-lab.net 2021.25.2521, Data-Shapes 2021.2.92, SteamNodes 1.2.3

file_path = Filename("..\ACG_logo.png")
file_from_path = FileObject(path=file_path)
readFromFile = Image.ReadFromFile(file=file_from_path)
code_block = CodeBlock { "Cancel"; true; "Run"; }
code_block_2 = CodeBlock { "Select Rooms"; catRooms=Revit.Elements.Category.ByName("Rooms"); ElementQueries.OfCategory(catRooms); "Level"; }
code_block_3 = CodeBlock()
# ---------- code_block_3.designscript (2 lines) ----------
"Make sure the Design Option which \n
contains the required rooms is active.";
# ----------------------------------------
ui_textnote_data = Custom[UI.TextNote Data](TextNote=code_block_3)  # package Data-Shapes; Create Data for TextNote input in UI.MultipleInputForm ++ . Check out www.data-shapes.net for more informations
code_block_4 = CodeBlock { "Select Level"; catLevels=Revit.Elements.Category.ByName("Levels"); ElementQueries.OfCategory(catLevels); }
name = Element.Name(element=code_block_4.out2)
ui_dropdown_data = Custom[UI.DropDown Data](InputName=code_block_4.out0, Keys=name, Values=code_block_4.out2)  # package Data-Shapes; Create data for DropDown input in UI.MultiInputForm ++ . Check out www.data-shapes.net for more infos.
code_block_5 = CodeBlock()
# ---------- code_block_5.designscript (7 lines) ----------
"Select Floor Type";


catFloors=Revit.Elements.Category.ByName("Floors");
ElementQueries.OfCategory(catFloors);

false;
# ----------------------------------------
type = archilab.Revit.Elements.Elements.Type(element=code_block_5.out2)
uniqueItems = List.UniqueItems(list=type)
name_2 = Element.Name(element=uniqueItems)
ui_dropdown_data_2 = Custom[UI.DropDown Data](InputName=code_block_5.out0, Keys=name_2, Values=uniqueItems, Sorted_optional=code_block_5.out3)
get_design_options = Custom[Get Design Options]()  # package archi-lab.net; Queries all of the design options currently in the project.
id = Element.Id(element=get_design_options.designOptions)
code_block_6 = CodeBlock(name=get_design_options.names, idEl=id) { name+" / "+idEl; "Select Design Option"; false; }
ui_dropdown_data_3 = Custom[UI.DropDown Data](InputName=code_block_6.out1, Keys=code_block_6.out0, Values=get_design_options.designOptions, Sorted_optional=code_block_6.out2)
list_create = List.Create(item0=ui_textnote_data, item1=ui_dropdown_data, item2=ui_dropdown_data_2, item3=ui_dropdown_data_3)
ui_multipleinputform = Custom[UI.MultipleInputForm ++](Logo_optional=readFromFile, ButtonText_optional=code_block.out2, Inputs=list_create, Toggle=code_block.out1, CancelButtonText_optional=code_block.out0)  # package Data-Shapes; Create a form with multiple inputs. see www.data-shapes.net for tutorials and infos!
code_block_7 = CodeBlock(level=ui_multipleinputform.User_Inputs, floorType=ui_multipleinputform.User_Inputs, designOption=ui_multipleinputform.User_Inputs) { level[0]; floorType[1]; designOption[2]; }

# group: Delete existng Floors
code_block_8 = CodeBlock { catFloors=Revit.Elements.Category.ByName("Floors"); }
byCategoryAndDesignOption = archilab.Revit.Selection.Select.ByCategoryAndDesignOption(category=code_block_8, designOption=code_block_7.out2)
type_2 = archilab.Revit.Elements.Elements.Type(element=byCategoryAndDesignOption)
name_3 = Element.Name(element=type_2)
name_4 = Element.Name(element=code_block_7.out1)
eq = name_3 == name_4
filterByBoolMask = List.FilterByBoolMask(list=byCategoryAndDesignOption, mask=eq)
code_block_9 = CodeBlock { "Level"; }
getParameterValueByName = Element.GetParameterValueByName(element=filterByBoolMask.in, parameterName=code_block_9)
name_5 = Level.Name(level=getParameterValueByName)
name_6 = Level.Name(level=code_block_7.out0)
eq_2 = name_5 == name_6
filterByBoolMask_2 = List.FilterByBoolMask(list=filterByBoolMask.in, mask=eq_2)
eraser = Custom[Tool.Eraser](Elements=filterByBoolMask_2.in)  # package SteamNodes; Try to delete any element from project

# group: Control
list_create_2 = List.Create(item0=code_block_2.out0, item1=eraser)
code_block_10 = CodeBlock(x=list_create_2) { x[0]; }

getParameterValueByName_2 = Element.GetParameterValueByName(element=code_block_2.out2, parameterName=code_block_2.out3)
name_7 = Element.Name(element=code_block_7.out0)
eq_3 = getParameterValueByName_2 == name_7
filterByBoolMask_3 = List.FilterByBoolMask(list=code_block_2.out2, mask=eq_3)
name_8 = Room.Name(room=filterByBoolMask_3.in)
groupByKey = List.GroupByKey(list=filterByBoolMask_3.in, keys=name_8)
code_block_11 = CodeBlock { false; }
ui_listview_data = Custom[UI.Listview Data](InputName=code_block_10, Keys=groupByKey.uniqueKeys, Values=groupByKey.groups, SortItems_optionnal=code_block_11, ShowId_optionnal=code_block_11)  # package Data-Shapes; Create data for ListView input in UI.MultiInputForm ++ . Check out www.data-shapes.net for more infos.
code_block_12 = CodeBlock { "Select Height Offset From Level"; 0; 100; 20; 10; }
slider = Custom[UI.Slider](InputName=code_block_12.out0, Minimum=code_block_12.out1, Maximum=code_block_12.out2, Default_Value=code_block_12.out3, Step=code_block_12.out4)  # package Data-Shapes; Creates slider input for UI.MultipleInputForm ++ . Set the step to decimal value if you want a double slider, or to a integer value if you want an integer slider.
code_block_13 = CodeBlock { "Override colours via script"; false; }
ui_boolean_input = Custom[UI.Boolean input](InputName=code_block_13.out0, DefaultValue=code_block_13.out1)  # package Data-Shapes; Creates a boolean input for UI.MultipleInputForm ++ . Check out www.data-shapes.net for more infos!
list_create_3 = List.Create(item0=ui_listview_data, item1=slider, item2=ui_boolean_input)
ui_multipleinputform_2 = Custom[UI.MultipleInputForm ++](Logo_optional=readFromFile, ButtonText_optional=code_block.out2, Inputs=list_create_3, Toggle=code_block.out1, CancelButtonText_optional=code_block.out0)
code_block_14 = CodeBlock(rooms=ui_multipleinputform_2.User_Inputs, offset=ui_multipleinputform_2.User_Inputs, override=ui_multipleinputform_2.User_Inputs) { rooms[0]; offset[1]; override[2]; }
flatten = List.Flatten(list=code_block_14.out0)
finishBoundary = Room.FinishBoundary(room=flatten)
byGeometry = Topologic.Topology.ByGeometry(geometry=finishBoundary)
byEdges = Topologic.Wire.ByEdges(edges=byGeometry)
code_block_15 = CodeBlock { 0; }
getItemAtIndex = List.GetItemAtIndex(list=byEdges@@L2, index=code_block_15)
byWire = Topologic.Face.ByWire(wire=getItemAtIndex)
geometry = Topologic.Topology.Geometry(topology=byWire)
perimeterCurves = Surface.PerimeterCurves(surface=geometry)
byOutlineTypeAndLevel = Floor.ByOutlineTypeAndLevel(outlineCurves=perimeterCurves, floorType=code_block_7.out1, level=code_block_7.out0)
name_9 = Room.Name(room=flatten)
code_block_16 = CodeBlock(roomName=name_9) { "Height Offset From Level"; "Comments"; "DynamoFloor_"+roomName; }
setParameterByName = Element.SetParameterByName(element=byOutlineTypeAndLevel, parameterName=code_block_16.out0, value=code_block_14.out1)
setParameterByName_2 = Element.SetParameterByName(element=byOutlineTypeAndLevel, parameterName=code_block_16.out1, value=code_block_16.out2)
runMe = Custom[Tool.RunMe](Boolean=code_block_14.out2, ThingToDo=setParameterByName_2)  # package SteamNodes; Use Boolean to perform an action
getParameterValueByName_3 = Element.GetParameterValueByName(element=runMe, parameterName=code_block_16.out1)
groupByKey_2 = List.GroupByKey(list=runMe, keys=getParameterValueByName_3)
acg_colours = Custom[ACG Colours]()
shuffle = List.Shuffle(list=acg_colours.All)
count = List.Count(list=groupByKey_2.uniqueKeys)
code_block_17 = CodeBlock(colours=shuffle, n=count) { colours[0..n]; }
fill_patterns = FillPatterns("<Solid fill>")
byProperties = Revit.Filter.OverrideGraphicSettings.ByProperties(projectionFillColor=code_block_17, projectionFillPattern=fill_patterns)
overrideInView = Element.OverrideInView(element=groupByKey_2.groups, overrides=byProperties)
watch = Watch(overrideInView)

# group: Usage
code_block_18 = CodeBlock { "Floors - Generate From Rooms"; }
acg_script_usage = Custom[ACG Script Usage](script_name=code_block_18)  # Adds an entry to TXT document every time a script is run. The document is located in R:\Dynamo\05-UsageStats
