# Dynamo graph Crop Region By Rooms_d.dyn (Dynamo 2.17.1.4055)
# packages: archi-lab.net 2021.25.2521, Data-Shapes 2021.2.92, Rhythm 2021.1.1

# group: Input
code_block = CodeBlock { false; Revit.Category.ByName("Rooms"); }

file_path = Filename("..\ACG_logo.png")
file_from_path = FileObject(path=file_path)
readFromFile = Image.ReadFromFile(file=file_from_path)

# group: Input
code_block_2 = CodeBlock { "Note:"; }
string = StringInput("""This tool will apply Crop Region in the active view based on a single or multiple rooms selection.
Users have also the option to define offset from the room boundaries (in mm).
Please select the room(s) after pressing the Set Crop Region button.""")
textnote_data = Custom[TextNote Data](Title=code_block_2, TextNote=string)  # package Data-Shapes; Create Data for TextNote input in UI.MultipleInputForm ++ . Check out www.data-shapes.net for more informations

# group: Input
code_block_3 = CodeBlock { "Offset from room boundary:"; 160; 1000; 300; 10; }
slider = Custom[Slider](InputName=code_block_3.out0, Minimum=code_block_3.out1, Maximum=code_block_3.out2, Default_Value=code_block_3.out3, Step=code_block_3.out4)  # package Data-Shapes; Creates slider input for UI.MultipleInputForm ++ . Set the step to decimal value if you want a double slider, or to a integer value if you want an integer slider.

list_create = List.Create(item0=textnote_data, item1=slider)

# group: Input
code_block_4 = CodeBlock { true; "Set Crop Region"; "Cancel"; false; 600; 300; }
ui_multipleinputform = Custom[UI.MultipleInputForm ++](Logo_optional=readFromFile, ButtonText_optional=code_block_4.out1, Inputs=list_create, Toggle=code_block_4.out0, CancelButtonText_optional=code_block_4.out2, Width_optional=code_block_4.out4, LabelWidth_optional=code_block_4.out5)  # package Data-Shapes; Create a form with multiple inputs. see www.data-shapes.net for tutorials and infos!

# group: Control
end = Revit.Transaction.Transaction.End(input=ui_multipleinputform.User_Inputs)
start = Revit.Transaction.Transaction.Start(input=end)

# group: Control
list_create_2 = List.Create(item0=code_block.out0, item1=start)
code_block_5 = CodeBlock(x=list_create_2) { x[0]; }

# group: Control
list_create_3 = List.Create(item0=code_block.out1, item1=start)
code_block_6 = CodeBlock(x=list_create_3) { x[0]; }

# group (continued): Input
ʳʰʸᵗʰᵐ_selection_pick = Rhythm.Revit.Selection.Selection.Pick(runIt=code_block_5, category=code_block_6, singleSelection=code_block_5)

code_block_7 = CodeBlock(x=ui_multipleinputform.User_Inputs) { roomSelection=x[0]; offset=x[0]; }

# group: Processing - Get the selected rooms outline with offset
geometry = Element.Geometry(element=ʳʰʸᵗʰᵐ_selection_pick)
bySolid = PolySurface.BySolid(solid=geometry)
surfaces = PolySurface.Surfaces(polySurface=bySolid)
acg_surface_filterbyorientation = Custom[ACG Surface.FilterByOrientation](surfaces=surfaces)  # Takes surfaces and filters them by orientation - vertical, horizontal down or horizontal up. Taken from Clockwork for Dynamo 2.x
flatten = List.Flatten(list=acg_surface_filterbyorientation.horizontal_down)
perimeterCurves = Surface.PerimeterCurves(surface=flatten)
byJoinedCurves = PolyCurve.ByJoinedCurves(curves=perimeterCurves)
code_block_8 = CodeBlock { false; }
offset = PolyCurve.Offset(polyCurve=byJoinedCurves, signedDistance=code_block_7.offset, extendCircular=code_block_8)
byPatch = Surface.ByPatch(closedCurve=offset)
byUnion = Surface.ByUnion(surfaces=byPatch)
perimeterCurves_2 = Surface.PerimeterCurves(surface=byUnion)

# group: Assing
current = Document.Current()
activeView = Document.ActiveView(document=current)
setCropBoxByCurves = archilab.Revit.Views.Views.SetCropBoxByCurves(view=activeView, curves=perimeterCurves_2)

# group: Control
code_block_9 = CodeBlock { "Crop Region - By Room Selection"; }
acg_script_usage = Custom[ACG Script Usage](script_name=code_block_9)  # Adds an entry to TXT document every time a script is run. The document is located in R:\Dynamo\05-UsageStats
