# Dynamo graph Doors Fire Rating By Walls.dyn (Dynamo 2.17.1.4055)
# packages: archi-lab.net 2022.210.2522, Data-Shapes 2021.2.92

file_path = Filename("..\ACG_logo.png")
file_from_path = FileObject(path=file_path)
readFromFile = Image.ReadFromFile(file=file_from_path)

# group: Input
code_block = CodeBlock { "Note:"; }
string = StringInput("""This tool will assign Fire Rating value to all door elements in the model based on the Fire Rating of their host walls.
Please note that Fire Rating wall parameters can be either type or instance parameter, but the Fire Rating door parameter can only be instance parameter and must vary by group instance. It is advisable that the shared ACG_Fire Rating parameter is used for both doors and walls.""")
textnote_data = Custom[TextNote Data](Title=code_block, TextNote=string)  # package Data-Shapes; Create Data for TextNote input in UI.MultipleInputForm ++ . Check out www.data-shapes.net for more informations

# group: Input
code_block_2 = CodeBlock { "Wall fire rating parameter name:"; "ACG_Fire Rating"; }
textbox_data = Custom[TextBox Data](InputName=code_block_2.out0, DefaultText=code_block_2.out1)  # package Data-Shapes; Create Data for TextBox input in UI.MultipleInputForm ++ . Check out www.data-shapes.net for more informations
code_block_3 = CodeBlock { "Door fire rating parameter name:"; "ACG_Fire Rating"; }
textbox_data_2 = Custom[TextBox Data](InputName=code_block_3.out0, DefaultText=code_block_3.out1)
code_block_4 = CodeBlock { "Is the Wall fire rating parameter instance?"; true; }
boolean_input = Custom[Boolean input](InputName=code_block_4.out0, DefaultValue=code_block_4.out1)  # package Data-Shapes; Creates a boolean input for UI.MultipleInputForm ++ . Check out www.data-shapes.net for more infos!

# group: Input
code_block_5 = CodeBlock { true; "Run"; "Cancel"; false; 800; 400; }
list_create = List.Create(item0=textnote_data, item1=textbox_data, item2=textbox_data_2, item3=boolean_input)
ui_multipleinputform = Custom[UI.MultipleInputForm ++](Logo_optional=readFromFile, ButtonText_optional=code_block_5.out1, Inputs=list_create, Toggle=code_block_5.out0, CancelButtonText_optional=code_block_5.out2, Width_optional=code_block_5.out4, LabelWidth_optional=code_block_5.out5)  # package Data-Shapes; Create a form with multiple inputs. see www.data-shapes.net for tutorials and infos!
code_block_6 = CodeBlock(x=ui_multipleinputform.User_Inputs) { wallParamName=x[0]; doorParamName=x[1]; wallParamInstance=x[2]; }

# group: Processing
code_block_7 = CodeBlock { "Doors"; }  # frozen
allElementsByCategoryName = Custom[Element.AllElementsByCategoryName](category_name=code_block_7)  # Collects all elements of a given category name.
getHost = FamilyInstance.GetHost(familyInstance=allElementsByCategoryName)
getParameterValueByName = Element.GetParameterValueByName(element=getHost, parameterName=code_block_6.wallParamName)
type = archilab.Revit.Elements.Elements.Type(element=getHost)
getParameterValueByName_2 = Element.GetParameterValueByName(element=type, parameterName=code_block_6.wallParamName)
code_block_8 = CodeBlock(input=code_block_6.wallParamInstance, instance=getParameterValueByName, type=getParameterValueByName_2) { input?instance:type; }

# group: Control
# note: collect only if ACG_Fire Rating has value
code_block_9 = CodeBlock(value=code_block_8) { value==""; }
filterByBoolMask = List.FilterByBoolMask(list=allElementsByCategoryName, mask=code_block_9)
filterByBoolMask_2 = List.FilterByBoolMask(list=getParameterValueByName, mask=code_block_9)

# group: Processing
code_block_10 = CodeBlock { "min"; ""; }
replace = String.Replace(string=filterByBoolMask_2.out, searchFor=code_block_10.out0, replaceWith=code_block_10.out1)
code_block_11 = CodeBlock(value=replace) { "FD"+value; }

# group: Visualisation
setParameterByName = Element.SetParameterByName(element=filterByBoolMask.out, parameterName=code_block_6.doorParamName, value=code_block_11)

# group: Control
code_block_12 = CodeBlock { "Doors - Fire Rating By Walls"; }
acg_script_usage = Custom[ACG Script Usage](script_name=code_block_12)  # Adds an entry to TXT document every time a script is run. The document is located in R:\Dynamo\05-UsageStats

# group: Visualisation
not_ = Not(x=ui_multipleinputform.Was_Cancelled)
# note: change the door FR parameter based on the host FR parameter
code_block_13 = CodeBlock(runMe=not_, wallParamName=code_block_6.wallParamName, doorParamName=code_block_6.doorParamName, wallInstanceParam=code_block_6.wallParamInstance) { runMe; wallParamName; doorParamName; wallInstanceParam; }
python_script = Python(IN[0]=code_block_13.runMe, IN[1]=code_block_13.wallParamName, IN[2]=code_block_13.doorParamName, IN[3]=code_block_13.wallInstanceParam)  # IronPython2
# ---------- python_script.python (96 lines) ----------
# Load the Python Standard and DesignScript Libraries
import clr
import sys
sys.path.append('C:\Program Files (x86)\IronPython 2.7\Lib')
import System
from System import Array
from System.Collections.Generic import *
clr.AddReference('ProtoGeometry')
from Autodesk.DesignScript.Geometry import *
clr.AddReference("RevitNodes")
import Revit
clr.ImportExtensions(Revit.Elements)
clr.ImportExtensions(Revit.GeometryConversion)
clr.AddReference("RevitServices")
import RevitServices
from RevitServices.Persistence import DocumentManager 
from RevitServices.Transactions import TransactionManager 

clr.AddReference("RevitAPI")
clr.AddReference("RevitAPIUI")

import Autodesk 
from Autodesk.Revit.DB import *
from Autodesk.Revit.UI import *

doc = DocumentManager.Instance.CurrentDBDocument
uiapp = DocumentManager.Instance.CurrentUIApplication 
app = uiapp.Application 
uidoc = uiapp.ActiveUIDocument

hosts = []
hostFRs = []
doorFRs =[]

runMe = IN[0]
wallsFRparam = IN[1]
doorsFRparam =IN[2]
FRparamInstance = IN[3]

temp=[]
# collect the host of each door, take value of FR parameter and push to doors

col = FilteredElementCollector(doc).OfCategory(BuiltInCategory.OST_Doors).WhereElementIsNotElementType().ToElements()

def doorFRtypeWalls(elements, wallFRparam, doorFRparam):
	TransactionManager.Instance.EnsureInTransaction(doc)
	for e in elements:
		host = e.Host
		cat = host.Category.Name
		if cat == 'Walls':
			hostType = host.WallType
			wallFR = hostType.LookupParameter(wallFRparam).AsValueString()
			if wallFR == None or wallFR == '':
				wallFR = 'min'
		else:
			wallFR = 'min'			
		doorFR = 'FD'+(wallFR.replace('min',''))
		if doorFR == 'FD':
			doorFR = ''		
		e.LookupParameter(doorFRparam).Set(doorFR)
		doorFRs.append(wallFR)

	TransactionManager.Instance.TransactionTaskDone()
	return doorFRs
	
	
def doorFRinstanceWalls(elements, wallFRparam, doorFRparam):
	TransactionManager.Instance.EnsureInTransaction(doc)
	for e in elements:
		try:
			host = e.Host
			cat = host.Category.Name
			if cat == 'Walls':
				wallFR = host.LookupParameter(wallFRparam).AsValueString()
				if not wallFR:
					wallFR = 'min'
			else:
				wallFR = 'min'			
			doorFR = 'FD'+(wallFR.replace('min',''))
			if doorFR == 'FD':
				doorFR = ''			
			e.LookupParameter(doorFRparam).Set(doorFR)
			doorFRs.append(wallFR)
		except:
			continue

	TransactionManager.Instance.TransactionTaskDone()
	return doorFRs
	
if FRparamInstance:
	do = doorFRinstanceWalls(col, wallsFRparam, doorsFRparam)
else:
	do = doorFRtypeWalls(col, wallsFRparam, doorsFRparam)
	
OUT = do
	
# ----------------------------------------
