# Dynamo graph Identify Mirrored Instances.dyn "Elements - Identify Mirrored_py" (Dynamo 2.12.1.8246)
# packages: Genius Loci 2021.2.3, Data-Shapes 2021.2.92

file_path = Filename("..\ACG_logo.png")
file_from_path = FileObject(path=file_path)
readFromFile = Image.ReadFromFile(file=file_from_path)

# group: Input
code_block = CodeBlock { "Note:"; }
string = StringInput("This tool will collect all elements of selected category and identify the ones that are mirrored. The value \"Mirrored\" will be assigned to an instance parameter \"ACG_Mirrored\". Please make sure that such parameter is loaded in the model . The parameter does not need to be shared, but its values must vary by group instance.")
textnote_data = Custom[TextNote Data](Title=code_block, TextNote=string)  # package Data-Shapes; Create Data for TextNote input in UI.MultipleInputForm ++ . Check out www.data-shapes.net for more informations

# group: Input
code_block_2 = CodeBlock()
# ---------- code_block_2.designscript (13 lines) ----------
"Select Category";

[
"Casework",
"Columns",
"Furniture",
"Furniture Systems",
"Generic Models",
"Parking",
"Planting",
"Plumbing Fixtures",
"Site"
];
# ----------------------------------------
ui_dropdown_data = Custom[UI.DropDown Data](InputName=code_block_2.out0, Keys=code_block_2.out1, Values=code_block_2.out1)  # package Data-Shapes; Create data for DropDown input in UI.MultiInputForm ++ . Check out www.data-shapes.net for more infos.

# group: Input
code_block_3 = CodeBlock { true; "Run"; "Cancel"; false; 700; 350; }
list_create = List.Create(item0=textnote_data, item1=ui_dropdown_data)
ui_multipleinputform = Custom[UI.MultipleInputForm ++](Logo_optional=readFromFile, ButtonText_optional=code_block_3.out1, Inputs=list_create, Toggle=code_block_3.out0, CancelButtonText_optional=code_block_3.out2, Width_optional=code_block_3.out4, LabelWidth_optional=code_block_3.out5)  # package Data-Shapes; Create a form with multiple inputs. see www.data-shapes.net for tutorials and infos!

# group: Processing
code_block_4 = CodeBlock(x=ui_multipleinputform.User_Inputs) { x[0]; }  # frozen
allElementsByCategoryName = Custom[Element.AllElementsByCategoryName](CategoryName=code_block_4)
familyinstance_get_mirrored = Custom[FamilyInstance Get Mirrored](familyInstance=allElementsByCategoryName)  # package Genius Loci; Gets the mirrored family instances.
code_block_5 = CodeBlock { "ACG_Mirrored Element"; "Mirrored"; "x"; }

# group: Visualisation
setParameterByName = Element.SetParameterByName(element=familyinstance_get_mirrored.Mirrored, parameterName=code_block_5.out0, value=code_block_5.out1)
setParameterByName_2 = Element.SetParameterByName(element=familyinstance_get_mirrored.Others, parameterName=code_block_5.out0, value=code_block_5.out2)

# group: Usage
code_block_6 = CodeBlock { "Elements - Identify Mirrored"; }
acg_script_usage = Custom[ACG Script Usage](scriptName=code_block_6)  # Adds an entry to Excel document every time a script is run. The document is located in S:\Dynamo\05-UsageStats

code_block_7 = CodeBlock(x=ui_multipleinputform.User_Inputs) { x[0]; }

# group: Visualisation
not_ = Not(x=ui_multipleinputform.Was_Cancelled)
python_script = Python(IN[0]=not_, IN[1]=code_block_7)  # IronPython2
# ---------- python_script.python (77 lines) ----------
# Load the Python Standard and DesignScript Libraries
import clr
import sys
sys.path.append('C:\Program Files (x86)\IronPython 2.7\Lib')
import System
from System import Array
from System.Collections.Generic import *
clr.AddReference('ProtoGeometry')
from Autodesk.DesignScript.Geometry import *
clr.AddReference("RevitNodes")
import Revit
clr.ImportExtensions(Revit.Elements)
clr.ImportExtensions(Revit.GeometryConversion)
clr.AddReference("RevitServices")
import RevitServices
from RevitServices.Persistence import DocumentManager 
from RevitServices.Transactions import TransactionManager 

clr.AddReference("RevitAPI")
clr.AddReference("RevitAPIUI")

import Autodesk 
from Autodesk.Revit.DB import *
from Autodesk.Revit.UI import *

doc = DocumentManager.Instance.CurrentDBDocument
uiapp = DocumentManager.Instance.CurrentUIApplication 
app = uiapp.Application 
uidoc = uiapp.ActiveUIDocument


temp = []

runMe = IN[0]
cat = IN[1]

if cat == "Generic Models":
	gmCol=FilteredElementCollector(doc).OfCategory(BuiltInCategory.OST_GenericModel).WhereElementIsNotElementType().ToElements()
	
elif cat == "Casework":
	gmCol=FilteredElementCollector(doc).OfCategory(BuiltInCategory.OST_Casework).WhereElementIsNotElementType().ToElements()
	
elif cat == "Furniture":
	gmCol=FilteredElementCollector(doc).OfCategory(BuiltInCategory.OST_Furniture).WhereElementIsNotElementType().ToElements()
	
elif cat == "Furniture Systems":
	gmCol=FilteredElementCollector(doc).OfCategory(BuiltInCategory.OST_FurnitureSystems).WhereElementIsNotElementType().ToElements()
	
elif cat == "Parking":
	gmCol=FilteredElementCollector(doc).OfCategory(BuiltInCategory.OST_Parking).WhereElementIsNotElementType().ToElements()	
	
elif cat == "Planting":
	gmCol=FilteredElementCollector(doc).OfCategory(BuiltInCategory.OST_Planting).WhereElementIsNotElementType().ToElements()
	
elif cat == "Plumbing Fixtures":
	gmCol=FilteredElementCollector(doc).OfCategory(BuiltInCategory.OST_PlumbingFixtures).WhereElementIsNotElementType().ToElements()
	
else:
	gmCol=FilteredElementCollector(doc).OfCategory(BuiltInCategory.OST_Site).WhereElementIsNotElementType().ToElements()

if runMe:
# get the IDs of the wall types in the active view
	TransactionManager.Instance.EnsureInTransaction(doc)
	for i in gmCol:
		try:
			if i.Mirrored:
				value = 'Mirrored'
			else:
				value = 'Not Mirrored'
			temp.append(value)
			i.LookupParameter('ACG_Mirrored').Set(value)
		except:
			continue
	TransactionManager.Instance.TransactionTaskDone()

	
OUT = temp
# ----------------------------------------
