# Dynamo graph Renumber Doors By Room & Level_d.dyn "Doors - Renumber By Room & Level" (Dynamo 2.6.1.8786)
# packages: Data-Shapes 2021.2.92, Genius Loci 2021.2.3, SteamNodes 1.2.3, archi-lab.net 2021.25.2521

file_path = Filename("..\ACG_logo.png")
file_from_path = FileObject(path=file_path)
readFromFile = Image.ReadFromFile(file=file_from_path)
code_block = CodeBlock { true; "Run"; "Cancel"; false; 800; 400; }

# group: Input
code_block_2 = CodeBlock { "Note:"; }
string = StringInput("""This tool will renumber doors in the model by using their Mark parameter. You can renumber all doors or filter by level, function or parameter of the rooms that thei are associated with.
The tool will use the From Rooms parameter to associate door with rooms. Where that parameter does not exist, the tool will use the To Room parameter or ignore the door if both of those parameters are missing.
The numbering convention being used is <functionCode>-<level>-<roomNumber*>-<uniqueNumber>.
There is aso the option to add a custom code at a specified position.
Remember, the tool is only as good as the data you are inputting!
For more information on how this tool works, plese refer to the Revit Tutorials channel in MS Teams or speak with Ivo.""")
textnote_data = Custom[TextNote Data](Title=code_block_2, TextNote=string)  # package Data-Shapes; Create Data for TextNote input in UI.MultipleInputForm ++ . Check out www.data-shapes.net for more informations

# group: Input
# note: Define doors from what funtion to be used
code_block_3 = CodeBlock { "Choose doors by function:"; ["All","Interior","Exterior"]; ["","0","1"]; 1; }
dropdown_data = Custom[DropDown Data](InputName=code_block_3.out0, Keys=code_block_3.out1, Values=code_block_3.out1, DefaultValueIndex=code_block_3.out3)  # package Data-Shapes; Create data for DropDown input in UI.MultiInputForm ++ . Check out www.data-shapes.net for more infos.

# group: Input
code_block_4 = CodeBlock { "Room number parameter:"; ["Name","Number","Department","Occupancy","Comments"]; 1; }
dropdown_data_2 = Custom[DropDown Data](InputName=code_block_4.out0, Keys=code_block_4.out1, Values=code_block_4.out1, DefaultValueIndex=code_block_4.out2)

# group: Input
code_block_5 = CodeBlock { "Filter by room parameter:"; ["Name","Number","Department","Occupancy","Comments"]; }
dropdown_data_3 = Custom[DropDown Data](InputName=code_block_5.out0, Keys=code_block_5.out1, Values=code_block_5.out1)
code_block_6 = CodeBlock { "Room parameter value must contain:"; }
textbox_data = Custom[TextBox Data](InputName=code_block_6)  # package Data-Shapes; Create Data for TextBox input in UI.MultipleInputForm ++ . Check out www.data-shapes.net for more informations

# group: Input
code_block_7 = CodeBlock { "Filter by level:"; "Select level:"; }
boolean_input = Custom[Boolean input](InputName=code_block_7.out0)  # package Data-Shapes; Creates a boolean input for UI.MultipleInputForm ++ . Check out www.data-shapes.net for more infos!
code_block_8 = CodeBlock { catL=Revit.Category.ByName("Levels"); allL=ElementQueries. OfCategory(catL); allL.Name; }
dropdown_data_4 = Custom[DropDown Data](InputName=code_block_7.out1, Keys=code_block_8.out2, Values=code_block_8.out2)

# group: Input
code_block_9 = CodeBlock { "Alphabetical numbering:"; true; }
boolean_input_2 = Custom[Boolean input](InputName=code_block_9.out0, DefaultValue=code_block_9.out1)

# group: Input
code_block_10 = CodeBlock { "Add additional code value:"; "Add additional code index:"; 1; 5; }
textbox_data_2 = Custom[TextBox Data](InputName=code_block_10.out0)
slider = Custom[Slider](InputName=code_block_10.out1, Minimum=code_block_10.out2, Maximum=code_block_10.out3, Step=code_block_10.out2)  # package Data-Shapes; Creates slider input for UI.MultipleInputForm ++ . Set the step to decimal value if you want a double slider, or to a integer value if you want an integer slider.

list_create = List.Create(item0=textnote_data, item1=dropdown_data, item2=dropdown_data_2, item3=dropdown_data_3, item4=textbox_data, item5=boolean_input, item6=dropdown_data_4, item7=boolean_input_2, item8=textbox_data_2, item9=slider)
ui_multipleinputform = Custom[UI.MultipleInputForm ++](Logo_optional=readFromFile, ButtonText_optional=code_block.out1, Inputs=list_create, Toggle=code_block.out0, CancelButtonText_optional=code_block.out2, Width_optional=code_block.out4, LabelWidth_optional=code_block.out5)  # package Data-Shapes; Create a form with multiple inputs. see www.data-shapes.net for tutorials and infos!
code_block_11 = CodeBlock(x=ui_multipleinputform.User_Inputs)
# ---------- code_block_11.designscript (9 lines) ----------
wallFuntion=x[0];
roomNumberParam=x[1];
roomParamName=x[2];
roomParamValue=x[3];
useLevels=x[4];
level=x[5];
alphabetical=x[6];
addCode=x[7];
codeIndex=x[8];
# ----------------------------------------

# group: Control
code_block_12 = CodeBlock(value=code_block_11.wallFuntion) { value=="All"; ""; value; }
if_ = If(test=code_block_12.out0, true=code_block_12.out1, false=code_block_12.value)
# note: convert funtion from text to int
code_block_13 = CodeBlock(value=if_) { value=="Interior"; "0"; value; }
if_2 = If(test=code_block_13.out0, true=code_block_13.out1, false=code_block_13.value)
code_block_14 = CodeBlock(value=if_2) { value=="Exterior"; "1"; value; }
if_3 = If(test=code_block_14.out0, true=code_block_14.out1, false=code_block_14.value)

# group: Filtering - Collect all doors with selected "function"
code_block_15 = CodeBlock { catD=Revit.Category.ByName("Doors"); allD=ElementQueries.OfCategory(catD); }
code_block_16 = CodeBlock(d=code_block_15.allD) { d.Type; "Function"; }
getParameterValueByName = Element.GetParameterValueByName(element=code_block_16.out0, parameterName=code_block_16.out1)
# note: Filter doors by function
string_from_object = FromObject(obj=getParameterValueByName)
contains = String.Contains(str=string_from_object, searchFor=if_3)
filterByBoolMask = List.FilterByBoolMask(list=code_block_15.allD, mask=contains)

# group: Filtering - Collect all doors of selected level
code_block_17 = CodeBlock { "Level"; }
# note: collect & filter levels
getParameterValueByName_2 = Element.GetParameterValueByName(element=filterByBoolMask.in, parameterName=code_block_17)
code_block_18 = CodeBlock(lvl=getParameterValueByName_2, input=code_block_11.level) { lvl.Name==input; }
filterByBoolMask_2 = List.FilterByBoolMask(list=filterByBoolMask.in, mask=code_block_18)

# group: Control
not_ = Not(x=code_block_11.useLevels)
runMe = Custom[Tool.RunMe](Boolean=not_, ThingToDo=filterByBoolMask.in)  # package SteamNodes; Use Boolean to perform an action
runMe_2 = Custom[Tool.RunMe](Boolean=code_block_11.useLevels, ThingToDo=filterByBoolMask_2.in)
list_create_2 = List.Create(item0=runMe, item1=runMe_2)
clear_list = Custom[Clear List](input=list_create_2)  # package archi-lab.net; This node will remove all Null and Empty Lists from any list.
flatten = List.Flatten(list=clear_list)
code_block_19 = CodeBlock(value=flatten) { value==0; }
filterByBoolMask_3 = List.FilterByBoolMask(list=flatten, mask=code_block_19)

# group: Visualisation - Get Rooms From/Room To
# note: Get the rooms from door inputs
python_script = Python(IN[0]=filterByBoolMask_3.out)
# ---------- python_script.python (47 lines) ----------
import clr
# Import RevitAPI
clr.AddReference('RevitAPI')
import Autodesk
from Autodesk.Revit.DB import *

# Import DocumentManager and TransactionManager
clr.AddReference('RevitServices')
import RevitServices
from RevitServices.Persistence import DocumentManager
from RevitServices.Transactions import TransactionManager

# Import ToDSType(bool) extension method
clr.AddReference('RevitNodes')
import Revit
clr.ImportExtensions(Revit.Elements)

doc = DocumentManager.Instance.CurrentDBDocument

fam_inst = IN[0]

elements = []
for i in IN[0]:
    elements.append(UnwrapElement(i))

def TryGetToRoom(Room, phase):
	if Room.get_ToRoom(phase) != None:
		toRoom = Room.get_ToRoom(phase)
	else :
		toRoom = 'No to room'
	return  toRoom

def TryGetFromRoom(Room, phase):
	if Room.get_FromRoom(phase) != None:
		fromRoom = Room.get_FromRoom(phase)
	else:
		fromRoom = 'No from room'
	return fromRoom

output = []

for i in elements:
	to_Room = TryGetToRoom(i, doc.GetElement(i.CreatedPhaseId))
	from_Room = TryGetFromRoom(i,doc.GetElement(i.CreatedPhaseId))
	output.append([to_Room,from_Room])

OUT = output
# ----------------------------------------

# group: Filtering - collect all doors associated with rooms filtered by sected criteria
getParameterValueByName_3 = Element.GetParameterValueByName(element=python_script, parameterName=code_block_11.roomParamName)
# note: Filter rooms by parameter and value
contains_2 = String.Contains(str=getParameterValueByName_3, searchFor=code_block_11.roomParamValue)

# group: Control
code_block_20 = CodeBlock(value=contains_2) { value==null; false; }
if_4 = If(test=code_block_20.out0, true=code_block_20.out1, false=contains_2)

# group: Processing - Get doors to be numbered and their associated rooms
filterByBoolMask_4 = List.FilterByBoolMask(list=python_script, mask=if_4)
isEmpty = List.IsEmpty(list=filterByBoolMask_4.in@L2)
# note: doors from filtered rooms - OUT
# note: Doorrs to be
# processed !!!!!!
filterByBoolMask_5 = List.FilterByBoolMask(list=filterByBoolMask_3.out, mask=isEmpty)
# note: rooms - OUT
filterByBoolMask_6 = List.FilterByBoolMask(list=filterByBoolMask_4.in, mask=isEmpty)

# group: Processing - get the number of the rooms
# note: collect the From/To rooms from the door elements
getParameterValueByName_4 = Element.GetParameterValueByName(element=filterByBoolMask_6.out, parameterName=code_block_11.roomNumberParam)

# group: Control
code_block_21 = CodeBlock(value=getParameterValueByName_4) { value==null; "No Room"; }
if_5 = If(test=code_block_21.out0, true=code_block_21.out1, false=getParameterValueByName_4)

# group: Processing - group doors and rooms by number
firstItem = List.FirstItem(list=if_5@@L2)
# note: group doors by room numbers
groupByKey = List.GroupByKey(list=filterByBoolMask_5.out, keys=firstItem)
# note: group room numbers
groupByKey_2 = List.GroupByKey(list=firstItem, keys=firstItem)

# group: Processing - sort doors by width
code_block_22 = CodeBlock(dr=groupByKey.groups) { dr.Type; "Width"; }
# note: sort the doors by their widths (biggest first)
getParameterValueByName_5 = Element.GetParameterValueByName(element=code_block_22.out0, parameterName=code_block_22.out1)
sortByKey = List.SortByKey(list=groupByKey.groups@L2, keys=getParameterValueByName_5@L2)
# note: Doors sorted by width
reverse = List.Reverse(list=sortByKey.sorted_list@L2)

# group: Processing - generate ID/ED codes
code_block_23 = CodeBlock(dr=reverse) { dr.Type; "Function"; }
getParameterValueByName_6 = Element.GetParameterValueByName(element=code_block_23.out0, parameterName=code_block_23.out1)
code_block_24 = CodeBlock { 0; "ID"; }
eq = getParameterValueByName_6 == code_block_24.out0
if_6 = If(test=eq, true=code_block_24.out1, false=getParameterValueByName_6)
code_block_25 = CodeBlock { 1; "ED"; }
eq_2 = if_6 == code_block_25.out0
if_7 = If(test=eq_2, true=code_block_25.out1, false=if_6)

# group: Processing
code_block_26 = CodeBlock { "Level"; }
# note: collect levels
getParameterValueByName_7 = Element.GetParameterValueByName(element=reverse, parameterName=code_block_26)
code_block_27 = CodeBlock(lvl=getParameterValueByName_7) { lvl.Name; }
length = String.Length(str=code_block_27)
code_block_28 = CodeBlock(lng=length) { 0; lng-2; }
remove = String.Remove(str=code_block_27, startIndex=code_block_28.out0, count=code_block_28.out1)

# group: Processing
count = List.Count(list=reverse@L2)
code_block_29 = CodeBlock(n=count) { 0..(n-1); 1..26; "A".."Z"; 1..n; }
getItemAtIndex = List.GetItemAtIndex(list=code_block_29.out2, index=code_block_29.out0@@L2)

if_8 = If(test=code_block_11.alphabetical, true=getItemAtIndex, false=code_block_29.out3)

# group: Processing
code_block_30 = CodeBlock(code=if_7, lvl=remove, roomNumber=groupByKey_2.groups, doorNumber=if_8) { code; lvl; roomNumber; doorNumber; }
flatten_2 = List.Flatten(list=code_block_30.code)
flatten_3 = List.Flatten(list=code_block_30.lvl)
flatten_4 = List.Flatten(list=code_block_30.roomNumber)
flatten_5 = List.Flatten(list=code_block_30.doorNumber)
list_create_3 = List.Create(item0=flatten_2, item1=flatten_3, item2=flatten_4, item3=flatten_5)
transpose = List.Transpose(lists=list_create_3)
string_from_object_2 = FromObject(obj=transpose)

# group: Processing
count_2 = List.Count(list=flatten_5)
ofRepeatedItem = List.OfRepeatedItem(item=code_block_11.addCode, amount=count_2)
code_block_31 = CodeBlock(index=code_block_11.codeIndex) { index-1; }
insertAtIndex = Custom[InsertAtIndex](list=transpose, element=ofRepeatedItem, index=code_block_31)  # package Genius Loci; Inserts items into lists at specified indices.
string_from_object_3 = FromObject(obj=insertAtIndex)

# group: Assing
code_block_32 = CodeBlock { "-"; }
join = String.Join(separator=code_block_32, string0=string_from_object_2)
flatten_6 = List.Flatten(list=join)
join_2 = String.Join(separator=code_block_32, string0=string_from_object_3)
flatten_7 = List.Flatten(list=join_2)

# group: Control
code_block_33 = CodeBlock(value=code_block_11.addCode) { value==""; }
if_9 = If(test=code_block_33, true=flatten_6, false=flatten_7)

# group: Assing
flatten_8 = List.Flatten(list=reverse)
code_block_34 = CodeBlock { "Mark"; }
setParameterByName = Element.SetParameterByName(element=flatten_8, parameterName=code_block_34, value=if_9)

# group: Control
code_block_35 = CodeBlock { "Doors - Renumber By Levels & Room"; }
acg_script_usage = Custom[ACG Script Usage](scriptName=code_block_35)  # Adds an entry to Excel document every time a script is run. The document is located in S:\Dynamo\05-UsageStats

# group: Input
code_block_36 = CodeBlock { "Remove wrapping at ends?"; }
boolean_input_3 = Custom[Boolean input](InputName=code_block_36)

code_block_37 = CodeBlock(lvl=code_block_11.roomNumberParam) { lvl; }
string_from_object_4 = FromObject(obj=code_block_37)
code_block_38 = CodeBlock { "Number"; }
