# Dynamo graph Report Handing Of Doors & Windows.dyn "Doors & Windows - Report Handing_py" (Dynamo 2.12.1.8246)
# packages: Data-Shapes 2021.2.92

# group: Usage
code_block = CodeBlock { "Doors & Windows - Report Handing"; }
acg_script_usage = Custom[ACG Script Usage](scriptName=code_block)  # Adds an entry to Excel document every time a script is run. The document is located in S:\Dynamo\05-UsageStats

# group: Input
code_block_2 = CodeBlock { "Note:"; }
string = StringInput("""This script will populate the ACG_Door Handing parameter for Door and Window families.
Before running the script please make sure the shared parameter is loaded into the model, assigned to the Door and Window category and in setup to Instance - Value can vary by group instance. For more information please refer to the Revit Tutorials channel in MS Stream.""")
textnote_data = Custom[TextNote Data](Title=code_block_2, TextNote=string)  # package Data-Shapes; Create Data for TextNote input in UI.MultipleInputForm ++ . Check out www.data-shapes.net for more informations

# group: Input
code_block_3 = CodeBlock()
# ---------- code_block_3.designscript (8 lines) ----------
"Chose element category.";
[
"Doors",
"Windows",
"Doors & Windows"
];
0;
false;
# ----------------------------------------
dropdown_data = Custom[DropDown Data](InputName=code_block_3.out0, Keys=code_block_3.out1, Values=code_block_3.out1, DefaultValueIndex=code_block_3.out2, Sorted_optional=code_block_3.out3)  # package Data-Shapes; Create data for DropDown input in UI.MultiInputForm ++ . Check out www.data-shapes.net for more infos.

# group: Input
code_block_4 = CodeBlock { "Filter elements by Type Mark value."; false; "Type Mark value must contain."; }
ui_boolean_input = Custom[UI.Boolean input](InputName=code_block_4.out0, DefaultValue=code_block_4.out1)  # package Data-Shapes; Creates a boolean input for UI.MultipleInputForm ++ . Check out www.data-shapes.net for more infos!
textbox_data = Custom[TextBox Data](InputName=code_block_4.out2)  # package Data-Shapes; Create Data for TextBox input in UI.MultipleInputForm ++ . Check out www.data-shapes.net for more informations

# group: Input
code_block_5 = CodeBlock { DSCore.Types.FindTypeByNameInAssembly("Phase","RevitAPI"); }
all_elements_of_type = ElementsOfType(element_type=code_block_5)
code_block_6 = CodeBlock(ph=all_elements_of_type) { "Choose model phase."; false; ph.Name; ph.Id; }
count = List.Count(list=all_elements_of_type)
code_block_7 = CodeBlock(count=count) { count-1; }
dropdown_data_2 = Custom[DropDown Data](InputName=code_block_6.out0, Keys=code_block_6.out2, Values=code_block_6.out3, DefaultValueIndex=code_block_7, Sorted_optional=code_block_6.out1)

# group: Input
file_path = Filename("..\ACG_logo.png")  # frozen
file_from_path = FileObject(path=file_path)
readFromFile = Image.ReadFromFile(file=file_from_path)
code_block_8 = CodeBlock { "Update ACG_Door Handing value"; true; "Run"; "Cancel"; 700; 400; }
list_create = List.Create(item0=textnote_data, item1=dropdown_data, item2=ui_boolean_input, item3=textbox_data, item4=dropdown_data_2)
ui_multipleinputform = Custom[UI.MultipleInputForm ++](ButtonText_optional=code_block_8.out2, Inputs=list_create, Toggle=code_block_8.out1, CancelButtonText_optional=code_block_8.out3, Width_optional=code_block_8.out4, LabelWidth_optional=code_block_8.out5)  # package Data-Shapes; Create a form with multiple inputs. see www.data-shapes.net for tutorials and infos!

code_block_9 = CodeBlock(categoryName=ui_multipleinputform.User_Inputs, filter=ui_multipleinputform.User_Inputs, typeMarkValue=ui_multipleinputform.User_Inputs, phase=ui_multipleinputform.User_Inputs) { categoryName[0]; filter[1]; typeMarkValue[2]; phase[3]; }
python_script = Python(IN[0]=ui_multipleinputform.Was_Cancelled, IN[1]=code_block_9.out0, IN[2]=code_block_9.out1, IN[3]=code_block_9.out2, IN[4]=code_block_9.out3)  # IronPython2
# ---------- python_script.python (89 lines) ----------
# Load the Python Standard and DesignScript Libraries
import clr
import sys
import os.path
from datetime import datetime
from System import Environment
sys.path.append('C:\Program Files (x86)\IronPython 2.7\Lib')
import System
from System import Array
from System.Collections.Generic import *
clr.AddReference('ProtoGeometry')
from Autodesk.DesignScript.Geometry import *
clr.AddReference("RevitNodes")
import Revit
clr.ImportExtensions(Revit.Elements)
clr.ImportExtensions(Revit.GeometryConversion)
clr.AddReference("RevitServices")
import RevitServices
from RevitServices.Persistence import DocumentManager 
from RevitServices.Transactions import TransactionManager 

clr.AddReference("RevitAPI")
clr.AddReference("RevitAPIUI")

import Autodesk 
from Autodesk.Revit.DB import *
from Autodesk.Revit.UI import *
import time

doc = DocumentManager.Instance.CurrentDBDocument
uiapp = DocumentManager.Instance.CurrentUIApplication 
app = uiapp.Application 
uidoc = uiapp.ActiveUIDocument

cancelled = IN[0]
catKey = IN[1]
filter = IN[2]
containsValue = IN[3]
phase = doc.GetElement(ElementId(IN[4]))

temp = []
filteredEls = []

	
	
if catKey == 'Doors':
	elements = FilteredElementCollector(doc).OfCategory(BuiltInCategory.OST_Doors).WhereElementIsNotElementType().ToElements()
elif catKey == 'Windows':
	elements = FilteredElementCollector(doc).OfCategory(BuiltInCategory.OST_Windows).WhereElementIsNotElementType().ToElements()
else:
	catList = [BuiltInCategory.OST_Doors, BuiltInCategory.OST_Windows]
	typedList = List[BuiltInCategory](catList)
	filter = ElementMulticategoryFilter(typedList)
	doorsCol = FilteredElementCollector(doc).OfCategory(BuiltInCategory.OST_Doors).WhereElementIsNotElementType()
	elements = FilteredElementCollector(doc).WherePasses(filter).WhereElementIsNotElementType().ToElements()
	
for e in elements:
	type = doc.GetElement(e.GetTypeId())
	if containsValue in type.LookupParameter('Type Mark').AsString():
		filteredEls.append(e)
		
# get HANDING and assign as parameter!!!
for i in filteredEls:
	toRoom = i.Room[phase]
	if toRoom is not None:
		if not i.FacingFlipped:
			if i.HandFlipped:
				i.LookupParameter('ACG_Door Handing').Set('Right')
			else:
				i.LookupParameter('ACG_Door Handing').Set('Left')
		else:
			if i.HandFlipped:
				i.LookupParameter('ACG_Door Handing').Set('Left')
			else:
				i.LookupParameter('ACG_Door Handing').Set('Right')
	else:
		if i.FacingFlipped:
			if i.HandFlipped:
				i.LookupParameter('ACG_Door Handing').Set('Right Reversed')
			else:
				i.LookupParameter('ACG_Door Handing').Set('Left Reversed')
		else:
			if i.HandFlipped:
				i.LookupParameter('ACG_Door Handing').Set('Left Reversed')
			else:
				i.LookupParameter('ACG_Door Handing').Set('Right Reversed')


OUT = filteredEls
# ----------------------------------------
