# Dynamo graph Swap Detail Items For 3D Families_d.dyn "Detail Items - Swap With Component Families" (Dynamo 2.12.1.8246)
# packages: Data-Shapes 2021.2.92, WombatDynamo 2.3.0

# group: Control
code_block = CodeBlock { "Detail Items - Swap With Componend Families"; }
acg_script_usage = Custom[ACG Script Usage](scriptName=code_block)  # Adds an entry to Excel document every time a script is run. The document is located in S:\Dynamo\05-UsageStats

# group: Input
code_block_2 = CodeBlock()
# ---------- code_block_2.designscript (12 lines) ----------
[
"Generic Models",
"Casework",
"Columns",
"Electrical Equipment",
"Electrical Fixtures",
"Furniture",
"Mechanical Equipment",
"Structural Columns",
"Pipes",
"Plumbing Fixtures"
];
# ----------------------------------------
allElementsByCategoryName = Custom[Element.AllElementsByCategoryName](CategoryName=code_block_2)
flatten = List.Flatten(list=allElementsByCategoryName)
types = Custom[Element.Types+](element=flatten)  # Gets types from linked elements too. From Clockworks
getFamily = FamilyInstance.GetFamily(familyInstance=flatten)
isNull = Object.IsNull(object=getFamily)
filterByBoolMask = List.FilterByBoolMask(list=types, mask=isNull)
filterByBoolMask_2 = List.FilterByBoolMask(list=getFamily, mask=isNull)
code_block_3 = CodeBlock(fam=filterByBoolMask_2.out, type=filterByBoolMask.out) { fam.Name+" : "+type.Name; }
groupByKey = List.GroupByKey(list=filterByBoolMask.out, keys=code_block_3)
code_block_4 = CodeBlock(type=groupByKey.groups) { type.Id; }
code_block_5 = CodeBlock { "Select a Component Family type:"; }
firstItem = List.FirstItem(list=groupByKey.groups@L2)
dropdown_data = Custom[DropDown Data](InputName=code_block_5, Keys=groupByKey.uniqueKeys, Values=firstItem)  # package Data-Shapes; Create data for DropDown input in UI.MultiInputForm ++ . Check out www.data-shapes.net for more infos.

file_path = Filename("..\ACG_logo.png")
file_from_path = FileObject(path=file_path)
readFromFile = Image.ReadFromFile(file=file_from_path)
code_block_6 = CodeBlock { true; "Run"; "Cancel"; false; 800; 400; }

# group: Input
code_block_7 = CodeBlock { "Note:"; }
string = StringInput("""This tools will replace all detail item instances of a given type in the active floor or ceiling view with a component family instances of a given type. The component families must be freestanding and there must be at least one instance in the model.
The tool also has the function to automatically remove the detail Items after the 3d Components are placed. If both detail items and component families have "Length" and "Width" instance parameters, the tool can transfer the values between the elements.""")
textnote_data = Custom[TextNote Data](Title=code_block_7, TextNote=string)  # package Data-Shapes; Create Data for TextNote input in UI.MultipleInputForm ++ . Check out www.data-shapes.net for more informations

# group: Input
code_block_8 = CodeBlock { "Select a Detail Item type to be replaced:"; }
code_block_9 = CodeBlock { "Detail Items"; }
allElementsByCategoryName_2 = Custom[Element.AllElementsByCategoryName](CategoryName=code_block_9)
types_2 = Custom[Element.Types+](element=allElementsByCategoryName_2)
getFamily_2 = FamilyInstance.GetFamily(familyInstance=allElementsByCategoryName_2)
isNull_2 = Object.IsNull(object=getFamily_2)
filterByBoolMask_3 = List.FilterByBoolMask(list=types_2, mask=isNull_2)
filterByBoolMask_4 = List.FilterByBoolMask(list=getFamily_2, mask=isNull_2)
code_block_10 = CodeBlock(fam=filterByBoolMask_4.out, type=filterByBoolMask_3.out) { fam.Name+" : "+type.Name; }
groupByKey_2 = List.GroupByKey(list=filterByBoolMask_3.out, keys=code_block_10)
code_block_11 = CodeBlock(type=groupByKey_2.groups) { type.Id; }
firstItem_2 = List.FirstItem(list=code_block_11@L2)
dropdown_data_2 = Custom[DropDown Data](InputName=code_block_8, Keys=groupByKey_2.uniqueKeys, Values=firstItem_2)

# group: Input
code_block_12 = CodeBlock { "Delete Detail Items?"; }
boolean_input = Custom[Boolean input](InputName=code_block_12)  # package Data-Shapes; Creates a boolean input for UI.MultipleInputForm ++ . Check out www.data-shapes.net for more infos!

# group: Input
code_block_13 = CodeBlock { "Push Width and Length values?"; true; }
boolean_input_2 = Custom[Boolean input](InputName=code_block_13.out0)

list_create = List.Create(item0=textnote_data, item1=dropdown_data_2, item2=dropdown_data, item3=boolean_input, item4=boolean_input_2)
ui_multipleinputform = Custom[UI.MultipleInputForm ++](Logo_optional=readFromFile, ButtonText_optional=code_block_6.out1, Inputs=list_create, Toggle=code_block_6.out0, CancelButtonText_optional=code_block_6.out2, Width_optional=code_block_6.out4, LabelWidth_optional=code_block_6.out5)  # package Data-Shapes; Create a form with multiple inputs. see www.data-shapes.net for tutorials and infos!

# group: Visualisation
code_block_14 = CodeBlock(x=ui_multipleinputform.User_Inputs) { detailItemID=x[0]; familyID=x[1]; delete=x[2]; pushParam=x[3]; }
python_script = Python(IN[0]=code_block_14.detailItemID, IN[1]=code_block_14.familyID, IN[2]=code_block_14.delete, IN[3]=code_block_14.pushParam)  # IronPython2
# ---------- python_script.python (136 lines) ----------
# Load the Python Standard and DesignScript Libraries
import clr
import sys
import math
sys.path.append('C:\Program Files (x86)\IronPython 2.7\Lib')
import System
from System import Array
from System.Collections.Generic import *
clr.AddReference('ProtoGeometry')
from Autodesk.DesignScript.Geometry import *
clr.AddReference("RevitNodes")
import Revit
clr.ImportExtensions(Revit.Elements)
clr.ImportExtensions(Revit.GeometryConversion)
clr.AddReference("RevitServices")
import RevitServices
from RevitServices.Persistence import DocumentManager 
from RevitServices.Transactions import TransactionManager 

clr.AddReference("RevitAPI")
clr.AddReference("RevitAPIUI")

import Autodesk 
from Autodesk.Revit.DB import *
from Autodesk.Revit.UI import *


clr.AddReference('DSCoreNodes')
import DSCore
from DSCore import *

doc = DocumentManager.Instance.CurrentDBDocument
uiapp = DocumentManager.Instance.CurrentUIApplication 
app = uiapp.Application 
uidoc = uiapp.ActiveUIDocument

diTypeID = str(IN[0])
famTypeID = UnwrapElement(IN[1])
delDI = IN[2]
pushParam = IN[3]

diInActiveView = []
targetDIs = []
targetLocations = []
targetWs = []
targetLs = []
elementsCreated = []
elementsDeleted = []


# Collect all Detail Items from the active view
allCol = FilteredElementCollector(doc, doc.ActiveView.Id).WhereElementIsNotElementType().ToElements()
for el in allCol:
	i = UnwrapElement(el)
	cat = i.Category
	if cat:
		catName = cat.Name
		if catName == 'Detail Items':
			diInActiveView.append(i)
			
# collect the active view's associated level

#filter only the target detail Items
for i in diInActiveView:
	typeID = i.GetTypeId().ToString()
	if typeID == diTypeID:
		targetDIs.append(i)
		
# collect the active view's associated level
activeView = doc.ActiveView
activeLvlName = activeView.LookupParameter('Associated Level').AsString()
lvlCol = FilteredElementCollector(doc).OfCategory(BuiltInCategory.OST_Levels).WhereElementIsNotElementType().ToElements()
for lvl in lvlCol:
	name = lvl.Name
	if name == activeLvlName:
		activeLvl = lvl
		
# Get project base point ane the angle to north
bps = FilteredElementCollector(doc).OfClass(BasePoint).ToElements()
prjBP = bps[1]
prjBPAngle = round(prjBP.get_Parameter(BuiltInParameter.BASEPOINT_ANGLETON_PARAM).AsDouble() * 180/math.pi)
		
# get the location of the target detail items
for t in targetDIs:
	i = UnwrapElement(t)
	loc = i.Location.Point
	targetLocations.append(loc)
	# get W and L
	w = t.LookupParameter('Width').AsDouble()
	l = t.LookupParameter('Length').AsDouble()
	targetWs.append(w)
	targetLs.append(l)
	
# CREATE THE ELEMENTS !!!!
TransactionManager.Instance.EnsureInTransaction(doc)
for loc in targetLocations:
	nFam = doc.Create.NewFamilyInstance(loc, famTypeID, activeLvl,Structure.StructuralType.NonStructural)
	elementsCreated.append(nFam)
	nFam.LookupParameter('Elevation from Level').Set(0)
TransactionManager.Instance.TransactionTaskDone()	
	
# DELETE detail items in the active view
if delDI:
	TransactionManager.Instance.EnsureInTransaction(doc)
	for i in targetDIs:
		id = i.Id
		doc.Delete(id)
		elementsDeleted.append(id)
	TransactionManager.Instance.TransactionTaskDone()
	
# push the Width and Length parameter values
if pushParam:
	TransactionManager.Instance.EnsureInTransaction(doc)
	for e, w, l in zip(elementsCreated, targetWs, targetLs):
		try:
			e.LookupParameter('Width').Set(w)
		except:
			continue
		try:
			e.LookupParameter('Length').Set(l)
		except:
			continue	
			

			
			

			
			
	TransactionManager.Instance.TransactionTaskDone()
		




OUT = [elementsCreated, targetDIs, elementsDeleted, prjBPAngle]
# ----------------------------------------

# group: Processing
code_block_15 = CodeBlock(newFams=python_script, oldDetails=python_script, angle=python_script) { newFams[0]; oldDetails[1]; angle[3]; }
orientation = WombatDynamo.FamilyInstance.Orientation(familyInstance=code_block_15.out1)
code_block_16 = CodeBlock(angle=orientation.rotation, pbp_angle=code_block_15.out2) { -1*(angle-pbp_angle); }
setRotation = FamilyInstance.SetRotation(familyInstance=code_block_15.out0, degree=code_block_16)
