# Dynamo graph Areas From Rooms.dyn "Areas - Generate By Rooms_py" (Dynamo 2.12.1.8246)
# packages: Data-Shapes 2021.2.92

# group: Usage
code_block = CodeBlock { "Areas - By Rooms"; }
acg_script_usage = Custom[ACG Script Usage](scriptName=code_block)  # Adds an entry to Excel document every time a script is run. The document is located in S:\Dynamo\05-UsageStats

file_path = Filename("..\ACG_logo.png")
file_from_path = FileObject(path=file_path)
readFromFile = Image.ReadFromFile(file=file_from_path)

# group: Input
code_block_2 = CodeBlock { "Filter rooms by department : "; 0; }
python_script = Python()  # IronPython2
# ---------- python_script.python (40 lines) ----------
# Load the Python Standard and DesignScript Libraries
import clr
import sys
import os.path
from System import Environment
sys.path.append('C:\Program Files (x86)\IronPython 2.7\Lib')
import System
from System import Array
from System.Collections.Generic import *
clr.AddReference('ProtoGeometry')
from Autodesk.DesignScript.Geometry import *
clr.AddReference("RevitNodes")
import Revit
clr.ImportExtensions(Revit.Elements)
clr.ImportExtensions(Revit.GeometryConversion)
clr.AddReference("RevitServices")
import RevitServices
from RevitServices.Persistence import DocumentManager 
from RevitServices.Transactions import TransactionManager 
clr.AddReference("RevitAPI")
clr.AddReference("RevitAPIUI")
import Autodesk 
from Autodesk.Revit.DB import *
from Autodesk.Revit.UI import *

doc = DocumentManager.Instance.CurrentDBDocument
uiapp = DocumentManager.Instance.CurrentUIApplication 
app = uiapp.Application 
uidoc = uiapp.ActiveUIDocument

rooms = FilteredElementCollector(doc).OfCategory(BuiltInCategory.OST_Rooms).ToElements()

rDept = ['_All']

for r in rooms:
	deptValue = r.get_Parameter(BuiltInParameter.ROOM_DEPARTMENT).AsString()
	if deptValue not in rDept:
		if deptValue != None and deptValue != '':
			rDept.append(str(deptValue))
OUT = rDept
# ----------------------------------------
dropdown_data = Custom[DropDown Data](InputName=code_block_2.out0, Keys=python_script, Values=python_script, DefaultValueIndex=code_block_2.out1)  # package Data-Shapes; Create data for DropDown input in UI.MultiInputForm ++ . Check out www.data-shapes.net for more infos.

# group: Input
code_block_3 = CodeBlock { "Transfer name values : "; "Transfer number values : "; "Transfer tenure values : "; }
code_block_4 = CodeBlock { true; }
boolean_input = Custom[Boolean input](InputName=code_block_3.out0, DefaultValue=code_block_4)  # package Data-Shapes; Creates a boolean input for UI.MultipleInputForm ++ . Check out www.data-shapes.net for more infos!
boolean_input_2 = Custom[Boolean input](InputName=code_block_3.out1, DefaultValue=code_block_4)
boolean_input_3 = Custom[Boolean input](InputName=code_block_3.out2, DefaultValue=code_block_4)

# group: Input
code_block_5 = CodeBlock { true; "Generate"; "Cancel"; 250; 700; }
code_block_6 = CodeBlock { "Note:"; }
string = StringInput("""This tool will generate Areas on a single Area Plan view from existing rooms in the model. Make sure the Area Plan where the areas need to be created is the active view and the correct model phase is applied.
The rooms that will be processed can be filtered by department and their name, number and tenure values can be transferred to the newly created areas. To transfer the tenure value, make sure ACG_Unit Tenure parameter is assigned to both rooms and areas.""")
textnote_data = Custom[TextNote Data](Title=code_block_6, TextNote=string)  # package Data-Shapes; Create Data for TextNote input in UI.MultipleInputForm ++ . Check out www.data-shapes.net for more informations
list_create = List.Create(item0=textnote_data, item1=dropdown_data, item2=boolean_input, item3=boolean_input_2, item4=boolean_input_3)
multipleinputform = Custom[MultipleInputForm ++](Logo_optional=readFromFile, ButtonText_optional=code_block_5.out1, Inputs=list_create, Toggle=code_block_5.out0, CancelButtonText_optional=code_block_5.out2, Width_optional=code_block_5.out4, LabelWidth_optional=code_block_5.out3)  # package Data-Shapes; Create a form with multiple inputs. see www.data-shapes.net for tutorials and infos!
code_block_7 = CodeBlock(x=multipleinputform.User_Inputs) { department = x[0]; nameBool = x[1]; numberBool = x[2]; tenureBool = x[3]; }

# group: Visualisation
python_script_2 = Python(IN[0]=multipleinputform.Was_Cancelled, IN[1]=code_block_7.department, IN[2]=code_block_7.nameBool, IN[3]=code_block_7.numberBool, IN[4]=code_block_7.tenureBool)  # IronPython2
# ---------- python_script_2.python (100 lines) ----------
# Load the Python Standard and DesignScript Libraries
import clr
import sys
import os.path
from System import Environment
sys.path.append('C:\Program Files (x86)\IronPython 2.7\Lib')
import System
from System import Array
from System.Collections.Generic import *
clr.AddReference('ProtoGeometry')
from Autodesk.DesignScript.Geometry import *
clr.AddReference("RevitNodes")
import Revit
clr.ImportExtensions(Revit.Elements)
clr.ImportExtensions(Revit.GeometryConversion)
clr.AddReference("RevitServices")
import RevitServices
from RevitServices.Persistence import DocumentManager 
from RevitServices.Transactions import TransactionManager 
clr.AddReference("RevitAPI")
clr.AddReference("RevitAPIUI")
import Autodesk 
from Autodesk.Revit.DB import *
from Autodesk.Revit.UI import *

doc = DocumentManager.Instance.CurrentDBDocument
uiapp = DocumentManager.Instance.CurrentUIApplication 
app = uiapp.Application 
uidoc = uiapp.ActiveUIDocument

cancelled =			IN[0]
rDept =				IN[1]
transferName =		IN[2]
transferNumber =	IN[3]
transferTenure =	IN[4]


if rDept == None:
	rooms = FilteredElementCollector(doc, doc.ActiveView.Id).OfCategory(BuiltInCategory.OST_Rooms).ToElements()
else:
	paramId = ElementId(BuiltInParameter.ROOM_DEPARTMENT)
	filter = ElementParameterFilter(FilterStringRule(ParameterValueProvider(paramId), FilterStringEquals(), rDept))
	rooms = FilteredElementCollector(doc, doc.ActiveView.Id).OfCategory(BuiltInCategory.OST_Rooms).WherePasses(filter).ToElements()

view =	doc.ActiveView
lvl =	view.GenLevel


if cancelled == True:
	OUT = 'Error ! ', 'The script was cancelled.'
	
elif len(rooms) == 0:
	OUT = 'Error ! ', 'There are no rooms on the current level or/and in the current phase.'

elif cancelled == False and len(rooms) > 0:
	TransactionManager.Instance.EnsureInTransaction(doc)
	opt = SpatialElementBoundaryOptions()
	plane =	SketchPlane.Create(doc, lvl.Id)
	# CREATE THE AREA SEPARATION LINES
	curves, areaSeparators, areas = [], [], []
	count = 0
	for r in rooms:
		if r.Area > 0:
			rLocation = r.Location.Point
			name = r.LookupParameter('Name').AsString()
			number = r.LookupParameter('Number').AsString()
			tenure = r.LookupParameter('ACG_Unit Tenure').AsString()
			rBoundary = r.GetBoundarySegments(opt)
			dsBoundary = []
			for rLoop in rBoundary: # because room can be complex, with miltiple loops if there are holes inside
				dsLoop = []
				for rLine in rLoop:
					dsLine = Revit.GeometryConversion.RevitToProtoCurve.ToProtoType(rLine.GetCurve(), True)
					curves.append(dsLine)
			for curve in curves:
				areaSeparator = doc.Create.NewAreaBoundaryLine(plane, curve.ToRevitType(), view)
				areaSeparators.append(areaSeparator)
	# CREATE AREAS
			area = doc.Create.NewArea(view, UV(rLocation.X, rLocation.Y))
			count += 1
	# TRANSFER PARAMETR VALUES FROM ROOMS
			if transferName == True:
				try:
					area.LookupParameter('Name').Set(name)
				except:
					continue
			if transferNumber == True:
				try:
					area.LookupParameter('Number').Set(number)
				except:
					continue
			if transferTenure == True:
				try:
					area.LookupParameter('ACG_Unit Tenure').Set(tenure)
				except:
					continue
			
		
	TransactionManager.Instance.TransactionTaskDone()
	OUT = 'Success ! ', str(count) + ' areas were created in the active view.'
# ----------------------------------------
code_block_8 = CodeBlock(x=python_script_2) { true; title = x[0]; text = x[1]; }

# group: Assing
code_block_9 = CodeBlock { "Okay"; }
ui_textnote_data = Custom[UI.TextNote Data](Title=code_block_8.title, TextNote=code_block_8.text)  # package Data-Shapes; Create Data for TextNote input in UI.MultipleInputForm ++ . Check out www.data-shapes.net for more informations
ui_multipleinputform = Custom[UI.MultipleInputForm ++](Logo_optional=readFromFile, ButtonText_optional=code_block_9, Inputs=ui_textnote_data, Toggle=code_block_8.out0)  # package Data-Shapes; Create a form with multiple inputs. see www.data-shapes.net for tutorials and infos!
