# Dynamo graph Create Room Boundary Detail Lines.dyn (Dynamo 2.17.1.4055)
# packages: Data-Shapes 2021.2.92

# group: Usage
code_block = CodeBlock { "Romms - Create Boundary Lines"; }
acg_script_usage = Custom[ACG Script Usage](script_name=code_block)  # Adds an entry to TXT document every time a script is run. The document is located in R:\Dynamo\05-UsageStats

file_path = Filename("..\ACG_logo.png")
file_from_path = FileObject(path=file_path)
readFromFile = Image.ReadFromFile(file=file_from_path)

# group: Input
code_block_2 = CodeBlock { true; "Generate"; "Cancel"; 250; 700; }
code_block_3 = CodeBlock { "Note:"; }
string = StringInput("The tool will generate detail lines of a given line style for the boundaries of the selected room(s).")
textnote_data = Custom[TextNote Data](Title=code_block_3, TextNote=string)  # package Data-Shapes; Create Data for TextNote input in UI.MultipleInputForm ++ . Check out www.data-shapes.net for more informations
python_script = Python()  # IronPython2
# ---------- python_script.python (45 lines) ----------
# Load the Python Standard and DesignScript Libraries
import clr
import sys
import os.path
from System import Environment
sys.path.append('C:\Program Files (x86)\IronPython 2.7\Lib')
import System
from System import Array
from System.Collections.Generic import *
clr.AddReference('ProtoGeometry')
from Autodesk.DesignScript.Geometry import *
clr.AddReference("RevitNodes")
import Revit
clr.ImportExtensions(Revit.Elements)
clr.ImportExtensions(Revit.GeometryConversion)
clr.AddReference("RevitServices")
import RevitServices
from RevitServices.Persistence import DocumentManager 
from RevitServices.Transactions import TransactionManager 
clr.AddReference("RevitAPI")
clr.AddReference("RevitAPIUI")
import Autodesk 
from Autodesk.Revit.DB import *
from Autodesk.Revit.UI import *

doc = DocumentManager.Instance.CurrentDBDocument
uiapp = DocumentManager.Instance.CurrentUIApplication 
app = uiapp.Application 
uidoc = uiapp.ActiveUIDocument

styles = doc.Settings.Categories.get_Item(BuiltInCategory.OST_Lines)
subtypes = styles.SubCategories




graphicsStyleCategory = Category.GetCategory(doc, BuiltInCategory.OST_Lines).GetGraphicsStyle(GraphicsStyleType.Projection).GraphicsStyleCategory.SubCategories
lineStyles = [i.GetGraphicsStyle(GraphicsStyleType.Projection) for i in graphicsStyleCategory]


#NewLine.LineStyle=lStyle[0]


#OUT = [s.Name for s in subtypes], subtypes#[s.Id for s in subtypes]
OUT = [i.Name for i in lineStyles], [i.Id for i in lineStyles]
# ----------------------------------------
code_block_4 = CodeBlock(x=python_script) { "Select line style :"; 0; keys = x[0]; values = x[1]; }
dropdown_data = Custom[DropDown Data](InputName=code_block_4.out0, Keys=code_block_4.keys, Values=code_block_4.values, DefaultValueIndex=code_block_4.out1)  # package Data-Shapes; Create data for DropDown input in UI.MultiInputForm ++ . Check out www.data-shapes.net for more infos.
list_create = List.Create(item0=textnote_data, item1=dropdown_data)
multipleinputform = Custom[MultipleInputForm ++](Logo_optional=readFromFile, ButtonText_optional=code_block_2.out1, Inputs=list_create, Toggle=code_block_2.out0, CancelButtonText_optional=code_block_2.out2, Width_optional=code_block_2.out4, LabelWidth_optional=code_block_2.out3)  # package Data-Shapes; Create a form with multiple inputs. see www.data-shapes.net for tutorials and infos!
code_block_5 = CodeBlock(x=multipleinputform.User_Inputs) { lineStyle = x[0]; }

# group: Input
code_block_6 = CodeBlock { true; Revit.Elements.Category.ByName("Rooms"); "Room"; }

# group: Control
list_create_2 = List.Create(item0=code_block_6.out1, item1=multipleinputform.Was_Cancelled)
code_block_7 = CodeBlock(x=list_create_2) { x[0]; }

# group (continued): Input
ACGSelectModelElements = Custom[ACGSelectModelElements](refresh=code_block_6.out0, category=code_block_7, cancel=multipleinputform.Was_Cancelled)  # Taken from Rhythm - IsolatedPickModelElements and updated.

# group: Visualisation
python_script_2 = Python(IN[0]=multipleinputform.Was_Cancelled, IN[1]=ACGSelectModelElements, IN[2]=code_block_5)  # IronPython2
# ---------- python_script_2.python (68 lines) ----------
# Load the Python Standard and DesignScript Libraries
import clr
import sys
import os.path
from System import Environment
sys.path.append('C:\Program Files (x86)\IronPython 2.7\Lib')
import System
from System import Array
from System.Collections.Generic import *
clr.AddReference('ProtoGeometry')
from Autodesk.DesignScript.Geometry import *
clr.AddReference("RevitNodes")
import Revit
clr.ImportExtensions(Revit.Elements)
clr.ImportExtensions(Revit.GeometryConversion)
clr.AddReference("RevitServices")
import RevitServices
from RevitServices.Persistence import DocumentManager 
from RevitServices.Transactions import TransactionManager 
clr.AddReference("RevitAPI")
clr.AddReference("RevitAPIUI")
import Autodesk 
from Autodesk.Revit.DB import *
from Autodesk.Revit.UI import *

doc = DocumentManager.Instance.CurrentDBDocument
uiapp = DocumentManager.Instance.CurrentUIApplication 
app = uiapp.Application 
uidoc = uiapp.ActiveUIDocument

cancelled =		IN[0]
selection =		UnwrapElement(IN[1])
lineStyleId =	IN[2]


view =	doc.ActiveView
lineStyle = doc.GetElement(lineStyleId)

if cancelled == True:
	OUT = 'Error : ', 'The script was cancelled.', False
	
else:
	if len(selection) == 0:
		OUT = 'Error : ', 'No valid rooms in selection.', True
	else:
		TransactionManager.Instance.EnsureInTransaction(doc)
		opt = SpatialElementBoundaryOptions()
		# get the room boundaries
		curves, detailLines, validRooms = [], [], []
		for r in selection:
			if r.Area > 0.1:
				validRooms.append(r)
				rBoundary = r.GetBoundarySegments(opt)
				dsBoundary = []
				for rLoop in rBoundary: # because room can be complex, with miltiple loops if there are holes inside
					dsLoop = []
					for rLine in rLoop:
						dsLine = Revit.GeometryConversion.RevitToProtoCurve.ToProtoType(rLine.GetCurve(), True)
						curves.append(dsLine)
				# CREATE THE DETAIL LINES
				for curve in curves:
					detailLine = doc.Create.NewDetailCurve(view, curve.ToRevitType())
					detailLine.LineStyle = lineStyle
					detailLines.append(detailLine)
		count = len(validRooms)
		
		TransactionManager.Instance.TransactionTaskDone()
		OUT = 'Success ! ', 'Boundary lines for ' + str(count) + ' rooms were created in the active view.', True
# ----------------------------------------
code_block_8 = CodeBlock(x=python_script_2) { true; title = x[0]; text = x[1]; run = x[2]; }

# group: Assing
code_block_9 = CodeBlock { "Okay"; }
ui_textnote_data = Custom[UI.TextNote Data](Title=code_block_8.title, TextNote=code_block_8.text)  # package Data-Shapes; Create Data for TextNote input in UI.MultipleInputForm ++ . Check out www.data-shapes.net for more informations
ui_multipleinputform = Custom[UI.MultipleInputForm ++](Logo_optional=readFromFile, ButtonText_optional=code_block_9, Inputs=ui_textnote_data, Toggle=code_block_8.run)  # package Data-Shapes; Create a form with multiple inputs. see www.data-shapes.net for tutorials and infos!

# group: Assing
code_block_10 = CodeBlock { "Error : "; "The script was cancelled."; "Okay"; }
ui_textnote_data_2 = Custom[UI.TextNote Data](Title=code_block_10.out0, TextNote=code_block_10.out1)
ui_multipleinputform_2 = Custom[UI.MultipleInputForm ++](Logo_optional=readFromFile, ButtonText_optional=code_block_10.out2, Inputs=ui_textnote_data_2, Toggle=multipleinputform.Was_Cancelled)
