# Dynamo graph Identify Elements Outside Of Rooms.dyn (Dynamo 2.17.1.4055)
# packages: Data-Shapes 2021.2.92

# group: Usage
code_block = CodeBlock { "Rooms - Identify Elements Outside Rooms"; }
acg_script_usage = Custom[ACG Script Usage](script_name=code_block)  # Adds an entry to TXT document every time a script is run. The document is located in R:\Dynamo\05-UsageStats

# group: Input
code_block_2 = CodeBlock { "Note:"; }
string = StringInput("""This tool is to be used in conjunction with the NDSS Room Schedule script. It will identify any beds and "complete" elements (bathrooms, ensuites, kitchens) that are outside of rooms and isolate them in the active view and/or report their ID numbers.
Once the IDs are reported, users can use Revit's Select By ID tool (Manage tab) to find the elements.
Default 3D view in NIA Phase is most appropriate when isolating the elements.""")
textnote_data = Custom[TextNote Data](Title=code_block_2, TextNote=string)  # package Data-Shapes; Create Data for TextNote input in UI.MultipleInputForm ++ . Check out www.data-shapes.net for more informations

# group: Input
code_block_3 = CodeBlock { "Report IDs of elements."; "Isolate elements in active view."; true; }
ui_boolean_input = Custom[UI.Boolean input](InputName=code_block_3.out0, DefaultValue=code_block_3.out2)  # package Data-Shapes; Creates a boolean input for UI.MultipleInputForm ++ . Check out www.data-shapes.net for more infos!
ui_boolean_input_2 = Custom[UI.Boolean input](InputName=code_block_3.out1, DefaultValue=code_block_3.out2)

# group: Input
file_path = Filename("..\ACG_logo.png")
file_from_path = FileObject(path=file_path)
readFromFile = Image.ReadFromFile(file=file_from_path)
code_block_4 = CodeBlock { "Update accomodation schedule"; true; "Run"; "Cancel"; 700; 400; }
list_create = List.Create(item0=textnote_data, item1=ui_boolean_input, item2=ui_boolean_input_2)
multipleinputform = Custom[MultipleInputForm ++](Logo_optional=readFromFile, ButtonText_optional=code_block_4.out2, Inputs=list_create, Toggle=code_block_4.out1, CancelButtonText_optional=code_block_4.out3, Width_optional=code_block_4.out4, LabelWidth_optional=code_block_4.out5)  # package Data-Shapes; Create a form with multiple inputs. see www.data-shapes.net for tutorials and infos!

code_block_5 = CodeBlock()
# ---------- code_block_5.designscript (8 lines) ----------
[
"KitchenComplete",
"BathroomComplete",
"EnsuiteComplete",
"Powder",
"BedSingle",
"BedDouble"
];
# ----------------------------------------
code_block_6 = CodeBlock(x=multipleinputform.User_Inputs) { report = 		x[0]; isolate = 		x[1]; }

# group: Visualisation
python_script = Python(IN[0]=multipleinputform.Was_Cancelled, IN[1]=code_block_5, IN[2]=code_block_6.isolate)  # IronPython2
# ---------- python_script.python (67 lines) ----------
# Load the Python Standard and DesignScript Libraries
import clr
import sys
import os.path
from System import Environment
sys.path.append('C:\Program Files (x86)\IronPython 2.7\Lib')
import System
from System import Array
from System.Collections.Generic import *
clr.AddReference('ProtoGeometry')
from Autodesk.DesignScript.Geometry import *
clr.AddReference("RevitNodes")
import Revit
clr.ImportExtensions(Revit.Elements)
clr.ImportExtensions(Revit.GeometryConversion)
clr.AddReference("RevitServices")
import RevitServices
from RevitServices.Persistence import DocumentManager 
from RevitServices.Transactions import TransactionManager 
clr.AddReference("RevitAPI")
clr.AddReference("RevitAPIUI")
import Autodesk 
from Autodesk.Revit.DB import *
from Autodesk.Revit.UI import *

doc = DocumentManager.Instance.CurrentDBDocument
uiapp = DocumentManager.Instance.CurrentUIApplication 
app = uiapp.Application 
uidoc = uiapp.ActiveUIDocument

cancelled =		IN[0]
lookForList =	IN[1]
isolate =		IN[2]



view = doc.ActiveView
elsToProcess, idsFail, temp = [], [], []
listFail = ''

if cancelled == True:
	OUT = 'Error : ', 'The script was cancelled.'
	
else:
	# collect elements to process
	elements = FilteredElementCollector(doc).OfClass(FamilyInstance).ToElements()
	for element in elements:
		type = doc.GetElement(element.GetTypeId())
		for i in lookForList:
			if i in type.FamilyName:
				elsToProcess.append(element)
	# get the location and check if amy element is outside a room
	for i in elsToProcess:
		if doc.GetRoomAtPoint(i.Location.Point) == None:
			idsFail.append(i.Id)
			if len(idsFail) != 0: 
				typedIdsFail = List[ElementId](idsFail)
				listFail += str(i.Id) + '\n'
	if isolate == True and len(idsFail) > 0:
		TransactionManager.Instance.EnsureInTransaction(doc)
		view.IsolateElementsTemporary(typedIdsFail)
		TransactionManager.Instance.TransactionTaskDone()
	# outputs
	if len(idsFail) == 0:
		OUT = 'Success ! ', 'Excellent! All NDSS families are inside room.'
	else:
		OUT = 'Result : ', str(len(idsFail)) + ' NDSS families are outside of rooms. Please move before you update the NDSS schedule. \n' + listFail
# ----------------------------------------
code_block_7 = CodeBlock(x=python_script) { "Okay"; true; title = x[0]; text = x[1]; }

# group: Control
list_create_2 = List.Create(item0=code_block_7.out1, item1=python_script)
code_block_8 = CodeBlock(x=list_create_2) { x[0]; }

# group: Assing
ui_textnote_data = Custom[UI.TextNote Data](Title=code_block_7.title, TextNote=code_block_7.text)  # package Data-Shapes; Create Data for TextNote input in UI.MultipleInputForm ++ . Check out www.data-shapes.net for more informations
ui_multipleinputform = Custom[UI.MultipleInputForm ++](ButtonText_optional=code_block_7.out0, Inputs=ui_textnote_data, Toggle=code_block_8)  # package Data-Shapes; Create a form with multiple inputs. see www.data-shapes.net for tutorials and infos!

watch = Watch(multipleinputform.User_Inputs)
