# Dynamo graph Map NIA Rooms To GIA Units_d.dyn (Dynamo 2.17.1.4055)
# packages: Data-Shapes 2021.2.92, SteamNodes 1.2.3, Clockwork for Dynamo 1.x 1.0.3

file_path = Filename("..\ACG_logo.png")
file_from_path = FileObject(path=file_path)
readFromFile = Image.ReadFromFile(file=file_from_path)
code_block = CodeBlock { "Cancel"; true; "Execute"; 700; 350; }
code_block_2 = CodeBlock { "Note:"; true; }
string = StringInput("""This toll will map Room elements from "Unit GIA" phase to Room elements from "Room GIA" phase. The values of the Number parameter will be transferred as values of the Department parameter in the elements of "Room GIA" phase to allow grouping in schedules.

The tool also has the option to update the Number parameter of the elements in "Room GIA" phase.

For more information, please refer to the Revit Tutorials channel in MS Stream.""")
ui_textnote_data = Custom[UI.TextNote Data](Title=code_block_2.out0, TextNote=string)  # package Data-Shapes; Create Data for TextNote input in UI.MultipleInputForm ++ . Check out www.data-shapes.net for more informations

# group: Input
code_block_3 = CodeBlock { catR=Revit.Category.ByName("Rooms"); allR=ElementQueries.OfCategory(catR); "Department"; }
getParameterValueByName = Element.GetParameterValueByName(element=code_block_3.allR, parameterName=code_block_3.out2)
code_block_4 = CodeBlock(deprt=getParameterValueByName) { "Select rooms of Department (flats)."; DSCore.List.UniqueItems(deprt); }
code_block_5 = CodeBlock { "None"; }
code_block_6 = CodeBlock(value=code_block_4.out1, a=code_block_5, b=code_block_4.out1) { value==""?a:b; }
code_block_7 = CodeBlock { false; 400; }
listview_data = Custom[Listview Data](InputName=code_block_4.out0, Keys=code_block_6, Values=code_block_6, Height_optionnal=code_block_7.out1, ShowId_optionnal=code_block_7.out0)  # package Data-Shapes; Create data for ListView input in UI.MultiInputForm ++ . Check out www.data-shapes.net for more infos.

# group: Processing
code_block_8 = CodeBlock { DSCore.Types.FindTypeByNameInAssembly("Phase","RevitAPI"); }
all_elements_of_type = ElementsOfType(element_type=code_block_8)
code_block_9 = CodeBlock(ph=all_elements_of_type) { "Select unit GIA phase (flats)"; ph; ph.Name; }
dropdown_data = Custom[DropDown Data](InputName=code_block_9.out0, Keys=code_block_9.out2, Values=code_block_9.out2)  # package Data-Shapes; Create data for DropDown input in UI.MultiInputForm ++ . Check out www.data-shapes.net for more infos.

# group: Processing
code_block_10 = CodeBlock { DSCore.Types.FindTypeByNameInAssembly("Phase","RevitAPI"); }
all_elements_of_type_2 = ElementsOfType(element_type=code_block_10)
code_block_11 = CodeBlock(ph=all_elements_of_type_2) { "Select unit NIA phase (rooms)"; ph; ph.Name; }
dropdown_data_2 = Custom[DropDown Data](InputName=code_block_11.out0, Keys=code_block_11.out2, Values=code_block_11.out2)

# group: Input
code_block_12 = CodeBlock { "Update Room numbers (order by size)."; false; }
boolean_input = Custom[Boolean input](InputName=code_block_12.out0, DefaultValue=code_block_12.out1)  # package Data-Shapes; Creates a boolean input for UI.MultipleInputForm ++ . Check out www.data-shapes.net for more infos!

# group: Input
code_block_13 = CodeBlock { "Numerical room indicator."; true; }
boolean_input_2 = Custom[Boolean input](InputName=code_block_13.out0, DefaultValue=code_block_13.out1)

# group: Input
code_block_14 = CodeBlock { "Assign NIA value to GIA room elements."; true; }
boolean_input_3 = Custom[Boolean input](InputName=code_block_14.out0, DefaultValue=code_block_14.out1)

list_create = List.Create(item0=ui_textnote_data, item1=listview_data, item2=dropdown_data, item3=dropdown_data_2, item4=boolean_input, item5=boolean_input_2, item6=boolean_input_3)
flatten = List.Flatten(list=list_create)
ui_multipleinputform = Custom[UI.MultipleInputForm ++](Logo_optional=readFromFile, ButtonText_optional=code_block.out2, Inputs=flatten, Toggle=code_block.out1, CancelButtonText_optional=code_block.out0, Width_optional=code_block.out3, LabelWidth_optional=code_block.out4)  # package Data-Shapes; Create a form with multiple inputs. see www.data-shapes.net for tutorials and infos!
code_block_15 = CodeBlock(x=ui_multipleinputform.User_Inputs) { department=x[0]; unitPhaseName=x[1]; roomPhaseName=x[2]; renameRooms=x[3]; numIndicator=x[4]; pushNIA=x[5]; }

# group: Input
python_script = Python()  # IronPython2
# ---------- python_script.python (38 lines) ----------
# Load the Python Standard and DesignScript Libraries
import clr
import sys
import os.path
from System import Environment
sys.path.append('C:\Program Files (x86)\IronPython 2.7\Lib')
import System
from System import Array
from System.Collections.Generic import *
clr.AddReference('ProtoGeometry')
from Autodesk.DesignScript.Geometry import *
clr.AddReference("RevitNodes")
import Revit
clr.ImportExtensions(Revit.Elements)
clr.ImportExtensions(Revit.GeometryConversion)
clr.AddReference("RevitServices")
import RevitServices
from RevitServices.Persistence import DocumentManager 
from RevitServices.Transactions import TransactionManager 
clr.AddReference("RevitAPI")
clr.AddReference("RevitAPIUI")
import Autodesk 
from Autodesk.Revit.DB import *
from Autodesk.Revit.UI import *

doc = DocumentManager.Instance.CurrentDBDocument
uiapp = DocumentManager.Instance.CurrentUIApplication 
app = uiapp.Application 
uidoc = uiapp.ActiveUIDocument

all_rooms = FilteredElementCollector(doc)\
.OfCategory(BuiltInCategory.OST_Rooms)\
.WhereElementIsNotElementType().ToElements()

valid_rooms = [r for r in all_rooms if r.Area > 0]
phases = [r.get_Parameter(BuiltInParameter.ROOM_PHASE).AsValueString() for r in valid_rooms]
		
OUT = valid_rooms, phases
# ----------------------------------------
code_block_16 = CodeBlock(x=python_script) { rooms = x[0]; phase_names = x[1]; }

# group: Filtering
eq = code_block_16.phase_names == code_block_15.roomPhaseName
# note: filter rooms from specified phase
filterByBoolMask = List.FilterByBoolMask(list=code_block_16.rooms, mask=eq)

# group: Filtering
eq_2 = code_block_16.phase_names == code_block_15.unitPhaseName
# note: filter units from specified phase
filterByBoolMask_2 = List.FilterByBoolMask(list=code_block_16.rooms, mask=eq_2)
code_block_17 = CodeBlock { "Department"; }
getParameterValueByName_2 = Element.GetParameterValueByName(element=filterByBoolMask_2.in, parameterName=code_block_17)
eq_3 = getParameterValueByName_2 == code_block_15.department  # lacing=CrossProduct
# note: filter units from specified department
anyTrue = List.AnyTrue(list=eq_3@@L2)
filterByBoolMask_3 = List.FilterByBoolMask(list=filterByBoolMask_2.in, mask=anyTrue)

# group: Processing
# note: Get room location
getLocation = Element.GetLocation(element=filterByBoolMask.in)
isNull = Object.IsNull(object=getLocation)
filterByBoolMask_4 = List.FilterByBoolMask(list=getLocation, mask=isNull)

# group: Processing
count = List.Count(list=filterByBoolMask_3.in)
ofRepeatedItem = List.OfRepeatedItem(item=filterByBoolMask.in, amount=count)
# note: Group ind. rooms as per their flat rooms
isInsideRoom = Room.IsInsideRoom(room=filterByBoolMask_3.in@L1, point=filterByBoolMask_4.out, lacing=CrossProduct)
filterByBoolMask_5 = List.FilterByBoolMask(list=ofRepeatedItem@L2, mask=isInsideRoom@L2)

# group: Processing
area = Room.Area()  # unwired: room
# note: sort rooms by area
sortByFunction = List.SortByFunction(list=filterByBoolMask_5.in@@L2, sortFunction=area)
reverse = List.Reverse(list=sortByFunction@@L2)

# group: Control
runMe = Custom[Tool.RunMe](Boolean=code_block_15.renameRooms, ThingToDo=reverse)  # package SteamNodes; Use Boolean to perform an action

# group: Processing
code_block_18 = CodeBlock { "Number"; }
# note: collect filtered unit numbers
getParameterValueByName_3 = Element.GetParameterValueByName(element=filterByBoolMask_3.in, parameterName=code_block_18)

# group: Processing
count_2 = List.Count(list=filterByBoolMask_5.in@@L2)
# note: assemble number for each individual room (in ordes of creation/random)
code_block_19 = CodeBlock(count=count_2) { 1..count; }
code_block_20 = CodeBlock(n=code_block_19) { n+1; true; }
fromNumber = Custom[Character.FromNumber](n=code_block_20.out0, upperCase=code_block_20.out1)  # package Clockwork for Dynamo 1.x; Converts a number into a character (where 1 = A, 2 = B, ... , 27 = AA, 28 = AB etc.).
code_block_21 = CodeBlock(x=code_block_15.numIndicator, a=code_block_19, b=fromNumber) { x?a:b; }

code_block_22 = CodeBlock(roomNumb=getParameterValueByName_3, ind=code_block_21) { "Number"; roomNumb+"-"+ind; }

# group: Visualisation
setParameterByName = Element.SetParameterByName(element=runMe, parameterName=code_block_22.out0, value=code_block_22.out1)

# group: Usage
code_block_23 = CodeBlock { "Rooms - Map Rooms To Units"; }
acg_script_usage = Custom[ACG Script Usage](script_name=code_block_23)  # Adds an entry to TXT document every time a script is run. The document is located in R:\Dynamo\05-UsageStats

code_block_24 = CodeBlock(rooms=filterByBoolMask_5.in) { rooms; }

# group: Processing
code_block_25 = CodeBlock { "ACG_M Category"; "ACG_Unit Tenure"; }
getParameterValueByName_4 = Element.GetParameterValueByName(element=filterByBoolMask_3.in, parameterName=code_block_25.out1)
getParameterValueByName_5 = Element.GetParameterValueByName(element=filterByBoolMask_3.in, parameterName=code_block_25.out0)

# group: Visualisation
count_3 = List.Count(list=code_block_24@L2)
ofRepeatedItem_2 = List.OfRepeatedItem(item=getParameterValueByName_4@L1, amount=count_3@@L1)
setParameterByName_2 = Element.SetParameterByName(element=code_block_24, parameterName=code_block_25.out1, value=ofRepeatedItem_2)
ofRepeatedItem_3 = List.OfRepeatedItem(item=getParameterValueByName_5@L1, amount=count_3@@L1)
setParameterByName_3 = Element.SetParameterByName(element=code_block_24, parameterName=code_block_25.out0, value=ofRepeatedItem_3)

code_block_26 = CodeBlock { "ACG_Unit NI Area"; }
code_block_27 = CodeBlock(flatNumber=getParameterValueByName_3) { "Department"; flatNumber; }

# group: Visualisation
count_4 = List.Count(list=code_block_24@L2)
ofRepeatedItem_4 = List.OfRepeatedItem(item=code_block_27.flatNumber@L1, amount=count_4@@L1)
setParameterByName_4 = Element.SetParameterByName(element=code_block_24, parameterName=code_block_27.out0, value=ofRepeatedItem_4)

# group: Processing
flatten_2 = List.Flatten(list=setParameterByName_4)
code_block_28 = CodeBlock { "Department"; }
getParameterValueByName_6 = Element.GetParameterValueByName(element=flatten_2, parameterName=code_block_28)
groupByKey = List.GroupByKey(list=flatten_2, keys=getParameterValueByName_6)
area_2 = Room.Area(room=groupByKey.groups)
sum = Math.Sum(values=area_2@L3)
flatten_3 = List.Flatten(list=sum)

# group: Processing
byKeysValues = DesignScript.Builtin.Dictionary.ByKeysValues(keys=groupByKey.uniqueKeys, values=flatten_3)
code_block_29 = CodeBlock { "Number"; }
getParameterValueByName_7 = Element.GetParameterValueByName(element=filterByBoolMask_3.in, parameterName=code_block_29)
valueAtKey = DesignScript.Builtin.Dictionary.ValueAtKey(dictionary=byKeysValues, key=getParameterValueByName_7)
code_block_30 = CodeBlock { 0; }
code_block_31 = CodeBlock(value=valueAtKey, a=code_block_30, b=valueAtKey) { value==null?a:b; }

runMe_2 = Custom[Tool.RunMe](Boolean=code_block_15.pushNIA, ThingToDo=code_block_31)

# group: Visualisation
setParameterByName_5 = Element.SetParameterByName(element=filterByBoolMask_3.in, parameterName=code_block_26, value=runMe_2)
