# Dynamo graph Map Room Content Data_d.dyn (Dynamo 2.17.1.4055)
# packages: Data-Shapes 2021.2.92, Genius Loci 2021.2.3, SteamNodes 1.2.3

# group: Usage
code_block = CodeBlock { "Rooms - Map Content Data"; }
acg_script_usage = Custom[ACG Script Usage](script_name=code_block)  # Adds an entry to TXT document every time a script is run. The document is located in R:\Dynamo\05-UsageStats

# group: Usage > Input
code_block_2 = CodeBlock { "Note:"; }
string = StringInput("""This tool will read the content of the units and write report them as Room parameters. Please make sure that the required shared parameters are loaded into the model before running the tool:
ACG_Unit_Kitchen Family
ACG_Unit_Kitchen Type  
ACG_Unit_Bathroom Family  
ACG_Unit_Bathroom Type  
ACG_Unit_Bathroom Mirrored
ACG_Unit_Ensuite Family  
ACG_Unit_Ensuite Type  
ACG_Unit_Ensuite Mirrored
ACG_Unit_Powder Room Family  
ACG_Unit_Powder Room Family
To identify the content above, the tool will be searching for Generic Model, Casework and Furniture families which names contain “KitchenComplete”, “BathroomComplete”, “EnsuiteComplete”, “PowderRoom”
For more detailed information on how the tool works please refer to the Revit Tutorials on MS Stream or speak with IP.
""")
textnote_data = Custom[TextNote Data](Title=code_block_2, TextNote=string)  # package Data-Shapes; Create Data for TextNote input in UI.MultipleInputForm ++ . Check out www.data-shapes.net for more informations

# group: Input
code_block_3 = CodeBlock { catR=Revit.Category.ByName("Rooms"); allR=ElementQueries.OfCategory(catR); "Department"; }
getParameterValueByName = Element.GetParameterValueByName(element=code_block_3.allR, parameterName=code_block_3.out2)
code_block_4 = CodeBlock(deps=getParameterValueByName) { "Filter room elements by Department."; DSCore.List.UniqueItems(deps); false; }
code_block_5 = CodeBlock(value=code_block_4.out1) { value; value==""; "none"; }
code_block_6 = CodeBlock(x=code_block_5.out1, a=code_block_5.out2, b=code_block_5.value) { x?a:b; }
dropdown_data = Custom[DropDown Data](InputName=code_block_4.out0, Keys=code_block_6, Values=code_block_6, Sorted_optional=code_block_4.out2)  # package Data-Shapes; Create data for DropDown input in UI.MultiInputForm ++ . Check out www.data-shapes.net for more infos.

# group: Processing
code_block_7 = CodeBlock { DSCore.Types.FindTypeByNameInAssembly("Phase","RevitAPI"); }
all_elements_of_type = ElementsOfType(element_type=code_block_7)
code_block_8 = CodeBlock(ph=all_elements_of_type) { "Select unit GIA phase."; ph; ph.Name; }
dropdown_data_2 = Custom[DropDown Data](InputName=code_block_8.out0, Keys=code_block_8.out2, Values=code_block_8.out2)

# group: Input
code_block_9 = CodeBlock { "Process kitchens."; "Process bathrooms."; "Process ensuites."; "Process powder rooms."; true; }
ui_boolean_input = Custom[UI.Boolean input](InputName=code_block_9.out0, DefaultValue=code_block_9.out4)  # package Data-Shapes; Creates a boolean input for UI.MultipleInputForm ++ . Check out www.data-shapes.net for more infos!
ui_boolean_input_2 = Custom[UI.Boolean input](InputName=code_block_9.out1, DefaultValue=code_block_9.out4)
ui_boolean_input_3 = Custom[UI.Boolean input](InputName=code_block_9.out2, DefaultValue=code_block_9.out4)
ui_boolean_input_4 = Custom[UI.Boolean input](InputName=code_block_9.out3, DefaultValue=code_block_9.out4)

# group: Input
file_path = Filename("..\ACG_logo.png")
file_from_path = FileObject(path=file_path)
readFromFile = Image.ReadFromFile(file=file_from_path)
code_block_10 = CodeBlock { "Update accomodation schedule"; true; "Run"; "Cancel"; 700; 400; }
list_create = List.Create(item0=textnote_data, item1=dropdown_data, item2=dropdown_data_2, item3=ui_boolean_input, item4=ui_boolean_input_2, item5=ui_boolean_input_3, item6=ui_boolean_input_4)
ui_multipleinputform = Custom[UI.MultipleInputForm ++](Logo_optional=readFromFile, ButtonText_optional=code_block_10.out2, Inputs=list_create, Toggle=code_block_10.out1, CancelButtonText_optional=code_block_10.out3, Width_optional=code_block_10.out4, LabelWidth_optional=code_block_10.out5)  # package Data-Shapes; Create a form with multiple inputs. see www.data-shapes.net for tutorials and infos!

code_block_11 = CodeBlock(x=ui_multipleinputform.User_Inputs) { departments=x[0]; phase=x[1]; runKitchens=x[2]; RunBathrooms=x[3]; runEnsuites=x[4]; runPowderRooms=x[5]; }
code_block_12 = CodeBlock { catR=Revit.Category.ByName("Rooms"); allR=ElementQueries.OfCategory(catR); "Department"; "Phase"; }

# group: Input
# note: collect all rooms in the model and the name of their phase
getParameterValueByName_2 = Element.GetParameterValueByName(element=code_block_12.allR, parameterName=code_block_12.out3)
code_block_13 = CodeBlock(ph=getParameterValueByName_2) { ph.Name; }
code_block_14 = CodeBlock(phase=code_block_11.phase, input=code_block_13) { phase==input; }
filterByBoolMask = List.FilterByBoolMask(list=code_block_12.allR, mask=code_block_14)

# group: Input
getParameterValueByName_3 = Element.GetParameterValueByName(element=filterByBoolMask.in, parameterName=code_block_12.out2)
code_block_15 = CodeBlock(dept=getParameterValueByName_3, input=code_block_11.departments) { dept==input; }
filterByBoolMask_2 = List.FilterByBoolMask(list=filterByBoolMask.in, mask=code_block_15)

# group: Filtering
area = Room.Area(room=filterByBoolMask_2.in)
# note: filter out redundant rooms
code_block_16 = CodeBlock(area=area) { area>0; }
filterByBoolMask_3 = List.FilterByBoolMask(list=filterByBoolMask_2.in, mask=code_block_16)

# group: Control
code_block_17 = CodeBlock { "ACG_Unit Type"; " "; }
# note: Erase ACG_Unit Type values from all rooms that are going to be processed.
setParameterByName = Element.SetParameterByName(element=filterByBoolMask_3.in, parameterName=code_block_17.out0, value=code_block_17.out1)

# group: Visualisation
# note: Rooms that are going to be processed !!!!!
code_block_18 = CodeBlock(selectedRooms=setParameterByName) { selectedRooms; }

# group: Input
code_block_19 = CodeBlock()
# ---------- code_block_19.designscript (5 lines) ----------
[
"Generic Models",
"Casework",
"Furniture"
];
# ----------------------------------------
allElementsByCategoryName = Custom[Element.AllElementsByCategoryName](category_name=code_block_19)  # Collects all elements of a given category name.
flatten = List.Flatten(list=allElementsByCategoryName)
code_block_20 = CodeBlock()
# ---------- code_block_20.designscript (6 lines) ----------
[
"KitchenComplete",
"BathroomComplete",
"EnsuiteComplete",
"Powder"
];
# ----------------------------------------

# group: Processing
# note: Element.FamilyName +++
python_script = Python(IN[0]=flatten, IN[1]=code_block_20)  # IronPython2
# ---------- python_script.python (54 lines) ----------
import clr
import sys
sys.path.append('C:\Program Files (x86)\IronPython 2.7\Lib')
import System
from System import Array
from System.Collections.Generic import *
clr.AddReference('ProtoGeometry')
from Autodesk.DesignScript.Geometry import *
clr.AddReference("RevitNodes")
import Revit
clr.ImportExtensions(Revit.Elements)
clr.ImportExtensions(Revit.GeometryConversion)
clr.AddReference("RevitServices")
import RevitServices
from RevitServices.Persistence import DocumentManager 
from RevitServices.Transactions import TransactionManager 

clr.AddReference("RevitAPI")
clr.AddReference("RevitAPIUI")

import Autodesk 
from Autodesk.Revit.DB import *
from Autodesk.Revit.UI import *

doc = DocumentManager.Instance.CurrentDBDocument
uiapp = DocumentManager.Instance.CurrentUIApplication 
app = uiapp.Application 
uidoc = uiapp.ActiveUIDocument

#######OK NOW YOU CAN CODE########

elements = UnwrapElement(IN[0])
codes = IN[1]

fam_names, valid_fams = [], []

for e in elements:
    try:
        fam_names.append(e.Symbol.Family.Name)
        valid_fams.append(e)
    except:
        continue

output = []

for code in codes:
    lst = []
    for fam in valid_fams:
        if code in fam.Symbol.Family.Name:
            lst.append(fam)
    output.append(lst)


OUT = output
# ----------------------------------------
code_block_21 = CodeBlock(x=python_script) { ktchn=x[0]; bth=x[1]; enst=x[2]; pwdrRoom=x[3]; }

# group: Processing - KITCHENS
# note: Element.FamilyName
python_script_2 = Python(IN[0]=code_block_21.ktchn)  # IronPython2
# ---------- python_script_2.python (42 lines) ----------
import clr
import sys
sys.path.append('C:\Program Files (x86)\IronPython 2.7\Lib')
import System
from System import Array
from System.Collections.Generic import *
clr.AddReference('ProtoGeometry')
from Autodesk.DesignScript.Geometry import *
clr.AddReference("RevitNodes")
import Revit
clr.ImportExtensions(Revit.Elements)
clr.ImportExtensions(Revit.GeometryConversion)
clr.AddReference("RevitServices")
import RevitServices
from RevitServices.Persistence import DocumentManager 
from RevitServices.Transactions import TransactionManager 

clr.AddReference("RevitAPI")
clr.AddReference("RevitAPIUI")

import Autodesk 
from Autodesk.Revit.DB import *
from Autodesk.Revit.UI import *

doc = DocumentManager.Instance.CurrentDBDocument
uiapp = DocumentManager.Instance.CurrentUIApplication 
app = uiapp.Application 
uidoc = uiapp.ActiveUIDocument

#######OK NOW YOU CAN CODE########

elements = UnwrapElement(IN[0])

fam_names = []

for e in elements:
    try:
        fam_names.append(e.Symbol.Family.Name)
    except:
        continue

OUT = fam_names
# ----------------------------------------
code_block_22 = CodeBlock(ktchn=code_block_21.ktchn) { ktchn; "Type Mark"; ktchn.Type; }
getLocation = Element.GetLocation(element=code_block_22.ktchn)
isInsideRoom = Room.IsInsideRoom(room=code_block_18, point=getLocation, lacing=CrossProduct)
code_block_23 = CodeBlock { true; }
indexOf = List.IndexOf(list=isInsideRoom@L2, element=code_block_23)
getItemAtIndex = List.GetItemAtIndex(list=python_script_2, index=indexOf)
getParameterValueByName_4 = Element.GetParameterValueByName(element=code_block_22.out2, parameterName=code_block_22.out1)
getItemAtIndex_2 = List.GetItemAtIndex(list=getParameterValueByName_4, index=indexOf)

# group: Visualisation
runMe = Custom[Tool.RunMe](Boolean=code_block_11.runKitchens, ThingToDo=code_block_18)  # package SteamNodes; Use Boolean to perform an action
list_create_2 = List.Create(item0=getItemAtIndex, item1=getItemAtIndex_2)
code_block_24 = CodeBlock(value=list_create_2)
# ---------- code_block_24.designscript (5 lines) ----------
[
"ACG_Unit_Kitchen Family",
"ACG_Unit_Kitchen Type"
];
value==null?"N/A":value;
# ----------------------------------------
setParameterByName_2 = Element.SetParameterByName(element=runMe, parameterName=code_block_24.out0@L1, value=code_block_24.out1@L2)

# group: Processing - BATHROOM
# note: Element.FamilyName
python_script_3 = Python(IN[0]=code_block_21.bth)  # IronPython2; same code as python_script_2
code_block_25 = CodeBlock(bth=code_block_21.bth) { bth; "Type Mark"; bth.Type; }
getLocation_2 = Element.GetLocation(element=code_block_25.bth)
isInsideRoom_2 = Room.IsInsideRoom(room=code_block_18, point=getLocation_2, lacing=CrossProduct)
code_block_26 = CodeBlock { true; }
indexOf_2 = List.IndexOf(list=isInsideRoom_2@L2, element=code_block_26)
getItemAtIndex_3 = List.GetItemAtIndex(list=python_script_3, index=indexOf_2)
getParameterValueByName_5 = Element.GetParameterValueByName(element=code_block_25.out2, parameterName=code_block_25.out1)
getItemAtIndex_4 = List.GetItemAtIndex(list=getParameterValueByName_5, index=indexOf_2)

# group: Visualisation
runMe_2 = Custom[Tool.RunMe](Boolean=code_block_11.RunBathrooms, ThingToDo=code_block_18)
list_create_3 = List.Create(item0=getItemAtIndex_3, item1=getItemAtIndex_4)
code_block_27 = CodeBlock(value=list_create_3)
# ---------- code_block_27.designscript (5 lines) ----------
[
"ACG_Unit_Bathroom Family",
"ACG_Unit_Bathroom Type"
];
value==null?"N/A":value;
# ----------------------------------------
setParameterByName_3 = Element.SetParameterByName(element=runMe_2, parameterName=code_block_27.out0@L1, value=code_block_27.out1@L2)

# group: Processing - ENSUITE
# note: Element.FamilyName
python_script_4 = Python(IN[0]=code_block_21.enst)  # IronPython2; same code as python_script_2
code_block_28 = CodeBlock(enst=code_block_21.enst) { enst; "Type Mark"; enst.Type; }
getLocation_3 = Element.GetLocation(element=code_block_28.enst)
isInsideRoom_3 = Room.IsInsideRoom(room=code_block_18, point=getLocation_3, lacing=CrossProduct)
code_block_29 = CodeBlock { true; }
indexOf_3 = List.IndexOf(list=isInsideRoom_3@L2, element=code_block_29)
getItemAtIndex_5 = List.GetItemAtIndex(list=python_script_4, index=indexOf_3)
getParameterValueByName_6 = Element.GetParameterValueByName(element=code_block_28.out2, parameterName=code_block_28.out1)
getItemAtIndex_6 = List.GetItemAtIndex(list=getParameterValueByName_6, index=indexOf_3)

# group: Visualisation
runMe_3 = Custom[Tool.RunMe](Boolean=code_block_11.runEnsuites, ThingToDo=code_block_18)
list_create_4 = List.Create(item0=getItemAtIndex_5, item1=getItemAtIndex_6)
code_block_30 = CodeBlock(value=list_create_4)
# ---------- code_block_30.designscript (5 lines) ----------
[
"ACG_Unit_Ensuite Family",
"ACG_Unit_Ensuite Type"
];
value==null?"N/A":value;
# ----------------------------------------
setParameterByName_4 = Element.SetParameterByName(element=runMe_3, parameterName=code_block_30.out0@L1, value=code_block_30.out1@L2)

# group: Processing - POWDER ROOMS
# note: Element.FamilyName
python_script_5 = Python(IN[0]=code_block_21.pwdrRoom)  # IronPython2; same code as python_script_2
code_block_31 = CodeBlock(pwdr=code_block_21.pwdrRoom) { pwdr; "Type Mark"; pwdr.Type; }
getLocation_4 = Element.GetLocation(element=code_block_31.pwdr)
isInsideRoom_4 = Room.IsInsideRoom(room=code_block_18, point=getLocation_4, lacing=CrossProduct)
code_block_32 = CodeBlock { true; }
indexOf_4 = List.IndexOf(list=isInsideRoom_4@L2, element=code_block_32)
getItemAtIndex_7 = List.GetItemAtIndex(list=python_script_5, index=indexOf_4)
getParameterValueByName_7 = Element.GetParameterValueByName(element=code_block_31.out2, parameterName=code_block_31.out1)
getItemAtIndex_8 = List.GetItemAtIndex(list=getParameterValueByName_7, index=indexOf_4)

# group: Visualisation
runMe_4 = Custom[Tool.RunMe](Boolean=code_block_11.runPowderRooms, ThingToDo=code_block_18)
list_create_5 = List.Create(item0=getItemAtIndex_7, item1=getItemAtIndex_8)
code_block_33 = CodeBlock(value=list_create_5)
# ---------- code_block_33.designscript (5 lines) ----------
[
"ACG_Unit_Powder Room Family",
"ACG_Unit_Powder Room Type"
];
value==null?"N/A":value;
# ----------------------------------------
setParameterByName_5 = Element.SetParameterByName(element=runMe_4, parameterName=code_block_33.out0@L1, value=code_block_33.out1@L2)

code_block_34 = CodeBlock(rooms=code_block_18) { rooms; }

# group: Processing - MIRRORED ENSUITES
familyinstance_get_mirrored = Custom[FamilyInstance Get Mirrored](familyInstance=code_block_21.enst)  # package Genius Loci; Gets the mirrored family instances.
getLocation_5 = Element.GetLocation(element=familyinstance_get_mirrored.Mirrored)
isInsideRoom_5 = Room.IsInsideRoom(room=code_block_34, point=getLocation_5, lacing=CrossProduct)
code_block_35 = CodeBlock { true; }
indexOf_5 = List.IndexOf(list=isInsideRoom_5@L2, element=code_block_35)
getItemAtIndex_9 = List.GetItemAtIndex(list=code_block_34, index=indexOf_5)
getLocation_6 = Element.GetLocation(element=familyinstance_get_mirrored.Others)
isInsideRoom_6 = Room.IsInsideRoom(room=code_block_34, point=getLocation_6, lacing=CrossProduct)
indexOf_6 = List.IndexOf(list=isInsideRoom_6@L2, element=code_block_35)
getItemAtIndex_10 = List.GetItemAtIndex(list=code_block_34, index=indexOf_6)

# group: Processing
anyTrue = List.AnyTrue(list=isInsideRoom_5@L2)
filterByBoolMask_4 = List.FilterByBoolMask(list=code_block_34, mask=anyTrue)
anyTrue_2 = List.AnyTrue(list=isInsideRoom_6@L2)
filterByBoolMask_5 = List.FilterByBoolMask(list=code_block_34, mask=anyTrue_2)
list_create_6 = List.Create(item0=filterByBoolMask_4.in, item1=filterByBoolMask_5.in)
flatten_2 = List.Flatten(list=list_create_6)
setDifference = List.SetDifference(list1=code_block_34, list2=flatten_2)

# group: Processing - MIRRORED BATHROOMS
familyinstance_get_mirrored_2 = Custom[FamilyInstance Get Mirrored](familyInstance=code_block_21.bth)
getLocation_7 = Element.GetLocation(element=familyinstance_get_mirrored_2.Mirrored)
isInsideRoom_7 = Room.IsInsideRoom(room=code_block_34, point=getLocation_7, lacing=CrossProduct)
getLocation_8 = Element.GetLocation(element=familyinstance_get_mirrored_2.Others)
isInsideRoom_8 = Room.IsInsideRoom(room=code_block_34, point=getLocation_8, lacing=CrossProduct)

# group: Processing
anyTrue_3 = List.AnyTrue(list=isInsideRoom_7@L2)
filterByBoolMask_6 = List.FilterByBoolMask(list=code_block_34, mask=anyTrue_3)
anyTrue_4 = List.AnyTrue(list=isInsideRoom_8@L2)
filterByBoolMask_7 = List.FilterByBoolMask(list=code_block_34, mask=anyTrue_4)
list_create_7 = List.Create(item0=filterByBoolMask_6.in, item1=filterByBoolMask_7.in)
flatten_3 = List.Flatten(list=list_create_7)
setDifference_2 = List.SetDifference(list1=code_block_34, list2=flatten_3)

# group: Visualisation
list_create_8 = List.Create(item0=filterByBoolMask_4.in, item1=filterByBoolMask_5.in, item2=setDifference)
code_block_36 = CodeBlock()
# ---------- code_block_36.designscript (7 lines) ----------
"ACG_Unit_Ensuite Mirrored";

[
"✓",
"✕",
"N/A"
];
# ----------------------------------------
runMe_5 = Custom[Tool.RunMe](Boolean=code_block_11.runEnsuites, ThingToDo=code_block_36.out0)
setParameterByName_6 = Element.SetParameterByName(element=list_create_8@L2, parameterName=runMe_5, value=code_block_36.out1@@L1)
list_create_9 = List.Create(item0=filterByBoolMask_6.in, item1=filterByBoolMask_7.in, item2=setDifference_2)
code_block_37 = CodeBlock()
# ---------- code_block_37.designscript (7 lines) ----------
"ACG_Unit_Bathroom Mirrored";

[
"✓",
"✕",
"N/A"
];
# ----------------------------------------
runMe_6 = Custom[Tool.RunMe](Boolean=code_block_11.RunBathrooms, ThingToDo=code_block_37.out0)
setParameterByName_7 = Element.SetParameterByName(element=list_create_9@L2, parameterName=runMe_6, value=code_block_37.out1@@L1)
