# Dynamo graph NDSS Schedule By Rooms & Furniture_d.dyn (Dynamo 2.17.1.4055)
# packages: SteamNodes 1.2.3, WombatDynamo 2.3.0, Data-Shapes 2021.2.92

# note: assign 0 tollerance values to non processed rooms

# group: Input
code_block = CodeBlock { catR=Revit.Category.ByName("Rooms"); allR=ElementQueries.OfCategory(catR); "Department"; }
getParameterValueByName = Element.GetParameterValueByName(element=code_block.allR, parameterName=code_block.out2)
code_block_2 = CodeBlock(deps=getParameterValueByName) { "Filter room elements by Department."; DSCore.List.UniqueItems(deps); false; }
code_block_3 = CodeBlock(value=code_block_2.out1) { value; value==""; "none"; }
code_block_4 = CodeBlock(x=code_block_3.out1, a=code_block_3.out2, b=code_block_3.value) { x?a:b; }
dropdown_data = Custom[DropDown Data](InputName=code_block_2.out0, Keys=code_block_4, Values=code_block_4, Sorted_optional=code_block_2.out2)  # package Data-Shapes; Create data for DropDown input in UI.MultiInputForm ++ . Check out www.data-shapes.net for more infos.

# group: Processing
code_block_5 = CodeBlock { DSCore.Types.FindTypeByNameInAssembly("Phase","RevitAPI"); }
all_elements_of_type = ElementsOfType(element_class=code_block_5)
code_block_6 = CodeBlock(ph=all_elements_of_type) { "Select unit GIA phase."; ph; ph.Name; }
dropdown_data_2 = Custom[DropDown Data](InputName=code_block_6.out0, Keys=code_block_6.out2, Values=code_block_6.out2)

# group: Input
code_block_7 = CodeBlock()
# ---------- code_block_7.designscript (9 lines) ----------
"Assign custom level parameter.";
"Assign custom room number parameter.";
"Assign unit type parameter.";
"Assign custom unit GI area parameter.";
"Assign storage area parameter.";
"Assign minimum NDSS unit area.";
"Assign minimum NDSS storage area.";
true;
"Assign unit count.";
# ----------------------------------------
ui_boolean_input = Custom[UI.Boolean input](InputName=code_block_7.out0, DefaultValue=code_block_7.out7)  # package Data-Shapes; Creates a boolean input for UI.MultipleInputForm ++ . Check out www.data-shapes.net for more infos!
ui_boolean_input_2 = Custom[UI.Boolean input](InputName=code_block_7.out1, DefaultValue=code_block_7.out7)
ui_boolean_input_3 = Custom[UI.Boolean input](InputName=code_block_7.out2, DefaultValue=code_block_7.out7)
ui_boolean_input_4 = Custom[UI.Boolean input](InputName=code_block_7.out3, DefaultValue=code_block_7.out7)
ui_boolean_input_5 = Custom[UI.Boolean input](InputName=code_block_7.out4, DefaultValue=code_block_7.out7)
ui_boolean_input_6 = Custom[UI.Boolean input](InputName=code_block_7.out5, DefaultValue=code_block_7.out7)
ui_boolean_input_7 = Custom[UI.Boolean input](InputName=code_block_7.out6, DefaultValue=code_block_7.out7)
ui_boolean_input_8 = Custom[UI.Boolean input](InputName=code_block_7.out8, DefaultValue=code_block_7.out7)
code_block_8 = CodeBlock { "Assign M category parameter"; true; "Validate unit types"; }
ui_boolean_input_9 = Custom[UI.Boolean input](InputName=code_block_8.out0, DefaultValue=code_block_8.out1)
ui_boolean_input_10 = Custom[UI.Boolean input](InputName=code_block_8.out2, DefaultValue=code_block_8.out1)

# group: Input
code_block_9 = CodeBlock()
# ---------- code_block_9.designscript (9 lines) ----------
"Increase NDSS required area from tenure (1).";
"Increase NDSS required area from tenure (2).";
"Increase NDSS required area from tenure (3).";
"Anount of area increase (in percents).";
true;
"0";

"Increase NDSS required area from tenure (4).";
"Increase NDSS required area from tenure (5).";
# ----------------------------------------
code_block_10 = CodeBlock { "ACG_Unit Tenure"; }
getParameterValueByName_2 = Element.GetParameterValueByName(element=code_block.allR, parameterName=code_block_10)
code_block_11 = CodeBlock(input=getParameterValueByName_2) { tenure=DSCore.List.UniqueItems(input); tenure==""; tenure; "No tenure assigned to rooms!"; false; }
code_block_12 = CodeBlock(x=code_block_11.out1, a=code_block_11.out3, b=code_block_11.out2) { x?a:b; }
dropdown_data_3 = Custom[DropDown Data](InputName=code_block_9.out0, Keys=code_block_12, Values=code_block_12)
textbox_data = Custom[TextBox Data](InputName=code_block_9.out3, DefaultText=code_block_9.out5, IsNumberEntry=code_block_9.out4)  # package Data-Shapes; Create Data for TextBox input in UI.MultipleInputForm ++ . Check out www.data-shapes.net for more informations
dropdown_data_4 = Custom[DropDown Data](InputName=code_block_9.out1, Keys=code_block_12, Values=code_block_12)
textbox_data_2 = Custom[TextBox Data](InputName=code_block_9.out3, DefaultText=code_block_9.out5, IsNumberEntry=code_block_9.out4)
dropdown_data_5 = Custom[DropDown Data](InputName=code_block_9.out2, Keys=code_block_12, Values=code_block_12)
textbox_data_3 = Custom[TextBox Data](InputName=code_block_9.out3, DefaultText=code_block_9.out5, IsNumberEntry=code_block_9.out4)
dropdown_data_6 = Custom[DropDown Data](InputName=code_block_9.out6, Keys=code_block_12, Values=code_block_12)
textbox_data_4 = Custom[TextBox Data](InputName=code_block_9.out3, DefaultText=code_block_9.out5, IsNumberEntry=code_block_9.out4)
dropdown_data_7 = Custom[DropDown Data](InputName=code_block_9.out7, Keys=code_block_12, Values=code_block_12)
textbox_data_5 = Custom[TextBox Data](InputName=code_block_9.out3, DefaultText=code_block_9.out5, IsNumberEntry=code_block_9.out4)

# group: Input
file_path = Filename("..\ACG_logo.png")
file_from_path = FileObject(path=file_path)
readFromFile = Image.ReadFromFile(file=file_from_path)
code_block_13 = CodeBlock { "Update accomodation schedule"; true; "Run"; "Cancel"; 700; 400; }
list_create = List.Create(item0=dropdown_data, item1=dropdown_data_2, item2=ui_boolean_input, item3=ui_boolean_input_2, item4=ui_boolean_input_3, item5=ui_boolean_input_4, item6=ui_boolean_input_5, item7=ui_boolean_input_6, item8=ui_boolean_input_7, item9=ui_boolean_input_8, item10=ui_boolean_input_9, item11=ui_boolean_input_10, item12=dropdown_data_3, item13=textbox_data, item14=dropdown_data_4, item15=textbox_data_2, item16=dropdown_data_5, item17=textbox_data_3, item18=dropdown_data_6, item19=textbox_data_4, item20=dropdown_data_7, item21=textbox_data_5)
ui_multipleinputform = Custom[UI.MultipleInputForm ++](Logo_optional=readFromFile, ButtonText_optional=code_block_13.out2, Inputs=list_create, Toggle=code_block_13.out1, CancelButtonText_optional=code_block_13.out3, Width_optional=code_block_13.out4, LabelWidth_optional=code_block_13.out5)  # package Data-Shapes; Create a form with multiple inputs. see www.data-shapes.net for tutorials and infos!

code_block_14 = CodeBlock(department=ui_multipleinputform.User_Inputs, lvl=ui_multipleinputform.User_Inputs, number=ui_multipleinputform.User_Inputs, unitType=ui_multipleinputform.User_Inputs, unitArea=ui_multipleinputform.User_Inputs, storageArea=ui_multipleinputform.User_Inputs, NDSSunitArea=ui_multipleinputform.User_Inputs, NDSSstorageArea=ui_multipleinputform.User_Inputs, unitCount=ui_multipleinputform.User_Inputs, phase=ui_multipleinputform.User_Inputs, mCategory=ui_multipleinputform.User_Inputs, validate=ui_multipleinputform.User_Inputs)
# ---------- code_block_14.designscript (12 lines) ----------
department[0];
lvl[2];
number[3];
unitType[4];
unitArea[5];
storageArea[6];
NDSSunitArea[7];
NDSSstorageArea[8];
unitCount[9];
phase[1];
mCategory[10];
validate[11];
# ----------------------------------------

# group: Visualisation
# note: Rooms that are going to be processed !!!!!
python_script = Python(IN[0]=code_block_14.out9, IN[1]=code_block_14.out0)  # IronPython2
# ---------- python_script.python (50 lines) ----------
# Load the Python Standard and DesignScript Libraries
import clr
import sys
import os.path
from System import Environment
sys.path.append('C:\Program Files (x86)\IronPython 2.7\Lib')
import System
from System import Array
from System.Collections.Generic import *
clr.AddReference('ProtoGeometry')
from Autodesk.DesignScript.Geometry import *
clr.AddReference("RevitNodes")
import Revit
clr.ImportExtensions(Revit.Elements)
clr.ImportExtensions(Revit.GeometryConversion)
clr.AddReference("RevitServices")
import RevitServices
from RevitServices.Persistence import DocumentManager 
from RevitServices.Transactions import TransactionManager 
clr.AddReference("RevitAPI")
clr.AddReference("RevitAPIUI")
import Autodesk 
from Autodesk.Revit.DB import *
from Autodesk.Revit.UI import *

doc = DocumentManager.Instance.CurrentDBDocument
uiapp = DocumentManager.Instance.CurrentUIApplication 
app = uiapp.Application 
uidoc = uiapp.ActiveUIDocument

phase_name = IN[0]
dept_name = IN[1]

all_rooms = FilteredElementCollector(doc)\
.OfCategory(BuiltInCategory.OST_Rooms)\
.WhereElementIsNotElementType().ToElements()

valid_rooms = [r for r in all_rooms if r.Area > 0]

rooms_of_phase = [r for r in valid_rooms if r.get_Parameter(BuiltInParameter.ROOM_PHASE).AsValueString() == phase_name]
rooms_of_dept = [r for r in rooms_of_phase if r.LookupParameter("Department").AsString() == dept_name]

for r in rooms_of_phase:
    try:
        r.LookupParameter("ACG_Unit Type").Set(" ")
    except:
        continue


OUT = rooms_of_dept
# ----------------------------------------

# group: Processing
code_block_15 = CodeBlock { "Number"; " "; }
getParameterValueByName_3 = Element.GetParameterValueByName(element=python_script, parameterName=code_block_15.out0)
split = String.Split(string=getParameterValueByName_3, separator0=code_block_15.out1)
firstItem = List.FirstItem(list=split@L2)

# group: Visualisation
# note: Rooms grouped by number
groupByKey = List.GroupByKey(list=python_script, keys=firstItem)

code_block_16 = CodeBlock { "ACG_Unit Type"; " "; }

# group: Processing
python_script_2 = Python()  # IronPython2
# ---------- python_script_2.python (48 lines) ----------
import clr
import sys
sys.path.append('C:\Program Files (x86)\IronPython 2.7\Lib')
import System
from System import Array
from System.Collections.Generic import *
clr.AddReference('ProtoGeometry')
from Autodesk.DesignScript.Geometry import *
clr.AddReference("RevitNodes")
import Revit
clr.ImportExtensions(Revit.Elements)
clr.ImportExtensions(Revit.GeometryConversion)
clr.AddReference("RevitServices")
import RevitServices
from RevitServices.Persistence import DocumentManager 
from RevitServices.Transactions import TransactionManager 

clr.AddReference("RevitAPI")
clr.AddReference("RevitAPIUI")

import Autodesk 
from Autodesk.Revit.DB import *
from Autodesk.Revit.UI import *

doc = DocumentManager.Instance.CurrentDBDocument
uiapp = DocumentManager.Instance.CurrentUIApplication 
app = uiapp.Application 
uidoc = uiapp.ActiveUIDocument

#######OK NOW YOU CAN CODE########

furn = FilteredElementCollector(doc).OfCategory(BuiltInCategory.OST_Furniture).WhereElementIsNotElementType().ToElements()

sngl_beds, dbl_beds, all_beds = [], [], []

for f in furn:
    try:
        fam_name = f.Symbol.Family.Name
        if "BedSingle" in fam_name:
            sngl_beds.append(f)
            all_beds.append(f)
        elif "BedDouble" in fam_name:
            dbl_beds.append(f)
            all_beds.append(f)
    except:
        continue

OUT = sngl_beds, dbl_beds, all_beds
# ----------------------------------------
code_block_17 = CodeBlock(x=python_script_2) { single_beds = x[0]; double_beds = x[1]; all_beds = x[2]; }

# group: Processing
getLocation = Element.GetLocation(element=code_block_17.single_beds)
isInsideRoom = Room.IsInsideRoom(room=python_script, point=getLocation, lacing=CrossProduct)
countTrue = List.CountTrue(list=isInsideRoom@L2)
getLocation_2 = Element.GetLocation(element=code_block_17.double_beds)
isInsideRoom_2 = Room.IsInsideRoom(room=python_script, point=getLocation_2, lacing=CrossProduct)
countTrue_2 = List.CountTrue(list=isInsideRoom_2@L2)
# note: bedroom & occupancu coeficient for each Room element
code_block_18 = CodeBlock(sBeds=countTrue, dBeds=countTrue_2) { bedrooms=sBeds+dBeds; occupancy=sBeds+(dBeds*2); }

# group: Visualisation
# note: Rooms grouped by number
# note: TYPES
groupByKey_2 = List.GroupByKey(list=code_block_18.bedrooms, keys=firstItem)
groupByKey_3 = List.GroupByKey(list=code_block_18.occupancy, keys=firstItem)

# group: Processing
code_block_19 = CodeBlock { ""; }
sum = Math.Sum(values=groupByKey_2.groups@L2)
sum_2 = Math.Sum(values=groupByKey_3.groups@L2)
python_script_3 = Python(IN[0]=sum, IN[1]=sum_2)  # IronPython2
# ---------- python_script_3.python (42 lines) ----------
import clr
import sys
sys.path.append('C:\Program Files (x86)\IronPython 2.7\Lib')
import System
from System import Array
from System.Collections.Generic import *
clr.AddReference('ProtoGeometry')
from Autodesk.DesignScript.Geometry import *
clr.AddReference("RevitNodes")
import Revit
clr.ImportExtensions(Revit.Elements)
clr.ImportExtensions(Revit.GeometryConversion)
clr.AddReference("RevitServices")
import RevitServices
from RevitServices.Persistence import DocumentManager 
from RevitServices.Transactions import TransactionManager 

clr.AddReference("RevitAPI")
clr.AddReference("RevitAPIUI")

import Autodesk 
from Autodesk.Revit.DB import *
from Autodesk.Revit.UI import *

doc = DocumentManager.Instance.CurrentDBDocument
uiapp = DocumentManager.Instance.CurrentUIApplication 
app = uiapp.Application 
uidoc = uiapp.ActiveUIDocument

#######OK NOW YOU CAN CODE########

beds = IN[0]
people = IN[1]

types = []

for b, p in zip(beds, people):
    b = str(int(b))
    p = str(int(p))
    types.append(b + "B" + p + "P")

OUT = types
# ----------------------------------------
code_block_20 = CodeBlock(a=code_block_19, b=python_script_3) { unitTyep=="0B0P"?a:b; }  # unwired: unitTyep

# group: Visualisation
code_block_21 = CodeBlock { "ACG_Unit Type"; }
# note: assign unit type value
setParameterByName = Element.SetParameterByName(element=groupByKey.groups, parameterName=code_block_21, value=code_block_20)

# group: Control
list_create_2 = List.Create(item0=code_block_16.out0, item1=setParameterByName)
# note: AWAIT
code_block_22 = CodeBlock(x=list_create_2) { x[0]; }

# group: Processing
getParameterValueByName_4 = Element.GetParameterValueByName(element=groupByKey.groups, parameterName=code_block_22)
length = String.Length()  # unwired: string
sortByFunction = List.SortByFunction(list=getParameterValueByName_4@L2, sortFunction=length)
lastItem = List.LastItem(list=sortByFunction@L2)

# group: Visualisation
# note: assign unit type value
setParameterByName_2 = Element.SetParameterByName(element=groupByKey.groups, parameterName=code_block_21, value=lastItem)

# group: Control
# note: do not process units that have not beds inside
code_block_23 = CodeBlock(unitType=lastItem) { unitType==""; }
filterByBoolMask = List.FilterByBoolMask(list=setParameterByName_2, mask=code_block_23)

# group: Processing
code_block_24 = CodeBlock { "Number"; " "; }
getParameterValueByName_5 = Element.GetParameterValueByName(element=filterByBoolMask.out, parameterName=code_block_24.out0)
split_2 = String.Split(string=getParameterValueByName_5, separator0=code_block_24.out1)
firstItem_2 = List.FirstItem(list=split_2@@L2)

# group: Processing
code_block_25 = CodeBlock { "___3"; " (Triplex)"; "ACG_Unit Number"; }
count = List.Count(list=filterByBoolMask.out@L2)
code_block_26 = CodeBlock(apNumbers=firstItem_2, noStories=count) { apNumbers+"___"+noStories; }
code_block_27 = CodeBlock { "___1"; ""; }
replace = String.Replace(string=code_block_26, searchFor=code_block_27.out0, replaceWith=code_block_27.out1)
code_block_28 = CodeBlock { "___2"; " (Duplex)"; }
replace_2 = String.Replace(string=replace, searchFor=code_block_28.out0, replaceWith=code_block_28.out1)
replace_3 = String.Replace(string=replace_2, searchFor=code_block_25.out0, replaceWith=code_block_25.out1)

# group: Visualisation
# note: ROOMS GROUPED BY NUMBER
# (to be used for the rest of the shared parameters)
setParameterByName_3 = Element.SetParameterByName(element=filterByBoolMask.out, parameterName=code_block_25.out2, value=replace_3)

# group: Control
code_block_29 = CodeBlock()
# ---------- code_block_29.designscript (5 lines) ----------
[
"Furniture",
"Casework",
"Generic Models"
];
# ----------------------------------------
list_create_3 = List.Create(item0=code_block_29, item1=setParameterByName_3)
# note: AWAIT
code_block_30 = CodeBlock(x=list_create_3) { x[0]; }

# group: Processing
byName = Category.ByName(name=code_block_30)
all_elements_of_category = ElementsOfCategory(Category=byName)
familyName = Python(IN[0]=all_elements_of_category)  # "Element.FamilyName"; IronPython2
# ---------- familyName.python (45 lines) ----------
import clr
import sys
sys.path.append('C:\Program Files (x86)\IronPython 2.7\Lib')
import System
from System import Array
from System.Collections.Generic import *
clr.AddReference('ProtoGeometry')
from Autodesk.DesignScript.Geometry import *
clr.AddReference("RevitNodes")
import Revit
clr.ImportExtensions(Revit.Elements)
clr.ImportExtensions(Revit.GeometryConversion)
clr.AddReference("RevitServices")
import RevitServices
from RevitServices.Persistence import DocumentManager 
from RevitServices.Transactions import TransactionManager 

clr.AddReference("RevitAPI")
clr.AddReference("RevitAPIUI")

import Autodesk 
from Autodesk.Revit.DB import *
from Autodesk.Revit.UI import *

doc = DocumentManager.Instance.CurrentDBDocument
uiapp = DocumentManager.Instance.CurrentUIApplication 
app = uiapp.Application 
uidoc = uiapp.ActiveUIDocument

#######OK NOW YOU CAN CODE########

fams = UnwrapElement(IN[0])

main_lst = []

for c in fams:
    sub_lst = []
    for i in c:
        try:
            sub_lst.append(i.Symbol.Family.Name)
        except:
            continue
    main_lst.append(sub_lst)

OUT = main_lst
# ----------------------------------------
code_block_31 = CodeBlock { "NDSSStorage"; }
contains = String.Contains(string=familyName, searchFor=code_block_31)
filterByBoolMask_2 = List.FilterByBoolMask(list=all_elements_of_category, mask=contains)
flatten = List.Flatten(list=filterByBoolMask_2.in)

# group: Processing
getLocation_3 = Element.GetLocation(element=flatten)
isInsideRoom_3 = Room.IsInsideRoom(room=python_script, point=getLocation_3, lacing=CrossProduct)
code_block_32 = CodeBlock { true; }
indexOf = List.IndexOf(list=isInsideRoom_3@@L2, element=code_block_32)
flatten_2 = List.Flatten()  # unwired: list
map = List.Map(list=indexOf, function=flatten_2)
isEmpty = List.IsEmpty(list=map@L2)
# note: rooms withOUT NDSS Storage [IN]
filterByBoolMask_3 = List.FilterByBoolMask(list=python_script, mask=isEmpty)
code_block_33 = CodeBlock(rms=filterByBoolMask_3.in) { 0; count=DSCore.List.Count(rms); }
ofRepeatedItem = List.OfRepeatedItem(item=code_block_33.out0, amount=code_block_33.count)
# note: rooms with NDSS Storage [OUT]
filterByBoolMask_4 = List.FilterByBoolMask(list=map, mask=isEmpty)
getItemAtIndex = List.GetItemAtIndex(list=flatten, index=filterByBoolMask_4.out@@L2)

# group: Processing
geometry = Element.Geometry(element=getItemAtIndex)
string_from_object = FromObject(object=geometry)
code_block_34 = CodeBlock(str=string_from_object) { str=="Solid"; }
filterByBoolMask_5 = List.FilterByBoolMask(list=geometry, mask=code_block_34)
bySolid = PolySurface.BySolid(solid=filterByBoolMask_5.in)
surfaces = PolySurface.Surfaces(polySurface=bySolid)
acg_surface_filterbyorientation = Custom[ACG Surface.FilterByOrientation](surfaces=surfaces)  # Takes surfaces and filters them by orientation - vertical, horizontal down or horizontal up. Taken from Clockwork for Dynamo 2.x
code_block_35 = CodeBlock { 2; }
flatten_3 = List.Flatten(amount=code_block_35)  # unwired: list
map_2 = List.Map(list=acg_surface_filterbyorientation.horizontal_down, function=flatten_3)
area = Surface.Area(surface=map_2)
sum_3 = Math.Sum(values=area@L2)
# note: list storage areas
code_block_36 = CodeBlock(area=sum_3) { area/1000000; }

# group: Processing
list_create_4 = List.Create(item0=filterByBoolMask_3.in, item1=filterByBoolMask_3.out)
# note: list Room elements
flatten_4 = List.Flatten(list=list_create_4)
list_create_5 = List.Create(item0=ofRepeatedItem, item1=code_block_36)
# note: list storage areas
flatten_5 = List.Flatten(list=list_create_5)

# group: Processing
code_block_37 = CodeBlock { "Number"; }
getParameterValueByName_6 = Element.GetParameterValueByName(element=flatten_4, parameterName=code_block_37)
groupByKey_4 = List.GroupByKey(list=flatten_4, keys=getParameterValueByName_6)
groupByKey_5 = List.GroupByKey(list=flatten_5, keys=getParameterValueByName_6)
sum_4 = Math.Sum(values=groupByKey_5.groups@L2)

# group: Visualisation
code_block_38 = CodeBlock { "ACG_Storage Area"; }
runMe = Custom[Tool.RunMe](Boolean=code_block_14.out5, ThingToDo=sum_4)  # package SteamNodes; Use Boolean to perform an action
# note: STORAGE AREA
setParameterByName_4 = Element.SetParameterByName(element=groupByKey_4.groups, parameterName=code_block_38, value=runMe)

# group: Processing
area_2 = Room.Area(room=setParameterByName_3)
# note: total unit area (calculation for duplexes)
sum_5 = Math.Sum(values=area_2@L2)
code_block_39 = CodeBlock(apArea=sum_5) { "ACG_Unit GI Area"; apArea; }

# group: Visualisation
runMe_2 = Custom[Tool.RunMe](Boolean=code_block_14.out4, ThingToDo=setParameterByName_3)
# note: COMBINED AREA
setParameterByName_5 = Element.SetParameterByName(element=runMe_2, parameterName=code_block_39.out0, value=code_block_39.apArea)

# group: Processing
code_block_40 = CodeBlock { "Level"; }
getParameterValueByName_7 = Element.GetParameterValueByName(element=setParameterByName_3, parameterName=code_block_40)
byName_2 = WombatDynamo.Level.ByName(name=getParameterValueByName_7)
elevation = Level.Elevation(level=byName_2)
sortByKey = List.SortByKey(list=getParameterValueByName_7@L2, keys=elevation@L2)
# note: only first floor for duplexes
firstItem_3 = List.FirstItem(list=sortByKey.sortedList@L2)
code_block_41 = CodeBlock(apLevels=firstItem_3) { "ACG_Unit Level"; apLevels; }

# group: Visualisation
# note: BASE LEVEL
# (if duplex or triplex all rooms will be assigned same level)
runMe_3 = Custom[Tool.RunMe](Boolean=code_block_14.out1, ThingToDo=setParameterByName_3)
setParameterByName_6 = Element.SetParameterByName(element=runMe_3, parameterName=code_block_41.out0, value=code_block_41.apLevels)

code_block_42 = CodeBlock { "ACG_Unit Type"; }

# group: Control
list_create_6 = List.Create(item0=code_block_42, item1=filterByBoolMask.out)
# note: AWAIT
code_block_43 = CodeBlock(x=list_create_6) { x[0]; }

# group: Processing
getParameterValueByName_8 = Element.GetParameterValueByName(element=setParameterByName_3, parameterName=code_block_43)
length_2 = String.Length()  # unwired: string
groupByFunction = List.GroupByFunction(list=getParameterValueByName_8, groupFunction=length_2)
lastItem_2 = List.LastItem(list=groupByFunction@L2)

# group: Processing
count_2 = List.Count(list=setParameterByName_3@L2)
code_block_44 = CodeBlock(unitType=lastItem_2, count=count_2) { unitType+"___"+count; }
code_block_45 = CodeBlock { "___1"; ""; }
replace_4 = String.Replace(string=code_block_44, searchFor=code_block_45.out0, replaceWith=code_block_45.out1)
code_block_46 = CodeBlock { "___2"; " (Duplex)"; }
replace_5 = String.Replace(string=replace_4, searchFor=code_block_46.out0, replaceWith=code_block_46.out1)
code_block_47 = CodeBlock { "___3"; " (Triplex)"; "ACG_Unit Number"; }
replace_6 = String.Replace(string=replace_5, searchFor=code_block_47.out0, replaceWith=code_block_47.out1)

# group: Visualisation
runMe_4 = Custom[Tool.RunMe](Boolean=code_block_14.out3, ThingToDo=setParameterByName_3)
# note: UNIT TYPES
setParameterByName_7 = Element.SetParameterByName(element=runMe_4, parameterName=code_block_42, value=replace_6)

# group: Processing
flatten_6 = List.Flatten(list=setParameterByName_7)
code_block_48 = CodeBlock { "ACG_Unit Type"; }
getParameterValueByName_9 = Element.GetParameterValueByName(element=flatten_6, parameterName=code_block_48)

# group: Input
code_block_49 = CodeBlock()
# ---------- code_block_49.designscript (47 lines) ----------
[
"1B1P",
"1B2P",
"2B3P",
"2B4P",
"3B4P",
"3B5P",
"3B6P",
"4B5P",
"4B6P",
"4B7P",
"4B8P",
"5B6P",
"5B7P",
"5B8P",
"6B7P",
"6B8P",

"1B2P (Duplex)",
"2B3P (Duplex)",
"2B4P (Duplex)",
"3B4P (Duplex)",
"3B5P (Duplex)",
"3B6P (Duplex)",
"4B5P (Duplex)",
"4B6P (Duplex)",
"4B7P (Duplex)",
"4B8P (Duplex)",
"5B6P (Duplex)",
"5B7P (Duplex)",
"5B8P (Duplex)",
"6B7P (Duplex)",
"6B8P (Duplex)",

"3B4P (Triplex)",
"3B5P (Triplex)",
"3B6P (Triplex)",
"4B5P (Triplex)",
"4B6P (Triplex)",
"4B7P (Triplex)",
"4B8P (Triplex)",
"5B6P (Triplex)",
"5B7P (Triplex)",
"5B8P (Triplex)",
"6B7P (Triplex)",
"6B8P (Triplex)"
];
# ----------------------------------------
code_block_50 = CodeBlock()
# ---------- code_block_50.designscript (47 lines) ----------
[
39,
50,
61,
70,
74,
86,
95,
90,
99,
108,
117,
103,
112,
121,
116,
125,

58,
70,
79,
84,
93,
102,
97,
106,
115,
124,
110,
119,
128,
123,
132,

90,
99,
108,
103,
112,
121,
130,
116,
125,
134,
129,
138
];
# ----------------------------------------
code_block_51 = CodeBlock()
# ---------- code_block_51.designscript (47 lines) ----------
[
1,
1.5,
2,
2,
2.5,
2.5,
2.5,
3,
3,
3,
3,
3.5,
3.5,
3.5,
4,
4,

1.5,
2,
2,
2.5,
2.5,
2.5,
3,
3,
3,
3,
3.5,
3.5,
3.5,
4,
4,

2.5,
2.5,
2.5,
3,
3,
3,
3,
3.5,
3.5,
3.5,
4,
4
];
# ----------------------------------------
list_create_7 = List.Create(item0=code_block_50, item1=code_block_51)
transpose = List.Transpose(lists=list_create_7)
byKeysValues = DesignScript.Builtin.Dictionary.ByKeysValues(keys=code_block_49, values=transpose)

# group: Processing
code_block_52 = CodeBlock { "NDSS_Min Unit Area"; "NDSS_Min Storage Area"; }
valueAtKey = DesignScript.Builtin.Dictionary.ValueAtKey(dictionary=byKeysValues, key=getParameterValueByName_9)
lastItem_3 = List.LastItem(list=valueAtKey@L2)
firstItem_4 = List.FirstItem(list=valueAtKey@@L2)

# group: Visualisation
setParameterByName_8 = Element.SetParameterByName(element=flatten_6, parameterName=code_block_52.out1, value=lastItem_3)
runMe_5 = Custom[Tool.RunMe](Boolean=code_block_14.out6, ThingToDo=setParameterByName_7)
runMe_6 = Custom[Tool.RunMe](Boolean=code_block_14.out7, ThingToDo=setParameterByName_7)
setParameterByName_9 = Element.SetParameterByName(element=flatten_6, parameterName=code_block_52.out0, value=firstItem_4)

# group: Info
python_script_4 = Python(IN[0]=code_block_17.all_beds)  # IronPython2
# ---------- python_script_4.python (37 lines) ----------
import clr
import sys
sys.path.append('C:\Program Files (x86)\IronPython 2.7\Lib')
import System
from System import Array
from System.Collections.Generic import *
clr.AddReference('ProtoGeometry')
from Autodesk.DesignScript.Geometry import *
clr.AddReference("RevitNodes")
import Revit
clr.ImportExtensions(Revit.Elements)
clr.ImportExtensions(Revit.GeometryConversion)
clr.AddReference("RevitServices")
import RevitServices
from RevitServices.Persistence import DocumentManager 
from RevitServices.Transactions import TransactionManager 

clr.AddReference("RevitAPI")
clr.AddReference("RevitAPIUI")

import Autodesk 
from Autodesk.Revit.DB import *
from Autodesk.Revit.UI import *

doc = DocumentManager.Instance.CurrentDBDocument
uiapp = DocumentManager.Instance.CurrentUIApplication 
app = uiapp.Application 
uidoc = uiapp.ActiveUIDocument

#######OK NOW YOU CAN CODE########

all_beds = UnwrapElement(IN[0])

access = [b for b in all_beds if "Accessible" in b.Symbol.Family.Name]
adapt = [b for b in all_beds if "Adaptable" in b.Symbol.Family.Name]

OUT = access, adapt
# ----------------------------------------
code_block_53 = CodeBlock(x=python_script_4) { accessible_beds = x[0]; adaptable_beds = x[1]; }

# group: Processing
getLocation_4 = Element.GetLocation(element=code_block_53.accessible_beds)
isInsideRoom_4 = Room.IsInsideRoom(room=python_script, point=getLocation_4, lacing=CrossProduct)
anyTrue = List.AnyTrue(list=isInsideRoom_4@L2)
code_block_54 = CodeBlock { " M4(3)(2)(b)"; "  "; " M4(3)(2)(a)"; }
getLocation_5 = Element.GetLocation(element=code_block_53.adaptable_beds)
isInsideRoom_5 = Room.IsInsideRoom(room=python_script, point=getLocation_5, lacing=CrossProduct)
anyTrue_2 = List.AnyTrue(list=isInsideRoom_5@L2)
code_block_55 = CodeBlock(acces=anyTrue, a=code_block_54.out0, n=code_block_54.out1, adapt=anyTrue_2, b=code_block_54.out2) { acces==true?a:n; adapt==true?b:n; }
code_block_56 = CodeBlock(cat1=code_block_55.out0, cat2=code_block_55.out1) { cat1+cat2; }
code_block_57 = CodeBlock { "    "; "M4(2)"; }
replace_7 = String.Replace(string=code_block_56, searchFor=code_block_57.out0, replaceWith=code_block_57.out1)

# group: Visualisation
# note: Rooms grouped by number
# note: M CATEGORY
groupByKey_6 = List.GroupByKey(list=python_script, keys=firstItem)
groupByKey_7 = List.GroupByKey(list=replace_7, keys=firstItem)

# group: Visualisation
code_block_58 = CodeBlock { "ACG_M Category"; }
runMe_7 = Custom[Tool.RunMe](Boolean=code_block_14.out10, ThingToDo=code_block_58)
length_3 = String.Length()  # unwired: string
sortByFunction_2 = List.SortByFunction(list=groupByKey_7.groups@L2, sortFunction=length_3)
lastItem_4 = List.LastItem(list=sortByFunction_2@L2)
# note: ACG_M Category
setParameterByName_10 = Element.SetParameterByName(element=groupByKey_6.groups, parameterName=runMe_7, value=lastItem_4)

# group: Processing
# note: unit count coef for duplexes and triplexes
code_block_59 = CodeBlock { "ACG_Unit Count"; }
count_3 = List.Count(list=setParameterByName_3@@L1)
count_4 = List.Count(list=setParameterByName_3@L2)
div = count_3 / count_4

# group: Visualisation
runMe_8 = Custom[Tool.RunMe](Boolean=code_block_14.out8, ThingToDo=setParameterByName_3)
# note: UNIT COUNT
setParameterByName_11 = Element.SetParameterByName(element=runMe_8, parameterName=code_block_59, value=div)

code_block_60 = CodeBlock { "List of Unit Types not matching the requirement:"; }

# group: Visualisation
flatten_7 = List.Flatten(list=setParameterByName_7)
code_block_61 = CodeBlock(rooms=flatten_7) { rooms; }

# group: Processing
code_block_62 = CodeBlock { "Number"; }
getParameterValueByName_10 = Element.GetParameterValueByName(element=code_block_61, parameterName=code_block_62)

# group: Processing
code_block_63 = CodeBlock { "ACG_Unit Type"; "ACG_M Category"; }
getParameterValueByName_11 = Element.GetParameterValueByName(element=code_block_61, parameterName=code_block_63.out0)
getParameterValueByName_12 = Element.GetParameterValueByName(element=code_block_61, parameterName=code_block_63.out1)

code_block_64 = CodeBlock(tp=getParameterValueByName_11, cat=getParameterValueByName_12) { tp+" "+cat; }

# group: Processing
code_block_65 = CodeBlock { "ACG_Unit Type Required"; }
getParameterValueByName_13 = Element.GetParameterValueByName(element=code_block_61, parameterName=code_block_65)

# group: Visualisation
code_block_66 = CodeBlock(achieved=code_block_64, required=getParameterValueByName_13) { achieved==required; }
filterByBoolMask_6 = List.FilterByBoolMask(list=getParameterValueByName_10, mask=code_block_66)
# note: OUT
code_block_67 = CodeBlock(rooms=filterByBoolMask_6.out) { DSCore.List.UniqueItems(rooms); }
sort = List.Sort(list=code_block_67)

# group: Processing
code_block_68 = CodeBlock { "None"; }
code_block_69 = CodeBlock { " \n"; }
join = String.Join(separator=code_block_69, string0=sort)
code_block_70 = CodeBlock(lst=sort, a=code_block_68, b=join) { count=DSCore.List.Count(lst); count==0?a:b; }

# group: Input
file_path_2 = Filename("..\ACG_logo.png")
file_from_path_2 = FileObject(path=file_path_2)
readFromFile_2 = Image.ReadFromFile(file=file_from_path_2)
code_block_71 = CodeBlock { "Okay..."; }
textnote_data = Custom[TextNote Data](Title=code_block_60, TextNote=code_block_70.out1)  # package Data-Shapes; Create Data for TextNote input in UI.MultipleInputForm ++ . Check out www.data-shapes.net for more informations
code_block_72 = CodeBlock { 700; 400; }
ui_multipleinputform_2 = Custom[UI.MultipleInputForm ++](Logo_optional=readFromFile_2, ButtonText_optional=code_block_71, Inputs=textnote_data, Toggle=code_block_14.out11, Width_optional=code_block_72.out0, LabelWidth_optional=code_block_72.out1)

code_block_73 = CodeBlock(rooms=setParameterByName_9) { rooms; }
code_block_74 = CodeBlock { "ACG_Unit Tenure"; }
code_block_75 = CodeBlock(x=ui_multipleinputform.User_Inputs)
# ---------- code_block_75.designscript (10 lines) ----------
tenToIncrease1=x[12];
increaseAmount1=x[13];
tenToIncrease2=x[14];
increaseAmount2=x[15];
tenToIncrease3=x[16];
increaseAmount3=x[17];
tenToIncrease4=x[18];
increaseAmount4=x[19];
tenToIncrease5=x[20];
increaseAmount5=x[21];
# ----------------------------------------
code_block_76 = CodeBlock { "NDSS_Min Unit Area"; "NDSS_Area Tolerance Required"; }

# group: Processing
getParameterValueByName_14 = Element.GetParameterValueByName(element=code_block_73, parameterName=code_block_74)
code_block_77 = CodeBlock(tnre=getParameterValueByName_14, input1=code_block_75.tenToIncrease1) { tnre==input1; }
filterByBoolMask_7 = List.FilterByBoolMask(list=code_block_73, mask=code_block_77)
getParameterValueByName_15 = Element.GetParameterValueByName(element=filterByBoolMask_7.in, parameterName=code_block_76.out0)
code_block_78 = CodeBlock(value=getParameterValueByName_15, increase=code_block_75.increaseAmount1) { value*increase/100; }
setParameterByName_12 = Element.SetParameterByName(element=filterByBoolMask_7.in, parameterName=code_block_76.out1, value=code_block_78)

# group: Processing
getParameterValueByName_16 = Element.GetParameterValueByName(element=code_block_73, parameterName=code_block_74)
code_block_79 = CodeBlock(tnre=getParameterValueByName_16, input1=code_block_75.tenToIncrease2) { tnre==input1; }
filterByBoolMask_8 = List.FilterByBoolMask(list=code_block_73, mask=code_block_79)
getParameterValueByName_17 = Element.GetParameterValueByName(element=filterByBoolMask_8.in, parameterName=code_block_76.out0)
code_block_80 = CodeBlock(value=getParameterValueByName_17, increase=code_block_75.increaseAmount2) { value*increase/100; }
setParameterByName_13 = Element.SetParameterByName(element=filterByBoolMask_8.in, parameterName=code_block_76.out1, value=code_block_80)

# group: Processing
getParameterValueByName_18 = Element.GetParameterValueByName(element=code_block_73, parameterName=code_block_74)
code_block_81 = CodeBlock(tnre=getParameterValueByName_18, input1=code_block_75.tenToIncrease3) { tnre==input1; }
filterByBoolMask_9 = List.FilterByBoolMask(list=code_block_73, mask=code_block_81)
getParameterValueByName_19 = Element.GetParameterValueByName(element=filterByBoolMask_9.in, parameterName=code_block_76.out0)
code_block_82 = CodeBlock(value=getParameterValueByName_19, increase=code_block_75.increaseAmount3) { value*increase/100; }
setParameterByName_14 = Element.SetParameterByName(element=filterByBoolMask_9.in, parameterName=code_block_76.out1, value=code_block_82)

# group: Processing
getParameterValueByName_20 = Element.GetParameterValueByName(element=code_block_73, parameterName=code_block_74)
code_block_83 = CodeBlock(tnre=getParameterValueByName_20, input1=code_block_75.tenToIncrease4) { tnre==input1; }
filterByBoolMask_10 = List.FilterByBoolMask(list=code_block_73, mask=code_block_83)
getParameterValueByName_21 = Element.GetParameterValueByName(element=filterByBoolMask_10.in, parameterName=code_block_76.out0)
code_block_84 = CodeBlock(value=getParameterValueByName_21, increase=code_block_75.increaseAmount4) { value*increase/100; }
setParameterByName_15 = Element.SetParameterByName(element=filterByBoolMask_10.in, parameterName=code_block_76.out1, value=code_block_84)

# group: Processing
getParameterValueByName_22 = Element.GetParameterValueByName(element=code_block_73, parameterName=code_block_74)
code_block_85 = CodeBlock(tnre=getParameterValueByName_22, input1=code_block_75.tenToIncrease5) { tnre==input1; }
filterByBoolMask_11 = List.FilterByBoolMask(list=code_block_73, mask=code_block_85)
getParameterValueByName_23 = Element.GetParameterValueByName(element=filterByBoolMask_11.in, parameterName=code_block_76.out0)
code_block_86 = CodeBlock(value=getParameterValueByName_23, increase=code_block_75.increaseAmount5) { value*increase/100; }
setParameterByName_16 = Element.SetParameterByName(element=filterByBoolMask_11.in, parameterName=code_block_76.out1, value=code_block_86)

# group: Assing
list_create_8 = List.Create(item0=setParameterByName_12, item1=setParameterByName_13, item2=setParameterByName_14, item3=setParameterByName_15, item4=setParameterByName_16)
flatten_8 = List.Flatten(list=list_create_8)
setDifference = List.SetDifference(list1=code_block_73, list2=flatten_8)
code_block_87 = CodeBlock { 0; }
setParameterByName_17 = Element.SetParameterByName(element=setDifference, parameterName=code_block_76.out1, value=code_block_87)

# group: Processing - compliant units
code_block_88 = CodeBlock { "ACG_Unit GI Area"; "NDSS_Min Unit Area"; "NDSS_Area Tolerance Required"; }
getParameterValueByName_24 = Element.GetParameterValueByName(element=setParameterByName_17, parameterName=code_block_88.out0)
getParameterValueByName_25 = Element.GetParameterValueByName(element=setParameterByName_17, parameterName=code_block_88.out1)
getParameterValueByName_26 = Element.GetParameterValueByName(element=setParameterByName_17, parameterName=code_block_88.out2)
code_block_89 = CodeBlock(GIA=getParameterValueByName_24, minArea=getParameterValueByName_25, reqTlrnc=getParameterValueByName_26) { "NDSS_Unit Area Compliant"; ((GIA-minArea)-reqTlrnc)<0?"✕":"✓"; }

# group: Visualisation
setParameterByName_18 = Element.SetParameterByName(element=setParameterByName_17, parameterName=code_block_89.out0, value=code_block_89.out1)

# group: Processing - compliant units
code_block_90 = CodeBlock { "ACG_Storage Area"; "NDSS_Min Storage Area"; }
getParameterValueByName_27 = Element.GetParameterValueByName(element=setParameterByName_17, parameterName=code_block_90.out0)
code_block_91 = CodeBlock { 2; }
round = Math.Round(number=getParameterValueByName_27, digits=code_block_91)
getParameterValueByName_28 = Element.GetParameterValueByName(element=setParameterByName_17, parameterName=code_block_90.out1)
code_block_92 = CodeBlock(achStrg=round, reqStrg=getParameterValueByName_28) { "NDSS_Storage Area Compliant"; (achStrg-reqStrg)<(-0.01)?"✕":"✓"; }

# group: Visualisation
setParameterByName_19 = Element.SetParameterByName(element=setParameterByName_17, parameterName=code_block_92.out0, value=code_block_92.out1)

anyTrue_3 = List.AnyTrue(list=isInsideRoom_3@L2)
code_block_93 = CodeBlock()
# ---------- code_block_93.designscript (24 lines) ----------
[
"Apartments",
"New Construction - GIA",
true,
true,
true,
true,
true,
true,
true,
true,
true,
false,
null,
0,
null,
0,
null,
0,
null,
0,
null,
0
];
# ----------------------------------------

# group: Usage
code_block_94 = CodeBlock { "NDSS Room Schedule - By Rooms & Furniture"; }
acg_script_usage = Custom[ACG Script Usage](script_name=code_block_94)  # Adds an entry to TXT document every time a script is run. The document is located in R:\Dynamo\05-UsageStats
