# Dynamo graph Rename Rooms By Model Group_d.dyn "Rooms - Rename By Model Group" (Dynamo 2.12.1.8246)
# packages: Data-Shapes 2021.2.92

# group: Usage
code_block = CodeBlock { "Rooms - Name By Model Group"; }
acg_script_usage = Custom[ACG Script Usage](scriptName=code_block)  # Adds an entry to Excel document every time a script is run. The document is located in S:\Dynamo\05-UsageStats

# group: Input
code_block_2 = CodeBlock { "Note:"; }
string = StringInput("""This tool will use “unit” model group placed inside a room and change the room’s name (or any other intance parameter) according to the unit code in the model group’s name. Please make sure all “unit” model groups are named and classified correctly e.g. “ACG-4500-“ and the unit code is at the end and is separated from the general description of the group with “-”. If there are variations of the unit type, please mark those as _suffix at the end of the group’s name.
Example:
Model groups for unit “1.A.08” can be named
“ACG-4500-Int_UnitType-1.A.08”, “ACG-4500-Int_UnitType-1.A.08_HighWalls” or  
“ACG-4500-Int_UnitType-1.A.08_Option01”
For more detailed information on how the tool works please refer to Revit Tutorials on MS Stream, or speak with IP.
PS: The "unit" model groups must contain at least one wall. """)
textnote_data = Custom[TextNote Data](Title=code_block_2, TextNote=string)  # package Data-Shapes; Create Data for TextNote input in UI.MultipleInputForm ++ . Check out www.data-shapes.net for more informations

# group: Input
code_block_3 = CodeBlock { catR=Revit.Category.ByName("Rooms"); allR=ElementQueries.OfCategory(catR); "Department"; }
getParameterValueByName = Element.GetParameterValueByName(element=code_block_3.allR, parameterName=code_block_3.out2)
code_block_4 = CodeBlock(deps=getParameterValueByName) { "Filter room elements by Department."; DSCore.List.UniqueItems(deps); false; }
code_block_5 = CodeBlock(value=code_block_4.out1) { value; value==""; "none"; }
code_block_6 = CodeBlock(x=code_block_5.out1, a=code_block_5.out2, b=code_block_5.value) { x?a:b; }
dropdown_data = Custom[DropDown Data](InputName=code_block_4.out0, Keys=code_block_6, Values=code_block_6, Sorted_optional=code_block_4.out2)  # package Data-Shapes; Create data for DropDown input in UI.MultiInputForm ++ . Check out www.data-shapes.net for more infos.

# group: Processing
code_block_7 = CodeBlock { DSCore.Types.FindTypeByNameInAssembly("Phase","RevitAPI"); }
all_elements_of_type = ElementsOfType(element_type=code_block_7)
code_block_8 = CodeBlock(ph=all_elements_of_type) { "Select unit GIA phase."; ph; ph.Name; }
dropdown_data_2 = Custom[DropDown Data](InputName=code_block_8.out0, Keys=code_block_8.out2, Values=code_block_8.out2)

# group: Input
code_block_9 = CodeBlock { "Name of parameter to be filled in."; "Name"; }
textbox_data = Custom[TextBox Data](InputName=code_block_9.out0, DefaultText=code_block_9.out1)  # package Data-Shapes; Create Data for TextBox input in UI.MultipleInputForm ++ . Check out www.data-shapes.net for more informations

# group: Input
file_path = Filename("..\ACG_logo.png")
file_from_path = FileObject(path=file_path)
readFromFile = Image.ReadFromFile(file=file_from_path)
code_block_10 = CodeBlock { "Update accomodation schedule"; true; "Run"; "Cancel"; 700; 400; }
list_create = List.Create(item0=textnote_data, item1=dropdown_data, item2=dropdown_data_2, item3=textbox_data)
ui_multipleinputform = Custom[UI.MultipleInputForm ++](Logo_optional=readFromFile, ButtonText_optional=code_block_10.out2, Inputs=list_create, Toggle=code_block_10.out1, CancelButtonText_optional=code_block_10.out3, Width_optional=code_block_10.out4, LabelWidth_optional=code_block_10.out5)  # package Data-Shapes; Create a form with multiple inputs. see www.data-shapes.net for tutorials and infos!

watch = Watch(ui_multipleinputform.User_Inputs)

# group: Filtering
code_block_11 = CodeBlock { "Model Groups"; }
allElementsByCategoryName = Custom[Element.AllElementsByCategoryName](CategoryName=code_block_11)
code_block_12 = CodeBlock(mg=allElementsByCategoryName) { "ACG-4500-"; mg.Name; }
contains = String.Contains(string=code_block_12.out1, searchFor=code_block_12.out0)
filterByBoolMask = List.FilterByBoolMask(list=allElementsByCategoryName, mask=contains)

code_block_13 = CodeBlock { catR=Revit.Category.ByName("Rooms"); allR=ElementQueries.OfCategory(catR); "Department"; "Phase"; }
code_block_14 = CodeBlock(x=ui_multipleinputform.User_Inputs) { department=x[0]; phase=x[1]; parameterName=x[2]; }

# group: Input
# note: collect all rooms in the model and the name of their phase
getParameterValueByName_2 = Element.GetParameterValueByName(element=code_block_13.allR, parameterName=code_block_13.out3)
code_block_15 = CodeBlock(ph=getParameterValueByName_2) { ph.Name; }
code_block_16 = CodeBlock(phase=code_block_14.phase, input=code_block_15) { phase==input; }
filterByBoolMask_2 = List.FilterByBoolMask(list=code_block_13.allR, mask=code_block_16)

# group: Input
getParameterValueByName_3 = Element.GetParameterValueByName(element=filterByBoolMask_2.in, parameterName=code_block_13.out2)
code_block_17 = CodeBlock(dept=getParameterValueByName_3, input=code_block_14.department) { dept==input; }
filterByBoolMask_3 = List.FilterByBoolMask(list=filterByBoolMask_2.in, mask=code_block_17)

# group: Filtering
area = Room.Area(room=filterByBoolMask_3.in)
# note: filter out redundant rooms
code_block_18 = CodeBlock(area=area) { area>0; }
filterByBoolMask_4 = List.FilterByBoolMask(list=filterByBoolMask_3.in, mask=code_block_18)

# group: Control
code_block_19 = CodeBlock { "ACG_Unit Type"; " "; }
# note: Erase ACG_Unit Type values from all rooms that are going to be processed.
setParameterByName = Element.SetParameterByName(element=filterByBoolMask_4.in, parameterName=code_block_19.out0, value=code_block_19.out1)

# group: Visualisation
# note: Rooms that are going to be processed !!!!!
code_block_20 = CodeBlock(selectedRooms=setParameterByName) { selectedRooms; }

# group: Processing
getMembers = Custom[Group.GetMembers](group=filterByBoolMask.in)  # Get all memebers of a group instance
getCategory = Element.GetCategory(element=getMembers)
string_from_object = FromObject(object=getCategory)
code_block_21 = CodeBlock(value=string_from_object) { value=="Walls"; }
filterByBoolMask_5 = List.FilterByBoolMask(list=getMembers, mask=code_block_21)

# group: Processing
geometry = Element.Geometry(element=filterByBoolMask_5.in@L2)
flatten = List.Flatten()  # unwired: list
map = List.Map(list=geometry, function=flatten)
byUnion = Solid.ByUnion(solids=map)
# note: Get the ceter point of each Model Group
centroid = Solid.Centroid(solid=byUnion)

# group: Processing
code_block_22 = CodeBlock(mg=filterByBoolMask.in) { " (members excluded)"; ""; mg.Name; }
replace = String.Replace(string=code_block_22.out2, searchFor=code_block_22.out0, replaceWith=code_block_22.out1)
isInsideRoom = Room.IsInsideRoom(room=code_block_20, point=centroid, lacing=CrossProduct)
code_block_23 = CodeBlock { true; }
indexOf = List.IndexOf(list=isInsideRoom@@L2, element=code_block_23)
# note: map gropups to rooms
getItemAtIndex = List.GetItemAtIndex(list=replace, index=indexOf)
code_block_24 = CodeBlock { "-"; }
split = String.Split(string=getItemAtIndex, separator0=code_block_24)
lastItem = List.LastItem(list=split@L2)

sort = List.Sort(list=replace)

# group: Processing
code_block_25 = CodeBlock { "_"; }
split_2 = String.Split(string=lastItem, separator0=code_block_25)
firstItem = List.FirstItem(list=split_2@L2)

# note: Get the code from the Model Group name
code_block_26 = CodeBlock(value=firstItem) { value==null?"N/A":value; }

# group: Visualisation
setParameterByName_2 = Element.SetParameterByName(element=code_block_20, parameterName=code_block_14.parameterName, value=code_block_26)

# group: Processing
anyTrue = List.AnyTrue(list=isInsideRoom@L2)
# note: Rooms with groups in [IN]
# Rooms withOUT grpoups in [OUT]
filterByBoolMask_6 = List.FilterByBoolMask(list=setParameterByName_2, mask=anyTrue)
code_block_27 = CodeBlock(parameterName=code_block_14.parameterName) { parameterName; }
code_block_28 = CodeBlock(parameterName=code_block_14.parameterName)
# ---------- code_block_28.designscript (4 lines) ----------
[
"ACG_Unit Number",
parameterName
];
# ----------------------------------------
getParameterValueByName_4 = Element.GetParameterValueByName(element=filterByBoolMask_6.in, parameterName=code_block_28@@L1)
# note: Assign value to duplex/triplex rooms where only one modelg group is modelled for the while unit.
code_block_29 = CodeBlock(x=getParameterValueByName_4) { nmb=x[0]; inpt=x[1]; }
byKeysValues = DesignScript.Builtin.Dictionary.ByKeysValues(keys=code_block_29.nmb, values=code_block_29.inpt)
code_block_30 = CodeBlock { "ACG_Unit Number"; }
getParameterValueByName_5 = Element.GetParameterValueByName(element=filterByBoolMask_6.out, parameterName=code_block_30)
valueAtKey = DesignScript.Builtin.Dictionary.ValueAtKey(dictionary=byKeysValues, key=getParameterValueByName_5)

# group: Visualisation
setParameterByName_3 = Element.SetParameterByName(element=filterByBoolMask_6.out, parameterName=code_block_27, value=valueAtKey)
