# Dynamo graph Renumber NIA Rooms By GIA Area & Rename By Content_d.dyn (Dynamo 2.17.1.4055)
# packages: Ampersand 2017.2.2, SteamNodes 1.2.3, LunchBox for Dynamo 2016.11.11, Rhythm 2021.1.1, Data-Shapes 2021.2.92

code_block = CodeBlock { "Name"; false; }
file_path = Filename("..\ACG_logo.png")
file_from_path = FileObject(path=file_path)
readFromFile = Image.ReadFromFile(file=file_from_path)

# group: Input > Input
# note: All levels in the model
code_block_2 = CodeBlock { catL=Revit.Category.ByName("Levels"); allL=ElementQueries.OfCategory(catL); }
code_block_3 = CodeBlock(l=code_block_2.allL) { l.Name; "Select a level"; }
dropdown_data = Custom[DropDown Data](InputName=code_block_3.out1, Keys=code_block_3.out0, Values=code_block_2.allL)  # package Data-Shapes; Create data for DropDown input in UI.MultiInputForm ++ . Check out www.data-shapes.net for more infos.

# group: Input
code_block_4 = CodeBlock { DSCore.Types.FindTypeByNameInAssembly("AreaScheme","RevitAPI"); }
all_elements_of_type = ElementsOfType(element_type=code_block_4)
code_block_5 = CodeBlock(e=all_elements_of_type) { e.Name; "Select area scheme"; }
dropdown_data_2 = Custom[DropDown Data](InputName=code_block_5.out1, Keys=code_block_5.out0, Values=code_block_5.out0)

# group: Input
code_block_6 = CodeBlock { "Delete redundant rooms?"; true; }
boolean_input = Custom[Boolean input](InputName=code_block_6.out0, DefaultValue=code_block_6.out1)  # package Data-Shapes; Creates a boolean input for UI.MultipleInputForm ++ . Check out www.data-shapes.net for more infos!

# group: Processing
code_block_7 = CodeBlock { DSCore.Types.FindTypeByNameInAssembly("Phase","RevitAPI"); }
all_elements_of_type_2 = ElementsOfType(element_type=code_block_7)
code_block_8 = CodeBlock(ph=all_elements_of_type_2) { "Select room NIA phase."; ph; ph.Name; }
dropdown_data_3 = Custom[DropDown Data](InputName=code_block_8.out0, Keys=code_block_8.out2, Values=code_block_8.out2)

# group: Input
code_block_9 = CodeBlock { true; "Generate"; "Cancel"; 250; 700; }
code_block_10 = CodeBlock { "Note:"; }
string = StringInput("This tool will rename rooms based on the furniture placed in them and the the Area elements whey fall into.")
textnote_data = Custom[TextNote Data](Title=code_block_10, TextNote=string)  # package Data-Shapes; Create Data for TextNote input in UI.MultipleInputForm ++ . Check out www.data-shapes.net for more informations
list_create = List.Create(item0=textnote_data, item1=dropdown_data, item2=dropdown_data_2, item3=boolean_input, item4=dropdown_data_3)
multipleinputform = Custom[MultipleInputForm ++](Logo_optional=readFromFile, ButtonText_optional=code_block_9.out1, Inputs=list_create, Toggle=code_block_9.out0, CancelButtonText_optional=code_block_9.out2, Width_optional=code_block_9.out4, LabelWidth_optional=code_block_9.out3)  # package Data-Shapes; Create a form with multiple inputs. see www.data-shapes.net for tutorials and infos!
code_block_11 = CodeBlock(x=multipleinputform.User_Inputs) { level=x[0]; deleteRedundant=x[2]; areaScheme=x[1]; phase=x[3]; }

# group: Filtering
code_block_12 = CodeBlock { catR=Revit.Category.ByName("Rooms"); allR=ElementQueries.OfCategory(catR); "Phase"; }
getParameterValueByName = Element.GetParameterValueByName(element=code_block_12.allR, parameterName=code_block_12.out2)
code_block_13 = CodeBlock(ph=getParameterValueByName) { ph.Name; }
code_block_14 = CodeBlock(phase=code_block_13, value=code_block_11.phase) { phase==value; }
filterByBoolMask = List.FilterByBoolMask(list=code_block_12.allR, mask=code_block_14)

code_block_15 = CodeBlock { "Area"; }
# note: This group will remove all not placed rooms. This is important for the rest of the script run without warnings.
getParameterValueByName_2 = Element.GetParameterValueByName(element=filterByBoolMask.in, parameterName=code_block_15)
code_block_16 = CodeBlock { ""; }
eq = getParameterValueByName_2 == code_block_16
filterByBoolMask_2 = List.FilterByBoolMask(list=filterByBoolMask.in, mask=eq)
code_block_17 = CodeBlock { "Level"; }
# note: Collect all rooms on the selected level and their location point.
getParameterValueByName_3 = Element.GetParameterValueByName(element=filterByBoolMask_2.out, parameterName=code_block_17)
runMe = Custom[Tool.RunMe](Boolean=code_block_11.deleteRedundant, ThingToDo=filterByBoolMask_2.in)  # package SteamNodes; Use Boolean to perform an action
eraser = Custom[Tool.Eraser](Elements=runMe)  # package SteamNodes; Try to delete any element from project

# group: Control
list_create_2 = List.Create(item0=code_block_11.level, item1=eraser)
# note: Collect the name of the level.
code_block_18 = CodeBlock(x=list_create_2) { x[0]; }

name = Element.Name(element=code_block_18)
eq_2 = getParameterValueByName_3 == name
filterByBoolMask_3 = List.FilterByBoolMask(list=filterByBoolMask_2.out, mask=eq_2)
getLocation = Element.GetLocation(element=filterByBoolMask_3.in)
isNull = Object.IsNull(object=getLocation)
filterByBoolMask_4 = List.FilterByBoolMask(list=filterByBoolMask_3.in, mask=isNull)

# group: Filtering
code_block_19 = CodeBlock { catA=Revit.Category.ByName("Areas"); allA=ElementQueries.OfCategory(catA); "Area Scheme Id"; }
getParameterValueByName_4 = Element.GetParameterValueByName(element=code_block_19.allA, parameterName=code_block_19.out2)
code_block_20 = CodeBlock(input=getParameterValueByName_4, areaScheme=code_block_11.areaScheme) { input.Name==areaScheme; }
filterByBoolMask_5 = List.FilterByBoolMask(list=code_block_19.allA, mask=code_block_20)
code_block_21 = CodeBlock { "Level"; }

# group: Filtering
getParameterValueByName_5 = Element.GetParameterValueByName(element=filterByBoolMask_5.in, parameterName=code_block_21)
code_block_22 = CodeBlock(input=getParameterValueByName_5, l=code_block_11.level) { input==l.Name; }
filterByBoolMask_6 = List.FilterByBoolMask(list=filterByBoolMask_5.in, mask=code_block_22)

# group: Visualisation
# note: Areas of the selected level
ʳʰʸᵗʰᵐ_areas_boundaries = Rhythm.Revit.Elements.Areas.Boundaries(area=filterByBoolMask_6.in)
startPoint = Curve.StartPoint(curve=ʳʰʸᵗʰᵐ_areas_boundaries)
byPoints = Polygon.ByPoints(points=startPoint)
flatten = List.Flatten(list=byPoints)

count = List.Count(list=flatten)
ofRepeatedItem = List.OfRepeatedItem(item=filterByBoolMask_4.out, amount=count)
filterByBoolMask_7 = List.FilterByBoolMask(list=getLocation, mask=isNull)
# note: Check if the selected rooms are located inside the selected areas.
containmentTest = Polygon.ContainmentTest(polygon=flatten@@L1, point=filterByBoolMask_7.out)
filterByBoolMask_8 = List.FilterByBoolMask(list=ofRepeatedItem, mask=containmentTest)

# group: Arrange rooms by their areas
code_block_23 = CodeBlock { "Area"; }
getParameterValueByName_6 = Element.GetParameterValueByName(element=filterByBoolMask_8.in, parameterName=code_block_23)
list_sortbykey = Custom[[&] List.SortByKey](list=filterByBoolMask_8.in, keys=getParameterValueByName_6)  # package Ampersand; Sort a list (or lists) according to the order specified by the key list.
flatten_2 = List.Flatten(list=list_sortbykey.sorted_list)
count_2 = List.Count(list=list_sortbykey.sorted_list@L2)
code_block_24 = CodeBlock(n=count_2) { n..1..-1; }
string_from_object = FromObject(obj=code_block_24)

# group: Assign the area number as a room comment
number_name_of_area_to_be_user = StringInput("Number")  # "Number/Name of area to be user for room numbers:"; graph input
getParameterValueByName_7 = Element.GetParameterValueByName(element=filterByBoolMask_6.in, parameterName=number_name_of_area_to_be_user)

length = String.Length(string=string_from_object)
code_block_25 = CodeBlock { 1; }
eq_3 = length == code_block_25
code_block_26 = CodeBlock(value=string_from_object) { "0"+value; }
if_ = If(test=eq_3, true=code_block_26, false=string_from_object)
# note: Assemble room numbers. Check room numbering convention.
code_block_27 = CodeBlock(areanumber=getParameterValueByName_7, roomnumber=if_) { areanumber+"-"+roomnumber; }
flatten_3 = List.Flatten(list=code_block_27)

# group: Assing
code_block_28 = CodeBlock { "Number"; }
# note: Assing the room number to the respective room.
setParameterByName = Element.SetParameterByName(element=flatten_2, parameterName=code_block_28, value=flatten_3)

# group: Control
list_create_3 = List.Create(item0=filterByBoolMask_8.in, item1=setParameterByName)
code_block_29 = CodeBlock(x=list_create_3) { x[0]; }

# note: Collect all instances of families in the project and their names.
python_script = Python()  # IronPython2; unwired: IN[0]
# ---------- python_script.python (34 lines) ----------
import clr
import sys
sys.path.append('C:\Program Files (x86)\IronPython 2.7\Lib')
import System
from System import Array
from System.Collections.Generic import *
clr.AddReference('ProtoGeometry')
from Autodesk.DesignScript.Geometry import *
clr.AddReference("RevitNodes")
import Revit
clr.ImportExtensions(Revit.Elements)
clr.ImportExtensions(Revit.GeometryConversion)
clr.AddReference("RevitServices")
import RevitServices
from RevitServices.Persistence import DocumentManager 
from RevitServices.Transactions import TransactionManager 

clr.AddReference("RevitAPI")
clr.AddReference("RevitAPIUI")

import Autodesk 
from Autodesk.Revit.DB import *
from Autodesk.Revit.UI import *

doc = DocumentManager.Instance.CurrentDBDocument
uiapp = DocumentManager.Instance.CurrentUIApplication 
app = uiapp.Application 
uidoc = uiapp.ActiveUIDocument

#######OK NOW YOU CAN CODE########

all_fams = FilteredElementCollector(doc).OfClass(Family).ToElements()

OUT = all_fams
# ----------------------------------------
flatten_4 = List.Flatten(list=python_script)
string_from_object_2 = FromObject(obj=flatten_4)
code_block_30 = CodeBlock { "RWP"; "Balcony"; }
contains = String.Contains(string=string_from_object_2, searchFor=code_block_30.out0, ignoreCase=code_block.out1)
filterByBoolMask_9 = List.FilterByBoolMask(list=flatten_4, mask=contains)
# note: ElementByFamily
python_script_2 = Python(IN[0]=filterByBoolMask_9.in)  # IronPython2
# ---------- python_script_2.python (11 lines) ----------
import clr
clr.AddReference('RevitAPI')
import Autodesk
from Autodesk.Revit.DB import FilteredElementCollector

families = UnwrapElement(IN[0]) if isinstance(IN[0],list) else [UnwrapElement(IN[0])]

instances=[FilteredElementCollector(fam.Document).OfCategoryId(fam.FamilyCategoryId).WhereElementIsNotElementType().ToElements().FindAll(lambda x : fam.Document.GetElement(x.GetTypeId()).Family.Id == fam.Id) for fam in families]

if isinstance(IN[0], list): OUT = instances
else: OUT = instances[0]
# ----------------------------------------
room = FamilyInstance.Room(familyInstance=python_script_2)
removeNulls = Lists.Manage.RemoveNulls(Data=room)

# group: Filtering
code_block_31 = CodeBlock { "Phase"; }
getParameterValueByName_8 = Element.GetParameterValueByName(element=removeNulls.Cleaned, parameterName=code_block_31)
code_block_32 = CodeBlock(ph=getParameterValueByName_8) { ph.Name; }
code_block_33 = CodeBlock(phase=code_block_32, value=code_block_11.phase) { phase==value; }
filterByBoolMask_10 = List.FilterByBoolMask(list=removeNulls.Cleaned, mask=code_block_33)
flatten_5 = List.Flatten(list=filterByBoolMask_10.in)
uniqueItems = List.UniqueItems(list=flatten_5)

code_block_34 = CodeBlock { "ShowerTray"; "Ensuite"; }
contains_2 = String.Contains(string=string_from_object_2, searchFor=code_block_34.out0, ignoreCase=code_block.out1)
filterByBoolMask_11 = List.FilterByBoolMask(list=flatten_4, mask=contains_2)
python_script_3 = Python(IN[0]=filterByBoolMask_11.in)  # IronPython2; same code as python_script_2
room_2 = FamilyInstance.Room(familyInstance=python_script_3)
removeNulls_2 = Lists.Manage.RemoveNulls(Data=room_2)

# group: Filtering
code_block_35 = CodeBlock { "Phase"; }
getParameterValueByName_9 = Element.GetParameterValueByName(element=removeNulls_2.Cleaned, parameterName=code_block_35)
code_block_36 = CodeBlock(ph=getParameterValueByName_9) { ph.Name; }
code_block_37 = CodeBlock(phase=code_block_36, value=code_block_11.phase) { phase==value; }
filterByBoolMask_12 = List.FilterByBoolMask(list=removeNulls_2.Cleaned, mask=code_block_37)
flatten_6 = List.Flatten(list=filterByBoolMask_12.in)
uniqueItems_2 = List.UniqueItems(list=flatten_6)

code_block_38 = CodeBlock { "BedSingle"; "Single Bedroom"; }
contains_3 = String.Contains(string=string_from_object_2, searchFor=code_block_38.out0, ignoreCase=code_block.out1)
filterByBoolMask_13 = List.FilterByBoolMask(list=flatten_4, mask=contains_3)
python_script_4 = Python(IN[0]=filterByBoolMask_13.in)  # IronPython2; same code as python_script_2
room_3 = FamilyInstance.Room(familyInstance=python_script_4)
removeNulls_3 = Lists.Manage.RemoveNulls(Data=room_3)

# group: Filtering
code_block_39 = CodeBlock { "Phase"; }
getParameterValueByName_10 = Element.GetParameterValueByName(element=removeNulls_3.Cleaned, parameterName=code_block_39)
code_block_40 = CodeBlock(ph=getParameterValueByName_10) { ph.Name; }
code_block_41 = CodeBlock(phase=code_block_40, value=code_block_11.phase) { phase==value; }
filterByBoolMask_14 = List.FilterByBoolMask(list=removeNulls_3.Cleaned, mask=code_block_41)
flatten_7 = List.Flatten(list=filterByBoolMask_14.in)
uniqueItems_3 = List.UniqueItems(list=flatten_7)

code_block_42 = CodeBlock { "BedDouble"; "Double Bedroom"; }
contains_4 = String.Contains(string=string_from_object_2, searchFor=code_block_42.out0, ignoreCase=code_block.out1)
filterByBoolMask_15 = List.FilterByBoolMask(list=flatten_4, mask=contains_4)
python_script_5 = Python(IN[0]=filterByBoolMask_15.in)  # IronPython2; same code as python_script_2
room_4 = FamilyInstance.Room(familyInstance=python_script_5)
removeNulls_4 = Lists.Manage.RemoveNulls(Data=room_4)

# group: Filtering
code_block_43 = CodeBlock { "Phase"; }
getParameterValueByName_11 = Element.GetParameterValueByName(element=removeNulls_4.Cleaned, parameterName=code_block_43)
code_block_44 = CodeBlock(ph=getParameterValueByName_11) { ph.Name; }
code_block_45 = CodeBlock(phase=code_block_44, value=code_block_11.phase) { phase==value; }
filterByBoolMask_16 = List.FilterByBoolMask(list=removeNulls_4.Cleaned, mask=code_block_45)
flatten_8 = List.Flatten(list=filterByBoolMask_16.in)
uniqueItems_4 = List.UniqueItems(list=flatten_8)

code_block_46 = CodeBlock { "Bath"; "Bathroom"; }
contains_5 = String.Contains(string=string_from_object_2, searchFor=code_block_46.out0, ignoreCase=code_block.out1)
filterByBoolMask_17 = List.FilterByBoolMask(list=flatten_4, mask=contains_5)
python_script_6 = Python(IN[0]=filterByBoolMask_17.in)  # IronPython2; same code as python_script_2
room_5 = FamilyInstance.Room(familyInstance=python_script_6)
removeNulls_5 = Lists.Manage.RemoveNulls(Data=room_5)

# group: Filtering
code_block_47 = CodeBlock { "Phase"; }
getParameterValueByName_12 = Element.GetParameterValueByName(element=removeNulls_5.Cleaned, parameterName=code_block_47)
code_block_48 = CodeBlock(ph=getParameterValueByName_12) { ph.Name; }
code_block_49 = CodeBlock(phase=code_block_48, value=code_block_11.phase) { phase==value; }
filterByBoolMask_18 = List.FilterByBoolMask(list=removeNulls_5.Cleaned, mask=code_block_49)
flatten_9 = List.Flatten(list=filterByBoolMask_18.in)
uniqueItems_5 = List.UniqueItems(list=flatten_9)

code_block_50 = CodeBlock { "Utility"; "CPD"; }
contains_6 = String.Contains(string=string_from_object_2, searchFor=code_block_50.out0, ignoreCase=code_block.out1)
filterByBoolMask_19 = List.FilterByBoolMask(list=flatten_4, mask=contains_6)
python_script_7 = Python(IN[0]=filterByBoolMask_19.in)  # IronPython2; same code as python_script_2
room_6 = FamilyInstance.Room(familyInstance=python_script_7)
removeNulls_6 = Lists.Manage.RemoveNulls(Data=room_6)

# group: Filtering
code_block_51 = CodeBlock { "Phase"; }
getParameterValueByName_13 = Element.GetParameterValueByName(element=removeNulls_6.Cleaned, parameterName=code_block_51)
code_block_52 = CodeBlock(ph=getParameterValueByName_13) { ph.Name; }
code_block_53 = CodeBlock(phase=code_block_52, value=code_block_11.phase) { phase==value; }
filterByBoolMask_20 = List.FilterByBoolMask(list=removeNulls_6.Cleaned, mask=code_block_53)
flatten_10 = List.Flatten(list=filterByBoolMask_20.in)
uniqueItems_6 = List.UniqueItems(list=flatten_10)

# group: Visualisation
setParameterByName_2 = Element.SetParameterByName(parameterName=code_block.out0)  # unwired: element, value
setParameterByName_3 = Element.SetParameterByName(element=uniqueItems, parameterName=code_block.out0, value=code_block_30.out1)
setParameterByName_4 = Element.SetParameterByName(element=uniqueItems_2, parameterName=code_block.out0, value=code_block_34.out1)
setParameterByName_5 = Element.SetParameterByName(element=uniqueItems_3, parameterName=code_block.out0, value=code_block_38.out1)
setParameterByName_6 = Element.SetParameterByName(element=uniqueItems_4, parameterName=code_block.out0, value=code_block_42.out1)
setParameterByName_7 = Element.SetParameterByName(element=uniqueItems_5, parameterName=code_block.out0, value=code_block_46.out1)
setParameterByName_8 = Element.SetParameterByName(element=uniqueItems_6, parameterName=code_block.out0, value=code_block_50.out1)

code_block_54 = CodeBlock { "Sofa"; "Balcony"; }
contains_7 = String.Contains(string=string_from_object_2, searchFor=code_block_54.out0, ignoreCase=code_block.out1)
filterByBoolMask_21 = List.FilterByBoolMask(list=flatten_4, mask=contains_7)
python_script_8 = Python(IN[0]=filterByBoolMask_21.in)  # IronPython2; same code as python_script_2
room_7 = FamilyInstance.Room(familyInstance=python_script_8)
removeNulls_7 = Lists.Manage.RemoveNulls(Data=room_7)

# group: Filtering
code_block_55 = CodeBlock { "Phase"; }
getParameterValueByName_14 = Element.GetParameterValueByName(element=removeNulls_7.Cleaned, parameterName=code_block_55)
code_block_56 = CodeBlock(ph=getParameterValueByName_14) { ph.Name; }
code_block_57 = CodeBlock(phase=code_block_56, value=code_block_11.phase) { phase==value; }
filterByBoolMask_22 = List.FilterByBoolMask(list=removeNulls_7.Cleaned, mask=code_block_57)
flatten_11 = List.Flatten(list=filterByBoolMask_22.in)
uniqueItems_7 = List.UniqueItems(list=flatten_11)
code_block_58 = CodeBlock(sofaRooms=uniqueItems_7) { sofaRooms; }

code_block_59 = CodeBlock { "Dining"; "Balcony"; }
contains_8 = String.Contains(string=string_from_object_2, searchFor=code_block_59.out0, ignoreCase=code_block.out1)
filterByBoolMask_23 = List.FilterByBoolMask(list=flatten_4, mask=contains_8)
python_script_9 = Python(IN[0]=filterByBoolMask_23.in)  # IronPython2; same code as python_script_2
room_8 = FamilyInstance.Room(familyInstance=python_script_9)
removeNulls_8 = Lists.Manage.RemoveNulls(Data=room_8)

# group: Filtering
code_block_60 = CodeBlock { "Phase"; }
getParameterValueByName_15 = Element.GetParameterValueByName(element=removeNulls_8.Cleaned, parameterName=code_block_60)
code_block_61 = CodeBlock(ph=getParameterValueByName_15) { ph.Name; }
code_block_62 = CodeBlock(phase=code_block_61, value=code_block_11.phase) { phase==value; }
filterByBoolMask_24 = List.FilterByBoolMask(list=removeNulls_8.Cleaned, mask=code_block_62)
flatten_12 = List.Flatten(list=filterByBoolMask_24.in)
uniqueItems_8 = List.UniqueItems(list=flatten_12)
code_block_63 = CodeBlock(diningRooms=uniqueItems_8) { diningRooms; }

code_block_64 = CodeBlock { "Kitchen"; "Balcony"; }
contains_9 = String.Contains(string=string_from_object_2, searchFor=code_block_64.out0, ignoreCase=code_block.out1)
filterByBoolMask_25 = List.FilterByBoolMask(list=flatten_4, mask=contains_9)
python_script_10 = Python(IN[0]=filterByBoolMask_25.in)  # IronPython2; same code as python_script_2
room_9 = FamilyInstance.Room(familyInstance=python_script_10)
removeNulls_9 = Lists.Manage.RemoveNulls(Data=room_9)

# group: Filtering
code_block_65 = CodeBlock { "Phase"; }
getParameterValueByName_16 = Element.GetParameterValueByName(element=removeNulls_9.Cleaned, parameterName=code_block_65)
code_block_66 = CodeBlock(ph=getParameterValueByName_16) { ph.Name; }
code_block_67 = CodeBlock(phase=code_block_66, value=code_block_11.phase) { phase==value; }
filterByBoolMask_26 = List.FilterByBoolMask(list=removeNulls_9.Cleaned, mask=code_block_67)
flatten_13 = List.Flatten(list=filterByBoolMask_26.in)
uniqueItems_9 = List.UniqueItems(list=flatten_13)
code_block_68 = CodeBlock(kitchenRooms=uniqueItems_9) { kitchenRooms; }

# group: Processing
list_create_4 = List.Create(item0=code_block_58, item1=code_block_63, item2=code_block_68)
flatten_14 = List.Flatten(list=list_create_4)
groupByKey = List.GroupByKey(list=flatten_14, keys=flatten_14)
count_3 = List.Count(list=groupByKey.groups@L2)
code_block_69 = CodeBlock(count=count_3) { count==3; }
filterByBoolMask_27 = List.FilterByBoolMask(list=groupByKey.uniqueKeys, mask=code_block_69)
# note: get L / D /K rooms
code_block_70 = CodeBlock(LDKroom=filterByBoolMask_27.in) { "L/K/D Room"; LDKroom; }

# group: Processing
list_create_5 = List.Create(item0=code_block_58, item1=code_block_63)
flatten_15 = List.Flatten(list=list_create_5)
groupByKey_2 = List.GroupByKey(list=flatten_15, keys=flatten_15)
count_4 = List.Count(list=groupByKey_2.groups@L2)
code_block_71 = CodeBlock(count=count_4) { count==2; }
filterByBoolMask_28 = List.FilterByBoolMask(list=groupByKey_2.uniqueKeys, mask=code_block_71)
setDifference = List.SetDifference(list1=filterByBoolMask_28.in, list2=filterByBoolMask_27.in)
code_block_72 = CodeBlock(LDroom=setDifference) { "L/D Room"; LDroom; }

# group: Processing
list_create_6 = List.Create(item0=code_block_63, item1=code_block_68)
flatten_16 = List.Flatten(list=list_create_6)
groupByKey_3 = List.GroupByKey(list=flatten_16, keys=flatten_16)
count_5 = List.Count(list=groupByKey_3.groups@L2)
code_block_73 = CodeBlock(count=count_5) { count==2; }
filterByBoolMask_29 = List.FilterByBoolMask(list=groupByKey_3.uniqueKeys, mask=code_block_73)
setDifference_2 = List.SetDifference(list1=filterByBoolMask_29.in, list2=filterByBoolMask_27.in)
code_block_74 = CodeBlock(DKroom=setDifference_2) { "K/D Room"; DKroom; }

# group: Processing
list_create_7 = List.Create(item0=code_block_58, item1=code_block_68)
flatten_17 = List.Flatten(list=list_create_7)
groupByKey_4 = List.GroupByKey(list=flatten_17, keys=flatten_17)
count_6 = List.Count(list=groupByKey_4.groups@L2)
code_block_75 = CodeBlock(count=count_6) { count==2; }
filterByBoolMask_30 = List.FilterByBoolMask(list=groupByKey_4.uniqueKeys, mask=code_block_75)
setDifference_3 = List.SetDifference(list1=filterByBoolMask_30.in, list2=filterByBoolMask_27.in)
code_block_76 = CodeBlock(LKroom=setDifference_3) { "L/K Room"; LKroom; }

# group: Processing
list_create_8 = List.Create(item0=code_block_72.LDroom, item1=code_block_70.LDKroom, item2=code_block_74.DKroom, item3=code_block_76.LKroom)
# note: L/K/D rooms +
# L/D rooms +
# K/D rooms +
# L/K rooms
flatten_18 = List.Flatten(list=list_create_8)

# group: Visualisation
code_block_77 = CodeBlock { "Name"; }
setParameterByName_9 = Element.SetParameterByName(element=code_block_72.LDroom, parameterName=code_block_77, value=code_block_72.out0)
# note: Living Rooms
setDifference_4 = List.SetDifference(list1=code_block_58, list2=flatten_18)
code_block_78 = CodeBlock { "Living Room"; }
setParameterByName_10 = Element.SetParameterByName(element=setDifference_4, parameterName=code_block_77, value=code_block_78)
setParameterByName_11 = Element.SetParameterByName(element=code_block_70.LDKroom, parameterName=code_block_77, value=code_block_70.out0)
# note: Dining Rooms
setDifference_5 = List.SetDifference(list1=code_block_63, list2=flatten_18)
code_block_79 = CodeBlock { "Dining Room"; }
setParameterByName_12 = Element.SetParameterByName(element=setDifference_5, parameterName=code_block_77, value=code_block_79)
setParameterByName_13 = Element.SetParameterByName(element=code_block_74.DKroom, parameterName=code_block_77, value=code_block_74.out0)
# note: Kitchen Rooms
setDifference_6 = List.SetDifference(list1=code_block_68, list2=flatten_18)
code_block_80 = CodeBlock { "Kitchen"; }
setParameterByName_14 = Element.SetParameterByName(element=setDifference_6, parameterName=code_block_77, value=code_block_80)
setParameterByName_15 = Element.SetParameterByName(element=code_block_76.LKroom, parameterName=code_block_77, value=code_block_76.out0)

create = List.Create(item0=setParameterByName_3, item1=setParameterByName_4, item2=setParameterByName_5, item3=setParameterByName_6, item4=setParameterByName_7, item5=setParameterByName_8, item6=setParameterByName_9, item7=setParameterByName_10, item8=setParameterByName_11, item9=setParameterByName_12, item10=setParameterByName_13, item11=setParameterByName_14, item12=setParameterByName_15)
flatten_19 = List.Flatten(list=create)
setDifference_7 = List.SetDifference(list1=code_block_29, list2=flatten_19)
code_block_81 = CodeBlock { "Area"; }
getParameterValueByName_17 = Element.GetParameterValueByName(element=setDifference_7, parameterName=code_block_81)
min_area_cpd = DoubleInput(0.5)  # graph input
gt = getParameterValueByName_17 > min_area_cpd
filterByBoolMask_31 = List.FilterByBoolMask(list=setDifference_7, mask=gt)
code_block_82 = CodeBlock { "Area"; }
getParameterValueByName_18 = Element.GetParameterValueByName(element=filterByBoolMask_31.in, parameterName=code_block_82)
max_area_hall = DoubleInput(10)  # graph input
lt = getParameterValueByName_18 < max_area_hall
filterByBoolMask_32 = List.FilterByBoolMask(list=filterByBoolMask_31.in, mask=lt)
code_block_83 = CodeBlock { "Area"; }
getParameterValueByName_19 = Element.GetParameterValueByName(element=filterByBoolMask_32.in, parameterName=code_block_83)
max_area_cpd_min_area_hall = DoubleInput(2)  # graph input
lt_2 = getParameterValueByName_19 < max_area_cpd_min_area_hall
filterByBoolMask_33 = List.FilterByBoolMask(list=filterByBoolMask_32.in, mask=lt_2)
code_block_84 = CodeBlock { "Name"; "CPD"; }
setParameterByName_16 = Element.SetParameterByName(element=filterByBoolMask_33.in, parameterName=code_block_84.out0, value=code_block_84.out1)
code_block_85 = CodeBlock { "Name"; "Hall"; }
setParameterByName_17 = Element.SetParameterByName(element=filterByBoolMask_33.out, parameterName=code_block_85.out0, value=code_block_85.out1)
watch = Watch(filterByBoolMask_8.in)

# group: Usage
code_block_86 = CodeBlock { "Room - Renumber By Area & Rename By Content"; }
acg_script_usage = Custom[ACG Script Usage](script_name=code_block_86)  # Adds an entry to TXT document every time a script is run. The document is located in R:\Dynamo\05-UsageStats

# group: Assing
code_block_87 = CodeBlock { "Department"; }
ofRepeatedItem_2 = List.OfRepeatedItem(item=getParameterValueByName_7@L1, amount=count_2@@L1)
# note: Assing the room department to the respective room.
flatten_20 = List.Flatten(list=ofRepeatedItem_2)
setParameterByName_18 = Element.SetParameterByName(element=flatten_2, parameterName=code_block_87, value=flatten_20)
