# Dynamo graph About Manage.dyn (Dynamo 2.12.1.8246)
# packages: Data-Shapes 2021.2.92

code_block = CodeBlock { "Cancel"; true; "Got it!"; }
code_block_2 = CodeBlock { "ACG Manage:"; }
string = StringInput("""
ACG Manage is a series of automation tools designed to support teams in managing and maintaining the Revit models, and export information in various formats. The toolkit includes the following panels:

Audit allows users to prepare audit reports, check the model’s health and check for incorrectly named elements.

Export contains tools for exporting drawings to PDF or DWG and schedules to Excel.
Sheets helps users to easily manage, setup and duplicate drawings.

Warnings tools isolate elements associated with warnings in the active view.

For more information on how the tools work please watch the Revit Tutorials, speak with the nearest BIM staff or attend BIM workshops as and when organized.

Thank you.
""")
ui_textnote_data = Custom[UI.TextNote Data](Title=code_block_2, TextNote=string)  # package Data-Shapes; Create Data for TextNote input in UI.MultipleInputForm ++ . Check out www.data-shapes.net for more informations
ui_multipleinputform = Custom[UI.MultipleInputForm ++](ButtonText_optional=code_block.out2, Inputs=ui_textnote_data, Toggle=code_block.out1)  # package Data-Shapes; Create a form with multiple inputs. see www.data-shapes.net for tutorials and infos!
