# Dynamo graph Check Family Naming.dyn "Check Family Naming_py" (Dynamo 2.12.1.8246)
# packages: Data-Shapes 2021.2.92

# group: Usage
code_block = CodeBlock { "Check Family Naming"; }
acg_script_usage = Custom[ACG Script Usage](scriptName=code_block)  # Adds an entry to Excel document every time a script is run. The document is located in S:\Dynamo\05-UsageStats

code_block_2 = CodeBlock { "\n"; }
code_block_3 = CodeBlock { "List of incorrectly named families:"; ""; }
acg_quick_family_naming_check = Custom[ACG Quick Family Naming Check]()
list_create = List.Create(item0=code_block_3.out0, item1=code_block_3.out1, item2=acg_quick_family_naming_check.ListOf_Incompliant)
flatten = List.Flatten(list=list_create)
join = String.Join(separator=code_block_2, string0=flatten)

# group: Input
code_block_4 = CodeBlock { "Result:"; true; "Got it!"; }
textnote_data = Custom[TextNote Data](Title=code_block_4.out0, TextNote=join)  # package Data-Shapes; Create Data for TextNote input in UI.MultipleInputForm ++ . Check out www.data-shapes.net for more informations
multipleinputform = Custom[MultipleInputForm ++](ButtonText_optional=code_block_4.out2, Inputs=textnote_data, Toggle=code_block_4.out1)  # package Data-Shapes; Create a form with multiple inputs. see www.data-shapes.net for tutorials and infos!
