# Dynamo graph Check Group Naming.dyn "Check Group Naming_py" (Dynamo 2.12.1.8246)
# packages: Data-Shapes 2021.2.92

code_block = CodeBlock { "\n"; }
code_block_2 = CodeBlock { "List of incorrectly named groups:"; ""; }
acg_quickaudit_groupscheck = Custom[ACG QuickAudit.GroupsCheck]()
list_create = List.Create(item0=code_block_2.out0, item1=code_block_2.out1, item2=acg_quickaudit_groupscheck.List_Naming)
flatten = List.Flatten(list=list_create)
join = String.Join(separator=code_block, string0=flatten)

# group: Input
file_path = Filename("..\..\ACG_logo.png")
file_from_path = FileObject(path=file_path)
readFromFile = Image.ReadFromFile(file=file_from_path)
code_block_3 = CodeBlock { "Result:"; true; "Got it!"; }
textnote_data = Custom[TextNote Data](Title=code_block_3.out0, TextNote=join)  # package Data-Shapes; Create Data for TextNote input in UI.MultipleInputForm ++ . Check out www.data-shapes.net for more informations
multipleinputform = Custom[MultipleInputForm ++](Logo_optional=readFromFile, ButtonText_optional=code_block_3.out2, Inputs=textnote_data, Toggle=code_block_3.out1)  # package Data-Shapes; Create a form with multiple inputs. see www.data-shapes.net for tutorials and infos!
