# Dynamo graph Check In-Place Families.dyn (Dynamo 2.17.1.4055)
# packages: Data-Shapes 2021.2.92, Clockwork for Dynamo 1.x 1.0.3

# group: Usage
code_block = CodeBlock { "Check In-Place Families"; }
acg_script_usage = Custom[ACG Script Usage](script_name=code_block)  # Adds an entry to TXT document every time a script is run. The document is located in R:\Dynamo\05-UsageStats

code_block_2 = CodeBlock { "\n"; }

# group: Visualisation
python_script = Python()  # IronPython2; unwired: IN[0]
# ---------- python_script.python (43 lines) ----------
# Load the Python Standard and DesignScript Libraries
import clr
import sys
sys.path.append('C:\Program Files (x86)\IronPython 2.7\Lib')
import System
from System import Array
from System.Collections.Generic import *
clr.AddReference('ProtoGeometry')
from Autodesk.DesignScript.Geometry import *
clr.AddReference("RevitNodes")
import Revit
clr.ImportExtensions(Revit.Elements)
clr.ImportExtensions(Revit.GeometryConversion)
clr.AddReference("RevitServices")
import RevitServices
from RevitServices.Persistence import DocumentManager 
from RevitServices.Transactions import TransactionManager 

clr.AddReference("RevitAPI")
clr.AddReference("RevitAPIUI")

import Autodesk 
from Autodesk.Revit.DB import *
from Autodesk.Revit.UI import *

doc = DocumentManager.Instance.CurrentDBDocument
uiapp = DocumentManager.Instance.CurrentUIApplication 
app = uiapp.Application 
uidoc = uiapp.ActiveUIDocument

lst = []

# collect all elements to be processed
famCol = FilteredElementCollector(doc).OfClass(Family).ToElements()

count = 0
for fam in famCol:
	if fam.IsInPlace:
		lst.append(fam.Name)
		count += 1


OUT = [lst, count]
# ----------------------------------------

code_block_3 = CodeBlock(x=python_script) { "There are " + x[1] + " in-place families in the model:"; ""; x[0]; }
list_create = List.Create(item0=code_block_3.out0, item1=code_block_3.out1, item2=code_block_3.out2)
flatten = List.Flatten(list=list_create)
join = String.Join(separator=code_block_2, string0=flatten)

# group: Input
code_block_4 = CodeBlock { "Result:"; true; "Got it!"; }
textnote_data = Custom[TextNote Data](Title=code_block_4.out0, TextNote=join)  # package Data-Shapes; Create Data for TextNote input in UI.MultipleInputForm ++ . Check out www.data-shapes.net for more informations
multipleinputform = Custom[MultipleInputForm ++](ButtonText_optional=code_block_4.out2, Inputs=textnote_data, Toggle=code_block_4.out1)  # package Data-Shapes; Create a form with multiple inputs. see www.data-shapes.net for tutorials and infos!

acg_quick_family_naming_check = Custom[ACG Quick Family Naming Check]()
isInPlace = Custom[Family.IsInPlace]()  # package Clockwork for Dynamo 1.x; Determines if a family is an in-place family; unwired: family
