# Dynamo graph Quick Audit.dyn (Dynamo 2.17.1.4055)
# packages: BumbleBee 2021.25.3, Data-Shapes 2021.2.92, WombatDynamo 2.3.0

# group: Get all warnings
current = Document.Current()
getWarnings = Warning.GetWarnings(document=current)
description = Warning.Description(warning=getWarnings)

# group: Warnings - All
count = List.Count(list=description)

# group: UI - Get length of sheet numbers
code_block = CodeBlock { "Cancel"; true; "Run"; 700; 350; }
code_block_2 = CodeBlock { "Sheet Number Length"; "4"; true; }
textbox_data = Custom[TextBox Data](InputName=code_block_2.out0, DefaultText=code_block_2.out1, IsNumberEntry=code_block_2.out2)  # package Data-Shapes; Create Data for TextBox input in UI.MultipleInputForm ++ . Check out www.data-shapes.net for more informations
ui_multipleinputform = Custom[UI.MultipleInputForm ++](ButtonText_optional=code_block.out2, Inputs=textbox_data, Toggle=code_block.out1, CancelButtonText_optional=code_block.out0, Width_optional=code_block.out3, LabelWidth_optional=code_block.out4)  # package Data-Shapes; Create a form with multiple inputs. see www.data-shapes.net for tutorials and infos!
end = Revit.Transaction.Transaction.End(input=ui_multipleinputform.User_Inputs)
code_block_3 = CodeBlock(sheetNumbLng=end) { sheetNumbLng[0]; }

# group: Custom checks
acg_quickaudit_cadimportscheck = Custom[ACG QuickAudit.CADImportsCheck]()
acg_quickaudit = Custom[ACG QuickAudit.RedundantRoomCheck]()
acg_quickaudit_2 = Custom[ACG QuickAudit.RedundantAreaCheck]()
acg_quickaudit_groupscheck = Custom[ACG QuickAudit.GroupsCheck]()
acg_quick_sheet_naming_check = Custom[ACG Quick Sheet Naming Check](NumberLength=code_block_3)
acg_quickaudit_familynamingcheck = Custom[ACG QuickAudit.FamilyNamingCheck]()
ACGQuickAuditViewsOnSheetsNamingCheck = Custom[ACGQuickAuditViewsOnSheetsNamingCheck]()  # Check views placed on PRODUCTION sheets. Only Plans, Elevations and Sections
ACGQuickLevelsAndGridsCheck = Custom[ACGQuickLevelsAndGridsCheck]()
ACGQuickFamilyInPlaceCheck = Custom[ACGQuickFamilyInPlaceCheck]()
acg_quick_duplicate_levels_check = Custom[ACG Quick Duplicate Levels Check]()

# group: Visualisation
# note: get all view templates
# (including null)
python_script = Python()  # IronPython2
# ---------- python_script.python (62 lines) ----------
import clr
import sys
sys.path.append('C:\Program Files (x86)\IronPython 2.7\Lib')
import System
from System import Array
from System.Collections.Generic import *
clr.AddReference('ProtoGeometry')
from Autodesk.DesignScript.Geometry import *
clr.AddReference("RevitNodes")
import Revit
clr.ImportExtensions(Revit.Elements)
clr.ImportExtensions(Revit.GeometryConversion)
clr.AddReference("RevitServices")
import RevitServices
from RevitServices.Persistence import DocumentManager 
from RevitServices.Transactions import TransactionManager 

clr.AddReference("RevitAPI")
clr.AddReference("RevitAPIUI")

import Autodesk 
from Autodesk.Revit.DB import *
from Autodesk.Revit.UI import *

import os
from System.IO import Directory, SearchOption

doc = DocumentManager.Instance.CurrentDBDocument
uiapp = DocumentManager.Instance.CurrentUIApplication 
app = uiapp.Application 
uidoc = uiapp.ActiveUIDocument

#######OK NOW YOU CAN CODE########
#get all views
views = FilteredElementCollector(doc)\
.OfCategory(BuiltInCategory.OST_Views)\
.WhereElementIsNotElementType()\
.ToElements()

# get all templates
all_templates = [v for v in views if v.IsTemplate]
templates = []
for v in all_templates:
	if v is None:
		continue
	else:
		templates.append(v)
# get all used template ids	
used_template_ids = []
for v in views:
	if v.ViewTemplateId in used_template_ids:
		continue
	else:
		used_template_ids.append(v.ViewTemplateId)

# get all used templates
used_templates = []
for i in used_template_ids:
	used_templates.append(doc.GetElement(i))
		

OUT = templates, used_templates
# ----------------------------------------
code_block_4 = CodeBlock(x=python_script) { all_templates = x[0]; used_templates = x[1]; }
python_script_2 = Python(IN[0]=code_block_4.all_templates, IN[1]=code_block_4.used_templates)  # IronPython2
# ---------- python_script_2.python (46 lines) ----------
def RemoveNulls(list):
	clean_list = []
	for item in list:
		if item is None: 
			continue
		else:
			clean_list.append(item)
	return clean_list

### COMPLIANCE
#clean the lists
all_templates = RemoveNulls(IN[0])
used_templates = RemoveNulls(IN[1])

#get the non-compliant view templates
non_compliant = []
for vt in all_templates:
	name = vt.Name
	if len(name) >8:
		if name[8] == "-" or name.startswith("ACG-") or name.startswith("WIP-"):
			continue
		else:
			non_compliant.append(vt.Name)
	else:
		if name.startswith("ACG-") or name.startswith("WIP-"):
			continue
		else:
			non_compliant.append(vt.Name)
		
# get the numbers
ttl_count = len(all_templates)
non_c_count = len(non_compliant)
percent_compl = round(non_c_count/float(ttl_count)*100)
		
### get the unused templates
unused_templates = []
for vt in all_templates:
	if vt not in used_templates:
		unused_templates.append(vt.Name)
		
unused_count = len(unused_templates)
percent_use = round(unused_count/float(ttl_count)*100)
		
	
#OUT = percentage, non_compliant
OUT = percent_compl,  non_compliant, percent_use, unused_templates, len(all_templates)
# ----------------------------------------
code_block_5 = CodeBlock(x=python_script_2) { result_naming = x[0]; list_naming = x[1]; result_use = x[2]; list_use = x[3]; }

# group: Warnings - Joining
code_block_6 = CodeBlock { ["join","overlap", "but miss", "hosted"]; }
contains = String.Contains(string=description, searchFor=code_block_6@@L1)
transpose = List.Transpose(lists=contains)
code_block_7 = CodeBlock(lst=transpose) { List.AnyTrue(lst); }
code_block_8 = CodeBlock(warn=code_block_7) { num=DSCore.List.CountTrue(warn); }

# group: File size
fileSize = Custom[ActiveDocument.FileSize]()  # package Data-Shapes; Gets the file size of the ative document, even if it is a BIM360 Design workshared project.
code_block_9 = CodeBlock { " "; }
split = String.Split(string=fileSize, separator0=code_block_9)
code_block_10 = CodeBlock(x=split) { x[0]; }
toNumber = String.ToNumber(string=code_block_10)

# group: Processing
# note: get the initials on the Revit user
python_script_3 = Python()  # IronPython2
# ---------- python_script_3.python (30 lines) ----------
import clr
import sys
sys.path.append('C:\Program Files (x86)\IronPython 2.7\Lib')
import System
clr.AddReference('ProtoGeometry')
clr.AddReference("RevitNodes")
import Revit
clr.AddReference("RevitServices")
import RevitServices
from RevitServices.Persistence import DocumentManager 

clr.AddReference("RevitAPI")
clr.AddReference("RevitAPIUI")
import datetime

doc = DocumentManager.Instance.CurrentDBDocument
uiapp = DocumentManager.Instance.CurrentUIApplication 
app = uiapp.Application 
uidoc = uiapp.ActiveUIDocument

###CODE, YOU GORGEOUS B_STARD########
today = datetime.date.today().strftime("%d.%m.%y")


user = app.Username
first = user.split(".")[0][:1].upper()
second = user.split(".")[1][:1].upper()

#OUT = first+second
OUT = today + " | " + first+second
# ----------------------------------------

list_create = List.Create(item0=count, item1=acg_quickaudit_cadimportscheck, item2=acg_quickaudit, item3=acg_quickaudit_2, item4=acg_quickaudit_groupscheck.Results_Naming, item5=acg_quickaudit_groupscheck.Results_Nesting, item6=acg_quick_sheet_naming_check.Results, item7=acg_quickaudit_familynamingcheck.Results_Naming, item8=ACGQuickAuditViewsOnSheetsNamingCheck.Result, item9=code_block_5.result_naming, item10=code_block_5.result_use, item11=ACGQuickLevelsAndGridsCheck.Result_percent, item12=code_block_8, item13=toNumber, item14=ACGQuickFamilyInPlaceCheck.Result, item15=acg_quick_duplicate_levels_check.Result, item16=python_script_3)
flatten = List.Flatten(list=list_create)
end_2 = Revit.Transaction.Transaction.End(input=flatten)
string_from_object = FromObject(object=end_2)
code_block_11 = CodeBlock { "NaN"; "0"; "null"; }
replace = String.Replace(string=string_from_object, searchFor=code_block_11.out0, replaceWith=code_block_11.out1)
replace_2 = String.Replace(string=replace, searchFor=code_block_11.out2, replaceWith=code_block_11.out1)
code_block_12 = CodeBlock { ".000000"; ""; }
replace_3 = String.Replace(string=replace_2, searchFor=code_block_12.out0, replaceWith=code_block_12.out1)

# group: Visualisation
python_script_4 = Python()  # IronPython2
# ---------- python_script_4.python (61 lines) ----------
import clr
import sys
sys.path.append('C:\Program Files (x86)\IronPython 2.7\Lib')
import System
from System import Array
from System.Collections.Generic import *
clr.AddReference('ProtoGeometry')
from Autodesk.DesignScript.Geometry import *
clr.AddReference("RevitNodes")
import Revit
clr.ImportExtensions(Revit.Elements)
clr.ImportExtensions(Revit.GeometryConversion)
clr.AddReference("RevitServices")
import RevitServices
from RevitServices.Persistence import DocumentManager 
from RevitServices.Transactions import TransactionManager 

clr.AddReference("RevitAPI")
clr.AddReference("RevitAPIUI")

import Autodesk 
from Autodesk.Revit.DB import *
from Autodesk.Revit.UI import *

import os
from System.IO import Directory, SearchOption

doc = DocumentManager.Instance.CurrentDBDocument
uiapp = DocumentManager.Instance.CurrentUIApplication 
app = uiapp.Application 
uidoc = uiapp.ActiveUIDocument

#######OK NOW YOU CAN CODE########
# get directory & project number
prj_info = FilteredElementCollector(doc)\
.OfCategory(BuiltInCategory.OST_ProjectInformation)\
.WhereElementIsNotElementType()\
.ToElements()[0]

prj_dir = prj_info.LookupParameter("Project Directory").AsString()
prj_number = prj_info.LookupParameter("Project Number").AsString()
model_number = prj_info.LookupParameter("ACG_Model Number").AsString()

# assemble the Quick Audit History file path
history_path = prj_dir + "\\06 Audit\\" + prj_number + "-QuickAuditHistory.xlsx"
audit_dir = prj_dir + "\\06 Audit"

# get all quick audit reports
qa_reports, qa_dates = [], []
if Directory.Exists(audit_dir):
	dir_contents = Directory.GetFiles(audit_dir, ".", SearchOption.TopDirectoryOnly)
	for file in dir_contents:
		if "QuickAuditResult" in file and model_number in file:
			qa_reports.append(file)
			#get the date
			codes = file.split("-")
			date = codes[len(codes) - 2]
			qa_dates.append(date[:4] + "." + date[4:6] + "." + date[6:])
			

OUT = history_path, model_number, qa_reports, qa_dates
# ----------------------------------------

code_block_13 = CodeBlock { c=Revit.Category.ByName("Project Information"); ElementQueries.OfCategory(c); }
code_block_14 = CodeBlock { "Project Directory"; "ACG_Model Number"; }
getParameterValueByName = Element.GetParameterValueByName(element=code_block_13.out1, parameterName=code_block_14.out0)
getParameterValueByName_2 = Element.GetParameterValueByName(element=code_block_13.out1, parameterName=code_block_14.out1)
now = DateTime.Now()
code_block_15 = CodeBlock { "yyyyMMdd"; }
format = DateTime.Format(dateTime=now, format=code_block_15)
code_block_16 = CodeBlock(prjdirectory=getParameterValueByName, modelNumber=getParameterValueByName_2, date=format) { prjdirectory+"\\06 Audit\\"+modelNumber+"-"+date+"-"+"QuickAuditResults.csv"; }
string_from_object_2 = FromObject(object=code_block_16)

# group: EXPORT CSV
exportCSV = Data.ExportCSV(filePath=string_from_object_2, data=end_2)

# group: WAIT !!!
code_block_17 = CodeBlock(data=python_script_4, waitfor=exportCSV) { [data,waitfor][0]; }

# group (continued): Visualisation
code_block_18 = CodeBlock(x=code_block_17) { history_path = x[0]; model_number = x[1]; report_paths = x[2]; report_dates = x[3]; }

# group: Input - Read the results from the reports
importCSV = Data.ImportCSV(filePath=code_block_18.report_paths)
code_block_19 = CodeBlock { 1; }
flatten_2 = List.Flatten(list=importCSV, amount=code_block_19)
transpose_2 = List.Transpose(lists=flatten_2)

# group: Visualisation
python_script_5 = Python(IN[0]=transpose_2)  # IronPython2
# ---------- python_script_5.python (76 lines) ----------
import clr
import sys
sys.path.append('C:\Program Files (x86)\IronPython 2.7\Lib')
import System
from System import Array
from System.Collections.Generic import *
clr.AddReference('ProtoGeometry')
from Autodesk.DesignScript.Geometry import *
clr.AddReference("RevitNodes")
import Revit
clr.ImportExtensions(Revit.Elements)
clr.ImportExtensions(Revit.GeometryConversion)
clr.AddReference("RevitServices")
import RevitServices
from RevitServices.Persistence import DocumentManager 
from RevitServices.Transactions import TransactionManager 

clr.AddReference("RevitAPI")
clr.AddReference("RevitAPIUI")

import Autodesk 
from Autodesk.Revit.DB import *
from Autodesk.Revit.UI import *

import os
from System.IO import Directory, SearchOption
import math

doc = DocumentManager.Instance.CurrentDBDocument
uiapp = DocumentManager.Instance.CurrentUIApplication 
app = uiapp.Application 
uidoc = uiapp.ActiveUIDocument

#######OK NOW YOU CAN CODE########
data = IN[0]

# generate alphabet
def alpha():
	alphabet = []
	for letter in range(ord("A"), ord("Z")+1):
		alphabet.append(chr(letter))
	return alphabet
	
#convet number to letter for excel
def convert_to_alpha(val, alphabet):
	count = len(alphabet)
	str2 = alphabet[(val % count) - 1]
	
	rep_alpha = int(math.floor((val - 1) / count))
	if rep_alpha == 0:
		return str2
	else:
		str1 = alphabet[rep_alpha - 1]	
		return str1 + str2
	
count_audits = len(data[0])
az = alpha()
column = convert_to_alpha(count_audits + 15, az)

# replace any nulls/Nones with 0
for check in data:
	for i in range(len(check)):
		if str(check[i]) == "None":
			check[i] = "0"
		else:
			check[i] = str(check[i])
			
# make list of empty spaces
spaces = []
for i in range(count_audits):
	spaces.append(" ")
	
	
			
OUT = data, count_audits, column, spaces
#OUT = data, spaces			
# ----------------------------------------
# note: replace null/none with 0
# and convert to string
code_block_20 = CodeBlock(x=python_script_5) { data = x[0]; count = x[1]; column = x[2]; empty_list = x[3]; }

code_block_21 = CodeBlock(column=code_block_20.column)
# ---------- code_block_21.designscript (19 lines) ----------
DSCore.Color.ByARGB(255,45,53,61);

[
"O2:"+column+"2",
"O6:"+column+"6",
"O9:"+column+"9",
"O13:"+column+"13",
"O17:"+column+"17",
"O22:"+column+"22",
"O26:"+column+"26"
];

7;

DSCore.Color.ByARGB(255,217,217,217);
"O1:"+column+"1";

"P1";
true;
# ----------------------------------------
code_block_22 = CodeBlock(dates=code_block_18.report_dates, empty=code_block_20.empty_list, x=code_block_20.data)
# ---------- code_block_22.designscript (23 lines) ----------
[
dates,
empty,
x[0],
x[12],
empty,empty,
x[1],
empty,empty,
x[2],
x[3],
empty,empty,
x[4],
x[5],
empty,empty,
x[7],
x[6],
x[8],
empty,empty,
x[9],
x[10],
empty,empty,
x[11]
];
# ----------------------------------------

# group: Processing
pattern_types = PatternTypesUi("xlSolid")
fill_style = Custom[Fill Style](PatternType=pattern_types, BackgroundColor=code_block_21.out0, PatternColor=code_block_21.out0)  # package BumbleBee; This node generates a Fill Style that can be used for conditional formatting or regular cell formatting.
graphic_style = Custom[Graphic Style](FillStyle=fill_style)  # package BumbleBee; This node will create a graphic style that can be used either for conditional formatting or regular cell formatting.
ofRepeatedItem = List.OfRepeatedItem(item=graphic_style, amount=code_block_21.out2)
fill_style_2 = Custom[Fill Style](PatternType=pattern_types, BackgroundColor=code_block_21.out3, PatternColor=code_block_21.out3)
graphic_style_2 = Custom[Graphic Style](FillStyle=fill_style_2)

# group: Collect all data and write to Excel
bb_data = Custom[BB Data](sheetName=code_block_18.model_number, origin=code_block_21.out5, data=code_block_22)  # package BumbleBee; This node is a building block for different modes of writing to Excel files. You can combines this node into a list to write to multiple sheets or use just one to write to a single sheet.
write_excel = Custom[Write Excel](filePath=code_block_18.history_path, runIt=code_block_21.out6, BBData=bb_data)  # package BumbleBee; This node will write data to Excel file and based on how your BBData nodes are structured it will either override the exsting file, create a new one and write a single worksheet or write multiple worksheets.
bb_style = Custom[BB Style](SheetName=code_block_18.model_number, CellRange=code_block_21.out1@L1, GraphicStyle=ofRepeatedItem@@L1)  # package BumbleBee; This node is a building block for different modes of formatting an Excel file. You can combines this node into a list to apply formatting to multiple ranges or sheets at the same time.
format_excel = Custom[Format Excel](filePath=code_block_18.history_path, RunIt=code_block_21.out6, BBStyle=bb_style@@L2)  # package BumbleBee; This node will allow you to apply formatting to a specific range within the document. You can format a single range on a single sheet or multiple ranges on multiple sheets at the same time.
bb_style_2 = Custom[BB Style](SheetName=code_block_18.model_number, CellRange=code_block_21.out4, GraphicStyle=graphic_style_2)
format_excel_2 = Custom[Format Excel](filePath=code_block_18.history_path, RunIt=code_block_21.out6, BBStyle=bb_style_2)

code_block_23 = CodeBlock { c=Revit.Category.ByName("Detail Items"); ElementQueries.OfCategory(c); }
name = Element.Name(element=code_block_23.out1)
code_block_24 = CodeBlock { "ACG-2010-ModelHealthBars"; }
eq = name == code_block_24
filterByBoolMask = List.FilterByBoolMask(list=code_block_23.out1, mask=eq)
code_block_25 = CodeBlock(x=filterByBoolMask.in) { x[0]; }
code_block_26 = CodeBlock()
# ---------- code_block_26.designscript (20 lines) ----------
[
"Warnings",
"CAD Imports",
"Redundant Rooms",
"Redundant Areas",
"Group Naming",
"Group Nesting",
"Sheet Naming",
"Family Naming",
"View Naming",
"View Template Naming",
"View Template Usage",
"Levels & Grids",
"Joining & Overlapping",
"File Size",
"In-Place Families",
"Duplicate Levels",

"Update Date"
];
# ----------------------------------------
setParameterByName = Element.SetParameterByName(element=code_block_25, parameterName=code_block_26@L1, value=flatten@L1)

# group: In-Place families
code_block_27 = CodeBlock { DSCore.Types.FindTypeByNameInAssembly("FamilyInstance","RevitAPI"); }  # frozen
all_elements_of_type = ElementsOfType(element_type=code_block_27)
isInPlace = WombatDynamo.FamilyInstance.IsInPlace(instance=all_elements_of_type)
isNull = Object.IsNull(object=isInPlace)
filterByBoolMask_2 = List.FilterByBoolMask(list=all_elements_of_type, mask=isNull)
isInPlace_2 = WombatDynamo.FamilyInstance.IsInPlace(instance=filterByBoolMask_2.out)
filterByBoolMask_3 = List.FilterByBoolMask(list=filterByBoolMask_2.out, mask=isInPlace_2)
code_block_28 = CodeBlock(el=filterByBoolMask_3.in) { el.Type; }
family = FamilyType.Family(familyType=code_block_28)
code_block_29 = CodeBlock(el=family) { listOfFams=el.Name; count=DSCore.List.Count(el); }
