# Dynamo graph Schedules To Excel_d.dyn (Dynamo 2.17.1.4055)
# packages: BumbleBee 2021.25.3, bimorphNodes 3.0.3, Data-Shapes 2021.2.92

# group: Input
code_block = CodeBlock { "Note:"; }
string = StringInput("This tool will export a given Revit schedule to Excel. If the file already exist you can clear the current content and keep any formatting. Please make sure the .xlsx file is closed when running the tool.")
textnote_data = Custom[TextNote Data](Title=code_block, TextNote=string)  # package Data-Shapes; Create Data for TextNote input in UI.MultipleInputForm ++ . Check out www.data-shapes.net for more informations

# group: Input
code_block_2 = CodeBlock { "Navigate to Excel file:"; }
filepath_data = Custom[FilePath Data](InputName=code_block_2)  # package Data-Shapes; Create filepath input for UI.MultipleInputForm ++ . Check out www.data-shapes.net for more infos !
# note: collect all schedules
python_script = Python()  # IronPython2
# ---------- python_script.python (44 lines) ----------
# Load the Python Standard and DesignScript Libraries
import clr
import sys
import os.path
from datetime import datetime
from System import Environment
sys.path.append('C:\Program Files (x86)\IronPython 2.7\Lib')
import System
from System import Array
from System.Collections.Generic import *
clr.AddReference('ProtoGeometry')
from Autodesk.DesignScript.Geometry import *
clr.AddReference("RevitNodes")
import Revit
clr.ImportExtensions(Revit.Elements)
clr.ImportExtensions(Revit.GeometryConversion)
clr.AddReference("RevitServices")
import RevitServices
from RevitServices.Persistence import DocumentManager 
from RevitServices.Transactions import TransactionManager 

clr.AddReference("RevitAPI")
clr.AddReference("RevitAPIUI")

import Autodesk 
from Autodesk.Revit.DB import *
from Autodesk.Revit.UI import *
import time

doc = DocumentManager.Instance.CurrentDBDocument
uiapp = DocumentManager.Instance.CurrentUIApplication 
app = uiapp.Application 
uidoc = uiapp.ActiveUIDocument

values = []
keys = []

schedules = FilteredElementCollector(doc).OfClass(ViewSchedule).WhereElementIsNotElementType().ToElements()
for s in schedules:
	if 'Revision Schedule' not in s.Name:
		values.append(s)
		keys.append(s.Name)

OUT = keys, values
# ----------------------------------------
code_block_3 = CodeBlock(x=python_script) { "Select a schedule:"; names = x[0]; schedules = x[1]; 0; }
dropdown_data = Custom[DropDown Data](InputName=code_block_3.out0, Keys=code_block_3.names, Values=code_block_3.schedules, DefaultValueIndex=code_block_3.out3)  # package Data-Shapes; Create data for DropDown input in UI.MultiInputForm ++ . Check out www.data-shapes.net for more infos.
code_block_4 = CodeBlock { "Sheet name:"; "Sheet1"; }
textbox_data = Custom[TextBox Data](InputName=code_block_4.out0, DefaultText=code_block_4.out1)  # package Data-Shapes; Create Data for TextBox input in UI.MultipleInputForm ++ . Check out www.data-shapes.net for more informations
code_block_5 = CodeBlock { "Clear existing content:"; true; }
boolean_input = Custom[Boolean input](InputName=code_block_5.out0, DefaultValue=code_block_5.out1)  # package Data-Shapes; Creates a boolean input for UI.MultipleInputForm ++ . Check out www.data-shapes.net for more infos!

# group: Input
code_block_6 = CodeBlock { true; "Export"; "Cancel"; false; 800; 400; }
list_create = List.Create(item0=textnote_data, item1=filepath_data, item2=dropdown_data, item3=textbox_data, item4=boolean_input)
ui_multipleinputform = Custom[UI.MultipleInputForm ++](ButtonText_optional=code_block_6.out1, Inputs=list_create, Toggle=code_block_6.out0, CancelButtonText_optional=code_block_6.out2, Width_optional=code_block_6.out4, LabelWidth_optional=code_block_6.out5)  # package Data-Shapes; Create a form with multiple inputs. see www.data-shapes.net for tutorials and infos!
code_block_7 = CodeBlock(x=ui_multipleinputform.User_Inputs) { path = x[0]; schedule = x[1]; sheet = x[2]; clear = x[3]; }

# group: Processing
code_block_8 = CodeBlock { true; }
clearContent = Custom[Excel.ClearContent](file_path=code_block_7.path, run_it=code_block_8, sheet_name=code_block_7.sheet, clear_content=code_block_7.clear)  # Deletes data from Excel cells and removes any formatting. Taken from BumbleBee and updated.

# group: Control
list_create_2 = List.Create(item0=code_block_7.path, item1=clearContent)
code_block_9 = CodeBlock(x=list_create_2) { x[0]; }

# group: Processing
not_ = Not(x=ui_multipleinputform.Was_Cancelled)
code_block_10 = CodeBlock { "A1"; }
getData = Revit.Schedule.GetData(scheduleView=code_block_7.schedule)
bb_data = Custom[BB Data](sheetName=code_block_7.sheet, origin=code_block_10, data=getData)  # package BumbleBee; This node is a building block for different modes of writing to Excel files. You can combines this node into a list to write to multiple sheets or use just one to write to a single sheet.

write_excel = Custom[Write Excel](filePath=code_block_9, runIt=not_, BBData=bb_data)  # package BumbleBee; This node will write data to Excel file and based on how your BBData nodes are structured it will either override the exsting file, create a new one and write a single worksheet or write multiple worksheets.

# group: Control
code_block_11 = CodeBlock { "Schedule - Export to Excel"; }
acg_script_usage = Custom[ACG Script Usage](script_name=code_block_11)  # Adds an entry to TXT document every time a script is run. The document is located in R:\Dynamo\05-UsageStats

python_script_2 = Python()  # IronPython2; same code as python_script
