# Dynamo graph Issue Model.dyn (Dynamo 2.17.1.4055)
# packages: archi-lab.net 2023.213.1722, Genius Loci 2021.2.3, SteamNodes 1.2.3, Data-Shapes 2021.2.92

# group: CLEAN THE NEW MODEL
# note: AWAIT

# group: EXPORT ADDITIONAL FORMATS
# note: AWAIT

# group: UPDATE METADATA AND SYNC THE WIP MODEL
# note: AWAIT

# group: SAVE NEW RVT FILE ON THE SERVER
# note: AWAIT

# group: ASSIGN THE SHARED METADATA
# note: AWAIT

# group: Input
code_block = CodeBlock { true; "Cancel"; "Run"; 700; 350; }
code_block_2 = CodeBlock()
# ---------- code_block_2.designscript (2 lines) ----------
"Note:";
"This script will: \n1. Assign new revision to the model and syncronise with Central.\n2. Save a detached copy of the model in the project's 01 WIP - Internal Work folder (or 02 Shared - Externally) and remove all sheets and views.\n3. Remove all linked files (optional).\n4. Export NWC and IFC files (optional).\n\nPlease make sure all users have relinquished all elements before running the script. If there are Design Options in the model, please accept primary after the script has run";
# ----------------------------------------
textnote_data = Custom[TextNote Data](Title=code_block_2.out0, TextNote=code_block_2.out1)  # package Data-Shapes; Create Data for TextNote input in UI.MultipleInputForm ++ . Check out www.data-shapes.net for more informations
code_block_3 = CodeBlock { "Issued to:"; "Issued by:"; "Approved by:"; "Revision description"; }
code_block_4 = CodeBlock { "DT"; ""; "Issued for co-ordination"; }
ui_textbox_data = Custom[UI.TextBox Data](InputName=code_block_3.out0, DefaultText=code_block_4.out0)  # package Data-Shapes; Create Data for TextBox input in UI.MultipleInputForm ++ . Check out www.data-shapes.net for more informations
ui_textbox_data_2 = Custom[UI.TextBox Data](InputName=code_block_3.out1, DefaultText=code_block_4.out1)
ui_textbox_data_3 = Custom[UI.TextBox Data](InputName=code_block_3.out2, DefaultText=code_block_4.out1)
ui_textbox_data_4 = Custom[UI.TextBox Data](InputName=code_block_3.out3, DefaultText=code_block_4.out2)
code_block_5 = CodeBlock { "Suitability :"; }
code_block_6 = CodeBlock()
# ---------- code_block_6.designscript (23 lines) ----------
[
"S1 - Suitable for Co-ordination",
"S2 - Suitable for Information",
"S3 - Suitable for Review & Comment",
"S4 - Suitable for Stage Approval",
"S6 - Suitable for PIM Authorization",
"S7 - Suitable for AIM Authorization",
"A1 - Authorized and Accepted",
"A2 - Authorized and Accepted",
"A3 - Authorized and Accepted",
"A4 - Authorized and Accepted",
"B1 - Partial Sign-off",
"B2 - Partial Sign-off",
"B3 - Partial Sign-off",
"B4 - Partial Sign-off",
"CR - As Constructed Record"
];

"S1 - Suitable for Co-ordination";

false;

0;
# ----------------------------------------
ui_dropdown_data = Custom[UI.DropDown Data](InputName=code_block_5, Keys=code_block_6.out0, Values=code_block_6.out0, DefaultValueIndex=code_block_6.out3, Sorted_optional=code_block_6.out2)  # package Data-Shapes; Create data for DropDown input in UI.MultiInputForm ++ . Check out www.data-shapes.net for more infos.
code_block_7 = CodeBlock { "Remove all .rvt links?"; true; }
ui_boolean_input = Custom[UI.Boolean input](InputName=code_block_7.out0, DefaultValue=code_block_7.out1)  # package Data-Shapes; Creates a boolean input for UI.MultipleInputForm ++ . Check out www.data-shapes.net for more infos!
code_block_8 = CodeBlock { "Remove all .dwg links?"; true; }
ui_boolean_input_2 = Custom[UI.Boolean input](InputName=code_block_8.out0, DefaultValue=code_block_8.out1)
code_block_9 = CodeBlock { "Export .nwc?"; "Export IFC?"; "Remove elements in Library phase?"; "Ungroup all Model Groups"; true; }
boolean_input = Custom[Boolean input](InputName=code_block_9.out0)  # package Data-Shapes; Creates a boolean input for UI.MultipleInputForm ++ . Check out www.data-shapes.net for more infos!
boolean_input_2 = Custom[Boolean input](InputName=code_block_9.out1)
boolean_input_3 = Custom[Boolean input](InputName=code_block_9.out2, DefaultValue=code_block_9.out4)
boolean_input_4 = Custom[Boolean input](InputName=code_block_9.out3, DefaultValue=code_block_9.out4)
list_create = List.Create(item0=textnote_data, item1=ui_textbox_data, item2=ui_textbox_data_2, item3=ui_textbox_data_3, item4=ui_textbox_data_4, item5=ui_dropdown_data, item6=ui_boolean_input, item7=ui_boolean_input_2, item8=boolean_input, item9=boolean_input_2, item10=boolean_input_3, item11=boolean_input_4)
ui_multipleinputform = Custom[UI.MultipleInputForm ++](ButtonText_optional=code_block.out2, Inputs=list_create, Toggle=code_block.out0, CancelButtonText_optional=code_block.out1, Width_optional=code_block.out3, LabelWidth_optional=code_block.out4)  # package Data-Shapes; Create a form with multiple inputs. see www.data-shapes.net for tutorials and infos!

# group: Control
# note: Do not run the script if the Cancel button is pressed
not_ = Not(x=ui_multipleinputform.Was_Cancelled)
runMe = Custom[Tool.RunMe](Boolean=not_, ThingToDo=ui_multipleinputform.User_Inputs)  # package SteamNodes; Use Boolean to perform an action

# group: Input
# note: Get the splash screen and the rest of the sheets
python_script = Python(IN[0]=not_)  # IronPython2
# ---------- python_script.python (52 lines) ----------
import clr
import sys
sys.path.append('C:\Program Files (x86)\IronPython 2.7\Lib')
import System
from System import Array
from System.Collections.Generic import *
clr.AddReference('ProtoGeometry')
from Autodesk.DesignScript.Geometry import *
clr.AddReference("RevitNodes")
import Revit
clr.ImportExtensions(Revit.Elements)
clr.ImportExtensions(Revit.GeometryConversion)
clr.AddReference("RevitServices")
import RevitServices
from RevitServices.Persistence import DocumentManager 
from RevitServices.Transactions import TransactionManager 

clr.AddReference("RevitAPI")
clr.AddReference("RevitAPIUI")

import Autodesk 
from Autodesk.Revit.DB import *
from Autodesk.Revit.UI import *

doc = DocumentManager.Instance.CurrentDBDocument
uiapp = DocumentManager.Instance.CurrentUIApplication 
app = uiapp.Application 
uidoc = uiapp.ActiveUIDocument

# CODE!

run_me = IN[0]

splash, delete_sheets = [], []

if run_me:
    sheets = FilteredElementCollector(doc)\
    .OfCategory(BuiltInCategory.OST_Sheets)\
    .ToElements()

    for s in sheets:
        try:
            if "Project Information" in s.SheetNumber:
                splash.append(s)
            else:
                delete_sheets.append(s)
        except:
            continue

    splash_screen = splash[0]

    OUT = splash_screen, delete_sheets
# ----------------------------------------
code_block_10 = CodeBlock(x=python_script) { splash_screen = x[0]; list_sheets = x[1]; }

# group: Input
code_block_11 = CodeBlock(x=runMe) { issuedTo=x[0]; x[1]; x[2]; issueDescr=x[3]; }

# group: Process
# note: create revision, apply to splash screen and push the rest of the parameters
code_block_12 = CodeBlock { "ACG"; }
python_script_2 = Python(IN[0]=code_block_10.splash_screen, IN[1]=code_block_11.issueDescr, IN[2]=code_block_12, IN[3]=code_block_11.out2, IN[4]=code_block_11.issuedTo, IN[5]=code_block_11.out1)  # IronPython2
# ---------- python_script_2.python (78 lines) ----------
# Load the Python Standard and DesignScript Libraries
import clr
import sys
import os.path
from datetime import datetime
from System import Environment
sys.path.append('C:\Program Files (x86)\IronPython 2.7\Lib')
import System
from System import Array
from System.Collections.Generic import *
clr.AddReference('ProtoGeometry')
from Autodesk.DesignScript.Geometry import *
clr.AddReference("RevitNodes")
import Revit
clr.ImportExtensions(Revit.Elements)
clr.ImportExtensions(Revit.GeometryConversion)
clr.AddReference("RevitServices")
import RevitServices
from RevitServices.Persistence import DocumentManager 
from RevitServices.Transactions import TransactionManager 

clr.AddReference("RevitAPI")
clr.AddReference("RevitAPIUI")

import Autodesk 
from Autodesk.Revit.DB import *
from Autodesk.Revit.UI import *
import time

doc = DocumentManager.Instance.CurrentDBDocument
uiapp = DocumentManager.Instance.CurrentUIApplication 
app = uiapp.Application 
uidoc = uiapp.ActiveUIDocument

sheet = UnwrapElement(IN[0])
issued_to = IN[1]
issued_by = IN[2]
approved_by = IN[3]
rev_descr = IN[4]
drawn_by = IN[5]


# THIS PART UPDATES THE PARAMETERS ON THE SPLASH SCREEN

# parameterValueProvider (the id of the parameter object) & the filterRuleStringEvaluator


# create a revision and assign it to the splash screen
def createAssignRevision(sheet, issued_to, issued_by, descr):
	# create the revision element
	TransactionManager.Instance.EnsureInTransaction(doc)
	new_rev = Revision.Create(doc)
	rev_id = []
	rev_id.append(new_rev.Id)
	TransactionManager.Instance.TransactionTaskDone()
	# set the metadata of the revision
	TransactionManager.Instance.EnsureInTransaction(doc)
	new_rev.IssuedTo = issued_to
	new_rev.IssuedBy = issued_by
	new_rev.Description = descr
	new_rev.RevisionDate = datetime.today().strftime('%d.%m.%y')
	TransactionManager.Instance.TransactionTaskDone()
	# assign the new revision to the splash screen
	cur_revs = sheet.GetAdditionalRevisionIds()
	cur_revs.Add(new_rev.Id)
	TransactionManager.Instance.EnsureInTransaction(doc)
	sheet.SetAdditionalRevisionIds(cur_revs)
	TransactionManager.Instance.TransactionTaskDone()
	

createAssignRevision(sheet, issued_to, issued_by, rev_descr)

TransactionManager.Instance.TransactionTaskDone()
sheet.LookupParameter("Drawn By").Set(drawn_by)
sheet.LookupParameter("Approved By").Set(approved_by)
TransactionManager.Instance.TransactionTaskDone()

OUT = sheet
# ----------------------------------------

# group: Control
code_block_13 = CodeBlock { true; }
runMe_2 = Custom[Tool.RunMe](Boolean=not_, ThingToDo=code_block_13)
# note: Do not run the script if the Cancel button is pressed
create = List.Create(item0=runMe_2, item1=python_script_2)
code_block_14 = CodeBlock(a=create) { a[0]; }

# group: Visualisation - Sync the WIP model
code_block_15 = CodeBlock { Document.Current; }
synchronizewithcentral_in = Custom[SynchronizeWithCentral in Document](relinquishProjectStandardWorksets=code_block_14, relinquishViewWorksets=code_block_14, relinquishFamilyWorksets=code_block_14, relinquishUserCreatedWorksets=code_block_14, relinquishBorrowedElements=code_block_14, compactCentralModel=code_block_14, saveLocalFileBeforeSync=code_block_14, saveLocalFileAfterSync=code_block_14, runMe=code_block_14, document=code_block_15)  # package Genius Loci; Synchronizes a workshared model with the central model with the choice of the Revit document. Based on a Clockwork node

# group: Control
end = Revit.Transaction.Transaction.End(input=synchronizewithcentral_in.Document)
# note: AWAIT
create_2 = List.Create(item0=not_, item1=end)
code_block_16 = CodeBlock(a=create_2) { a[0]; }

# group: Input
python_script_3 = Python(IN[0]=code_block_16)  # IronPython2
# ---------- python_script_3.python (58 lines) ----------
import clr
import sys
sys.path.append('C:\Program Files (x86)\IronPython 2.7\Lib')
import System
from System import Array
from System.Collections.Generic import *
clr.AddReference('ProtoGeometry')
from Autodesk.DesignScript.Geometry import *
clr.AddReference("RevitNodes")
import Revit
clr.ImportExtensions(Revit.Elements)
clr.ImportExtensions(Revit.GeometryConversion)
clr.AddReference("RevitServices")
import RevitServices
from RevitServices.Persistence import DocumentManager 
from RevitServices.Transactions import TransactionManager 

clr.AddReference("RevitAPI")
clr.AddReference("RevitAPIUI")

import Autodesk 
from Autodesk.Revit.DB import *
from Autodesk.Revit.UI import *

doc = DocumentManager.Instance.CurrentDBDocument
uiapp = DocumentManager.Instance.CurrentUIApplication 
app = uiapp.Application 
uidoc = uiapp.ActiveUIDocument

#######OK NOW YOU CAN CODE########
import datetime

# CODE!

run_me = IN[0]

#get the date
today = datetime.date.today().strftime("%y%m%d")

#get the project directory
pi = FilteredElementCollector(doc)\
.OfCategory(BuiltInCategory.OST_ProjectInformation)\
.FirstElement()

prj_dir = pi.LookupParameter("Project Directory").AsString()

# get the file name
file_name = doc.Title
if file_name.endswith("_"):
    file_name = file_name[:-1]

dir_path = prj_dir + "\\01 WIP - Internal Work\\" + today
file_path = dir_path + "\\" + file_name

if run_me:
    OUT = dir_path, file_path, prj_dir, file_name
else:
    OUT = "","","",""
# ----------------------------------------
code_block_17 = CodeBlock(x=python_script_3) { folder_path = x[0]; file_path =x[1]; prj_dir = x[2]; file_name = x[3]; }
# note: Create directory in the 02-Shared folder
directory_from_path = DirectoryObject(path=code_block_17.folder_path)

# group: Control
# note: Do not run the script if the Cancel button is pressed
create_3 = List.Create(item0=code_block_17.file_path, item1=directory_from_path)
code_block_18 = CodeBlock(a=create_3) { a[0]; }
code_block_19 = CodeBlock { true; }
runMe_3 = Custom[Tool.RunMe](Boolean=not_, ThingToDo=code_block_19)

document_saveas = Custom[Document SaveAs](filePath=code_block_18, compactFile=runMe_3, saveAsCentral=runMe_3, isWorkshared=runMe_3)  # package Genius Loci; Saves the given Revit document under the given name. Based on a Clockwork node

# group: Input
# note: AWAIT
create_4 = List.Create(item0=runMe, item1=document_saveas.Success)
code_block_20 = CodeBlock(a=create_4) { a[0]; }
code_block_21 = CodeBlock(suitability=code_block_20, rvtLinks=code_block_20, dwgLinks=code_block_20, exportNWC=code_block_20, exportIFC=code_block_20, deleteLibrary=code_block_20, ungpruop=code_block_20) { suitability[4]; rvtLinks[5]; dwgLinks[6]; exportNWC[7]; exportIFC[8]; deleteLibrary[9]; ungpruop[10]; }

# group: Assing
code_block_22 = CodeBlock { "ACG_Suitability"; catPI=Revit.Elements.Category.ByName("Project Information"); ElementQueries.OfCategory(catPI); }
# note: Change suitability status
setParameterByName = Element.SetParameterByName(element=code_block_22.out2, parameterName=code_block_22.out0, value=code_block_21.out0)

# group: Processing - Remove CAD & RVT Links
python_script_4 = Python(IN[0]=code_block_21.out2)  # IronPython2
# ---------- python_script_4.python (19 lines) ----------
import clr
clr.AddReference('RevitAPI')
from Autodesk.Revit.DB import *
import Autodesk

clr.AddReference("RevitServices")
import RevitServices
from RevitServices.Persistence import DocumentManager

doc = DocumentManager.Instance.CurrentDBDocument

# need to learn how to implement LINQ here...
run_me = IN[0]

if run_me:
    link_inst = FilteredElementCollector(doc).OfClass(ImportInstance).ToElements()
    OUT = link_inst
else:
    OUT = []
# ----------------------------------------
# note: Remove Links
delete = archilab.Revit.Elements.Elements.Delete(element=python_script_4)
python_script_5 = Python(IN[0]=code_block_21.out1)  # IronPython2
# ---------- python_script_5.python (19 lines) ----------
import clr
clr.AddReference('RevitAPI')
from Autodesk.Revit.DB import *
import Autodesk

clr.AddReference("RevitServices")
import RevitServices
from RevitServices.Persistence import DocumentManager

doc = DocumentManager.Instance.CurrentDBDocument

# need to learn how to implement LINQ here...
run_me = IN[0]

if run_me:
    link_inst = FilteredElementCollector(doc).OfClass(RevitLinkInstance).ToElements()
    OUT = link_inst
else:
    OUT = []
# ----------------------------------------
delete_2 = archilab.Revit.Elements.Elements.Delete(element=python_script_5)

# group: Input
python_script_6 = Python(IN[0]=not_)  # IronPython2
# ---------- python_script_6.python (53 lines) ----------
import clr
import sys
sys.path.append('C:\Program Files (x86)\IronPython 2.7\Lib')
import System
from System import Array
from System.Collections.Generic import *
clr.AddReference('ProtoGeometry')
from Autodesk.DesignScript.Geometry import *
clr.AddReference("RevitNodes")
import Revit
clr.ImportExtensions(Revit.Elements)
clr.ImportExtensions(Revit.GeometryConversion)
clr.AddReference("RevitServices")
import RevitServices
from RevitServices.Persistence import DocumentManager 
from RevitServices.Transactions import TransactionManager 

clr.AddReference("RevitAPI")
clr.AddReference("RevitAPIUI")

import Autodesk 
from Autodesk.Revit.DB import *
from Autodesk.Revit.UI import *

doc = DocumentManager.Instance.CurrentDBDocument
uiapp = DocumentManager.Instance.CurrentUIApplication 
app = uiapp.Application 
uidoc = uiapp.ActiveUIDocument

# CODE!

run_me = IN[0]


splash, delete_sheets = [], []

if run_me:
    sheets = FilteredElementCollector(doc)\
    .OfCategory(BuiltInCategory.OST_Sheets)\
    .ToElements()

    for s in sheets:
        try:
            if "Project Information" in s.SheetNumber:
                splash.append(s)
            else:
                delete_sheets.append(s)
        except:
            continue

    splash_screen = splash[0]

    OUT = splash_screen, delete_sheets
# ----------------------------------------
# note: Get the splash screen and the rest of the sheets
code_block_23 = CodeBlock(x=python_script_6) { splash_screen = x[0]; list_sheets = x[1]; }

# group: Input - collect schedules and legends
collector_of_views = Custom[Collector of Views]()  # package Genius Loci; Collects all views in the active or given document.
list_create_2 = List.Create(item0=collector_of_views.Schedule, item1=collector_of_views.Legend)
# note: Collect all shedules and legends
flatten = List.Flatten(list=list_create_2)

# group: Input - Collect Templates
# note: Collect all view templates (except 3D)
collectallviewtemplates_python = Python()  # "CollectAllViewTemplates - Python Script"; IronPython2; unwired: IN[0]
# ---------- collectallviewtemplates_python.python (19 lines) ----------
# https://forum.dynamobim.com/t/get-all-view-templates-with-python/24527/3

import clr
clr.AddReference('RevitAPI')
from Autodesk.Revit.DB import*

clr.AddReference('RevitServices')
from RevitServices.Persistence import DocumentManager
from RevitServices.Transactions import TransactionManager

clr.AddReference('ProtoGeometry')
from Autodesk.DesignScript.Geometry import *

doc = DocumentManager.Instance.CurrentDBDocument

viewswithoutnull = [t for t in FilteredElementCollector(doc).OfClass
(View).ToElements() if t.IsTemplate and t.ViewType < ViewType.ThreeD]

OUT = viewswithoutnull
# ----------------------------------------

# group: Input - delete views
python_script_7 = Python()  # IronPython2
# ---------- python_script_7.python (51 lines) ----------
import clr
import sys
sys.path.append('C:\Program Files (x86)\IronPython 2.7\Lib')
import System
from System import Array
from System.Collections.Generic import *
clr.AddReference('ProtoGeometry')
from Autodesk.DesignScript.Geometry import *
clr.AddReference("RevitNodes")
import Revit
clr.ImportExtensions(Revit.Elements)
clr.ImportExtensions(Revit.GeometryConversion)
clr.AddReference("RevitServices")
import RevitServices
from RevitServices.Persistence import DocumentManager 
from RevitServices.Transactions import TransactionManager 

clr.AddReference("RevitAPI")
clr.AddReference("RevitAPIUI")

import Autodesk 
from Autodesk.Revit.DB import *
from Autodesk.Revit.UI import *

doc = DocumentManager.Instance.CurrentDBDocument
uiapp = DocumentManager.Instance.CurrentUIApplication 
app = uiapp.Application 
uidoc = uiapp.ActiveUIDocument

#######OK NOW YOU CAN CODE########

views = FilteredElementCollector(doc)\
.OfCategory(BuiltInCategory.OST_Views)\
.WhereElementIsNotElementType()\
.ToElements()

keep_views, rest_views, delete_views = [], [], []
for v in views:
    try:
        if str(v.ViewType) == "ThreeD" and v.Name == "IFC Export":
            keep_views.append(v)
        elif str(v.ViewType) == "ThreeD" and v.Name == "Navisworks":
            keep_views.append(v)
        elif "COORD" not in v.LookupParameter("View Folder 1 (View type)").AsString():
            delete_views.append(v)
    except:
        continue



OUT = keep_views, delete_views
# ----------------------------------------
code_block_24 = CodeBlock(x=python_script_7) { ifc_view = x[0][0]; nwc_view = x[0][1]; non_coord_views = x[1]; }
code_block_25 = CodeBlock(lst=code_block_24.non_coord_views) { List.Clean(lst, false); }

# group: Delete all collected elements
create_5 = List.Create(item0=code_block_10.list_sheets, item1=flatten, item2=collectallviewtemplates_python, item3=code_block_25, item4=code_block_23.list_sheets)
flatten_2 = List.Flatten(list=create_5)

# group: Control
# note: Do not run the script if the Cancel button is pressed
runMe_4 = Custom[Tool.RunMe](Boolean=not_, ThingToDo=flatten_2)

# group: Process - Delete all views and view templates
delete_3 = archilab.Revit.Elements.Elements.Delete(element=runMe_4)

# group: Control
create_6 = List.Create(item0=code_block_23.splash_screen, item1=delete_3)
# note: AWAIT
code_block_26 = CodeBlock(a=create_6) { a[0]; }

code_block_27 = CodeBlock { " - "; }

# group: Assing
split = String.Split(string=code_block_21.out0, separator0=code_block_27)
code_block_28 = CodeBlock(x=split) { x[0]; x[1]; "Suitability No."; "Suitability Desc."; }
setParameterByName_2 = Element.SetParameterByName(element=code_block_26, parameterName=code_block_28.out2, value=code_block_28.out0)
setParameterByName_3 = Element.SetParameterByName(element=code_block_26, parameterName=code_block_28.out3, value=code_block_28.out1)

# group: Python | Important
code_block_29 = CodeBlock { Document.Current; }
create_7 = List.Create(item0=code_block_29, item1=delete_3)
# note: AWAIT
code_block_30 = CodeBlock(a=create_7) { a[0]; true; }
purgeUnused = Document.PurgeUnused(document=code_block_30.out0, fullPurge=code_block_30.out1)

# group: Control
create_8 = List.Create(item0=code_block_18, item1=purgeUnused)
# note: AWAIT
code_block_31 = CodeBlock(a=create_8) { a[0]; }
# note: Do not run the script if the Cancel button is pressed
runMe_5 = Custom[Tool.RunMe](Boolean=not_, ThingToDo=code_block_31)
code_block_32 = CodeBlock { true; }
runMe_6 = Custom[Tool.RunMe](Boolean=not_, ThingToDo=code_block_32)

# group: Python | Important - SAVE SHARED FILE
document_saveas_2 = Custom[Document SaveAs](filePath=runMe_5, compactFile=runMe_6, saveAsCentral=runMe_6, isWorkshared=runMe_6)

# group: Control
runMe_7 = Custom[Tool.RunMe](Boolean=code_block_21.out3, ThingToDo=code_block_24.nwc_view)
create_9 = List.Create(item0=code_block_17.file_name, item1=document_saveas_2.Success)
# note: AWAIT
code_block_33 = CodeBlock(a=create_9) { a[0]; }

# group: Python | Important - EXPORT NWC
export_views_to_navisworks = Python(IN[0]=runMe_7, IN[1]=code_block_33, IN[2]=code_block_17.folder_path)  # IronPython2
# ---------- export_views_to_navisworks.python (20 lines) ----------
import clr
clr.AddReference('RevitAPI')
from Autodesk.Revit.DB import*

clr.AddReference('RevitServices')
from RevitServices.Persistence import DocumentManager

doc = DocumentManager.Instance.CurrentDBDocument

view = UnwrapElement(IN[0])
file_name = IN[1]
dir = IN[2]

nop = NavisworksExportOptions()
nop.ExportScope = NavisworksExportScope.View
nop.ViewId = view.Id

doc.Export(dir, file_name, nop)

OUT = "Success"
# ----------------------------------------

# group: Control
runMe_8 = Custom[Tool.RunMe](Boolean=code_block_21.out4, ThingToDo=code_block_24.ifc_view)
# note: AWAIT
create_10 = List.Create(item0=runMe_8, item1=export_views_to_navisworks)
code_block_34 = CodeBlock(a=create_10) { a[0]; }

# group: Python | Important - EXPORT IFC
code_block_35 = CodeBlock { "0"; false; }
export_ifc = Custom[Export IFC](DirectoryPath=code_block_17.folder_path, view=code_block_34, Filename=code_block_33, ProjectOrigin=code_block_35.out0, RevitInternalPset=code_block_35.out1)  # package Genius Loci; Export View to IFC file. For use with the Select Phase node. Some other IFC options are embedded inside the python script.

# group: Processing - Ungroup all Model Groups
code_block_36 = CodeBlock { c=Revit.Elements.Category.ByName("Model Groups"); ElementQueries.OfCategory(c); }
runMe_9 = Custom[Tool.RunMe](Boolean=code_block_21.out6, ThingToDo=code_block_36.out1)
# note: Ungroup all Model Groups
ungroupElements = Group.UngroupElements(group=runMe_9)

# group: Process - Delete library elements
# note: Delete Library elements
python_script_8 = Python(IN[0]=not_)  # IronPython2
# ---------- python_script_8.python (62 lines) ----------
import clr
import sys
sys.path.append('C:\Program Files (x86)\IronPython 2.7\Lib')
import System
from System import Array
from System.Collections.Generic import *
clr.AddReference('ProtoGeometry')
from Autodesk.DesignScript.Geometry import *
clr.AddReference("RevitNodes")
import Revit
clr.ImportExtensions(Revit.Elements)
clr.ImportExtensions(Revit.GeometryConversion)
clr.AddReference("RevitServices")
import RevitServices
from RevitServices.Persistence import DocumentManager 
from RevitServices.Transactions import TransactionManager 

clr.AddReference("RevitAPI")
clr.AddReference("RevitAPIUI")

import Autodesk 
from Autodesk.Revit.DB import *
from Autodesk.Revit.UI import *

doc = DocumentManager.Instance.CurrentDBDocument
uiapp = DocumentManager.Instance.CurrentUIApplication 
app = uiapp.Application 
uidoc = uiapp.ActiveUIDocument

#######OK NOW YOU CAN CODE########
run_me = IN[0]

lst_lib, lst_exist = [], []
count = 0

if run_me:

# collect all elements in the model that are not types
    all_els = FilteredElementCollector(doc).WhereElementIsNotElementType().ToElements()

    TransactionManager.Instance.EnsureInTransaction(doc)

    for e in all_els:
        try:
           if "Library" in e.get_Parameter(BuiltInParameter.PHASE_CREATED).AsValueString():
               lst_lib.append(e)
        except:
            continue

    for e in lst_lib:
        try:
            if "Existing" in e.get_Parameter(BuiltInParameter.PHASE_DEMOLISHED).AsValueString():
                doc.Delete(e.Id)
                count += 1
        except:
            continue

    TransactionManager.Instance.TransactionTaskDone()
    OUT = count

else:
    OUT = "Script not run"
# ----------------------------------------
