# Dynamo graph Check For Duplicate Sheets.dyn "Check For Duplicate Sheets_py" (Dynamo 2.12.1.8246)
# packages: Data-Shapes 2021.2.92

# group: Visualisation
python_script = Python()  # IronPython2
# ---------- python_script.python (72 lines) ----------
# Load the Python Standard and DesignScript Libraries
import clr
import sys
import os.path
from System import Environment
sys.path.append('C:\Program Files (x86)\IronPython 2.7\Lib')
import System
from System import Array
from System.Collections.Generic import *
clr.AddReference('ProtoGeometry')
from Autodesk.DesignScript.Geometry import *
clr.AddReference("RevitNodes")
import Revit
clr.ImportExtensions(Revit.Elements)
clr.ImportExtensions(Revit.GeometryConversion)
clr.AddReference("RevitServices")
import RevitServices
from RevitServices.Persistence import DocumentManager 
from RevitServices.Transactions import TransactionManager 
clr.AddReference("RevitAPI")
clr.AddReference("RevitAPIUI")
import Autodesk 
from Autodesk.Revit.DB import *
from Autodesk.Revit.UI import *

doc = DocumentManager.Instance.CurrentDBDocument
uiapp = DocumentManager.Instance.CurrentUIApplication 
app = uiapp.Application 
uidoc = uiapp.ActiveUIDocument

processDocs = uiapp.Application.Documents
# docNames = [doc.Title for doc in docs]		# DONT NEED THIS

def getSheetNumbers(doc):
	sheets = FilteredElementCollector(doc).OfClass(ViewSheet).ToElements()
	numbers = [s.get_Parameter(BuiltInParameter.SHEET_NUMBER).AsString() for s in sheets]
	listApproved = {'XXXX-XX-XX', '0001', 'Project Information', 'Model Thumbnail'}
	processNumbers = [i for i in numbers if i not in listApproved]
	return processNumbers

numberModels = ['a' for doc in processDocs]

if len(numberModels) < 2:
	OUT = 'Error : ', 'Only a single model is opened in this Revit session. The script requires minimum of two models.'
else:
	# get list of unique sheet numbers
	listAllSheets = [getSheetNumbers(doc) for doc in processDocs]
	listUniqueSheets = []
	for docSheets in listAllSheets:
		for sNumber in docSheets:
			if sNumber not in listUniqueSheets:
				listUniqueSheets.append(sNumber)
			
	# get the duplicates
	listDuplicates, stringDuplicates = [], []
	result = ''
	for uniqueNumber in listUniqueSheets:
		numberList = [uniqueNumber]
		numberString = uniqueNumber
		for docSheets, doc in zip(listAllSheets, processDocs):
			if uniqueNumber in docSheets:
				numberList.append(doc.Title)
				numberString += '\n' + str(doc.Title)
		if len(numberList) > 2:
			listDuplicates.append(numberString)
		
	# compile the final result as a single string		
	result = ''
	for list in listDuplicates:
		result += list + '\n\n'

	OUT = 'List of sheet numbers present in two or more open models : ', result
# ----------------------------------------
code_block = CodeBlock(x=python_script) { title = x[0]; text = x[1]; }

# group: Input
file_path = Filename("..\..\ACG_logo.png")
file_from_path = FileObject(path=file_path)
readFromFile = Image.ReadFromFile(file=file_from_path)
code_block_2 = CodeBlock { "Ok"; true; }
textnote_data = Custom[TextNote Data](Title=code_block.title, TextNote=code_block.text)  # package Data-Shapes; Create Data for TextNote input in UI.MultipleInputForm ++ . Check out www.data-shapes.net for more informations
multipleinputform = Custom[MultipleInputForm ++](Logo_optional=readFromFile, ButtonText_optional=code_block_2.out0, Inputs=textnote_data, Toggle=code_block_2.out1)  # package Data-Shapes; Create a form with multiple inputs. see www.data-shapes.net for tutorials and infos!

# group: Usage
code_block_3 = CodeBlock { "Check for Duplicate Sheets"; }
acg_script_usage = Custom[ACG Script Usage](scriptName=code_block_3)  # Adds an entry to Excel document every time a script is run. The document is located in S:\Dynamo\05-UsageStats
