# Dynamo graph Duplicate Sheets.dyn (Dynamo 2.17.1.4055)
# packages: bimorphNodes 3.0.3, Data-Shapes 2021.2.92

# group: Input
file_path = Filename("..\ACG_logo.png")
file_from_path = FileObject(path=file_path)
readFromFile = Image.ReadFromFile(file=file_from_path)

# group: Input
string = StringInput("""This tool will duplicate a given list of sheets multiple times. All metadata, apart from revision history, will be transferred to the new sheets. The name of the new sheets will remail the same but the number will have a suffix "_n", where n is the consecutive copy number.
Users can also copy the views placed on the parent sheets as duplicate or dependent. Please note that schedules will not be copied.
Please rename all new sheets and views logically ASAP.""")
textnote_data = Custom[TextNote Data](TextNote=string)  # package Data-Shapes; Create Data for TextNote input in UI.MultipleInputForm ++ . Check out www.data-shapes.net for more informations

# group: Input
code_block = CodeBlock { true; "Duplicate"; "Cancel"; 250; 700; }
python_script = Python()  # IronPython2
# ---------- python_script.python (39 lines) ----------
# Load the Python Standard and DesignScript Libraries
import clr
import sys
import os.path
from datetime import datetime
from System import Environment
sys.path.append('C:\Program Files (x86)\IronPython 2.7\Lib')
import System
from System import Array
from System.Collections.Generic import *
clr.AddReference('ProtoGeometry')
from Autodesk.DesignScript.Geometry import *
clr.AddReference("RevitNodes")
import Revit
clr.ImportExtensions(Revit.Elements)
clr.ImportExtensions(Revit.GeometryConversion)
clr.AddReference("RevitServices")
import RevitServices
from RevitServices.Persistence import DocumentManager 
from RevitServices.Transactions import TransactionManager 
clr.AddReference("RevitAPI")
clr.AddReference("RevitAPIUI")
import Autodesk 
from Autodesk.Revit.DB import *
from Autodesk.Revit.UI import *
import time

doc = DocumentManager.Instance.CurrentDBDocument
uiapp = DocumentManager.Instance.CurrentUIApplication 
app = uiapp.Application 
uidoc = uiapp.ActiveUIDocument

sheets = FilteredElementCollector(doc).OfClass(ViewSheet).ToElements()
keys = []
for sheet in sheets:
	number = sheet.get_Parameter(BuiltInParameter.SHEET_NUMBER).AsString()
	name = sheet.get_Parameter(BuiltInParameter.SHEET_NAME).AsString()
	keys.append(number + '-' + name)
OUT = keys, sheets
# ----------------------------------------
code_block_2 = CodeBlock(x=python_script) { false; "Select sheets to duplicate"; 400; keys = x[0]; sheets = x[1]; }
listview_data = Custom[Listview Data](InputName=code_block_2.out1, Keys=code_block_2.keys, Values=code_block_2.sheets, Height_optionnal=code_block_2.out2, ShowId_optionnal=code_block_2.out0)  # package Data-Shapes; Create data for ListView input in UI.MultiInputForm ++ . Check out www.data-shapes.net for more infos.
code_block_3 = CodeBlock { "Diplicate with Views"; true; "Number of copies"; "1"; true; }
boolean_input = Custom[Boolean input](InputName=code_block_3.out0, DefaultValue=code_block_3.out1)  # package Data-Shapes; Creates a boolean input for UI.MultipleInputForm ++ . Check out www.data-shapes.net for more infos!
code_block_4 = CodeBlock { "Select view diplicate option:"; }
code_block_5 = CodeBlock()
# ---------- code_block_5.designscript (4 lines) ----------
[
"Duplicate",
"Duplicate with Detailing"
];
# ----------------------------------------
code_block_6 = CodeBlock()
# ---------- code_block_6.designscript (4 lines) ----------
[
0,
1
];
# ----------------------------------------
code_block_7 = CodeBlock { false; }
dropdown_data = Custom[DropDown Data](InputName=code_block_4, Keys=code_block_5, Values=code_block_6, Sorted_optional=code_block_7)  # package Data-Shapes; Create data for DropDown input in UI.MultiInputForm ++ . Check out www.data-shapes.net for more infos.
textbox_data = Custom[TextBox Data](InputName=code_block_3.out2, DefaultText=code_block_3.out3, IsNumberEntry=code_block_3.out4)  # package Data-Shapes; Create Data for TextBox input in UI.MultipleInputForm ++ . Check out www.data-shapes.net for more informations
list_create = List.Create(item0=textnote_data, item1=listview_data, item2=boolean_input, item3=dropdown_data, item4=textbox_data)
flatten = List.Flatten(list=list_create)

# group: Input
multipleinputform = Custom[MultipleInputForm ++](Logo_optional=readFromFile, ButtonText_optional=code_block.out1, Inputs=flatten, Toggle=code_block.out0, CancelButtonText_optional=code_block.out2, Width_optional=code_block.out4, LabelWidth_optional=code_block.out3)  # package Data-Shapes; Create a form with multiple inputs. see www.data-shapes.net for tutorials and infos!
code_block_8 = CodeBlock(x=multipleinputform.User_Inputs) { sheets = x[0]; withViews = x[1]; duplicateOption = x[2]; numberCopies = x[3]; }

# group: Process
ofRepeatedItem = List.OfRepeatedItem(item=code_block_8.sheets, amount=code_block_8.numberCopies)
not_ = Not(x=multipleinputform.Was_Cancelled)
code_block_9 = CodeBlock(numberCopies=code_block_8.numberCopies) { n=1..numberCopies; "_"+n; "."; }
split = String.Split(string=code_block_9.out1, separator0=code_block_9.out2)
firstItem = List.FirstItem(list=split@@L2)
list_create_2 = List.Create(item0=firstItem)
transpose = List.Transpose(lists=list_create_2)
duplicate = Revit.Sheet.Duplicate(sheets=ofRepeatedItem@@L2, run=not_, duplicateWithViews=code_block_8.withViews, duplicateOption=code_block_8.duplicateOption, suffix=transpose@L2)
code_block_10 = CodeBlock { 1; }
flatten_2 = List.Flatten(list=duplicate.Sheet, amount=code_block_10)
code_block_11 = CodeBlock { "ACG_Level"; "ACG_Type"; "ACG_Volume"; }
getParameterValueByName = Element.GetParameterValueByName(element=ofRepeatedItem, parameterName=code_block_11.out2)
getParameterValueByName_2 = Element.GetParameterValueByName(element=ofRepeatedItem, parameterName=code_block_11.out1)
getParameterValueByName_3 = Element.GetParameterValueByName(element=ofRepeatedItem, parameterName=code_block_11.out0)

# group: Assing
code_block_12 = CodeBlock { "Sheet Phase"; "WIP"; }
setParameterByName = Element.SetParameterByName(element=duplicate.Sheet, parameterName=code_block_12.out0, value=code_block_12.out1)
setParameterByName_2 = Element.SetParameterByName(element=flatten_2, parameterName=code_block_11.out2, value=getParameterValueByName)
setParameterByName_3 = Element.SetParameterByName(element=flatten_2, parameterName=code_block_11.out1, value=getParameterValueByName_2)
setParameterByName_4 = Element.SetParameterByName(element=flatten_2, parameterName=code_block_11.out0, value=getParameterValueByName_3)

# group: Usage
code_block_13 = CodeBlock { "Duplicate Sheets"; }
acg_script_usage = Custom[ACG Script Usage](script_name=code_block_13)  # Adds an entry to TXT document every time a script is run. The document is located in R:\Dynamo\05-UsageStats
