# Dynamo graph Update PDF Clip Set.dyn "Update PDF Clip Set_py" (Dynamo 2.6.2.15705)
# packages: Data-Shapes 2021.2.92

# group: Usage
code_block = CodeBlock { "Update PDF Clip Set"; }
acg_script_usage = Custom[ACG Script Usage](scriptName=code_block)  # Adds an entry to Excel document every time a script is run. The document is located in S:\Dynamo\05-UsageStats

code_block_2 = CodeBlock { "PDF Clip Set folder located in 01 - WIP"; true; }
boolean_input = Custom[Boolean input](InputName=code_block_2.out0)  # package Data-Shapes; Creates a boolean input for UI.MultipleInputForm ++ . Check out www.data-shapes.net for more infos!

# group: Input
file_path = Filename("..\ACG_logo.png")
file_from_path = FileObject(path=file_path)
readFromFile = Image.ReadFromFile(file=file_from_path)
code_block_3 = CodeBlock { "Update"; "Cancel"; 700; 350; true; }
code_block_4 = CodeBlock { "Note:"; }
string = StringInput("""This tool will update the clip set for the project of the active Revit model with the most recent version of the issued PDF drawings. Please make sure that all .pdf files are closed at the time of running the script. Open files might not be processed.
The default location of the clip set is P:\XXX_Name\XXX_Production\XXX_BIM Sharing\01 WIP - Internal Work\Architect\XXX_PDFClipSet. Users have the option to set the location to P:\XXX_Name\XXX_Production\XXX_BIM Sharing\02 Shared - Externally\Architect\XXX_PDFClipSet (for older projects only) or navigate and update the clip sets for other projects as well. Please note that PDF files not named in compliance with ISO 19650 will most likely not be processed.
For more information on how the tools works, please refer to the Revit Tutorials channel.
""")
ui_textnote_data = Custom[UI.TextNote Data](Title=code_block_4, TextNote=string)  # package Data-Shapes; Create Data for TextNote input in UI.MultipleInputForm ++ . Check out www.data-shapes.net for more informations
code_block_5 = CodeBlock { "Update clip forder for active project"; true; }
boolean_input_2 = Custom[Boolean input](InputName=code_block_5.out0, DefaultValue=code_block_5.out1)
code_block_6 = CodeBlock { "Navigate to the folder whick contains all \nexported PDF files (for non active models):"; }
directorypath_data = Custom[DirectoryPath Data](InputName=code_block_6)  # package Data-Shapes; Creates a DirectoryPath input for UI.MultipleInputForm ++ . Check out www.data-shapes.net for more infos!
list_create = List.Create(item0=ui_textnote_data, item1=boolean_input_2, item2=boolean_input, item3=directorypath_data)
ui_multipleinputform = Custom[UI.MultipleInputForm ++](Logo_optional=readFromFile, ButtonText_optional=code_block_3.out0, Inputs=list_create, Toggle=code_block_3.out4, CancelButtonText_optional=code_block_3.out1, Width_optional=code_block_3.out2, LabelWidth_optional=code_block_3.out3)  # package Data-Shapes; Create a form with multiple inputs. see www.data-shapes.net for tutorials and infos!

watch = Watch(ui_multipleinputform.User_Inputs)
code_block_7 = CodeBlock(x=ui_multipleinputform.User_Inputs) { activeProject = x[0]; wipFolder = x[1]; alternativePath = x[2]; }
python_script = Python(IN[0]=ui_multipleinputform.Was_Cancelled, IN[1]=code_block_7.activeProject, IN[2]=code_block_7.wipFolder, IN[3]=code_block_7.alternativePath)
# ---------- python_script.python (198 lines) ----------
# Load the Python Standard and DesignScript Libraries
import clr
import sys
import os.path
from datetime import datetime
from System import Environment
sys.path.append('C:\Program Files (x86)\IronPython 2.7\Lib')
import System
from System import Array
from System.Collections.Generic import *
clr.AddReference('ProtoGeometry')
from Autodesk.DesignScript.Geometry import *
clr.AddReference("RevitNodes")
import Revit
clr.ImportExtensions(Revit.Elements)
clr.ImportExtensions(Revit.GeometryConversion)
clr.AddReference("RevitServices")
import RevitServices
from RevitServices.Persistence import DocumentManager 
from RevitServices.Transactions import TransactionManager 
clr.AddReference("RevitAPI")
clr.AddReference("RevitAPIUI")
import Autodesk 
from Autodesk.Revit.DB import *
from Autodesk.Revit.UI import *
import time

# import stuff for the files
from System.IO import Directory, SearchOption
import os
from stat import *
import shutil

doc = DocumentManager.Instance.CurrentDBDocument
uiapp = DocumentManager.Instance.CurrentUIApplication 
app = uiapp.Application 
uidoc = uiapp.ActiveUIDocument

cancelled = IN[0]
activePRJ = IN[1]
wipPath = IN[2]
manualPath = str(IN[3])

failedPaths, failedNames = [], []

if cancelled == False:

	prjInfo = FilteredElementCollector(doc).OfCategory(BuiltInCategory.OST_ProjectInformation).ToElements()[0]
	prjPath = prjInfo.LookupParameter('Project Directory').AsString()

	# get the project number / generate ClipFolder name
	prjName = prjPath.split('\\')[1]
	prjNumber = prjName.Split('_')[0]
	clipFName = prjPath + '\\02 Shared - Externally\Architect\\' + prjNumber + '_PDFClipSet'
	#make sure the PDFClipSet folder exists
	if Directory.Exists(clipFName) == False:
		os.mkdir(clipFName)
	
	# get the target flder
	if activePRJ == True and wipPath == True:
		targetPath = prjPath + '\\01 WIP - Internal Work\Architect'
	elif activePRJ == True and wipPath == False:
		targetPath = prjPath + '\\02 Shared - Externally\Architect'
	elif activePRJ == False and manualPath:
		targetPath = manualPath
	else:
		OUT = 'Error: ', 'I dont undertand?!?!'

	# GET THE FILES
	files = []
	PDFpaths = []
	if Directory.Exists(targetPath):
		files = Directory.GetFiles(targetPath, '.', SearchOption.AllDirectories)
		for file in files:
			if '.pdf' in file and '_PDFClipSet' not in file:
				PDFpaths.append(file)
	else:
		OUT = 'Error: ', 'Folder does not exist. Please check model settings.'
	
	PDFnames = []
	# get te PDF file names
	for path in PDFpaths:
		broken = path.split('\\')
		PDFname = broken.pop()
		PDFnames.append(PDFname)

	# CHECK 01
	# get only files that have 6 '-' in the name
	for name, path in zip(PDFnames, PDFpaths):
		if name.count('-') != 6:
			if path not in failedPaths:
				failedNames.append(name)
				failedPaths.append(path)
	# CHECK 02
	# get only files with lenght less than 44 and more than 23 symbols (including .pdf)
	for name, path in zip(PDFnames, PDFpaths):
		if len(name) < 23 or len(name) > 44:
			if path not in failedPaths:
				failedNames.append(name)
				failedPaths.append(path)
	# CHECK 03
	# get only files if their las 3 symbols are digits
	for name, path in zip(PDFnames, PDFpaths):
		if '-ACG-' not in name and '-A-' not in name:
			if path not in failedPaths:
				failedNames.append(name)
				failedPaths.append(path)
	# CHECK 04
	# check if the file path is < 260 symbols
	for name, path in zip(PDFnames, PDFpaths):
		if len(path) > 260:
			if path not in failedPaths:
				failedNames.append(name)
				failedPaths.append(path)
	# CHECK 05
	# get only files that don't have '_' or the last 3 symbols are digits
	for name, path in zip(PDFnames, PDFpaths):
		if '_' in name:
			try:
				int(name[-3:])
			except:
				if path not in failedPaths:
					failedNames.append(name)
					failedPaths.append(path)

	# remove failed names & paths
	for name, path in zip(failedNames, failedPaths):
		try:
			PDFpaths.Remove(path)
			PDFnames.Remove(name)
		except:
			continue
	
	# function to get the file date
	def getYYMMDDHHMMin(filepath):
		statbuf = os.stat(filepath)
		date = time.localtime((statbuf.st_mtime))
		year = date[0]
		month = date[1]
		day = date[2]
		hour = date[3]
		minute = date[4]
		YY = str(year)[2:]	
		if (month <=9):
			MM = '0' + str(month)
		else:
			MM = str(month)
		if (day <=9):
			DD = '0' + str(day)
		else:
			DD = str(day)
		if (hour <=9):
			HH = '0' + str(hour)
		else:
			HH = str(hour)
		if (minute <=9):
			MMin = '0' + str(minute)
		else:
			MMin = str(minute)
		return (YY + MM + DD + HH + MMin)
	# function to sort by key
	def sortByKey(listA, listB):
		zippedPairs = zip(listB, listA)
		z = [x for _, x in sorted(zippedPairs)]
		return z
		
	# get the file dates
	PDFdates = [getYYMMDDHHMMin(path) for path in PDFpaths ]
	# sort the paths by the dates
	sortedPDFpaths = reversed(sortByKey(PDFpaths, PDFdates))
	sortedPDFnames = reversed(sortByKey(PDFnames, PDFdates))
#	sortedPDFpaths = reversed(PDFdates)
	# get only the latest versions of each file
	latestPDFpaths, latestPDFnames = [], []
	for name, path in zip(sortedPDFnames, sortedPDFpaths):
		if name not in latestPDFnames:
			latestPDFnames.append(name)
			latestPDFpaths.append(path)
			
			
#	# create PDFClipSet paths
	destinationPDFpaths = []
	for name in latestPDFnames:
		destinationPDFpaths.append(clipFName + '\\' + name)
	# COPY THE FILES
	for path, destPath in zip(latestPDFpaths, destinationPDFpaths):
		shutil.copyfile(path, destPath)
	
	if len(destinationPDFpaths) > 0:
		OUT = 'Success! ', str(len(destinationPDFpaths)) + ' PDF files were updated. Please check the PDFClipSet folder.'
	else:
		OUT = 'Error: ', 'Something went wrong. No PDF files were updated.'

else:
	OUT = 'Error: ', 'The script was cancelled.'


#OUT = destinationPDFpaths
# ----------------------------------------
code_block_8 = CodeBlock(x=python_script) { true; title = x[0]; text = x[1]; }

# group: Assing
code_block_9 = CodeBlock { "Okay"; }
ui_textnote_data_2 = Custom[UI.TextNote Data](Title=code_block_8.title, TextNote=code_block_8.text)
ui_multipleinputform_2 = Custom[UI.MultipleInputForm ++](Logo_optional=readFromFile, ButtonText_optional=code_block_9, Inputs=ui_textnote_data_2, Toggle=code_block_8.out0)
