# Dynamo graph Isolate All.dyn (Dynamo 2.12.1.8246)
# packages: Data-Shapes 2021.2.92, ACG Tools 0.1.1

# group: Usage
code_block = CodeBlock { "Isolate All"; }
acg_script_usage = Custom[ACG Script Usage](script_name=code_block)  # package ACG Tools; Adds an entry to TXT document every time a script is run. The document is located in R:\Dynamo\05-UsageStats

file_path = Filename("..\ACG_logo.png")
file_from_path = FileObject(path=file_path)
readFromFile = Image.ReadFromFile(file=file_from_path)
code_block_2 = CodeBlock { "Cancel"; true; "Isolate"; 700; 350; }

# group: Input
code_block_3 = CodeBlock { "Warning:"; true; }
string = StringInput("This tool will identify all elements in the model that are associated with warnings and will either isovate all visible in the active view or override the graphical settings of the rest of the elements.")
ui_textnote_data = Custom[UI.TextNote Data](Title=code_block_3.out0, TextNote=string)  # package Data-Shapes; Create Data for TextNote input in UI.MultipleInputForm ++ . Check out www.data-shapes.net for more informations

code_block_4 = CodeBlock()
# ---------- code_block_4.designscript (9 lines) ----------
[
"Isolate elments",
"Override rest in halftone"
];

[
true,
false
];
# ----------------------------------------
boolean_input = Custom[Boolean input](InputName=code_block_4.out0, DefaultValue=code_block_4.out1)  # package Data-Shapes; Creates a boolean input for UI.MultipleInputForm ++ . Check out www.data-shapes.net for more infos!
code_block_5 = CodeBlock { "Set transparency to rest"; 0; 100; 1; }
slider = Custom[Slider](InputName=code_block_5.out0, Minimum=code_block_5.out1, Maximum=code_block_5.out2, Default_Value=code_block_5.out1, Step=code_block_5.out3)  # package Data-Shapes; Creates slider input for UI.MultipleInputForm ++ . Set the step to decimal value if you want a double slider, or to a integer value if you want an integer slider.
list_create = List.Create(item0=ui_textnote_data, item1=boolean_input, item2=slider)
flatten = List.Flatten(list=list_create)
ui_multipleinputform = Custom[UI.MultipleInputForm ++](Logo_optional=readFromFile, ButtonText_optional=code_block_2.out2, Inputs=flatten, Toggle=code_block_2.out1, CancelButtonText_optional=code_block_2.out0, Width_optional=code_block_2.out3, LabelWidth_optional=code_block_2.out4)  # package Data-Shapes; Create a form with multiple inputs. see www.data-shapes.net for tutorials and infos!
code_block_6 = CodeBlock(x=ui_multipleinputform.User_Inputs) { hide = 			x[0]; halftome = 		x[1]; trantarency = 	x[2]; }

# group: Isoate warning element in active view
python_script = Python(IN[0]=ui_multipleinputform.Was_Cancelled, IN[1]=code_block_6.hide, IN[2]=code_block_6.halftome, IN[3]=code_block_6.trantarency)  # IronPython2
# ---------- python_script.python (77 lines) ----------
# Load the Python Standard and DesignScript Libraries
import clr
import sys
import os.path
from datetime import datetime
from System import Environment
sys.path.append('C:\Program Files (x86)\IronPython 2.7\Lib')
import System
from System import Array
from System.Collections.Generic import *
clr.AddReference('ProtoGeometry')
from Autodesk.DesignScript.Geometry import *
clr.AddReference("RevitNodes")
import Revit
clr.ImportExtensions(Revit.Elements)
clr.ImportExtensions(Revit.GeometryConversion)
clr.AddReference("RevitServices")
import RevitServices
from RevitServices.Persistence import DocumentManager 
from RevitServices.Transactions import TransactionManager 

clr.AddReference("RevitAPI")
clr.AddReference("RevitAPIUI")

import Autodesk 
from Autodesk.Revit.DB import *
from Autodesk.Revit.UI import *
import time

doc = DocumentManager.Instance.CurrentDBDocument
uiapp = DocumentManager.Instance.CurrentUIApplication 
app = uiapp.Application 
uidoc = uiapp.ActiveUIDocument

#### NOW LIFT WHAT THOUSANDS CAN'T SHIFT ####

cancelled = 	IN[0]
hide = 			IN[1]
halftone = 		IN[2]
transparent = 	IN[3]

# get the warning elements
warnings = doc.GetWarnings()
idsToIsolate = List[ElementId]()

if cancelled:
    OUT = "The script was cancelled!"
else:

    for w in warnings:
        ids = w.GetFailingElements()
        for i in ids:
            idsToIsolate.Add(i)

# override the elements
    if hide:
			
        TransactionManager.Instance.EnsureInTransaction(doc)
        doc.ActiveView.	IsolateElementsTemporary(idsToIsolate)
        TransactionManager.Instance.TransactionTaskDone()
	
    else:
        # set the graphic override settings
        overrides = None
        if halftone:
            overrides = OverrideGraphicSettings().SetHalftone(True)
        if transparent > 0:
            overrides = OverrideGraphicSettings().SetSurfaceTransparency(transparent)
        
        TransactionManager.Instance.EnsureInTransaction(doc)
        allIds = FilteredElementCollector(doc, doc.ActiveView.Id).WhereElementIsNotElementType().ToElementIds()
        for id in allIds:
            if id not in idsToIsolate:
                doc.ActiveView.SetElementOverrides(id, overrides)
        TransactionManager.Instance.TransactionTaskDone()
    
    OUT = "Success!"
# ----------------------------------------
