# Dynamo graph Isolate By Type.dyn "Isolate By Type_py" (Dynamo 2.12.1.8246)
# packages: Data-Shapes 2021.2.92

# group: Usage
code_block = CodeBlock { "Isolate By Type"; }
acg_script_usage = Custom[ACG Script Usage](scriptName=code_block)  # Adds an entry to Excel document every time a script is run. The document is located in S:\Dynamo\05-UsageStats

file_path = Filename("..\ACG_logo.png")
file_from_path = FileObject(path=file_path)
readFromFile = Image.ReadFromFile(file=file_from_path)
code_block_2 = CodeBlock { "Select Warning Type"; true; "Isolate Warnings"; "Cancel"; false; 1000; 200; }

# group: Isoate warning element in active view
code_block_3 = CodeBlock { true; 0; }
python_script = Python(IN[0]=code_block_3.out0)  # IronPython2
# ---------- python_script.python (64 lines) ----------
# Load the Python Standard and DesignScript Libraries
import clr
import sys
import os.path
from datetime import datetime
from System import Environment
sys.path.append('C:\Program Files (x86)\IronPython 2.7\Lib')
import System
from System import Array
from System.Collections.Generic import *
clr.AddReference('ProtoGeometry')
from Autodesk.DesignScript.Geometry import *
clr.AddReference("RevitNodes")
import Revit
clr.ImportExtensions(Revit.Elements)
clr.ImportExtensions(Revit.GeometryConversion)
clr.AddReference("RevitServices")
import RevitServices
from RevitServices.Persistence import DocumentManager 
from RevitServices.Transactions import TransactionManager 

clr.AddReference("RevitAPI")
clr.AddReference("RevitAPIUI")

import Autodesk 
from Autodesk.Revit.DB import *
from Autodesk.Revit.UI import *
import time

doc = DocumentManager.Instance.CurrentDBDocument
uiapp = DocumentManager.Instance.CurrentUIApplication 
app = uiapp.Application 
uidoc = uiapp.ActiveUIDocument

runMe = IN[0]

if runMe:
	warnings = doc.GetWarnings()
	allDescr = []
	uniqueDescr = []
	count = []
	dropdownKeys = []

	
	for w in warnings:
		descr = w.GetDescriptionText()
		allDescr.append(descr)
		if descr not in uniqueDescr:
			uniqueDescr.append(descr)
		
	for d in uniqueDescr:
		c = allDescr.count(d)
		count.append(c)
		key = str(c) + ' - ' + d
		dropdownKeys.append(key)
			
	def sortList(txtList, intList):
		result = [x for _, x in sorted(zip(intList, txtList))]
		return result
	
	output = sortList(dropdownKeys, count)
	output.reverse()	
	
	OUT = output
# ----------------------------------------

ui_dropdown_data = Custom[UI.DropDown Data](InputName=code_block_2.out0, Keys=python_script, Values=python_script, DefaultValueIndex=code_block_3.out1, Sorted_optional=code_block_2.out4)  # package Data-Shapes; Create data for DropDown input in UI.MultiInputForm ++ . Check out www.data-shapes.net for more infos.
ui_multipleinputform = Custom[UI.MultipleInputForm ++](Logo_optional=readFromFile, ButtonText_optional=code_block_2.out2, Inputs=ui_dropdown_data, Toggle=code_block_2.out1, CancelButtonText_optional=code_block_2.out3, Width_optional=code_block_2.out5, LabelWidth_optional=code_block_2.out6)  # package Data-Shapes; Create a form with multiple inputs. see www.data-shapes.net for tutorials and infos!

# group: Visualisation
not_ = Not(x=ui_multipleinputform.Was_Cancelled)
python_script_2 = Python(IN[0]=not_, IN[1]=ui_multipleinputform.User_Inputs)  # IronPython2
# ---------- python_script_2.python (59 lines) ----------
# Load the Python Standard and DesignScript Libraries
import clr
import sys
import os.path
from datetime import datetime
from System import Environment
sys.path.append('C:\Program Files (x86)\IronPython 2.7\Lib')
import System
from System import Array
from System.Collections.Generic import *
clr.AddReference('ProtoGeometry')
from Autodesk.DesignScript.Geometry import *
clr.AddReference("RevitNodes")
import Revit
clr.ImportExtensions(Revit.Elements)
clr.ImportExtensions(Revit.GeometryConversion)
clr.AddReference("RevitServices")
import RevitServices
from RevitServices.Persistence import DocumentManager 
from RevitServices.Transactions import TransactionManager 

clr.AddReference("RevitAPI")
clr.AddReference("RevitAPIUI")

import Autodesk 
from Autodesk.Revit.DB import *
from Autodesk.Revit.UI import *
import time

doc = DocumentManager.Instance.CurrentDBDocument
uiapp = DocumentManager.Instance.CurrentUIApplication 
app = uiapp.Application 
uidoc = uiapp.ActiveUIDocument

runMe = IN[0]
input = IN[1][0]
warningType = input.split(' - ')[1]
isolateList = List[ElementId]()
temp = []

if runMe:
	warnings = doc.GetWarnings()
	for w in warnings:
		if w.GetDescriptionText() == warningType:
			ids = w.GetFailingElements()
			for i in ids:
				isolateList.Add(i)
				try:
					element = doc.GetElement(i)
					hostId = element.GetHostIds()[0]
					isolateList.Add(hostId)
				except:
					continue
				
	TransactionManager.Instance.EnsureInTransaction(doc)
	doc.ActiveView.	IsolateElementsTemporary(isolateList)
	TransactionManager.Instance.TransactionTaskDone()
	
	OUT = warningType, isolateList, temp
# ----------------------------------------
