# Dynamo graph Resolve Warnings.dyn "Resolve Warnings_py" (Dynamo 2.12.1.8246)
# packages: Data-Shapes 2021.2.92

# note: Assing - Text Notes
# note: Processing - Detail Group Audit (count instances of each detail group)
# note: Processing - View Templates
# note: Processing - Stats
# note: Processing - Detail Lines
# note: Script usage - not in use (one .csv file per month system)

# group: Filtering
# note: views not placed on sheets or placed on SKETCHES sheets
# note: views placed on WIP & PRODUCTION sheets
# note: Sheets [IN]
# note: views [OUT]

# group: Processing - Text Notes
# note: all elements no placed on:
# - legend & drafting views

# group: Processing
# note: View Names [uniqueKeys]

# group: Filtering
# note: views placed on WIP & PRODUCTION sheets
# note: views not placed on sheets or placed on SKETCHES sheets

# group: Processing
# note: View Names [uniqueKeys]

# group: Filtering
# note: views not placed on sheets or placed on SKETCHES sheets
# note: views placed on WIP & PRODUCTION sheets
# note: Sheets [IN]
# note: views [OUT]

# group: Processing - Filled Regions
# note: all elements no placed on:
# - legend & drafting views

# group: Processing
# note: View Names [uniqueKeys]

# group: Processing
# note: View Names [uniqueKeys]

# group: Filtering
# note: views not placed on sheets or placed on SKETCHES sheets
# note: views placed on WIP & PRODUCTION sheets

# group: Processing
# note: View Names [uniqueKeys]

# group: Filtering
# note: views not placed on sheets or placed on SKETCHES sheets
# note: views placed on WIP & PRODUCTION sheets
# note: Sheets [IN]
# note: views [OUT]

# group: Processing
# note: all elements no placed on:
# - legend & drafting views

# group: Visualisation
# note: if instance convert to list

# group: Visualisation
# note: if instance convert to list

# group: Visualisation
# note: if instance convert to list

# group: Visualisation
# note: if instance convert to list

# group: Processing
# note: View Names [uniqueKeys]

# group: Processing
# note: View Names [uniqueKeys]

# group: Processing
# note: View Names [uniqueKeys]

code_block = CodeBlock { "Resolve Warnings"; }
acg_script_usage = Custom[ACG Script Usage](scriptName=code_block)  # Adds an entry to Excel document every time a script is run. The document is located in S:\Dynamo\05-UsageStats
file_path = Filename("..\ACG_logo.png")
file_from_path = FileObject(path=file_path)
readFromFile = Image.ReadFromFile(file=file_from_path)
code_block_2 = CodeBlock { "Select Warning to resolve"; true; "Run"; "Cancel"; 600; 400; }
python_script = Python()  # IronPython2
# ---------- python_script.python (64 lines) ----------
# Load the Python Standard and DesignScript Libraries
import clr
import sys
import os.path
from datetime import datetime
from System import Environment
sys.path.append('C:\Program Files (x86)\IronPython 2.7\Lib')
import System
from System import Array
from System.Collections.Generic import *
clr.AddReference('ProtoGeometry')
from Autodesk.DesignScript.Geometry import *
clr.AddReference("RevitNodes")
import Revit
clr.ImportExtensions(Revit.Elements)
clr.ImportExtensions(Revit.GeometryConversion)
clr.AddReference("RevitServices")
import RevitServices
from RevitServices.Persistence import DocumentManager 
from RevitServices.Transactions import TransactionManager 

clr.AddReference("RevitAPI")
clr.AddReference("RevitAPIUI")

import Autodesk 
from Autodesk.Revit.DB import *
from Autodesk.Revit.UI import *
import time

doc = DocumentManager.Instance.CurrentDBDocument
uiapp = DocumentManager.Instance.CurrentUIApplication 
app = uiapp.Application 
uidoc = uiapp.ActiveUIDocument

warnings = doc.GetWarnings()

w1 = 'There are identical instances in the same place.'
w2 = 'Highlighted elements are joined but do not intersect.'
w3 = 'Multiple Rooms are in the same enclosed region.'
w4 = 'Room Tag is outside of its Room.'
w5 = 'Could not create Reveal.'
w6 = 'Could not create Wall Sweep.'


def inputLine(lookFor):
	count = 0
	for w in warnings:
		if lookFor in w.GetDescriptionText().ToString():
			count +=1
	return '(' + str(count) + ') ' + lookFor
	
def inputLineDouble(lookFor, lookForAnother, txt):
	count = 0
	for w in warnings:
		if lookFor in w.GetDescriptionText().ToString() \
		or lookForAnother in w.GetDescriptionText().ToString():
			count +=1
	return '(' + str(count) + ') ' + txt	
	
	
	
	
	
OUT = inputLine(w1), inputLine(w2), inputLine(w3), inputLine(w4), inputLineDouble(w5, w6, 'Could not create Wall Sweep or Reveal'), 
# ----------------------------------------
ui_boolean_input = Custom[UI.Boolean input](InputName=python_script@@L1)  # package Data-Shapes; Creates a boolean input for UI.MultipleInputForm ++ . Check out www.data-shapes.net for more infos!
# note: Assing - Scripts
# note: Input
# note: Control
# note: Filtering
# note: Processing
ui_multipleinputform = Custom[UI.MultipleInputForm ++](Logo_optional=readFromFile, ButtonText_optional=code_block_2.out2, Inputs=ui_boolean_input, Toggle=code_block_2.out1, CancelButtonText_optional=code_block_2.out3, Width_optional=code_block_2.out4, LabelWidth_optional=code_block_2.out5)  # package Data-Shapes; Create a form with multiple inputs. see www.data-shapes.net for tutorials and infos!
code_block_3 = CodeBlock(identicalInstances=ui_multipleinputform.User_Inputs, unjoinElements=ui_multipleinputform.User_Inputs, roomsInSamePlace=ui_multipleinputform.User_Inputs, reveals=ui_multipleinputform.User_Inputs, roomTags=ui_multipleinputform.User_Inputs) { identicalInstances[0]; unjoinElements[1]; roomsInSamePlace[2]; reveals[3]; roomTags[4]; }
python_script_2 = Python(IN[0]=code_block_3.out4)  # IronPython2
# ---------- python_script_2.python (57 lines) ----------
# Load the Python Standard and DesignScript Libraries
import clr
import sys
import os.path
from datetime import datetime
from System import Environment
sys.path.append('C:\Program Files (x86)\IronPython 2.7\Lib')
import System
from System import Array
from System.Collections.Generic import *
clr.AddReference('ProtoGeometry')
from Autodesk.DesignScript.Geometry import *
clr.AddReference("RevitNodes")
import Revit
clr.ImportExtensions(Revit.Elements)
clr.ImportExtensions(Revit.GeometryConversion)
clr.AddReference("RevitServices")
import RevitServices
from RevitServices.Persistence import DocumentManager 
from RevitServices.Transactions import TransactionManager 

clr.AddReference("RevitAPI")
clr.AddReference("RevitAPIUI")

import Autodesk 
from Autodesk.Revit.DB import *
from Autodesk.Revit.UI import *
import time

doc = DocumentManager.Instance.CurrentDBDocument
uiapp = DocumentManager.Instance.CurrentUIApplication 
app = uiapp.Application 
uidoc = uiapp.ActiveUIDocument

warnings = doc.GetWarnings()
runMe = IN[0]

warningTypes = []
lookFor = 'Could not create Wall Sweep.'
looForAnother = 'Could not create Reveal.'
temp = List[ElementId]()

if runMe:
	# resolve Identical Instance in the same place
	removeList = List[ElementId]()
	count = 0
	for w in warnings:
		type = w.GetDescriptionText().ToString()
		if lookFor in type or looForAnother in type:
			id = w.GetFailingElements()[0]
			removeList.Add(id)
			count +=1

	TransactionManager.Instance.EnsureInTransaction(doc)
	doc.Delete(removeList)
	TransactionManager.Instance.TransactionTaskDone()
	OUT = '(' + str(count) + ') ' + 'Could not create Wall Sweep / Reveal' 
# ----------------------------------------
python_script_3 = Python(IN[0]=code_block_3.out0)  # IronPython2
# ---------- python_script_3.python (58 lines) ----------
# Load the Python Standard and DesignScript Libraries
import clr
import sys
import os.path
from datetime import datetime
from System import Environment
sys.path.append('C:\Program Files (x86)\IronPython 2.7\Lib')
import System
from System import Array
from System.Collections.Generic import *
clr.AddReference('ProtoGeometry')
from Autodesk.DesignScript.Geometry import *
clr.AddReference("RevitNodes")
import Revit
clr.ImportExtensions(Revit.Elements)
clr.ImportExtensions(Revit.GeometryConversion)
clr.AddReference("RevitServices")
import RevitServices
from RevitServices.Persistence import DocumentManager 
from RevitServices.Transactions import TransactionManager 

clr.AddReference("RevitAPI")
clr.AddReference("RevitAPIUI")

import Autodesk 
from Autodesk.Revit.DB import *
from Autodesk.Revit.UI import *
import time

doc = DocumentManager.Instance.CurrentDBDocument
uiapp = DocumentManager.Instance.CurrentUIApplication 
app = uiapp.Application 
uidoc = uiapp.ActiveUIDocument

warnings = doc.GetWarnings()
runMe = IN[0]

warningTypes = []
lookFor = 'There are identical instances in the same place'

# resolve Identical Instance in the same place
removeList = List[ElementId]()
count = 0

if runMe:
	for w in warnings:
		type = w.GetDescriptionText().ToString()
		if lookFor in type:
			count +=1
			ids = w.GetFailingElements()
			remove = ids[1:]
			for i in remove:
				removeList.Add(i)
		
	TransactionManager.Instance.EnsureInTransaction(doc)
	doc.Delete(removeList)
	OUT = '(' + str(count) + ') ' + lookFor 
	TransactionManager.Instance.TransactionTaskDone()
# ----------------------------------------
python_script_4 = Python(IN[0]=code_block_3.out1)  # IronPython2
# ---------- python_script_4.python (55 lines) ----------
# Load the Python Standard and DesignScript Libraries
import clr
import sys
import os.path
from datetime import datetime
from System import Environment
sys.path.append('C:\Program Files (x86)\IronPython 2.7\Lib')
import System
from System import Array
from System.Collections.Generic import *
clr.AddReference('ProtoGeometry')
from Autodesk.DesignScript.Geometry import *
clr.AddReference("RevitNodes")
import Revit
clr.ImportExtensions(Revit.Elements)
clr.ImportExtensions(Revit.GeometryConversion)
clr.AddReference("RevitServices")
import RevitServices
from RevitServices.Persistence import DocumentManager 
from RevitServices.Transactions import TransactionManager 

clr.AddReference("RevitAPI")
clr.AddReference("RevitAPIUI")

import Autodesk 
from Autodesk.Revit.DB import *
from Autodesk.Revit.UI import *
import time

doc = DocumentManager.Instance.CurrentDBDocument
uiapp = DocumentManager.Instance.CurrentUIApplication 
app = uiapp.Application 
uidoc = uiapp.ActiveUIDocument

warnings = doc.GetWarnings()
runMe = IN[0]

warningTypes = []
lookFor = 'Highlighted elements are joined but do not intersect.'

# resolve elements joined but do not intersect
temp = []
count = 0

if runMe:
	TransactionManager.Instance.EnsureInTransaction(doc)
	for w in warnings:
		type = w.GetDescriptionText().ToString()
		if lookFor in type:
			count +=1
			ids = w.GetFailingElements()
			JoinGeometryUtils.UnjoinGeometry(doc, doc.GetElement(ids[0]), doc.GetElement(ids[1]))
	TransactionManager.Instance.TransactionTaskDone()		

	OUT = count
# ----------------------------------------
python_script_5 = Python(IN[0]=code_block_3.out2)  # IronPython2
# ---------- python_script_5.python (57 lines) ----------
# Load the Python Standard and DesignScript Libraries
import clr
import sys
import os.path
from datetime import datetime
from System import Environment
sys.path.append('C:\Program Files (x86)\IronPython 2.7\Lib')
import System
from System import Array
from System.Collections.Generic import *
clr.AddReference('ProtoGeometry')
from Autodesk.DesignScript.Geometry import *
clr.AddReference("RevitNodes")
import Revit
clr.ImportExtensions(Revit.Elements)
clr.ImportExtensions(Revit.GeometryConversion)
clr.AddReference("RevitServices")
import RevitServices
from RevitServices.Persistence import DocumentManager 
from RevitServices.Transactions import TransactionManager 

clr.AddReference("RevitAPI")
clr.AddReference("RevitAPIUI")

import Autodesk 
from Autodesk.Revit.DB import *
from Autodesk.Revit.UI import *
import time

doc = DocumentManager.Instance.CurrentDBDocument
uiapp = DocumentManager.Instance.CurrentUIApplication 
app = uiapp.Application 
uidoc = uiapp.ActiveUIDocument

warnings = doc.GetWarnings()
runMe = IN[0]

warningTypes = []
lookFor = 'Multiple Rooms are in the same enclosed region.'

if runMe:
	# resolve Identical Instance in the same place
	removeList = List[ElementId]()
	count = 0
	for w in warnings:
		type = w.GetDescriptionText().ToString()
		if lookFor in type:
			count +=1
			ids = w.GetFailingElements()
			remove = ids[1:]
			for i in remove:
				removeList.Add(i)

	TransactionManager.Instance.EnsureInTransaction(doc)
	doc.Delete(removeList)
	OUT = '(' + str(count) + ') ' + lookFor 
	TransactionManager.Instance.TransactionTaskDone()
# ----------------------------------------
python_script_6 = Python(IN[0]=code_block_3.out3)  # IronPython2
# ---------- python_script_6.python (55 lines) ----------
# Load the Python Standard and DesignScript Libraries
import clr
import sys
import os.path
from datetime import datetime
from System import Environment
sys.path.append('C:\Program Files (x86)\IronPython 2.7\Lib')
import System
from System import Array
from System.Collections.Generic import *
clr.AddReference('ProtoGeometry')
from Autodesk.DesignScript.Geometry import *
clr.AddReference("RevitNodes")
import Revit
clr.ImportExtensions(Revit.Elements)
clr.ImportExtensions(Revit.GeometryConversion)
clr.AddReference("RevitServices")
import RevitServices
from RevitServices.Persistence import DocumentManager 
from RevitServices.Transactions import TransactionManager 

clr.AddReference("RevitAPI")
clr.AddReference("RevitAPIUI")

import Autodesk 
from Autodesk.Revit.DB import *
from Autodesk.Revit.UI import *
import time

doc = DocumentManager.Instance.CurrentDBDocument
uiapp = DocumentManager.Instance.CurrentUIApplication 
app = uiapp.Application 
uidoc = uiapp.ActiveUIDocument

warnings = doc.GetWarnings()
runMe = IN[0]

warningTypes = []
lookFor = 'Room Tag is outside of its Room.'

# resolve Identical Instance in the same place
removeList = List[ElementId]()
count = 0

if runMe:
	TransactionManager.Instance.EnsureInTransaction(doc)
	for w in warnings:
		type = w.GetDescriptionText().ToString()
		if lookFor in type:
			count +=1
			ids = w.GetFailingElements()
			tag = doc.GetElement(ids[0])
			tag.Location.Move(tag.Room.Location.Point - tag.Location.Point   )
	TransactionManager.Instance.TransactionTaskDone()
	OUT = '(' + str(count) + ') ' + lookFor 
# ----------------------------------------
