# Dynamo graph About Views.dyn (Dynamo 2.12.1.8246)
# packages: Data-Shapes 2021.2.92

code_block = CodeBlock { "Cancel"; true; "Got it!"; }
code_block_2 = CodeBlock { "ACG Views:"; }
string = StringInput("""
ACG Views is toolset which contains tools for creating and enhancing different package views. Some of the tools included create individual specification views for elements such as walls, floors, doors, windows or any generic model components. Others create view filters or annotation elements in views based of a given criteria.

For more information on how the tools work please watch the Revit Tutorials, speak with the nearest BIM staff or attend BIM workshops as and when organized.

Thank you.""")
ui_textnote_data = Custom[UI.TextNote Data](Title=code_block_2, TextNote=string)  # package Data-Shapes; Create Data for TextNote input in UI.MultipleInputForm ++ . Check out www.data-shapes.net for more informations
ui_multipleinputform = Custom[UI.MultipleInputForm ++](ButtonText_optional=code_block.out2, Inputs=ui_textnote_data, Toggle=code_block.out1)  # package Data-Shapes; Create a form with multiple inputs. see www.data-shapes.net for tutorials and infos!
