# Dynamo graph Align Views On Sheets.dyn "Views - Align On Sheets" (Dynamo 2.6.1.8786)
# packages: Rhythm 2021.1.1, Data-Shapes 2021.2.92, Orchid 260.1.0.7729

# group: Usage
code_block = CodeBlock { "Align Views"; }
acg_script_usage = Custom[ACG Script Usage](scriptName=code_block)  # Adds an entry to Excel document every time a script is run. The document is located in S:\Dynamo\05-UsageStats

file_path = Filename("..\ACG_logo.png")
# note: Custom Node: Data-Shapes v.2018.12.1
file_from_path = FileObject(path=file_path)
readFromFile = Image.ReadFromFile(file=file_from_path)
code_block_2 = CodeBlock { "Select parent view:"; }

# group: Control
code_block_3 = CodeBlock { catVP=Revit.Elements.Category.ByName("Viewports"); ElementQueries.OfCategory(catVP); }
ʳʰʸᵗʰᵐ_viewport_getview = Rhythm.Revit.Elements.Viewport.GetView(viewport=code_block_3.out1)
code_block_4 = CodeBlock(e=ʳʰʸᵗʰᵐ_viewport_getview) { e.Name; }
sortByKey = List.SortByKey(list=code_block_3.out1, keys=code_block_4)
ʳʰʸᵗʰᵐ_viewport_getview_2 = Rhythm.Revit.Elements.Viewport.GetView(viewport=sortByKey.sorted_list)
code_block_5 = CodeBlock(e=ʳʰʸᵗʰᵐ_viewport_getview_2) { e.Name; }

ui_dropdown_data = Custom[UI.DropDown Data](InputName=code_block_2, Keys=code_block_5, Values=sortByKey.sorted_list)  # package Data-Shapes; Create data for DropDown input in UI.MultiInputForm ++ . Check out www.data-shapes.net for more infos.
code_block_6 = CodeBlock { "Select alignment point:"; ["Center","Bottom Right","Top Right","Top Left","Bottom Left"]; [0..4]; }
code_block_7 = CodeBlock { "Vies to aling:"; 700; false; }
ui_dropdown_data_2 = Custom[UI.DropDown Data](InputName=code_block_6.out0, Keys=code_block_6.out1, Values=code_block_6.out2, Sorted_optional=code_block_7.out2)
listview_data = Custom[Listview Data](InputName=code_block_7.out0, Keys=code_block_5, Values=sortByKey.sorted_list, Height_optionnal=code_block_7.out1, ShowId_optionnal=code_block_7.out2)  # package Data-Shapes; Create data for ListView input in UI.MultiInputForm ++ . Check out www.data-shapes.net for more infos.
list_create = List.Create(item0=ui_dropdown_data, item1=ui_dropdown_data_2, item2=listview_data)
code_block_8 = CodeBlock(input=list_create) { "Run"; "Cancel"; 600; 200; true; DSCore.List.Flatten(input); }
ui_multipleinputform = Custom[UI.MultipleInputForm ++](Logo_optional=readFromFile, ButtonText_optional=code_block_8.out0, Inputs=code_block_8.out5, Toggle=code_block_8.out4, CancelButtonText_optional=code_block_8.out1, Width_optional=code_block_8.out2, LabelWidth_optional=code_block_8.out3)  # package Data-Shapes; Create a form with multiple inputs. see www.data-shapes.net for tutorials and infos!
code_block_9 = CodeBlock(x=ui_multipleinputform.User_Inputs) { getPoint=x[0]; alignmentPoints=x[1]; pushPoint=x[2]; }

# group: Control
ʳʰʸᵗʰᵐ_viewport_locationdata = Rhythm.Revit.Elements.Viewport.LocationData(viewport=code_block_9.getPoint)
startPoint = Curve.StartPoint(curve=ʳʰʸᵗʰᵐ_viewport_locationdata.boxOutline)
addItemToFront = List.AddItemToFront(item=ʳʰʸᵗʰᵐ_viewport_locationdata.boxCenter, list=startPoint)
code_block_10 = CodeBlock(point=addItemToFront, index=code_block_9.alignmentPoints) { point[index]; }
ʳʰʸᵗʰᵐ_viewport_setboxcenter = Rhythm.Revit.Elements.Viewport.SetBoxCenter(viewport=code_block_9.pushPoint, point=code_block_10)

end = Revit.Transaction.Transaction.End(input=ʳʰʸᵗʰᵐ_viewport_setboxcenter)
start = Revit.Transaction.Transaction.Start(input=end)
await_ = Orchid.Common.DataStream.Await(pass=code_block_9.pushPoint, waitFor=start)
ʳʰʸᵗʰᵐ_viewport_locationdata_2 = Rhythm.Revit.Elements.Viewport.LocationData(viewport=await_)
startPoint_2 = Curve.StartPoint(curve=ʳʰʸᵗʰᵐ_viewport_locationdata_2.boxOutline)
addItemToFront_2 = List.AddItemToFront(item=ʳʰʸᵗʰᵐ_viewport_locationdata_2.boxCenter@@L1, list=startPoint_2@L2)
code_block_11 = CodeBlock(n=code_block_9.alignmentPoints) { 0; n; }
getItemAtIndex = List.GetItemAtIndex(list=addItemToFront_2@@L2, index=code_block_11.n)
getItemAtIndex_2 = List.GetItemAtIndex(list=addItemToFront_2@@L2, index=code_block_11.out0)
byTwoPoints = Vector.ByTwoPoints(start=getItemAtIndex@L1, end=getItemAtIndex_2@@L1)
moveByVector = Element.MoveByVector(element=await_, vector=byTwoPoints)
