# Dynamo graph Create Component Spec Views.dyn "Views - Generate Spec Views - Components" (Dynamo 2.12.1.8246)
# packages: RIE 2020.12.2, Orchid 260.1.0.7729, SteamNodes 1.2.3, archi-lab.net 2021.25.2521, Rhythm 2021.1.1, Genius Loci 2021.2.3, Data-Shapes 2021.2.92, BIM4Struc.Productivity 2.2.2

file_path = Filename("..\ACG_logo.png")
file_from_path = FileObject(path=file_path)
readFromFile = Image.ReadFromFile(file=file_from_path)

# group: Input
code_block = CodeBlock { "Note:"; }
string = StringInput("""All views apart from Axonometric view will be generated as Sections. View Crop might need to be adjusted in some cases.
For more detailed information, please refer to the Revit Tutorials channed on MS Stream or speak with IP.""")
textnote_data = Custom[TextNote Data](Title=code_block, TextNote=string)  # package Data-Shapes; Create Data for TextNote input in UI.MultipleInputForm ++ . Check out www.data-shapes.net for more informations

# group: Input
code_block_2 = CodeBlock()
# ---------- code_block_2.designscript (19 lines) ----------
"Select Category";

[
"Casework",
"Ceilings",
"Columns",
"Doors",
"Floors",
"Furniture",
"Generic Models",
"Parking",
"Planting",
"Plumbing Fixtures",
"Railings",
"Roofs",
"Stairs",
"Walls",
"Windows"
];
# ----------------------------------------
ui_dropdown_data = Custom[UI.DropDown Data](InputName=code_block_2.out0, Keys=code_block_2.out1, Values=code_block_2.out1)  # package Data-Shapes; Create data for DropDown input in UI.MultiInputForm ++ . Check out www.data-shapes.net for more infos.
code_block_3 = CodeBlock { "Type parameter name"; "Type Mark"; }
textbox_data = Custom[TextBox Data](InputName=code_block_3.out0, DefaultText=code_block_3.out1)  # package Data-Shapes; Create Data for TextBox input in UI.MultipleInputForm ++ . Check out www.data-shapes.net for more informations
code_block_4 = CodeBlock { "Value must contain"; "LNT"; }
textbox_data_2 = Custom[TextBox Data](InputName=code_block_4.out0)
code_block_5 = CodeBlock { "Select offset for section boxes"; 0; 200; 50; 10; }
slider = Custom[Slider](InputName=code_block_5.out0, Minimum=code_block_5.out1, Maximum=code_block_5.out2, Default_Value=code_block_5.out3, Step=code_block_5.out4)  # package Data-Shapes; Creates slider input for UI.MultipleInputForm ++ . Set the step to decimal value if you want a double slider, or to a integer value if you want an integer slider.
code_block_6 = CodeBlock { "Inclide Linked RVT models"; }
boolean_input = Custom[Boolean input](InputName=code_block_6)  # package Data-Shapes; Creates a boolean input for UI.MultipleInputForm ++ . Check out www.data-shapes.net for more infos!

# group: Filtering
code_block_7 = CodeBlock { catV=Revit.Category.ByName("Views"); allV=ElementQueries.OfCategory(catV); }
isViewTemplate = View.IsViewTemplate(view=code_block_7.allV)
code_block_8 = CodeBlock(obj=isViewTemplate) { obj==null?false:obj; }
filterByBoolMask = List.FilterByBoolMask(list=code_block_7.allV, mask=code_block_8)
code_block_9 = CodeBlock(vt=filterByBoolMask.in) { vt.Name; "Assign View Template (optional)"; }
dropdown_data = Custom[DropDown Data](InputName=code_block_9.out1, Keys=code_block_9.out0, Values=filterByBoolMask.in)  # package Data-Shapes; Create data for DropDown input in UI.MultiInputForm ++ . Check out www.data-shapes.net for more infos.

# group: Input
code_block_10 = CodeBlock { "Enter first sheet number"; "Number of elements per sheet"; }
textbox_data_3 = Custom[TextBox Data](InputName=code_block_10.out0)
textbox_data_4 = Custom[TextBox Data](InputName=code_block_10.out1)
code_block_11 = CodeBlock()
# ---------- code_block_11.designscript (7 lines) ----------
"Generate Top view";
"Generate Front view";
"Generate Side view";
"Generate Section view";
"Generate Axonometic view";
true;
false;
# ----------------------------------------
boolean_input_2 = Custom[Boolean input](InputName=code_block_11.out0, DefaultValue=code_block_11.out5)
boolean_input_3 = Custom[Boolean input](InputName=code_block_11.out1, DefaultValue=code_block_11.out5)
boolean_input_4 = Custom[Boolean input](InputName=code_block_11.out2, DefaultValue=code_block_11.out5)
boolean_input_5 = Custom[Boolean input](InputName=code_block_11.out3, DefaultValue=code_block_11.out5)
boolean_input_6 = Custom[Boolean input](InputName=code_block_11.out4, DefaultValue=code_block_11.out6)

# group: Input
code_block_12 = CodeBlock { "Add simple Title on Sheet :"; }
boolean_input_7 = Custom[Boolean input](InputName=code_block_12)

# group: Input
code_block_13 = CodeBlock { true; "Generate Views"; "Cancel"; false; 700; 350; }
list_create = List.Create(item0=textnote_data, item1=ui_dropdown_data, item2=textbox_data, item3=textbox_data_2, item4=slider, item5=boolean_input, item6=dropdown_data, item7=textbox_data_3, item8=textbox_data_4, item9=boolean_input_2, item10=boolean_input_3, item11=boolean_input_4, item12=boolean_input_5, item13=boolean_input_6, item14=boolean_input_7)
ui_multipleinputform = Custom[UI.MultipleInputForm ++](Logo_optional=readFromFile, ButtonText_optional=code_block_13.out1, Inputs=list_create, Toggle=code_block_13.out0, CancelButtonText_optional=code_block_13.out2, Width_optional=code_block_13.out4, LabelWidth_optional=code_block_13.out5)  # package Data-Shapes; Create a form with multiple inputs. see www.data-shapes.net for tutorials and infos!

# group: Visualisation
code_block_14 = CodeBlock(x=ui_multipleinputform.User_Inputs)
# ---------- code_block_14.designscript (15 lines) ----------
category = 		x[0];
parameter = 	x[1];
value = 		x[2];
DoNotUse = 		x[3];
offset = 		x[3];
linked = 		x[4];
template = 		x[5];
firstSheet = 	x[6];
elsOnSheet = 	x[7];
topView = 		x[8];
frontView = 	x[9];
sideView = 		x[10];
sectionView = 	x[11];
axoView = 		x[12];
titleOnSheet = 	x[13];
# ----------------------------------------

# group: Processing
code_block_15 = CodeBlock(input=code_block_14.category) { cat=Revit.Category.ByName(input); }
toNumber = String.ToNumber(string=code_block_14.elsOnSheet)
toNumber_2 = String.ToNumber(string=code_block_14.firstSheet)

# group: Processing
getDocuments = archilab.Revit.Selection.Select.GetDocuments()
# note: Add elements from input category in linked RVT instances
runMe = Custom[Tool.RunMe](Boolean=code_block_14.linked, ThingToDo=code_block_15)  # package SteamNodes; Use Boolean to perform an action
getFromLinkedFile = Custom[Element.GetFromLinkedFile](LinkInstance=getDocuments.Link_Instance@L1, LinkDocument=getDocuments.Link_Doc@L1, Category=runMe)  # package SteamNodes; Get elements from link document instance based on category

# group: Processing
all_elements_of_category = ElementsOfCategory(Category=code_block_15)
list_create_2 = List.Create(item0=getFromLinkedFile, item1=all_elements_of_category)
# note: combine elements from the host model and elements from the linked model
flatten = List.Flatten(list=list_create_2)
clear_list = Custom[Clear List](input=flatten)  # package archi-lab.net; This node will remove all Null and Empty Lists from any list.

# group: Filtering
elementTypes = Custom[ElementTypes+](element=clear_list)  # Gets types from linked elements too. From Clockworks
getParameterValueByName = Element.GetParameterValueByName(element=elementTypes, parameterName=code_block_14.parameter)
contains = String.Contains(string=getParameterValueByName, searchFor=code_block_14.value)
filterByBoolMask_2 = List.FilterByBoolMask(list=clear_list, mask=contains)
elementTypes_2 = Custom[ElementTypes+](element=filterByBoolMask_2.in)
getParameterValueByName_2 = Element.GetParameterValueByName(element=elementTypes_2, parameterName=code_block_14.parameter)
groupByKey = List.GroupByKey(list=filterByBoolMask_2.in, keys=getParameterValueByName_2)
firstItem = List.FirstItem(list=groupByKey.groups@@L2)
# note: Elements !!!
# note: Type Mark values
sortByKey = List.SortByKey(list=firstItem, keys=groupByKey.uniqueKeys)

# group: Visualisation
code_block_16 = CodeBlock(elements=sortByKey.sortedList) { elements; }

# group: Processing
facingOrientation = FamilyInstance.FacingOrientation(familyInstance=sortByKey.sortedList)
ZAxis = Vector.ZAxis()
# note: Front view vector
code_block_17 = CodeBlock { 90; }
# note: Get vector along the long axis of the element (horizontal, perpendicular to face). Use for Axis of rotation
rotate = Vector.Rotate(vector=facingOrientation, axis=ZAxis, degrees=code_block_17)

# group: Processing
getLocation = Element.GetLocation(element=code_block_16)
ZAxis_2 = Vector.ZAxis()
code_block_18 = CodeBlock { 45; -30; }
rotate_2 = Vector.Rotate(vector=facingOrientation, axis=ZAxis_2, degrees=code_block_18.out0)
# note: Axo view vector
rotate_3 = Vector.Rotate(vector=rotate_2, axis=rotate, degrees=code_block_18.out1)
code_block_19 = CodeBlock { 1000; true; }
translate = Geometry.Translate(geometry=getLocation, direction=rotate_3, distance=code_block_19.out0)

# group: Input - Crop Region Offset
code_block_20 = CodeBlock(cropViewOffset=code_block_14.offset) { cropViewOffset; }

# group: Processing - Get local principal vectors and combine them
# note: Get the insertion base point and the local XYZ vectors of the structural column. The column can be either vertical or slanted.
localCoordinateSystem = Custom[Element.LocalCoordinateSystem](element=code_block_16)  # package BIM4Struc.Productivity; Get the insertion point and local axes of an element.

# group: Processing
# note: Distance from centre
# of element to section
# plane
code_block_21 = CodeBlock { 1000; 2000; }
# note: Views Center Point (auxiliary)
translate_2 = Geometry.Translate(geometry=localCoordinateSystem.InsertionPoint, direction=localCoordinateSystem.Yvector, distance=code_block_21.out0)

# group: Processing
code_block_22 = CodeBlock(e=code_block_16) { "Width"; e.Type; }
# note: get Width as type or instance parameter
getParameterValueByName_3 = Element.GetParameterValueByName(element=code_block_22.out1, parameterName=code_block_22.out0)
getParameterValueByName_4 = Element.GetParameterValueByName(element=code_block_16, parameterName=code_block_22.out0)
code_block_23 = CodeBlock(wTp=getParameterValueByName_3, inst=getParameterValueByName_4) { wTp==""?inst:wTp; }

# group: Processing - Side Views
code_block_24 = CodeBlock(width=code_block_23) { width; offset=(-1)*(width+1); offset==null?0:-1; }
# note: Views Center Point (auxiliary)
translate_3 = Geometry.Translate(geometry=localCoordinateSystem.InsertionPoint, direction=localCoordinateSystem.Yvector, distance=code_block_24.out2)
code_block_25 = CodeBlock(width=code_block_23) { width; }

# group: Processing
# note: Create sublists of elements, so it fits with the number of view types that need to be generated.
# Alternatively you could choose different view center points for each view type to be created. In this case the same point is used for the three view types.
reverse = Vector.Reverse(vector=localCoordinateSystem.Xvector)
# note: Views Center Point (auxiliary)
# note: Cut plane elevation
code_block_26 = CodeBlock { 1000; 2000; }
translate_4 = Geometry.Translate(geometry=localCoordinateSystem.InsertionPoint, direction=localCoordinateSystem.Zvector, distance=code_block_26.out0)

# group: Input
code_block_27 = CodeBlock { catS=Revit.Elements.Category.ByName("Sheets"); allS=ElementQueries.OfCategory(catS); }

# group: Filtering
code_block_28 = CodeBlock(lst=sortByKey.sortedList, elPerSheet=toNumber, firstSheet=toNumber_2)
# ---------- code_block_28.designscript (8 lines) ----------
numElements=DSCore.List.Count(lst);
tempSheets=numElements/elPerSheet;
numSheets=DSCore.Math.Ceiling(tempSheets);
lastSheet=(firstSheet+numSheets)-1;

firstSheet..lastSheet;

"Sheet Number";
# ----------------------------------------
string_from_object = FromObject(obj=code_block_28.out4)
getParameterValueByName_5 = Element.GetParameterValueByName(element=code_block_27.allS, parameterName=code_block_28.out5)
# note: Collect sheets to put the views on
eq = getParameterValueByName_5 == string_from_object  # lacing=CrossProduct
anyTrue = Orchid.Common.List.AnyTrue(list=eq)
filterByBoolMask_3 = List.FilterByBoolMask(list=code_block_27.allS, mask=anyTrue)

# group: Processing
# note: generate sheet numbers for the view names (ACG's naming convention)
chop = List.Chop(list=sortByKey.sortedList, lengths=toNumber)
count = List.Count(list=chop@@L2)
ofRepeatedItem = List.OfRepeatedItem(item=string_from_object@L1, amount=count@@L1)
flatten_2 = List.Flatten(list=ofRepeatedItem)

# group: Processing - View Names
code_block_29 = CodeBlock(sheet=flatten_2, value=sortByKey.sortedKeys) { sheet+"-XX-"+value+"-AxoView"; value+"-AxoView"; }
boundingBox = Element.BoundingBox(element=sortByKey.sortedList)
boundingBoxExpand = Custom[BoundingBoxExpand](Amount=code_block_20, BBox=boundingBox)  # Expands element's bounding box. From RIE
code_block_30 = CodeBlock(sheet=flatten_2, value=sortByKey.sortedKeys) { sheet+"-XX-"+value+"-SectionView"; value+"-SectionView"; }
code_block_31 = CodeBlock(sheet=flatten_2, value=sortByKey.sortedKeys) { sheet+"-XX-"+value+"-SideView"; value+"-SideView"; }
code_block_32 = CodeBlock(sheet=flatten_2, value=sortByKey.sortedKeys) { sheet+"-XX-"+value+"-FrontView"; value+"-FrontView"; }
# note: Assemble view names
code_block_33 = CodeBlock(sheet=flatten_2, value=sortByKey.sortedKeys) { sheet+"-XX-"+value+"-TopView"; value+"-TopView"; }

# group: Control
runMe_2 = Custom[Tool.RunMe](Boolean=code_block_14.axoView, ThingToDo=code_block_29.out0)
runMe_3 = Custom[Tool.RunMe](Boolean=code_block_14.sectionView, ThingToDo=code_block_30.out0)
runMe_4 = Custom[Tool.RunMe](Boolean=code_block_14.sideView, ThingToDo=code_block_31.out0)
runMe_5 = Custom[Tool.RunMe](Boolean=code_block_14.frontView, ThingToDo=code_block_32.out0)
runMe_6 = Custom[Tool.RunMe](Boolean=code_block_14.topView, ThingToDo=code_block_33.out0)

# group: Visualisation - Section for all views
# note: Axo View
byEyePointTargetAndElement = AxonometricView.ByEyePointTargetAndElement(eyePoint=translate@L1, target=getLocation@L1, name=runMe_2@L1, element=sortByKey.sortedList@L1, isolateElement=code_block_19.out1)
# note: Sections
create_element_view = Custom[Create Element View](Xvector=localCoordinateSystem.Yvector, Yvector=localCoordinateSystem.Zvector, CropRegionOffset=code_block_20, ViewDepth=code_block_21.out1, CSPoint=localCoordinateSystem.InsertionPoint, RevitElements=code_block_16, Viewname=runMe_3)  # package BIM4Struc.Productivity; This node makes it possible to automatically create aligned section views on selected elements. Necessary inputs are: Revit Elements: this to detect the solid.centroid. The views are oriented to that point. X-vectors and Y-vectors to get the direction of the section plane. Traditionally these vectors are taken from the location lines of linear objects or facing directions of generic elements (i.e. doors). You might replace this with the vector of a selected edge for instance.
# note: Side Views
create_element_view_2 = Custom[Create Element View](Xvector=localCoordinateSystem.Yvector, Yvector=localCoordinateSystem.Zvector, CropRegionOffset=code_block_20, ViewDepth=code_block_21.out1, CSPoint=translate_3, RevitElements=code_block_16, Viewname=runMe_4)
# note: Front View
create_element_view_3 = Custom[Create Element View](Xvector=localCoordinateSystem.Xvector, Yvector=localCoordinateSystem.Zvector, CropRegionOffset=code_block_20, ViewDepth=code_block_21.out1, CSPoint=translate_2, RevitElements=code_block_16, Viewname=runMe_5)
# note: Top View
create_element_view_4 = Custom[Create Element View](Xvector=reverse, Yvector=localCoordinateSystem.Yvector, CropRegionOffset=code_block_20, ViewDepth=code_block_26.out1, CSPoint=translate_4, RevitElements=code_block_16, Viewname=runMe_6)

# group: Assing
ʳʰʸᵗʰᵐ_view3d_setsectionbox = Rhythm.Revit.Views.View3D.SetSectionBox(view3D=byEyePointTargetAndElement, bBox=boundingBoxExpand)
await_ = Orchid.Common.DataStream.Await(pass=byEyePointTargetAndElement, waitFor=ʳʰʸᵗʰᵐ_view3d_setsectionbox.success)
code_block_34 = CodeBlock { true; }
n3dview_lock_or_unlock = Custom[3DView Lock or Unlock](ThreeDView=byEyePointTargetAndElement, Toggle=code_block_34)  # package Genius Loci; Use a boolean True to unlock the 3D view. False locks the 3D view and saves its orientation. (The default 3D view aka {3D} must be renamed to be saved)

# group: Processing
# note: Axo View
chop_2 = List.Chop(list=await_, lengths=toNumber)
# note: Sections
chop_3 = List.Chop(list=create_element_view, lengths=toNumber)
# note: Side Views
chop_4 = List.Chop(list=create_element_view_2, lengths=toNumber)
# note: Front View
chop_5 = List.Chop(list=create_element_view_3, lengths=toNumber)
# note: Top View
chop_6 = List.Chop(list=create_element_view_4, lengths=toNumber)

# group: Assing
list_create_3 = List.Create(item0=chop_6, item1=chop_5, item2=chop_4, item3=chop_3, item4=chop_2)
# note: Assign template to the views
flatten_3 = List.Flatten(list=list_create_3)
set = Orchid.RevitProject.Views.ViewTemplate.Set(view=flatten_3, viewTemplate=code_block_14.template)
await_2 = Orchid.Common.DataStream.Await(pass=filterByBoolMask_3.in, waitFor=set)

# group: Processing
code_block_35 = CodeBlock(n=toNumber) { z=0; x=(1..n)*2; }
code_block_36 = CodeBlock { 5; }
byCoordinates = Point.ByCoordinates(x=code_block_35.x, y=code_block_36, z=code_block_35.z)
code_block_37 = CodeBlock { 4.5; }
byCoordinates_2 = Point.ByCoordinates(x=code_block_35.x, y=code_block_37, z=code_block_35.z)
code_block_38 = CodeBlock { 4; }
byCoordinates_3 = Point.ByCoordinates(x=code_block_35.x, y=code_block_38, z=code_block_35.z)
code_block_39 = CodeBlock { 3.5; }
byCoordinates_4 = Point.ByCoordinates(x=code_block_35.x, y=code_block_39, z=code_block_35.z)
code_block_40 = CodeBlock { 3; 2..8..2; 0; }
byCoordinates_5 = Point.ByCoordinates(x=code_block_35.x, y=code_block_40.out0, z=code_block_35.z)

# group: Processing
chop_7 = List.Chop(list=code_block_16, lengths=toNumber)
# note: Group views to be placed on sheets (4 elements each sheet)
count_2 = List.Count(list=chop_7@L2)
code_block_41 = CodeBlock(n=count_2) { 0..(n-1); }

# group: Processing
# note: Top View
getItemAtIndex = List.GetItemAtIndex(list=byCoordinates, index=code_block_41)
# note: Front View
getItemAtIndex_2 = List.GetItemAtIndex(list=byCoordinates_2, index=code_block_41)
# note: Side Views
getItemAtIndex_3 = List.GetItemAtIndex(list=byCoordinates_3, index=code_block_41)
# note: Sections
getItemAtIndex_4 = List.GetItemAtIndex(list=byCoordinates_4, index=code_block_41)
# note: Axo View
getItemAtIndex_5 = List.GetItemAtIndex(list=byCoordinates_5, index=code_block_41)

# group: Assing
# note: Place views on sheets
code_block_42 = CodeBlock { true; }
RIE_PlaceViewOnSheet = Custom[RIE_PlaceViewOnSheet](view_Schedule_Legend=chop_6@L2, sheet=await_2@@L1, point=getItemAtIndex@L2, refresh=code_block_42)  # package RIE; Places Views, Schedules or Legends into sheets.
await_3 = Orchid.Common.DataStream.Await(pass=chop_5, waitFor=RIE_PlaceViewOnSheet.Placed)
RIE_PlaceViewOnSheet_2 = Custom[RIE_PlaceViewOnSheet](view_Schedule_Legend=await_3@L2, sheet=await_2@@L1, point=getItemAtIndex_2@L2, refresh=code_block_42)
await_4 = Orchid.Common.DataStream.Await(pass=chop_4, waitFor=RIE_PlaceViewOnSheet_2.Placed)
RIE_PlaceViewOnSheet_3 = Custom[RIE_PlaceViewOnSheet](view_Schedule_Legend=await_4@L2, sheet=await_2@@L1, point=getItemAtIndex_3@L2, refresh=code_block_42)
await_5 = Orchid.Common.DataStream.Await(pass=chop_3, waitFor=RIE_PlaceViewOnSheet_3.Failed)
RIE_PlaceViewOnSheet_4 = Custom[RIE_PlaceViewOnSheet](view_Schedule_Legend=await_5@@L2, sheet=await_2@L1, point=getItemAtIndex_4@L2, refresh=code_block_42)
await_6 = Orchid.Common.DataStream.Await(pass=chop_2, waitFor=RIE_PlaceViewOnSheet_4.Placed)
RIE_PlaceViewOnSheet_5 = Custom[RIE_PlaceViewOnSheet](view_Schedule_Legend=await_6@L2, sheet=await_2@@L1, point=getItemAtIndex_5@L2, refresh=code_block_42)

# group: Usage
code_block_43 = CodeBlock { "Views - Generate Element Views"; }
acg_script_usage = Custom[ACG Script Usage](scriptName=code_block_43)  # Adds an entry to Excel document every time a script is run. The document is located in S:\Dynamo\05-UsageStats

# group: Processing - Side Views
code_block_44 = CodeBlock(width=code_block_23) { width/2; }

# group: Control
runMe_7 = Custom[Tool.RunMe](Boolean=code_block_14.topView, ThingToDo=code_block_33.out1)
runMe_8 = Custom[Tool.RunMe](Boolean=code_block_14.frontView, ThingToDo=code_block_32.out1)
runMe_9 = Custom[Tool.RunMe](Boolean=code_block_14.sideView, ThingToDo=code_block_31.out1)
runMe_10 = Custom[Tool.RunMe](Boolean=code_block_14.sectionView, ThingToDo=code_block_30.out1)
runMe_11 = Custom[Tool.RunMe](Boolean=code_block_14.axoView, ThingToDo=code_block_29.out1)

# group: Processing
views = Sheet.Views(sheet=code_block_27.allS)
flatten_4 = List.Flatten(list=views)
name = Element.Name(element=flatten_4)

# group: Control
list_create_4 = List.Create(item0=runMe_6, item1=runMe_5, item2=runMe_4, item3=runMe_3, item4=runMe_2)
flatten_5 = List.Flatten(list=list_create_4)
list_create_5 = List.Create(item0=runMe_7, item1=runMe_8, item2=runMe_9, item3=runMe_10, item4=runMe_11)
flatten_6 = List.Flatten(list=list_create_5)
code_block_45 = CodeBlock(value=flatten_6) { value==0; }
filterByBoolMask_4 = List.FilterByBoolMask(list=flatten_5, mask=code_block_45)
filterByBoolMask_5 = List.FilterByBoolMask(list=flatten_6, mask=code_block_45)
# note: Check if there are views for any of the values
contains_2 = String.Contains(string=name, searchFor=filterByBoolMask_5.out, lacing=CrossProduct)
transpose = List.Transpose(lists=contains_2)
anyTrue_2 = Orchid.Common.List.AnyTrue(list=transpose)
filterByBoolMask_6 = List.FilterByBoolMask(list=filterByBoolMask_4.out, mask=anyTrue_2)
anyTrue_3 = Orchid.Common.List.AnyTrue(list=contains_2)
filterByBoolMask_7 = List.FilterByBoolMask(list=name, mask=anyTrue_3)

# group: Processing
code_block_46 = CodeBlock(new=filterByBoolMask_6.in, existing=filterByBoolMask_7.in) { new+"     /     "+existing; }
code_block_47 = CodeBlock(mightExist=code_block_46) { "Similar views might already existing in the model:"; "\n"; mightExist; }
join = String.Join(separator=code_block_47.out1, string0=code_block_47.mightExist)

# group: Input
file_path_2 = Filename("..\ACG_logo.png")
file_from_path_2 = FileObject(path=file_path_2)
readFromFile_2 = Image.ReadFromFile(file=file_from_path_2)
code_block_48 = CodeBlock { "Okay...Thanks"; }
textnote_data_2 = Custom[TextNote Data](Title=code_block_47.out0, TextNote=join)
code_block_49 = CodeBlock { 700; 350; true; }
ui_multipleinputform_2 = Custom[UI.MultipleInputForm ++](Logo_optional=readFromFile_2, ButtonText_optional=code_block_48, Inputs=textnote_data_2, Toggle=code_block_49.out2, Width_optional=code_block_49.out0, LabelWidth_optional=code_block_49.out1)

sortByKey_2 = List.SortByKey(list=firstItem, keys=groupByKey.uniqueKeys)

# group: Processing
code_block_50 = CodeBlock { "Title on Sheet"; }
runMe_12 = Custom[Tool.RunMe](Boolean=code_block_14.titleOnSheet, ThingToDo=code_block_50)
code_block_51 = CodeBlock { "Top"; "Front"; "Side"; "Section"; "Axonimetry"; }
setParameterByName = Element.SetParameterByName(element=create_element_view_4, parameterName=runMe_12, value=code_block_51.out0)
setParameterByName_2 = Element.SetParameterByName(element=create_element_view_3, parameterName=runMe_12, value=code_block_51.out1)
setParameterByName_3 = Element.SetParameterByName(element=create_element_view_2, parameterName=runMe_12, value=code_block_51.out2)
setParameterByName_4 = Element.SetParameterByName(element=create_element_view, parameterName=runMe_12, value=code_block_51.out3)
setParameterByName_5 = Element.SetParameterByName(element=byEyePointTargetAndElement, parameterName=runMe_12, value=code_block_51.out4)
