# Dynamo graph Create Curtain Walls Spec Views.dyn "Views - Generate Spec Views - Curtain Walls" (Dynamo 2.6.1.8786)
# packages: Orchid 260.1.0.7729, archi-lab.net 2021.25.2521, Data-Shapes 2021.2.92, RIE 2020.12.2, SteamNodes 1.2.3, BIM4Struc.Productivity 2.2.2, WombatDynamo 2.3.0

file_path = Filename("..\ACG_logo.png")
file_from_path = FileObject(path=file_path)
readFromFile = Image.ReadFromFile(file=file_from_path)
code_block = CodeBlock { true; "Generate Views"; "Cancel"; false; 800; 400; }

# group: Input
code_block_2 = CodeBlock { "Note:"; }
string = StringInput("This tool can geverate Plan, Elevation and Section view for selected Window or Door elements.")
textnote_data = Custom[TextNote Data](Title=code_block_2, TextNote=string)  # package Data-Shapes; Create Data for TextNote input in UI.MultipleInputForm ++ . Check out www.data-shapes.net for more informations

# group: Input
code_block_3 = CodeBlock { "Select elements"; "Select"; Revit.Category.ByName("Walls"); }
selectmodelelements_data = Custom[SelectModelElements Data](InputName=code_block_3.out0, ButtonText=code_block_3.out1, CategoryFilter=code_block_3.out2)  # package Data-Shapes; Creates a Revit element selection input for UI.MultipleInputForm++ . Check out www.data-shapes.net for more infos!

# group: Input
code_block_4 = CodeBlock { "Select offset for section boxes"; 0; 200; 50; 10; }
slider = Custom[Slider](InputName=code_block_4.out0, Minimum=code_block_4.out1, Maximum=code_block_4.out2, Default_Value=code_block_4.out3, Step=code_block_4.out4)  # package Data-Shapes; Creates slider input for UI.MultipleInputForm ++ . Set the step to decimal value if you want a double slider, or to a integer value if you want an integer slider.

# group: Filtering
code_block_5 = CodeBlock { catV=Revit.Category.ByName("Views"); allV=ElementQueries.OfCategory(catV); }
isViewTemplate = View.IsViewTemplate(view=code_block_5.allV)
isNull = Object.IsNull(obj=isViewTemplate)
code_block_6 = CodeBlock { false; }
if_ = If(test=isNull, true=code_block_6, false=isViewTemplate)
filterByBoolMask = List.FilterByBoolMask(list=code_block_5.allV, mask=if_)
code_block_7 = CodeBlock(vt=filterByBoolMask.in) { vt.Name; "Assign View Template (optional)"; }
dropdown_data = Custom[DropDown Data](InputName=code_block_7.out1, Keys=code_block_7.out0, Values=filterByBoolMask.in)  # package Data-Shapes; Create data for DropDown input in UI.MultiInputForm ++ . Check out www.data-shapes.net for more infos.

# group: Input
code_block_8 = CodeBlock { "Enter first sheet number"; true; }
textbox_data = Custom[TextBox Data](InputName=code_block_8.out0)  # package Data-Shapes; Create Data for TextBox input in UI.MultipleInputForm ++ . Check out www.data-shapes.net for more informations

# group: Input
code_block_9 = CodeBlock { "Number of elements per sheet"; true; }
textbox_data_2 = Custom[TextBox Data](InputName=code_block_9.out0)

# group: Filtering
code_block_10 = CodeBlock { DSCore.Types.FindTypeByNameInAssembly("Viewport","RevitAPI"); "Type"; }
all_elements_of_type = ElementsOfType(element_type=code_block_10.out0)
elementType = Element.ElementType(element=all_elements_of_type)
code_block_11 = CodeBlock(input=elementType) { types=DSCore.List.UniqueItems(input); types.Name; "Select Viewport type"; }
dropdown_data_2 = Custom[DropDown Data](InputName=code_block_11.out2, Keys=code_block_11.out1, Values=code_block_11.types)

# group: Input
code_block_12 = CodeBlock { "Views markers not visible in scales coarser than 1:"; "25"; true; }
textbox_data_3 = Custom[TextBox Data](InputName=code_block_12.out0, DefaultText=code_block_12.out1)

# group: Input
code_block_13 = CodeBlock { "Generate Plan view"; "Generate Front Elevation view"; "Generate Section view"; true; }
boolean_input = Custom[Boolean input](InputName=code_block_13.out0, DefaultValue=code_block_13.out3)  # package Data-Shapes; Creates a boolean input for UI.MultipleInputForm ++ . Check out www.data-shapes.net for more infos!
boolean_input_2 = Custom[Boolean input](InputName=code_block_13.out1, DefaultValue=code_block_13.out3)
boolean_input_3 = Custom[Boolean input](InputName=code_block_13.out2, DefaultValue=code_block_13.out3)

list_create = List.Create(item0=textnote_data, item1=selectmodelelements_data, item2=slider, item3=dropdown_data, item4=textbox_data, item5=textbox_data_2, item6=dropdown_data_2, item7=textbox_data_3, item8=boolean_input, item9=boolean_input_2, item10=boolean_input_3)
ui_multipleinputform = Custom[UI.MultipleInputForm ++](Logo_optional=readFromFile, ButtonText_optional=code_block.out1, Inputs=list_create, Toggle=code_block.out0, CancelButtonText_optional=code_block.out2, Width_optional=code_block.out4, LabelWidth_optional=code_block.out5)  # package Data-Shapes; Create a form with multiple inputs. see www.data-shapes.net for tutorials and infos!
code_block_14 = CodeBlock(x=ui_multipleinputform.User_Inputs)
# ---------- code_block_14.designscript (10 lines) ----------
elements=x[0];
cropOffset=x[1];
viewTemplate=x[2];
firstSheetNumner=x[3];
viewPerSheet=x[4];
plan=x[7];
elevation=x[8];
section=x[9];
viewportType=x[5];
hideInScales=x[6];
# ----------------------------------------

# group: Filtering
flatten = List.Flatten(list=code_block_14.elements)
# note: Elements
clear_list = Custom[Clear List](input=flatten)  # package archi-lab.net; This node will remove all Null and Empty Lists from any list.
elementTypes = Custom[ElementTypes+](element=clear_list)  # Gets types from linked elements too. From Clockworks
code_block_15 = CodeBlock { "Mark"; }
# note: Type Mark values
getParameterValueByName = Element.GetParameterValueByName(element=clear_list, parameterName=code_block_15)

toNumber = String.ToNumber(str=code_block_14.viewPerSheet)
toNumber_2 = String.ToNumber(str=code_block_14.firstSheetNumner)

# group: Filtering
code_block_16 = CodeBlock { catS=Revit.Elements.Category.ByName("Sheets"); allS=ElementQueries.OfCategory(catS); }
code_block_17 = CodeBlock(lst=getParameterValueByName, elPerSheet=toNumber, firstSheet=toNumber_2)
# ---------- code_block_17.designscript (8 lines) ----------
numElements=DSCore.List.Count(lst);
tempSheets=numElements/elPerSheet;
numSheets=DSCore.Math.Ceiling(tempSheets);
lastSheet=(firstSheet+numSheets)-1;

firstSheet..lastSheet;

"Sheet Number";
# ----------------------------------------
getParameterValueByName_2 = Element.GetParameterValueByName(element=code_block_16.allS, parameterName=code_block_17.out5)
string_from_object = FromObject(obj=code_block_17.out4)
# note: Select the sheets on which to place the views on
eq = getParameterValueByName_2 == string_from_object  # lacing=CrossProduct
anyTrue = Orchid.Common.List.AnyTrue(list=eq)
# note: Collect sheets to put the views on (IN)
filterByBoolMask_2 = List.FilterByBoolMask(list=code_block_16.allS, mask=anyTrue)
sheetNumber = Sheet.SheetNumber(sheet=filterByBoolMask_2.in)

# group: Usage
code_block_18 = CodeBlock { "Views - Generate Spec Views - Curtain Walls"; }
acg_script_usage = Custom[ACG Script Usage](scriptName=code_block_18)  # Adds an entry to Excel document every time a script is run. The document is located in S:\Dynamo\05-UsageStats

watch = Watch(ui_multipleinputform.User_Inputs)
code_block_19 = CodeBlock(elementsCurtainWalls=code_block_14.elements) { elementsCurtainWalls; }

# group: Get local principal vectors and combine them
byElement = CurtainPanel.ByElement(hostingElement=code_block_19)  # frozen
byWall = WombatDynamo.CurtainGrid.ByWall(wall=code_block_19)
getPanels = WombatDynamo.CurtainGrid.GetPanels(grid=byWall)
firstItem = List.FirstItem(list=getPanels@@L2)
localCoordinateSystem = Custom[Element.LocalCoordinateSystem](element=firstItem)  # package BIM4Struc.Productivity; Get the insertion point and local axes of an element.
# note: Get the insertion base point and the local XYZ vectors of the structural column. The column can be either vertical or slanted.
localCoordinateSystem_2 = Custom[Element.LocalCoordinateSystem](element=code_block_19)

# group: Processing
# note: Cut plane elevation
# note: Views Center Point (auxiliary)
code_block_20 = CodeBlock { 1500; }
# note: Create sublists of elements, so it fits with the number of view types that need to be generated.
# Alternatively you could choose different view center points for each view type to be created. In this case the same point is used for the three view types.
translate = Geometry.Translate(geometry=localCoordinateSystem_2.InsertionPoint, direction=localCoordinateSystem.Zvector, distance=code_block_20)

# group: Visualisation
code_block_21 = CodeBlock(elevation=code_block_20) { elevation+100; }

# group: Processing
chop = List.Chop(list=code_block_19, lengths=toNumber)
count = List.Count(list=chop@L2)
ofRepeatedItem = List.OfRepeatedItem(item=string_from_object@L1, amount=count, lacing=Shortest)
flatten_2 = List.Flatten(list=ofRepeatedItem)

# group: Assing
code_block_22 = CodeBlock { "Mark"; "Length"; }
getParameterValueByName_3 = Element.GetParameterValueByName(element=code_block_19, parameterName=code_block_22.out0)
code_block_23 = CodeBlock(sheetNumber=flatten_2, typeMark=getParameterValueByName_3)
# ---------- code_block_23.designscript (3 lines) ----------
sheetNumber+"-XX-"+typeMark+"_PlanView";
sheetNumber+"-XX-"+typeMark+"_FrontElevation";
sheetNumber+"-XX-"+typeMark+"_Section";
# ----------------------------------------
runMe = Custom[Tool.RunMe](Boolean=code_block_14.plan, ThingToDo=code_block_23.out0)  # package SteamNodes; Use Boolean to perform an action
runMe_2 = Custom[Tool.RunMe](Boolean=code_block_14.elevation, ThingToDo=code_block_23.out1)
getParameterValueByName_4 = Element.GetParameterValueByName(element=code_block_19, parameterName=code_block_22.out1)
runMe_3 = Custom[Tool.RunMe](Boolean=code_block_14.section, ThingToDo=code_block_23.out2)

# group: Input
code_block_24 = CodeBlock(vectorX=localCoordinateSystem.Xvector, vectorY=localCoordinateSystem.Yvector, cropRegionOffset=code_block_14.cropOffset, viewDepth=code_block_21, CSPoint=translate, elements=getPanels, viewName=runMe) { vectorX; vectorY; cropRegionOffset; viewDepth; CSPoint; elements; viewName; }

# group: ELEMENT GEOMETRY SIMPLIFICATION
geometry = Element.Geometry(element=code_block_24.elements)
# note: Filter solids from the element.geometry output
type = Object.Type(obj=geometry)
code_block_25 = CodeBlock { "Autodesk.DesignScript.Geometry.Solid"; }
eq_2 = type == code_block_25
filterByBoolMask_3 = List.FilterByBoolMask(list=geometry, mask=eq_2)
byUnion = Solid.ByUnion(solids=filterByBoolMask_3.in@L3)

byUnion_2 = Solid.ByUnion(solids=byUnion)

# group (continued): ELEMENT GEOMETRY SIMPLIFICATION
flatten_3 = List.Flatten(list=byUnion_2)
# note: Union solids in case the object consists of multiple, and get the bounding box of it, to create rectangular boundaries representing the view planes.
byGeometry = BoundingBox.ByGeometry(geom=flatten_3, lacing=Longest)
toCuboid = BoundingBox.ToCuboid(boundingBox=byGeometry)

# group: APPLY CS AND WORKPLANE
# note: Defines the coordinate system for the direction of the section view.
# This is taken in the centroid of the solid geometry to be able to define negative and positive values for the min/max point
# Top view:
# X=length axis element
# Y=normal at length axis
# Front view:
# X=length axis element
# Y=Global Z axis
# Cross section view:
# X=normal axis element
# Y=Global Z axis
byOriginVectors = CoordinateSystem.ByOriginVectors(origin=code_block_24.CSPoint, xAxis=code_block_24.vectorX, yAxis=code_block_24.vectorY, lacing=Longest)
centroid = Solid.Centroid(solid=flatten_3)
# note: Generate a plane at the solid center which is orientated to the view cs. This plane is used to detect the boundaries of the section view.
byOriginXAxisYAxis = Plane.ByOriginXAxisYAxis(origin=centroid, xAxis=code_block_24.vectorX, yAxis=code_block_24.vectorY, lacing=Longest)

# group: DETECT SECTION BOUNDARY CURVES AND WORKPOINTS
intersect = Geometry.Intersect(geometry=toCuboid, other=byOriginXAxisYAxis, lacing=Longest)
# note: Detect the perimeter curves of the cutting surface at the solid centroid
flatten_4 = List.Flatten(list=intersect)
perimeterCurves = Surface.PerimeterCurves(surface=flatten_4)
byJoinedCurves = PolyCurve.ByJoinedCurves(curves=perimeterCurves)
code_block_26 = CodeBlock(x=code_block_24.cropRegionOffset) { [x,-x]; }
# note: Apply the offset on the cutting surface perimeter curves.
offset = Curve.Offset(curve=byJoinedCurves, distance=code_block_26, lacing=CrossProduct)
isNull_2 = Object.IsNull(obj=offset)
# note: If the offset value exceeds the half-width of the surface, then it generates a "null" value for the generated polycurve.
# This might return an error in the Curve.Offset node. To filter out the "null" values, the List.FilterByBoolMask is used.
filterByBoolMask_4 = List.FilterByBoolMask(list=offset, mask=isNull_2)
length = Curve.Length()  # unwired: curve
# note: Get the external polycurve of the offsetted polycurves.
maximumItemByKey = List.MaximumItemByKey(list=filterByBoolMask_4.out@L2, keyProjector=length)
# note: Get the single curves and their starting point to define the min and max boundary values
explode = Geometry.Explode(geometry=maximumItemByKey)
startPoint = Curve.StartPoint(curve=explode)

# group: TRANSLATE TO WCS FOR minPoint / maxPoint Calc
identity = CoordinateSystem.Identity()
transform = Geometry.Transform(contextCoordinateSystem=identity)  # unwired: geometry, fromCoordinateSystem
# note: As Point.X and Point.Y only work according to global WCS, the curves are transformed from the solid.centroid to the WCS in order to define the MinPoint and MaxPoint of the cut surface (offset values already included)
combine = List.Combine(comb=transform, list1=startPoint, list2=byOriginVectors)
X = Point.X(point=combine)
minimumItem = List.MinimumItem(list=X)
Y = Point.Y(point=combine)
minimumItem_2 = List.MinimumItem(list=Y)
maximumItem = List.MaximumItem(list=X)
maximumItem_2 = List.MaximumItem(list=Y)

# group: CREATE SECTION VIEW ACCORDING BOUNDING BOX
code_block_27 = CodeBlock(CropRegionOffset=code_block_24.cropRegionOffset, ViewDepth=code_block_24.viewDepth)
# ---------- code_block_27.designscript (7 lines) ----------
//Z value calculation
//in accordance with the
//Centroid point
//Startingpoint of sectionview
-CropRegionOffset;
//Relative depth of sectionview
ViewDepth-CropRegionOffset;
# ----------------------------------------
byCoordinates = Point.ByCoordinates(x=minimumItem, y=minimumItem_2, z=code_block_27.out0)
byCoordinates_2 = Point.ByCoordinates(x=maximumItem, y=maximumItem_2, z=code_block_27.out1)
# note: The section view is created according the CS, defined by the centroid and the given section view direction.
# The minPoint / maxPoint is defined by the local oriented bounding box + offset of the element.
byCoordinateSystemMinPointMaxPoint = SectionView.ByCoordinateSystemMinPointMaxPoint(cs=byOriginVectors, minPoint=byCoordinates, maxPoint=byCoordinates_2)
code_block_28 = CodeBlock { "View Name"; }
setParameterByName = Element.SetParameterByName(element=byCoordinateSystemMinPointMaxPoint, parameterName=code_block_28, value=code_block_24.viewName)

# group: Processing
# note: Distance from centre
# of window to elevation
# plane
code_block_29 = CodeBlock { 1000; }
# note: Views Center Point (auxiliary)
translate_2 = Geometry.Translate(geometry=localCoordinateSystem_2.InsertionPoint, direction=localCoordinateSystem.Yvector, distance=code_block_29)

# group: Visualisation
code_block_30 = CodeBlock(distance=code_block_29) { distance+1000; }

# group: Input
code_block_31 = CodeBlock(vectorX=localCoordinateSystem.Xvector, vectorY=localCoordinateSystem.Zvector, cropRegionOffset=code_block_14.cropOffset, viewDepth=code_block_30, CSPoint=translate_2, elements=getPanels, viewName=runMe_2) { vectorX; vectorY; cropRegionOffset; viewDepth; CSPoint; elements; viewName; }

# group: ELEMENT GEOMETRY SIMPLIFICATION
geometry_2 = Element.Geometry(element=code_block_31.elements)
# note: Filter solids from the element.geometry output
type_2 = Object.Type(obj=geometry_2)
code_block_32 = CodeBlock { "Autodesk.DesignScript.Geometry.Solid"; }
eq_3 = type_2 == code_block_32
filterByBoolMask_5 = List.FilterByBoolMask(list=geometry_2, mask=eq_3)
byUnion_3 = Solid.ByUnion(solids=filterByBoolMask_5.in@L3)

byUnion_4 = Solid.ByUnion(solids=byUnion_3)

# group (continued): ELEMENT GEOMETRY SIMPLIFICATION
flatten_5 = List.Flatten(list=byUnion_4)
# note: Union solids in case the object consists of multiple, and get the bounding box of it, to create rectangular boundaries representing the view planes.
byGeometry_2 = BoundingBox.ByGeometry(geom=flatten_5, lacing=Longest)
toCuboid_2 = BoundingBox.ToCuboid(boundingBox=byGeometry_2)

# group: APPLY CS AND WORKPLANE
# note: Defines the coordinate system for the direction of the section view.
# This is taken in the centroid of the solid geometry to be able to define negative and positive values for the min/max point
# Top view:
# X=length axis element
# Y=normal at length axis
# Front view:
# X=length axis element
# Y=Global Z axis
# Cross section view:
# X=normal axis element
# Y=Global Z axis
byOriginVectors_2 = CoordinateSystem.ByOriginVectors(origin=code_block_31.CSPoint, xAxis=code_block_31.vectorX, yAxis=code_block_31.vectorY, lacing=Longest)
centroid_2 = Solid.Centroid(solid=flatten_5)
# note: Generate a plane at the solid center which is orientated to the view cs. This plane is used to detect the boundaries of the section view.
byOriginXAxisYAxis_2 = Plane.ByOriginXAxisYAxis(origin=centroid_2, xAxis=code_block_31.vectorX, yAxis=code_block_31.vectorY, lacing=Longest)

# group: DETECT SECTION BOUNDARY CURVES AND WORKPOINTS
intersect_2 = Geometry.Intersect(geometry=toCuboid_2, other=byOriginXAxisYAxis_2, lacing=Longest)
# note: Detect the perimeter curves of the cutting surface at the solid centroid
flatten_6 = List.Flatten(list=intersect_2)
perimeterCurves_2 = Surface.PerimeterCurves(surface=flatten_6)
byJoinedCurves_2 = PolyCurve.ByJoinedCurves(curves=perimeterCurves_2)
code_block_33 = CodeBlock(x=code_block_31.cropRegionOffset) { [x,-x]; }
# note: Apply the offset on the cutting surface perimeter curves.
offset_2 = Curve.Offset(curve=byJoinedCurves_2, distance=code_block_33, lacing=CrossProduct)
isNull_3 = Object.IsNull(obj=offset_2)
# note: If the offset value exceeds the half-width of the surface, then it generates a "null" value for the generated polycurve.
# This might return an error in the Curve.Offset node. To filter out the "null" values, the List.FilterByBoolMask is used.
filterByBoolMask_6 = List.FilterByBoolMask(list=offset_2, mask=isNull_3)
length_2 = Curve.Length()  # unwired: curve
# note: Get the external polycurve of the offsetted polycurves.
maximumItemByKey_2 = List.MaximumItemByKey(list=filterByBoolMask_6.out@L2, keyProjector=length_2)
# note: Get the single curves and their starting point to define the min and max boundary values
explode_2 = Geometry.Explode(geometry=maximumItemByKey_2)
startPoint_2 = Curve.StartPoint(curve=explode_2)

# group: TRANSLATE TO WCS FOR minPoint / maxPoint Calc
identity_2 = CoordinateSystem.Identity()
transform_2 = Geometry.Transform(contextCoordinateSystem=identity_2)  # unwired: geometry, fromCoordinateSystem
# note: As Point.X and Point.Y only work according to global WCS, the curves are transformed from the solid.centroid to the WCS in order to define the MinPoint and MaxPoint of the cut surface (offset values already included)
combine_2 = List.Combine(comb=transform_2, list1=startPoint_2, list2=byOriginVectors_2)
X_2 = Point.X(point=combine_2)
minimumItem_3 = List.MinimumItem(list=X_2)
Y_2 = Point.Y(point=combine_2)
minimumItem_4 = List.MinimumItem(list=Y_2)
maximumItem_3 = List.MaximumItem(list=X_2)
maximumItem_4 = List.MaximumItem(list=Y_2)

# group: CREATE SECTION VIEW ACCORDING BOUNDING BOX
code_block_34 = CodeBlock(CropRegionOffset=code_block_31.cropRegionOffset, ViewDepth=code_block_31.viewDepth)  # same code as code_block_27
byCoordinates_3 = Point.ByCoordinates(x=minimumItem_3, y=minimumItem_4, z=code_block_34.out0)
byCoordinates_4 = Point.ByCoordinates(x=maximumItem_3, y=maximumItem_4, z=code_block_34.out1)
# note: The section view is created according the CS, defined by the centroid and the given section view direction.
# The minPoint / maxPoint is defined by the local oriented bounding box + offset of the element.
byCoordinateSystemMinPointMaxPoint_2 = SectionView.ByCoordinateSystemMinPointMaxPoint(cs=byOriginVectors_2, minPoint=byCoordinates_3, maxPoint=byCoordinates_4)
code_block_35 = CodeBlock { "View Name"; }
setParameterByName_2 = Element.SetParameterByName(element=byCoordinateSystemMinPointMaxPoint_2, parameterName=code_block_35, value=code_block_31.viewName)

# group: Visualisation
code_block_36 = CodeBlock(width=getParameterValueByName_4) { -500; DSCore.List.MaximumItem((width/2)+100); }

# group: Processing
code_block_37 = CodeBlock { 1000; }
# note: Views Center Point (auxiliary)
translate_3 = Geometry.Translate(geometry=localCoordinateSystem_2.InsertionPoint, direction=localCoordinateSystem.Zvector, distance=code_block_37)

# group: Input
code_block_38 = CodeBlock(vectorX=localCoordinateSystem.Yvector, vectorY=localCoordinateSystem.Zvector, cropRegionOffset=code_block_36.out0, viewDepth=code_block_36.out1, CSPoint=translate_3, elements=getPanels, viewName=runMe_3) { vectorX; vectorY; cropRegionOffset; viewDepth; CSPoint; elements; viewName; }

# group: ELEMENT GEOMETRY SIMPLIFICATION
geometry_3 = Element.Geometry(element=code_block_38.elements)
# note: Filter solids from the element.geometry output
type_3 = Object.Type(obj=geometry_3)
code_block_39 = CodeBlock { "Autodesk.DesignScript.Geometry.Solid"; }
eq_4 = type_3 == code_block_39
filterByBoolMask_7 = List.FilterByBoolMask(list=geometry_3, mask=eq_4)
byUnion_5 = Solid.ByUnion(solids=filterByBoolMask_7.in@L3)

byUnion_6 = Solid.ByUnion(solids=byUnion_5)

# group (continued): ELEMENT GEOMETRY SIMPLIFICATION
flatten_7 = List.Flatten(list=byUnion_6)
# note: Union solids in case the object consists of multiple, and get the bounding box of it, to create rectangular boundaries representing the view planes.
byGeometry_3 = BoundingBox.ByGeometry(geom=flatten_7, lacing=Longest)
toCuboid_3 = BoundingBox.ToCuboid(boundingBox=byGeometry_3)

# group: APPLY CS AND WORKPLANE
# note: Defines the coordinate system for the direction of the section view.
# This is taken in the centroid of the solid geometry to be able to define negative and positive values for the min/max point
# Top view:
# X=length axis element
# Y=normal at length axis
# Front view:
# X=length axis element
# Y=Global Z axis
# Cross section view:
# X=normal axis element
# Y=Global Z axis
byOriginVectors_3 = CoordinateSystem.ByOriginVectors(origin=code_block_38.CSPoint, xAxis=code_block_38.vectorX, yAxis=code_block_38.vectorY, lacing=Longest)
centroid_3 = Solid.Centroid(solid=flatten_7)
# note: Generate a plane at the solid center which is orientated to the view cs. This plane is used to detect the boundaries of the section view.
byOriginXAxisYAxis_3 = Plane.ByOriginXAxisYAxis(origin=centroid_3, xAxis=code_block_38.vectorX, yAxis=code_block_38.vectorY, lacing=Longest)

# group: DETECT SECTION BOUNDARY CURVES AND WORKPOINTS
intersect_3 = Geometry.Intersect(geometry=toCuboid_3, other=byOriginXAxisYAxis_3, lacing=Longest)
# note: Detect the perimeter curves of the cutting surface at the solid centroid
flatten_8 = List.Flatten(list=intersect_3)
perimeterCurves_3 = Surface.PerimeterCurves(surface=flatten_8)
byJoinedCurves_3 = PolyCurve.ByJoinedCurves(curves=perimeterCurves_3)
code_block_40 = CodeBlock(x=code_block_38.cropRegionOffset) { [x,-x]; }
# note: Apply the offset on the cutting surface perimeter curves.
offset_3 = Curve.Offset(curve=byJoinedCurves_3, distance=code_block_40, lacing=CrossProduct)
isNull_4 = Object.IsNull(obj=offset_3)
# note: If the offset value exceeds the half-width of the surface, then it generates a "null" value for the generated polycurve.
# This might return an error in the Curve.Offset node. To filter out the "null" values, the List.FilterByBoolMask is used.
filterByBoolMask_8 = List.FilterByBoolMask(list=offset_3, mask=isNull_4)
length_3 = Curve.Length()  # unwired: curve
# note: Get the external polycurve of the offsetted polycurves.
maximumItemByKey_3 = List.MaximumItemByKey(list=filterByBoolMask_8.out@L2, keyProjector=length_3)
# note: Get the single curves and their starting point to define the min and max boundary values
explode_3 = Geometry.Explode(geometry=maximumItemByKey_3)
startPoint_3 = Curve.StartPoint(curve=explode_3)

# group: TRANSLATE TO WCS FOR minPoint / maxPoint Calc
identity_3 = CoordinateSystem.Identity()
transform_3 = Geometry.Transform(contextCoordinateSystem=identity_3)  # unwired: geometry, fromCoordinateSystem
# note: As Point.X and Point.Y only work according to global WCS, the curves are transformed from the solid.centroid to the WCS in order to define the MinPoint and MaxPoint of the cut surface (offset values already included)
combine_3 = List.Combine(comb=transform_3, list1=startPoint_3, list2=byOriginVectors_3)
X_3 = Point.X(point=combine_3)
minimumItem_5 = List.MinimumItem(list=X_3)
Y_3 = Point.Y(point=combine_3)
minimumItem_6 = List.MinimumItem(list=Y_3)
maximumItem_5 = List.MaximumItem(list=X_3)
maximumItem_6 = List.MaximumItem(list=Y_3)

# group: CREATE SECTION VIEW ACCORDING BOUNDING BOX
code_block_41 = CodeBlock(CropRegionOffset=code_block_38.cropRegionOffset, ViewDepth=code_block_38.viewDepth)  # same code as code_block_27
byCoordinates_5 = Point.ByCoordinates(x=minimumItem_5, y=minimumItem_6, z=code_block_41.out0)
byCoordinates_6 = Point.ByCoordinates(x=maximumItem_5, y=maximumItem_6, z=code_block_41.out1)
# note: The section view is created according the CS, defined by the centroid and the given section view direction.
# The minPoint / maxPoint is defined by the local oriented bounding box + offset of the element.
byCoordinateSystemMinPointMaxPoint_3 = SectionView.ByCoordinateSystemMinPointMaxPoint(cs=byOriginVectors_3, minPoint=byCoordinates_5, maxPoint=byCoordinates_6)
code_block_42 = CodeBlock { "View Name"; }
setParameterByName_3 = Element.SetParameterByName(element=byCoordinateSystemMinPointMaxPoint_3, parameterName=code_block_42, value=code_block_38.viewName)

toNumber_3 = String.ToNumber(str=code_block_14.hideInScales)

# group: Processing
code_block_43 = CodeBlock(elsPerView=toNumber) { x=(1..elsPerView); z=0; }
code_block_44 = CodeBlock { 3; 3.5; 4; }
byCoordinates_7 = Point.ByCoordinates(x=code_block_43.x, y=code_block_44.out0, z=code_block_43.z)
code_block_45 = CodeBlock(count=count) { 0..(count-1); }
getItemAtIndex = List.GetItemAtIndex(list=byCoordinates_7, index=code_block_45)
byCoordinates_8 = Point.ByCoordinates(x=code_block_43.x, y=code_block_44.out1, z=code_block_43.z)
getItemAtIndex_2 = List.GetItemAtIndex(list=byCoordinates_8, index=code_block_45)
byCoordinates_9 = Point.ByCoordinates(x=code_block_43.x, y=code_block_44.out2, z=code_block_43.z)
getItemAtIndex_3 = List.GetItemAtIndex(list=byCoordinates_9, index=code_block_45)

code_block_46 = CodeBlock { true; }

# group: Assing
chop_2 = List.Chop(list=setParameterByName, lengths=toNumber)
code_block_47 = CodeBlock(e=chop_2) { e.Id; }
element_by_id = ElementById(Id=code_block_47)
chop_3 = List.Chop(list=getItemAtIndex, lengths=toNumber)
RIE_PlaceViewOnSheet = Custom[RIE_PlaceViewOnSheet](view_Schedule_Legend=element_by_id@L2, sheet=filterByBoolMask_2.in@@L1, point=chop_3@L2, refresh=code_block_46)  # package RIE; Places Views, Schedules or Legends into sheets.
firstItem_2 = List.FirstItem(list=RIE_PlaceViewOnSheet.Placed@L2)

# group: Assing
chop_4 = List.Chop(list=setParameterByName_2, lengths=toNumber)
code_block_48 = CodeBlock(e=chop_4) { e.Id; }
element_by_id_2 = ElementById(Id=code_block_48)
chop_5 = List.Chop(list=getItemAtIndex_2, lengths=toNumber)
RIE_PlaceViewOnSheet_2 = Custom[RIE_PlaceViewOnSheet](view_Schedule_Legend=element_by_id_2@L2, sheet=filterByBoolMask_2.in@@L1, point=chop_5@L2, refresh=code_block_46)
firstItem_3 = List.FirstItem(list=RIE_PlaceViewOnSheet_2.Placed@L2)

# group: Assing
chop_6 = List.Chop(list=setParameterByName_3, lengths=toNumber)
code_block_49 = CodeBlock(e=chop_6) { e.Id; }
element_by_id_3 = ElementById(Id=code_block_49)
chop_7 = List.Chop(list=getItemAtIndex_3, lengths=toNumber)
RIE_PlaceViewOnSheet_3 = Custom[RIE_PlaceViewOnSheet](view_Schedule_Legend=element_by_id_3@L2, sheet=filterByBoolMask_2.in@@L1, point=chop_7@L2, refresh=code_block_46)
firstItem_4 = List.FirstItem(list=RIE_PlaceViewOnSheet_3.Placed@L2)

# group: Control
list_create_2 = List.Create(item0=chop_2, item1=chop_4, item2=chop_6)
flatten_9 = List.Flatten(list=list_create_2)
clear_list_2 = Custom[Clear List](input=flatten_9)

# group: Assing
# note: Assign template to the views
set = Orchid.RevitProject.Views.ViewTemplate.Set(view=clear_list_2, viewTemplate=code_block_14.viewTemplate)

# group: Assing
code_block_50 = CodeBlock { "Hide at scales coarser than"; 20; }
setParameterByName_4 = Element.SetParameterByName(element=clear_list_2, parameterName=code_block_50.out0, value=toNumber_3)

# group: Control
list_create_3 = List.Create(item0=firstItem_2, item1=firstItem_3, item2=firstItem_4)
flatten_10 = List.Flatten(list=list_create_3)
clear_list_3 = Custom[Clear List](input=flatten_10)

# group: Assing
code_block_51 = CodeBlock(input=clear_list_3) { "ELEM_TYPE_PARAM"; DSCore.List.Count(input); }
id = Element.Id(element=code_block_14.viewportType)
ofRepeatedItem_2 = List.OfRepeatedItem(item=id, amount=code_block_51.out1)
set_builtin_parameter = Custom[Set BuiltIn Parameter](parameterName=code_block_51.out0, elements=clear_list_3, parameterValues=ofRepeatedItem_2)  # package archi-lab.net; This node will take an input of a built in parameter name and set that parameter to given value for given elements.
