# Dynamo graph Create Doors & Windows Spec Views.dyn "Views - Generate Spec Views - Doors & Windows" (Dynamo 2.12.1.8246)
# packages: Orchid 260.1.0.7729, archi-lab.net 2021.25.2521, Data-Shapes 2021.2.92, BIM4Struc.Productivity 2.2.2, SteamNodes 1.2.3, RIE 2020.12.2, Rhythm 2021.1.1

file_path = Filename("..\ACG_logo.png")
file_from_path = FileObject(path=file_path)
readFromFile = Image.ReadFromFile(file=file_from_path)
code_block = CodeBlock { true; "Generate Views"; "Cancel"; false; 800; 400; }

# group: Input
code_block_2 = CodeBlock { "Note:"; }
string = StringInput("This tool can geverate Plan, Elevation and Section view for selected Window or Door elements.")
textnote_data = Custom[TextNote Data](Title=code_block_2, TextNote=string)  # package Data-Shapes; Create Data for TextNote input in UI.MultipleInputForm ++ . Check out www.data-shapes.net for more informations

# group: Input
code_block_3 = CodeBlock { "Select offset for section boxes"; 0; 200; 50; 10; }
slider = Custom[Slider](InputName=code_block_3.out0, Minimum=code_block_3.out1, Maximum=code_block_3.out2, Default_Value=code_block_3.out3, Step=code_block_3.out4)  # package Data-Shapes; Creates slider input for UI.MultipleInputForm ++ . Set the step to decimal value if you want a double slider, or to a integer value if you want an integer slider.

# group: Filtering
code_block_4 = CodeBlock { catV=Revit.Category.ByName("Views"); allV=ElementQueries.OfCategory(catV); }
isViewTemplate = View.IsViewTemplate(view=code_block_4.allV)
isNull = Object.IsNull(object=isViewTemplate)

filterByBoolMask = List.FilterByBoolMask(list=code_block_4.allV, mask=isNull)
isViewTemplate_2 = View.IsViewTemplate(view=filterByBoolMask.out)

# group (continued): Filtering
filterByBoolMask_2 = List.FilterByBoolMask(list=filterByBoolMask.out, mask=isViewTemplate_2)
code_block_5 = CodeBlock(vt=filterByBoolMask_2.in) { vt.Name; "Assign View Template (optional)"; }
dropdown_data = Custom[DropDown Data](InputName=code_block_5.out1, Keys=code_block_5.out0, Values=filterByBoolMask_2.in)  # package Data-Shapes; Create data for DropDown input in UI.MultiInputForm ++ . Check out www.data-shapes.net for more infos.

# group: Input
code_block_6 = CodeBlock { "Enter first sheet number"; true; }
textbox_data = Custom[TextBox Data](InputName=code_block_6.out0)  # package Data-Shapes; Create Data for TextBox input in UI.MultipleInputForm ++ . Check out www.data-shapes.net for more informations

# group: Input
code_block_7 = CodeBlock { "Number of elements per sheet"; true; }
textbox_data_2 = Custom[TextBox Data](InputName=code_block_7.out0)

# group: Filtering
code_block_8 = CodeBlock { DSCore.Types.FindTypeByNameInAssembly("Viewport","RevitAPI"); "Type"; }
all_elements_of_type = ElementsOfType(element_type=code_block_8.out0)
elementType = Element.ElementType(element=all_elements_of_type)
code_block_9 = CodeBlock(input=elementType) { types=DSCore.List.UniqueItems(input); types.Name; "Select Viewport type"; }
dropdown_data_2 = Custom[DropDown Data](InputName=code_block_9.out2, Keys=code_block_9.out1, Values=code_block_9.types)

# group: Input
code_block_10 = CodeBlock { "Views markers not visible in scales coarser than 1:"; "25"; true; }
textbox_data_3 = Custom[TextBox Data](InputName=code_block_10.out0, DefaultText=code_block_10.out1)

# group: Input
code_block_11 = CodeBlock { "Generate Plan view"; "Generate Front Elevation view"; "Generate Section view"; true; }
boolean_input = Custom[Boolean input](InputName=code_block_11.out0, DefaultValue=code_block_11.out3)  # package Data-Shapes; Creates a boolean input for UI.MultipleInputForm ++ . Check out www.data-shapes.net for more infos!
boolean_input_2 = Custom[Boolean input](InputName=code_block_11.out1, DefaultValue=code_block_11.out3)
boolean_input_3 = Custom[Boolean input](InputName=code_block_11.out2, DefaultValue=code_block_11.out3)

list_create = List.Create(item0=textnote_data, item1=slider, item2=dropdown_data, item3=textbox_data, item4=textbox_data_2, item5=dropdown_data_2, item6=textbox_data_3, item7=boolean_input, item8=boolean_input_2, item9=boolean_input_3)
ui_multipleinputform = Custom[UI.MultipleInputForm ++](Logo_optional=readFromFile, ButtonText_optional=code_block.out1, Inputs=list_create, Toggle=code_block.out0, CancelButtonText_optional=code_block.out2, Width_optional=code_block.out4, LabelWidth_optional=code_block.out5)  # package Data-Shapes; Create a form with multiple inputs. see www.data-shapes.net for tutorials and infos!

# group: Control
end = Revit.Transaction.Transaction.End(input=ui_multipleinputform.User_Inputs)
start = Revit.Transaction.Transaction.Start(input=end)

# group: Input
code_block_12 = CodeBlock { true; Revit.Category.ByName("Windows"); Revit.Category.ByName("Doors"); }
await_ = Orchid.Common.DataStream.Await(pass=code_block_12.out0, waitFor=start)
list_create_2 = List.Create(item0=code_block_12.out1, item1=code_block_12.out2)
flatten = List.Flatten(list=list_create_2)
await_2 = Orchid.Common.DataStream.Await(pass=flatten, waitFor=start)
ʳʰʸᵗʰᵐ_selection_pick = Rhythm.Revit.Selection.Selection.Pick(runIt=await_, category=await_2)

# group: Control
getCategory = Element.GetCategory(element=ʳʰʸᵗʰᵐ_selection_pick)
name = Category.Name(category=getCategory)
# note: Filter only doors and windows
code_block_13 = CodeBlock(input=name) { input=="Doors"; input=="Windows"; }
filterByBoolMask_3 = List.FilterByBoolMask(list=ʳʰʸᵗʰᵐ_selection_pick, mask=code_block_13.out0)
filterByBoolMask_4 = List.FilterByBoolMask(list=ʳʰʸᵗʰᵐ_selection_pick, mask=code_block_13.out1)
list_create_3 = List.Create(item0=filterByBoolMask_3.in, item1=filterByBoolMask_4.in)
flatten_2 = List.Flatten(list=list_create_3)

# group: Filtering
flatten_3 = List.Flatten(list=flatten_2)
# note: Elements
clear_list = Custom[Clear List](input=flatten_3)  # package archi-lab.net; This node will remove all Null and Empty Lists from any list.
elementTypes = Custom[ElementTypes+](element=clear_list)  # Gets types from linked elements too. From Clockworks
code_block_14 = CodeBlock { "Type Mark"; }
# note: Type Mark values
getParameterValueByName = Element.GetParameterValueByName(element=elementTypes, parameterName=code_block_14)

code_block_15 = CodeBlock(x=start)
# ---------- code_block_15.designscript (10 lines) ----------
elements=x[0];
cropOffset=x[0];
viewTemplate=x[1];
firstSheetNumner=x[2];
viewPerSheet=x[3];
plan=x[6];
elevation=x[7];
section=x[8];
viewportType=x[4];
hideInScales=x[5];
# ----------------------------------------
toNumber = String.ToNumber(string=code_block_15.viewPerSheet)
toNumber_2 = String.ToNumber(string=code_block_15.firstSheetNumner)

# group: Filtering
code_block_16 = CodeBlock { catS=Revit.Elements.Category.ByName("Sheets"); allS=ElementQueries.OfCategory(catS); }
code_block_17 = CodeBlock(lst=getParameterValueByName, elPerSheet=toNumber, firstSheet=toNumber_2)
# ---------- code_block_17.designscript (8 lines) ----------
numElements=DSCore.List.Count(lst);
tempSheets=numElements/elPerSheet;
numSheets=DSCore.Math.Ceiling(tempSheets);
lastSheet=(firstSheet+numSheets)-1;

firstSheet..lastSheet;

"Sheet Number";
# ----------------------------------------
getParameterValueByName_2 = Element.GetParameterValueByName(element=code_block_16.allS, parameterName=code_block_17.out5)
string_from_object = FromObject(obj=code_block_17.out4)
# note: Select the sheets on which to place the views on
eq = getParameterValueByName_2 == string_from_object  # lacing=CrossProduct
anyTrue = Orchid.Common.List.AnyTrue(list=eq)
# note: Collect sheets to put the views on (IN)
filterByBoolMask_5 = List.FilterByBoolMask(list=code_block_16.allS, mask=anyTrue)
sheetNumber = Sheet.SheetNumber(sheet=filterByBoolMask_5.in)

# group: Usage
code_block_18 = CodeBlock { "Views - Generate Spec Views - Door & Windows"; }
acg_script_usage = Custom[ACG Script Usage](scriptName=code_block_18)  # Adds an entry to Excel document every time a script is run. The document is located in S:\Dynamo\05-UsageStats

watch = Watch(ui_multipleinputform.User_Inputs)
code_block_19 = CodeBlock(elementsComponentFams=flatten_2) { elementsComponentFams; }

# group: Get local principal vectors and combine them
# note: Get the insertion base point and the local XYZ vectors of the structural column. The column can be either vertical or slanted.
localCoordinateSystem = Custom[Element.LocalCoordinateSystem](element=code_block_19)  # package BIM4Struc.Productivity; Get the insertion point and local axes of an element.

# group: Processing
type = archilab.Revit.Elements.Elements.Type(element=code_block_19)
code_block_20 = CodeBlock { "Width"; "Height"; }
# note: Define at that elevation the PLAN section will be
getParameterValueByName_3 = Element.GetParameterValueByName(element=type, parameterName=code_block_20.out1)
code_block_21 = CodeBlock(height=getParameterValueByName_3) { height/3*2; }
getParameterValueByName_4 = Element.GetParameterValueByName(element=type, parameterName=code_block_20.out0)

# group: Processing
# note: Cut plane elevation
# note: Views Center Point (auxiliary)
code_block_22 = CodeBlock { 1500; }
# note: Create sublists of elements, so it fits with the number of view types that need to be generated.
# Alternatively you could choose different view center points for each view type to be created. In this case the same point is used for the three view types.
translate = Geometry.Translate(geometry=localCoordinateSystem.InsertionPoint, direction=localCoordinateSystem.Zvector, distance=code_block_21)

# group: Processing
code_block_23 = CodeBlock(els=code_block_19) { count=DSCore.List.Count(els); 1..count; }
# note: Generate temp names for the views. In case there is bad element which will not generate views
code_block_24 = CodeBlock(number=code_block_23.out1) { "temp-"+number+"_PlanView"; "temp-"+number+"_FrontElevation"; "temp-"+number+"_Section"; }
runMe = Custom[Tool.RunMe](Boolean=code_block_15.plan, ThingToDo=code_block_24.out0)  # package SteamNodes; Use Boolean to perform an action
runMe_2 = Custom[Tool.RunMe](Boolean=code_block_15.elevation, ThingToDo=code_block_24.out1)
runMe_3 = Custom[Tool.RunMe](Boolean=code_block_15.section, ThingToDo=code_block_24.out2)

# group: Visualisation
reverse = Vector.Reverse(vector=localCoordinateSystem.Xvector)
code_block_25 = CodeBlock(elevation=code_block_22) { elevation+100; }
create_element_view = Custom[Create Element View](Xvector=reverse, Yvector=localCoordinateSystem.Yvector, CropRegionOffset=code_block_15.cropOffset, ViewDepth=code_block_25, CSPoint=translate, RevitElements=code_block_19, Viewname=runMe)  # package BIM4Struc.Productivity; This node makes it possible to automatically create aligned section views on selected elements. Necessary inputs are: Revit Elements: this to detect the solid.centroid. The views are oriented to that point. X-vectors and Y-vectors to get the direction of the section plane. Traditionally these vectors are taken from the location lines of linear objects or facing directions of generic elements (i.e. doors). You might replace this with the vector of a selected edge for instance.

# group: Processing
# note: Distance from centre
# of window to elevation
# plane
code_block_26 = CodeBlock { 1000; }
# note: Views Center Point (auxiliary)
translate_2 = Geometry.Translate(geometry=localCoordinateSystem.InsertionPoint, direction=localCoordinateSystem.Yvector, distance=code_block_26)

# group: Visualisation
code_block_27 = CodeBlock(distance=code_block_26) { distance+1000; }
create_element_view_2 = Custom[Create Element View](Xvector=localCoordinateSystem.Xvector, Yvector=localCoordinateSystem.Zvector, CropRegionOffset=code_block_15.cropOffset, ViewDepth=code_block_27, CSPoint=translate_2, RevitElements=code_block_19, Viewname=runMe_2)

# group: Processing
code_block_28 = CodeBlock { 1000; }
# note: Views Center Point (auxiliary)
translate_3 = Geometry.Translate(geometry=localCoordinateSystem.InsertionPoint, direction=localCoordinateSystem.Zvector, distance=code_block_28)

# group: Visualisation
code_block_29 = CodeBlock(width=getParameterValueByName_4) { 100; DSCore.List.MaximumItem((width/2)+100); }
create_element_view_3 = Custom[Create Element View](Xvector=localCoordinateSystem.Yvector, Yvector=localCoordinateSystem.Zvector, CropRegionOffset=code_block_29.out0, ViewDepth=code_block_29.out1, CSPoint=translate_3, RevitElements=code_block_19, Viewname=runMe_3)

# group: Assing
chop = List.Chop(list=code_block_19, lengths=toNumber)
count = List.Count(list=chop@L2)
ofRepeatedItem = List.OfRepeatedItem(item=string_from_object@L1, amount=count@@L1)
flatten_4 = List.Flatten(list=ofRepeatedItem)
type_2 = archilab.Revit.Elements.Elements.Type(element=code_block_19)
code_block_30 = CodeBlock { "Type Mark"; }
getParameterValueByName_5 = Element.GetParameterValueByName(element=type_2, parameterName=code_block_30)
# note: Generate name for each view of the input elements
code_block_31 = CodeBlock(sheetNumber=flatten_4, typeMark=getParameterValueByName_5)
# ---------- code_block_31.designscript (3 lines) ----------
sheetNumber+"-XX-"+typeMark+"_PlanView";
sheetNumber+"-XX-"+typeMark+"_FrontElevation";
sheetNumber+"-XX-"+typeMark+"_Section";
# ----------------------------------------

# group: Control
isNull_2 = Object.IsNull(object=create_element_view)
filterByBoolMask_6 = List.FilterByBoolMask(list=create_element_view, mask=isNull_2)
isNull_3 = Object.IsNull(object=create_element_view_2)
filterByBoolMask_7 = List.FilterByBoolMask(list=create_element_view_2, mask=isNull_3)
isNull_4 = Object.IsNull(object=create_element_view_3)
filterByBoolMask_8 = List.FilterByBoolMask(list=create_element_view_3, mask=isNull_4)
filterByBoolMask_9 = List.FilterByBoolMask(list=code_block_31.out0, mask=isNull_2)
filterByBoolMask_10 = List.FilterByBoolMask(list=code_block_31.out1, mask=isNull_3)
filterByBoolMask_11 = List.FilterByBoolMask(list=code_block_31.out2, mask=isNull_4)

# group: Visualisation
acg_element_setname = Custom[ACG Element.SetName](element=filterByBoolMask_6.out, name=filterByBoolMask_9.out)
acg_element_setname_2 = Custom[ACG Element.SetName](element=filterByBoolMask_7.out, name=filterByBoolMask_10.out)
acg_element_setname_3 = Custom[ACG Element.SetName](element=filterByBoolMask_8.out, name=filterByBoolMask_11.out)

# group: Processing
code_block_32 = CodeBlock(elsPerView=toNumber) { x=(1..elsPerView); z=0; }
code_block_33 = CodeBlock { 3; 3.5; 4; }
byCoordinates = Point.ByCoordinates(x=code_block_32.x, y=code_block_33.out0, z=code_block_32.z)
list_create_4 = List.Create(item0=acg_element_setname.element, item1=acg_element_setname_2.element, item2=acg_element_setname_3.element)
count_2 = List.Count(list=list_create_4@@L2)
maximumItem = List.MaximumItem(list=count_2)
code_block_34 = CodeBlock(count=maximumItem) { 0..(count-1); }
chop_2 = List.Chop(list=code_block_34, lengths=toNumber)
count_3 = List.Count(list=chop_2@L2)
code_block_35 = CodeBlock(count=count_3) { 0..(count-1); }
getItemAtIndex = List.GetItemAtIndex(list=byCoordinates, index=code_block_35)
byCoordinates_2 = Point.ByCoordinates(x=code_block_32.x, y=code_block_33.out1, z=code_block_32.z)
getItemAtIndex_2 = List.GetItemAtIndex(list=byCoordinates_2, index=code_block_35)
byCoordinates_3 = Point.ByCoordinates(x=code_block_32.x, y=code_block_33.out2, z=code_block_32.z)
getItemAtIndex_3 = List.GetItemAtIndex(list=byCoordinates_3, index=code_block_35)

code_block_36 = CodeBlock { true; }

# group: Assing
chop_3 = List.Chop(list=filterByBoolMask_6.out, lengths=toNumber)
code_block_37 = CodeBlock(e=chop_3) { e.Id; }
element_by_id = ElementById(Id=code_block_37)
chop_4 = List.Chop(list=getItemAtIndex, lengths=toNumber)
RIE_PlaceViewOnSheet = Custom[RIE_PlaceViewOnSheet](view_Schedule_Legend=element_by_id@L2, sheet=filterByBoolMask_5.in@@L1, point=chop_4@L2, refresh=code_block_36)  # package RIE; Places Views, Schedules or Legends into sheets.
firstItem = List.FirstItem(list=RIE_PlaceViewOnSheet.Placed@L2)

# group: Assing
chop_5 = List.Chop(list=filterByBoolMask_7.out, lengths=toNumber)
code_block_38 = CodeBlock(e=chop_5) { e.Id; }
element_by_id_2 = ElementById(Id=code_block_38)
chop_6 = List.Chop(list=getItemAtIndex_2, lengths=toNumber)
RIE_PlaceViewOnSheet_2 = Custom[RIE_PlaceViewOnSheet](view_Schedule_Legend=element_by_id_2@L2, sheet=filterByBoolMask_5.in@@L1, point=chop_6@L2, refresh=code_block_36)
firstItem_2 = List.FirstItem(list=RIE_PlaceViewOnSheet_2.Placed@L2)

# group: Assing
chop_7 = List.Chop(list=filterByBoolMask_8.out, lengths=toNumber)
code_block_39 = CodeBlock(e=chop_7) { e.Id; }
element_by_id_3 = ElementById(Id=code_block_39)
chop_8 = List.Chop(list=getItemAtIndex_3, lengths=toNumber)
RIE_PlaceViewOnSheet_3 = Custom[RIE_PlaceViewOnSheet](view_Schedule_Legend=element_by_id_3@L2, sheet=filterByBoolMask_5.in@@L1, point=chop_8@L2, refresh=code_block_36)
firstItem_3 = List.FirstItem(list=RIE_PlaceViewOnSheet_3.Placed@L2)

# group: Control
list_create_5 = List.Create(item0=chop_3, item1=chop_5, item2=chop_7)
flatten_5 = List.Flatten(list=list_create_5)
clear_list_2 = Custom[Clear List](input=flatten_5)

# group: Assing
# note: Assign template to the views
set = Orchid.RevitProject.Views.ViewTemplate.Set(view=clear_list_2, viewTemplate=code_block_15.viewTemplate)

# group: Control
list_create_6 = List.Create(item0=firstItem, item1=firstItem_2, item2=firstItem_3)
flatten_6 = List.Flatten(list=list_create_6)
clear_list_3 = Custom[Clear List](input=flatten_6)

# group: Assing
code_block_40 = CodeBlock(input=clear_list_3) { "ELEM_TYPE_PARAM"; DSCore.List.Count(input); }
id = Element.Id(element=code_block_15.viewportType)
ofRepeatedItem_2 = List.OfRepeatedItem(item=id, amount=code_block_40.out1)
set_builtin_parameter = Custom[Set BuiltIn Parameter](parameterName=code_block_40.out0, elements=clear_list_3, parameterValues=ofRepeatedItem_2)  # package archi-lab.net; This node will take an input of a built in parameter name and set that parameter to given value for given elements.

toNumber_3 = String.ToNumber(string=code_block_15.hideInScales)

# group: Assing
code_block_41 = CodeBlock { "Hide at scales coarser than"; 20; }
setParameterByName = Element.SetParameterByName(element=clear_list_2, parameterName=code_block_41.out0, value=toNumber_3)

# group: Assing
chop_9 = List.Chop(list=filterByBoolMask_6.out, lengths=toNumber)
code_block_42 = CodeBlock(e=chop_9) { e.Id; }
element_by_id_4 = ElementById(Id=code_block_42)
chop_10 = List.Chop(list=getItemAtIndex, lengths=toNumber)
RIE_PlaceViewOnSheet_4 = Custom[RIE_PlaceViewOnSheet](view_Schedule_Legend=element_by_id_4@L2, sheet=filterByBoolMask_5.in@@L1, point=chop_10@L2, refresh=code_block_36)
firstItem_4 = List.FirstItem(list=RIE_PlaceViewOnSheet_4.Placed@L2)

# group: Control
list_create_7 = List.Create(item0=chop_9, item1=chop_5, item2=chop_7)
flatten_7 = List.Flatten(list=list_create_7)
clear_list_4 = Custom[Clear List](input=flatten_7)

# group: Assing
# note: Assign template to the views
set_2 = Orchid.RevitProject.Views.ViewTemplate.Set(view=clear_list_4, viewTemplate=code_block_15.viewTemplate)

# group: Assing
code_block_43 = CodeBlock { "Hide at scales coarser than"; 20; }
setParameterByName_2 = Element.SetParameterByName(element=clear_list_4, parameterName=code_block_43.out0, value=toNumber_3)

# group: Control
list_create_8 = List.Create(item0=firstItem_4, item1=firstItem_2, item2=firstItem_3)
flatten_8 = List.Flatten(list=list_create_8)
clear_list_5 = Custom[Clear List](input=flatten_8)

# group: Assing
code_block_44 = CodeBlock(input=clear_list_5) { "ELEM_TYPE_PARAM"; DSCore.List.Count(input); }
id_2 = Element.Id(element=code_block_15.viewportType)
ofRepeatedItem_3 = List.OfRepeatedItem(item=id_2, amount=code_block_44.out1)
set_builtin_parameter_2 = Custom[Set BuiltIn Parameter](parameterName=code_block_44.out0, elements=clear_list_5, parameterValues=ofRepeatedItem_3)
