# Dynamo graph Create Floor Spec Views.dyn "Views - Generate Spec Views - Floors" (Dynamo 2.12.1.8246)
# packages: Genius Loci 2021.2.3, archi-lab.net 2021.25.2521, SteamNodes 1.2.3, Data-Shapes 2021.2.92, Orchid 260.1.0.7729, RIE 2020.12.2, Rhythm 2021.1.1, archi-lab.net 2022.210.2522

# group: Process the FLOORS from the host model

# group: Process the walls from the linked model(s)

# group: Create FLOOR instances for the specification view

# group: Dimension FLOOR layers

# group: Annotate FLOOR layers - material tags

# group: Create section view for each FLOOR

# group: Apply View template

# group: Processing
# note: Set Planes for the sections
XAxis = Vector.XAxis()
reverse = Vector.Reverse(vector=XAxis)
ZAxis = Vector.ZAxis()
code_block = CodeBlock { 150; 50; }

file_path = Filename("..\ACG_logo.png")
file_from_path = FileObject(path=file_path)
readFromFile = Image.ReadFromFile(file=file_from_path)
code_block_2 = CodeBlock { true; "Generate Views"; "Cancel"; false; 800; 400; }

# group: Input
code_block_3 = CodeBlock { "Note:"; }
string = StringInput("""This tool can generate Floor spec section views for Floor elements in the model.
To run the tool, you need to create a dedicated view and place a line to define the origin for generating the elements. Make sure all required Floor and Material tags are present in the model.
To place the section views directly onto Sheets, please make sure the Sheets already exist in the model. If not, untick "Place on sheets" and enter placeholder sheet value. The sections will be generated with compliant names but will remain in the Views section of the Project Browser.
If you are working with linked models, please use Transfer Project Standards to bring all new floor types from the linked RVT model. Make sure that the linked floor types with unique Type Mark value have unique Type Name as well.
Please fill in the required fields below and click "Generate Elements". Select the a line once the window disappears.
Please remember, that this tool is only as good as the data you are inputting!
For more information on how this tool works, please refer to the Revit Tutorials channel in MS Teams or speak with IP.""")
textnote_data = Custom[TextNote Data](Title=code_block_3, TextNote=string)  # package Data-Shapes; Create Data for TextNote input in UI.MultipleInputForm ++ . Check out www.data-shapes.net for more informations

# group: Input
code_block_4 = CodeBlock { "Type parameter name to filter:"; "Type Mark"; }
textbox_data = Custom[TextBox Data](InputName=code_block_4.out0, DefaultText=code_block_4.out1)  # package Data-Shapes; Create Data for TextBox input in UI.MultipleInputForm ++ . Check out www.data-shapes.net for more informations

# group: Input
code_block_5 = CodeBlock { "Parameter value must contain:"; }
textbox_data_2 = Custom[TextBox Data](InputName=code_block_5)

# group: Input
code_block_6 = CodeBlock { DSCore.Types.FindTypeByNameInAssembly("Family","RevitAPI"); }
all_elements_of_type = ElementsOfType(element_type=code_block_6)
code_block_7 = CodeBlock(e=all_elements_of_type) { e.Name; "Tag"; true; }
contains = String.Contains(string=code_block_7.out0, searchFor=code_block_7.out1, ignoreCase=code_block_7.out2)
filterByBoolMask = List.FilterByBoolMask(list=all_elements_of_type, mask=contains)
code_block_8 = CodeBlock(e=filterByBoolMask.in) { e.Name; "Mat"; true; }
contains_2 = String.Contains(string=code_block_8.out0, searchFor=code_block_8.out1, ignoreCase=code_block_8.out2)
filterByBoolMask_2 = List.FilterByBoolMask(list=filterByBoolMask.in, mask=contains_2)
name = Family.Name(family=filterByBoolMask_2.in)
types = Family.Types(family=filterByBoolMask_2.in)
code_block_9 = CodeBlock(tp=types) { tp.Name; }
count = List.Count(list=code_block_9@L2)
ofRepeatedItem = List.OfRepeatedItem(item=name, amount=count, lacing=Shortest)
code_block_10 = CodeBlock(famName=ofRepeatedItem, typeName=code_block_9) { famName+" - "+typeName; "Select material tag type"; }
flatten = List.Flatten(list=code_block_10.out0)
flatten_2 = List.Flatten(list=types)
dropdown_data = Custom[DropDown Data](InputName=code_block_10.out1, Keys=flatten, Values=flatten_2)  # package Data-Shapes; Create data for DropDown input in UI.MultiInputForm ++ . Check out www.data-shapes.net for more infos.

# group: Input
code_block_11 = CodeBlock { DSCore.Types.FindTypeByNameInAssembly("Family","RevitAPI"); }
all_elements_of_type_2 = ElementsOfType(element_type=code_block_11)
code_block_12 = CodeBlock(e=all_elements_of_type_2) { e.Name; "Tag"; true; }
contains_3 = String.Contains(string=code_block_12.out0, searchFor=code_block_12.out1, ignoreCase=code_block_12.out2)
filterByBoolMask_3 = List.FilterByBoolMask(list=all_elements_of_type_2, mask=contains_3)
code_block_13 = CodeBlock(e=filterByBoolMask_3.in) { e.Name; "Floor"; true; }
contains_4 = String.Contains(string=code_block_13.out0, searchFor=code_block_13.out1, ignoreCase=code_block_13.out2)
filterByBoolMask_4 = List.FilterByBoolMask(list=filterByBoolMask_3.in, mask=contains_4)
name_2 = Family.Name(family=filterByBoolMask_4.in)
types_2 = Family.Types(family=filterByBoolMask_4.in)
code_block_14 = CodeBlock(tp=types_2) { tp.Name; }
count_2 = List.Count(list=code_block_14@L2)
ofRepeatedItem_2 = List.OfRepeatedItem(item=name_2, amount=count_2, lacing=Shortest)
code_block_15 = CodeBlock(famName=ofRepeatedItem_2, typeName=code_block_14) { famName+" - "+typeName; "Select floor tag type"; }
flatten_3 = List.Flatten(list=code_block_15.out0)
flatten_4 = List.Flatten(list=types_2)
dropdown_data_2 = Custom[DropDown Data](InputName=code_block_15.out1, Keys=flatten_3, Values=flatten_4)

# group: Input
code_block_16 = CodeBlock { "Select spacing between material tags"; 30; 200; 60; 5; }
slider = Custom[Slider](InputName=code_block_16.out0, Minimum=code_block_16.out1, Maximum=code_block_16.out2, Default_Value=code_block_16.out3, Step=code_block_16.out4)  # package Data-Shapes; Creates slider input for UI.MultipleInputForm ++ . Set the step to decimal value if you want a double slider, or to a integer value if you want an integer slider.

# group: Input
code_block_17 = CodeBlock { "Generate dimensions"; true; }
boolean_input = Custom[Boolean input](InputName=code_block_17.out0, DefaultValue=code_block_17.out1)  # package Data-Shapes; Creates a boolean input for UI.MultipleInputForm ++ . Check out www.data-shapes.net for more infos!

# group: Input
code_block_18 = CodeBlock { "Include walls from linked models ?"; true; }
boolean_input_2 = Custom[Boolean input](InputName=code_block_18.out0)

# group: Input
code_block_19 = CodeBlock { "Place on sheets"; true; }
boolean_input_3 = Custom[Boolean input](InputName=code_block_19.out0)

# group: Input
code_block_20 = CodeBlock { "Enter first sheet number (must have a value)"; "9030"; true; }
textbox_data_3 = Custom[TextBox Data](InputName=code_block_20.out0, DefaultText=code_block_20.out1)

# group: Filtering
code_block_21 = CodeBlock { catV=Revit.Category.ByName("Views"); allV=ElementQueries.OfCategory(catV); }
isViewTemplate = View.IsViewTemplate(view=code_block_21.allV)
code_block_22 = CodeBlock(value=isViewTemplate) { value==null?false:value; }
filterByBoolMask_5 = List.FilterByBoolMask(list=code_block_21.allV, mask=code_block_22)
code_block_23 = CodeBlock(vt=filterByBoolMask_5.in) { vt.Name; "Assign View Template (optional)"; }
dropdown_data_3 = Custom[DropDown Data](InputName=code_block_23.out1, Keys=code_block_23.out0, Values=filterByBoolMask_5.in)

list_create = List.Create(item0=textnote_data, item1=textbox_data, item2=textbox_data_2, item3=dropdown_data, item4=dropdown_data_2, item5=slider, item6=boolean_input, item7=boolean_input_2, item8=boolean_input_3, item9=textbox_data_3, item10=dropdown_data_3)
multipleinputform = Custom[MultipleInputForm ++](Logo_optional=readFromFile, ButtonText_optional=code_block_2.out1, Inputs=list_create, Toggle=code_block_2.out0, CancelButtonText_optional=code_block_2.out2, Width_optional=code_block_2.out4, LabelWidth_optional=code_block_2.out5)  # package Data-Shapes; Create a form with multiple inputs. see www.data-shapes.net for tutorials and infos!

# group: Control
end = Revit.Transaction.Transaction.End(input=multipleinputform.User_Inputs)
start = Revit.Transaction.Transaction.Start(input=end)

# group: Input
code_block_24 = CodeBlock { true; Revit.Category.ByName("Lines"); }
await_ = Orchid.Common.DataStream.Await(pass=code_block_24.out0, waitFor=start)
await_2 = Orchid.Common.DataStream.Await(pass=code_block_24.out1, waitFor=start)
ʳʰʸᵗʰᵐ_selection_pick = Rhythm.Revit.Selection.Selection.Pick(runIt=await_, category=await_2, singleSelection=await_)

# group: Visualisation
geometry = Element.Geometry(element=ʳʰʸᵗʰᵐ_selection_pick)
startPoint = Curve.StartPoint(curve=geometry)

# group: Filtering
code_block_25 = CodeBlock { 400; -300; }
# note: Locate -1 point for the walls
translate = Geometry.Translate(geometry=startPoint, xTranslation=code_block_25.out0, yTranslation=code_block_25.out1)

# group: Processing
all_elements_in_active_view = ElementsInView()
getCategory = Element.GetCategory(element=all_elements_in_active_view)
name_3 = Category.Name(category=getCategory)
code_block_26 = CodeBlock(value=name_3) { value=="Floors"; }
# note: Collect the types of all floors already existing in the view
filterByBoolMask_6 = List.FilterByBoolMask(list=all_elements_in_active_view, mask=code_block_26)
type = archilab.Revit.Elements.Elements.Type(element=filterByBoolMask_6.in)

# group: Processing
code_block_27 = CodeBlock { catF=Revit.Category.ByName("Floors"); allF=ElementQueries.OfCategory(catF); }
type_2 = archilab.Revit.Elements.Elements.Type(element=code_block_27.allF)
# note: Collect all wall types in model
uniqueItems = List.UniqueItems(list=type_2)
clear_list = Custom[Clear List](input=uniqueItems)  # package archi-lab.net; This node will remove all Null and Empty Lists from any list.

# group: Input
code_block_28 = CodeBlock(x=multipleinputform.User_Inputs)
# ---------- code_block_28.designscript (11 lines) ----------
line=x[0];
parameterName=x[0];
parameterValue=x[1];
materialTag=x[2];
floorTag=x[3];
tagSpacing=x[4];
withDimensions=x[5];
includeLinked=x[6];
placeOnSheets=x[7];
firstSheet=x[8];
template=x[9];
# ----------------------------------------

# group: Filtering
getParameterValueByName = Element.GetParameterValueByName(element=clear_list, parameterName=code_block_28.parameterName)
# note: Filter floor types by certain parameter
contains_5 = String.Contains(string=getParameterValueByName, searchFor=code_block_28.parameterValue)
filterByBoolMask_7 = List.FilterByBoolMask(list=clear_list, mask=contains_5)

# group: Control
# note: Check if the floor types are not already existing in the view
setDifference = List.SetDifference(list1=filterByBoolMask_7.in, list2=filterByBoolMask_6.in)

# group: Control
isEmpty = List.IsEmpty(list=type)
runMe = Custom[Tool.RunMe](Boolean=isEmpty, ThingToDo=filterByBoolMask_7.in)  # package SteamNodes; Use Boolean to perform an action
not_ = Not(x=isEmpty)
runMe_2 = Custom[Tool.RunMe](Boolean=not_, ThingToDo=setDifference)
list_create_2 = List.Create(item0=runMe, item1=runMe_2)
flatten_5 = List.Flatten(list=list_create_2)
code_block_29 = CodeBlock(value=flatten_5) { value==0; }
filterByBoolMask_8 = List.FilterByBoolMask(list=flatten_5, mask=code_block_29)

# group: Control
code_block_30 = CodeBlock { "Type Mark"; }
# note: Sort floor types by Type Mark value
getParameterValueByName_2 = Element.GetParameterValueByName(element=filterByBoolMask_8.out, parameterName=code_block_30)
sortByKey = List.SortByKey(list=filterByBoolMask_8.out, keys=getParameterValueByName_2)

# group: Processing
getDocuments = archilab.Revit.Selection.Select.GetDocuments()
code_block_31 = CodeBlock { catW=Revit.Category.ByName("Floors"); }
runMe_3 = Custom[Tool.RunMe](Boolean=code_block_28.includeLinked, ThingToDo=code_block_31)
getFromLinkedFile = Custom[Element.GetFromLinkedFile](LinkInstance=getDocuments.Link_Instance@L1, LinkDocument=getDocuments.Link_Doc@L1, Category=runMe_3)  # package SteamNodes; Get elements from link document instance based on category
flatten_6 = List.Flatten(list=getFromLinkedFile)
elementTypes = Custom[ElementTypes+](element=flatten_6)  # Gets types from linked elements too. From Clockworks
# note: Add elements from input category in linked RVT instances
uniqueItems_2 = List.UniqueItems(list=elementTypes)
# note: Collect all wall types in linked model
clear_list_2 = Custom[Clear List](input=uniqueItems_2)

# group: Processing
code_block_32 = CodeBlock { DSCore.Types.FindTypeByNameInAssembly("FloorType","RevitAPI"); }
all_elements_of_type_3 = ElementsOfType(element_type=code_block_32)
code_block_33 = CodeBlock(fTypes=all_elements_of_type_3) { fTypes.Name; }
code_block_34 = CodeBlock(fTypes=clear_list_2) { fTypes.Name; }

# group: Filtering
# note: Filter the wall types in the host model that match the wall types in the linked model (match by type name)
eq = code_block_33 == code_block_34  # lacing=CrossProduct
anyTrue = Orchid.Common.List.AnyTrue(list=eq@L2)
filterByBoolMask_9 = List.FilterByBoolMask(list=all_elements_of_type_3, mask=anyTrue)

# group: Filtering
code_block_35 = CodeBlock(fTypes=filterByBoolMask_9.in) { fTypes.Name; }
# note: Filter the wall types in the host model that match the wall types in the linked model (match by type name)
eq_2 = code_block_34 == code_block_35  # lacing=CrossProduct
anyTrue_2 = Orchid.Common.List.AnyTrue(list=eq_2@L2)
filterByBoolMask_10 = List.FilterByBoolMask(list=clear_list_2, mask=anyTrue_2)

# group: Control
# note: Sort walls by type name
code_block_36 = CodeBlock(fTypes=filterByBoolMask_9.in) { fTypes.Name; }
sortByKey_2 = List.SortByKey(list=filterByBoolMask_9.in, keys=code_block_36)
code_block_37 = CodeBlock(fTypes=filterByBoolMask_10.in) { fTypes.Name; "Type Mark"; }
sortByKey_3 = List.SortByKey(list=filterByBoolMask_10.in, keys=code_block_37.out0)
getParameterValueByName_3 = Element.GetParameterValueByName(element=sortByKey_3.sortedList, parameterName=code_block_37.out1)
setParameterByName = Element.SetParameterByName(element=sortByKey_2.sortedList, parameterName=code_block_37.out1, value=getParameterValueByName_3)

# group: Filtering
getParameterValueByName_4 = Element.GetParameterValueByName(element=setParameterByName, parameterName=code_block_28.parameterName)
# note: Filter wall types by certain parameter
contains_6 = String.Contains(string=getParameterValueByName_4, searchFor=code_block_28.parameterValue)
filterByBoolMask_11 = List.FilterByBoolMask(list=setParameterByName, mask=contains_6)

code_block_38 = CodeBlock(existingWType=type, newWType=filterByBoolMask_11.in) { existingWType.Name; newWType.Name; }

# group: Control
eq_3 = code_block_38.out0 == code_block_38.out1  # lacing=CrossProduct
# note: Check if the walls types are not already existing in the view
transpose = List.Transpose(lists=eq_3)
anyTrue_3 = Orchid.Common.List.AnyTrue(list=transpose@@L2)
filterByBoolMask_12 = List.FilterByBoolMask(list=filterByBoolMask_11.in, mask=anyTrue_3)

count_3 = List.Count(list=filterByBoolMask_12.out)

# group: Processing
lastItem = List.LastItem(list=clear_list)
ofRepeatedItem_3 = List.OfRepeatedItem(item=lastItem, amount=count_3)
# note: Create placeholders walls for linked types
list_create_3 = List.Create(item0=sortByKey.sortedList, item1=ofRepeatedItem_3)
flatten_7 = List.Flatten(list=list_create_3)

# group: Processing
count_4 = List.Count(list=flatten_7)
code_block_39 = CodeBlock(count=count_4) { rows=count/4; rowsTotal=DSCore.Math.Ceiling(rows); leftover=(rowsTotal*4-count)*-1; }
X = Point.X(point=translate)
code_block_40 = CodeBlock(rowsTotal=code_block_39.rowsTotal) { (0..3)*1750; (0..(rowsTotal-1))*1350; }
add = X + code_block_40.out0  # lacing=Longest
Y = Point.Y(point=translate)
sub = Y - code_block_40.out1  # lacing=Longest
Z = Point.Z(point=translate)
byCoordinates = Point.ByCoordinates(x=add, y=sub, z=Z, lacing=CrossProduct)
flatten_8 = List.Flatten(list=byCoordinates)
Y_2 = Point.Y()  # unwired: point
groupByFunction = List.GroupByFunction(list=flatten_8, groupFunction=Y_2)
X_2 = Point.X()  # unwired: point
sortByFunction = List.SortByFunction(list=groupByFunction@L2, sortFunction=X_2)
flatten_9 = List.Flatten(list=sortByFunction)
# note: Generate starting points for the FLOOR instances
dropItems = List.DropItems(list=flatten_9, amount=code_block_39.leftover)

# group: Processing
X_3 = Point.X(point=translate)
code_block_41 = CodeBlock(rowsTotal=code_block_39.rowsTotal) { 6450; (0..(rowsTotal-1))*1350; }
add_2 = X_3 + code_block_41.out0  # lacing=Longest
Y_3 = Point.Y(point=translate)
sub_2 = Y_3 - code_block_41.out1  # lacing=Longest
Z_2 = Point.Z(point=translate)
byCoordinates_2 = Point.ByCoordinates(x=add_2, y=sub_2, z=Z_2, lacing=CrossProduct)
flatten_10 = List.Flatten(list=byCoordinates_2)
code_block_42 = CodeBlock { width=-6450; -200; }
translate_2 = Geometry.Translate(geometry=flatten_10, xTranslation=code_block_42.width)
# note: Generate points for the large rectangles to create sections from
translate_3 = Geometry.Translate(geometry=flatten_10, xTranslation=code_block_42.width, yTranslation=code_block_42.out1)
translate_4 = Geometry.Translate(geometry=flatten_10, yTranslation=code_block_42.out1)
list_create_4 = List.Create(item0=flatten_10, item1=translate_2, item2=translate_3, item3=translate_4)
transpose_2 = List.Transpose(lists=list_create_4)
byCornerPoints = Rectangle.ByCornerPoints(points=transpose_2)

# group: Visualisation
patch = Curve.Patch(curve=byCornerPoints)
code_block_43 = CodeBlock { -1000; false; }
thicken = Surface.Thicken(surface=patch, thickness=code_block_43.out0, both_sides=code_block_43.out1)

# group: Processing
code_block_44 = CodeBlock(els=thicken) { count=DSCore.List.Count(els); number=1..count; "temp-"+number+"_Section"; }
# note: Generate temp names for the views. In case there is bad element which will not generate views
code_block_45 = CodeBlock(number=code_block_44.number) { "temp-"+number+"_Section"; }

# group: Visualisation
# note: CREATE SECTIONS
createGeometryView = Custom[CreateGeometryView](Xvector=reverse, Yvector=ZAxis, CropRegionOffset=code_block.out1, ViewDepth=code_block.out0, CSPoint=flatten_10, Viewname=code_block_45, Geometry=thicken)  # Modified from Create Element View in the BIM4Struc package

# group: Processing
toNumber = String.ToNumber(string=code_block_28.firstSheet)
code_block_46 = CodeBlock(slds=thicken, firstSheet=toNumber)
# ---------- code_block_46.designscript (3 lines) ----------
solids=DSCore.List.Count(slds);
numbOfSheets=DSCore.Math.Ceiling(solids/2);
sheetNumbs=firstSheet..(firstSheet+numbOfSheets-1);
# ----------------------------------------
string_from_object = FromObject(obj=code_block_46.sheetNumbs)
code_block_47 = CodeBlock { catS=Revit.Category.ByName("Sheets"); allS=ElementQueries.OfCategory(catS); }
sheetNumber = Sheet.SheetNumber(sheet=code_block_47.allS)
# note: select sheets on which to place the views.
toNumber_2 = String.ToNumber(string=sheetNumber)
eq_4 = toNumber_2 == code_block_46.sheetNumbs  # lacing=CrossProduct
anyTrue_4 = Orchid.Common.List.AnyTrue(list=eq_4)
filterByBoolMask_13 = List.FilterByBoolMask(list=code_block_47.allS, mask=anyTrue_4)
sheetNumber_2 = Sheet.SheetNumber()  # unwired: sheet
sortByFunction_2 = List.SortByFunction(list=filterByBoolMask_13.in, sortFunction=sheetNumber_2)

# group: Processing
code_block_48 = CodeBlock { 2; 1..2; }
chop = List.Chop(list=code_block_45, lengths=code_block_48.out0)
count_5 = List.Count(list=chop)
ofRepeatedItem_4 = List.OfRepeatedItem(item=string_from_object@@L1, amount=count_5)
flatten_11 = List.Flatten(list=ofRepeatedItem_4)
ofRepeatedItem_5 = List.OfRepeatedItem(item=code_block_48.out1, amount=count_5)
flatten_12 = List.Flatten(list=ofRepeatedItem_5)
# note: Generate name for each view of the input elements. When on Sheets
code_block_49 = CodeBlock(sheetNumber=flatten_11, count=flatten_12) { sheetNumber+"-XX-FloorSpecSection_0"+count; }
code_block_50 = CodeBlock(sec=code_block_45, sheets=count_5) { views=DSCore.List.Count(sec); sheets*2-views; 0; -1; }
code_block_51 = CodeBlock(value=code_block_50.out1, a=code_block_50.out3, b=code_block_50.out2) { value==1?a:b; }
dropItems_2 = List.DropItems(list=code_block_49, amount=code_block_51)

# group: Control
isNull = Object.IsNull(object=createGeometryView)
filterByBoolMask_14 = List.FilterByBoolMask(list=createGeometryView, mask=isNull)
filterByBoolMask_15 = List.FilterByBoolMask(list=dropItems_2, mask=isNull)

# group: Visualisation
# note: SET PROPER NAME OF VIEWS
acg_element_setname = Custom[ACG Element.SetName](element=filterByBoolMask_14.out, name=filterByBoolMask_15.out)

# group: Assing
code_block_52 = CodeBlock { 10; }
# note: VIEW SCALE
setScale = View.SetScale(view=acg_element_setname.element, scale=code_block_52)

code_block_53 = CodeBlock { width=1200; lengthFixed=-200; }

# group: Processing
translate_5 = Geometry.Translate(geometry=dropItems, xTranslation=code_block_53.width)
# note: Generate points for the rectangles
translate_6 = Geometry.Translate(geometry=dropItems, xTranslation=code_block_53.width, yTranslation=code_block_53.lengthFixed)
translate_7 = Geometry.Translate(geometry=dropItems, yTranslation=code_block_53.lengthFixed)
list_create_5 = List.Create(item0=dropItems, item1=translate_5, item2=translate_6, item3=translate_7)
transpose_3 = List.Transpose(lists=list_create_5)
byCornerPoints_2 = Rectangle.ByCornerPoints(points=transpose_3)

# group: Input
current = Document.Current()
activeView = Document.ActiveView(document=current)
code_block_54 = CodeBlock { "Associated Level"; }
getParameterValueByName_5 = Element.GetParameterValueByName(element=activeView, parameterName=code_block_54)
getLevelByName = archilab.Revit.Selection.Select.GetLevelByName(name=getParameterValueByName_5)

# group: Visualisation
curves = PolyCurve.Curves(polyCurve=byCornerPoints_2)
byOutlineTypeAndLevel = Floor.ByOutlineTypeAndLevel(outline=curves, floorType=flatten_7, level=getLevelByName)

end_2 = Revit.Transaction.Transaction.End(input=byOutlineTypeAndLevel)

# group: Control
code_block_55 = CodeBlock { "Type Mark"; }
# note: Sort walls by type mark value
getParameterValueByName_6 = Element.GetParameterValueByName(element=filterByBoolMask_12.out, parameterName=code_block_55)
sortByKey_4 = List.SortByKey(list=filterByBoolMask_12.out, keys=getParameterValueByName_6)

# group: Control - replace placeholder's wall type with wall type from linked model
count_6 = List.Count(list=end_2)
# note: Collect placeholder walls
code_block_56 = CodeBlock(countAll=count_6, countLinked=count_3) { countNative=countAll-countLinked; countNative..(countAll-1); }
getItemAtIndex = List.GetItemAtIndex(list=end_2, index=code_block_56.out1)
code_block_57 = CodeBlock { "Type"; }
setParameterByName_2 = Element.SetParameterByName(element=getItemAtIndex, parameterName=code_block_57, value=sortByKey_4.sortedList, lacing=Longest)

await_3 = Orchid.Common.DataStream.Await(pass=end_2, waitFor=setParameterByName_2)

# group: Visualisation
# note: Elements
code_block_58 = CodeBlock(countLinked=count_3, a=end_2, b=await_3) { countLinked==00?a:b; }

# group: Control
end_3 = Revit.Transaction.Transaction.End(input=code_block_58)

# group: Processing
# note: length of line(s)
code_block_59 = CodeBlock(originPoint=dropItems) { originPoint; -75; }
# note: Create detail lines for dimensioning
translate_8 = Geometry.Translate(geometry=code_block_59.originPoint, xTranslation=code_block_59.out1)

# group: Control
runMe_4 = Custom[Tool.RunMe](Boolean=code_block_28.withDimensions, ThingToDo=end_3)

# group: Processing
type_3 = archilab.Revit.Elements.Elements.Type(element=runMe_4)
compoundStructureLayers = Custom[Element.CompoundStructureLayers](elementsType=type_3)  # From Clockworks. Widths not working in mm

# group: Control
code_block_60 = CodeBlock(value=compoundStructureLayers.widths) { value==0?null:value; }
# note: remove any 0 layers
clear_list_3 = Custom[Clear List](input=code_block_60)

# group: Processing
code_block_61 = CodeBlock { 0; }
count_7 = List.Count(list=clear_list_3@@L2)
code_block_62 = CodeBlock(count=count_7) { 1..count; }
# note: Create offset distances for the detail lines
slice = List.Slice(list=clear_list_3@L2, start=code_block_61, end=code_block_62@L2)
sum = Math.Sum(values=slice)
code_block_63 = CodeBlock(sum=sum) { sum*(-1); }

# group: Processing
list_create_6 = List.Create(item0=code_block_59.originPoint, item1=translate_8)
transpose_4 = List.Transpose(lists=list_create_6)
byPoints = PolyCurve.ByPoints(points=transpose_4)
curves_2 = PolyCurve.Curves(polyCurve=byPoints)
flatten_13 = List.Flatten(list=curves_2)
# note: duplicate the lines
translate_9 = Geometry.Translate(geometry=flatten_13, zTranslation=code_block_63)
addItemToFront = List.AddItemToFront(item=flatten_13@@L1, list=translate_9@L2)

# group: Processing
code_block_64 = CodeBlock(view=setScale) { view; 4; }
ofRepeatedItem_6 = List.OfRepeatedItem(item=code_block_64.view@@L1, amount=code_block_64.out1)
code_block_65 = CodeBlock(views=ofRepeatedItem_6, els=end_3)
# ---------- code_block_65.designscript (4 lines) ----------
flatViews=DSCore.List.Flatten(views);
calcViews=DSCore.List.Count(flatViews);
numEl=DSCore.List.Count(els);
drop=(calcViews-numEl)*-1;
# ----------------------------------------
dropItems_3 = List.DropItems(list=code_block_65.flatViews, amount=code_block_65.drop)
list_create_7 = List.Create(item0=dropItems_3)
transpose_5 = List.Transpose(lists=list_create_7)
startPoint_2 = Curve.StartPoint(curve=translate_9)
code_block_66 = CodeBlock(wdth=code_block_53.width) { 5; wdth/2; }
translate_10 = Geometry.Translate(geometry=startPoint_2, xTranslation=code_block_66.out1, zTranslation=code_block_66.out0)
code_block_67 = CodeBlock(location=translate_10) { location; }
count_8 = List.Count(list=code_block_67@L2)
ofRepeatedItem_7 = List.OfRepeatedItem(item=transpose_5@L2, amount=count_8@L1)
flatten_14 = List.Flatten()  # unwired: list
map = List.Map(list=ofRepeatedItem_7, f_x=flatten_14)
list_create_8 = List.Create(item0=end_3)
transpose_6 = List.Transpose(lists=list_create_8)

# group: Visualisation
code_block_68 = CodeBlock { true; }
create_tag = Custom[Create Tag](view=map@L2, element=transpose_6@L2, TagLocation=code_block_67@L2, TagType=code_block_28.materialTag, RunIt=code_block_68)  # package Genius Loci; Works only in Revit 2018 and later. Creates a tag at a given location, of given type and in a supplied view. The node also works with Linked Elements (except space and area), Multi Category tag and Material Tag. Based on an archilab node

# group: Assing
code_block_69 = CodeBlock { "Leader Line"; 1; }
setParameterByName_3 = Element.SetParameterByName(element=create_tag, parameterName=code_block_69.out0, value=code_block_69.out1)

# group: Control
end_4 = Revit.Transaction.Transaction.End(input=setParameterByName_3)

# group: Processing
startPoint_3 = Curve.StartPoint(curve=flatten_13)
count_9 = List.Count(list=map@L2)
code_block_70 = CodeBlock(numb=count_9, tagSpacing=code_block_28.tagSpacing) { 90+((1..numb)*tagSpacing); }
translate_11 = Geometry.Translate(geometry=startPoint_3, xTranslation=code_block_66.out1, zTranslation=code_block_70)

# group: Assing
flatten_15 = List.Flatten(list=end_4)
flatten_16 = List.Flatten(list=translate_11)
tag_setlocation = Custom[Tag SetLocation](tag=flatten_15, location=flatten_16)  # package Genius Loci; Moves the head of the tag to the given location point.

# group: Visualisation
# note: create dimensions
byCurve = ModelCurve.ByCurve(curve=addItemToFront)
code_block_71 = CodeBlock { 4; }
chop_2 = List.Chop(list=byCurve, lengths=code_block_71)
end_5 = Revit.Transaction.Transaction.End(input=chop_2)
byElements = Dimension.ByElements(view=setScale@@L1, referenceElements=end_5@L3)

# group: Assing
list_create_9 = List.Create(item0=end_2, item1=byCurve)
flatten_17 = List.Flatten(list=list_create_9)
code_block_72 = CodeBlock { "Phase Created"; "Phase Demolished"; "Library"; "Existing"; }
getPhaseByName = Custom[Tool.GetPhaseByName](PhaseName=code_block_72.out3)  # package SteamNodes; Get Document Phases by String
getPhaseByName_2 = Custom[Tool.GetPhaseByName](PhaseName=code_block_72.out2)
setParameterByName_4 = Element.SetParameterByName(element=flatten_17, parameterName=code_block_72.out0, value=getPhaseByName_2.Phase, lacing=Longest)
# note: Assign Phases
await_4 = Orchid.Common.DataStream.Await(pass=getPhaseByName.Phase, waitFor=setParameterByName_4)
setParameterByName_5 = Element.SetParameterByName(element=flatten_17, parameterName=code_block_72.out1, value=await_4, lacing=Longest)

# group: Processing
code_block_73 = CodeBlock(views=createGeometryView) { views; }
list_create_10 = List.Create(item0=dropItems, item1=translate_7)
transpose_7 = List.Transpose(lists=list_create_10)
byPoints_2 = PolyCurve.ByPoints(points=transpose_7)
code_block_74 = CodeBlock { 0.5; true; }
# note: points for Super Tag
pointAtParameter = Curve.PointAtParameter(curve=byPoints_2, param=code_block_74.out0)

# group: Visualisation
create_tag_2 = Custom[Create Tag](view=code_block_73, element=end_3, TagLocation=pointAtParameter, TagType=code_block_28.floorTag, RunIt=code_block_74.out1)

# group: Control
code_block_75 = CodeBlock { "Views - Generate Spec Views - Floors"; }
acg_script_usage = Custom[ACG Script Usage](scriptName=code_block_75)  # Adds an entry to Excel document every time a script is run. The document is located in S:\Dynamo\05-UsageStats

# group: Control
runMe_5 = Custom[Tool.RunMe](Boolean=code_block_28.placeOnSheets, ThingToDo=setScale)

# group: Processing
code_block_76 = CodeBlock { 2; 1.805; 0.93; 0; }
byCoordinates_3 = Point.ByCoordinates(x=code_block_76.out0, y=code_block_76.out1, z=code_block_76.out3)
byCoordinates_4 = Point.ByCoordinates(x=code_block_76.out0, y=code_block_76.out2, z=code_block_76.out3)
list_create_11 = List.Create(item0=byCoordinates_3, item1=byCoordinates_4)
flatten_18 = List.Flatten(list=list_create_11)
ofRepeatedItem_8 = List.OfRepeatedItem(item=flatten_18, amount=count_5)
flatten_19 = List.Flatten(list=ofRepeatedItem_8)
dropItems_4 = List.DropItems(list=flatten_19, amount=code_block_51)

# group: Assing
code_block_77 = CodeBlock { 2; }
chop_3 = List.Chop(list=runMe_5, lengths=code_block_77)
code_block_78 = CodeBlock(e=chop_3) { e.Id; }
element_by_id = ElementById(Id=code_block_78)
chop_4 = List.Chop(list=dropItems_4, lengths=code_block_77)
code_block_79 = CodeBlock { true; }
RIE_PlaceViewOnSheet = Custom[RIE_PlaceViewOnSheet](view_Schedule_Legend=element_by_id@L2, sheet=sortByFunction_2@@L1, point=chop_4@L2, refresh=code_block_79)  # package RIE; Places Views, Schedules or Legends into sheets.
firstItem = List.FirstItem(list=RIE_PlaceViewOnSheet.Placed@L2)

# group: Assing
await_5 = Orchid.Common.DataStream.Await(pass=setScale, waitFor=RIE_PlaceViewOnSheet.Placed)
# note: Assign template to the views
set = Orchid.RevitProject.Views.ViewTemplate.Set(view=await_5, viewTemplate=code_block_28.template)

# group: Assing
code_block_80 = CodeBlock { "Hide at scales coarser than"; 20; }
setParameterByName_6 = Element.SetParameterByName(element=setScale, parameterName=code_block_80.out0, value=code_block_80.out1)

# group: Control
flatten_20 = List.Flatten(list=firstItem)
clear_list_4 = Custom[Clear List](input=flatten_20)

# group: Assing
code_block_81 = CodeBlock(input=clear_list_4) { "ELEM_TYPE_PARAM"; DSCore.List.Count(input); }
id = Element.Id()  # unwired: element
ofRepeatedItem_9 = List.OfRepeatedItem(item=id, amount=code_block_81.out1)
set_builtin_parameter = Custom[Set BuiltIn Parameter](parameterName=code_block_81.out0, elements=clear_list_4, parameterValues=ofRepeatedItem_9)  # package archi-lab.net; This node will take an input of a built in parameter name and set that parameter to given value for given elements.

watch = Watch(multipleinputform.User_Inputs)
