# Dynamo graph Create Legend From TXT.dyn "Views - Generate Legend From TXT_py" (Dynamo 2.12.1.8246)
# packages: Data-Shapes 2021.2.92

# group: Control
code_block = CodeBlock { "Views - Generate Legend From TXT"; }
acg_script_usage = Custom[ACG Script Usage](scriptName=code_block)  # Adds an entry to Excel document every time a script is run. The document is located in S:\Dynamo\05-UsageStats

# group: Input
file_path = Filename("..\ACG_logo.png")
file_from_path = FileObject(path=file_path)
readFromFile = Image.ReadFromFile(file=file_from_path)
code_block_2 = CodeBlock { "Select Category"; true; "Apply"; "Cancel"; false; 700; 250; }
code_block_3 = CodeBlock { "Note:"; }
string = StringInput("""This tool will apply Comment values to Filler Regions in the active Legend view.
Please make sure the number of Filled Region elements is equal or greater that the number of elements in the .txt file. """)
textnote_data = Custom[TextNote Data](Title=code_block_3, TextNote=string)  # package Data-Shapes; Create Data for TextNote input in UI.MultipleInputForm ++ . Check out www.data-shapes.net for more informations
code_block_4 = CodeBlock { "Navigate to .csv file:"; }
filepath_data = Custom[FilePath Data](InputName=code_block_4)  # package Data-Shapes; Create filepath input for UI.MultipleInputForm ++ . Check out www.data-shapes.net for more infos !
list_create = List.Create(item0=textnote_data, item1=filepath_data)

multipleinputform = Custom[MultipleInputForm ++](Logo_optional=readFromFile, ButtonText_optional=code_block_2.out2, Inputs=list_create, Toggle=code_block_2.out1, CancelButtonText_optional=code_block_2.out3, Width_optional=code_block_2.out5, LabelWidth_optional=code_block_2.out6)  # package Data-Shapes; Create a form with multiple inputs. see www.data-shapes.net for tutorials and infos!
code_block_5 = CodeBlock(x=multipleinputform.User_Inputs) { filePath = x[0]; }

# group: Visualisation
python_script = Python(IN[0]=multipleinputform.Was_Cancelled, IN[1]=code_block_5)  # IronPython2
# ---------- python_script.python (58 lines) ----------
# Load the Python Standard and DesignScript Libraries
import clr
import sys
sys.path.append('C:\Program Files (x86)\IronPython 2.7\Lib')
import System
from System import Array
from System.Collections.Generic import *
clr.AddReference('ProtoGeometry')
from Autodesk.DesignScript.Geometry import *
clr.AddReference("RevitNodes")
import Revit
clr.ImportExtensions(Revit.Elements)
clr.ImportExtensions(Revit.GeometryConversion)
clr.AddReference("RevitServices")
import RevitServices
from RevitServices.Persistence import DocumentManager 
from RevitServices.Transactions import TransactionManager 

clr.AddReference("RevitAPI")
clr.AddReference("RevitAPIUI")

import Autodesk 
from Autodesk.Revit.DB import *
from Autodesk.Revit.UI import *

doc = DocumentManager.Instance.CurrentDBDocument
uiapp = DocumentManager.Instance.CurrentUIApplication 
app = uiapp.Application 
uidoc = uiapp.ActiveUIDocument

hosts = []
hostFRs = []
doorFRs =[]

cancelled = IN[0]
path = IN[1]

# read the data from the TXT file as a list
file = open(path, 'r')
data = [l.rstrip() for l in file]
count = data.pop()
values = data[0].split(',')

# get all Filled Regions in the active view
view = doc.ActiveView
fRegions = FilteredElementCollector(doc, view.Id).OfClass(FilledRegion).ToElements()

def assignComments(fRegion, value):
	fRegion.LookupParameter('Comments').Set(value)

TransactionManager.Instance.EnsureInTransaction(doc)
for fRegion, value in zip(fRegions, values):
	try:
		fRegion.LookupParameter('Comments').Set(value)
	except:
		continue
TransactionManager.Instance.TransactionTaskDone()
OUT = fRegions
# ----------------------------------------
