# Dynamo graph Create Unit Types Views.dyn "Views - Generate From Unit Types" (Dynamo 2.12.0.5650)
# packages: archi-lab.net 2021.25.2521, Rhythm 2021.1.1, Data-Shapes 2021.2.92, archi-lab.net 2022.210.2522, SteamNodes 1.2.3, RIE 2020.12.2

# group: Usage
code_block = CodeBlock { "Views - Generate From Unit Types"; }
acg_script_usage = Custom[ACG Script Usage](scriptName=code_block)  # Adds an entry to Excel document every time a script is run. The document is located in S:\Dynamo\05-UsageStats

file_path = Filename("..\ACG_logo.png")
file_from_path = FileObject(path=file_path)
readFromFile = Image.ReadFromFile(file=file_from_path)
code_block_2 = CodeBlock { "Cancel"; true; "Generate Views"; 700; 350; }
code_block_3 = CodeBlock { "Warning:"; true; }
string = StringInput("""This tool will create Floor Plan, RCP and four Elevation views for each type of room. Rooms types are defined by their Name. Users can choose which room types to use for generating theviews.

Unless specified in the applied View Template, all views will be placed under 01 - WIP / A-5700 - Unit Types in the Project Browser.

Please make sure there is atleast one elevation view in the model.

For more information, please refer to the Revit Tutorials channel in MS Stream.
""")
ui_textnote_data = Custom[UI.TextNote Data](Title=code_block_3.out0, TextNote=string)  # package Data-Shapes; Create Data for TextNote input in UI.MultipleInputForm ++ . Check out www.data-shapes.net for more informations
code_block_4 = CodeBlock { "Select Room type."; "Select Elevation type."; "Select scale"; "Select View Template (optional)"; }

# group: Input
code_block_5 = CodeBlock { catR=Revit.Category.ByName("Rooms"); allR=ElementQueries.OfCategory(catR); allR.Name; }
sortByKey = List.SortByKey(list=code_block_5.allR, keys=code_block_5.out2)
code_block_6 = CodeBlock(e=sortByKey.sortedList) { e.Name; }

# group: Control
code_block_7 = CodeBlock(rName=code_block_6) { rName==""; }
# note: Check if views have name or empty string ""
filterByBoolMask = List.FilterByBoolMask(list=sortByKey.sortedList, mask=code_block_7)
filterByBoolMask_2 = List.FilterByBoolMask(list=code_block_6, mask=code_block_7)

# group: Input
groupByKey = List.GroupByKey(list=filterByBoolMask.out, keys=filterByBoolMask_2.out)
# note: Target Rooms!!!
firstItem = List.FirstItem(list=groupByKey.groups@@L2)
code_block_8 = CodeBlock { false; 400; }
listview_data = Custom[Listview Data](InputName=code_block_4.out0, Keys=groupByKey.uniqueKeys, Values=firstItem, Height_optionnal=code_block_8.out1, ShowId_optionnal=code_block_8.out0)  # package Data-Shapes; Create data for ListView input in UI.MultiInputForm ++ . Check out www.data-shapes.net for more infos.

# group: Processing
code_block_9 = CodeBlock { catV=Revit.Elements.Category.ByName("Views"); ElementQueries.OfCategory(catV); }
type = archilab.Revit.Elements.Elements.Type(element=code_block_9.out1)
clear_list = Custom[Clear List](input=type)  # package archi-lab.net; This node will remove all Null and Empty Lists from any list.
uniqueItems = List.UniqueItems(list=clear_list)
name = Element.Name(element=uniqueItems)
code_block_10 = CodeBlock { "elevation"; true; }
contains = String.Contains(string=name, searchFor=code_block_10.out0, ignoreCase=code_block_10.out1)
filterByBoolMask_3 = List.FilterByBoolMask(list=uniqueItems, mask=contains)
code_block_11 = CodeBlock(e=filterByBoolMask_3.in) { 0; e.Name; }
dropdown_data = Custom[DropDown Data](InputName=code_block_4.out1, Keys=code_block_11.out1, Values=filterByBoolMask_3.in, DefaultValueIndex=code_block_11.out0)  # package Data-Shapes; Create data for DropDown input in UI.MultiInputForm ++ . Check out www.data-shapes.net for more infos.

# group: Input
code_block_12 = CodeBlock { "20"; true; }
textbox_data = Custom[TextBox Data](InputName=code_block_4.out2, DefaultText=code_block_12.out0, IsNumberEntry=code_block_12.out1)  # package Data-Shapes; Create Data for TextBox input in UI.MultipleInputForm ++ . Check out www.data-shapes.net for more informations

# group: Input
clear_list_2 = Custom[Clear List](input=code_block_9.out1)
isViewTemplate = View.IsViewTemplate(view=clear_list_2)
filterByBoolMask_4 = List.FilterByBoolMask(list=clear_list_2, mask=isViewTemplate)
code_block_13 = CodeBlock(e=filterByBoolMask_4.in) { e.Name; }
dropdown_data_2 = Custom[DropDown Data](InputName=code_block_4.out3, Keys=code_block_13, Values=filterByBoolMask_4.in)

# group: Input
code_block_14 = CodeBlock { "Generate Floor Plans."; "Generate RCPs."; "Generate Elevations."; true; }
boolean_input = Custom[Boolean input](InputName=code_block_14.out0, DefaultValue=code_block_14.out3)  # package Data-Shapes; Creates a boolean input for UI.MultipleInputForm ++ . Check out www.data-shapes.net for more infos!
boolean_input_2 = Custom[Boolean input](InputName=code_block_14.out1, DefaultValue=code_block_14.out3)
boolean_input_3 = Custom[Boolean input](InputName=code_block_14.out2, DefaultValue=code_block_14.out3)

list_create = List.Create(item0=ui_textnote_data, item1=listview_data, item2=dropdown_data, item3=textbox_data, item4=dropdown_data_2, item5=boolean_input, item6=boolean_input_2, item7=boolean_input_3)
flatten = List.Flatten(list=list_create)
multipleinputform = Custom[MultipleInputForm ++](Logo_optional=readFromFile, ButtonText_optional=code_block_2.out2, Inputs=flatten, Toggle=code_block_2.out1, CancelButtonText_optional=code_block_2.out0, Width_optional=code_block_2.out3, LabelWidth_optional=code_block_2.out4)  # package Data-Shapes; Create a form with multiple inputs. see www.data-shapes.net for tutorials and infos!
code_block_15 = CodeBlock(x=multipleinputform.User_Inputs) { rooms=x[0]; viewType=x[1]; viewScale=x[2]; viewtemplate=x[3]; runPlans=x[4]; runRCP=x[5]; runElevations=x[6]; }

# group: Control
# note: Filter only rooms that have geometry. Probably are not placed on not enclosed.
geometry = Element.Geometry(element=code_block_15.rooms)
isEmpty = List.IsEmpty(list=geometry@L2)
filterByBoolMask_5 = List.FilterByBoolMask(list=code_block_15.rooms, mask=isEmpty)

# group: Control
runMe = Custom[Tool.RunMe](Boolean=code_block_15.runRCP, ThingToDo=filterByBoolMask_5.out)  # package SteamNodes; Use Boolean to perform an action
runMe_2 = Custom[Tool.RunMe](Boolean=code_block_15.runPlans, ThingToDo=filterByBoolMask_5.out)
runMe_3 = Custom[Tool.RunMe](Boolean=code_block_15.runElevations, ThingToDo=filterByBoolMask_5.out)

# group: Visualisation
code_block_16 = CodeBlock { "RCP"; "FloorPlan"; 1; true; }
# note: Generate RCP & Floor Plans
acg_rcp_byroom = Custom[ACG RCP.ByRoom](room=runMe, prefix=code_block_16.out0, offset=code_block_16.out2, runIt=code_block_16.out3)  # from Archi-lab
code_block_17 = CodeBlock(RCP=acg_rcp_byroom) { viewsRCP=DSCore.List.Flatten(RCP); }
byRoom = Custom[FloorPlan.ByRoom](room=runMe_2, prefix=code_block_16.out1, offset=code_block_16.out2, runIt=code_block_16.out3)  # package archi-lab.net; This node takes input of a Room and creates a Floor Plan View with Crop Box set around that room.
code_block_18 = CodeBlock(FP=byRoom) { viewsFP=DSCore.List.Flatten(FP); }

code_block_19 = CodeBlock(e=filterByBoolMask_5.out) { e.Name; }

# group: Assing
# note: Generate names for the new views
code_block_20 = CodeBlock(rName=code_block_19) { "View Name"; "WIP-XX-"+rName+"_RCP"; "WIP-XX-"+rName+"_FloorPlan"; }
setParameterByName = Element.SetParameterByName(element=code_block_17, parameterName=code_block_20.out0, value=code_block_20.out1)
setParameterByName_2 = Element.SetParameterByName(element=code_block_18, parameterName=code_block_20.out0, value=code_block_20.out2)

# group: Processing
location = Room.Location(room=runMe_3)
count = List.Count(list=filterByBoolMask_5.out)
ofRepeatedItem = List.OfRepeatedItem(item=code_block_15.viewScale, amount=count)
ofRepeatedItem_2 = List.OfRepeatedItem(item=code_block_15.viewType, amount=count)
ʳʰʸᵗʰᵐ_elevationmarker = Rhythm.Revit.Elements.ElevationMarker.CreateElevationMarker(location=location@L1, scaleFactor=ofRepeatedItem@L1, viewFamilyType=ofRepeatedItem_2@L1)
code_block_21 = CodeBlock(lst=ʳʰʸᵗʰᵐ_elevationmarker) { DSCore.List.Flatten(lst); 0..3; }

# group: Visualisation
# note: Generate Elevations
ʳʰʸᵗʰᵐ_elevationmarker_2 = Rhythm.Revit.Elements.ElevationMarker.CreateElevationByMarkerIndex(elevationMarker=ʳʰʸᵗʰᵐ_elevationmarker@L2, planView=byRoom@@L1, index=code_block_21.out1)

# group: Filtering
code_block_22 = CodeBlock { 1; }
flatten_2 = List.Flatten(list=ʳʰʸᵗʰᵐ_elevationmarker_2, amount=code_block_22)
code_block_23 = CodeBlock { 0; 1; 2; 3; }
getItemAtIndex = List.GetItemAtIndex(list=flatten_2@@L2, index=code_block_23.out0)
getItemAtIndex_2 = List.GetItemAtIndex(list=flatten_2@@L2, index=code_block_23.out1)
getItemAtIndex_3 = List.GetItemAtIndex(list=flatten_2@@L2, index=code_block_23.out2)
getItemAtIndex_4 = List.GetItemAtIndex(list=flatten_2@@L2, index=code_block_23.out3)

# group: Assing
# note: Generate names for the elevation views
code_block_24 = CodeBlock(rName=code_block_19)
# ---------- code_block_24.designscript (6 lines) ----------
"View Name";

"WIP-XX-"+rName+"_Elevation1";
"WIP-XX-"+rName+"_Elevation2";
"WIP-XX-"+rName+"_Elevation3";
"WIP-XX-"+rName+"_Elevation4";
# ----------------------------------------
setParameterByName_3 = Element.SetParameterByName(element=getItemAtIndex, parameterName=code_block_24.out0, value=code_block_24.out1)
setParameterByName_4 = Element.SetParameterByName(element=getItemAtIndex_2, parameterName=code_block_24.out0, value=code_block_24.out2)
setParameterByName_5 = Element.SetParameterByName(element=getItemAtIndex_3, parameterName=code_block_24.out0, value=code_block_24.out3)
setParameterByName_6 = Element.SetParameterByName(element=getItemAtIndex_4, parameterName=code_block_24.out0, value=code_block_24.out4)

# group: Assing
# note: Apply Browser parameters to the views
list_create_2 = List.Create(item0=setParameterByName, item1=setParameterByName_2, item2=setParameterByName_3, item3=setParameterByName_4, item4=setParameterByName_5, item5=setParameterByName_6)
code_block_25 = CodeBlock { "View Folder 3"; }
setParameterByName_7 = Element.SetParameterByName(element=list_create_2@@L2, parameterName=code_block_25, value=code_block_19)

# group: Assing
# note: Apply Browser parameters to the views
flatten_3 = List.Flatten(list=setParameterByName_7)
code_block_26 = CodeBlock { "View Folder 1 (View type)"; "01 - WIP"; "View Folder 2"; "A-5700 - Unit Types"; }
setParameterByName_8 = Element.SetParameterByName(element=flatten_3, parameterName=code_block_26.out2, value=code_block_26.out3)
setParameterByName_9 = Element.SetParameterByName(element=flatten_3, parameterName=code_block_26.out0, value=code_block_26.out1)

# group: Processing
code_block_27 = CodeBlock(rooms=filterByBoolMask_5.out) { rooms; }
finishBoundary = Room.FinishBoundary(room=code_block_27)
byJoinedCurves = PolyCurve.ByJoinedCurves(curves=finishBoundary)
patch = Curve.Patch(curve=byJoinedCurves)
code_block_28 = CodeBlock { 0.5; }
pointAtParameter = Surface.PointAtParameter(surface=patch, u=code_block_28, v=code_block_28)
isInsideRoom = Room.IsInsideRoom(room=code_block_27, point=pointAtParameter)
filterByBoolMask_6 = List.FilterByBoolMask(list=byJoinedCurves, mask=isInsideRoom)
code_block_29 = CodeBlock { 300; false; }
offset = PolyCurve.Offset(polyCurve=filterByBoolMask_6.in, signedDistance=code_block_29.out0, extendCircular=code_block_29.out1)
byPatch = Surface.ByPatch(closedCurve=offset)
perimeterCurves = Surface.PerimeterCurves(surface=byPatch)
code_block_30 = CodeBlock { 1; }
flatten_4 = List.Flatten(list=perimeterCurves, amount=code_block_30)

# group: Processing
code_block_31 = CodeBlock { 1; }
flatten_5 = List.Flatten(list=finishBoundary, amount=code_block_31)
length = Curve.Length()  # unwired: curve
sortByFunction = List.SortByFunction(list=flatten_5@L2, sortFunction=length)
RIE_Curve_Rotation_XZ = Custom[RIE_Curve_Rotation_XZ](curve=sortByFunction)  # package RIE; Find the XZ rotation component of a line
code_block_32 = CodeBlock { 2; [0,90,180,270]; }
# note: Check rotation of the longest line of room boundary
round = Math.Round(number=RIE_Curve_Rotation_XZ, digits=code_block_32.out0)
eq = round@@L2 == code_block_32.out1  # lacing=CrossProduct
anyTrue = List.AnyTrue(list=eq@@L2)
countTrue = List.CountTrue(list=anyTrue@L2)
code_block_33 = CodeBlock(value=countTrue) { value>1; }

# group: Control
filterByBoolMask_7 = List.FilterByBoolMask(list=ʳʰʸᵗʰᵐ_elevationmarker_2, mask=code_block_33)  # frozen
# note: Only rooms that have wall in at least 2 orthogonal directions.
code_block_34 = CodeBlock { 1; }
flatten_6 = List.Flatten(list=filterByBoolMask_7.in, amount=code_block_34)
filterByBoolMask_8 = List.FilterByBoolMask(list=filterByBoolMask_5.out, mask=code_block_33)  # frozen

# group: Assing
geometry_2 = Element.Geometry(element=filterByBoolMask_8.in)
# note: Assign crop to views
boundingBox = Geometry.BoundingBox(geometry=geometry_2)
ʳʰʸᵗʰᵐ_view_setcropregion = Rhythm.Revit.Views.View.SetCropRegion(view=flatten_6@L2, bBox=boundingBox)

# group: Assing
# note: Apply view scale
uniqueItems_2 = List.UniqueItems(list=setParameterByName_9)
setScale = View.SetScale(view=uniqueItems_2, scale=code_block_15.viewScale)

# group: Assing
# note: Apply view templates
setViewTemplate = archilab.Revit.Views.Views.SetViewTemplate(view=setScale, viewTemplate=code_block_15.viewtemplate)

# group: Assing
setCropBoxByCurves = archilab.Revit.Views.Views.SetCropBoxByCurves(view=setParameterByName, curves=flatten_4)
setCropBoxByCurves_2 = archilab.Revit.Views.Views.SetCropBoxByCurves(view=setParameterByName_2, curves=flatten_4)
