# Dynamo graph Create View Filters.dyn "Views - Generate View Filters" (Dynamo 2.12.1.8246)
# packages: Data-Shapes 2021.2.92, SteamNodes 1.2.3, archi-lab.net 2021.25.2521, Genius Loci 2021.2.3, Orchid 260.1.0.7729

# group: Filtering
code_block = CodeBlock { catV=Revit.Category.ByName("Views"); allV=ElementQueries.OfCategory(catV); }
isViewTemplate = View.IsViewTemplate(view=code_block.allV)
isNull = Object.IsNull(object=isViewTemplate)
code_block_2 = CodeBlock { false; }
code_block_3 = CodeBlock(x=isNull, a=code_block_2, b=isViewTemplate) { x?a:b; }
filterByBoolMask = List.FilterByBoolMask(list=code_block.allV, mask=code_block_3)

# group: Control
isNull_2 = Object.IsNull(object=filterByBoolMask.in)
filterByBoolMask_2 = List.FilterByBoolMask(list=filterByBoolMask.in, mask=isNull_2)
code_block_4 = CodeBlock(vT=filterByBoolMask_2.out) { vT.Name; }
isNull_3 = Object.IsNull(object=filterByBoolMask.out)
filterByBoolMask_3 = List.FilterByBoolMask(list=filterByBoolMask.out, mask=isNull_3)
code_block_5 = CodeBlock(v=filterByBoolMask_3.out) { v.Name; }

# group: Input
code_block_6 = CodeBlock()
# ---------- code_block_6.designscript (9 lines) ----------
"Select surface background pattern";

"Select cut background pattern";

"Define transperancy";

"Use halftone";

"Hide in view";
# ----------------------------------------
code_block_7 = CodeBlock { DSCore.Types.FindTypeByNameInAssembly("FillPatternElement","RevitAPI"); }
all_elements_of_type = ElementsOfType(element_type=code_block_7)
code_block_8 = CodeBlock(e=all_elements_of_type) { e.Name; 0; }
ui_dropdown_data = Custom[UI.DropDown Data](InputName=code_block_6.out0, Keys=code_block_8.out0, Values=all_elements_of_type)  # package Data-Shapes; Create data for DropDown input in UI.MultiInputForm ++ . Check out www.data-shapes.net for more infos.
ui_dropdown_data_2 = Custom[UI.DropDown Data](InputName=code_block_6.out1, Keys=code_block_8.out0, Values=all_elements_of_type)
code_block_9 = CodeBlock { 0; 100; 1; }
slider = Custom[Slider](InputName=code_block_6.out2, Minimum=code_block_9.out0, Maximum=code_block_9.out1, Default_Value=code_block_9.out0, Step=code_block_9.out2)  # package Data-Shapes; Creates slider input for UI.MultipleInputForm ++ . Set the step to decimal value if you want a double slider, or to a integer value if you want an integer slider.
boolean_input = Custom[Boolean input](InputName=code_block_6.out3)  # package Data-Shapes; Creates a boolean input for UI.MultipleInputForm ++ . Check out www.data-shapes.net for more infos!
boolean_input_2 = Custom[Boolean input](InputName=code_block_6.out4)

code_block_10 = CodeBlock { "Export parameter values"; "Locate folder for .csv file (values)"; }
boolean_input_3 = Custom[Boolean input](InputName=code_block_10.out0)
directorypath_data = Custom[DirectoryPath Data](InputName=code_block_10.out1)  # package Data-Shapes; Creates a DirectoryPath input for UI.MultipleInputForm ++ . Check out www.data-shapes.net for more infos!

# group: Input
file_path = Filename("..\ACG_logo.png")
file_from_path = FileObject(path=file_path)
readFromFile = Image.ReadFromFile(file=file_from_path)
code_block_11 = CodeBlock { "Select Category"; true; "Generate Filters"; "Cancel"; false; 700; 250; }
string = StringInput("""This tool will generate View Filters for a Category based on the parameter values of the elements.

View Filters will be named as follows:
<category>(<Parametr>-Equals-<value>)""")
textnote_data = Custom[TextNote Data](TextNote=string)  # package Data-Shapes; Create Data for TextNote input in UI.MultipleInputForm ++ . Check out www.data-shapes.net for more informations
code_block_12 = CodeBlock()
# ---------- code_block_12.designscript (17 lines) ----------
[
"Casework",
"Ceilings",
"Columns",
"Doors",
"Floors",
"Furniture",
"Generic Models",
"Parking",
"Planting",
"Plumbing Fixtures",
"Railings",
"Roofs",
"Stairs",
"Walls",
"Windows"
];
# ----------------------------------------
ui_dropdown_data_3 = Custom[UI.DropDown Data](InputName=code_block_11.out0, Keys=code_block_12, Values=code_block_12)
code_block_13 = CodeBlock()
# ---------- code_block_13.designscript (15 lines) ----------
"Type Parameter name";
"Type Mark";

"Filter Type patameters?";
true;

"Add to View Template (optional)";

"Add to View (optional)";

"Value must contain...";
"";

"Include linked RVT models?";
false;
# ----------------------------------------
textbox_data = Custom[TextBox Data](InputName=code_block_13.out0, DefaultText=code_block_13.out1)  # package Data-Shapes; Create Data for TextBox input in UI.MultipleInputForm ++ . Check out www.data-shapes.net for more informations
code_block_14 = CodeBlock { "Value length to be processesd"; "Full length"; true; }
textbox_data_2 = Custom[TextBox Data](InputName=code_block_14.out0, DefaultText=code_block_14.out1)
boolean_input_4 = Custom[Boolean input](InputName=code_block_13.out2, DefaultValue=code_block_13.out3)
boolean_input_5 = Custom[Boolean input](InputName=code_block_13.out8, DefaultValue=code_block_13.out9)
ui_dropdown_data_4 = Custom[UI.DropDown Data](InputName=code_block_13.out4, Keys=code_block_4, Values=filterByBoolMask_2.out)
ui_dropdown_data_5 = Custom[UI.DropDown Data](InputName=code_block_13.out5, Keys=code_block_5, Values=filterByBoolMask_3.out)

textbox_data_3 = Custom[TextBox Data](InputName=code_block_13.out6, DefaultText=code_block_13.out7)

# group (continued): Input
list_create = List.Create(item0=textnote_data, item1=ui_dropdown_data_3, item2=textbox_data, item3=textbox_data_3, item4=textbox_data_2, item5=boolean_input_4, item6=boolean_input_5, item7=ui_dropdown_data_4, item8=ui_dropdown_data_5, item9=ui_dropdown_data, item10=ui_dropdown_data_2, item11=slider, item12=boolean_input, item13=boolean_input_2, item14=boolean_input_3, item15=directorypath_data)
ui_multipleinputform = Custom[UI.MultipleInputForm ++](Logo_optional=readFromFile, ButtonText_optional=code_block_11.out2, Inputs=list_create, Toggle=code_block_11.out1, CancelButtonText_optional=code_block_11.out3, Width_optional=code_block_11.out5, LabelWidth_optional=code_block_11.out6)  # package Data-Shapes; Create a form with multiple inputs. see www.data-shapes.net for tutorials and infos!

code_block_15 = CodeBlock(x=ui_multipleinputform.User_Inputs)
# ---------- code_block_15.designscript (15 lines) ----------
catName = x[0];
parName = x[1];
value = x[2];
valueLen = x[3];
runType = x[4];
includeLinks = x[5];
viewTemplate = x[6];
view = x[7];
surfaceTappert = x[8];
cutPattern = x[9];
transpetancy = x[10];
halftone = x[11];
hide = x[12];
saveCsv = x[13];
csvPath = x[14];
# ----------------------------------------
byName = Category.ByName(name=code_block_15.catName)

# group: Processing
getDocuments = archilab.Revit.Selection.Select.GetDocuments()
# note: Add elements from input category in linked RVT instances
runMe = Custom[Tool.RunMe](Boolean=code_block_15.includeLinks, ThingToDo=byName)  # package SteamNodes; Use Boolean to perform an action
getFromLinkedFile = Custom[Element.GetFromLinkedFile](LinkInstance=getDocuments.Link_Instance@L1, LinkDocument=getDocuments.Link_Doc@L1, Category=runMe)  # package SteamNodes; Get elements from link document instance based on category

# group: Processing
code_block_16 = CodeBlock(cat=byName) { allOfCat=ElementQueries.OfCategory(cat); }
# note: Combine all elements of category and clear list
list_create_2 = List.Create(item0=getFromLinkedFile, item1=code_block_16)
flatten = List.Flatten(list=list_create_2)
clear_list = Custom[Clear List](input=flatten)  # package archi-lab.net; This node will remove all Null and Empty Lists from any list.

# group: Control
runMe_2 = Custom[Tool.RunMe](Boolean=code_block_15.runType, ThingToDo=clear_list)
# note: Choose what to ryn type/instance parameter
code_block_17 = CodeBlock { false; true; }
code_block_18 = CodeBlock(x=code_block_15.runType, a=code_block_17.out0, b=code_block_17.out1) { x?a:b; }
runMe_3 = Custom[Tool.RunMe](Boolean=code_block_18, ThingToDo=clear_list)

# group: Filtering
elementTypes = Custom[ElementTypes+](element=runMe_2)  # Gets types from linked elements too. From Clockworks
code_block_19 = CodeBlock(lst=elementTypes) { DSCore.List.UniqueItems(lst); }
# note: Collect all element types and get the values for the parameter
getParameterValueByName = Element.GetParameterValueByName(element=code_block_19, parameterName=code_block_15.parName)
code_block_20 = CodeBlock(par=getParameterValueByName) { par==""; }
filterByBoolMask_4 = List.FilterByBoolMask(list=code_block_19, mask=code_block_20)
getParameterValueByName_2 = Element.GetParameterValueByName(element=filterByBoolMask_4.out, parameterName=code_block_15.parName)
python_script = Python(IN[0]=getParameterValueByName_2, IN[1]=code_block_15.valueLen)  # IronPython2
# ---------- python_script.python (22 lines) ----------
# Load the Python Standard and DesignScript Libraries
import sys
import clr
clr.AddReference('ProtoGeometry')
from Autodesk.DesignScript.Geometry import *

# The inputs to this node will be stored as a list in the IN variables.
values = IN[0]
length = IN[1]
newValues = []

if length == 'Full length':
	OUT = values
else:
	len = int(length)
	for v in values:
		try:
			newValue = v[:len]
			newValues.append(newValue)
		except:
			newValues.append(v)
	OUT = newValues
# ----------------------------------------
code_block_21 = CodeBlock(firstEleemnt=filterByBoolMask_4.out) { firstEleemnt[0]; }

# group: Processing
contains = String.Contains(string=python_script, searchFor=code_block_15.value)
filterByBoolMask_5 = List.FilterByBoolMask(list=python_script, mask=contains)
uniqueItems = List.UniqueItems(list=filterByBoolMask_5.in)
# note: Sort all unique values
sort = List.Sort(list=uniqueItems)

# group: Processing
# note: Assemble filter names
code_block_22 = CodeBlock(cat=code_block_15.catName, par=code_block_15.parName, value=sort) { cat+"("+par+"-Contains-"+value+")"; }

# group: Filtering
code_block_23 = CodeBlock { DSCore.Types.FindTypeByNameInAssembly("FilterElement","RevitAPI"); }
# note: Collect all existing view filters in the model
all_elements_of_type_2 = ElementsOfType(element_type=code_block_23)
code_block_24 = CodeBlock(filters=all_elements_of_type_2) { filters.Name; }

# group: Control
# note: Check if filter doesn't already exist. If it does - ignore
eq = code_block_22 == code_block_24  # lacing=CrossProduct
anyTrue = Orchid.Common.List.AnyTrue(list=eq@@L2)
# note: OUT = New filters to be created
filterByBoolMask_6 = List.FilterByBoolMask(list=code_block_22, mask=anyTrue)
# note: Filter parameter values
filterByBoolMask_7 = List.FilterByBoolMask(list=sort, mask=anyTrue)

count = List.Count(list=filterByBoolMask_6.out)

# group: Control
# note: Collect as many categories as unique values
ofRepeatedItem = List.OfRepeatedItem(item=byName, amount=count)
code_block_25 = CodeBlock { catDI=Revit.Category.ByName("Detail Items"); allDI=ElementQueries.OfCategory(catDI); allDI[0]; "Comments"; }
ofRepeatedItem_2 = List.OfRepeatedItem(item=code_block_25.catDI, amount=count)
list_create_3 = List.Create(item0=ofRepeatedItem, item1=ofRepeatedItem_2)
transpose = List.Transpose(lists=list_create_3)
ofRepeatedItem_3 = List.OfRepeatedItem(item=code_block_25.out2, amount=count)
# note: Collect as many element as unique values
ofRepeatedItem_4 = List.OfRepeatedItem(item=code_block_21, amount=count)

# group: Ouput
select_rule_type = RuleTypes("Contains")
parameterByName = Parameter.ParameterByName(element=ofRepeatedItem_3, name=code_block_25.out3)
parameterByName_2 = Parameter.ParameterByName(element=ofRepeatedItem_4, name=code_block_15.parName)
list_create_4 = List.Create(item0=parameterByName, item1=parameterByName_2)
transpose_2 = List.Transpose(lists=list_create_4)
byRuleType = Revit.Filter.FilterRule.ByRuleType(type=select_rule_type, value=filterByBoolMask_7.out, parameter=transpose_2)
byRules = Revit.Filter.ParameterFilterElement.ByRules(name=filterByBoolMask_6.out, categories=transpose, rules=byRuleType, lacing=Longest)

# group: Filtering
getParameterValueByName_3 = Element.GetParameterValueByName(element=runMe_3, parameterName=code_block_15.parName)
# note: Collect all elements and get the values for the parameter
python_script_2 = Python(IN[0]=getParameterValueByName_3, IN[1]=code_block_15.valueLen)  # IronPython2; same code as python_script
code_block_26 = CodeBlock(par=python_script_2) { par==""; }
filterByBoolMask_8 = List.FilterByBoolMask(list=python_script_2, mask=code_block_26)
filterByBoolMask_9 = List.FilterByBoolMask(list=runMe_3, mask=code_block_26)
code_block_27 = CodeBlock(firstEleemnt=filterByBoolMask_9.out) { firstEleemnt[0]; }

string_from_object = FromObject(object=filterByBoolMask_8.out)

# group: Processing
contains_2 = String.Contains(string=string_from_object, searchFor=code_block_15.value)
filterByBoolMask_10 = List.FilterByBoolMask(list=filterByBoolMask_8.out, mask=contains_2)
uniqueItems_2 = List.UniqueItems(list=filterByBoolMask_10.in)
sort_2 = List.Sort(list=uniqueItems_2)

# group: Processing
# note: Assemble filter names
code_block_28 = CodeBlock(cat=code_block_15.catName, par=code_block_15.parName, value=sort_2) { cat+"("+par+"-Contains-"+value+")"; }

# group: Control
# note: Check if filter doesn't already exist. If it does - ignore
eq_2 = code_block_28 == code_block_24  # lacing=CrossProduct
anyTrue_2 = Orchid.Common.List.AnyTrue(list=eq_2@@L2)
# note: OUT = New filters to be created
filterByBoolMask_11 = List.FilterByBoolMask(list=code_block_28, mask=anyTrue_2)
# note: Filter parameter values
filterByBoolMask_12 = List.FilterByBoolMask(list=sort_2, mask=anyTrue_2)

count_2 = List.Count(list=filterByBoolMask_11.out)

# group: Control
# note: Collect as many categories as unique values
ofRepeatedItem_5 = List.OfRepeatedItem(item=byName, amount=count_2)
code_block_29 = CodeBlock { catDI=Revit.Category.ByName("Detail Items"); allDI=ElementQueries.OfCategory(catDI); allDI[0]; "Comments"; }
ofRepeatedItem_6 = List.OfRepeatedItem(item=code_block_29.catDI, amount=count_2)
list_create_5 = List.Create(item0=ofRepeatedItem_5, item1=ofRepeatedItem_6)
transpose_3 = List.Transpose(lists=list_create_5)
ofRepeatedItem_7 = List.OfRepeatedItem(item=code_block_29.out2, amount=count_2)
# note: Collect as many element as unique values
ofRepeatedItem_8 = List.OfRepeatedItem(item=code_block_27, amount=count_2)

# group: Ouput
select_rule_type_2 = RuleTypes("Contains")
parameterByName_3 = Parameter.ParameterByName(element=ofRepeatedItem_7, name=code_block_29.out3)
parameterByName_4 = Parameter.ParameterByName(element=ofRepeatedItem_8, name=code_block_15.parName)
list_create_6 = List.Create(item0=parameterByName_3, item1=parameterByName_4)
transpose_4 = List.Transpose(lists=list_create_6)
byRuleType_2 = Revit.Filter.FilterRule.ByRuleType(type=select_rule_type_2, value=filterByBoolMask_12.out, parameter=transpose_4)
byRules_2 = Revit.Filter.ParameterFilterElement.ByRules(name=filterByBoolMask_11.out, categories=transpose_3, rules=byRuleType_2, lacing=Longest)

count_3 = List.Count(list=code_block_22)
count_4 = List.Count(list=code_block_28)
list_create_7 = List.Create(item0=count_3, item1=count_4)
flatten_2 = List.Flatten(list=list_create_7)
maximumItem = List.MaximumItem(list=flatten_2)

# group: Assing
python_script_3 = Python(IN[0]=maximumItem)  # IronPython2
# ---------- python_script_3.python (60 lines) ----------
# Load the Python Standard and DesignScript Libraries
import clr
import sys
import os.path
from System import Environment
sys.path.append('C:\Program Files (x86)\IronPython 2.7\Lib')
import System
from System import Array
from System.Collections.Generic import *
clr.AddReference('ProtoGeometry')
from Autodesk.DesignScript.Geometry import (Geometry, Point as pt)
clr.AddReference("RevitNodes")
import Revit
clr.ImportExtensions(Revit.Elements)
clr.ImportExtensions(Revit.GeometryConversion)
clr.AddReference("RevitServices")
import RevitServices
from RevitServices.Persistence import DocumentManager 
from RevitServices.Transactions import TransactionManager 
clr.AddReference("RevitAPI")
clr.AddReference("RevitAPIUI")
import Autodesk 
from Autodesk.Revit.DB import *
from Autodesk.Revit.UI import *
import csv

doc = DocumentManager.Instance.CurrentDBDocument
uiapp = DocumentManager.Instance.CurrentUIApplication 
app = uiapp.Application 
uidoc = uiapp.ActiveUIDocument

filePath =	'R:\\3600_IT\\3605_BIM\\3605_17_Dynamo\\01-Scripts\\_Dyno Scripts\\Views\\Resources\\Colours.csv'
numberOUT = int(IN[0])

file = open(filePath, 'r')
data = [l.rstrip() for l in file]

rs, bs, gs = [], [], []

# get the values from the list
for color in data:
	rs.append(int(color.split('-')[0]))
	bs.append(int(color.split('-')[1]))
	gs.append(int(color.split('-')[2]))
	
# add greys
greys = [200] * 300
rs.extend(greys)
bs.extend(greys)
gs.extend(greys)
	

colors = []
for r, b, g in zip(rs, bs, gs):
	colors.append(Color(r,b,g))
	
if len(colors) >= int(numberOUT):
	OUT = colors[:numberOUT]
else:
	OUT = "Too many colors required"
# ----------------------------------------
create_overridegraphicsettings = Custom[Create OverrideGraphicSettings](SurfaceBackgroundPattern=code_block_15.surfaceTappert, SurfaceBackgroundColor=python_script_3, CutBackgroundPattern=code_block_15.cutPattern, CutBackgroundPatternColor=python_script_3, Transparency=code_block_15.transpetancy, Halftone=code_block_15.halftone)  # package Genius Loci; Create a OverrideGraphicSettings (All graphic inputs are optional). Unlike the OOTB OverrideGraphicSettings.ByProperties node, the Foreground and background patterns are available. Note : Prior to Revit 2019, the materials have only one surface pattern and one cut pattern.

not_ = Not(x=code_block_15.hide)

# group: Assing
list_create_8 = List.Create(item0=code_block_15.viewTemplate, item1=code_block_15.view)
flatten_3 = List.Flatten(list=list_create_8)
clear_list_2 = Custom[Clear List](input=flatten_3)
list_create_9 = List.Create(item0=byRules, item1=byRules_2)
flatten_4 = List.Flatten(list=list_create_9)
clear_list_3 = Custom[Clear List](input=flatten_4)
# note: Assign to view / view template
view_addfilter = Custom[View AddFilter](view=clear_list_2, filterElement=clear_list_3@@L1, overrides=create_overridegraphicsettings@L1, visible=not_)  # package Genius Loci; Add a Filter and set its overrides to a view. Unlike the OOTB nodes, it also works with SelectionFilterElement. For use with the Create OverrideGraphicSettings node.

# group: Control
code_block_30 = CodeBlock { "Views - Generate Filters"; }
acg_script_usage = Custom[ACG Script Usage](scriptName=code_block_30)  # Adds an entry to Excel document every time a script is run. The document is located in S:\Dynamo\05-UsageStats

# group: Assing
code_block_31 = CodeBlock(dir=code_block_15.csvPath) { dir+"\\ParameterValues.csv"; }
runMe_4 = Custom[Tool.RunMe](Boolean=code_block_15.saveCsv, ThingToDo=code_block_31)
list_create_10 = List.Create(item0=sort, item1=sort_2)
flatten_5 = List.Flatten(list=list_create_10)
clear_list_4 = Custom[Clear List](input=flatten_5)
code_block_32 = CodeBlock(values=clear_list_4) { allV=DSCore.List.Flatten(values); DSCore.List.Count(allV); }
list_create_11 = List.Create(item0=code_block_32.allV, item1=code_block_32.out1)
exportCSV = Data.ExportCSV(filePath=runMe_4, data=list_create_11)
flatten_6 = List.Flatten(list=list_create_11)
