# Dynamo graph Create Views By Workset.dyn "Views - By Workset_py" (Dynamo 2.12.1.8246)
# packages: Data-Shapes 2021.2.92

# group: Usage
code_block = CodeBlock { "Worksets - Create Views"; }
acg_script_usage = Custom[ACG Script Usage](scriptName=code_block)  # Adds an entry to Excel document every time a script is run. The document is located in S:\Dynamo\05-UsageStats

# group: Visualisation
python_script = Python()  # IronPython2
# ---------- python_script.python (88 lines) ----------
# Load the Python Standard and DesignScript Libraries
import clr
import sys
import os.path
from datetime import datetime
from System import Environment
sys.path.append('C:\Program Files (x86)\IronPython 2.7\Lib')
import System
from System import Array
from System.Collections.Generic import *
clr.AddReference('ProtoGeometry')
from Autodesk.DesignScript.Geometry import *
clr.AddReference("RevitNodes")
import Revit
clr.ImportExtensions(Revit.Elements)
clr.ImportExtensions(Revit.GeometryConversion)
clr.AddReference("RevitServices")
import RevitServices
from RevitServices.Persistence import DocumentManager 
from RevitServices.Transactions import TransactionManager 

clr.AddReference("RevitAPI")
clr.AddReference("RevitAPIUI")

import Autodesk 
from Autodesk.Revit.DB import *
from Autodesk.Revit.UI import *
import time

doc = DocumentManager.Instance.CurrentDBDocument
uiapp = DocumentManager.Instance.CurrentUIApplication 
app = uiapp.Application 
uidoc = uiapp.ActiveUIDocument

worksets = FilteredWorksetCollector(doc).OfKind(WorksetKind.UserWorkset).ToWorksets()

wNames = [w.Name for w in worksets]
vNames = ['Workset-'+w.Name for w in worksets]

# the vireFamilyType Ids
allViewTypes = FilteredElementCollector(doc).OfClass(ViewFamilyType).ToElements()
viewTypeNames = [i.ToDSType(True).Name for i in allViewTypes]
viewTypeIds = [i.ToDSType(True).Id for i in allViewTypes]
threeDViewTypeId = ''
for name, id in zip(viewTypeNames, viewTypeIds):
	if 'Three' in name or '3D' in name:
		threeDViewTypeId = id


def create3D(workset, name):
	v = View3D.CreateIsometric(doc, ElementId(threeDViewTypeId))
	v.get_Parameter(BuiltInParameter.VIEW_NAME).Set(name)
	return v
	
def setWorksetVis(view, worksets):
	for w in worksets:
		if w.Name in v.Name:
			v.SetWorksetVisibility(w.Id, WorksetVisibility.Visible)
		else:
			v.SetWorksetVisibility(w.Id, WorksetVisibility.Hidden)	

TransactionManager.Instance.EnsureInTransaction(doc)

views = []
for w,n in zip(worksets, vNames):
	try:
		views.append(create3D(w,n))
	except:
		continue
for v in views:
	try:
		setWorksetVis(v, worksets)
	except:
		continue
for v in views:
	try:
		v.LookupParameter('View Folder 1 (View type)').Set('01 - WIP')
		v.LookupParameter('View Folder 2').Set('Worksets')
		v.LookupParameter('View Folder 3').Set('NTS')
	except:
		continue
		
TransactionManager.Instance.TransactionTaskDone()	

if len(views) > 0:
	OUT = 'Success ! ', str(len(views)) + ' workset views were created. Check 01 - WIP folder.'
else:
	OUT = 'Error :' , 'The views could not be created.'
# ----------------------------------------

code_block_2 = CodeBlock(x=python_script) { true; "Okay"; title = x[0]; text = x[1]; }

# group: Input
file_path = Filename("..\ACG_logo.png")
file_from_path = FileObject(path=file_path)
readFromFile = Image.ReadFromFile(file=file_from_path)
textnote_data = Custom[TextNote Data](Title=code_block_2.title, TextNote=code_block_2.text)  # package Data-Shapes; Create Data for TextNote input in UI.MultipleInputForm ++ . Check out www.data-shapes.net for more informations
multipleinputform = Custom[MultipleInputForm ++](Logo_optional=readFromFile, ButtonText_optional=code_block_2.out1, Inputs=textnote_data, Toggle=code_block_2.out0)  # package Data-Shapes; Create a form with multiple inputs. see www.data-shapes.net for tutorials and infos!
