# Dynamo graph Create Walls Spec Views.dyn "Views - Generate Spec Views - Walls" (Dynamo 2.12.0.5650)
# packages: Genius Loci 2021.2.3, archi-lab.net 2021.25.2521, SteamNodes 1.2.3, Data-Shapes 2021.2.92, Orchid 260.1.0.7729, archi-lab.net 2022.210.2522, Clockwork for Dynamo 1.x 1.0.3, Rhythm 2021.1.1

# group: Process the walls from the host model

# group: Process the walls from the linked model(s)

# group: Create wall instance for the specification view

# group: Dimension wall layers

# group: Annotate wall layers - material tags

# group: Annotate wall instances

# group: Input
current = Document.Current()
activeView = Document.ActiveView(document=current)
code_block = CodeBlock { "Associated Level"; }
getParameterValueByName = Element.GetParameterValueByName(element=activeView, parameterName=code_block)
getLevelByName = archilab.Revit.Selection.Select.GetLevelByName(name=getParameterValueByName)

file_path = Filename("..\ACG_logo.png")
file_from_path = FileObject(path=file_path)
readFromFile = Image.ReadFromFile(file=file_from_path)

# group: Input
code_block_2 = CodeBlock { "Note:"; }
string = StringInput("""This tool can generate Wall spec elements in the active view.
To run the tool, you need to create a dedicated view and place a line to define the origin for generating the elements. Make sure all required Wall and Material tags are present in the model.
The tool will detect all wall types already placed and visible in the view and ignore them.
If you are working with linked models, please use Transfer Project Standards to bring all new wall types from the linked RVT model. Make sure that the linked wall types with unique Type Mark value have unique Type Name as well.
Please fill in the required fields below and click "Generate Elements". Select the a line once the window disappears.
Please remember, that this tool is only as good as the data you are inputting!
For more information on how this tool works, please refer to the Revit Tutorials channel in MS Teams.""")
textnote_data = Custom[TextNote Data](Title=code_block_2, TextNote=string)  # package Data-Shapes; Create Data for TextNote input in UI.MultipleInputForm ++ . Check out www.data-shapes.net for more informations

# group: Input
code_block_3 = CodeBlock { "Type parameter name to filter:"; "Type Mark"; }
textbox_data = Custom[TextBox Data](InputName=code_block_3.out0, DefaultText=code_block_3.out1)  # package Data-Shapes; Create Data for TextBox input in UI.MultipleInputForm ++ . Check out www.data-shapes.net for more informations

# group: Input
code_block_4 = CodeBlock { "Parameter value must contain:"; }
textbox_data_2 = Custom[TextBox Data](InputName=code_block_4)

# group: Input
code_block_5 = CodeBlock { DSCore.Types.FindTypeByNameInAssembly("Family","RevitAPI"); }
all_elements_of_type = ElementsOfType(element_type=code_block_5)
code_block_6 = CodeBlock(e=all_elements_of_type) { e.Name; "Tag"; true; }
contains = String.Contains(string=code_block_6.out0, searchFor=code_block_6.out1, ignoreCase=code_block_6.out2)
filterByBoolMask = List.FilterByBoolMask(list=all_elements_of_type, mask=contains)
code_block_7 = CodeBlock(e=filterByBoolMask.in) { e.Name; "Mat"; true; }
contains_2 = String.Contains(string=code_block_7.out0, searchFor=code_block_7.out1, ignoreCase=code_block_7.out2)
filterByBoolMask_2 = List.FilterByBoolMask(list=filterByBoolMask.in, mask=contains_2)
name = Family.Name(family=filterByBoolMask_2.in)
types = Family.Types(family=filterByBoolMask_2.in)
code_block_8 = CodeBlock(tp=types) { tp.Name; }
count = List.Count(list=code_block_8@L2)
ofRepeatedItem = List.OfRepeatedItem(item=name, amount=count, lacing=Shortest)
code_block_9 = CodeBlock(famName=ofRepeatedItem, typeName=code_block_8) { famName+" - "+typeName; "Select material tag type"; }
flatten = List.Flatten(list=code_block_9.out0)
flatten_2 = List.Flatten(list=types)
dropdown_data = Custom[DropDown Data](InputName=code_block_9.out1, Keys=flatten, Values=flatten_2)  # package Data-Shapes; Create data for DropDown input in UI.MultiInputForm ++ . Check out www.data-shapes.net for more infos.

# group: Input
code_block_10 = CodeBlock { DSCore.Types.FindTypeByNameInAssembly("Family","RevitAPI"); }
all_elements_of_type_2 = ElementsOfType(element_type=code_block_10)
code_block_11 = CodeBlock(e=all_elements_of_type_2) { e.Name; "Tag"; true; }
contains_3 = String.Contains(string=code_block_11.out0, searchFor=code_block_11.out1, ignoreCase=code_block_11.out2)
filterByBoolMask_3 = List.FilterByBoolMask(list=all_elements_of_type_2, mask=contains_3)
code_block_12 = CodeBlock(e=filterByBoolMask_3.in) { e.Name; "Wall"; true; }
contains_4 = String.Contains(string=code_block_12.out0, searchFor=code_block_12.out1, ignoreCase=code_block_12.out2)
filterByBoolMask_4 = List.FilterByBoolMask(list=filterByBoolMask_3.in, mask=contains_4)
name_2 = Family.Name(family=filterByBoolMask_4.in)
types_2 = Family.Types(family=filterByBoolMask_4.in)
code_block_13 = CodeBlock(tp=types_2) { tp.Name; }
count_2 = List.Count(list=code_block_13@L2)
ofRepeatedItem_2 = List.OfRepeatedItem(item=name_2, amount=count_2, lacing=Shortest)
code_block_14 = CodeBlock(famName=ofRepeatedItem_2, typeName=code_block_13) { famName+" - "+typeName; "Select wall tag type"; }
flatten_3 = List.Flatten(list=code_block_14.out0)
flatten_4 = List.Flatten(list=types_2)
dropdown_data_2 = Custom[DropDown Data](InputName=code_block_14.out1, Keys=flatten_3, Values=flatten_4)

# group: Input
code_block_15 = CodeBlock { "Select spacing between material tags"; 30; 200; 60; 5; }
slider = Custom[Slider](InputName=code_block_15.out0, Minimum=code_block_15.out1, Maximum=code_block_15.out2, Default_Value=code_block_15.out3, Step=code_block_15.out4)  # package Data-Shapes; Creates slider input for UI.MultipleInputForm ++ . Set the step to decimal value if you want a double slider, or to a integer value if you want an integer slider.

# group: Input
code_block_16 = CodeBlock { "Generate dimensions"; true; }
boolean_input = Custom[Boolean input](InputName=code_block_16.out0)  # package Data-Shapes; Creates a boolean input for UI.MultipleInputForm ++ . Check out www.data-shapes.net for more infos!

# group: Input
code_block_17 = CodeBlock { "Include walls from linked models ?"; true; }
boolean_input_2 = Custom[Boolean input](InputName=code_block_17.out0)

# group: Input
code_block_18 = CodeBlock { true; "Generate Elements"; "Cancel"; false; 800; 400; }
list_create = List.Create(item0=textnote_data, item1=textbox_data, item2=textbox_data_2, item3=dropdown_data, item4=dropdown_data_2, item5=slider, item6=boolean_input, item7=boolean_input_2)
ui_multipleinputform = Custom[UI.MultipleInputForm ++](Logo_optional=readFromFile, ButtonText_optional=code_block_18.out1, Inputs=list_create, Toggle=code_block_18.out0, CancelButtonText_optional=code_block_18.out2, Width_optional=code_block_18.out4, LabelWidth_optional=code_block_18.out5)  # package Data-Shapes; Create a form with multiple inputs. see www.data-shapes.net for tutorials and infos!

# group: Control
end = Revit.Transaction.Transaction.End(input=ui_multipleinputform.User_Inputs)
start = Revit.Transaction.Transaction.Start(input=end)

# group: Input
code_block_19 = CodeBlock { true; Revit.Category.ByName("Lines"); }
await_ = Orchid.Common.DataStream.Await(pass=code_block_19.out0, waitFor=start)
await_2 = Orchid.Common.DataStream.Await(pass=code_block_19.out1, waitFor=start)
ʳʰʸᵗʰᵐ_selection_pick = Rhythm.Revit.Selection.Selection.Pick(runIt=await_, category=await_2, singleSelection=await_)

# group: Visualisation
geometry = Element.Geometry(element=ʳʰʸᵗʰᵐ_selection_pick)
startPoint = Curve.StartPoint(curve=geometry)

# group: Filtering
code_block_20 = CodeBlock { 400; -300; }
# note: Locate -1 point for the walls
translate = Geometry.Translate(geometry=startPoint, xTranslation=code_block_20.out0, yTranslation=code_block_20.out1)

# group: Processing
all_elements_in_active_view = ElementsInView()
getCategory = Element.GetCategory(element=all_elements_in_active_view)
name_3 = Category.Name(category=getCategory)
code_block_21 = CodeBlock(value=name_3) { value=="Walls"; }
# note: Collect the types of all walls already existing in the view
filterByBoolMask_5 = List.FilterByBoolMask(list=all_elements_in_active_view, mask=code_block_21)
type = archilab.Revit.Elements.Elements.Type(element=filterByBoolMask_5.in)

# group: Processing
code_block_22 = CodeBlock { catW=Revit.Category.ByName("Walls"); allW=ElementQueries.OfCategory(catW); }
type_2 = archilab.Revit.Elements.Elements.Type(element=code_block_22.allW)
# note: Collect all wall types in model
uniqueItems = List.UniqueItems(list=type_2)
clear_list = Custom[Clear List](input=uniqueItems)  # package archi-lab.net; This node will remove all Null and Empty Lists from any list.

# group: Filtering
kind = WallType.Kind(wallType=clear_list)
# note: Filter out curtain walls
code_block_23 = CodeBlock(str=kind) { str=="Curtain"; }
filterByBoolMask_6 = List.FilterByBoolMask(list=clear_list, mask=code_block_23)

code_block_24 = CodeBlock(x=start)
# ---------- code_block_24.designscript (8 lines) ----------
line=x[0];
parameterName=x[0];
parameterValue=x[1];
materialTag=x[2];
wallTag=x[3];
tagSpacing=x[4];
withDimensions=x[5];
includeLinked=x[6];
# ----------------------------------------

# group: Filtering
getParameterValueByName_2 = Element.GetParameterValueByName(element=filterByBoolMask_6.out, parameterName=code_block_24.parameterName)
# note: Filter wall types by certain parameter
contains_5 = String.Contains(string=getParameterValueByName_2, searchFor=code_block_24.parameterValue)
filterByBoolMask_7 = List.FilterByBoolMask(list=filterByBoolMask_6.out, mask=contains_5)

code_block_25 = CodeBlock(existingWType=type, newWType=filterByBoolMask_7.in) { existingWType.Name; newWType.Name; }

# group: Control
eq = code_block_25.out0 == code_block_25.out1  # lacing=CrossProduct
# note: Check if the walls types are not already existing in the view
transpose = List.Transpose(lists=eq)
anyTrue = Orchid.Common.List.AnyTrue(list=transpose@@L2)
filterByBoolMask_8 = List.FilterByBoolMask(list=filterByBoolMask_7.in, mask=anyTrue)

# group: Control
isEmpty = List.IsEmpty(list=type)
runMe = Custom[Tool.RunMe](Boolean=isEmpty, ThingToDo=filterByBoolMask_7.in)  # package SteamNodes; Use Boolean to perform an action
not_ = Not(x=isEmpty)
runMe_2 = Custom[Tool.RunMe](Boolean=not_, ThingToDo=filterByBoolMask_8.out)
list_create_2 = List.Create(item0=runMe, item1=runMe_2)
flatten_5 = List.Flatten(list=list_create_2)
code_block_26 = CodeBlock(value=flatten_5) { value==0; }
filterByBoolMask_9 = List.FilterByBoolMask(list=flatten_5, mask=code_block_26)

# group: Control
code_block_27 = CodeBlock { "Type Mark"; }
# note: Sort wall types by Type Mark value
getParameterValueByName_3 = Element.GetParameterValueByName(element=filterByBoolMask_9.out, parameterName=code_block_27)
sortByKey = List.SortByKey(list=filterByBoolMask_9.out, keys=getParameterValueByName_3)

# group: Processing
getDocuments = archilab.Revit.Selection.Select.GetDocuments()
code_block_28 = CodeBlock { catW=Revit.Category.ByName("Walls"); }
runMe_3 = Custom[Tool.RunMe](Boolean=code_block_24.includeLinked, ThingToDo=code_block_28)
getFromLinkedFile = Custom[Element.GetFromLinkedFile](LinkInstance=getDocuments.Link_Instance@L1, LinkDocument=getDocuments.Link_Doc@L1, Category=runMe_3)  # package SteamNodes; Get elements from link document instance based on category
flatten_6 = List.Flatten(list=getFromLinkedFile)
elementTypes = Custom[ElementTypes+](element=flatten_6)  # Gets types from linked elements too. From Clockworks
uniqueItems_2 = List.UniqueItems(list=elementTypes)
# note: Add elements from input category in linked RVT instances
kind_2 = WallType.Kind(wallType=uniqueItems_2)
# note: Collect all wall types in linked model
code_block_29 = CodeBlock(kind=kind_2) { kind=="Basic"; }
filterByBoolMask_10 = List.FilterByBoolMask(list=uniqueItems_2, mask=code_block_29)
clear_list_2 = Custom[Clear List](input=filterByBoolMask_10.in)

# group: Processing
code_block_30 = CodeBlock { DSCore.Types.FindTypeByNameInAssembly("WallType","RevitAPI"); }
all_elements_of_type_3 = ElementsOfType(element_type=code_block_30)
kind_3 = WallType.Kind(wallType=all_elements_of_type_3)
# note: collect all basic wall types (even if instances not placed)
code_block_31 = CodeBlock(kind=kind_3) { kind=="Basic"; }
filterByBoolMask_11 = List.FilterByBoolMask(list=all_elements_of_type_3, mask=code_block_31)
code_block_32 = CodeBlock(wTypes=filterByBoolMask_11.in) { wTypes.Name; }
code_block_33 = CodeBlock(wTypes=clear_list_2) { wTypes.Name; }

# group: Filtering
# note: Filter the wall types in the host model that match the wall types in the linked model (match by type name)
eq_2 = code_block_32 == code_block_33  # lacing=CrossProduct
anyTrue_2 = Orchid.Common.List.AnyTrue(list=eq_2@L2)
filterByBoolMask_12 = List.FilterByBoolMask(list=filterByBoolMask_11.in, mask=anyTrue_2)

# group: Filtering
code_block_34 = CodeBlock(wTypes=filterByBoolMask_12.in) { wTypes.Name; }
# note: Filter the wall types in the host model that match the wall types in the linked model (match by type name)
eq_3 = code_block_33 == code_block_34  # lacing=CrossProduct
anyTrue_3 = Orchid.Common.List.AnyTrue(list=eq_3@L2)
filterByBoolMask_13 = List.FilterByBoolMask(list=clear_list_2, mask=anyTrue_3)

# group: Control
# note: Sort walls by type name
code_block_35 = CodeBlock(wTypes=filterByBoolMask_12.in) { wTypes.Name; }
sortByKey_2 = List.SortByKey(list=filterByBoolMask_12.in, keys=code_block_35)
code_block_36 = CodeBlock(wTypes=filterByBoolMask_13.in) { wTypes.Name; "Type Mark"; }
sortByKey_3 = List.SortByKey(list=filterByBoolMask_13.in, keys=code_block_36.out0)
getParameterValueByName_4 = Element.GetParameterValueByName(element=sortByKey_3.sortedList, parameterName=code_block_36.out1)
setParameterByName = Element.SetParameterByName(element=sortByKey_2.sortedList, parameterName=code_block_36.out1, value=getParameterValueByName_4)

# group: Filtering
getParameterValueByName_5 = Element.GetParameterValueByName(element=setParameterByName, parameterName=code_block_24.parameterName)
# note: Filter wall types by certain parameter
contains_6 = String.Contains(string=getParameterValueByName_5, searchFor=code_block_24.parameterValue)
filterByBoolMask_14 = List.FilterByBoolMask(list=setParameterByName, mask=contains_6)

code_block_37 = CodeBlock(existingWType=type, newWType=filterByBoolMask_14.in) { existingWType.Name; newWType.Name; }

# group: Control
eq_4 = code_block_37.out0 == code_block_37.out1  # lacing=CrossProduct
# note: Check if the walls types are not already existing in the view
transpose_2 = List.Transpose(lists=eq_4)
anyTrue_4 = Orchid.Common.List.AnyTrue(list=transpose_2@@L2)
filterByBoolMask_15 = List.FilterByBoolMask(list=filterByBoolMask_14.in, mask=anyTrue_4)

count_3 = List.Count(list=filterByBoolMask_15.out)

# group: Processing
lastItem = List.LastItem(list=filterByBoolMask_6.out)
ofRepeatedItem_3 = List.OfRepeatedItem(item=lastItem, amount=count_3)
# note: Create placeholders walls for linked types
list_create_3 = List.Create(item0=sortByKey.sortedList, item1=ofRepeatedItem_3)
flatten_7 = List.Flatten(list=list_create_3)

# group: Processing
X = Point.X(point=translate)
count_4 = List.Count(list=flatten_7)
code_block_38 = CodeBlock(count=count_4) { rows=count/4; rowsTotal=DSCore.Math.Ceiling(rows); leftover=(rowsTotal*4-count)*-1; }
code_block_39 = CodeBlock(rowsTotal=code_block_38.rowsTotal) { (0..3)*1750; (0..(rowsTotal-1))*1350; }
add = X + code_block_39.out0  # lacing=Longest
Y = Point.Y(point=translate)
sub = Y - code_block_39.out1  # lacing=Longest
Z = Point.Z(point=translate)
byCoordinates = Point.ByCoordinates(x=add, y=sub, z=Z, lacing=CrossProduct)
flatten_8 = List.Flatten(list=byCoordinates)
Y_2 = Point.Y()  # unwired: point
groupByFunction = List.GroupByFunction(list=flatten_8, groupFunction=Y_2)
X_2 = Point.X()  # unwired: point
sortByFunction = List.SortByFunction(list=groupByFunction@L2, sortFunction=X_2)
flatten_9 = List.Flatten(list=sortByFunction)
# note: Generate starting points for the wall instances
dropItems = List.DropItems(list=flatten_9, amount=code_block_38.leftover)

# group: Input
code_block_40 = CodeBlock { 1350; }
code_block_41 = CodeBlock { -850; }
code_block_42 = CodeBlock(verticalDisttanceBetweenWallPieces=code_block_40, wallPiecesLength=code_block_41) { verticalDisttanceBetweenWallPieces; wallPiecesLength; halfLength=wallPiecesLength/2; }

# group: Processing
# note: Generate point for the wall instances
translate_2 = Geometry.Translate(geometry=dropItems, yTranslation=code_block_42.wallPiecesLength)

# group: Visualisation
byStartPointEndPoint = Line.ByStartPointEndPoint(startPoint=dropItems, endPoint=translate_2)
code_block_43 = CodeBlock { 3000; }
# note: Create wall instances
byCurveAndHeight = Wall.ByCurveAndHeight(curve=byStartPointEndPoint, height=code_block_43, level=getLevelByName, wallType=flatten_7)

end_2 = Revit.Transaction.Transaction.End(input=byCurveAndHeight)

# group: Control
code_block_44 = CodeBlock { "Type Mark"; }
# note: Sort walls by type mark value
getParameterValueByName_6 = Element.GetParameterValueByName(element=filterByBoolMask_15.out, parameterName=code_block_44)
sortByKey_4 = List.SortByKey(list=filterByBoolMask_15.out, keys=getParameterValueByName_6)

# group: Control - replace placeholder's wall type with wall type from linked model
count_5 = List.Count(list=end_2)
# note: Collect placeholder walls
code_block_45 = CodeBlock(countAll=count_5, countLinked=count_3) { countNative=countAll-countLinked; countNative..(countAll-1); }
getItemAtIndex = List.GetItemAtIndex(list=end_2, index=code_block_45.out1)
code_block_46 = CodeBlock { "Type"; }
setParameterByName_2 = Element.SetParameterByName(element=getItemAtIndex, parameterName=code_block_46, value=sortByKey_4.sortedList, lacing=Longest)

# group: Control
await_3 = Orchid.Common.DataStream.Await(pass=end_2, waitFor=setParameterByName_2)
end_3 = Revit.Transaction.Transaction.End(input=await_3)

# group: Processing
flatten_10 = List.Flatten(list=end_3)
types_3 = Custom[Element.Types+](element=flatten_10)  # Gets types from linked elements too. From Clockworks
compoundStructureLayers = Custom[Element.CompoundStructureLayers](elementsType=types_3)  # From Clockworks. Widths not working in mm
code_block_47 = CodeBlock(value=compoundStructureLayers.widths) { value==0?null:value; }
# note: remove any 0 layers
clear_list_3 = Custom[Clear List](input=code_block_47)
code_block_48 = CodeBlock(wall=end_3) { "Width"; wall.GetLocation(); }
getParameterValueByName_7 = Element.GetParameterValueByName(element=types_3, parameterName=code_block_48.out0)
code_block_49 = CodeBlock(wdth=getParameterValueByName_7) { (wdth/2)-1; }
# note: external face of wall line (-1mm)
translate_3 = Geometry.Translate(geometry=code_block_48.out1, xTranslation=code_block_49)
startPoint_2 = Curve.StartPoint(curve=translate_3)

# group: Processing
count_6 = List.Count(list=clear_list_3@@L2)
code_block_50 = CodeBlock { 0; }
dropLastItem = Custom[List.DropLastItem](list=clear_list_3@L2)  # package Clockwork for Dynamo 1.x; Drops the last item from a given list.
addItemToFront = List.AddItemToFront(item=code_block_50, list=dropLastItem@L2)

# group: Control
ofRepeatedItem_4 = List.OfRepeatedItem(item=end_3@@L1, amount=count_6@L2)
code_block_51 = CodeBlock { 1; }
flatten_11 = List.Flatten(list=ofRepeatedItem_4, amount=code_block_51)

# group: Processing
# note: Create offset distances for the detail lines
code_block_52 = CodeBlock(count=count_6) { 0; 1..count; }
slice = List.Slice(list=addItemToFront@L2, start=code_block_52.out0, end=code_block_52.out1@L2)
sum = Math.Sum(values=slice)
code_block_53 = CodeBlock(wdth=sum) { wdth*(-1); }
code_block_54 = CodeBlock(count=code_block_52.out1, tagSpacing=code_block_24.tagSpacing) { (count*tagSpacing*(-1))-tagSpacing; }
# note: location point for the material tags
translate_4 = Geometry.Translate(geometry=startPoint_2, xTranslation=code_block_53, yTranslation=code_block_54)

# group: Visualisation
code_block_55 = CodeBlock { true; }
create_tag = Custom[Create Tag](view=activeView, element=flatten_11@L2, TagLocation=translate_4@L2, TagType=code_block_24.materialTag, RunIt=code_block_55)  # package Genius Loci; Works only in Revit 2018 and later. Creates a tag at a given location, of given type and in a supplied view. The node also works with Linked Elements (except space and area), Multi Category tag and Material Tag. Based on an archilab node

# group: Assing
code_block_56 = CodeBlock { "Leader Line"; 1; }
setParameterByName_3 = Element.SetParameterByName(element=create_tag, parameterName=code_block_56.out0, value=code_block_56.out1)

# group: Control
end_4 = Revit.Transaction.Transaction.End(input=setParameterByName_3)

# group: Processing
code_block_57 = CodeBlock { 4; }
chop = List.Chop(list=end_4, lengths=code_block_57)
transpose_3 = List.Transpose(lists=chop)
isNull = Object.IsNull(object=transpose_3@L3)
filterByBoolMask_16 = List.FilterByBoolMask(list=transpose_3, mask=isNull)

# group: Processing
X_3 = Point.X(point=startPoint)
code_block_58 = CodeBlock { columns=0..3; (1750*columns)+820; }
add_2 = X_3 + code_block_58.out1  # lacing=Longest

# group: Processing
code_block_59 = CodeBlock { 4; }
chop_2 = List.Chop(list=create_tag, lengths=code_block_59)
transpose_4 = List.Transpose(lists=chop_2)
isNull_2 = Object.IsNull(object=transpose_4@L3)
filterByBoolMask_17 = List.FilterByBoolMask(list=transpose_4, mask=isNull_2)
tag_getlocation = Custom[Tag GetLocation](tag=filterByBoolMask_17.out@@L2)  # package Genius Loci; Retrieves the position of the head of tag.
Y_3 = Point.Y(point=tag_getlocation)
Z_2 = Point.Z(point=tag_getlocation)
byCoordinates_2 = Point.ByCoordinates(x=add_2@@L1, y=Y_3@L3, z=Z_2@L3, lacing=Shortest)

# group: Assing
flatten_12 = List.Flatten(list=filterByBoolMask_16.out)
flatten_13 = List.Flatten(list=byCoordinates_2)
tag_setlocation = Custom[Tag SetLocation](tag=flatten_12, location=flatten_13)  # package Genius Loci; Moves the head of the tag to the given location point.

# group: Assing
code_block_60 = CodeBlock { "Phase Created"; "Phase Demolished"; "Library"; "Existing"; }
getPhaseByName = Custom[Tool.GetPhaseByName](PhaseName=code_block_60.out2)  # package SteamNodes; Get Document Phases by String
# note: Assign Phases
setParameterByName_4 = Element.SetParameterByName(element=end_3, parameterName=code_block_60.out0, value=getPhaseByName.Phase, lacing=Longest)
getPhaseByName_2 = Custom[Tool.GetPhaseByName](PhaseName=code_block_60.out3)
setParameterByName_5 = Element.SetParameterByName(element=setParameterByName_4, parameterName=code_block_60.out1, value=getPhaseByName_2.Phase, lacing=Longest)

# group: Processing
X_4 = Point.X(point=startPoint)
count_7 = List.Count(list=flatten_7)
code_block_61 = CodeBlock(count=count_7) { rows=count/4; rowsTotal=DSCore.Math.Ceiling(rows); leftover=(rowsTotal*4-count)*-1; }
code_block_62 = CodeBlock(rowsTotal=code_block_61.rowsTotal) { (0..3)*1750; (0..(rowsTotal-1))*1350; }
add_3 = X_4 + code_block_62.out0  # lacing=Longest
Y_4 = Point.Y(point=startPoint)
sub_2 = Y_4 - code_block_62.out1  # lacing=Longest
Z_3 = Point.Z(point=startPoint)
byCoordinates_3 = Point.ByCoordinates(x=add_3, y=sub_2, z=Z_3, lacing=CrossProduct)
flatten_14 = List.Flatten(list=byCoordinates_3)
Y_5 = Point.Y()  # unwired: point
groupByFunction_2 = List.GroupByFunction(list=flatten_14, groupFunction=Y_5)
X_5 = Point.X()  # unwired: point
sortByFunction_2 = List.SortByFunction(list=groupByFunction_2@L2, sortFunction=X_5)
flatten_15 = List.Flatten(list=sortByFunction_2)
# note: Generate starting points for the Detail Items
dropItems_2 = List.DropItems(list=flatten_15, amount=code_block_61.leftover)

code_block_63 = CodeBlock { true; }

# group: Visualisation
create_tag_2 = Custom[Create Tag](view=activeView, element=end_3, TagLocation=dropItems_2, TagType=code_block_24.wallTag, RunIt=code_block_63)

# group: Input
current_2 = Document.Current()
activeView_2 = Document.ActiveView(document=current_2)

# group: Control
runMe_4 = Custom[Tool.RunMe](Boolean=code_block_24.withDimensions, ThingToDo=end_3)

# group: Filtering
flatten_16 = List.Flatten(list=runMe_4)
faces = Element.Faces(element=flatten_16)
types_4 = Custom[Element.Types+](element=flatten_16)
compoundStructureLayers_2 = Custom[Element.CompoundStructureLayers](elementsType=types_4)

# group: Processing
code_block_64 = CodeBlock { 0; }
pointAtParameter = Surface.PointAtParameter(surface=faces, u=code_block_64, v=code_block_64)
X_6 = Point.X(point=pointAtParameter)
sort = List.Sort(list=X_6@@L2)
firstItem = List.FirstItem(list=sort@L2)
Y_6 = Point.Y(point=pointAtParameter)
sort_2 = List.Sort(list=Y_6@@L2)
reverse = List.Reverse(list=sort_2@@L2)
firstItem_2 = List.FirstItem(list=reverse@L2)
Z_4 = Point.Z(point=pointAtParameter)
sort_3 = List.Sort(list=Z_4@@L2)
firstItem_3 = List.FirstItem(list=sort_3@L2)
byCoordinates_4 = Point.ByCoordinates(x=firstItem, y=firstItem_2, z=firstItem_3)
# note: length of line(s)
code_block_65 = CodeBlock { 75; }
# note: Create detail lines for dimensioning
translate_5 = Geometry.Translate(geometry=byCoordinates_4, yTranslation=code_block_65)
byStartPointEndPoint_2 = Line.ByStartPointEndPoint(startPoint=byCoordinates_4, endPoint=translate_5)

# group: Control
# note: remove any 0 layers
reverse_2 = List.Reverse(list=compoundStructureLayers_2.widths@@L2)
code_block_66 = CodeBlock(value=reverse_2) { value==0?null:value; }
clear_list_4 = Custom[Clear List](input=code_block_66)

# group: Processing
count_8 = List.Count(list=clear_list_4@@L2)
# note: Create offset distances for the detail lines
code_block_67 = CodeBlock(count=count_8) { 0; 1..count; }
slice_2 = List.Slice(list=clear_list_4@L2, start=code_block_67.out0, end=code_block_67.out1@L2)
sum_2 = Math.Sum(values=slice_2)

# group: Processing
# note: duplicate the lines
translate_6 = Geometry.Translate(geometry=byStartPointEndPoint_2, xTranslation=sum_2)
addItemToFront_2 = List.AddItemToFront(item=byStartPointEndPoint_2@@L1, list=translate_6@L2)

# group: Visualisation
# note: create the actual detail lines
byCurve = DetailCurve.ByCurve(view=activeView_2, curve=addItemToFront_2)

# group: Visualisation
# note: create dimensions
byElements = Dimension.ByElements(view=activeView_2, referenceElements=byCurve)

# group: Control
code_block_68 = CodeBlock { "Views - Generate Spec Views - Walls"; }
acg_script_usage = Custom[ACG Script Usage](scriptName=code_block_68)  # Adds an entry to Excel document every time a script is run. The document is located in S:\Dynamo\05-UsageStats
