# Dynamo graph Delete Hidden Filled Regions.dyn "Views - Delete Hidden Filled Regions_py" (Dynamo 2.12.1.8246)
# packages: Data-Shapes 2021.2.92, Orchid 260.1.0.7729

# group: Usage
code_block = CodeBlock { "Views - Delete Hidden Filled Regions"; }
acg_script_usage = Custom[ACG Script Usage](scriptName=code_block)  # Adds an entry to Excel document every time a script is run. The document is located in S:\Dynamo\05-UsageStats

# group: Input
code_block_2 = CodeBlock { "Note:"; }
string = StringInput("This tool will delete all hidden filled regions in the model. This applies for elements that were hidden on an instance basis. Elements hidden by category or by a view filter will be ignored.")
textnote_data = Custom[TextNote Data](Title=code_block_2, TextNote=string)  # package Data-Shapes; Create Data for TextNote input in UI.MultipleInputForm ++ . Check out www.data-shapes.net for more informations

# group: Input
file_path = Filename("..\ACG_logo.png")
file_from_path = FileObject(path=file_path)
readFromFile = Image.ReadFromFile(file=file_from_path)
code_block_3 = CodeBlock { "Update accomodation schedule"; true; "Run"; "Cancel"; 700; 400; }
list_create = List.Create(item0=textnote_data)
multipleinputform = Custom[MultipleInputForm ++](Logo_optional=readFromFile, ButtonText_optional=code_block_3.out2, Inputs=list_create, Toggle=code_block_3.out1, CancelButtonText_optional=code_block_3.out3, Width_optional=code_block_3.out4, LabelWidth_optional=code_block_3.out5)  # package Data-Shapes; Create a form with multiple inputs. see www.data-shapes.net for tutorials and infos!

# group: Visualisation
python_script = Python(IN[0]=multipleinputform.Was_Cancelled)  # IronPython2
# ---------- python_script.python (56 lines) ----------
# Load the Python Standard and DesignScript Libraries
import clr
import sys
sys.path.append('C:\Program Files (x86)\IronPython 2.7\Lib')
import System
from System import Array
from System.Collections.Generic import *
clr.AddReference('ProtoGeometry')
from Autodesk.DesignScript.Geometry import *
clr.AddReference("RevitNodes")
import Revit
clr.ImportExtensions(Revit.Elements)
clr.ImportExtensions(Revit.GeometryConversion)
clr.AddReference("RevitServices")
import RevitServices
from RevitServices.Persistence import DocumentManager 
from RevitServices.Transactions import TransactionManager 

clr.AddReference("RevitAPI")
clr.AddReference("RevitAPIUI")

import Autodesk 
from Autodesk.Revit.DB import *
from Autodesk.Revit.UI import *

doc = DocumentManager.Instance.CurrentDBDocument
uiapp = DocumentManager.Instance.CurrentUIApplication 
app = uiapp.Application 
uidoc = uiapp.ActiveUIDocument

cancelled = IN[0]


if cancelled == False:
	# get all Filled Regions in the model
	fRegions = FilteredElementCollector(doc).OfClass(FilledRegion).ToElements()

	count = 0
	ids = []

	TransactionManager.Instance.EnsureInTransaction(doc)
	for fr in fRegions:
		ownerViewId = fr.OwnerViewId
		hidden = fr.IsHidden(doc.GetElement(ownerViewId))
		if hidden == True:
			try:
				doc.Delete(fr.Id)
				count += 1
				ids.append(fr.Id)
			except:
				continue
		
	TransactionManager.Instance.TransactionTaskDone()
	if count == 0: OUT = "Success ! ", "Excellent! There were no hidden filled regions in the model."
	else: OUT = 'Success ! ', str(count) + ' hidden filled regions were deleted.'
else: OUT = 'Error : ', 'The script was cancelled.'
# ----------------------------------------
code_block_4 = CodeBlock(x=python_script) { "Okay"; true; title = x[0]; text = x[1]; }

# group: Assing
ui_textnote_data = Custom[UI.TextNote Data](Title=code_block_4.title, TextNote=code_block_4.text)  # package Data-Shapes; Create Data for TextNote input in UI.MultipleInputForm ++ . Check out www.data-shapes.net for more informations
await_ = Orchid.Common.DataStream.Await(pass=code_block_4.out1, waitFor=python_script)
ui_multipleinputform = Custom[UI.MultipleInputForm ++](ButtonText_optional=code_block_4.out0, Inputs=ui_textnote_data, Toggle=await_)  # package Data-Shapes; Create a form with multiple inputs. see www.data-shapes.net for tutorials and infos!

code_block_5 = CodeBlock { false; }
