# Dynamo graph Delete Unused Filters_d.dyn "Views - Delete Unused Filters" (Dynamo 2.12.1.8246)
# packages: Data-Shapes 2021.2.92, BVN 1.6.1

# group: Control
code_block = CodeBlock { "Views - Delete Unused Filters"; }
acg_script_usage = Custom[ACG Script Usage](scriptName=code_block)  # Adds an entry to Excel document every time a script is run. The document is located in S:\Dynamo\05-UsageStats

code_block_2 = CodeBlock { true; }
getUnused = Custom[Filter.GetUnused](toggle=code_block_2)  # package BVN; Returns all unused filters in the project so that they can be used. Use in conjunction with 'Tool.Eraser' from the SteamNodes package or 'Delete.Elements' from Grimshaw package.
code_block_3 = CodeBlock(e=getUnused) { e.Name; "\n"; }
join = String.Join(separator=code_block_3.out1, string0=code_block_3.out0)

# group: Input
file_path = Filename("..\ACG_logo.png")
file_from_path = FileObject(path=file_path)
readFromFile = Image.ReadFromFile(file=file_from_path)
code_block_4 = CodeBlock { "List of deleted filters:"; true; "Ok"; }
textnote_data = Custom[TextNote Data](Title=code_block_4.out0, TextNote=join)  # package Data-Shapes; Create Data for TextNote input in UI.MultipleInputForm ++ . Check out www.data-shapes.net for more informations
multipleinputform = Custom[MultipleInputForm ++](Logo_optional=readFromFile, ButtonText_optional=code_block_4.out2, Inputs=textnote_data, Toggle=code_block_2)  # package Data-Shapes; Create a form with multiple inputs. see www.data-shapes.net for tutorials and infos!

delete = Element.Delete(element=getUnused)
