# Dynamo graph Delete Unused Templates.dyn "Views - Delete Unused Templates_py" (Dynamo 2.12.1.8246)
# packages: Data-Shapes 2021.2.92

# group: Control
code_block = CodeBlock { "Views - Delete Unused Templates"; }
acg_script_usage = Custom[ACG Script Usage](scriptName=code_block)  # Adds an entry to Excel document every time a script is run. The document is located in S:\Dynamo\05-UsageStats

# group: Visualisation
python_script = Python()  # IronPython2
# ---------- python_script.python (58 lines) ----------
# Load the Python Standard and DesignScript Libraries
import clr
import sys
import os.path
from datetime import datetime
from System import Environment
sys.path.append('C:\Program Files (x86)\IronPython 2.7\Lib')
import System
from System import Array
from System.Collections.Generic import *
clr.AddReference('ProtoGeometry')
from Autodesk.DesignScript.Geometry import *
clr.AddReference("RevitNodes")
import Revit
clr.ImportExtensions(Revit.Elements)
clr.ImportExtensions(Revit.GeometryConversion)
clr.AddReference("RevitServices")
import RevitServices
from RevitServices.Persistence import DocumentManager 
from RevitServices.Transactions import TransactionManager 

clr.AddReference("RevitAPI")
clr.AddReference("RevitAPIUI")

import Autodesk 
from Autodesk.Revit.DB import *
from Autodesk.Revit.UI import *
import time

doc = DocumentManager.Instance.CurrentDBDocument
uiapp = DocumentManager.Instance.CurrentUIApplication 
app = uiapp.Application 
uidoc = uiapp.ActiveUIDocument

viewCol = FilteredElementCollector(doc).OfClass(View).WhereElementIsNotElementType().ToElements()

allTemplates = []
allViews = []
usedIds = []
notUsedIds = []
notUsedNames = []

for v in viewCol:
	if v.IsTemplate:
		allTemplates.append(v)
	else:
		allViews.append(v)
		
for view in allViews:
	if view.ViewTemplateId not in usedIds:
		usedIds.append(view.ViewTemplateId)
			
for vt in allTemplates:
	if vt.Id not in usedIds:
		notUsedIds.append(vt.Id)
		notUsedNames.append(vt.Name)	
			
OUT = notUsedNames, notUsedIds
# ----------------------------------------
code_block_2 = CodeBlock(x=python_script) { names = x[0]; ids = x[1]; }

# group: Input
file_path = Filename("..\ACG_logo.png")
file_from_path = FileObject(path=file_path)
readFromFile = Image.ReadFromFile(file=file_from_path)
code_block_3 = CodeBlock { "Delete"; "Cancel"; 700; 250; true; }
code_block_4 = CodeBlock { "Delete unused View Templates"; 700; false; }
listview_data = Custom[Listview Data](InputName=code_block_4.out0, Keys=code_block_2.names, Values=code_block_2.ids, Height_optionnal=code_block_4.out1, ShowId_optionnal=code_block_4.out2)  # package Data-Shapes; Create data for ListView input in UI.MultiInputForm ++ . Check out www.data-shapes.net for more infos.
# note: Custom Node: Data-Shapes v.2018.12.1
ui_multipleinputform = Custom[UI.MultipleInputForm ++](Logo_optional=readFromFile, ButtonText_optional=code_block_3.out0, Inputs=listview_data, Toggle=code_block_3.out4, CancelButtonText_optional=code_block_3.out1, Width_optional=code_block_3.out2, LabelWidth_optional=code_block_3.out3)  # package Data-Shapes; Create a form with multiple inputs. see www.data-shapes.net for tutorials and infos!

# group: Visualisation
python_script_2 = Python(IN[0]=ui_multipleinputform.Was_Cancelled, IN[1]=ui_multipleinputform.User_Inputs)  # IronPython2
# ---------- python_script_2.python (42 lines) ----------
# Load the Python Standard and DesignScript Libraries
import clr
import sys
import os.path
from datetime import datetime
from System import Environment
sys.path.append('C:\Program Files (x86)\IronPython 2.7\Lib')
import System
from System import Array
from System.Collections.Generic import *
clr.AddReference('ProtoGeometry')
from Autodesk.DesignScript.Geometry import *
clr.AddReference("RevitNodes")
import Revit
clr.ImportExtensions(Revit.Elements)
clr.ImportExtensions(Revit.GeometryConversion)
clr.AddReference("RevitServices")
import RevitServices
from RevitServices.Persistence import DocumentManager 
from RevitServices.Transactions import TransactionManager 

clr.AddReference("RevitAPI")
clr.AddReference("RevitAPIUI")

import Autodesk 
from Autodesk.Revit.DB import *
from Autodesk.Revit.UI import *
import time

doc = DocumentManager.Instance.CurrentDBDocument
uiapp = DocumentManager.Instance.CurrentUIApplication 
app = uiapp.Application 
uidoc = uiapp.ActiveUIDocument

cancelled = IN[0]
ids = IN[1][0]

if not cancelled:
	TransactionManager.Instance.EnsureInTransaction(doc)
	for i in ids:
		doc.Delete(i)
	TransactionManager.Instance.TransactionTaskDone()		
# ----------------------------------------
