# Dynamo graph Duplicate Schedules.dyn "Views - Duplicate Schedules" (Dynamo 2.6.1.8786)
# packages: archi-lab.net 2021.25.2521, Data-Shapes 2021.2.92

file_path = Filename("..\ACG_logo.png")
file_from_path = FileObject(path=file_path)
readFromFile = Image.ReadFromFile(file=file_from_path)

# group: Input
code_block = CodeBlock { true; "Duplicate"; "Cancel"; 250; 700; }
code_block_2 = CodeBlock { "Schedule"; "Select schedules to duplicate"; 400; false; }
getByType = archilab.Revit.Views.Views.GetByType(viewType=code_block_2.out0)
code_block_3 = CodeBlock(e=getByType) { e.Name; "<Revision"; }
startsWith = String.StartsWith(str=code_block_3.out0, searchFor=code_block_3.out1)
filterByBoolMask = List.FilterByBoolMask(list=getByType, mask=startsWith)
code_block_4 = CodeBlock(e=filterByBoolMask.out) { e.Name; }
sortByKey = List.SortByKey(list=filterByBoolMask.out, keys=code_block_4)
listview_data = Custom[Listview Data](InputName=code_block_2.out1, Keys=sortByKey.sorted_keys, Values=sortByKey.sorted_list, Height_optionnal=code_block_2.out2, ShowId_optionnal=code_block_2.out3)  # package Data-Shapes; Create data for ListView input in UI.MultiInputForm ++ . Check out www.data-shapes.net for more infos.
code_block_5 = CodeBlock { "Number of copies"; "1"; true; }
textbox_data = Custom[TextBox Data](InputName=code_block_5.out0, DefaultText=code_block_5.out1, IsNumberEntry=code_block_5.out2)  # package Data-Shapes; Create Data for TextBox input in UI.MultipleInputForm ++ . Check out www.data-shapes.net for more informations
list_create = List.Create(item0=listview_data, item1=textbox_data)
multipleinputform = Custom[MultipleInputForm ++](Logo_optional=readFromFile, ButtonText_optional=code_block.out1, Inputs=list_create, Toggle=code_block.out0, CancelButtonText_optional=code_block.out2, Width_optional=code_block.out4, LabelWidth_optional=code_block.out3)  # package Data-Shapes; Create a form with multiple inputs. see www.data-shapes.net for tutorials and infos!
code_block_6 = CodeBlock(x=multipleinputform.User_Inputs) { schedules=x[0]; numberCopies=x[1]; }

code_block_7 = CodeBlock(sch=code_block_6.schedules) { DSCore.List.Count(sch); sch.Name; }
ofRepeatedItem = List.OfRepeatedItem(item=code_block_7.out1, amount=code_block_7.out0)
code_block_8 = CodeBlock(n=code_block_6.numberCopies) { 1..n; "."; }
string_from_object = FromObject(obj=code_block_8.out0)
split = String.Split(str=string_from_object, separator0=code_block_8.out1)
firstItem = List.FirstItem(list=split@@L2)
code_block_9 = CodeBlock(index=firstItem) { "_"+index; }
code_block_10 = CodeBlock(name=ofRepeatedItem, numbers=code_block_9) { name+numbers; "Duplicate"; }
transpose = List.Transpose(lists=code_block_10.out0)
duplicate = archilab.Revit.Views.Views.Duplicate(view=code_block_6.schedules, name=transpose, options=code_block_10.out1)

# group: Usage
code_block_11 = CodeBlock { "Duplicate Schedules"; }
acg_script_usage = Custom[ACG Script Usage](scriptName=code_block_11)  # Adds an entry to Excel document every time a script is run. The document is located in S:\Dynamo\05-UsageStats
