# Dynamo graph Isolate Overwritten Elements.dyn "Views - Isolate Overwritten Elements" (Dynamo 2.12.1.8246)
# packages: Genius Loci 2021.2.3, archi-lab.net 2022.210.2522, Data-Shapes 2021.2.92, Orchid 260.1.0.7729

# group: Input
all_elements_in_active_view = ElementsInView()
current = Document.Current()
activeView = Document.ActiveView(document=current)

# group: Input
code_block = CodeBlock { "Note:"; }
string = StringInput("This tool will isolate all the elements in the active view who's graphics have been overwritten. This applies only for Overwrites By Element (EOD) and does not include overwrites by View Filters.")
textnote_data = Custom[TextNote Data](Title=code_block, TextNote=string)  # package Data-Shapes; Create Data for TextNote input in UI.MultipleInputForm ++ . Check out www.data-shapes.net for more informations

# group: Input
file_path = Filename("..\ACG_logo.png")
file_from_path = FileObject(path=file_path)
readFromFile = Image.ReadFromFile(file=file_from_path)
code_block_2 = CodeBlock { "Update accomodation schedule"; true; "Run"; "Cancel"; 700; 400; }
ui_multipleinputform = Custom[UI.MultipleInputForm ++](Logo_optional=readFromFile, ButtonText_optional=code_block_2.out2, Inputs=textnote_data, Toggle=code_block_2.out1, CancelButtonText_optional=code_block_2.out3, Width_optional=code_block_2.out4, LabelWidth_optional=code_block_2.out5)  # package Data-Shapes; Create a form with multiple inputs. see www.data-shapes.net for tutorials and infos!

await_ = Orchid.Common.DataStream.Await(pass=all_elements_in_active_view, waitFor=ui_multipleinputform.User_Inputs)
get_elements_overrides = Custom[Get Elements Overrides](view=activeView, element=await_)  # package Genius Loci; Get the overrides applied to the elements in the given View. Note : Prior to Revit 2019, the materials have only one surface pattern and one cut pattern.

# group: Processing - Projection Lines
code_block_3 = CodeBlock(patternV=get_elements_overrides.ProjectionLinePattern, colorV=get_elements_overrides.ProjectionLineColor, weightV=get_elements_overrides.ProjectionLineWeight) { patternV==null; colorV==null; weightV==-1; }
filterByBoolMask = List.FilterByBoolMask(list=await_, mask=code_block_3.out0)
filterByBoolMask_2 = List.FilterByBoolMask(list=await_, mask=code_block_3.out1)
filterByBoolMask_3 = List.FilterByBoolMask(list=await_, mask=code_block_3.out2)

# group: Processing - Cut Lines
code_block_4 = CodeBlock(patternV=get_elements_overrides.CutLinePattern, colorV=get_elements_overrides.CutLineColor, weightV=get_elements_overrides.CutLineWeight) { patternV==null; colorV==null; weightV==-1; }
filterByBoolMask_4 = List.FilterByBoolMask(list=await_, mask=code_block_4.out0)
filterByBoolMask_5 = List.FilterByBoolMask(list=await_, mask=code_block_4.out1)
filterByBoolMask_6 = List.FilterByBoolMask(list=await_, mask=code_block_4.out2)

# group: Processing - Surface Overrides
code_block_5 = CodeBlock(patternF=get_elements_overrides.SurfaceForegroundPattern, colorF=get_elements_overrides.SurfaceForegroundPatternColor, patternB=get_elements_overrides.SurfaceBackgroundPattern, colorB=get_elements_overrides.SurfaceBackgroundPatternColor) { patternF==null; colorF==null; patternB==null; colorB==null; }
filterByBoolMask_7 = List.FilterByBoolMask(list=await_, mask=code_block_5.out0)
filterByBoolMask_8 = List.FilterByBoolMask(list=await_, mask=code_block_5.out1)
filterByBoolMask_9 = List.FilterByBoolMask(list=await_, mask=code_block_5.out2)
filterByBoolMask_10 = List.FilterByBoolMask(list=await_, mask=code_block_5.out3)

# group: Processing - Cut Overrides
code_block_6 = CodeBlock(patternF=get_elements_overrides.CutForegroundPattern, colorF=get_elements_overrides.CutForegroundPatternColor, patternB=get_elements_overrides.CutBackgroundPattern, colorB=get_elements_overrides.CutBackgroundPatternColor) { patternF==null; colorF==null; patternB==null; colorB==null; }
filterByBoolMask_11 = List.FilterByBoolMask(list=await_, mask=code_block_6.out0)
filterByBoolMask_12 = List.FilterByBoolMask(list=await_, mask=code_block_6.out1)
filterByBoolMask_13 = List.FilterByBoolMask(list=await_, mask=code_block_6.out2)
filterByBoolMask_14 = List.FilterByBoolMask(list=await_, mask=code_block_6.out3)

# group: Filtering - Transparency
code_block_7 = CodeBlock(value=get_elements_overrides.Transparency) { value==0; }
filterByBoolMask_15 = List.FilterByBoolMask(list=await_, mask=code_block_7)

# group: Filtering - Visibility
clear_list = Custom[Clear List](input=get_elements_overrides.Visible)  # package archi-lab.net; This node will remove all Null and Empty Lists from any list.
filterByBoolMask_16 = List.FilterByBoolMask(list=await_, mask=clear_list)

list_create = List.Create(item0=filterByBoolMask.out, item1=filterByBoolMask_2.out, item2=filterByBoolMask_3.out, item3=filterByBoolMask_4.out, item4=filterByBoolMask_5.out, item5=filterByBoolMask_6.out, item6=filterByBoolMask_7.out, item7=filterByBoolMask_8.out, item8=filterByBoolMask_9.out, item9=filterByBoolMask_10.out, item10=filterByBoolMask_11.out, item11=filterByBoolMask_12.out, item12=filterByBoolMask_13.out, item13=filterByBoolMask_14.out, item14=filterByBoolMask_15.out, item15=filterByBoolMask_16.out)

# group: Visualisation
flatten = List.Flatten(list=list_create)
uniqueItems = List.UniqueItems(list=flatten)
isolate_in_view = Custom[Isolate in View](element=uniqueItems, view=activeView)  # package archi-lab.net; This node will take input of elements and a view to isolate selected elements in a view.

# group: Usage
code_block_8 = CodeBlock { "Views - Isolate Overwritten Elements"; }
acg_script_usage = Custom[ACG Script Usage](scriptName=code_block_8)  # Adds an entry to Excel document every time a script is run. The document is located in S:\Dynamo\05-UsageStats
