# Dynamo graph Personal WIP Views.dyn "Views - Create Personal WIP Views_py" (Dynamo 2.12.1.8246)
# packages: Data-Shapes 2021.2.92

# group: Input
file_path = Filename("..\ACG_logo.png")  # frozen
file_from_path = FileObject(path=file_path)
readFromFile = Image.ReadFromFile(file=file_from_path)

# group: Usage
code_block = CodeBlock { "Views - Create Personal WIP Views"; }
acg_script_usage = Custom[ACG Script Usage](scriptName=code_block)  # Adds an entry to Excel document every time a script is run. The document is located in S:\Dynamo\05-UsageStats

# group: Input
code_block_2 = CodeBlock()
# ---------- code_block_2.designscript (8 lines) ----------
catL=Revit.Category.ByName("Levels");
allL=ElementQueries.OfCategory(catL);
allL.Id;
allL.Name;

"Select levels.";

false;
# ----------------------------------------
listview_data = Custom[Listview Data](InputName=code_block_2.out4, Keys=code_block_2.out3, Values=code_block_2.out2, ShowId_optionnal=code_block_2.out5)  # package Data-Shapes; Create data for ListView input in UI.MultiInputForm ++ . Check out www.data-shapes.net for more infos.

code_block_3 = CodeBlock(n=code_block_2.out3) { n; }
code_block_4 = CodeBlock(i=code_block_2.out2) { i; }
code_block_5 = CodeBlock { "Cancel"; true; "Create Views"; 700; 250; }

# group: Input
code_block_6 = CodeBlock { "Note:"; }
string = StringInput("""Does what is says on the tin!
For more information please refer to the Revit Tutorials channel on MS Stream.""")
ui_textnote_data = Custom[UI.TextNote Data](Title=code_block_6, TextNote=string)  # package Data-Shapes; Create Data for TextNote input in UI.MultipleInputForm ++ . Check out www.data-shapes.net for more informations

# group: Input
code_block_7 = CodeBlock { "Create Floor Plans."; "Create Reflected Ceiling Plans."; true; false; }
boolean_input = Custom[Boolean input](InputName=code_block_7.out0, DefaultValue=code_block_7.out2)  # package Data-Shapes; Creates a boolean input for UI.MultipleInputForm ++ . Check out www.data-shapes.net for more infos!
boolean_input_2 = Custom[Boolean input](InputName=code_block_7.out1, DefaultValue=code_block_7.out3)

# group: Input
code_block_8 = CodeBlock { "Enter initials."; "Enter Floor Plans descripton."; "Enter RCPs descripton."; }
textbox_data = Custom[TextBox Data](InputName=code_block_8.out0)  # package Data-Shapes; Create Data for TextBox input in UI.MultipleInputForm ++ . Check out www.data-shapes.net for more informations
textbox_data_2 = Custom[TextBox Data](InputName=code_block_8.out1)
textbox_data_3 = Custom[TextBox Data](InputName=code_block_8.out2)

list_create = List.Create(item0=ui_textnote_data, item1=listview_data, item2=boolean_input, item3=boolean_input_2, item4=textbox_data, item5=textbox_data_2, item6=textbox_data_3)
flatten = List.Flatten(list=list_create)
ui_multipleinputform = Custom[UI.MultipleInputForm ++](ButtonText_optional=code_block_5.out2, Inputs=flatten, Toggle=code_block_5.out1, CancelButtonText_optional=code_block_5.out0, Width_optional=code_block_5.out3, LabelWidth_optional=code_block_5.out4)  # package Data-Shapes; Create a form with multiple inputs. see www.data-shapes.net for tutorials and infos!
code_block_9 = CodeBlock(x=ui_multipleinputform.User_Inputs) { levels=x[0]; initials=x[3]; descriptionFP=x[4]; createFP=x[1]; createRCP=x[2]; descriptionRCP=x[5]; }

# group: Visualisation
python_script = Python(IN[0]=code_block_9.initials, IN[1]=code_block_9.createFP, IN[2]=code_block_9.descriptionFP, IN[3]=code_block_9.createRCP, IN[4]=code_block_9.descriptionRCP, IN[5]=code_block_9.levels)  # IronPython2
# ---------- python_script.python (99 lines) ----------
# Load the Python Standard and DesignScript Libraries
import clr
import sys
import os.path
from datetime import datetime
from System import Environment
sys.path.append('C:\Program Files (x86)\IronPython 2.7\Lib')
import System
from System import Array
from System.Collections.Generic import *
clr.AddReference('ProtoGeometry')
from Autodesk.DesignScript.Geometry import *
clr.AddReference("RevitNodes")
import Revit
clr.ImportExtensions(Revit.Elements)
clr.ImportExtensions(Revit.GeometryConversion)
clr.AddReference("RevitServices")
import RevitServices
from RevitServices.Persistence import DocumentManager 
from RevitServices.Transactions import TransactionManager 

clr.AddReference("RevitAPI")
clr.AddReference("RevitAPIUI")

import Autodesk 
from Autodesk.Revit.DB import *
from Autodesk.Revit.UI import *
import time

doc = DocumentManager.Instance.CurrentDBDocument
uiapp = DocumentManager.Instance.CurrentUIApplication 
app = uiapp.Application 
uidoc = uiapp.ActiveUIDocument

initial = IN[0]
runFP = IN[1]
descrFP = IN[2]
runRCP = IN[3]
descrRCP = IN[4]
levelIds = IN[5]

# the vireFamilyType Ids
allViewTypes = FilteredElementCollector(doc).OfClass(ViewFamilyType).ToElements()
viewTypeNames = [i.ToDSType(True).Name for i in allViewTypes]
viewTypeIds = [i.ToDSType(True).Id for i in allViewTypes]
FPtypeId, RCPtypeId = '', ''
for name, id in zip(viewTypeNames, viewTypeIds):
	if 'floor' in name or  'Floor' in name:
		FPtypeId = id
	if 'eiling' in name or 'RCP' in name:
		RCPtypeId = id


allViews = FilteredElementCollector(doc).OfClass(View).WhereElementIsNotElementType().ToElements()
existingViewNames = [i.Name for i in allViews]

fail = ''
passPlanIds, passRCPIds, floorPlans, RCPs = [], [], [], []

def createPlan(levelId, initial, descr, vTypeId):
	lvl = doc.GetElement(ElementId(levelId))
	lvlName = lvl.Name
	vName = 'WIP-' + lvlName + '-' + descr + '_' + initial
	v = ViewPlan.Create(doc, ElementId(vTypeId), ElementId(levelId))
	v.get_Parameter(BuiltInParameter.VIEW_NAME).Set(vName)
	v.LookupParameter('View Folder 1 (View type)').Set('01 - WIP')
	v.LookupParameter('View Folder 2').Set('WIP-' + initial)
	return v

if runFP:
	for lvlId in levelIds:
		lvl = doc.GetElement(ElementId(lvlId))
		lvlName = lvl.Name
		if 'WIP-' + lvlName + '-' + descrFP + '_' + initial not in existingViewNames:
			passPlanIds.append(lvlId)
		else:
			fail = fail + 'WIP-' + lvlName + '-' + descrFP + '_' + initial + '\n'

	TransactionManager.Instance.EnsureInTransaction(doc)
	floorPlans = [createPlan(lvlId, initial, descrFP, FPtypeId) for lvlId in passPlanIds]
	TransactionManager.Instance.TransactionTaskDone()		
	
if runRCP:	
	for lvlId in levelIds:
		lvl = doc.GetElement(ElementId(lvlId))
		lvlName = lvl.Name
		if 'WIP-' + lvlName + '-' + descrRCP + '_' + initial not in existingViewNames:
			passRCPIds.append(lvlId)	
		else:
			fail = fail + 'WIP-' + lvlName + '-' + descrFP + '_' + initial + '\n'
			
	TransactionManager.Instance.EnsureInTransaction(doc)			
	RCPs = [createPlan(lvlId, initial, descrRCP, RCPtypeId) for lvlId in passRCPIds]
	TransactionManager.Instance.TransactionTaskDone()	
	
if len(fail) > 0:
	OUT = 'List of view not created as they are already existing in the model : ', fail,
else:	
	OUT = 'Success ! ', str(len(floorPlans) + len(RCPs)) + ' views were created.'
# ----------------------------------------
code_block_10 = CodeBlock(x=python_script) { "Ok"; title = x[0]; text = x[1]; }

# group: Input
textnote_data = Custom[TextNote Data](Title=code_block_10.title, TextNote=code_block_10.text)  # package Data-Shapes; Create Data for TextNote input in UI.MultipleInputForm ++ . Check out www.data-shapes.net for more informations
code_block_11 = CodeBlock { true; }
multipleinputform = Custom[MultipleInputForm ++](ButtonText_optional=code_block_10.out0, Inputs=textnote_data, Toggle=code_block_11)  # package Data-Shapes; Create a form with multiple inputs. see www.data-shapes.net for tutorials and infos!
