# Dynamo graph Place View Aligned On Sheets_d.dyn "Views - Place On Sheets Aligned" (Dynamo 2.6.1.8786)
# packages: archi-lab.net 2021.25.2521, Rhythm 2021.1.1, Orchid 260.1.0.7729, Data-Shapes 2021.2.92, SteamNodes 1.2.3, RIE 2020.12.2

file_path = Filename("..\ACG_logo.png")
file_from_path = FileObject(path=file_path)
readFromFile = Image.ReadFromFile(file=file_from_path)

# group: Input
code_block = CodeBlock { true; "Run"; "Cancel"; 250; 700; }
string = StringInput("Note")
string_2 = StringInput("""This tool will:
1. Collect all Viewports placed on selected Sheets in models A and record their locations to a .csv file on the Desktop
2. Read the .csv file and place the Views with the same names on Sheets with the same numbers in model B in the same locations.

Please note, the Sheets and Views must be already transferred from model A to model B. You can use Transfer single for that.
""")
textnote_data = Custom[TextNote Data](Title=string, TextNote=string_2)  # package Data-Shapes; Create Data for TextNote input in UI.MultipleInputForm ++ . Check out www.data-shapes.net for more informations
code_block_2 = CodeBlock { "Export view locations"; }
boolean_input = Custom[Boolean input](InputName=code_block_2)  # package Data-Shapes; Creates a boolean input for UI.MultipleInputForm ++ . Check out www.data-shapes.net for more infos!
code_block_3 = CodeBlock { DSCore.Types.FindTypeByNameInAssembly("Viewport","RevitAPI"); }
all_elements_of_type = ElementsOfType(element_type=code_block_3)
type = archilab.Revit.Elements.Elements.Type(element=all_elements_of_type)
code_block_4 = CodeBlock(types=type) { input=DSCore.List.UniqueItems(types); input.Name; "Select Viewport type (optional)"; }
dropdown_data = Custom[DropDown Data](InputName=code_block_4.out2, Keys=code_block_4.out1, Values=code_block_4.input)  # package Data-Shapes; Create data for DropDown input in UI.MultiInputForm ++ . Check out www.data-shapes.net for more infos.
code_block_5 = CodeBlock()
# ---------- code_block_5.designscript (7 lines) ----------
catS=Revit.Category.ByName("Sheets");
allS=ElementQueries.OfCategory(catS);
"Sheet Number";
"Sheet Name";

"Select sheets";
400;
# ----------------------------------------
getParameterValueByName = Element.GetParameterValueByName(element=code_block_5.allS, parameterName=code_block_5.out2)
getParameterValueByName_2 = Element.GetParameterValueByName(element=code_block_5.allS, parameterName=code_block_5.out3)
code_block_6 = CodeBlock(number=getParameterValueByName, name=getParameterValueByName_2) { number+" - "+name; false; }
listview_data = Custom[Listview Data](InputName=code_block_5.out4, Keys=code_block_6.out0, Values=code_block_5.allS, Height_optionnal=code_block_5.out5, ShowId_optionnal=code_block_6.out1)  # package Data-Shapes; Create data for ListView input in UI.MultiInputForm ++ . Check out www.data-shapes.net for more infos.
list_create = List.Create(item0=textnote_data, item1=boolean_input, item2=dropdown_data, item3=listview_data)
multipleinputform = Custom[MultipleInputForm ++](Logo_optional=readFromFile, ButtonText_optional=code_block.out1, Inputs=list_create, Toggle=code_block.out0, CancelButtonText_optional=code_block.out2, Width_optional=code_block.out4, LabelWidth_optional=code_block.out3)  # package Data-Shapes; Create a form with multiple inputs. see www.data-shapes.net for tutorials and infos!
code_block_7 = CodeBlock(x=multipleinputform.User_Inputs) { sheets=x[2]; export=x[0]; viewportType=x[1]; }

# group: Input
code_block_8 = CodeBlock { "C:\\Users\\"; "\\Desktop\\ViewportLocation.csv"; }
userName = Python()  # "System.UserName"; unwired: IN[0]
# ---------- userName.python (3 lines) ----------
import clr
from System import Environment
OUT = Environment.UserName
# ----------------------------------------
code_block_9 = CodeBlock(part1=code_block_8.out0, currentuser=userName, part2=code_block_8.out1) { part1+currentuser+part2; }

# group: Filtering
code_block_10 = CodeBlock { catS=Revit.Category.ByName("Sheets"); allS=ElementQueries.OfCategory(catS); }
sheetNumber = Sheet.SheetNumber(sheet=code_block_10.allS)
runMe = Custom[Tool.RunMe](Boolean=code_block_7.export, ThingToDo=code_block_7.sheets)  # package SteamNodes; Use Boolean to perform an action
sheetNumber_2 = Sheet.SheetNumber(sheet=runMe)
string_from_object = FromObject(obj=sheetNumber_2)
eq = sheetNumber == string_from_object@@L1  # lacing=CrossProduct
anyTrue = Orchid.Common.List.AnyTrue(list=eq)
filterByBoolMask = List.FilterByBoolMask(list=code_block_10.allS, mask=anyTrue)

# group: Processing
runMe_2 = Custom[Tool.RunMe](Boolean=code_block_7.export, ThingToDo=code_block_9)
viewports = archilab.Revit.Views.Sheets.Viewports(sheet=filterByBoolMask.in)
ʳʰʸᵗʰᵐ_viewport_locationdata = Rhythm.Revit.Elements.Viewport.LocationData(viewport=viewports)
X = Point.X(point=ʳʰʸᵗʰᵐ_viewport_locationdata.boxCenter)
flatten = List.Flatten(list=X)
Y = Point.Y(point=ʳʰʸᵗʰᵐ_viewport_locationdata.boxCenter)
flatten_2 = List.Flatten(list=Y)
code_block_11 = CodeBlock { "View Name"; "Sheet Number"; }
getParameterValueByName_3 = Element.GetParameterValueByName(element=viewports, parameterName=code_block_11.out0)
flatten_3 = List.Flatten(list=getParameterValueByName_3)
getParameterValueByName_4 = Element.GetParameterValueByName(element=viewports, parameterName=code_block_11.out1)
flatten_4 = List.Flatten(list=getParameterValueByName_4)
list_create_2 = List.Create(item0=flatten, item1=flatten_2, item2=flatten_3, item3=flatten_4)
exportCSV = Data.ExportCSV(filePath=runMe_2, data=list_create_2)

# group: Usage
code_block_12 = CodeBlock { "Views - Place On Sheets Aligned"; }
acg_script_usage = Custom[ACG Script Usage](scriptName=code_block_12)  # Adds an entry to Excel document every time a script is run. The document is located in S:\Dynamo\05-UsageStats

# group: Processing
not_ = Not(x=code_block_7.export)
runMe_3 = Custom[Tool.RunMe](Boolean=not_, ThingToDo=code_block_9)
code_block_13 = CodeBlock { true; }
importCSV = Data.ImportCSV(filePath=runMe_3, transpose=code_block_13)
code_block_14 = CodeBlock(x=importCSV) { xPoint=x[0]; yPoint=x[1]; name=x[2]; sheets=x[3]; 0; }
byName = Orchid.RevitProject.Views.View.ByName(name=code_block_14.name)
groupByKey = List.GroupByKey(list=byName, keys=code_block_14.sheets)
groupByKey_2 = List.GroupByKey(list=code_block_14.sheets, keys=code_block_14.sheets)
count = List.Count(list=groupByKey_2.groups@@L2)
code_block_15 = CodeBlock(inputX=code_block_14.xPoint, inputY=code_block_14.yPoint) { inputX/304.8; inputY/304.8; }
byCoordinates = Point.ByCoordinates(x=code_block_15.out0, y=code_block_15.out1, z=code_block_14.out4)
groupByKey_3 = List.GroupByKey(list=byCoordinates, keys=code_block_14.sheets)
code_block_16 = CodeBlock { true; }

# group: Filtering
code_block_17 = CodeBlock { catS=Revit.Category.ByName("Sheets"); allS=ElementQueries.OfCategory(catS); }
sheetNumber_3 = Sheet.SheetNumber(sheet=code_block_17.allS)
string_from_object_2 = FromObject(obj=code_block_14.sheets)
eq_2 = sheetNumber_3 == string_from_object_2@@L1  # lacing=CrossProduct
anyTrue_2 = Orchid.Common.List.AnyTrue(list=eq_2)
filterByBoolMask_2 = List.FilterByBoolMask(list=code_block_17.allS, mask=anyTrue_2)

# group (continued): Processing
ofRepeatedItem = List.OfRepeatedItem(item=filterByBoolMask_2.in@L1, amount=count@@L1)

# group: Processing
end = Revit.Transaction.Transaction.End(input=groupByKey.groups)
end_2 = Revit.Transaction.Transaction.End(input=ofRepeatedItem)
end_3 = Revit.Transaction.Transaction.End(input=groupByKey_3.groups)
RIE_PlaceViewOnSheet = Custom[RIE_PlaceViewOnSheet](view_Schedule_Legend=end@L2, sheet=end_2@L2, point=end_3@L2, refresh=code_block_16)  # package RIE; Places Views, Schedules or Legends into sheets.

# group: Visualisation
firstItem = List.FirstItem(list=RIE_PlaceViewOnSheet.Placed@@L2)
flatten_5 = List.Flatten(list=firstItem)
clear_list = Custom[Clear List](input=flatten_5)  # package archi-lab.net; This node will remove all Null and Empty Lists from any list.
code_block_18 = CodeBlock { "Type"; }
setParameterByName = Element.SetParameterByName(element=clear_list, parameterName=code_block_18, value=code_block_7.viewportType)
