# Dynamo graph Rename All Views On Sheets_d.dyn "Views - Rename All On Sheets" (Dynamo 2.6.1.8786)
# packages: Orchid 260.1.0.7729, SteamNodes 1.2.3, Data-Shapes 2021.2.92, archi-lab.net 2021.25.2521

# group: Filtering
code_block = CodeBlock { catSheets=Revit.Elements.Category.ByName("Sheets"); ElementQueries.OfCategory(catSheets); "Sheet Phase"; }
getParameterValueByName = Element.GetParameterValueByName(element=code_block.out1, parameterName=code_block.out2)
code_block_2 = CodeBlock(phase=getParameterValueByName) { phase=="PRODUCTION"; }
filterByBoolMask = List.FilterByBoolMask(list=code_block.out1, mask=code_block_2)

# group: To Revit
views = Sheet.Views(sheet=filterByBoolMask.in)
flatten = List.Flatten(list=views)
string_from_object = FromObject(obj=flatten)
code_block_3 = CodeBlock { "Legend"; }
startsWith = String.StartsWith(str=string_from_object, searchFor=code_block_3)
filterByBoolMask_2 = List.FilterByBoolMask(list=flatten, mask=startsWith)

# group: Input
file_path = Filename("..\ACG_logo.png")
file_from_path = FileObject(path=file_path)
readFromFile = Image.ReadFromFile(file=file_from_path)
code_block_4 = CodeBlock { "Rename"; "Cancel"; 500; 250; }
code_block_5 = CodeBlock { "Note :"; true; }
string = StringInput("""This script will rename all views placed on PRODUCTION sheets in compliance with ACG's naming protocols.
Please watch tutorial before executing to see how the algorithm works.
""")
ui_textnote_data = Custom[UI.TextNote Data](Title=code_block_5.out0, TextNote=string)  # package Data-Shapes; Create Data for TextNote input in UI.MultipleInputForm ++ . Check out www.data-shapes.net for more informations
code_block_6 = CodeBlock { "Generate Title on Sheets values?"; }
boolean_input = Custom[Boolean input](InputName=code_block_6)  # package Data-Shapes; Creates a boolean input for UI.MultipleInputForm ++ . Check out www.data-shapes.net for more infos!

list_create = List.Create(item0=ui_textnote_data, item1=boolean_input)
flatten_2 = List.Flatten(list=list_create)

# group (continued): Input
ui_multipleinputform = Custom[UI.MultipleInputForm ++](Logo_optional=readFromFile, ButtonText_optional=code_block_4.out0, Inputs=flatten_2, Toggle=code_block_5.out1, CancelButtonText_optional=code_block_4.out1, Width_optional=code_block_4.out2, LabelWidth_optional=code_block_4.out3)  # package Data-Shapes; Create a form with multiple inputs. see www.data-shapes.net for tutorials and infos!

code_block_7 = CodeBlock(x=ui_multipleinputform.User_Inputs) { titleOnSheets=x[0]; }

# group: Processing
code_block_8 = CodeBlock(e=filterByBoolMask_2.out) { e.Name; 4; 7; 8; }
get_chatacter_at_index = CodeBlock(str=code_block_8.out0, index=code_block_8.out1)
# ---------- get_chatacter_at_index.designscript (5 lines) ----------
def CharacterAtIndex (str,index)
{
return=str[index];
};
CharacterAtIndex(str,index);
# ----------------------------------------
string_from_object_2 = FromObject(obj=get_chatacter_at_index)
get_chatacter_at_index_2 = CodeBlock(str=code_block_8.out0, index=code_block_8.out2)  # same code as get_chatacter_at_index
string_from_object_3 = FromObject(obj=get_chatacter_at_index_2)
get_chatacter_at_index_3 = CodeBlock(str=code_block_8.out0, index=code_block_8.out3)  # same code as get_chatacter_at_index
string_from_object_4 = FromObject(obj=get_chatacter_at_index_3)
code_block_9 = CodeBlock(fifthCharacter=string_from_object_2, eigthCharacter=string_from_object_3, ninthCharacter=string_from_object_4) { fifthCharacter=="-"; eigthCharacter=="-"; ninthCharacter=="-"; }
# note: check if the 5th, 8th and 9th characters are "-"
list_create_2 = List.Create(item0=code_block_9.out1, item1=code_block_9.out2)
transpose = List.Transpose(lists=list_create_2)
anyTrue = Orchid.Common.List.AnyTrue(list=transpose@L2)

# group: Filtering
filterByBoolMask_3 = List.FilterByBoolMask(list=filterByBoolMask_2.out, mask=code_block_9.out0)
filterByBoolMask_4 = List.FilterByBoolMask(list=filterByBoolMask_2.out, mask=anyTrue)
# note: looks compliant
list_create_3 = List.Create(item0=filterByBoolMask_3.in, item1=filterByBoolMask_4.in)
code_block_10 = CodeBlock(lst=list_create_3) { flat=DSCore.List.Flatten(lst); DSCore.List.UniqueItems(flat); }
# note: non-compliant
list_create_4 = List.Create(item0=filterByBoolMask_3.out, item1=filterByBoolMask_4.out)
code_block_11 = CodeBlock(lst=list_create_4) { flat=DSCore.List.Flatten(lst); DSCore.List.UniqueItems(flat); }

# group: Processing
code_block_12 = CodeBlock(v=code_block_10.out1) { "Sheet Number"; v.Name; 0; }
getParameterValueByName_2 = Element.GetParameterValueByName(element=code_block_10.out1, parameterName=code_block_12.out0)

length = String.Length(str=getParameterValueByName_2)

# group (continued): Processing
# note: update the sheet code in the view name. Assumes all sheets numbers are 4 digits
remove = String.Remove(str=code_block_12.out1, startIndex=code_block_12.out2, count=length)
code_block_13 = CodeBlock(sheetNumber=getParameterValueByName_2, restOfName=remove) { "View Name"; sheetNumber+restOfName; }

# group: Visualisation
# note: Update "compliant" views
setParameterByName = Element.SetParameterByName(element=code_block_10.out1, parameterName=code_block_13.out0, value=code_block_13.out1)

# group: Annotation
code_block_14 = CodeBlock { "Sheet Number"; "Associated Level"; }
getParameterValueByName_3 = Element.GetParameterValueByName(element=code_block_11.out1, parameterName=code_block_14.out0)
getParameterValueByName_4 = Element.GetParameterValueByName(element=code_block_11.out1, parameterName=code_block_14.out1)
code_block_15 = CodeBlock(lvl=getParameterValueByName_4) { lvl==""; "ZZ"; lvl; }
code_block_16 = CodeBlock(x=code_block_15.out0, a=code_block_15.out1, b=code_block_15.lvl) { x?a:b; }

# group: Processing
code_block_17 = CodeBlock(e=code_block_11.out1) { e.Name; "WIP-"; ""; }
# note: Remove "WIP" code from views
replace = String.Replace(str=code_block_17.out0, searchFor=code_block_17.out1, replaceWith=code_block_17.out2)

# group: Processing
code_block_18 = CodeBlock(e=code_block_11.out1) { e.Name; 0; }
code_block_19 = CodeBlock { 2; 3; }
get_chatacter_at_index_4 = CodeBlock(str=replace, index=code_block_19.out0)  # same code as get_chatacter_at_index
string_from_object_5 = FromObject(obj=get_chatacter_at_index_4)
code_block_20 = CodeBlock(thirdCharacter=string_from_object_5) { thirdCharacter=="-"?3:0; }
remove_2 = String.Remove(str=code_block_18.out0, startIndex=code_block_18.out1, count=code_block_20)
get_chatacter_at_index_5 = CodeBlock(str=remove_2, index=code_block_19.out1)  # same code as get_chatacter_at_index
string_from_object_6 = FromObject(obj=get_chatacter_at_index_5)
code_block_21 = CodeBlock(fourthCharacter=string_from_object_6) { fourthCharacter=="-"?4:0; }
remove_3 = String.Remove(str=code_block_18.out0, startIndex=code_block_18.out1, count=code_block_21)

code_block_22 = CodeBlock(sheet=getParameterValueByName_3, lvl=code_block_16, description=remove_3) { "View Name"; sheet+"-"+lvl+"-"+description; }

# group: Visualisation
setParameterByName_2 = Element.SetParameterByName(element=code_block_11.out1, parameterName=code_block_22.out0, value=code_block_22.out1)

list_create_5 = List.Create(item0=setParameterByName, item1=setParameterByName_2)
flatten_3 = List.Flatten(list=list_create_5)
clear_list = Custom[Clear List](input=flatten_3)  # package archi-lab.net; This node will remove all Null and Empty Lists from any list.

# group: Title on sheets where one is not existing
runMe = Custom[Tool.RunMe](Boolean=code_block_7, ThingToDo=clear_list)  # package SteamNodes; Use Boolean to perform an action
await_ = Orchid.Common.DataStream.Await(pass=filterByBoolMask_2.out, waitFor=runMe)
code_block_23 = CodeBlock { "Title on Sheet"; }
getParameterValueByName_5 = Element.GetParameterValueByName(element=await_, parameterName=code_block_23)
code_block_24 = CodeBlock(value=getParameterValueByName_5) { value==""; }
filterByBoolMask_5 = List.FilterByBoolMask(list=await_, mask=code_block_24)
code_block_25 = CodeBlock(e=filterByBoolMask_5.in) { "Title on Sheet"; e.Name; }
code_block_26 = CodeBlock { "-"; 0..1; }
split = String.Split(str=code_block_25.out1, separator0=code_block_26.out0)
removeItemAtIndex = List.RemoveItemAtIndex(list=split@@L2, indices=code_block_26.out1)
join = String.Join(separator=code_block_26.out0, string0=removeItemAtIndex@L2)
code_block_27 = CodeBlock(x=join) { x[0]; }
setParameterByName_3 = Element.SetParameterByName(element=filterByBoolMask_5.in, parameterName=code_block_25.out0, value=code_block_27)

# group: Usage
code_block_28 = CodeBlock { "Rename Views on Sheets"; }
acg_script_usage = Custom[ACG Script Usage](scriptName=code_block_28)  # Adds an entry to Excel document every time a script is run. The document is located in S:\Dynamo\05-UsageStats
