# Dynamo graph Detailed Annotation Stats.dyn (Dynamo 2.12.1.8246)
# packages: Orchid 260.1.0.7729, Data-Shapes 2021.2.92, BumbleBee 2021.25.3

# group: Input
code_block = CodeBlock { "Cancel"; true; "Run"; }
code_block_2 = CodeBlock { "Select Excel file"; }
ui_filepath_data = Custom[UI.FilePath Data](InputName=code_block_2)  # package Data-Shapes; Create filepath input for UI.MultipleInputForm ++ . Check out www.data-shapes.net for more infos !
ui_multipleinputform = Custom[UI.MultipleInputForm ++](ButtonText_optional=code_block.out2, Inputs=ui_filepath_data, Toggle=code_block.out1, CancelButtonText_optional=code_block.out0)  # package Data-Shapes; Create a form with multiple inputs. see www.data-shapes.net for tutorials and infos!
code_block_3 = CodeBlock(filePath=ui_multipleinputform.User_Inputs) { filePath; }

# group: Input - SHEETS & VIEWS
python_script = Python()  # IronPython2
# ---------- python_script.python (55 lines) ----------
import clr
import sys
sys.path.append('C:\Program Files (x86)\IronPython 2.7\Lib')
import System
from System import Array
from System.Collections.Generic import *
clr.AddReference('ProtoGeometry')
from Autodesk.DesignScript.Geometry import *
clr.AddReference("RevitNodes")
import Revit
clr.ImportExtensions(Revit.Elements)
clr.ImportExtensions(Revit.GeometryConversion)
clr.AddReference("RevitServices")
import RevitServices
from RevitServices.Persistence import DocumentManager 
from RevitServices.Transactions import TransactionManager 
clr.AddReference("RevitAPI")
clr.AddReference("RevitAPIUI")
import Autodesk 
from Autodesk.Revit.DB import *
from Autodesk.Revit.UI import *

doc = DocumentManager.Instance.CurrentDBDocument
uiapp = DocumentManager.Instance.CurrentUIApplication 
app = uiapp.Application 
uidoc = uiapp.ActiveUIDocument

allSheets = FilteredElementCollector(doc).OfCategory(BuiltInCategory.OST_Sheets).ToElements()

viewsOnSheets, sheetsToProcess, sheetPhase, viewScale, viewNames, sheetIds, sheetNames = [], [], [], [], [], [], []

for s in allSheets:
	try:
		if s.LookupParameter("Sheet Phase").AsString().Contains("SKETCH"):
			continue
		else:
			sheetsToProcess.append(s)
	except:
		continue

for s in sheetsToProcess:
	viewIds = s.GetAllPlacedViews()
	for vId in viewIds:
		v = doc.GetElement(vId)
		if v.ViewType != ViewType.Legend:
			if v.ViewType != ViewType.DraftingView:
				if v.ViewType != ViewType.Schedule:
					viewsOnSheets.append(v.Id)
					sheetPhase.append(s.LookupParameter("Sheet Phase").AsString())
					viewScale.append(v.Scale)
					viewNames.append(v.Name)
	sheetIds.append(s.Id)
	sheetNames.append(s.SheetNumber + " : " + s.Name)
	
OUT = viewsOnSheets, viewNames, sheetPhase, viewScale, sheetIds, sheetNames
# ----------------------------------------
# note: all views placed on seets (excl. legends, schedules, drafting views)
await_ = Orchid.Common.DataStream.Await(pass=python_script, waitFor=code_block_3)
code_block_4 = CodeBlock(x=await_) { viewIds = x[0]; viewName = x[1]; sheetPhases = x[2]; viewScales = x[3]; sheetIds = x[4]; sheetNames = x[5]; }

# group: Input - DETAIL GROUPS
code_block_5 = CodeBlock { true; }
allDetail = Orchid.RevitProject.Elements.Group.AllDetail(filter=code_block_5)
# note: if instance convert to list
python_script_2 = Python(IN[0]=allDetail)  # IronPython2
# ---------- python_script_2.python (16 lines) ----------
# Load the Python Standard and DesignScript Libraries
import sys
import clr
clr.AddReference('ProtoGeometry')
from Autodesk.DesignScript.Geometry import *

# The inputs to this node will be stored as a list in the IN variables.
input = IN[0]

if not isinstance(input, list):
 input = [input]

# Place your code below this line

# Assign your output to the OUT variable.
OUT = input
# ----------------------------------------

# group: Visualisation
# note: Process elements
python_script_3 = Python(IN[0]=code_block_4.viewIds, IN[1]=python_script_2)  # IronPython2
# ---------- python_script_3.python (46 lines) ----------
import clr
import sys
sys.path.append('C:\Program Files (x86)\IronPython 2.7\Lib')
import System
from System import Array
from System.Collections.Generic import *
clr.AddReference('ProtoGeometry')
from Autodesk.DesignScript.Geometry import *
clr.AddReference("RevitNodes")
import Revit
clr.ImportExtensions(Revit.Elements)
clr.ImportExtensions(Revit.GeometryConversion)
clr.AddReference("RevitServices")
import RevitServices
from RevitServices.Persistence import DocumentManager 
from RevitServices.Transactions import TransactionManager 
clr.AddReference("RevitAPI")
clr.AddReference("RevitAPIUI")
import Autodesk 
from Autodesk.Revit.DB import *
from Autodesk.Revit.UI import *

doc = DocumentManager.Instance.CurrentDBDocument
uiapp = DocumentManager.Instance.CurrentUIApplication 
app = uiapp.Application 
uidoc = uiapp.ActiveUIDocument

viewIds = IN[0]
elements = UnwrapElement(IN[1])

def ProcessElementsOnViews (lstElements, lstViewIds):

	lstAllElements = []

	for id in lstViewIds:
		lstViewElements = []
	
		for e in lstElements:
			if e.OwnerViewId != None:
				if e.OwnerViewId == id:
					lstViewElements.append(e.OwnerViewId)
					#allDetailCurves.Remove(line)
		lstAllElements.append(lstViewElements)
	return lstAllElements

OUT = ProcessElementsOnViews(elements, viewIds)
# ----------------------------------------

# group: Filtering
count = List.Count(list=python_script_3@L2)
sortByKey = List.SortByKey(list=code_block_4.viewName, keys=count)
code_block_6 = CodeBlock(count=sortByKey.sortedKeys, vName=sortByKey.sortedList) { count + " : " + vName; }
sortByKey_2 = List.SortByKey(list=code_block_4.sheetPhases, keys=count)
sortByKey_3 = List.SortByKey(list=code_block_4.viewScales, keys=count)

# group: Visualisation
# note: Remove views that have no elements
python_script_4 = Python(IN[0]=code_block_6, IN[1]=sortByKey_2.sortedList, IN[2]=sortByKey_3.sortedList)  # IronPython2
# ---------- python_script_4.python (44 lines) ----------
import clr
import sys
sys.path.append('C:\Program Files (x86)\IronPython 2.7\Lib')
import System
from System import Array
from System.Collections.Generic import *
clr.AddReference('ProtoGeometry')
from Autodesk.DesignScript.Geometry import *
clr.AddReference("RevitNodes")
import Revit
clr.ImportExtensions(Revit.Elements)
clr.ImportExtensions(Revit.GeometryConversion)
clr.AddReference("RevitServices")
import RevitServices
from RevitServices.Persistence import DocumentManager 
from RevitServices.Transactions import TransactionManager 
clr.AddReference("RevitAPI")
clr.AddReference("RevitAPIUI")
import Autodesk 
from Autodesk.Revit.DB import *
from Autodesk.Revit.UI import *

doc = DocumentManager.Instance.CurrentDBDocument
uiapp = DocumentManager.Instance.CurrentUIApplication 
app = uiapp.Application 
uidoc = uiapp.ActiveUIDocument

inputItems =	IN[0]
sPhases =		IN[1]
vScales =		IN[2]



for i, ph, sc in zip(inputItems, sPhases, vScales):
	if i.StartsWith("0"):
		inputItems.remove(i)
		sPhases.remove(ph)
		vScales.remove(sc)
		
revItems = inputItems[::-1]
revPhases = sPhases[::-1]
revScales = vScales[::-1]
	
OUT = revItems, revPhases, revScales
# ----------------------------------------
code_block_7 = CodeBlock(x=python_script_4) { views = x[0]; phases = x[1]; scales = x[2]; }

# group: Visualisation
# note: Process elements
python_script_5 = Python(IN[0]=code_block_4.sheetIds, IN[1]=python_script_2)  # IronPython2; same code as python_script_3

# group: Filtering
count_2 = List.Count(list=python_script_5@L2)
sortByKey_4 = List.SortByKey(list=code_block_4.sheetNames, keys=count_2)
code_block_8 = CodeBlock(count=sortByKey_4.sortedKeys, vName=sortByKey_4.sortedList)
# ---------- code_block_8.designscript (3 lines) ----------
count == 0?
"":
(count + " : " + vName);
# ----------------------------------------
reverse = List.Reverse(list=code_block_8)

# group: Processing
list_create = List.Create(item0=reverse)
code_block_9 = CodeBlock(lst=python_script_5, b=list_create)
# ---------- code_block_9.designscript (4 lines) ----------
flatLst = DSCore.List.Flatten(lst);
DSCore.List.Count(flatLst)==0?
["No elements placed on sheets"]:
b;
# ----------------------------------------
flatten = List.Flatten(list=code_block_9.out1)

# group: Assing
code_block_10 = CodeBlock { "Detail Groups Audit"; }
code_block_11 = CodeBlock(value=flatten) { value==null?"Detail Groups on Sheets N/A":value; }

# group: Processing - Stats
sum = Math.Sum(values=count)
count_3 = List.Count(list=code_block_4.viewIds)
code_block_12 = CodeBlock(elements=sum, views=count_3)
# ---------- code_block_12.designscript (3 lines) ----------
elements == 0?
0:
elements/views;
# ----------------------------------------
sum_2 = Math.Sum(values=count_2)
count_4 = List.Count(list=code_block_4.sheetIds)
code_block_13 = CodeBlock(elements=sum_2, views=count_4)  # same code as code_block_12
list_create_2 = List.Create(item0=sum, item1=count_3, item2=code_block_12, item3=sum_2, item4=count_4, item5=code_block_13)
flatten_2 = List.Flatten(list=list_create_2)

# group: Processing
code_block_14 = CodeBlock(gr=python_script_2) { gr.Name; }
groupByKey = List.GroupByKey(list=code_block_14, keys=code_block_14)
count_5 = List.Count(list=groupByKey.groups@L2)
sortByKey_5 = List.SortByKey(list=groupByKey.uniqueKeys, keys=count_5)
code_block_15 = CodeBlock(count=sortByKey_5.sortedKeys, vName=sortByKey_5.sortedList) { count + " : " + vName; }
reverse_2 = List.Reverse(list=code_block_15)

# group: Assing
isEmpty = List.IsEmpty(list=code_block_7.views)
code_block_16 = CodeBlock()
# ---------- code_block_16.designscript (5 lines) ----------
"A3";
[
"No elements placed on sheet views.",
"."
];
# ----------------------------------------
bb_data = Custom[BB Data](sheetName=code_block_10, origin=code_block_16.out0, data=code_block_16.out1)  # package BumbleBee; This node is a building block for different modes of writing to Excel files. You can combines this node into a list to write to multiple sheets or use just one to write to a single sheet.
code_block_17 = CodeBlock()
# ---------- code_block_17.designscript (8 lines) ----------
[
"E3",
"A3",
"B3",
"C3",
"G2",
"H2"
];
# ----------------------------------------
list_create_3 = List.Create(item0=code_block_11, item1=code_block_7.views, item2=code_block_7.phases, item3=code_block_7.scales, item4=flatten_2, item5=reverse_2)
bb_data_2 = Custom[BB Data](sheetName=code_block_10, origin=code_block_17, data=list_create_3, lacing=Longest)
code_block_18 = CodeBlock(test=isEmpty, a=bb_data, b=bb_data_2) { test?a:b; }
flatten_3 = List.Flatten(list=code_block_18)

# group: Input - TEXT
python_script_6 = Python()  # IronPython2
# ---------- python_script_6.python (29 lines) ----------
import clr
import sys
sys.path.append('C:\Program Files (x86)\IronPython 2.7\Lib')
import System
from System import Array
from System.Collections.Generic import *
clr.AddReference('ProtoGeometry')
from Autodesk.DesignScript.Geometry import *
clr.AddReference("RevitNodes")
import Revit
clr.ImportExtensions(Revit.Elements)
clr.ImportExtensions(Revit.GeometryConversion)
clr.AddReference("RevitServices")
import RevitServices
from RevitServices.Persistence import DocumentManager 
from RevitServices.Transactions import TransactionManager 
clr.AddReference("RevitAPI")
clr.AddReference("RevitAPIUI")
import Autodesk 
from Autodesk.Revit.DB import *
from Autodesk.Revit.UI import *

doc = DocumentManager.Instance.CurrentDBDocument
uiapp = DocumentManager.Instance.CurrentUIApplication 
app = uiapp.Application 
uidoc = uiapp.ActiveUIDocument


OUT = allDetailCurves = FilteredElementCollector(doc).OfCategory(BuiltInCategory.OST_TextNotes).WhereElementIsNotElementType().ToElements()
# ----------------------------------------

# group: Visualisation
# note: Process elements
python_script_7 = Python(IN[0]=code_block_4.sheetIds, IN[1]=python_script_6)  # IronPython2; same code as python_script_3

# group: Filtering
count_6 = List.Count(list=python_script_7@L2)
sortByKey_6 = List.SortByKey(list=code_block_4.sheetNames, keys=count_6)
code_block_19 = CodeBlock(count=sortByKey_6.sortedKeys, vName=sortByKey_6.sortedList)  # same code as code_block_8
reverse_3 = List.Reverse(list=code_block_19)

# group: Processing
list_create_4 = List.Create(item0=reverse_3)
code_block_20 = CodeBlock(lst=python_script_7, b=list_create_4)  # same code as code_block_9
flatten_4 = List.Flatten(list=code_block_20.out1)

# group: Assing
code_block_21 = CodeBlock { "Text Notes Audit"; }
code_block_22 = CodeBlock(value=flatten_4) { value==null?"Text Notes on Sheets N/A":value; }

# group: Visualisation
# note: Process elements
python_script_8 = Python(IN[0]=code_block_4.viewIds, IN[1]=python_script_6)  # IronPython2; same code as python_script_3

# group: Filtering
count_7 = List.Count(list=python_script_8@L2)
sortByKey_7 = List.SortByKey(list=code_block_4.viewName, keys=count_7)
code_block_23 = CodeBlock(count=sortByKey_7.sortedKeys, vName=sortByKey_7.sortedList) { count + " : " + vName; }
sortByKey_8 = List.SortByKey(list=code_block_4.sheetPhases, keys=count_7)
sortByKey_9 = List.SortByKey(list=code_block_4.viewScales, keys=count_7)

# group: Visualisation
# note: Remove views that have no elements
python_script_9 = Python(IN[0]=code_block_23, IN[1]=sortByKey_8.sortedList, IN[2]=sortByKey_9.sortedList)  # IronPython2; same code as python_script_4
code_block_24 = CodeBlock(x=python_script_9) { views = x[0]; phases = x[1]; scales = x[2]; }

# group: Processing - Stats
sum_3 = Math.Sum(values=count_7)
count_8 = List.Count(list=code_block_4.viewIds)
code_block_25 = CodeBlock(elements=sum_3, views=count_8)  # same code as code_block_12
sum_4 = Math.Sum(values=count_6)
count_9 = List.Count(list=code_block_4.sheetIds)
code_block_26 = CodeBlock(elements=sum_4, views=count_9)  # same code as code_block_12
list_create_5 = List.Create(item0=sum_3, item1=count_8, item2=code_block_25, item3=sum_4, item4=count_9, item5=code_block_26)
flatten_5 = List.Flatten(list=list_create_5)

# group: Assing
isEmpty_2 = List.IsEmpty(list=code_block_7.views)
code_block_27 = CodeBlock()  # same code as code_block_16
bb_data_3 = Custom[BB Data](sheetName=code_block_10, origin=code_block_27.out0, data=code_block_27.out1)
code_block_28 = CodeBlock()
# ---------- code_block_28.designscript (7 lines) ----------
[
"E3",
"A3",
"B3",
"C3",
"G2"
];
# ----------------------------------------
list_create_6 = List.Create(item0=code_block_22, item1=code_block_24.views, item2=code_block_24.phases, item3=code_block_24.scales, item4=flatten_5)
bb_data_4 = Custom[BB Data](sheetName=code_block_21, origin=code_block_28, data=list_create_6, lacing=Longest)
code_block_29 = CodeBlock(test=isEmpty_2, a=bb_data_3, b=bb_data_4) { test?a:b; }
flatten_6 = List.Flatten(list=code_block_29)

# group: Input - LINES
# note: get all Lines in the model
python_script_10 = Python()  # IronPython2
# ---------- python_script_10.python (29 lines) ----------
import clr
import sys
sys.path.append('C:\Program Files (x86)\IronPython 2.7\Lib')
import System
from System import Array
from System.Collections.Generic import *
clr.AddReference('ProtoGeometry')
from Autodesk.DesignScript.Geometry import *
clr.AddReference("RevitNodes")
import Revit
clr.ImportExtensions(Revit.Elements)
clr.ImportExtensions(Revit.GeometryConversion)
clr.AddReference("RevitServices")
import RevitServices
from RevitServices.Persistence import DocumentManager 
from RevitServices.Transactions import TransactionManager 
clr.AddReference("RevitAPI")
clr.AddReference("RevitAPIUI")
import Autodesk 
from Autodesk.Revit.DB import *
from Autodesk.Revit.UI import *

doc = DocumentManager.Instance.CurrentDBDocument
uiapp = DocumentManager.Instance.CurrentUIApplication 
app = uiapp.Application 
uidoc = uiapp.ActiveUIDocument


OUT = allDetailCurves = FilteredElementCollector(doc).OfCategory(BuiltInCategory.OST_Lines).WhereElementIsNotElementType().ToElements()
# ----------------------------------------

# group: Visualisation
# note: Process elements
python_script_11 = Python(IN[0]=code_block_4.sheetIds, IN[1]=python_script_10)  # IronPython2; same code as python_script_3

# group: Filtering
count_10 = List.Count(list=python_script_11@L2)
sortByKey_10 = List.SortByKey(list=code_block_4.sheetNames, keys=count_10)
code_block_30 = CodeBlock(count=sortByKey_10.sortedKeys, vName=sortByKey_10.sortedList)  # same code as code_block_8
reverse_4 = List.Reverse(list=code_block_30)

# group: Processing
list_create_7 = List.Create(item0=reverse_4)
code_block_31 = CodeBlock(lst=python_script_11, b=list_create_7)  # same code as code_block_9
flatten_7 = List.Flatten(list=code_block_31.out1)

# group: Assing
code_block_32 = CodeBlock { "Detail Lines Audit"; }
code_block_33 = CodeBlock(value=flatten_7) { value==null?"Detail Lines on Sheets N/A":value; }

# group: Visualisation
# note: Process elements
python_script_12 = Python(IN[0]=code_block_4.viewIds, IN[1]=python_script_10)  # IronPython2; same code as python_script_3

# group: Filtering
count_11 = List.Count(list=python_script_12@L2)
sortByKey_11 = List.SortByKey(list=code_block_4.viewName, keys=count_11)
code_block_34 = CodeBlock(count=sortByKey_11.sortedKeys, vName=sortByKey_11.sortedList) { count + " : " + vName; }
sortByKey_12 = List.SortByKey(list=code_block_4.sheetPhases, keys=count_11)
sortByKey_13 = List.SortByKey(list=code_block_4.viewScales, keys=count_11)

# group: Visualisation
# note: Remove views that have no elements
python_script_13 = Python(IN[0]=code_block_34, IN[1]=sortByKey_12.sortedList, IN[2]=sortByKey_13.sortedList)  # IronPython2; same code as python_script_4
code_block_35 = CodeBlock(x=python_script_13) { views = x[0]; phases = x[1]; scales = x[2]; }

# group: Processing - Stats
sum_5 = Math.Sum(values=count_11)
count_12 = List.Count(list=code_block_4.viewIds)
code_block_36 = CodeBlock(elements=sum_5, views=count_12)  # same code as code_block_12
sum_6 = Math.Sum(values=count_10)
count_13 = List.Count(list=code_block_4.sheetIds)
code_block_37 = CodeBlock(elements=sum_6, views=count_13)  # same code as code_block_12
list_create_8 = List.Create(item0=sum_5, item1=count_12, item2=code_block_36, item3=sum_6, item4=count_13, item5=code_block_37)
flatten_8 = List.Flatten(list=list_create_8)

# group: Assing
isEmpty_3 = List.IsEmpty(list=code_block_7.views)
code_block_38 = CodeBlock()  # same code as code_block_16
bb_data_5 = Custom[BB Data](sheetName=code_block_10, origin=code_block_38.out0, data=code_block_38.out1)
code_block_39 = CodeBlock()  # same code as code_block_28
list_create_9 = List.Create(item0=code_block_33, item1=code_block_35.views, item2=code_block_35.phases, item3=code_block_35.scales, item4=flatten_8)
bb_data_6 = Custom[BB Data](sheetName=code_block_32, origin=code_block_39, data=list_create_9, lacing=Longest)
code_block_40 = CodeBlock(test=isEmpty_3, a=bb_data_5, b=bb_data_6) { test?a:b; }
flatten_9 = List.Flatten(list=code_block_40)

# group: Input - FILLED REGIONS
code_block_41 = CodeBlock { DSCore.Types.FindTypeByNameInAssembly("FilledRegion","RevitAPI"); }
all_elements_of_type = ElementsOfType(element_type=code_block_41)
python_script_14 = Python()  # IronPython2; frozen
# ---------- python_script_14.python (29 lines) ----------
import clr
import sys
sys.path.append('C:\Program Files (x86)\IronPython 2.7\Lib')
import System
from System import Array
from System.Collections.Generic import *
clr.AddReference('ProtoGeometry')
from Autodesk.DesignScript.Geometry import *
clr.AddReference("RevitNodes")
import Revit
clr.ImportExtensions(Revit.Elements)
clr.ImportExtensions(Revit.GeometryConversion)
clr.AddReference("RevitServices")
import RevitServices
from RevitServices.Persistence import DocumentManager 
from RevitServices.Transactions import TransactionManager 
clr.AddReference("RevitAPI")
clr.AddReference("RevitAPIUI")
import Autodesk 
from Autodesk.Revit.DB import *
from Autodesk.Revit.UI import *

doc = DocumentManager.Instance.CurrentDBDocument
uiapp = DocumentManager.Instance.CurrentUIApplication 
app = uiapp.Application 
uidoc = uiapp.ActiveUIDocument


OUT = FilteredElementCollector(doc).OfCategory(BuiltInCategory.OST_FilledRegions).WhereElementIsNotElementType().ToElements()
# ----------------------------------------

# group: Visualisation
# note: Process elements
python_script_15 = Python(IN[0]=code_block_4.sheetIds, IN[1]=all_elements_of_type)  # IronPython2; same code as python_script_3

# group: Filtering
count_14 = List.Count(list=python_script_15@L2)
sortByKey_14 = List.SortByKey(list=code_block_4.sheetNames, keys=count_14)
code_block_42 = CodeBlock(count=sortByKey_14.sortedKeys, vName=sortByKey_14.sortedList)  # same code as code_block_8
reverse_5 = List.Reverse(list=code_block_42)

# group: Processing
list_create_10 = List.Create(item0=reverse_5)
code_block_43 = CodeBlock(lst=python_script_15, b=list_create_10)  # same code as code_block_9
flatten_10 = List.Flatten(list=code_block_43.out1)

# group: Assing
code_block_44 = CodeBlock { "Filled Regions Audit"; }
code_block_45 = CodeBlock(value=flatten_10) { value==null?"Filled Regions on Sheets N/A":value; }

# group: Visualisation
# note: Process elements
python_script_16 = Python(IN[0]=code_block_4.viewIds, IN[1]=all_elements_of_type)  # IronPython2; same code as python_script_3

# group: Filtering
count_15 = List.Count(list=python_script_16@L2)
sortByKey_15 = List.SortByKey(list=code_block_4.viewName, keys=count_15)
code_block_46 = CodeBlock(count=sortByKey_15.sortedKeys, vName=sortByKey_15.sortedList) { count + " : " + vName; }
sortByKey_16 = List.SortByKey(list=code_block_4.sheetPhases, keys=count_15)
sortByKey_17 = List.SortByKey(list=code_block_4.viewScales, keys=count_15)

# group: Visualisation
# note: Remove views that have no elements
python_script_17 = Python(IN[0]=code_block_46, IN[1]=sortByKey_16.sortedList, IN[2]=sortByKey_17.sortedList)  # IronPython2; same code as python_script_4
code_block_47 = CodeBlock(x=python_script_17) { views = x[0]; phases = x[1]; scales = x[2]; }

# group: Processing - Stats
sum_7 = Math.Sum(values=count_15)
count_16 = List.Count(list=code_block_4.viewIds)
code_block_48 = CodeBlock(elements=sum_7, views=count_16)  # same code as code_block_12
sum_8 = Math.Sum(values=count_14)
count_17 = List.Count(list=code_block_4.sheetIds)
code_block_49 = CodeBlock(elements=sum_8, views=count_17)  # same code as code_block_12
list_create_11 = List.Create(item0=sum_7, item1=count_16, item2=code_block_48, item3=sum_8, item4=count_17, item5=code_block_49)
flatten_11 = List.Flatten(list=list_create_11)

# group: Assing
isEmpty_4 = List.IsEmpty(list=code_block_7.views)
code_block_50 = CodeBlock()  # same code as code_block_16
bb_data_7 = Custom[BB Data](sheetName=code_block_10, origin=code_block_50.out0, data=code_block_50.out1)
code_block_51 = CodeBlock()  # same code as code_block_28
list_create_12 = List.Create(item0=code_block_45, item1=code_block_47.views, item2=code_block_47.phases, item3=code_block_47.scales, item4=flatten_11)
bb_data_8 = Custom[BB Data](sheetName=code_block_44, origin=code_block_51, data=list_create_12, lacing=Longest)
code_block_52 = CodeBlock(test=isEmpty_4, a=bb_data_7, b=bb_data_8) { test?a:b; }
flatten_12 = List.Flatten(list=code_block_52)

# group: Processing - View Templates
python_script_18 = Python(IN[0]=code_block_4.viewIds)  # IronPython2
# ---------- python_script_18.python (42 lines) ----------
import clr
import sys
sys.path.append('C:\Program Files (x86)\IronPython 2.7\Lib')
import System
from System import Array
from System.Collections.Generic import *
clr.AddReference('ProtoGeometry')
from Autodesk.DesignScript.Geometry import *
clr.AddReference("RevitNodes")
import Revit
clr.ImportExtensions(Revit.Elements)
clr.ImportExtensions(Revit.GeometryConversion)
clr.AddReference("RevitServices")
import RevitServices
from RevitServices.Persistence import DocumentManager 
from RevitServices.Transactions import TransactionManager 
clr.AddReference("RevitAPI")
clr.AddReference("RevitAPIUI")
import Autodesk 
from Autodesk.Revit.DB import *
from Autodesk.Revit.UI import *

doc = DocumentManager.Instance.CurrentDBDocument
uiapp = DocumentManager.Instance.CurrentUIApplication 
app = uiapp.Application 
uidoc = uiapp.ActiveUIDocument

# The inputs to this node will be stored as a list in the IN variables.
viewIds = IN[0]

viewTemplates = []

for id in viewIds:
	v = doc.GetElement(id)
	if v.ViewTemplateId != None:
		try:
			template = doc.GetElement(v.ViewTemplateId)
			viewTemplates.append(template.Name)
		except:
			continue
	
OUT = viewTemplates
# ----------------------------------------
groupByKey_2 = List.GroupByKey(list=python_script_18, keys=python_script_18)
count_18 = List.Count(list=groupByKey_2.groups@L2)
sortByKey_18 = List.SortByKey(list=groupByKey_2.uniqueKeys, keys=count_18)
code_block_53 = CodeBlock(count=sortByKey_18.sortedKeys, templName=sortByKey_18.sortedList) { count+" - "+templName; }
reverse_6 = List.Reverse(list=code_block_53)
code_block_54 = CodeBlock(value=reverse_6)
# ---------- code_block_54.designscript (3 lines) ----------
value==null?
"View Templates placed on Sheets N/A":
value;
# ----------------------------------------

# group: Assing - Text Notes
code_block_55 = CodeBlock { "A3"; "Annotation Elements"; }
bb_data_9 = Custom[BB Data](sheetName=code_block_55.out1, origin=code_block_55.out0, data=code_block_54)

# group: Visualisation
code_block_56 = CodeBlock { true; }
list_create_13 = List.Create(item0=flatten_3, item1=flatten_6, item2=flatten_9, item3=flatten_12, item4=bb_data_9)
write_excel = Custom[Write Excel](filePath=code_block_3, runIt=code_block_56, byColumn=code_block_56, BBData=list_create_13)  # package BumbleBee; This node will write data to Excel file and based on how your BBData nodes are structured it will either override the exsting file, create a new one and write a single worksheet or write multiple worksheets.

# group: Usage
code_block_57 = CodeBlock { "Detailed Annotation Stats"; }
acg_script_usage = Custom[ACG Script Usage](scriptName=code_block_57)  # Adds an entry to Excel document every time a script is run. The document is located in S:\Dynamo\05-UsageStats
