# Dynamo graph Detailed Audit.dyn (Dynamo 2.12.1.8246)
# packages: Bang! 2020.4.24, BVN 1.6.1, archi-lab.net 2021.25.2521, Orchid 260.1.0.7729, Data-Shapes 2021.2.92, BumbleBee 2021.25.3

# group: Linked CAD files
code_block = CodeBlock { true; false; }
imports_audit = Python(IN[0]=code_block.out0, IN[1]=code_block.out1)  # IronPython2
# ---------- imports_audit.python (55 lines) ----------
import clr

clr.AddReference("RevitAPI")
import Autodesk
from Autodesk.Revit.DB import *

# Import DocumentManager and TransactionManager
clr.AddReference("RevitServices")
import RevitServices
from RevitServices.Persistence import DocumentManager
from RevitServices.Transactions import TransactionManager

# Import RevitAPI
clr.AddReference("RevitAPI")
import Autodesk
from Autodesk.Revit.DB import *

doc = DocumentManager.Instance.CurrentDBDocument
TransactionManager.Instance.EnsureInTransaction(doc)

links = []
imports = []
output = []
header = ["Link Name", "Link", "View Based", "View Name"]
collector = FilteredElementCollector(doc).OfClass(ImportInstance).ToElements()
output.append(header)

if IN[0]:
	for element in collector:
		out = []
		out.append(element.LookupParameter("Name").AsString())
		if element.IsLinked:
			out.append("True")
		else:
			out.append("False")
			if IN[1]:
				try:
					doc.Delete(element.Id)
				except:
					pass
		if element.ViewSpecific:
			out.append("True")
			view = doc.GetElement(element.OwnerViewId)
			out.append(view.Name.ToString())
		else:
			out.append("False")
			out.append("None")
		
		output.append(out)
else: 
	output.append("Set RunIt to True!")
#output.append(links)
	
TransactionManager.Instance.TransactionTaskDone()
OUT = output
# ----------------------------------------
transpose = List.Transpose(lists=imports_audit)
code_block_2 = CodeBlock(x=transpose) { x[0]; x[1]; }
string_from_object = FromObject(obj=code_block_2.out0)
restOfItems = List.RestOfItems(list=string_from_object)
count = List.Count(list=restOfItems)
string_from_object_2 = FromObject(obj=code_block_2.out1)
restOfItems_2 = List.RestOfItems(list=string_from_object_2)
code_block_3 = CodeBlock { "True"; }
eq = restOfItems_2 == code_block_3
filterByBoolMask = List.FilterByBoolMask(list=restOfItems, mask=eq)
uniqueItems = List.UniqueItems(list=filterByBoolMask.in)
code_block_4 = CodeBlock(dwgLinks=uniqueItems)
# ---------- code_block_4.designscript (9 lines) ----------
numLinks=DSCore.List.Count(dwgLinks);

numLinks==0;

"There are no linked CAD files in the model. No action required.";

"There are "
+numLinks+
" linked CAD files in the model. Please review and remove unneeded.";
# ----------------------------------------
code_block_5 = CodeBlock(x=code_block_4.out1, a=code_block_4.out2, b=code_block_4.out3) { x?a:b; }
watch = Watch(code_block_5)

# group: Usage
code_block_6 = CodeBlock { "Detailed Audit"; }
acg_script_usage = Custom[ACG Script Usage](scriptName=code_block_6)  # Adds an entry to Excel document every time a script is run. The document is located in S:\Dynamo\05-UsageStats

file_path = Filename("..\ACG_logo.png")
file_from_path = FileObject(path=file_path)
readFromFile = Image.ReadFromFile(file=file_from_path)
code_block_7 = CodeBlock { "Cancel"; true; "Run"; 700; 350; }
code_block_8 = CodeBlock { "Select Excel file"; "Navigate"; "Sheet Number Length"; "4"; true; }
ui_filepath_data = Custom[UI.FilePath Data](InputName=code_block_8.out0, ButtonText=code_block_8.out1)  # package Data-Shapes; Create filepath input for UI.MultipleInputForm ++ . Check out www.data-shapes.net for more infos !
textbox_data = Custom[TextBox Data](InputName=code_block_8.out2, DefaultText=code_block_8.out3, IsNumberEntry=code_block_8.out4)  # package Data-Shapes; Create Data for TextBox input in UI.MultipleInputForm ++ . Check out www.data-shapes.net for more informations
list_create = List.Create(item0=ui_filepath_data, item1=textbox_data)
flatten = List.Flatten(list=list_create)
ui_multipleinputform = Custom[UI.MultipleInputForm ++](Logo_optional=readFromFile, ButtonText_optional=code_block_7.out2, Inputs=flatten, Toggle=code_block_7.out1, CancelButtonText_optional=code_block_7.out0, Width_optional=code_block_7.out3, LabelWidth_optional=code_block_7.out4)  # package Data-Shapes; Create a form with multiple inputs. see www.data-shapes.net for tutorials and infos!
code_block_9 = CodeBlock(filePath=ui_multipleinputform.User_Inputs, sheetLength=ui_multipleinputform.User_Inputs) { filePath[0]; sheetLength[1]; }
code_block_10 = CodeBlock { "BIM Project Audit"; 18; 2; false; }

# group: Processing
code_block_11 = CodeBlock()
# ---------- code_block_11.designscript (6 lines) ----------
[
"Project Name",
"Project Number",
"ACG_Project Lead"
];
"B6";
# ----------------------------------------
code_block_12 = CodeBlock { catPI=Revit.Category.ByName("Project Information"); ElementQueries.OfCategory(catPI); }
getParameterValueByName = Element.GetParameterValueByName(element=code_block_12.out1, parameterName=code_block_11.out0, lacing=Longest)
ACGCurrentDate = Custom[ACGCurrentDate]()  # Generates today's date YY MM DD or DD.MM.YY

# group: Processing
# note: Current document name
# Custom Node: Node-Mode v.2016.11.10
python_script = Python()  # IronPython2
# ---------- python_script.python (15 lines) ----------
#Copyright (c) mostafa el ayoubi
#Node-mode 2016 elayoub.mostafa@gmail.com

import clr
clr.AddReference('RevitAPI')
from Autodesk.Revit.DB import*
clr.AddReference('RevitServices')
from RevitServices.Persistence import DocumentManager

doc = DocumentManager.Instance.CurrentDBDocument
path = doc.PathName
docname = path.encode('string-escape')


OUT = docname.split("\\")[-1] , path
# ----------------------------------------
code_block_13 = CodeBlock(docName=python_script) { docName[0]; }
code_block_14 = CodeBlock { "/"; }
split = String.Split(string=code_block_13, separator0=code_block_14)
lastItem = List.LastItem(list=split)
fileSize = Custom[ActiveDocument.FileSize]()  # package Data-Shapes; Gets the file size of the ative document, even if it is a BIM360 Design workshared project.

# group: Processing
list_create_2 = List.Create(item0=getParameterValueByName, item1=ACGCurrentDate.DD_MM_YY, item2=lastItem, item3=fileSize)
flatten_2 = List.Flatten(list=list_create_2)

# group: Warnings
code_block_15 = CodeBlock { true; }
getWarnings = Bang.Revit.Elements.WarningTools.GetWarnings(toggle=code_block_15)
count_2 = List.Count(list=getWarnings.Warning_Text)
code_block_16 = CodeBlock(count=count_2)
# ---------- code_block_16.designscript (5 lines) ----------
"Currently there are "

+count+

" warnings in the model";
# ----------------------------------------

# group: Processing
groupByKey = List.GroupByKey(list=getWarnings.Warning_Text, keys=getWarnings.Warning_Text)
count_3 = List.Count(list=groupByKey.groups@L2)
sortByKey = List.SortByKey(list=groupByKey.uniqueKeys, keys=count_3)
code_block_17 = CodeBlock(count=sortByKey.sortedKeys, description=sortByKey.sortedList) { count+" - "+description; }

# group: Processing
reverse = List.Reverse(list=code_block_17)
code_block_18 = CodeBlock { 0..4; }
getItemAtIndex = List.GetItemAtIndex(list=reverse, index=code_block_18)
code_block_19 = CodeBlock(x=getItemAtIndex) { ". "; x[0]; x[1]; x[2]; x[3]; x[4]; }
join = String.Join(separator=code_block_19.out0, string0=code_block_16, string1=code_block_19.out1, string2=code_block_19.out2, string3=code_block_19.out3, string4=code_block_19.out4, string5=code_block_19.out5)
watch_2 = Watch(join)

code_block_20 = CodeBlock { " "; }

# group: Views not on sheets
code_block_21 = CodeBlock { "Views"; }
byName = Category.ByName(name=code_block_21)
all_elements_of_category = ElementsOfCategory(Category=byName)
code_block_22 = CodeBlock { "Sheet Number"; }
code_block_23 = CodeBlock { "---"; }
code_block_24 = CodeBlock { "Legend"; }

# group: Filtering
code_block_25 = CodeBlock { null; }
# note: Instead of Manage.RevomeNull
eq_2 = all_elements_of_category == code_block_25
filterByBoolMask_2 = List.FilterByBoolMask(list=all_elements_of_category, mask=eq_2)

# group (continued): Views not on sheets
parameterByName = Parameter.ParameterByName(element=filterByBoolMask_2.out, name=code_block_22)
string_from_object_3 = FromObject(obj=parameterByName)
contains = String.Contains(string=string_from_object_3, searchFor=code_block_23)
filterByBoolMask_3 = List.FilterByBoolMask(list=filterByBoolMask_2.out, mask=contains)
viewType = Custom[View.ViewType](view=filterByBoolMask_3.in)  # From Clockworks 1.0.3
eq_3 = viewType == code_block_24
filterByBoolMask_4 = List.FilterByBoolMask(list=filterByBoolMask_3.in, mask=eq_3)
code_block_26 = CodeBlock(viewsNotOnSheets=filterByBoolMask_4.out) { viewsNotOnSheets; "View Folder 1 (View type)"; ""; }
getParameterValueByName_2 = Element.GetParameterValueByName(element=code_block_26.viewsNotOnSheets, parameterName=code_block_26.out1)
eq_4 = getParameterValueByName_2 == code_block_26.out2
viewType_2 = Custom[View.ViewType](view=filterByBoolMask_2.out)
eq_5 = viewType_2 == code_block_24
code_block_27 = CodeBlock(notOnSheets=filterByBoolMask_4.out, notClassified=eq_4, allViews=eq_5) { DSCore.List.Count(notOnSheets); DSCore.List.CountTrue(notClassified); DSCore.List.CountFalse(allViews); }
code_block_28 = CodeBlock(notOnSheets=code_block_27.out0, allViews=code_block_27.out2)
# ---------- code_block_28.designscript (11 lines) ----------
percent=notOnSheets/allViews*100;

DSCore.Math.Round(percent);

".";

percent>0;

" Please review and remove unneeded views.";

" No action required";
# ----------------------------------------
string_from_object_4 = FromObject(obj=code_block_28.out1)
split_2 = String.Split(string=string_from_object_4, separator0=code_block_28.out2)
code_block_29 = CodeBlock(x=code_block_28.out3, a=code_block_28.out4, b=code_block_28.out5) { x?a:b; }
code_block_30 = CodeBlock(notOnSheets=code_block_27.out0, notClassified=code_block_27.out1, percent=split_2, statement=code_block_29)
# ---------- code_block_30.designscript (15 lines) ----------
"There are "

+notOnSheets+

" views not placed on sheets. "

+notClassified+

" of those views are unclassified. That is "

+percent[0]+

" % of all views in the model."

+statement;
# ----------------------------------------

# group: Rooms
acg_quick_redundant_room_check = Custom[ACG Quick Redundant Room Check]()
code_block_31 = CodeBlock(numRedundantRooms=acg_quick_redundant_room_check) { numRedundantRooms==0; "."; }
string_from_object_5 = FromObject(obj=acg_quick_redundant_room_check)
split_3 = String.Split(string=string_from_object_5, separator0=code_block_31.out1)
code_block_32 = CodeBlock(numRedundantRooms=split_3)
# ---------- code_block_32.designscript (6 lines) ----------
"Excellent! There are no redundant Rooms in the model.";


"There are "
+numRedundantRooms[0]+
" redundant Rooms in the model. Please use a Room Schedule to delete all redundant rooms.";
# ----------------------------------------
code_block_33 = CodeBlock(x=code_block_31.out0, a=code_block_32.out0, b=code_block_32.out1) { x?a:b; }

# group: Areas
acg_quick_redundant_area_check = Custom[ACG Quick Redundant Area Check]()
code_block_34 = CodeBlock(numRedundantAreas=acg_quick_redundant_area_check) { numRedundantAreas>0; "."; }
string_from_object_6 = FromObject(obj=acg_quick_redundant_area_check)
split_4 = String.Split(string=string_from_object_6, separator0=code_block_34.out1)
code_block_35 = CodeBlock(numRedundantAreass=split_4)
# ---------- code_block_35.designscript (6 lines) ----------
"Excellent! There are no redundant Areas in the model.";


"There are "
+numRedundantAreass[0]+
" redundant Areas in the model. Please use an Area Schedule to delete all redundant areas.";
# ----------------------------------------
code_block_36 = CodeBlock(x=code_block_34.out0, a=code_block_35.out1, b=code_block_35.out0) { x?a:b; }

# group: Imported CADS
acg_quick_cad_import_check = Custom[ACG Quick CAD Import Check]()
string_from_object_7 = FromObject(obj=acg_quick_cad_import_check)
code_block_37 = CodeBlock { "."; }
split_5 = String.Split(string=string_from_object_7, separator0=code_block_37)
code_block_38 = CodeBlock(numImported=acg_quick_cad_import_check, stringImported=split_5)
# ---------- code_block_38.designscript (7 lines) ----------
numImported>0;

"Excellent! All CAD files in the model have been linked. No action required.";

"There are "
+stringImported[0]+
" imported CAD files in the model. Please remove/link them and use script to remove imported line patterns.";
# ----------------------------------------
code_block_39 = CodeBlock(x=code_block_38.out0, a=code_block_38.out2, b=code_block_38.out1) { x?a:b; }

# group: Linked RVT
code_block_40 = CodeBlock { catRVT=Revit.Category.ByName("RVT Links"); ElementQueries.OfCategory(catRVT); }
code_block_41 = CodeBlock(lst=code_block_40.out1) { DSCore.List.Count(lst); incompliantRVT>0; "."; }  # unwired: incompliantRVT
string_from_object_8 = FromObject(obj=code_block_41.out0)
split_6 = String.Split(string=string_from_object_8, separator0=code_block_41.out2)
code_block_42 = CodeBlock(num=split_6) { num=="0"; "no"; num; }
code_block_43 = CodeBlock(x=code_block_42.out0, a=code_block_42.out1, b=code_block_42.num) { x?a:b; }
code_block_44 = CodeBlock(allRVT=code_block_43)
# ---------- code_block_44.designscript (3 lines) ----------
"There are "
+allRVT[0]+
" RVT files linked in the model.";
# ----------------------------------------

code_block_45 = CodeBlock { true; }
groups_audit = Python(IN[0]=code_block_45)  # IronPython2
# ---------- groups_audit.python (107 lines) ----------
import clr
clr.AddReference('RevitAPI')
import Autodesk
from Autodesk.Revit.DB import *

clr.AddReference("RevitNodes")
import Revit
clr.ImportExtensions(Revit.Elements)

clr.AddReference("RevitServices")
import RevitServices
from RevitServices.Persistence import DocumentManager
from RevitServices.Transactions import TransactionManager

from operator import itemgetter

doc = DocumentManager.Instance.CurrentDBDocument

groupTypes = FilteredElementCollector(doc).OfClass(GroupType)

output = []
out = []
groupNames = []
groupInstances = []
groupFamily = []
unconHeight = []
groupNested = [] 
nestedNames = []
nestedGroups = []
restoreExcluded = []
elements = []
output = []

if IN[0]:
	TransactionManager.Instance.EnsureInTransaction(doc)
	
	for groupType in groupTypes:
		
		groupNames.append(groupType.LookupParameter("Type Name").AsString())
		groupInstances.append(groupType.Groups.Size)
		groupFamily.append(groupType.FamilyName.ToString())
		if groupType.Groups.Size>0:
			groupSet = groupType.Groups.ForwardIterator()
			numOfMem = 0
			excluded = "False"
			uncon = "False"
			nested = "False"
			while groupSet.MoveNext():
				names = []
				membersIds = groupSet.Current.GetMemberIds()
				for id in membersIds:
					item = doc.GetElement(id)
					if item.Category != None:
						if item.Category.Name == "Walls":
							try:
								if item.LookupParameter("Top Constraint").AsString() == "Unconnected":
									uncon = "True"
							except:
								pass
					
						if item.Category.Name == "Model Groups" or item.Category.Name == "Detail Groups":
							nested = "True"
							names.append(item.Name)
				
				if numOfMem == 0:
					numOfMem = len(membersIds)
				elif numOfMem < len(membersIds):
					numOfMem = len(membersIds)
					excluded = "True"
				elif numOfMem > len(membersIds):
					excluded = "True"
			restoreExcluded.append(excluded)
			unconHeight.append(uncon)
			groupNested.append(nested)
			nestedNames.append(names)
		else:
			restoreExcluded.append("No instances in project")
			
			
		
	output.append(groupNames)
	output.append(groupFamily)
	output.append(groupInstances)
	output.append(restoreExcluded)
	output.append(unconHeight)
	output.append(groupNested)
	
	
	output = map(list, zip(*output))
	for i in xrange(len(output)):
		temp = output[i]
		for item in nestedNames[i]:
			if item != None:
				temp.append(item)
		out.append(temp)
		
	
	out = sorted(out, key=itemgetter(0))	
	header = ["Group name", "Type of group", "Number of instances", "Restore excluded", "Unconnected height", "Groups nested", "Nested groups names"]
	out.insert(0,header)
	OUT = out

	#OUT = nestedNames
	TransactionManager.Instance.TransactionTaskDone()
else: 
	OUT = "Set RunIt to true"
	
# ----------------------------------------
transpose_2 = List.Transpose(lists=groups_audit)
code_block_46 = CodeBlock(x=transpose_2) { x[0]; x[2]; x[5]; }

# group: Group Check
get_all_detail_groups = Custom[Get All Detail Groups]()  # package archi-lab.net; This node will retrieve all instances of Detail Groups in the model.
typeCollector = Custom[ModelGroup.TypeCollector]()  # package BVN; Returns all the types (not instances) from all model groups in the project
name = Element.Name(element=typeCollector)
restOfItems_3 = List.RestOfItems(list=code_block_46.out0)
create = List.Create(item0=get_all_detail_groups.groupNames, item1=name, item2=restOfItems_3)
flatten_3 = List.Flatten(list=create)
uniqueItems_2 = List.UniqueItems(list=flatten_3)
code_block_47 = CodeBlock { "ACG-"; }
startsWith = String.StartsWith(string=uniqueItems_2, searchFor=code_block_47)
filterByBoolMask_5 = List.FilterByBoolMask(list=uniqueItems_2, mask=startsWith)
code_block_48 = CodeBlock { 0; 8; "-"; }
remove = String.Remove(string=filterByBoolMask_5.in, startIndex=code_block_48.out0, count=code_block_48.out1)
startsWith_2 = String.StartsWith(string=remove, searchFor=code_block_48.out2)
filterByBoolMask_6 = List.FilterByBoolMask(list=filterByBoolMask_5.in, mask=startsWith_2)
list_create_3 = List.Create(item0=filterByBoolMask_6.out, item1=filterByBoolMask_5.out)
flatten_4 = List.Flatten(list=list_create_3)
uniqueItems_3 = List.UniqueItems(list=flatten_4)
code_block_49 = CodeBlock(compGroups=filterByBoolMask_6.in, incompGroups=uniqueItems_3)
# ---------- code_block_49.designscript (11 lines) ----------
compNames=DSCore.List.Count(compGroups);

incompNames=DSCore.List.Count(incompGroups);

percent=incompNames/(incompNames+compNames)*100;

percent==0;

DSCore.Math.Round(percent);

".";
# ----------------------------------------
string_from_object_9 = FromObject(obj=code_block_49.out4)
split_7 = String.Split(string=string_from_object_9, separator0=code_block_49.out5)
code_block_50 = CodeBlock(percent=split_7)
# ---------- code_block_50.designscript (5 lines) ----------
SEEVIC Campus, Runnymede Chase,
Benfleet, SS7 1TW"Excellent! All groups in the model are named in compliance with ACG's naming protocols.";

percent[0]+
"% of all groups in the model are not named in compliance with ACG's naming protocols. Please review and rename.";
# ----------------------------------------
code_block_51 = CodeBlock(x=code_block_49.out3, a=code_block_50.out0, b=code_block_50.out1) { x?a:b; }

restOfItems_4 = List.RestOfItems(list=code_block_46.out1)
code_block_52 = CodeBlock(numInstances=restOfItems_4)
# ---------- code_block_52.designscript (13 lines) ----------
lst=numInstances==0;

numUsed=DSCore.List.CountFalse(lst);
numUnused=DSCore.List.CountTrue(lst);


percent=numUnused/(numUnused+numUsed)*100;

percent==0;

DSCore.Math.Round(percent);

".";
# ----------------------------------------
string_from_object_10 = FromObject(obj=code_block_52.out5)
split_8 = String.Split(string=string_from_object_10, separator0=code_block_52.out6)
code_block_53 = CodeBlock(percent=split_8)
# ---------- code_block_53.designscript (4 lines) ----------
"Excellent! There are no unused groups in the model.";

percent[0]+
"% of all groups in the model are unused. Please review and delete if unneeded.";
# ----------------------------------------
code_block_54 = CodeBlock(x=code_block_52.out4, a=code_block_53.out0, b=code_block_53.out1) { x?a:b; }
restOfItems_5 = List.RestOfItems(list=code_block_46.out2)
string_from_object_11 = FromObject(obj=restOfItems_5)
code_block_55 = CodeBlock { "False"; }
eq_6 = string_from_object_11 == code_block_55
code_block_56 = CodeBlock(lstGroups=eq_6)
# ---------- code_block_56.designscript (11 lines) ----------
compNest=DSCore.List.CountTrue(lstGroups);

incompNest=DSCore.List.CountFalse(lstGroups);

percent=incompNest/(compNest+incompNest)*100;

percent==0;

DSCore.Math.Round(percent);

".";
# ----------------------------------------
string_from_object_12 = FromObject(obj=code_block_56.out4)
split_9 = String.Split(string=string_from_object_12, separator0=code_block_56.out5)
code_block_57 = CodeBlock(percent=split_9)
# ---------- code_block_57.designscript (4 lines) ----------
"Excellent! There are no nested groups in the model.";

percent[0]+
"% of all groups in the model are nested. Please review.";
# ----------------------------------------
code_block_58 = CodeBlock(x=code_block_56.out3, a=code_block_57.out0, b=code_block_57.out1) { x?a:b; }
code_block_59 = CodeBlock(statementNaming=code_block_51, statementNesting=code_block_54, statementUsed=code_block_58)
# ---------- code_block_59.designscript (5 lines) ----------
statementNaming
+"\n"+
statementNesting
+"\n"+
statementUsed;
# ----------------------------------------

# group: Warnings - join/overlap
code_block_60 = CodeBlock { ["join","overlap", "but miss", "hosted"]; }
contains_2 = String.Contains(string=getWarnings.Warning_Text, searchFor=code_block_60@@L1)
transpose_3 = List.Transpose(lists=contains_2)
anyTrue = Orchid.Common.List.AnyTrue(list=transpose_3@@L2)
code_block_61 = CodeBlock(warn=anyTrue) { num=DSCore.List.CountTrue(warn); "."; num>0; "Excellent! All elements in the model are joined/hosted correctly"; }
string_from_object_13 = FromObject(obj=code_block_61.num)
split_10 = String.Split(string=string_from_object_13, separator0=code_block_61.out1)
code_block_62 = CodeBlock(numWarnings=split_10)
# ---------- code_block_62.designscript (5 lines) ----------
"There are "

+numWarnings[0]+

" warnings associated with overlapping or incorrectly joined/hosted elements in the model.";
# ----------------------------------------
code_block_63 = CodeBlock(x=code_block_61.out2, a=code_block_62, b=code_block_61.out3) { x?a:b; }

# group: Processing
filterByBoolMask_7 = List.FilterByBoolMask(list=getWarnings.Warning_Text, mask=anyTrue)
groupByKey_2 = List.GroupByKey(list=filterByBoolMask_7.in, keys=filterByBoolMask_7.in)
count_4 = List.Count(list=groupByKey_2.groups@L2)
sortByKey_2 = List.SortByKey(list=groupByKey_2.uniqueKeys, keys=count_4)
code_block_64 = CodeBlock(count=sortByKey_2.sortedKeys, description=sortByKey_2.sortedList) { count+" - "+description; }

# group: Processing
reverse_2 = List.Reverse(list=code_block_64)
code_block_65 = CodeBlock { 0..4; }
getItemAtIndex_2 = List.GetItemAtIndex(list=reverse_2, index=code_block_65)
code_block_66 = CodeBlock(x=getItemAtIndex_2) { ". "; x[0]; x[1]; x[2]; x[3]; x[4]; }
join_2 = String.Join(separator=code_block_66.out0, string0=code_block_63, string1=code_block_66.out1, string2=code_block_66.out2, string3=code_block_66.out3, string4=code_block_66.out4, string5=code_block_66.out5)
watch_3 = Watch(join_2)

# group: Check Sheets
acg_quick_sheet_naming_check = Custom[ACG Quick Sheet Naming Check](NumberLength=code_block_9.out1)
code_block_67 = CodeBlock(result=acg_quick_sheet_naming_check.Results) { result==0; "."; }
string_from_object_14 = FromObject(obj=acg_quick_sheet_naming_check.Results)
split_11 = String.Split(string=string_from_object_14, separator0=code_block_67.out1)
code_block_68 = CodeBlock(result=split_11)
# ---------- code_block_68.designscript (4 lines) ----------
"Excellent! All sheets in the model are numbered correctly.";

result[0]+
"% of all sheets in the model are not numbered in compliance with ACG's protocols. Please review and renumber.";
# ----------------------------------------
code_block_69 = CodeBlock(x=code_block_67.out0, a=code_block_68.out0, b=code_block_68.out1) { x?a:b; }

# group: Processing - Views on PRODUCTION sheet naming
ACGQuickAuditViewsOnSheetsNamingCheck = Custom[ACGQuickAuditViewsOnSheetsNamingCheck]()  # Check views placed on PRODUCTION sheets. Only Plans, Elevations and Sections
string_from_object_15 = FromObject(obj=ACGQuickAuditViewsOnSheetsNamingCheck.Result)
code_block_70 = CodeBlock { "."; }
split_12 = String.Split(string=string_from_object_15, separator0=code_block_70)
code_block_71 = CodeBlock(percent=split_12)
# ---------- code_block_71.designscript (4 lines) ----------
"Excellent! All views placed on sheets are named in compliance with ACG's protocols.";

percent[0]+
"% of all views placed on sheets are not named in compliance with ACG's protocols. Please review and rename.";
# ----------------------------------------
code_block_72 = CodeBlock(result=ACGQuickAuditViewsOnSheetsNamingCheck.Result, a=code_block_71.out0, b=code_block_71.out1) { result==0?a:b; }

# group: Processing - Family Naming
acg_quick_family_naming_check = Custom[ACG Quick Family Naming Check]()
code_block_73 = CodeBlock(result=acg_quick_family_naming_check.Results_Naming) { result==0; "."; }
string_from_object_16 = FromObject(obj=acg_quick_family_naming_check.Results_Naming)
split_13 = String.Split(string=string_from_object_16, separator0=code_block_73.out1)
code_block_74 = CodeBlock(percent=split_13)
# ---------- code_block_74.designscript (4 lines) ----------
"Excellent! All families are named in compliance with ACG's protocols.";

percent[0]+
"% of all families are not named in compliance with ACG's protocols. Please review and rename.";
# ----------------------------------------
code_block_75 = CodeBlock(x=code_block_73.out0, a=code_block_74.out0, b=code_block_74.out1) { x?a:b; }

ACGQuickLevelsAndGridsCheck = Custom[ACGQuickLevelsAndGridsCheck]()

# group: Processing
code_block_76 = CodeBlock(result=ACGQuickLevelsAndGridsCheck.Result_percent) { result==0; "."; }
string_from_object_17 = FromObject(object=ACGQuickLevelsAndGridsCheck.Result_percent)
split_14 = String.Split(string=string_from_object_17, separator0=code_block_76.out1)
code_block_77 = CodeBlock(percent=split_14)
# ---------- code_block_77.designscript (6 lines) ----------
"Excellent! All Levels and Grids in the model are pinned and in the correct workset.";

percent[0]+
"% of all Levels and Grids elements are not pinned or in the correct workset. ";
"Please review and correct.";
"";
# ----------------------------------------
code_block_78 = CodeBlock(x=code_block_76.out0, a=code_block_77.out0, b=code_block_77.out1) { x?a:b; }
code_block_79 = CodeBlock(x=code_block_76.out0, a=code_block_77.out3, b=code_block_77.out2) { x?a:b; }

# group: Processing
code_block_80 = CodeBlock(result=ACGQuickLevelsAndGridsCheck.Levels_number) { result==0; "."; }
string_from_object_18 = FromObject(object=ACGQuickLevelsAndGridsCheck.Levels_number)
split_15 = String.Split(string=string_from_object_18, separator0=code_block_80.out1)
code_block_81 = CodeBlock(lvls=split_15)
# ---------- code_block_81.designscript (3 lines) ----------
lvls[0]+
" Levels are not pinned or in the correct workset. ";
" ";
# ----------------------------------------
code_block_82 = CodeBlock(x=code_block_80.out0, a=code_block_81.out1, b=code_block_81.out0) { x?a:b; }

# group: Processing
code_block_83 = CodeBlock(result=ACGQuickLevelsAndGridsCheck.Grids_number) { result==0; "."; }
string_from_object_19 = FromObject(object=ACGQuickLevelsAndGridsCheck.Grids_number)
split_16 = String.Split(string=string_from_object_19, separator0=code_block_83.out1)
code_block_84 = CodeBlock(grds=split_16)
# ---------- code_block_84.designscript (3 lines) ----------
grds[0]+
" Grids are not pinned or in the correct workset. ";
" ";
# ----------------------------------------
code_block_85 = CodeBlock(x=code_block_83.out0, a=code_block_84.out1, b=code_block_84.out0) { x?a:b; }

code_block_86 = CodeBlock(a=code_block_78, b=code_block_82, c=code_block_85, d=code_block_79) { a+b+c+d; }

# group: Processing - Location
code_block_87 = CodeBlock { Revit.Category.ByName("Project Information"); "Project Address"; }
all_elements_of_category_2 = ElementsOfCategory(Category=code_block_87.out0)
getParameterValueByName_3 = Element.GetParameterValueByName(element=all_elements_of_category_2, parameterName=code_block_87.out1)
siteLocation = SiteLocation()
string_from_object_20 = FromObject(object=siteLocation)
code_block_88 = CodeBlock { ": "; }
split_17 = String.Split(string=string_from_object_20, separator0=code_block_88)
code_block_89 = CodeBlock(locTxt=getParameterValueByName_3, locSite=split_17)
# ---------- code_block_89.designscript (6 lines) ----------
lstTxt = DSCore.String.Split(locTxt, "\n");

concat = DSCore.String.Concat(lstTxt);
output = concat[0];

check = DSCore.String.StartsWith(locSite[1], output);
# ----------------------------------------
code_block_90 = CodeBlock()
# ---------- code_block_90.designscript (2 lines) ----------
"Excellent! The GPS location under Manage matches the project's address.";
"The GPS location under Manage does not match the project's address. Please review.";
# ----------------------------------------
code_block_91 = CodeBlock(x=code_block_89.check, a=code_block_90.out0, b=code_block_90.out1) { x?a:b; }
code_block_92 = CodeBlock(x=code_block_91) { x[0]; }

# group: Processing - Templates
collectallviewtemplates_python = Python()  # "CollectAllViewTemplates - Python Script"; IronPython2; unwired: IN[0]
# ---------- collectallviewtemplates_python.python (19 lines) ----------
# https://forum.dynamobim.com/t/get-all-view-templates-with-python/24527/3

import clr
clr.AddReference('RevitAPI')
from Autodesk.Revit.DB import*

clr.AddReference('RevitServices')
from RevitServices.Persistence import DocumentManager
from RevitServices.Transactions import TransactionManager

clr.AddReference('ProtoGeometry')
from Autodesk.DesignScript.Geometry import *

doc = DocumentManager.Instance.CurrentDBDocument

viewswithoutnull = [t for t in FilteredElementCollector(doc).OfClass
(View).ToElements() if t.IsTemplate and t.ViewType < ViewType.ThreeD]

OUT = viewswithoutnull
# ----------------------------------------
name_2 = Element.Name(element=collectallviewtemplates_python)
code_block_93 = CodeBlock { "ACG-"; 0; 8; "-"; }
startsWith_3 = String.StartsWith(string=name_2, searchFor=code_block_93.out0)
filterByBoolMask_8 = List.FilterByBoolMask(list=name_2, mask=startsWith_3)
remove_2 = String.Remove(string=filterByBoolMask_8.in, startIndex=code_block_93.out1, count=code_block_93.out2)
startsWith_4 = String.StartsWith(string=remove_2, searchFor=code_block_93.out3)
code_block_94 = CodeBlock { true; }
getAll = Custom[View.GetAll](toggle=code_block_94)  # package BVN; Gets all views except for view templates
viewTemplate = archilab.Revit.Views.Views.ViewTemplate(view=getAll)
uniqueItems_4 = List.UniqueItems(list=viewTemplate)
isNull = Object.IsNull(object=uniqueItems_4)
filterByBoolMask_9 = List.FilterByBoolMask(list=uniqueItems_4, mask=isNull)
setDifference = List.SetDifference(list1=collectallviewtemplates_python, list2=filterByBoolMask_9.out)
code_block_result_use = CodeBlock(tempPy=collectallviewtemplates_python, nonComp=setDifference)
# ---------- code_block_result_use.designscript (7 lines) ----------
numTotal=DSCore.List.Count(tempPy);
numNonComp=DSCore.List.Count(nonComp);

percentUse=numNonComp/numTotal*100;
".";
percentRound=DSCore.Math.Round(percentUse);
percentRound==0;
# ----------------------------------------
code_block_result_naming = CodeBlock(lst=startsWith_4, numTotal=code_block_result_use.numTotal)
# ---------- code_block_result_naming.designscript (8 lines) ----------
numComp=DSCore.List.CountTrue(lst);

percentName=(numTotal-numComp)/numTotal*100;
".";

percentRound=DSCore.Math.Round(percentName);

percentRound==0;
# ----------------------------------------
string_from_object_21 = FromObject(obj=code_block_result_naming.percentRound)
split_18 = String.Split(string=string_from_object_21, separator0=code_block_result_naming.out2)
string_from_object_22 = FromObject(obj=code_block_result_use.percentRound)
split_19 = String.Split(string=string_from_object_22, separator0=code_block_result_use.out3)
code_block_95 = CodeBlock(persentName=split_18, persentUse=split_19)
# ---------- code_block_95.designscript (8 lines) ----------
"Excellent! All view templates are named in compliance with ACG's naming protocols. ";
persentName[0]+
"% of all templates in the model are not named in compliance with ACG's naming protocols. Please rename.";


"All view templates are in use. No action required. ";
persentUse[0]+
"% of all templates in the model are not applied to a view. Please review and remove if unneeded.";
# ----------------------------------------
code_block_96 = CodeBlock(x=code_block_result_naming.out4, a=code_block_95.out0, b=code_block_95.out1) { x?a:b; }
code_block_97 = CodeBlock(x=code_block_result_use.out5, a=code_block_95.out2, b=code_block_95.out3) { x?a:b; }
code_block_98 = CodeBlock(statementNaming=code_block_96, statementUse=code_block_97)
# ---------- code_block_98.designscript (3 lines) ----------
statementNaming
+"\n"+
statementUse;
# ----------------------------------------

# group: Processing - Floor plans placed on sheets
code_block_99 = CodeBlock { Revit.Category.ByName("Views"); }
all_elements_of_category_3 = ElementsOfCategory(Category=code_block_99)
code_block_100 = CodeBlock { null; }
# note: Instead of Manage.RevomeNull
eq_7 = all_elements_of_category_3 == code_block_100
filterByBoolMask_10 = List.FilterByBoolMask(list=all_elements_of_category_3, mask=eq_7)
code_block_101 = CodeBlock { "Sheet Name"; ""; }
getParameterValueByName_4 = Element.GetParameterValueByName(element=filterByBoolMask_10.out, parameterName=code_block_101.out0)
eq_8 = getParameterValueByName_4 == code_block_101.out1
filterByBoolMask_11 = List.FilterByBoolMask(list=filterByBoolMask_10.out, mask=eq_8)
code_block_102 = CodeBlock { "View Scale"; }
getParameterValueByName_5 = Element.GetParameterValueByName(element=filterByBoolMask_11.out, parameterName=code_block_102)
code_block_103 = CodeBlock(viewScale=getParameterValueByName_5) { viewScale>=50; false; "Scope Box"; }
code_block_104 = CodeBlock { false; input; }  # unwired: input
# note: Instead of Manage.ReplaceNulls
code_block_105 = CodeBlock(input=code_block_103.out0, a=code_block_104.out0, b=code_block_104.input) { input == null?a:b; }
filterByBoolMask_12 = List.FilterByBoolMask(list=filterByBoolMask_11.out, mask=code_block_105)
getParameterValueByName_6 = Element.GetParameterValueByName(element=filterByBoolMask_12.in, parameterName=[code_block_103.out2, code_block_103.out2])
code_block_106 = CodeBlock(scopeBox=getParameterValueByName_6) { scopeBox=="None"; }
code_block_107 = CodeBlock(views=code_block_106)
# ---------- code_block_107.designscript (9 lines) ----------
numComp=DSCore.List.CountFalse(views);
numNonComp=DSCore.List.CountTrue(views);

percent=numNonComp/(numComp+numNonComp)*100;

percentRound=DSCore.Math.Round(percent);
percentRound>0;

".";
# ----------------------------------------
string_from_object_23 = FromObject(obj=code_block_107.percentRound)
split_20 = String.Split(string=string_from_object_23, separator0=code_block_107.out5)
code_block_108 = CodeBlock(percent=split_20)
# ---------- code_block_108.designscript (3 lines) ----------
"Excellent! All large scale Views placed on Sheets have Scope Box assigned to.";
percent[0]+
"% of all large scale Views placed on Sheets have no Scope Box assigned to. Pleare review and assign where possible.";
# ----------------------------------------
code_block_109 = CodeBlock(x=code_block_107.out4, a=code_block_108.out1, b=code_block_108.out0) { x?a:b; }

# group: Processing
acg_quickaudit_revisioncheck = Custom[ACG QuickAudit.RevisionCheck]()  # Checks if PRODUCTION sheets have no revision or if there are revisions assigned to WIP sheets

code_block_results_text = CodeBlock(warnings=watch_2, emptyRow=code_block_20, redundantViews=code_block_30, redundantRooms=code_block_33, redundantAreas=code_block_36, CADImports=code_block_39, CADLinks=watch, RVTLinks=code_block_44, levelOfDetail=code_block_20, detailGroups=code_block_20, groups=code_block_59, warningsJoins=watch_3, sheets=code_block_69, views=code_block_72, families=code_block_75, worksets=code_block_20, levelsGrids=code_block_86, location=code_block_92, folder=code_block_20, archive=code_block_20, templates=code_block_98, scopeBoxes=code_block_109, materals=code_block_20, overrides=code_block_20, sheetIssue=acg_quickaudit_revisioncheck.Result, detailItems=code_block_20, tags=code_block_20, correctLevels=code_block_20, position=code_block_20, basePoint=code_block_20)
# ---------- code_block_results_text.designscript (47 lines) ----------
warnings;
emptyRow;
redundantViews;
redundantRooms;
emptyRow;
redundantAreas;
emptyRow;
CADImports;
emptyRow;
CADLinks;
RVTLinks;
levelOfDetail;
emptyRow;
emptyRow;
detailGroups;
groups;
emptyRow;
warningsJoins;
emptyRow;
emptyRow;
emptyRow;
sheets;
emptyRow;
views;
emptyRow;
families;
emptyRow;
worksets;
levelsGrids;
location;
folder;
archive;
emptyRow;
emptyRow;
templates;
emptyRow;
scopeBoxes;
materals;
overrides;
sheetIssue;
detailItems;
tags;
emptyRow;
emptyRow;
correctLevels;
position;
basePoint;
# ----------------------------------------
list_create_4 = List.Create(item0=code_block_results_text.out0, item1=code_block_results_text.out1, item2=code_block_results_text.out2, item3=code_block_results_text.out3, item4=code_block_results_text.out4, item5=code_block_results_text.out5, item6=code_block_results_text.out6, item7=code_block_results_text.out7, item8=code_block_results_text.out8, item9=code_block_results_text.out9, item10=code_block_results_text.out10, item11=code_block_results_text.out11, item12=code_block_results_text.out12, item13=code_block_results_text.out13, item14=code_block_results_text.out14, item15=code_block_results_text.out15, item16=code_block_results_text.out16, item17=code_block_results_text.out17, item18=code_block_results_text.out18, item19=code_block_results_text.out19, item20=code_block_results_text.out20, item21=code_block_results_text.out21, item22=code_block_results_text.out22, item23=code_block_results_text.out23, item24=code_block_results_text.out24, item25=code_block_results_text.out25, item26=code_block_results_text.out26, item27=code_block_results_text.out27, item28=code_block_results_text.out28, item29=code_block_results_text.out29, item30=code_block_results_text.out30, item31=code_block_results_text.out31, item32=code_block_results_text.out32, item33=code_block_results_text.out33, item34=code_block_results_text.out34, item35=code_block_results_text.out35, item36=code_block_results_text.out36, item37=code_block_results_text.out37, item38=code_block_results_text.out38, item39=code_block_results_text.out39, item40=code_block_results_text.out40, item41=code_block_results_text.out41, item42=code_block_results_text.out42, item43=code_block_results_text.out43, item44=code_block_results_text.out44, item45=code_block_results_text.out45, item46=code_block_results_text.out46)

# group: Processing - push model health legacy
code_block_110 = CodeBlock()
# ---------- code_block_110.designscript (5 lines) ----------
catPI=Revit.Elements.Category.ByName("Project Information");
ElementQueries.OfCategory(catPI);

"Project Directory";
"ACG_Model Number";
# ----------------------------------------
getParameterValueByName_7 = Element.GetParameterValueByName(element=code_block_110.out1, parameterName=code_block_110.out2)
code_block_111 = CodeBlock(prjDir=getParameterValueByName_7) { prjDir+"\\06 Audit"; }
directory_from_path = DirectoryObject(path=code_block_111)
getDirectoryContents = FileSystem.GetDirectoryContents(directory=directory_from_path)
getParameterValueByName_8 = Element.GetParameterValueByName(element=code_block_110.out1, parameterName=code_block_110.out3)
string_from_object_24 = FromObject(object=getParameterValueByName_8)
contains_3 = String.Contains(string=getDirectoryContents.files, searchFor=string_from_object_24)
filterByBoolMask_13 = List.FilterByBoolMask(list=getDirectoryContents.files, mask=contains_3)
flatten_5 = List.Flatten(list=filterByBoolMask_13.in)
importCSV = Data.ImportCSV(filePath=flatten_5)
flatten_6 = List.Flatten()  # unwired: list
map = List.Map(list=importCSV, function=flatten_6)
string_from_object_25 = FromObject(object=map)
code_block_112 = CodeBlock { "null"; "0"; }
replace = String.Replace(string=string_from_object_25, searchFor=code_block_112.out0, replaceWith=code_block_112.out1)

# group: Processing
transpose_4 = List.Transpose(lists=replace)
code_block_113 = CodeBlock(x=transpose_4) { x[0]; x[12]; x[1]; x[2]; x[3]; x[4]; x[5]; x[7]; x[6]; x[8]; x[9]; x[10]; }
list_create_5 = List.Create(item0=code_block_113.out0, item1=code_block_113.out1, item2=code_block_113.out2, item3=code_block_113.out3, item4=code_block_113.out4, item5=code_block_113.out5, item6=code_block_113.out6, item7=code_block_113.out7, item8=code_block_113.out8, item9=code_block_113.out9, item10=code_block_113.out10, item11=code_block_113.out11)

# group: Processing
code_block_114 = CodeBlock { "ACG_RIBA STAGE"; "C12"; }
getParameterValueByName_9 = Element.GetParameterValueByName(element=code_block_12.out1, parameterName=code_block_114.out0, lacing=Longest)
code_block_115 = CodeBlock(value=getParameterValueByName_9) { "RIBA Stage "+value; }

# group: Visualisation
bb_data = Custom[BB Data](sheetName=code_block_10.out0, origin=code_block_11.out1, data=flatten_2)  # package BumbleBee; This node is a building block for different modes of writing to Excel files. You can combines this node into a list to write to multiple sheets or use just one to write to a single sheet.
code_block_116 = CodeBlock { "C19"; }
flatten_7 = List.Flatten(list=list_create_4)
bb_data_2 = Custom[BB Data](sheetName=code_block_10.out0, origin=code_block_116, data=flatten_7)
code_block_117 = CodeBlock { "BIM Project Audit"; "D16"; true; }
bb_data_3 = Custom[BB Data](sheetName=code_block_117.out0, origin=code_block_117.out1, data=list_create_5)
bb_data_4 = Custom[BB Data](sheetName=code_block_10.out0, origin=code_block_114.out1, data=code_block_115)

# group: Visualisation
code_block_118 = CodeBlock { true; }
list_create_6 = List.Create(item0=bb_data, item1=bb_data_2, item2=bb_data_3, item3=bb_data_4)
write_excel = Custom[Write Excel](filePath=code_block_9.out0, runIt=code_block_118, byColumn=code_block_118, BBData=list_create_6)  # package BumbleBee; This node will write data to Excel file and based on how your BBData nodes are structured it will either override the exsting file, create a new one and write a single worksheet or write multiple worksheets.
