# Dynamo graph Detailed Audit_2.dyn (Dynamo 2.12.1.8246)
# packages: Bang! 2020.4.24, BVN 1.6.1, archi-lab.net 2021.25.2521, Orchid 260.1.0.7729, Data-Shapes 2021.2.92, BumbleBee 2021.25.3

# group: Processing - RVT LINKS - ARCHIVED
code_block = CodeBlock { catRVT=Revit.Category.ByName("RVT Links"); ElementQueries.OfCategory(catRVT); }  # frozen
code_block_2 = CodeBlock(lst=code_block.out1) { DSCore.List.Count(lst); "."; }
string_from_object = FromObject(obj=code_block_2.out0)
split = String.Split(string=string_from_object, separator0=code_block_2.out1)
code_block_3 = CodeBlock(num=split) { num=="0"; "no"; num; }
code_block_4 = CodeBlock(x=code_block_3.out0, a=code_block_3.out1, b=code_block_3.num) { x?a:b; }
code_block_5 = CodeBlock(allRVT=code_block_4)
# ---------- code_block_5.designscript (3 lines) ----------
"There are "
+allRVT[0]+
" RVT files linked in the model.";
# ----------------------------------------

# group: Processing - CAD LINKS - ARCHIVE
code_block_6 = CodeBlock { true; false; }  # frozen
imports_audit = Python(IN[0]=code_block_6.out0, IN[1]=code_block_6.out1)  # IronPython2
# ---------- imports_audit.python (55 lines) ----------
import clr

clr.AddReference("RevitAPI")
import Autodesk
from Autodesk.Revit.DB import *

# Import DocumentManager and TransactionManager
clr.AddReference("RevitServices")
import RevitServices
from RevitServices.Persistence import DocumentManager
from RevitServices.Transactions import TransactionManager

# Import RevitAPI
clr.AddReference("RevitAPI")
import Autodesk
from Autodesk.Revit.DB import *

doc = DocumentManager.Instance.CurrentDBDocument
TransactionManager.Instance.EnsureInTransaction(doc)

links = []
imports = []
output = []
header = ["Link Name", "Link", "View Based", "View Name"]
collector = FilteredElementCollector(doc).OfClass(ImportInstance).ToElements()
output.append(header)

if IN[0]:
	for element in collector:
		out = []
		out.append(element.LookupParameter("Name").AsString())
		if element.IsLinked:
			out.append("True")
		else:
			out.append("False")
			if IN[1]:
				try:
					doc.Delete(element.Id)
				except:
					pass
		if element.ViewSpecific:
			out.append("True")
			view = doc.GetElement(element.OwnerViewId)
			out.append(view.Name.ToString())
		else:
			out.append("False")
			out.append("None")
		
		output.append(out)
else: 
	output.append("Set RunIt to True!")
#output.append(links)
	
TransactionManager.Instance.TransactionTaskDone()
OUT = output
# ----------------------------------------
transpose = List.Transpose(lists=imports_audit)
code_block_7 = CodeBlock(x=transpose) { x[0]; x[1]; }
string_from_object_2 = FromObject(obj=code_block_7.out0)
restOfItems = List.RestOfItems(list=string_from_object_2)
count = List.Count(list=restOfItems)
string_from_object_3 = FromObject(obj=code_block_7.out1)
restOfItems_2 = List.RestOfItems(list=string_from_object_3)
code_block_8 = CodeBlock { "True"; }
eq = restOfItems_2 == code_block_8
filterByBoolMask = List.FilterByBoolMask(list=restOfItems, mask=eq)
uniqueItems = List.UniqueItems(list=filterByBoolMask.in)
code_block_9 = CodeBlock(dwgLinks=uniqueItems)
# ---------- code_block_9.designscript (9 lines) ----------
numLinks=DSCore.List.Count(dwgLinks);

numLinks==0;

"There are no linked CAD files in the model. No action required.";

"There are "
+numLinks+
" linked CAD files in the model. Please review and remove unneeded.";
# ----------------------------------------
code_block_10 = CodeBlock(x=code_block_9.out1, a=code_block_9.out2, b=code_block_9.out3) { x?a:b; }

# group: Usage
code_block_11 = CodeBlock { "Detailed Audit"; }
acg_script_usage = Custom[ACG Script Usage](scriptName=code_block_11)  # Adds an entry to Excel document every time a script is run. The document is located in S:\Dynamo\05-UsageStats

file_path = Filename("..\ACG_logo.png")
file_from_path = FileObject(path=file_path)
readFromFile = Image.ReadFromFile(file=file_from_path)
code_block_12 = CodeBlock { "Cancel"; true; "Run"; 700; 350; }
code_block_13 = CodeBlock { "Select Excel file"; "Navigate"; "Sheet Number Length"; "4"; true; }
ui_filepath_data = Custom[UI.FilePath Data](InputName=code_block_13.out0, ButtonText=code_block_13.out1)  # package Data-Shapes; Create filepath input for UI.MultipleInputForm ++ . Check out www.data-shapes.net for more infos !
textbox_data = Custom[TextBox Data](InputName=code_block_13.out2, DefaultText=code_block_13.out3, IsNumberEntry=code_block_13.out4)  # package Data-Shapes; Create Data for TextBox input in UI.MultipleInputForm ++ . Check out www.data-shapes.net for more informations
list_create = List.Create(item0=ui_filepath_data, item1=textbox_data)
flatten = List.Flatten(list=list_create)
ui_multipleinputform = Custom[UI.MultipleInputForm ++](Logo_optional=readFromFile, ButtonText_optional=code_block_12.out2, Inputs=flatten, Toggle=code_block_12.out1, CancelButtonText_optional=code_block_12.out0, Width_optional=code_block_12.out3, LabelWidth_optional=code_block_12.out4)  # package Data-Shapes; Create a form with multiple inputs. see www.data-shapes.net for tutorials and infos!
code_block_14 = CodeBlock(filePath=ui_multipleinputform.User_Inputs, sheetLength=ui_multipleinputform.User_Inputs) { filePath[0]; sheetLength[1]; }

# group: Warnings
code_block_15 = CodeBlock { true; }
getWarnings = Bang.Revit.Elements.WarningTools.GetWarnings(toggle=code_block_15)
count_2 = List.Count(list=getWarnings.Warning_Text)
code_block_16 = CodeBlock(count=count_2)
# ---------- code_block_16.designscript (5 lines) ----------
"Currently there are "

+count+

" warnings in the model";
# ----------------------------------------

# group: Processing
groupByKey = List.GroupByKey(list=getWarnings.Warning_Text, keys=getWarnings.Warning_Text)
count_3 = List.Count(list=groupByKey.groups@L2)
sortByKey = List.SortByKey(list=groupByKey.uniqueKeys, keys=count_3)
code_block_17 = CodeBlock(count=sortByKey.sortedKeys, description=sortByKey.sortedList) { count+" - "+description; }

# group: Processing
reverse = List.Reverse(list=code_block_17)
code_block_18 = CodeBlock { 0..4; }
getItemAtIndex = List.GetItemAtIndex(list=reverse, index=code_block_18)
code_block_19 = CodeBlock(x=getItemAtIndex) { ". "; x[0]; x[1]; x[2]; x[3]; x[4]; }
join = String.Join(separator=code_block_19.out0, string0=code_block_16, string1=code_block_19.out1, string2=code_block_19.out2, string3=code_block_19.out3, string4=code_block_19.out4, string5=code_block_19.out5)
watch = Watch(join)

# group: Processing - VIEWS CHECK
code_block_20 = CodeBlock { "Views"; }
byName = Category.ByName(name=code_block_20)
all_elements_of_category = ElementsOfCategory(Category=byName)
code_block_21 = CodeBlock { null; }
# note: Instead of Manage.RevomeNull
eq_2 = all_elements_of_category == code_block_21
filterByBoolMask_2 = List.FilterByBoolMask(list=all_elements_of_category, mask=eq_2)
code_block_22 = CodeBlock { "Sheet Number"; }
parameterByName = Parameter.ParameterByName(element=filterByBoolMask_2.out, name=code_block_22)
string_from_object_4 = FromObject(obj=parameterByName)
code_block_23 = CodeBlock { "---"; }
contains = String.Contains(string=string_from_object_4, searchFor=code_block_23)
filterByBoolMask_3 = List.FilterByBoolMask(list=filterByBoolMask_2.out, mask=contains)
viewType = Custom[View.ViewType](view=filterByBoolMask_3.in)  # From Clockworks 1.0.3
code_block_24 = CodeBlock { "Legend"; }
eq_3 = viewType == code_block_24
filterByBoolMask_4 = List.FilterByBoolMask(list=filterByBoolMask_3.in, mask=eq_3)
code_block_25 = CodeBlock(viewsNotOnSheets=filterByBoolMask_4.out) { viewsNotOnSheets; "View Folder 1 (View type)"; ""; }
getParameterValueByName = Element.GetParameterValueByName(element=code_block_25.viewsNotOnSheets, parameterName=code_block_25.out1)
eq_4 = getParameterValueByName == code_block_25.out2
viewType_2 = Custom[View.ViewType](view=filterByBoolMask_2.out)
eq_5 = viewType_2 == code_block_24
code_block_26 = CodeBlock(notOnSheets=filterByBoolMask_4.out, notClassified=eq_4, allViews=eq_5) { DSCore.List.Count(notOnSheets); DSCore.List.CountTrue(notClassified); DSCore.List.CountFalse(allViews); }
code_block_27 = CodeBlock(notOnSheets=code_block_26.out0, allViews=code_block_26.out2)
# ---------- code_block_27.designscript (11 lines) ----------
percent=notOnSheets/allViews*100;

DSCore.Math.Round(percent);

".";

percent>0;

" Please review and remove unneeded views.";

" No action required";
# ----------------------------------------
string_from_object_5 = FromObject(obj=code_block_27.out1)
split_2 = String.Split(string=string_from_object_5, separator0=code_block_27.out2)
code_block_28 = CodeBlock(x=code_block_27.out3, a=code_block_27.out4, b=code_block_27.out5) { x?a:b; }
code_block_29 = CodeBlock(notOnSheets=code_block_26.out0, notClassified=code_block_26.out1, percent=split_2, statement=code_block_28)
# ---------- code_block_29.designscript (15 lines) ----------
"There are "

+notOnSheets+

" views not placed on sheets. "

+notClassified+

" of those views are unclassified. That is "

+percent[0]+

" % of all views in the model."

+statement;
# ----------------------------------------

# group: Processing - ROOMS
python_script = Python()  # IronPython2
# ---------- python_script.python (21 lines) ----------
import clr
clr.AddReference('RevitAPI')
from Autodesk.Revit.DB import*
clr.AddReference('RevitServices')
from RevitServices.Persistence import DocumentManager

doc = DocumentManager.Instance.CurrentDBDocument

rooms = FilteredElementCollector(doc)\
.OfCategory(BuiltInCategory.OST_Rooms)\
.ToElements()

countBad = sum(1 for room in rooms if not room.Area > 0)

if countBad == 0:
	OUT = "Excellent! There are no redundant rooms in the model."
elif countBad == 1:
	OUT = "There is 1 redundant Rooms in the model. Please use a Room Schedule or ACG Tools to delete it."
else:
	OUT = "There are " + str(countBad) +\
	" redundant Rooms in the model. Please use a Room Schedule or ACG Tools to delete all redundant rooms."
# ----------------------------------------

# group: Processing - AREAS
python_script_2 = Python()  # IronPython2
# ---------- python_script_2.python (21 lines) ----------
import clr
clr.AddReference('RevitAPI')
from Autodesk.Revit.DB import*
clr.AddReference('RevitServices')
from RevitServices.Persistence import DocumentManager

doc = DocumentManager.Instance.CurrentDBDocument

areas = FilteredElementCollector(doc)\
.OfCategory(BuiltInCategory.OST_Areas)\
.ToElements()

countBad = sum(1 for area in areas if not area.Area > 0)

if countBad == 0:
	OUT = "Excellent! There are no redundant Areas in the model."
elif countBad == 1:
	OUT = "There is 1 redundant Area in the model. Please use an Area Schedule or ACG Tools to delete it."
else:
	OUT = "There are " + str(countBad) +\
	" redundant Areas in the model. Please use an Area Schedule or ACG Tools to delete all redundant Areas."
# ----------------------------------------

# group: Processing - CAD IMPORTS
python_script_3 = Python()  # IronPython2
# ---------- python_script_3.python (30 lines) ----------
import clr
clr.AddReference("RevitAPI")
import Autodesk
from Autodesk.Revit.DB import *
# Import DocumentManager and TransactionManager
clr.AddReference("RevitServices")
import RevitServices
from RevitServices.Persistence import DocumentManager
# Import RevitAPI
clr.AddReference("RevitAPI")
import Autodesk
from Autodesk.Revit.DB import *

doc = DocumentManager.Instance.CurrentDBDocument

CADs = FilteredElementCollector(doc).OfClass(ImportInstance).ToElements()

imports = []

for c in CADs:
	if c.IsLinked == False:
		imports.append(c)
		
if len(CADs) == 0 or len(imports) == 0:
	OUT = "Excellent! All CAD files in the model have been linked. No action required."
elif len(imports) == 1:
	OUT = "There is 1 imported CAD file in the model. Please remove/link it and use ACT Tools to remove imported line patterns."
elif len(imports) > 1:
	OUT = "There are " + str(len(imports)) +\
	" imported CAD files in the model. Please remove/link them and use ACG Tools to remove imported line patterns."
# ----------------------------------------

# group: Processing - CAD LINKS
python_script_4 = Python()  # IronPython2
# ---------- python_script_4.python (55 lines) ----------
import clr

clr.AddReference("RevitAPI")
import Autodesk
from Autodesk.Revit.DB import *

# Import DocumentManager and TransactionManager
clr.AddReference("RevitServices")
import RevitServices
from RevitServices.Persistence import DocumentManager
from RevitServices.Transactions import TransactionManager

# Import RevitAPI
clr.AddReference("RevitAPI")
import Autodesk
from Autodesk.Revit.DB import *

doc = DocumentManager.Instance.CurrentDBDocument

cads = FilteredElementCollector(doc).OfClass(CADLinkType).ToElements()

countNonCloud = 0
paths = []

def GetExtFileRefPath(item):
	try :
	   dirRefs = item.GetExternalResourceReferences()
	   for i,v in enumerate(dirRefs):
	       return v.Value.InSessionPath
	except Exception as e: return e.ToString()
	
for cad in cads:
	path = GetExtFileRefPath(cad)
	if "This Element does not use any external" not in path:		
		paths.append(path)
		if "Autodesk Docs://" not in path:
			countNonCloud += 1
			
if len(paths) == 0:
	OUT = "There are no linked CAD files in the model. No action required."
elif len(paths) == 1 and countNonCloud ==0:
	OUT = "There is 1 linked CAD files in the model. Please review and remove if it is unneeded."		
	
elif len(paths) > 1 and countNonCloud == 0:
	OUT = "There are " + str(len(paths)) +\
	" linked CAD files in the model. Please review and remove unneeded."
	
elif len(paths) > 1 and countNonCloud == 1:
	OUT = "There are " + str(len(paths)) +\
	" linked CAD files in the model. 1 is not linked from ACC. Please review and remove unneeded CAD links. Upload the rest ACC and reload from there."	
else:
	OUT = "There are " + str(len(paths)) +\
	" linked CAD files in the model." +\
	str(countNonCloud)	+\
	" are not linked from ACC. Please review and remove unneeded CAD links. Upload the rest ACC and reload from there."
# ----------------------------------------

# group: Processing - PDF & IMAGE LINKS
python_script_5 = Python()  # IronPython2
# ---------- python_script_5.python (76 lines) ----------
import clr
clr.AddReference("RevitAPI")
import Autodesk
from Autodesk.Revit.DB import *
# Import DocumentManager and TransactionManager
clr.AddReference("RevitServices")
import RevitServices
from RevitServices.Persistence import DocumentManager
# Import RevitAPI
clr.AddReference("RevitAPI")
import Autodesk
from Autodesk.Revit.DB import *

doc = DocumentManager.Instance.CurrentDBDocument

imgTypes = FilteredElementCollector(doc).OfClass(ImageType).ToElements()
imgs = FilteredElementCollector(doc).OfClass(ImageInstance).ToElements()

countNonCloud = 0
countNonPlaced = 0
paths, typeIds, imgIds = [], [], []
temp = []

def GetExtFileRefPath(item):
	try :
	   dirRefs = item.GetExternalResourceReferences()
	   for i,v in enumerate(dirRefs):
	       return v.Value.InSessionPath
	except Exception as e: return e.ToString()

# check for all paths
for imgT in imgTypes:
	path = GetExtFileRefPath(imgT)
	typeIds.append(str(imgT.Id))
	if "This Element does not use any external" not in path:		
		paths.append(path)
		if "Autodesk Docs://" not in path:
			countNonCloud += 1

# check if there are any unplaced image types
for img in imgs:
	imgIds.append(str(img.GetTypeId()))

for id in typeIds:
	if id not in imgIds:
		countNonPlaced += 1



# unused report
rep = ""
if countNonPlaced == 1:
	rep = " 1 of the link is not placed in the model. Please remove if unneeded."
elif countNonPlaced > 1:
	rep = " " + str(countNonPlaced) + " of the links are not placed in the model. Please remove if unneeded."


if len(imgTypes) == 0:
	OUT = "There are no linked PDF / Image files in the model. No action required." + rep
	
elif len(imgTypes) == 1 and countNonCloud ==0:
	OUT = "There is 1 linked PDF / Image file in the model. Please review and remove if it is unneeded." + rep		
	
elif len(imgTypes) > 1 and countNonCloud == 0:
	OUT = "There are " + str(len(paths)) +\
	" linked PDF / Image files in the model. Please review and remove unneeded." + rep
	
elif len(imgTypes) > 1 and countNonCloud == 1:
	OUT = "There are " + str(len(imgTypes)) +\
	" linked PDF / Image files in the model. 1 is not linked from ACC. Please review and remove unneeded links. Upload the rest ACC and reload from there." + rep
	
else:
	OUT = "There are " + str(len(imgTypes)) +\
	" linked PDF / Image files in the model." +\
	str(countNonCloud)	+\
	" are not linked from ACC. Please review and remove unneeded links. Upload the rest ACC and reload from there." + rep
# ----------------------------------------

# group: Processing - RVT LINKS
python_script_6 = Python()  # IronPython2
# ---------- python_script_6.python (55 lines) ----------
import clr

clr.AddReference("RevitAPI")
import Autodesk
from Autodesk.Revit.DB import *

# Import DocumentManager and TransactionManager
clr.AddReference("RevitServices")
import RevitServices
from RevitServices.Persistence import DocumentManager
from RevitServices.Transactions import TransactionManager

# Import RevitAPI
clr.AddReference("RevitAPI")
import Autodesk
from Autodesk.Revit.DB import *

doc = DocumentManager.Instance.CurrentDBDocument

cads = FilteredElementCollector(doc).OfClass(RevitLinkType).ToElements()

countNonCloud = 0
paths = []

def GetExtFileRefPath(item):
	try :
	   dirRefs = item.GetExternalResourceReferences()
	   for i,v in enumerate(dirRefs):
	       return v.Value.InSessionPath
	except Exception as e: return e.ToString()
	
for cad in cads:
	path = GetExtFileRefPath(cad)
	if "This Element does not use any external" not in path:		
		paths.append(path)
		if "Autodesk Docs://" not in path:
			countNonCloud += 1
			
if len(paths) == 0:
	OUT = "There are no linked RVT files in the model. No action required."
elif len(paths) == 1 and countNonCloud ==0:
	OUT = "There is 1 linked RVT files in the model. Please review and remove if it is unneeded."		
	
elif len(paths) > 1 and countNonCloud == 0:
	OUT = "There are " + str(len(paths)) +\
	" linked RVT files in the model. Please review and remove unneeded."
	
elif len(paths) > 1 and countNonCloud == 1:
	OUT = "There are " + str(len(paths)) +\
	" linked RVT files in the model. 1 is not linked from ACC. Please review and remove unneeded RVT links. Upload the rest ACC and reload from there."	
else:
	OUT = "There are " + str(len(paths)) +\
	" linked RVT files in the model." +\
	str(countNonCloud)	+\
	" are not linked from ACC. Please review and remove unneeded RVT links. Upload the rest ACC and reload from there."
# ----------------------------------------

code_block_30 = CodeBlock { true; }
groups_audit = Python(IN[0]=code_block_30)  # IronPython2
# ---------- groups_audit.python (107 lines) ----------
import clr
clr.AddReference('RevitAPI')
import Autodesk
from Autodesk.Revit.DB import *

clr.AddReference("RevitNodes")
import Revit
clr.ImportExtensions(Revit.Elements)

clr.AddReference("RevitServices")
import RevitServices
from RevitServices.Persistence import DocumentManager
from RevitServices.Transactions import TransactionManager

from operator import itemgetter

doc = DocumentManager.Instance.CurrentDBDocument

groupTypes = FilteredElementCollector(doc).OfClass(GroupType)

output = []
out = []
groupNames = []
groupInstances = []
groupFamily = []
unconHeight = []
groupNested = [] 
nestedNames = []
nestedGroups = []
restoreExcluded = []
elements = []
output = []

if IN[0]:
	TransactionManager.Instance.EnsureInTransaction(doc)
	
	for groupType in groupTypes:
		
		groupNames.append(groupType.LookupParameter("Type Name").AsString())
		groupInstances.append(groupType.Groups.Size)
		groupFamily.append(groupType.FamilyName.ToString())
		if groupType.Groups.Size>0:
			groupSet = groupType.Groups.ForwardIterator()
			numOfMem = 0
			excluded = "False"
			uncon = "False"
			nested = "False"
			while groupSet.MoveNext():
				names = []
				membersIds = groupSet.Current.GetMemberIds()
				for id in membersIds:
					item = doc.GetElement(id)
					if item.Category != None:
						if item.Category.Name == "Walls":
							try:
								if item.LookupParameter("Top Constraint").AsString() == "Unconnected":
									uncon = "True"
							except:
								pass
					
						if item.Category.Name == "Model Groups" or item.Category.Name == "Detail Groups":
							nested = "True"
							names.append(item.Name)
				
				if numOfMem == 0:
					numOfMem = len(membersIds)
				elif numOfMem < len(membersIds):
					numOfMem = len(membersIds)
					excluded = "True"
				elif numOfMem > len(membersIds):
					excluded = "True"
			restoreExcluded.append(excluded)
			unconHeight.append(uncon)
			groupNested.append(nested)
			nestedNames.append(names)
		else:
			restoreExcluded.append("No instances in project")
			
			
		
	output.append(groupNames)
	output.append(groupFamily)
	output.append(groupInstances)
	output.append(restoreExcluded)
	output.append(unconHeight)
	output.append(groupNested)
	
	
	output = map(list, zip(*output))
	for i in xrange(len(output)):
		temp = output[i]
		for item in nestedNames[i]:
			if item != None:
				temp.append(item)
		out.append(temp)
		
	
	out = sorted(out, key=itemgetter(0))	
	header = ["Group name", "Type of group", "Number of instances", "Restore excluded", "Unconnected height", "Groups nested", "Nested groups names"]
	out.insert(0,header)
	OUT = out

	#OUT = nestedNames
	TransactionManager.Instance.TransactionTaskDone()
else: 
	OUT = "Set RunIt to true"
	
# ----------------------------------------
transpose_2 = List.Transpose(lists=groups_audit)
code_block_31 = CodeBlock(x=transpose_2) { x[0]; x[2]; x[5]; }

# group: Group Check
get_all_detail_groups = Custom[Get All Detail Groups]()  # package archi-lab.net; This node will retrieve all instances of Detail Groups in the model.
typeCollector = Custom[ModelGroup.TypeCollector]()  # package BVN; Returns all the types (not instances) from all model groups in the project
name = Element.Name(element=typeCollector)
restOfItems_3 = List.RestOfItems(list=code_block_31.out0)
create = List.Create(item0=get_all_detail_groups.groupNames, item1=name, item2=restOfItems_3)
flatten_2 = List.Flatten(list=create)
uniqueItems_2 = List.UniqueItems(list=flatten_2)
code_block_32 = CodeBlock { "ACG-"; }
startsWith = String.StartsWith(string=uniqueItems_2, searchFor=code_block_32)
filterByBoolMask_5 = List.FilterByBoolMask(list=uniqueItems_2, mask=startsWith)
code_block_33 = CodeBlock { 0; 8; "-"; }
remove = String.Remove(string=filterByBoolMask_5.in, startIndex=code_block_33.out0, count=code_block_33.out1)
startsWith_2 = String.StartsWith(string=remove, searchFor=code_block_33.out2)
filterByBoolMask_6 = List.FilterByBoolMask(list=filterByBoolMask_5.in, mask=startsWith_2)
list_create_2 = List.Create(item0=filterByBoolMask_6.out, item1=filterByBoolMask_5.out)
flatten_3 = List.Flatten(list=list_create_2)
uniqueItems_3 = List.UniqueItems(list=flatten_3)
code_block_34 = CodeBlock(compGroups=filterByBoolMask_6.in, incompGroups=uniqueItems_3)
# ---------- code_block_34.designscript (11 lines) ----------
compNames=DSCore.List.Count(compGroups);

incompNames=DSCore.List.Count(incompGroups);

percent=incompNames/(incompNames+compNames)*100;

percent==0;

DSCore.Math.Round(percent);

".";
# ----------------------------------------
string_from_object_6 = FromObject(obj=code_block_34.out4)
split_3 = String.Split(string=string_from_object_6, separator0=code_block_34.out5)
code_block_35 = CodeBlock(percent=split_3)
# ---------- code_block_35.designscript (4 lines) ----------
"Excellent! All groups in the model are named in compliance with ACG's naming protocols.";

percent[0]+
"% of all groups in the model are not named in compliance with ACG's naming protocols. Please review and rename.";
# ----------------------------------------
code_block_36 = CodeBlock(x=code_block_34.out3, a=code_block_35.out0, b=code_block_35.out1) { x?a:b; }

restOfItems_4 = List.RestOfItems(list=code_block_31.out1)
code_block_37 = CodeBlock(numInstances=restOfItems_4)
# ---------- code_block_37.designscript (13 lines) ----------
lst=numInstances==0;

numUsed=DSCore.List.CountFalse(lst);
numUnused=DSCore.List.CountTrue(lst);


percent=numUnused/(numUnused+numUsed)*100;

percent==0;

DSCore.Math.Round(percent);

".";
# ----------------------------------------
string_from_object_7 = FromObject(obj=code_block_37.out5)
split_4 = String.Split(string=string_from_object_7, separator0=code_block_37.out6)
code_block_38 = CodeBlock(percent=split_4)
# ---------- code_block_38.designscript (4 lines) ----------
"Excellent! There are no unused groups in the model.";

percent[0]+
"% of all groups in the model are unused. Please review and delete if unneeded.";
# ----------------------------------------
code_block_39 = CodeBlock(x=code_block_37.out4, a=code_block_38.out0, b=code_block_38.out1) { x?a:b; }
restOfItems_5 = List.RestOfItems(list=code_block_31.out2)
string_from_object_8 = FromObject(obj=restOfItems_5)
code_block_40 = CodeBlock { "False"; }
eq_6 = string_from_object_8 == code_block_40
code_block_41 = CodeBlock(lstGroups=eq_6)
# ---------- code_block_41.designscript (11 lines) ----------
compNest=DSCore.List.CountTrue(lstGroups);

incompNest=DSCore.List.CountFalse(lstGroups);

percent=incompNest/(compNest+incompNest)*100;

percent==0;

DSCore.Math.Round(percent);

".";
# ----------------------------------------
string_from_object_9 = FromObject(obj=code_block_41.out4)
split_5 = String.Split(string=string_from_object_9, separator0=code_block_41.out5)
code_block_42 = CodeBlock(percent=split_5)
# ---------- code_block_42.designscript (4 lines) ----------
"Excellent! There are no nested groups in the model.";

percent[0]+
"% of all groups in the model are nested. Please review.";
# ----------------------------------------
code_block_43 = CodeBlock(x=code_block_41.out3, a=code_block_42.out0, b=code_block_42.out1) { x?a:b; }
code_block_44 = CodeBlock(statementNaming=code_block_36, statementNesting=code_block_39, statementUsed=code_block_43)
# ---------- code_block_44.designscript (5 lines) ----------
statementNaming
+"\n"+
statementNesting
+"\n"+
statementUsed;
# ----------------------------------------

# group: Warnings - join/overlap
code_block_45 = CodeBlock { ["join","overlap", "but miss", "hosted"]; }
contains_2 = String.Contains(string=getWarnings.Warning_Text, searchFor=code_block_45@@L1)
transpose_3 = List.Transpose(lists=contains_2)
anyTrue = Orchid.Common.List.AnyTrue(list=transpose_3@@L2)
code_block_46 = CodeBlock(warn=anyTrue) { num=DSCore.List.CountTrue(warn); "."; num>0; "Excellent! All elements in the model are joined/hosted correctly"; }
string_from_object_10 = FromObject(obj=code_block_46.num)
split_6 = String.Split(string=string_from_object_10, separator0=code_block_46.out1)
code_block_47 = CodeBlock(numWarnings=split_6)
# ---------- code_block_47.designscript (5 lines) ----------
"There are "

+numWarnings[0]+

" warnings associated with overlapping or incorrectly joined/hosted elements in the model.";
# ----------------------------------------
code_block_48 = CodeBlock(x=code_block_46.out2, a=code_block_47, b=code_block_46.out3) { x?a:b; }

# group: Processing
filterByBoolMask_7 = List.FilterByBoolMask(list=getWarnings.Warning_Text, mask=anyTrue)
groupByKey_2 = List.GroupByKey(list=filterByBoolMask_7.in, keys=filterByBoolMask_7.in)
count_4 = List.Count(list=groupByKey_2.groups@L2)
sortByKey_2 = List.SortByKey(list=groupByKey_2.uniqueKeys, keys=count_4)
code_block_49 = CodeBlock(count=sortByKey_2.sortedKeys, description=sortByKey_2.sortedList) { count+" - "+description; }

# group: Processing
reverse_2 = List.Reverse(list=code_block_49)
code_block_50 = CodeBlock { 0..4; }
getItemAtIndex_2 = List.GetItemAtIndex(list=reverse_2, index=code_block_50)
code_block_51 = CodeBlock(x=getItemAtIndex_2) { ". "; x[0]; x[1]; x[2]; x[3]; x[4]; }
join_2 = String.Join(separator=code_block_51.out0, string0=code_block_48, string1=code_block_51.out1, string2=code_block_51.out2, string3=code_block_51.out3, string4=code_block_51.out4, string5=code_block_51.out5)
watch_2 = Watch(join_2)

# group: Processing
acg_quick_sheet_naming_check = Custom[ACG Quick Sheet Naming Check](NumberLength=code_block_14.out1)
code_block_52 = CodeBlock(result=acg_quick_sheet_naming_check.Results) { result==0; "."; }
string_from_object_11 = FromObject(obj=acg_quick_sheet_naming_check.Results)
split_7 = String.Split(string=string_from_object_11, separator0=code_block_52.out1)
code_block_53 = CodeBlock(result=split_7)
# ---------- code_block_53.designscript (4 lines) ----------
"Excellent! All sheets in the model are numbered correctly.";

result[0]+
"% of all sheets in the model are not numbered in compliance with ACG's protocols. Please review and renumber.";
# ----------------------------------------
code_block_54 = CodeBlock(x=code_block_52.out0, a=code_block_53.out0, b=code_block_53.out1) { x?a:b; }

# group: Processing - Views on PRODUCTION sheet naming
ACGQuickAuditViewsOnSheetsNamingCheck = Custom[ACGQuickAuditViewsOnSheetsNamingCheck]()  # Check views placed on PRODUCTION sheets. Only Plans, Elevations and Sections
string_from_object_12 = FromObject(obj=ACGQuickAuditViewsOnSheetsNamingCheck.Result)
code_block_55 = CodeBlock { "."; }
split_8 = String.Split(string=string_from_object_12, separator0=code_block_55)
code_block_56 = CodeBlock(percent=split_8)
# ---------- code_block_56.designscript (4 lines) ----------
"Excellent! All views placed on sheets are named in compliance with ACG's protocols.";

percent[0]+
"% of all views placed on sheets are not named in compliance with ACG's protocols. Please review and rename.";
# ----------------------------------------
code_block_57 = CodeBlock(result=ACGQuickAuditViewsOnSheetsNamingCheck.Result, a=code_block_56.out0, b=code_block_56.out1) { result==0?a:b; }

# group: Processing - Family Naming
acg_quick_family_naming_check = Custom[ACG Quick Family Naming Check]()
code_block_58 = CodeBlock(result=acg_quick_family_naming_check.Results_Naming) { result==0; "."; }
string_from_object_13 = FromObject(obj=acg_quick_family_naming_check.Results_Naming)
split_9 = String.Split(string=string_from_object_13, separator0=code_block_58.out1)
code_block_59 = CodeBlock(percent=split_9)
# ---------- code_block_59.designscript (4 lines) ----------
"Excellent! All families are named in compliance with ACG's protocols.";

percent[0]+
"% of all families are not named in compliance with ACG's protocols. Please review and rename.";
# ----------------------------------------
code_block_60 = CodeBlock(x=code_block_58.out0, a=code_block_59.out0, b=code_block_59.out1) { x?a:b; }

ACGQuickLevelsAndGridsCheck = Custom[ACGQuickLevelsAndGridsCheck]()

# group: Processing
code_block_61 = CodeBlock(result=ACGQuickLevelsAndGridsCheck.Result_percent) { result==0; "."; }
string_from_object_14 = FromObject(object=ACGQuickLevelsAndGridsCheck.Result_percent)
split_10 = String.Split(string=string_from_object_14, separator0=code_block_61.out1)
code_block_62 = CodeBlock(percent=split_10)
# ---------- code_block_62.designscript (6 lines) ----------
"Excellent! All Levels and Grids in the model are pinned and in the correct workset.";

percent[0]+
"% of all Levels and Grids elements are not pinned or in the correct workset. ";
"Please review and correct.";
"";
# ----------------------------------------
code_block_63 = CodeBlock(x=code_block_61.out0, a=code_block_62.out0, b=code_block_62.out1) { x?a:b; }
code_block_64 = CodeBlock(x=code_block_61.out0, a=code_block_62.out3, b=code_block_62.out2) { x?a:b; }

# group: Processing
code_block_65 = CodeBlock(result=ACGQuickLevelsAndGridsCheck.Levels_number) { result==0; "."; }
string_from_object_15 = FromObject(object=ACGQuickLevelsAndGridsCheck.Levels_number)
split_11 = String.Split(string=string_from_object_15, separator0=code_block_65.out1)
code_block_66 = CodeBlock(lvls=split_11)
# ---------- code_block_66.designscript (3 lines) ----------
lvls[0]+
" Levels are not pinned or in the correct workset. ";
" ";
# ----------------------------------------
code_block_67 = CodeBlock(x=code_block_65.out0, a=code_block_66.out1, b=code_block_66.out0) { x?a:b; }

# group: Processing
code_block_68 = CodeBlock(result=ACGQuickLevelsAndGridsCheck.Grids_number) { result==0; "."; }
string_from_object_16 = FromObject(object=ACGQuickLevelsAndGridsCheck.Grids_number)
split_12 = String.Split(string=string_from_object_16, separator0=code_block_68.out1)
code_block_69 = CodeBlock(grds=split_12)
# ---------- code_block_69.designscript (3 lines) ----------
grds[0]+
" Grids are not pinned or in the correct workset. ";
" ";
# ----------------------------------------
code_block_70 = CodeBlock(x=code_block_68.out0, a=code_block_69.out1, b=code_block_69.out0) { x?a:b; }

code_block_71 = CodeBlock(a=code_block_63, b=code_block_67, c=code_block_70, d=code_block_64) { a+b+c+d; }

# group: Processing - Templates
collectallviewtemplates_python = Python()  # "CollectAllViewTemplates - Python Script"; IronPython2; unwired: IN[0]
# ---------- collectallviewtemplates_python.python (19 lines) ----------
# https://forum.dynamobim.com/t/get-all-view-templates-with-python/24527/3

import clr
clr.AddReference('RevitAPI')
from Autodesk.Revit.DB import*

clr.AddReference('RevitServices')
from RevitServices.Persistence import DocumentManager
from RevitServices.Transactions import TransactionManager

clr.AddReference('ProtoGeometry')
from Autodesk.DesignScript.Geometry import *

doc = DocumentManager.Instance.CurrentDBDocument

viewswithoutnull = [t for t in FilteredElementCollector(doc).OfClass
(View).ToElements() if t.IsTemplate and t.ViewType < ViewType.ThreeD]

OUT = viewswithoutnull
# ----------------------------------------
name_2 = Element.Name(element=collectallviewtemplates_python)
code_block_72 = CodeBlock { "ACG-"; 0; 8; "-"; }
startsWith_3 = String.StartsWith(string=name_2, searchFor=code_block_72.out0)
filterByBoolMask_8 = List.FilterByBoolMask(list=name_2, mask=startsWith_3)
remove_2 = String.Remove(string=filterByBoolMask_8.in, startIndex=code_block_72.out1, count=code_block_72.out2)
startsWith_4 = String.StartsWith(string=remove_2, searchFor=code_block_72.out3)
code_block_73 = CodeBlock { true; }
getAll = Custom[View.GetAll](toggle=code_block_73)  # package BVN; Gets all views except for view templates
viewTemplate = archilab.Revit.Views.Views.ViewTemplate(view=getAll)
uniqueItems_4 = List.UniqueItems(list=viewTemplate)
isNull = Object.IsNull(object=uniqueItems_4)
filterByBoolMask_9 = List.FilterByBoolMask(list=uniqueItems_4, mask=isNull)
setDifference = List.SetDifference(list1=collectallviewtemplates_python, list2=filterByBoolMask_9.out)
code_block_result_use = CodeBlock(tempPy=collectallviewtemplates_python, nonComp=setDifference)
# ---------- code_block_result_use.designscript (7 lines) ----------
numTotal=DSCore.List.Count(tempPy);
numNonComp=DSCore.List.Count(nonComp);

percentUse=numNonComp/numTotal*100;
".";
percentRound=DSCore.Math.Round(percentUse);
percentRound==0;
# ----------------------------------------
code_block_result_naming = CodeBlock(lst=startsWith_4, numTotal=code_block_result_use.numTotal)
# ---------- code_block_result_naming.designscript (8 lines) ----------
numComp=DSCore.List.CountTrue(lst);

percentName=(numTotal-numComp)/numTotal*100;
".";

percentRound=DSCore.Math.Round(percentName);

percentRound==0;
# ----------------------------------------
string_from_object_17 = FromObject(obj=code_block_result_naming.percentRound)
split_13 = String.Split(string=string_from_object_17, separator0=code_block_result_naming.out2)
string_from_object_18 = FromObject(obj=code_block_result_use.percentRound)
split_14 = String.Split(string=string_from_object_18, separator0=code_block_result_use.out3)
code_block_74 = CodeBlock(persentName=split_13, persentUse=split_14)
# ---------- code_block_74.designscript (8 lines) ----------
"Excellent! All view templates are named in compliance with ACG's naming protocols. ";
persentName[0]+
"% of all templates in the model are not named in compliance with ACG's naming protocols. Please rename.";


"All view templates are in use. No action required. ";
persentUse[0]+
"% of all templates in the model are not applied to a view. Please review and remove if unneeded.";
# ----------------------------------------
code_block_75 = CodeBlock(x=code_block_result_naming.out4, a=code_block_74.out0, b=code_block_74.out1) { x?a:b; }
code_block_76 = CodeBlock(x=code_block_result_use.out5, a=code_block_74.out2, b=code_block_74.out3) { x?a:b; }
code_block_77 = CodeBlock(statementNaming=code_block_75, statementUse=code_block_76)
# ---------- code_block_77.designscript (3 lines) ----------
statementNaming
+"\n"+
statementUse;
# ----------------------------------------

# group: Processing - SCOPE BOXES
python_script_7 = Python()  # IronPython2
# ---------- python_script_7.python (80 lines) ----------
import clr
clr.AddReference("RevitAPI")
import Autodesk
from Autodesk.Revit.DB import *
# Import DocumentManager and TransactionManager
clr.AddReference("RevitServices")
import RevitServices
from RevitServices.Persistence import DocumentManager
# Import RevitAPI
clr.AddReference("RevitAPI")
import Autodesk
from Autodesk.Revit.DB import *

doc = DocumentManager.Instance.CurrentDBDocument

vOnSheets, scalesOnSheet, vToProcess = [], [], []
temp = []

# get view placed on sheets with length less than 7 gidits
views = FilteredElementCollector(doc)\
.OfCategory(BuiltInCategory.OST_Views)\
.WhereElementIsNotElementType()\
.ToElements()

sheets = FilteredElementCollector(doc)\
.OfCategory(BuiltInCategory.OST_Sheets)\
.WhereElementIsNotElementType()\
.ToElements()

# get the numbers of PRODUCTION sheets
prodSheetNumbs = []
for s in sheets:
	if s.LookupParameter("Sheet Phase").AsString() == "PRODUCTION":
		prodSheetNumbs.append(s.SheetNumber)


for v in views:
	if v.LookupParameter("Sheet Number") != None:
		sheetNumb = v.LookupParameter("Sheet Number").AsString()
		if sheetNumb != "---" and sheetNumb in prodSheetNumbs:
			vOnSheets.append(v)
			scalesOnSheet\
			.append(v.get_Parameter(BuiltInParameter.VIEW_SCALE)\
			.AsValueString())
			
# filter only views in scale 1:50 or coarser
for v in vOnSheets:
	try:
		if int(v.get_Parameter(BuiltInParameter.VIEW_SCALE)\
		.AsValueString()) >= 50:
			vToProcess.append(v)
	except:
		continue

# check for SCOPE BOXES
countWithout = 0
for v in vToProcess:
	temp.append(v.get_Parameter(BuiltInParameter.VIEWER_VOLUME_OF_INTEREST_CROP)\
	.AsValueString())
	if v.get_Parameter(BuiltInParameter.VIEWER_VOLUME_OF_INTEREST_CROP)\
	.AsValueString() == "None":
		countWithout += 1

if len(vToProcess) == 0:
	OUT = ("There are no views at scale 1:50 or coarser"
	" placed on PRODUCTION sheets. No action required.")

elif countWithout == 0:
	OUT = ("Excellent! All view at scale 1:50 or coarser"
	" placed on PRODUCTION sheets have Scope Boxes assigned to.")
	
elif countWithout == 1:
	OUT = ("There is 1 view at scale 1:50 or coarser"
	" placed on a PRODUCTION sheet that doesn't have a"
	" Scope Box assigned to. Please review and assign if possible.")

elif countWithout > 1:
	OUT = ("There are " + str(countWithout) + " views at scale 1:50 or coarser"
	" placed on PRODUCTION sheets that don't have"
	" Scope Boxes assigned to. Please review and assign where possible.")
# ----------------------------------------

# group: Processing
acg_quickaudit_revisioncheck = Custom[ACG QuickAudit.RevisionCheck]()  # Checks if PRODUCTION sheets have no revision or if there are revisions assigned to WIP sheets

# group: Filtering
code_block_78 = CodeBlock { " "; }
code_block_results_text = CodeBlock(warnings=watch, emptyRow=code_block_78, redundantViews=code_block_29, redundantRooms=python_script, redundantAreas=python_script_2, CADImports=python_script_3, CADLinks=python_script_4, PDFLinks=python_script_5, RVTLinks=python_script_6, levelOfDetail=code_block_78, detailGroups=code_block_78, groups=code_block_44, warningsJoins=watch_2, sheets=code_block_54, views=code_block_57, families=code_block_60, worksets=code_block_78, levelsGrids=code_block_71, folder=code_block_78, archive=code_block_78, templates=code_block_77, scopeBoxes=python_script_7, materals=code_block_78, sheetIssue=acg_quickaudit_revisioncheck.Result, tags=code_block_78, correctLevels=code_block_78, position=code_block_78)
# ---------- code_block_results_text.designscript (44 lines) ----------
warnings;
emptyRow;
redundantViews;
redundantRooms;
emptyRow;
redundantAreas;
emptyRow;
CADImports;
emptyRow;
CADLinks;
PDFLinks;
RVTLinks;
levelOfDetail;
emptyRow;
emptyRow;
detailGroups;
groups;
emptyRow;
warningsJoins;
emptyRow;
emptyRow;
emptyRow;
sheets;
emptyRow;
views;
emptyRow;
families;
emptyRow;
worksets;
levelsGrids;
folder;
archive;
emptyRow;
emptyRow;
templates;
emptyRow;
scopeBoxes;
materals;
sheetIssue;
tags;
emptyRow;
emptyRow;
correctLevels;
position;
# ----------------------------------------
list_create_3 = List.Create(item0=code_block_results_text.out0, item1=code_block_results_text.out1, item2=code_block_results_text.out2, item3=code_block_results_text.out3, item4=code_block_results_text.out4, item5=code_block_results_text.out5, item6=code_block_results_text.out6, item7=code_block_results_text.out7, item8=code_block_results_text.out8, item9=code_block_results_text.out9, item10=code_block_results_text.out10, item11=code_block_results_text.out11, item12=code_block_results_text.out12, item13=code_block_results_text.out13, item14=code_block_results_text.out14, item15=code_block_results_text.out15, item16=code_block_results_text.out16, item17=code_block_results_text.out17, item18=code_block_results_text.out18, item19=code_block_results_text.out19, item20=code_block_results_text.out20, item21=code_block_results_text.out21, item22=code_block_results_text.out22, item23=code_block_results_text.out23, item24=code_block_results_text.out24, item25=code_block_results_text.out25, item26=code_block_results_text.out26, item27=code_block_results_text.out27, item28=code_block_results_text.out28, item29=code_block_results_text.out29, item30=code_block_results_text.out30, item31=code_block_results_text.out31, item32=code_block_results_text.out32, item33=code_block_results_text.out33, item34=code_block_results_text.out34, item35=code_block_results_text.out35, item36=code_block_results_text.out36, item37=code_block_results_text.out37, item38=code_block_results_text.out38, item39=code_block_results_text.out39, item40=code_block_results_text.out40, item41=code_block_results_text.out41, item42=code_block_results_text.out42, item43=code_block_results_text.out43)

# group: Processing - push model health legacy
code_block_79 = CodeBlock()
# ---------- code_block_79.designscript (5 lines) ----------
catPI=Revit.Elements.Category.ByName("Project Information");
ElementQueries.OfCategory(catPI);

"Project Directory";
"ACG_Model Number";
# ----------------------------------------
getParameterValueByName_2 = Element.GetParameterValueByName(element=code_block_79.out1, parameterName=code_block_79.out2)
code_block_80 = CodeBlock(prjDir=getParameterValueByName_2) { prjDir+"\\06 Audit"; }
directory_from_path = DirectoryObject(path=code_block_80)
getDirectoryContents = FileSystem.GetDirectoryContents(directory=directory_from_path)
getParameterValueByName_3 = Element.GetParameterValueByName(element=code_block_79.out1, parameterName=code_block_79.out3)
string_from_object_19 = FromObject(object=getParameterValueByName_3)
contains_3 = String.Contains(string=getDirectoryContents.files, searchFor=string_from_object_19)
filterByBoolMask_10 = List.FilterByBoolMask(list=getDirectoryContents.files, mask=contains_3)
flatten_4 = List.Flatten(list=filterByBoolMask_10.in)
importCSV = Data.ImportCSV(filePath=flatten_4)
flatten_5 = List.Flatten()  # unwired: list
map = List.Map(list=importCSV, function=flatten_5)
string_from_object_20 = FromObject(object=map)
code_block_81 = CodeBlock { "null"; "0"; }
replace = String.Replace(string=string_from_object_20, searchFor=code_block_81.out0, replaceWith=code_block_81.out1)

# group: Processing
transpose_4 = List.Transpose(lists=replace)
code_block_82 = CodeBlock(x=transpose_4) { x[0]; x[12]; x[1]; x[2]; x[3]; x[4]; x[5]; x[7]; x[6]; x[8]; x[9]; x[10]; }
list_create_4 = List.Create(item0=code_block_82.out0, item1=code_block_82.out1, item2=code_block_82.out2, item3=code_block_82.out3, item4=code_block_82.out4, item5=code_block_82.out5, item6=code_block_82.out6, item7=code_block_82.out7, item8=code_block_82.out8, item9=code_block_82.out9, item10=code_block_82.out10, item11=code_block_82.out11)

# group: Visualisation
code_block_83 = CodeBlock { "BIM Project Audit"; "D16"; true; }
code_block_84 = CodeBlock { "B4"; }
python_script_8 = Python()  # IronPython2
# ---------- python_script_8.python (65 lines) ----------
#Copyright (c) mostafa el ayoubi
#Node-mode 2016 elayoub.mostafa@gmail.com
import datetime
import os
import clr
clr.AddReference('RevitAPI')
from Autodesk.Revit.DB import*
clr.AddReference('RevitServices')
from RevitServices.Persistence import DocumentManager
import System
from System.IO import SearchOption
from System import Environment

doc = DocumentManager.Instance.CurrentDBDocument
path = doc.PathName
docname = path.encode('string-escape')


# get the AUDITOR NAME
userName = doc.Application.Username
if "sanap" in userName:
	auditor = "Jan Sanap"
elif "petrov" in userName:
	auditor = "Ivo Petrov"
else: auditor = " "

# Get the PROJECT CODE
pi = FilteredElementCollector(doc).OfCategory(BuiltInCategory.OST_ProjectInformation)\
.FirstElement()
try:
	prjCode = pi.LookupParameter("Project Number").AsString()
except:	prjCode = " "
try:
	prjName = pi.LookupParameter("Project Name").AsString()
except:	prjName = " "
try:
	prjStage = "RIBA Stage " + pi.LookupParameter("ACG_RIBA STAGE").AsString()
except: prjStage = " "
try:
	prjLead = pi.LookupParameter("ACG_Project Lead").AsString()
except: prjLead = " "

# get the DATE
date = datetime.date.today()
formattedDate = date.strftime("%d.%m.%y")

# get the file NAME
fName = doc.Title

#get the file SIZE
pn = doc.PathName
try:
	guid = doc.WorksharingCentralGUID  
	AppDataList = Environment.GetFolderPath(Environment.SpecialFolder.ApplicationData).split("\\")
	AppDataList.pop(-1)
	AppData = "\\".join(AppDataList)
	location =  AppData + "\\Local\\Autodesk\\Revit"
	cashedFile = System.IO.Directory.GetFiles(location, str(guid) + ".rvt" ,SearchOption.AllDirectories)
	size = [os.path.getsize(file) for file in cashedFile][0]
except:
	size = os.path.getsize(pn)



OUT = [auditor, prjCode, prjName, prjStage, prjLead, formattedDate, fName, str(size/1000000) + " mb"]
# ----------------------------------------
bb_data = Custom[BB Data](sheetName=code_block_83.out0, origin=code_block_84, data=python_script_8)  # package BumbleBee; This node is a building block for different modes of writing to Excel files. You can combines this node into a list to write to multiple sheets or use just one to write to a single sheet.
code_block_85 = CodeBlock { "C20"; }
flatten_6 = List.Flatten(list=list_create_3)
bb_data_2 = Custom[BB Data](sheetName=code_block_83.out0, origin=code_block_85, data=flatten_6)
bb_data_3 = Custom[BB Data](sheetName=code_block_83.out0, origin=code_block_83.out1, data=list_create_4)

# group: Visualisation
code_block_86 = CodeBlock { true; }
list_create_5 = List.Create(item0=bb_data, item1=bb_data_2, item2=bb_data_3)
write_excel = Custom[Write Excel](filePath=code_block_14.out0, runIt=code_block_86, byColumn=code_block_86, BBData=list_create_5)  # package BumbleBee; This node will write data to Excel file and based on how your BBData nodes are structured it will either override the exsting file, create a new one and write a single worksheet or write multiple worksheets.

# group: Processing - IMPORTED CADs - ARCHIVED
acg_quick_cad_import_check = Custom[ACG Quick CAD Import Check]()  # frozen
string_from_object_21 = FromObject(obj=acg_quick_cad_import_check)
code_block_87 = CodeBlock { "."; }
split_15 = String.Split(string=string_from_object_21, separator0=code_block_87)
code_block_88 = CodeBlock(numImported=acg_quick_cad_import_check, stringImported=split_15)
# ---------- code_block_88.designscript (7 lines) ----------
numImported>0;

"Excellent! All CAD files in the model have been linked. No action required.";

"There are "
+stringImported[0]+
" imported CAD files in the model. Please remove/link them and use script to remove imported line patterns.";
# ----------------------------------------
code_block_89 = CodeBlock(x=code_block_88.out0, a=code_block_88.out2, b=code_block_88.out1) { x?a:b; }

# group: Processing - Floor plans placed on sheets - ARCHIVED
code_block_90 = CodeBlock { Revit.Category.ByName("Views"); }  # frozen
all_elements_of_category_2 = ElementsOfCategory(Category=code_block_90)
code_block_91 = CodeBlock { null; }
# note: Instead of Manage.RevomeNull
eq_7 = all_elements_of_category_2 == code_block_91
filterByBoolMask_11 = List.FilterByBoolMask(list=all_elements_of_category_2, mask=eq_7)
code_block_92 = CodeBlock { "Sheet Name"; ""; }
getParameterValueByName_4 = Element.GetParameterValueByName(element=filterByBoolMask_11.out, parameterName=code_block_92.out0)
eq_8 = getParameterValueByName_4 == code_block_92.out1
filterByBoolMask_12 = List.FilterByBoolMask(list=filterByBoolMask_11.out, mask=eq_8)
code_block_93 = CodeBlock { "View Scale"; }
getParameterValueByName_5 = Element.GetParameterValueByName(element=filterByBoolMask_12.out, parameterName=code_block_93)
code_block_94 = CodeBlock(viewScale=getParameterValueByName_5) { viewScale>=50; false; "Scope Box"; }
code_block_95 = CodeBlock { false; input; }  # unwired: input
# note: Instead of Manage.ReplaceNulls
code_block_96 = CodeBlock(input=code_block_94.out0, a=code_block_95.out0, b=code_block_95.input) { input == null?a:b; }
filterByBoolMask_13 = List.FilterByBoolMask(list=filterByBoolMask_12.out, mask=code_block_96)
getParameterValueByName_6 = Element.GetParameterValueByName(element=filterByBoolMask_13.in, parameterName=[code_block_94.out2, code_block_94.out2])
code_block_97 = CodeBlock(scopeBox=getParameterValueByName_6) { scopeBox=="None"; }
code_block_98 = CodeBlock(views=code_block_97)
# ---------- code_block_98.designscript (9 lines) ----------
numComp=DSCore.List.CountFalse(views);
numNonComp=DSCore.List.CountTrue(views);

percent=numNonComp/(numComp+numNonComp)*100;

percentRound=DSCore.Math.Round(percent);
percentRound>0;

".";
# ----------------------------------------
string_from_object_22 = FromObject(obj=code_block_98.percentRound)
split_16 = String.Split(string=string_from_object_22, separator0=code_block_98.out5)
code_block_99 = CodeBlock(percent=split_16)
# ---------- code_block_99.designscript (3 lines) ----------
"Excellent! All large scale Views placed on Sheets have Scope Box assigned to.";
percent[0]+
"% of all large scale Views placed on Sheets have no Scope Box assigned to. Pleare review and assign where possible.";
# ----------------------------------------
code_block_100 = CodeBlock(x=code_block_98.out4, a=code_block_99.out1, b=code_block_99.out0) { x?a:b; }

# group: Processing - Location - ARCHIVE
code_block_101 = CodeBlock { Revit.Category.ByName("Project Information"); "Project Address"; }  # frozen
all_elements_of_category_3 = ElementsOfCategory(Category=code_block_101.out0)
getParameterValueByName_7 = Element.GetParameterValueByName(element=all_elements_of_category_3, parameterName=code_block_101.out1)
siteLocation = SiteLocation()  # frozen
string_from_object_23 = FromObject(object=siteLocation)
code_block_102 = CodeBlock { ": "; }
split_17 = String.Split(string=string_from_object_23, separator0=code_block_102)
code_block_103 = CodeBlock(locTxt=getParameterValueByName_7, locSite=split_17)
# ---------- code_block_103.designscript (6 lines) ----------
lstTxt = DSCore.String.Split(locTxt, "\n");

concat = DSCore.String.Concat(lstTxt);
output = concat[0];

check = DSCore.String.StartsWith(locSite[1], output);
# ----------------------------------------
code_block_104 = CodeBlock()
# ---------- code_block_104.designscript (2 lines) ----------
"Excellent! The GPS location under Manage matches the project's address.";
"The GPS location under Manage does not match the project's address. Please review.";
# ----------------------------------------
code_block_105 = CodeBlock(x=code_block_103.check, a=code_block_104.out0, b=code_block_104.out1) { x?a:b; }
code_block_106 = CodeBlock(x=code_block_105) { x[0]; }
