# Dynamo graph Quick Audit.dyn (Dynamo 2.12.1.8246)
# packages: Orchid 260.1.0.7729, Data-Shapes 2021.2.92, archi-lab.net 2022.210.2522, BumbleBee 2021.25.3, WombatDynamo 2.3.0

current = Document.Current()
getWarnings = Warning.GetWarnings(document=current)
description = Warning.Description(warning=getWarnings)
count = List.Count(list=description)
acg_quickaudit_cadimportscheck = Custom[ACG QuickAudit.CADImportsCheck]()
acg_quickaudit = Custom[ACG QuickAudit.RedundantRoomCheck]()
acg_quickaudit_2 = Custom[ACG QuickAudit.RedundantAreaCheck]()
acg_quickaudit_groupscheck = Custom[ACG QuickAudit.GroupsCheck]()
file_path = Filename("..\ACG_logo.png")
file_from_path = FileObject(path=file_path)
readFromFile = Image.ReadFromFile(file=file_from_path)
code_block = CodeBlock { "Cancel"; true; "Run"; 700; 350; }
code_block_2 = CodeBlock { "Sheet Number Length"; "4"; true; }
textbox_data = Custom[TextBox Data](InputName=code_block_2.out0, DefaultText=code_block_2.out1, IsNumberEntry=code_block_2.out2)  # package Data-Shapes; Create Data for TextBox input in UI.MultipleInputForm ++ . Check out www.data-shapes.net for more informations
ui_multipleinputform = Custom[UI.MultipleInputForm ++](Logo_optional=readFromFile, ButtonText_optional=code_block.out2, Inputs=textbox_data, Toggle=code_block.out1, CancelButtonText_optional=code_block.out0, Width_optional=code_block.out3, LabelWidth_optional=code_block.out4)  # package Data-Shapes; Create a form with multiple inputs. see www.data-shapes.net for tutorials and infos!
end = Revit.Transaction.Transaction.End(input=ui_multipleinputform.User_Inputs)
code_block_3 = CodeBlock(sheetNumbLng=end) { sheetNumbLng[0]; }
acg_quick_sheet_naming_check = Custom[ACG Quick Sheet Naming Check](NumberLength=code_block_3)
acg_quickaudit_familynamingcheck = Custom[ACG QuickAudit.FamilyNamingCheck]()
ACGQuickAuditViewsOnSheetsNamingCheck = Custom[ACGQuickAuditViewsOnSheetsNamingCheck]()  # Check views placed on PRODUCTION sheets. Only Plans, Elevations and Sections
view_type = ViewTypesUi("View Template")
getByType = archilab.Revit.Views.Views.GetByType(viewType=view_type)
count_2 = List.Count(list=getByType)
code_block_4 = CodeBlock(e=getByType) { "ACG-"; e.Name; }
startsWith = String.StartsWith(string=code_block_4.out1, searchFor=code_block_4.out0)
filterByBoolMask = List.FilterByBoolMask(list=code_block_4.out1, mask=startsWith)
code_block_5 = CodeBlock { 0; 8; "-"; }
remove = String.Remove(string=filterByBoolMask.in, startIndex=code_block_5.out0, count=code_block_5.out1)
startsWith_2 = String.StartsWith(string=remove, searchFor=code_block_5.out2)
filterByBoolMask_2 = List.FilterByBoolMask(list=filterByBoolMask.in, mask=startsWith_2)
count_3 = List.Count(list=filterByBoolMask_2.in)
code_block_6 = CodeBlock(ttl=count_2, compl=count_3) { (ttl-compl)/ttl*100; }
round = Math.Round(number=code_block_6)
code_block_7 = CodeBlock { c=Revit.Category.ByName("Views"); ElementQueries.OfCategory(c); }
clear_list = Custom[Clear List](input=code_block_7.out1)  # package archi-lab.net; This node will remove all Null and Empty Lists from any list.
viewTemplate = archilab.Revit.Views.Views.ViewTemplate(view=clear_list)
code_block_8 = CodeBlock(views=viewTemplate) { obj=DSCore.List.UniqueItems(views); obj==null; }
filterByBoolMask_3 = List.FilterByBoolMask(list=code_block_8.obj, mask=code_block_8.out1)
setDifference = List.SetDifference(list1=getByType, list2=filterByBoolMask_3.out)
count_4 = List.Count(list=setDifference)
code_block_9 = CodeBlock(notUsed=count_4, ttl=count_2) { notUsed/ttl*100; }
round_2 = Math.Round(number=code_block_9)
ACGQuickLevelsAndGridsCheck = Custom[ACGQuickLevelsAndGridsCheck]()
code_block_10 = CodeBlock { ["join","overlap", "but miss", "hosted"]; }
contains = String.Contains(string=description, searchFor=code_block_10@@L1)
transpose = List.Transpose(lists=contains)
anyTrue = Orchid.Common.List.AnyTrue(list=transpose)
code_block_11 = CodeBlock(warn=anyTrue) { num=DSCore.List.CountTrue(warn); }
fileSize = Custom[ActiveDocument.FileSize]()  # package Data-Shapes; Gets the file size of the ative document, even if it is a BIM360 Design workshared project.
code_block_12 = CodeBlock { " "; }
split = String.Split(string=fileSize, separator0=code_block_12)
code_block_13 = CodeBlock(x=split) { x[0]; }
toNumber = String.ToNumber(string=code_block_13)
code_block_14 = CodeBlock { DSCore.Types.FindTypeByNameInAssembly("FamilyInstance","RevitAPI"); }
all_elements_of_type = ElementsOfType(element_type=code_block_14)
isInPlace = WombatDynamo.FamilyInstance.IsInPlace(instance=all_elements_of_type)
isNull = Object.IsNull(object=isInPlace)
filterByBoolMask_4 = List.FilterByBoolMask(list=all_elements_of_type, mask=isNull)
isInPlace_2 = WombatDynamo.FamilyInstance.IsInPlace(instance=filterByBoolMask_4.out)
filterByBoolMask_5 = List.FilterByBoolMask(list=filterByBoolMask_4.out, mask=isInPlace_2)
code_block_15 = CodeBlock(el=filterByBoolMask_5.in) { el.Type; }
family = FamilyType.Family(familyType=code_block_15)
code_block_16 = CodeBlock(el=family) { listOfFams=el.Name; count=DSCore.List.Count(el); }
acg_quick_duplicate_levels_check = Custom[ACG Quick Duplicate Levels Check]()
list_create = List.Create(item0=count, item1=acg_quickaudit_cadimportscheck, item2=acg_quickaudit, item3=acg_quickaudit_2, item4=acg_quickaudit_groupscheck.Results_Naming, item5=acg_quickaudit_groupscheck.Results_Nesting, item6=acg_quick_sheet_naming_check.Results, item7=acg_quickaudit_familynamingcheck.Results_Naming, item8=ACGQuickAuditViewsOnSheetsNamingCheck.Result, item9=round, item10=round_2, item11=ACGQuickLevelsAndGridsCheck.Result_percent, item12=code_block_11, item13=toNumber, item14=code_block_16.count, item15=acg_quick_duplicate_levels_check.Result)
flatten = List.Flatten(list=list_create)
end_2 = Revit.Transaction.Transaction.End(input=flatten)
string_from_object = FromObject(obj=end_2)
code_block_17 = CodeBlock { "NaN"; "0"; "null"; }
replace = String.Replace(string=string_from_object, searchFor=code_block_17.out0, replaceWith=code_block_17.out1)
replace_2 = String.Replace(string=replace, searchFor=code_block_17.out2, replaceWith=code_block_17.out1)
code_block_18 = CodeBlock { ".000000"; ""; }
replace_3 = String.Replace(string=replace_2, searchFor=code_block_18.out0, replaceWith=code_block_18.out1)
ACGQuickFamilyInPlaceCheck = Custom[ACGQuickFamilyInPlaceCheck]()  # frozen
code_block_19 = CodeBlock { c=Revit.Category.ByName("Detail Items"); ElementQueries.OfCategory(c); }
name = Element.Name(element=code_block_19.out1)
code_block_20 = CodeBlock { "ACG-2010-ModelHealthBars"; }
eq = name == code_block_20
filterByBoolMask_6 = List.FilterByBoolMask(list=code_block_19.out1, mask=eq)
code_block_21 = CodeBlock(x=filterByBoolMask_6.in) { x[0]; }
code_block_22 = CodeBlock()
# ---------- code_block_22.designscript (18 lines) ----------
[
"Warnings",
"CAD Imports",
"Redundant Rooms",
"Redundant Areas",
"Group Naming",
"Group Nesting",
"Sheet Naming",
"Family Naming",
"View Naming",
"View Template Naming",
"View Template Usage",
"Levels & Grids",
"Joining & Overlapping",
"File Size",
"In-Place Families",
"Duplicate Levels"
];
# ----------------------------------------
setParameterByName = Element.SetParameterByName(element=code_block_21, parameterName=code_block_22@L1, value=flatten@L1)
code_block_23 = CodeBlock { c=Revit.Category.ByName("Project Information"); ElementQueries.OfCategory(c); }
code_block_24 = CodeBlock { "Project Directory"; "ACG_Model Number"; }
getParameterValueByName = Element.GetParameterValueByName(element=code_block_23.out1, parameterName=code_block_24.out0)
getParameterValueByName_2 = Element.GetParameterValueByName(element=code_block_23.out1, parameterName=code_block_24.out1)
now = DateTime.Now()
code_block_25 = CodeBlock { "yyyyMMdd"; }
format = DateTime.Format(dateTime=now, format=code_block_25)
code_block_26 = CodeBlock(prjdirectory=getParameterValueByName, modelNumber=getParameterValueByName_2, date=format) { prjdirectory+"\\06 Audit\\"+modelNumber+"-"+date+"-"+"QuickAuditResults.csv"; }
string_from_object_2 = FromObject(object=code_block_26)
exportCSV = Data.ExportCSV(filePath=string_from_object_2, data=end_2)
code_block_27 = CodeBlock { c=Revit.Category.ByName("Project Information"); ElementQueries.OfCategory(c); }
code_block_28 = CodeBlock { "Project Directory"; "Project Number"; "ACG_Model Number"; }
getParameterValueByName_3 = Element.GetParameterValueByName(element=code_block_27.out1, parameterName=code_block_28.out0)
getParameterValueByName_4 = Element.GetParameterValueByName(element=code_block_27.out1, parameterName=code_block_28.out1)
code_block_29 = CodeBlock(dir=getParameterValueByName_3, prjNum=getParameterValueByName_4) { dir+"\\06 Audit"; "QuickAuditResult"; "-"; dir+"\\06 Audit\\"+prjNum+"-QuickAuditHistory.xlsx"; }
code_block_30 = CodeBlock { "P1"; true; }
getParameterValueByName_5 = Element.GetParameterValueByName(element=code_block_27.out1, parameterName=code_block_28.out2)
code_block_31 = CodeBlock(x=getParameterValueByName_5) { x[0]; }
contents = Orchid.Common.Directory.Contents(directory=code_block_29.out0)
flatten_2 = List.Flatten(list=contents)
contains_2 = String.Contains(string=flatten_2, searchFor=code_block_29.out1)
filterByBoolMask_7 = List.FilterByBoolMask(list=flatten_2, mask=contains_2)
contains_3 = String.Contains(string=filterByBoolMask_7.in, searchFor=code_block_31)
filterByBoolMask_8 = List.FilterByBoolMask(list=filterByBoolMask_7.in, mask=contains_3)
split_2 = String.Split(string=filterByBoolMask_8.in, separator0=code_block_31)
transpose_2 = List.Transpose(lists=split_2)
lastItem = List.LastItem(list=transpose_2)
split_3 = String.Split(string=lastItem, separator0=code_block_29.out2)
transpose_3 = List.Transpose(lists=split_3)
code_block_32 = CodeBlock(x=transpose_3) { date=x[0]; }
code_block_33 = CodeBlock { 4; 7; "."; }
insert = String.Insert(string=code_block_32@@L1, index=code_block_33.out0, toInsert=code_block_33.out2)
insert_2 = String.Insert(string=insert@@L1, index=code_block_33.out1, toInsert=code_block_33.out2)
importCSV = Data.ImportCSV(filePath=filterByBoolMask_8.in)
code_block_34 = CodeBlock { 1; }
flatten_3 = List.Flatten(list=importCSV, amount=code_block_34)
transpose_4 = List.Transpose(lists=flatten_3)
string_from_object_3 = FromObject(object=transpose_4)
code_block_35 = CodeBlock(obj=string_from_object_3) { obj=="null"?"0":obj; }
code_block_36 = CodeBlock(lst=code_block_35) { count=DSCore.List.Count(lst[0]); " "; count+15; }
ofRepeatedItem = List.OfRepeatedItem(item=code_block_36.out1, amount=code_block_36.count)
code_block_37 = CodeBlock(dates=insert_2, empty=ofRepeatedItem, x=code_block_35)
# ---------- code_block_37.designscript (27 lines) ----------
dates;
empty;
x[0];
x[12];
empty;
empty;
x[1];
empty;
empty;
x[2];
x[3];
empty;
empty;
x[4];
x[5];
empty;
empty;
x[7];
x[6];
x[8];
empty;
empty;
x[9];
x[10];
empty;
empty;
x[11];
# ----------------------------------------
list_create_2 = List.Create(item0=code_block_37.out0, item1=code_block_37.out1, item2=code_block_37.out2, item3=code_block_37.out3, item4=code_block_37.out4, item5=code_block_37.out5, item6=code_block_37.out6, item7=code_block_37.out7, item8=code_block_37.out8, item9=code_block_37.out9, item10=code_block_37.out10, item11=code_block_37.out11, item12=code_block_37.out12, item13=code_block_37.out13, item14=code_block_37.out14, item15=code_block_37.out15, item16=code_block_37.out16, item17=code_block_37.out17, item18=code_block_37.out18, item19=code_block_37.out19, item20=code_block_37.out20, item21=code_block_37.out21, item22=code_block_37.out22, item23=code_block_37.out23, item24=code_block_37.out24, item25=code_block_37.out25, item26=code_block_37.out26)
bb_data = Custom[BB Data](sheetName=code_block_31, origin=code_block_30.out0, data=list_create_2)  # package BumbleBee; This node is a building block for different modes of writing to Excel files. You can combines this node into a list to write to multiple sheets or use just one to write to a single sheet.
write_excel = Custom[Write Excel](filePath=code_block_29.out3, runIt=code_block_30.out1, BBData=bb_data)  # package BumbleBee; This node will write data to Excel file and based on how your BBData nodes are structured it will either override the exsting file, create a new one and write a single worksheet or write multiple worksheets.
code_block_38 = CodeBlock { ""; "a".."z"; true; }
join = List.Join(list0=code_block_38.out0, list1=code_block_38.out1)
changeCase = String.ChangeCase(string=join, upper=code_block_38.out2)
code_block_39 = CodeBlock(seq=changeCase, n=code_block_36.out2)
# ---------- code_block_39.designscript (7 lines) ----------
// First digit
string1 = seq[DSCore.Math.Floor((n-1)/26)];
// Second digit
rest = n%26;
string2 = seq[rest > 0 ? rest : 26];
// Entire string
string1 + string2;
# ----------------------------------------
code_block_40 = CodeBlock(column=code_block_39.out3)
# ---------- code_block_40.designscript (14 lines) ----------
DSCore.Color.ByARGB(255,45,53,61);

"O2:"+column+"2";
"O6:"+column+"6";
"O9:"+column+"9";
"O13:"+column+"13";
"O17:"+column+"17";
"O22:"+column+"22";
"O26:"+column+"26";

7;

DSCore.Color.ByARGB(255,217,217,217);
"O1:"+column+"1";
# ----------------------------------------
list_create_3 = List.Create(item0=code_block_40.out1, item1=code_block_40.out2, item2=code_block_40.out3, item3=code_block_40.out4, item4=code_block_40.out5, item5=code_block_40.out6, item6=code_block_40.out7)
flatten_4 = List.Flatten(list=list_create_3)
pattern_types = PatternTypesUi("xlSolid")
fill_style = Custom[Fill Style](PatternType=pattern_types, BackgroundColor=code_block_40.out0, PatternColor=code_block_40.out0)  # package BumbleBee; This node generates a Fill Style that can be used for conditional formatting or regular cell formatting.
graphic_style = Custom[Graphic Style](FillStyle=fill_style)  # package BumbleBee; This node will create a graphic style that can be used either for conditional formatting or regular cell formatting.
ofRepeatedItem_2 = List.OfRepeatedItem(item=graphic_style, amount=code_block_40.out8)
bb_style = Custom[BB Style](SheetName=code_block_31, CellRange=flatten_4@L1, GraphicStyle=ofRepeatedItem_2@@L1)  # package BumbleBee; This node is a building block for different modes of formatting an Excel file. You can combines this node into a list to apply formatting to multiple ranges or sheets at the same time.
format_excel = Custom[Format Excel](filePath=code_block_29.out3, RunIt=code_block_30.out1, BBStyle=bb_style@@L2)  # package BumbleBee; This node will allow you to apply formatting to a specific range within the document. You can format a single range on a single sheet or multiple ranges on multiple sheets at the same time.
fill_style_2 = Custom[Fill Style](PatternType=pattern_types, BackgroundColor=code_block_40.out9, PatternColor=code_block_40.out9)
graphic_style_2 = Custom[Graphic Style](FillStyle=fill_style_2)
bb_style_2 = Custom[BB Style](SheetName=code_block_31, CellRange=code_block_40.out10, GraphicStyle=graphic_style_2)
format_excel_2 = Custom[Format Excel](filePath=code_block_29.out3, RunIt=code_block_30.out1, BBStyle=bb_style_2)
