# Dynamo graph Collect Library Content.dyn (Dynamo 2.6.1.8786)
# packages: Orchid 260.1.0.7729, archi-lab.net 2021.25.2521, Data-Shapes 2021.2.92

# group: DYNAMO GRAPHIC STANDARD
# note: AYRE CHAMBERLAIN GAUNT
# Creted by: Ivo Petrov
# Created: 01/06/2020
# Varsion: 1.0
# Last undated: 01/06/2020
# Dynamo version: 2.0.3
# Notes:
# All scripts to follow graphic standards for ease of use by other members on the design team.

# group: DESIGNER'S GUIDELINES
# note: Designer's guidelines:
# 1. Divide Dynamo script into groups: "Input", "Processing" and "Output".
# 2. Colour code groups according to the template.
# 3. Script should be broken up into small groups of nodes.
# 4. Groups of "Processing" nodes should always have Input/Output
# 5. Rename Input/Output groups depending on their function.
# 6. Fill out script information for users.

# group: <PROJECT NUMBER> <PROJECT NAME>
# note: Created by: <Name Surname>
# Created: <Date>
# Version: <1.x>
# Last edited: <Date>
# Dynamo version: <Dynamo x.x.x>
# Packages:
# <Packages>
# Notes:
# <Notes>

# group: CHANGE LOG
# note: Version:
# <1.x: Description of change>

# group: CONTROL
# note: CONTROL
# Use:
# For user input: sliders, numbers, selecting levels, etc.

# group: INPUT
# note: INPUT
# Use:
# For the incomming references: file paths, geometries.

# group: PROCESSING
# note: DESIGN
# Use:
# For the back-end fuctionality.

# group: WIP
# note: WIP
# Use:
# For in-progress not tested nodes.

# group: MONITOR
# note: MONITOR
# Use:
# For important watch nodes.

# group: FILTERING DATA
# note: FILTERING DATA
# Use:
# For filtering list data: filter by bool mask, sort groups by key.

# group: OUTPUT
# note: OUTPUT
# Use:
# For final output.

# group: Processing
string = StringInput("C:\Users\")
userName = Python()  # "System.UserName"; unwired: IN[0]
# ---------- userName.python (3 lines) ----------
import clr
from System import Environment
OUT = Environment.UserName
# ----------------------------------------
string_2 = StringInput("\Documents\02-ExportedDocuments\")
code_block = CodeBlock { "Library-2DContent_Component.csv"; "Library-3DContent_Component.csv"; "Library-Content_System.csv"; }
code_block_2 = CodeBlock(part1=string, user=userName, part2=string_2, fileName=code_block.out2) { part1+user+part2+fileName; }
code_block_3 = CodeBlock(part1=string, user=userName, part2=string_2, fileName=code_block.out1) { part1+user+part2+fileName; }
code_block_4 = CodeBlock(part1=string, user=userName, part2=string_2, fileName=code_block.out0) { part1+user+part2+fileName; }

# group: Processing
code_block_5 = CodeBlock { Revit.Elements.Category.ByName("Walls"); Revit.Elements.Category.ByName("Floors"); }
list_create = List.Create(item0=code_block_5.out0, item1=code_block_5.out1)
code_block_6 = CodeBlock(lst=list_create) { ElementQueries.OfCategory(lst); }
type = archilab.Revit.Elements.Elements.Type(element=code_block_6)
uniqueItems = List.UniqueItems(list=type@@L2)
flatten = List.Flatten(list=uniqueItems)
string_from_object = FromObject(obj=flatten)

# group: Processing
code_block_7 = CodeBlock()
# ---------- code_block_7.designscript (38 lines) ----------
"Casework";
Revit.Elements.Category.ByName("Casework");

"Doors";
Revit.Elements.Category.ByName("Doors");

"Electrical Equipment";
Revit.Elements.Category.ByName("Electrical Equipment");

"Entourage";
Revit.Elements.Category.ByName("Entourage");

"Furniture";
Revit.Elements.Category.ByName("Furniture");

"Generic Models";
Revit.Elements.Category.ByName("Generic Models");

"Mechanical Equipment";
Revit.Elements.Category.ByName("Mechanical Equipment");

"Planting";
Revit.Elements.Category.ByName("Planting");

"Plumbing Fixtures";
Revit.Elements.Category.ByName("Plumbing Fixtures");

"Railings";
Revit.Elements.Category.ByName("Railings");

"Site";
Revit.Elements.Category.ByName("Site");

"Specialty Equipment";
Revit.Elements.Category.ByName("Specialty Equipment");

"Windows";
Revit.Elements.Category.ByName("Windows");
# ----------------------------------------
list_create_2 = List.Create(item0=code_block_7.out1, item1=code_block_7.out3, item2=code_block_7.out5, item3=code_block_7.out7, item4=code_block_7.out9, item5=code_block_7.out11, item6=code_block_7.out13, item7=code_block_7.out15, item8=code_block_7.out17, item9=code_block_7.out19, item10=code_block_7.out21, item11=code_block_7.out23, item12=code_block_7.out25)
byCategory = Orchid.RevitProject.Elements.Family.ByCategory(category=list_create_2)
flatten_2 = List.Flatten(list=byCategory)
string_from_object_2 = FromObject(obj=flatten_2)
code_block_8 = CodeBlock { "Family: "; ""; }
replace = String.Replace(str=string_from_object_2, searchFor=code_block_8.out0, replaceWith=code_block_8.out1)

# group: Processing
code_block_9 = CodeBlock()
# ---------- code_block_9.designscript (5 lines) ----------
"Generic Annotations";
Revit.Elements.Category.ByName("Generic Annotations");

"Detail Items";
Revit.Elements.Category.ByName("Detail Items");
# ----------------------------------------
list_create_3 = List.Create(item0=code_block_9.out1, item1=code_block_9.out3)
byCategory_2 = Orchid.RevitProject.Elements.Family.ByCategory(category=list_create_3)
flatten_3 = List.Flatten(list=byCategory_2)
string_from_object_3 = FromObject(obj=flatten_3)
code_block_10 = CodeBlock { "Family: "; ""; }
replace_2 = String.Replace(str=string_from_object_3, searchFor=code_block_10.out0, replaceWith=code_block_10.out1)

# group: Output
exportCSV = Data.ExportCSV(filePath=code_block_2, data=string_from_object)
exportCSV_2 = Data.ExportCSV(filePath=code_block_3, data=replace)
exportCSV_3 = Data.ExportCSV(filePath=code_block_4, data=replace_2)

# group: Input
file_path = Filename("..\ACG_logo.png")
file_from_path = FileObject(path=file_path)
readFromFile = Image.ReadFromFile(file=file_from_path)
code_block_11 = CodeBlock { "Got it!"; }
code_block_12 = CodeBlock { "Tip:"; true; }
string_3 = StringInput("This script will export a list with all existing families in the ACG's Library model. The list will be saved  in Documents\02-ExportedDocuments folder.")
ui_textnote_data = Custom[UI.TextNote Data](Title=code_block_12.out0, TextNote=string_3)  # package Data-Shapes; Create Data for TextNote input in UI.MultipleInputForm ++ . Check out www.data-shapes.net for more informations
ui_multipleinputform = Custom[UI.MultipleInputForm ++](Logo_optional=readFromFile, ButtonText_optional=code_block_11, Inputs=ui_textnote_data, Toggle=code_block_12.out1)  # package Data-Shapes; Create a form with multiple inputs. see www.data-shapes.net for tutorials and infos!

# group: Usage
code_block_13 = CodeBlock { "Collect Library Content"; }
acg_script_usage = Custom[ACG Script Usage](scriptName=code_block_13)  # Adds an entry to Excel document every time a script is run. The document is located in S:\Dynamo\05-UsageStats
