# Dynamo graph Elements - Remove Paint_py.dyn "Elements - Remove Paint" (Dynamo 2.12.1.8246)
# packages: Data-Shapes 2021.2.92

# group: Input
file_path = Filename("..\ACG_logo.png")
file_from_path = FileObject(path=file_path)
readFromFile = Image.ReadFromFile(file=file_from_path)
code_block = CodeBlock { "Cancel"; true; "Run"; 600; 300; }
code_block_2 = CodeBlock()
# ---------- code_block_2.designscript (4 lines) ----------
"Note:";
"This tool will remove the paint from any system family’s face visible in the active view. To remove the paint from all elements in the model, open a 3D view and make sure all system family categories are visible.
System family categories include : walls, floors, roofs, ceilings, railings, ramps, site and stairs.
";
# ----------------------------------------
textnote_data = Custom[TextNote Data](Title=code_block_2.out0, TextNote=code_block_2.out1)  # package Data-Shapes; Create Data for TextNote input in UI.MultipleInputForm ++ . Check out www.data-shapes.net for more informations
list_create = List.Create(item0=textnote_data)
ui_multipleinputform = Custom[UI.MultipleInputForm ++](Logo_optional=readFromFile, ButtonText_optional=code_block.out2, Inputs=list_create, Toggle=code_block.out1, CancelButtonText_optional=code_block.out0, Width_optional=code_block.out3, LabelWidth_optional=code_block.out4)  # package Data-Shapes; Create a form with multiple inputs. see www.data-shapes.net for tutorials and infos!

# group: Visualisation
python_script = Python(IN[0]=ui_multipleinputform.Was_Cancelled)  # IronPython2
# ---------- python_script.python (66 lines) ----------
# Load the Python Standard and DesignScript Libraries
import clr
import sys
import os.path
from System import Environment
sys.path.append('C:\Program Files (x86)\IronPython 2.7\Lib')
import System
from System import Array
from System.Collections.Generic import *
clr.AddReference('ProtoGeometry')
from Autodesk.DesignScript.Geometry import *
clr.AddReference("RevitNodes")
import Revit
clr.ImportExtensions(Revit.Elements)
clr.ImportExtensions(Revit.GeometryConversion)
clr.AddReference("RevitServices")
import RevitServices
from RevitServices.Persistence import DocumentManager 
from RevitServices.Transactions import TransactionManager 
clr.AddReference("RevitAPI")
clr.AddReference("RevitAPIUI")
import Autodesk 
from Autodesk.Revit.DB import *
from Autodesk.Revit.UI import *

doc = DocumentManager.Instance.CurrentDBDocument
uiapp = DocumentManager.Instance.CurrentUIApplication 
app = uiapp.Application 
uidoc = uiapp.ActiveUIDocument

cancelled =		IN[0]

if cancelled == True:
	OUT = 'Error : ', 'The script was cancelled.'
	
else:
	gOpt = Options()
	countPainted = 0
	# create list with all sustem family categories
	catList = [BuiltInCategory.OST_Walls, BuiltInCategory.OST_Floors, BuiltInCategory.OST_Roofs, BuiltInCategory.OST_Ceilings, BuiltInCategory.OST_Railings, BuiltInCategory.OST_Ramps, BuiltInCategory.OST_Site, BuiltInCategory.OST_Stairs, BuiltInCategory.OST_StructuralColumns, BuiltInCategory.OST_StructuralFraming, BuiltInCategory.OST_StructuralFoundation]
	# create typed list
	typedCatList = List[BuiltInCategory](catList)
	#create a filter
	filter = ElementMulticategoryFilter(typedCatList)	
	# collect elements from all sustem family categories
	elements = FilteredElementCollector(doc, doc.ActiveView.Id).WherePasses(filter).ToElements()
	
	
	TransactionManager.Instance.EnsureInTransaction(doc)
	for el in elements:
		try:
			objGeom = el.get_Geometry(gOpt)
			for geom in objGeom:
				faces = geom.Faces
				for face in faces:
					if doc.IsPainted(el.Id, face):
						doc.RemovePaint(el.Id, face)
						countPainted += 1
		except:
			continue
	TransactionManager.Instance.TransactionTaskDone()
	if countPainted == 0:
		OUT = 'Result : ', 'There are no painted faces in the active view.'
	else:	
		OUT = 'Success ! ', str(countPainted) + ' faces were painted. The paint is now removed.'		
		
# ----------------------------------------
code_block_3 = CodeBlock(x=python_script) { "Okay"; true; title = x[0]; text = x[1]; }

# group: Assing
ui_textnote_data = Custom[UI.TextNote Data](Title=code_block_3.title, TextNote=code_block_3.text)  # package Data-Shapes; Create Data for TextNote input in UI.MultipleInputForm ++ . Check out www.data-shapes.net for more informations
ui_multipleinputform_2 = Custom[UI.MultipleInputForm ++](ButtonText_optional=code_block_3.out0, Inputs=ui_textnote_data, Toggle=code_block_3.out1)
