# Dynamo graph Floors - Create By Selected Rooms.dyn (Dynamo 2.12.1.8246)
# packages: Data-Shapes 2021.2.92, Orchid 260.1.0.7729, Topologic 1.4.0

# group: Usage
code_block = CodeBlock { "Floors - Create By Selected Rooms"; }
acg_script_usage = Custom[ACG Script Usage](scriptName=code_block)  # Adds an entry to Excel document every time a script is run. The document is located in S:\Dynamo\05-UsageStats

file_path = Filename("..\ACG_logo.png")
file_from_path = FileObject(path=file_path)
readFromFile = Image.ReadFromFile(file=file_from_path)

# group: Input
code_block_2 = CodeBlock { true; "Generate"; "Cancel"; 250; 700; }
code_block_3 = CodeBlock { "Note:"; }
string = StringInput("The tool will generate floor elements of a given floor type and offset from level for the boundaries of the selected room(s).")
textnote_data = Custom[TextNote Data](Title=code_block_3, TextNote=string)  # package Data-Shapes; Create Data for TextNote input in UI.MultipleInputForm ++ . Check out www.data-shapes.net for more informations
python_script = Python()  # IronPython2
# ---------- python_script.python (33 lines) ----------
# Load the Python Standard and DesignScript Libraries
import clr
import sys
import os.path
from System import Environment
sys.path.append('C:\Program Files (x86)\IronPython 2.7\Lib')
import System
from System import Array
from System.Collections.Generic import *
clr.AddReference('ProtoGeometry')
from Autodesk.DesignScript.Geometry import *
clr.AddReference("RevitNodes")
import Revit
clr.ImportExtensions(Revit.Elements)
clr.ImportExtensions(Revit.GeometryConversion)
clr.AddReference("RevitServices")
import RevitServices
from RevitServices.Persistence import DocumentManager 
from RevitServices.Transactions import TransactionManager 
clr.AddReference("RevitAPI")
clr.AddReference("RevitAPIUI")
import Autodesk 
from Autodesk.Revit.DB import *
from Autodesk.Revit.UI import *

doc = DocumentManager.Instance.CurrentDBDocument
uiapp = DocumentManager.Instance.CurrentUIApplication 
app = uiapp.Application 
uidoc = uiapp.ActiveUIDocument

fTypes = FilteredElementCollector(doc).OfCategory(BuiltInCategory.OST_Floors).WhereElementIsElementType().ToElements()

OUT = [f.Id for f in fTypes], [f.get_Parameter(BuiltInParameter.SYMBOL_NAME_PARAM).AsValueString() for f in fTypes]
# ----------------------------------------
code_block_4 = CodeBlock(x=python_script) { "Select floor type :"; 0; keys = x[1]; values = x[0]; }
dropdown_data = Custom[DropDown Data](InputName=code_block_4.out0, Keys=code_block_4.keys, Values=code_block_4.values, DefaultValueIndex=code_block_4.out1)  # package Data-Shapes; Create data for DropDown input in UI.MultiInputForm ++ . Check out www.data-shapes.net for more infos.
code_block_5 = CodeBlock { "Offset from Level :"; "0"; true; }
textbox_data = Custom[TextBox Data](InputName=code_block_5.out0, DefaultText=code_block_5.out1, IsNumberEntry=code_block_5.out2)  # package Data-Shapes; Create Data for TextBox input in UI.MultipleInputForm ++ . Check out www.data-shapes.net for more informations
list_create = List.Create(item0=textnote_data, item1=dropdown_data, item2=textbox_data)
multipleinputform = Custom[MultipleInputForm ++](Logo_optional=readFromFile, ButtonText_optional=code_block_2.out1, Inputs=list_create, Toggle=code_block_2.out0, CancelButtonText_optional=code_block_2.out2, Width_optional=code_block_2.out4, LabelWidth_optional=code_block_2.out3)  # package Data-Shapes; Create a form with multiple inputs. see www.data-shapes.net for tutorials and infos!
code_block_6 = CodeBlock(x=multipleinputform.User_Inputs) { fTypeId = x[0]; offset = x[1]; }

# group: Assing
code_block_7 = CodeBlock { "Error : "; "The script was cancelled."; "Okay"; }
ui_textnote_data = Custom[UI.TextNote Data](Title=code_block_7.out0, TextNote=code_block_7.out1)  # package Data-Shapes; Create Data for TextNote input in UI.MultipleInputForm ++ . Check out www.data-shapes.net for more informations
ui_multipleinputform = Custom[UI.MultipleInputForm ++](Logo_optional=readFromFile, ButtonText_optional=code_block_7.out2, Inputs=ui_textnote_data, Toggle=multipleinputform.Was_Cancelled)  # package Data-Shapes; Create a form with multiple inputs. see www.data-shapes.net for tutorials and infos!

code_block_8 = CodeBlock(x=multipleinputform.User_Inputs) { fTypeId = x[0]; }

# group: Input
code_block_9 = CodeBlock { true; Revit.Elements.Category.ByName("Rooms"); "Room"; }
await_ = Orchid.Common.DataStream.Await(pass=code_block_9.out1, waitFor=multipleinputform.Was_Cancelled)
ACGSelectModelElements = Custom[ACGSelectModelElements](refresh=code_block_9.out0, category=await_, cancel=multipleinputform.Was_Cancelled)  # from IsolatedPickModelElements

# group: Processing
finishBoundary = Room.FinishBoundary(room=ACGSelectModelElements)
byGeometry = Topologic.Topology.ByGeometry(geometry=finishBoundary)
byEdges = Topologic.Wire.ByEdges(edges=byGeometry)
code_block_10 = CodeBlock { 0; }
getItemAtIndex = List.GetItemAtIndex(list=byEdges@@L2, index=code_block_10)
byWire = Topologic.Face.ByWire(wire=getItemAtIndex)
geometry = Topologic.Topology.Geometry(topology=byWire)
perimeterCurves = Surface.PerimeterCurves(surface=geometry)
python_script_2 = Python(IN[0]=ACGSelectModelElements, IN[1]=code_block_6.fTypeId)  # IronPython2
# ---------- python_script_2.python (34 lines) ----------
# Load the Python Standard and DesignScript Libraries
import clr
import sys
import os.path
from System import Environment
sys.path.append('C:\Program Files (x86)\IronPython 2.7\Lib')
import System
from System import Array
from System.Collections.Generic import *
clr.AddReference('ProtoGeometry')
from Autodesk.DesignScript.Geometry import *
clr.AddReference("RevitNodes")
import Revit
clr.ImportExtensions(Revit.Elements)
clr.ImportExtensions(Revit.GeometryConversion)
clr.AddReference("RevitServices")
import RevitServices
from RevitServices.Persistence import DocumentManager 
from RevitServices.Transactions import TransactionManager 
clr.AddReference("RevitAPI")
clr.AddReference("RevitAPIUI")
import Autodesk 
from Autodesk.Revit.DB import *
from Autodesk.Revit.UI import *

doc = DocumentManager.Instance.CurrentDBDocument
uiapp = DocumentManager.Instance.CurrentUIApplication 
app = uiapp.Application 
uidoc = uiapp.ActiveUIDocument

rooms = UnwrapElement(IN[0])
floorTypeId = IN[1]

OUT = [r.Level for r in rooms], [doc.GetElement(IN[1])]
# ----------------------------------------
code_block_11 = CodeBlock(x=python_script_2) { levels = x[0]; floorType = x[1]; }
byOutlineTypeAndLevel = Floor.ByOutlineTypeAndLevel(outlineCurves=perimeterCurves, floorType=code_block_11.floorType, level=code_block_11.levels, lacing=Longest)
code_block_12 = CodeBlock { "Height Offset From Level"; }
setParameterByName = Element.SetParameterByName(element=byOutlineTypeAndLevel, parameterName=code_block_12, value=code_block_6.offset)
