# Dynamo graph Views - Set Title On Sheet_py.dyn (Dynamo 2.12.1.8246)
# packages: Data-Shapes 2021.2.92, Orchid 260.1.0.7729

# group: Input
code_block = CodeBlock { "Note:"; }
string = StringInput("""This tool looks for views placed on sheets from a given package and sets their titles on sheets if their names contain a given string.
Please don't use special characters like '\' or '/'.""")
textnote_data = Custom[TextNote Data](Title=code_block, TextNote=string)  # package Data-Shapes; Create Data for TextNote input in UI.MultipleInputForm ++ . Check out www.data-shapes.net for more informations

# group: Input
code_block_2 = CodeBlock { "Sheet number must begin with :"; "If view name contains :"; "Set title on sheet :"; true; }
textbox_data = Custom[TextBox Data](InputName=code_block_2.out0)  # package Data-Shapes; Create Data for TextBox input in UI.MultipleInputForm ++ . Check out www.data-shapes.net for more informations
textbox_data_2 = Custom[TextBox Data](InputName=code_block_2.out1)
textbox_data_3 = Custom[TextBox Data](InputName=code_block_2.out2)

# group: Input
file_path = Filename("..\ACG_logo.png")
file_from_path = FileObject(path=file_path)
readFromFile = Image.ReadFromFile(file=file_from_path)
code_block_3 = CodeBlock { "Update accomodation schedule"; true; "Run"; "Cancel"; 700; 400; }
list_create = List.Create(item0=textnote_data, item1=textbox_data, item2=textbox_data_2, item3=textbox_data_3)
multipleinputform = Custom[MultipleInputForm ++](Logo_optional=readFromFile, ButtonText_optional=code_block_3.out2, Inputs=list_create, Toggle=code_block_3.out1, CancelButtonText_optional=code_block_3.out3, Width_optional=code_block_3.out4, LabelWidth_optional=code_block_3.out5)  # package Data-Shapes; Create a form with multiple inputs. see www.data-shapes.net for tutorials and infos!
code_block_4 = CodeBlock(x=multipleinputform.User_Inputs) { sheetCode = 	x[0]; viewCode = 		x[1]; titleOnSheet =	x[2]; }

watch = Watch(multipleinputform.User_Inputs)

# group: Usage
code_block_5 = CodeBlock { "Views - Set Title on Sheet"; }
acg_script_usage = Custom[ACG Script Usage](scriptName=code_block_5)  # Adds an entry to Excel document every time a script is run. The document is located in S:\Dynamo\05-UsageStats

# group: Visualisation
python_script = Python(IN[0]=multipleinputform.Was_Cancelled, IN[1]=code_block_4.sheetCode, IN[2]=code_block_4.viewCode, IN[3]=code_block_4.titleOnSheet)  # IronPython2
# ---------- python_script.python (65 lines) ----------
# Load the Python Standard and DesignScript Libraries
import clr
import sys
import os.path
from System import Environment
sys.path.append('C:\Program Files (x86)\IronPython 2.7\Lib')
import System
from System import Array
from System.Collections.Generic import *
clr.AddReference('ProtoGeometry')
from Autodesk.DesignScript.Geometry import *
clr.AddReference("RevitNodes")
import Revit
clr.ImportExtensions(Revit.Elements)
clr.ImportExtensions(Revit.GeometryConversion)
clr.AddReference("RevitServices")
import RevitServices
from RevitServices.Persistence import DocumentManager 
from RevitServices.Transactions import TransactionManager 
clr.AddReference("RevitAPI")
clr.AddReference("RevitAPIUI")
import Autodesk 
from Autodesk.Revit.DB import *
from Autodesk.Revit.UI import *

doc = DocumentManager.Instance.CurrentDBDocument
uiapp = DocumentManager.Instance.CurrentUIApplication 
app = uiapp.Application 
uidoc = uiapp.ActiveUIDocument

cancelled =			IN[0]
sheetStartWith =	str(IN[1])
viewCode =			str(IN[2])
title =				str(IN[3])

tempSheets, tempViews = [], []


if cancelled == True:
	OUT = 'Error : ', 'The script was cancelled.'
	
else:
	TransactionManager.Instance.EnsureInTransaction(doc)
	sheets = FilteredElementCollector(doc).OfClass(ViewSheet).ToElements()
	for sheet in sheets:
		numb = sheet.LookupParameter('Sheet Number').AsString()
		if numb.StartsWith(sheetStartWith):
			viewportSetIds = sheet.GetAllViewports()
			for viewportId in viewportSetIds:
				try:
					viewport = doc.GetElement(viewportId)
					viewId = viewport.ViewId
					view = doc.GetElement(viewId)
					if viewCode in view.Name:
						tempViews.append(view)
						view.get_Parameter(BuiltInParameter.VIEW_DESCRIPTION).Set(title)
						if sheet not in tempSheets:
							tempSheets.append(sheet)					
				except:
					continue
	TransactionManager.Instance.TransactionTaskDone()
	if len(tempViews) == 0:
		OUT = 'Result : ', 'No views were found.'
	elif len(tempViews) > 0:
		OUT = 'Success ! ', str(len(tempViews)) + ' views have nwe titles on sheet'	
# ----------------------------------------
code_block_6 = CodeBlock(x=python_script) { "Okay"; true; title = x[0]; text = x[1]; }

# group: Assing
ui_textnote_data = Custom[UI.TextNote Data](Title=code_block_6.title, TextNote=code_block_6.text)  # package Data-Shapes; Create Data for TextNote input in UI.MultipleInputForm ++ . Check out www.data-shapes.net for more informations
await_ = Orchid.Common.DataStream.Await(pass=code_block_6.out1, waitFor=python_script)
ui_multipleinputform = Custom[UI.MultipleInputForm ++](ButtonText_optional=code_block_6.out0, Inputs=ui_textnote_data, Toggle=await_)  # package Data-Shapes; Create a form with multiple inputs. see www.data-shapes.net for tutorials and infos!
