# Dynamo graph Generate Main Groups-SS.dyn "Generate Main Groups" (Dynamo 2.6.1.8786)
# packages: bimorphNodes 3.0.3, BVN 1.6.1, LunchBox for Dynamo 2016.11.11, Data-Shapes 2021.2.92, WombatDynamo 2.3.0

# group: Input
# note: 1.Purge the model. Make sure the typical floor grous are the only model groups left.
# 2.Open the script and define inputs.
# 3.Run the "Generate group types" part of the script (Input group).
# 4.Use "Open Rescent" to re-open the same script. The script needs to be refreshed (save when asked).
# 5.Run the "Place group instances to levels" part of the script (Input group).
# note: The script needs to generate small .csv file with list of levels on which each typical floor group exists. That file can be deleted after running the second part of the script.

typeCollector = Custom[ModelGroup.TypeCollector]()  # package BVN; Returns all the types (not instances) from all model groups in the project
groups = Custom[GroupType.Groups](groupType=typeCollector)
code_block = CodeBlock { 0; }
getItemAtIndex = List.GetItemAtIndex(list=groups@@L2, index=code_block)
members = Custom[Group.Members](group=getItemAtIndex@@L2)
geometry = Element.Geometry(element=members)
# note: Extract the geometry from the unit families
string_from_object = FromObject(obj=geometry)
code_block_2 = CodeBlock { "Solid"; }
eq = string_from_object == code_block_2
filterByBoolMask = List.FilterByBoolMask(list=geometry, mask=eq)
count = List.Count(list=filterByBoolMask.in@@L2)
code_block_3 = CodeBlock { 3; }
eq_2 = count == code_block_3
filterByBoolMask_2 = List.FilterByBoolMask(list=filterByBoolMask.in, mask=eq_2)
area = Solid.Area()  # unwired: solid
sortByFunction = List.SortByFunction(list=filterByBoolMask_2.in@@L2, func=area)
code_block_4 = CodeBlock { [0]; }
# note: Exclude the balcony solids
removeItemAtIndex = List.RemoveItemAtIndex(list=sortByFunction@@L2, indices=code_block_4)
code_block_5 = CodeBlock { 1; }
flatten = List.Flatten(list=removeItemAtIndex@L3, amt=code_block_5)
# note: Split Residential/Non-Residential units
code_block_6 = CodeBlock { 3; }
flatten_2 = List.Flatten(list=filterByBoolMask_2.out@L3, amt=code_block_6)
list_create = List.Create(item0=flatten, item1=flatten_2)
transpose = List.Transpose(lists=list_create)
code_block_7 = CodeBlock { 1; }
flatten_3 = List.Flatten(list=transpose@L3, amt=code_block_7)
removeNulls = Lists.Manage.RemoveNulls(Data=flatten_3)
byUnion = Solid.ByUnion(solids=removeNulls.Cleaned)
bySolid = PolySurface.BySolid(solid=byUnion)
surfaces = PolySurface.Surfaces(polySurface=bySolid)
filterByOrientation = Custom[Surface.FilterByOrientation](surfaces=surfaces)
flatten_4 = List.Flatten(list=filterByOrientation.horizontalDown)
perimeterCurves = Surface.PerimeterCurves(surface=flatten_4)
file_path = Filename("..\ACG_logo.png")
file_from_path = FileObject(path=file_path)
readFromFile = Image.ReadFromFile(file=file_from_path)
code_block_8 = CodeBlock { "Cancel"; true; "Generate"; 600; 300; }
code_block_9 = CodeBlock { "Select external wall type"; "Select party wall type"; "Select internal floor type"; "Select external floor type"; }
code_block_10 = CodeBlock()
# ---------- code_block_10.designscript (5 lines) ----------
catWalls=Revit.Category.ByName("Walls");
ElementQueries.OfCategory(catWalls);

catFloors=Revit.Category.ByName("Floors");
ElementQueries.OfCategory(catFloors);
# ----------------------------------------

# group: collect all wall types
getType = WombatDynamo.Element.GetType(element=code_block_10.out1)
uniqueItems = List.UniqueItems(list=getType)
name = Element.Name(element=uniqueItems)
ui_dropdown_data = Custom[UI.DropDown Data](InputName=code_block_9.out0, Keys=name, Values=uniqueItems)  # package Data-Shapes; Create data for DropDown input in UI.MultiInputForm ++ . Check out www.data-shapes.net for more infos.
ui_dropdown_data_2 = Custom[UI.DropDown Data](InputName=code_block_9.out1, Keys=name, Values=uniqueItems)

# group: collect all floor types
getType_2 = WombatDynamo.Element.GetType(element=code_block_10.out3)
uniqueItems_2 = List.UniqueItems(list=getType_2)
name_2 = Element.Name(element=uniqueItems_2)
ui_dropdown_data_3 = Custom[UI.DropDown Data](InputName=code_block_9.out2, Keys=name_2, Values=uniqueItems_2)
ui_dropdown_data_4 = Custom[UI.DropDown Data](InputName=code_block_9.out3, Keys=name_2, Values=uniqueItems_2)

code_block_11 = CodeBlock { "Enter floor height"; 2700; 4500; 3075; 75; }
slider = Custom[UI.Slider](InputName=code_block_11.out0, Minimum=code_block_11.out1, Maximum=code_block_11.out2, Default_Value=code_block_11.out3, Step=code_block_11.out4)  # package Data-Shapes; Creates slider input for UI.MultipleInputForm ++ . Set the step to decimal value if you want a double slider, or to a integer value if you want an integer slider.
list_create_2 = List.Create(item0=ui_dropdown_data, item1=ui_dropdown_data_2, item2=ui_dropdown_data_3, item3=ui_dropdown_data_4, item4=slider)
flatten_5 = List.Flatten(list=list_create_2)
ui_multipleinputform = Custom[UI.MultipleInputForm ++](Logo_optional=readFromFile, ButtonText_optional=code_block_8.out2, Inputs=flatten_5, Toggle=code_block_8.out1, CancelButtonText_optional=code_block_8.out0, Width_optional=code_block_8.out3, LabelWidth_optional=code_block_8.out4)  # package Data-Shapes; Create a form with multiple inputs. see www.data-shapes.net for tutorials and infos!
code_block_12 = CodeBlock(extwall=ui_multipleinputform.User_Inputs, intwall=ui_multipleinputform.User_Inputs, extfloor=ui_multipleinputform.User_Inputs, intfloor=ui_multipleinputform.User_Inputs, height=ui_multipleinputform.User_Inputs) { extwall[0]; intwall[1]; extfloor[2]; intfloor[3]; height[4]; }
code_block_13 = CodeBlock(height=code_block_12.out4) { height/92902.8; }
code_block_14 = CodeBlock { "Reference Level"; }
getParameterValueByName = Element.GetParameterValueByName(element=getItemAtIndex, parameterName=code_block_14)
code_block_15 = CodeBlock { "Interior"; true; }
# note: Generate external wals
byCurveAndLocation = WombatDynamo.Wall.ByCurveAndLocation(curve=perimeterCurves@L2, height=code_block_13, level=getParameterValueByName, wallType=code_block_12.out0, locationLine=code_block_15.out0, flip=code_block_15.out1, lacing=Longest)
code_block_16 = CodeBlock { "Location Line"; 2; }
setParameterByName = Element.SetParameterByName(element=byCurveAndLocation, parameterName=code_block_16.out0, value=code_block_16.out1)
flatten_6 = List.Flatten(list=setParameterByName@@L3)
getItemAtIndex_2 = List.GetItemAtIndex(list=sortByFunction@@L2, index=code_block_4)
code_block_17 = CodeBlock { 1; }
flatten_7 = List.Flatten(list=getItemAtIndex_2@L3, amt=code_block_17)
byUnion_2 = Solid.ByUnion(solids=flatten_7)
bySolid_2 = PolySurface.BySolid(solid=byUnion_2)
surfaces_2 = PolySurface.Surfaces(polySurface=bySolid_2)
filterByOrientation_2 = Custom[Surface.FilterByOrientation](surfaces=surfaces_2)
perimeterCurves_2 = Surface.PerimeterCurves(surface=filterByOrientation_2.horizontalDown)
# note: Generate balcony floors
byOutlineTypeAndLevel = Floor.ByOutlineTypeAndLevel(outlineCurves=perimeterCurves_2, floorType=code_block_12.out2, level=getParameterValueByName)
list_create_3 = List.Create(item0=flatten_6, item1=byOutlineTypeAndLevel)
transpose_2 = List.Transpose(lists=list_create_3)
code_block_18 = CodeBlock { 1; }
flatten_8 = List.Flatten(list=transpose_2@@L3, amt=code_block_18)
# note: Collect model groups and their elements.
name_3 = Element.Name(element=getItemAtIndex)
code_block_19 = CodeBlock(groupname=name_3) { groupname+"_ExternalWalls"; groupname+"_PartyWalls"; }
# note: Group the newly generated elements
fromElements = Custom[Group.FromElements](elements=flatten_8@L2, groupName=code_block_19.out0)
flatten_9 = List.Flatten(list=filterByBoolMask.out@L3)
length = Curve.Length(curve=flatten_9)
sortByKey = List.SortByKey(list=flatten_9@L2, keys=length@@L2)
removeDuplicates = Curve.RemoveDuplicates(curves=sortByKey.sorted_list)
code_block_20 = CodeBlock { "Default Thickness"; }
getParameterValueByName_2 = Element.GetParameterValueByName(element=code_block_12.out3, parameterName=code_block_20)
code_block_21 = CodeBlock(height=code_block_12.out4, slabthickness=getParameterValueByName_2) { (height-slabthickness)/92902.8; }
watch = Watch(getParameterValueByName)
code_block_22 = CodeBlock { "Centerline"; false; }
byCurveAndLocation_2 = WombatDynamo.Wall.ByCurveAndLocation(curve=removeDuplicates.cleanedCurves@@L2, height=code_block_21, level=watch, wallType=code_block_12.out1, locationLine=code_block_22.out0, flip=code_block_22.out1, lacing=Longest)
# note: Generate party walls
flatten_10 = List.Flatten(list=byCurveAndLocation_2@@L3)
# note: Generate interior floors
byOutlineTypeAndLevel_2 = Floor.ByOutlineTypeAndLevel(outlineCurves=perimeterCurves, floorType=code_block_12.out3, level=getParameterValueByName)
list_create_4 = List.Create(item0=byOutlineTypeAndLevel_2)
transpose_3 = List.Transpose(lists=list_create_4)
list_create_5 = List.Create(item0=flatten_10, item1=transpose_3)
transpose_4 = List.Transpose(lists=list_create_5)
flatten_11 = List.Flatten(list=transpose_4@L3, amt=code_block_18)
fromElements_2 = Custom[Group.FromElements](elements=flatten_11@L2, groupName=code_block_19.out1)
string = StringInput("C:\Users\")
userName = Python()  # "System.UserName"; unwired: IN[0]
# ---------- userName.python (3 lines) ----------
import clr
from System import Environment
OUT = Environment.UserName
# ----------------------------------------
string_2 = StringInput("\Desktop\Capacity-GroupsToLevels.csv")
code_block_23 = CodeBlock(part1=string, currentuser=userName, part2=string_2) { part1+currentuser+part2; }
watch_2 = Watch(code_block_23)
removeItemAtIndex_2 = List.RemoveItemAtIndex(list=groups@@L2, indices=code_block)
code_block_24 = CodeBlock { "Reference Level"; }
getParameterValueByName_3 = Element.GetParameterValueByName(element=removeItemAtIndex_2, parameterName=code_block_24)
name_4 = Element.Name(element=getParameterValueByName_3)
transpose_5 = List.Transpose(lists=name_4)
removeNulls_2 = Lists.Manage.RemoveNulls(Data=transpose_5)
code_block_25 = CodeBlock { "0"; "zero"; }
replace = String.Replace(str=removeNulls_2.Cleaned, searchFor=code_block_25.out0, replaceWith=code_block_25.out1)
# note: Write temporary .csv file with list of levels
writeToCSV = Custom[File.WriteToCSV](path=watch_2, data=replace)
members_2 = Custom[Group.Members](group=groups)
flatten_12 = List.Flatten(list=members_2)
geometry_2 = Element.Geometry(element=flatten_12)
string_from_object_2 = FromObject(obj=geometry_2)
code_block_26 = CodeBlock { "Solid"; }
eq_3 = string_from_object_2 == code_block_26
filterByBoolMask_3 = List.FilterByBoolMask(list=geometry_2, mask=eq_3)
count_2 = List.Count(list=filterByBoolMask_3.in@@L2)
code_block_27 = CodeBlock { 3; }
eq_4 = count_2 == code_block_27
filterByBoolMask_4 = List.FilterByBoolMask(list=filterByBoolMask_3.in, mask=eq_4)
area_2 = Solid.Area()  # unwired: solid
sortByFunction_2 = List.SortByFunction(list=filterByBoolMask_4.in@@L2, func=area_2)
code_block_28 = CodeBlock { [0]; }
removeItemAtIndex_3 = List.RemoveItemAtIndex(list=sortByFunction_2@@L2, indices=code_block_28)
code_block_29 = CodeBlock { 1; }
flatten_13 = List.Flatten(list=removeItemAtIndex_3@L3, amt=code_block_29)
code_block_30 = CodeBlock { 3; }
flatten_14 = List.Flatten(list=filterByBoolMask_4.out@L3, amt=code_block_30)
list_create_6 = List.Create(item0=flatten_13, item1=flatten_14)
flatten_15 = List.Flatten(list=list_create_6)
byUnion_3 = Solid.ByUnion(solids=flatten_15)
bySolid_3 = PolySurface.BySolid(solid=byUnion_3)
surfaces_3 = PolySurface.Surfaces(polySurface=bySolid_3)
filterByOrientation_3 = Custom[Surface.FilterByOrientation](surfaces=surfaces_3)
area_3 = Surface.Area(surface=filterByOrientation_3.horizontalUp)
code_block_31 = CodeBlock { 15000000; }
gt = area_3 > code_block_31
filterByBoolMask_5 = List.FilterByBoolMask(list=filterByOrientation_3.horizontalUp, mask=gt)
perimeterCurves_3 = Surface.PerimeterCurves(surface=filterByBoolMask_5.in)
code_block_32 = CodeBlock { "Levels"; }
byName = Category.ByName(name=code_block_32)
all_elements_of_category = ElementsOfCategory(Category=byName)
elevation = Level.Elevation(level=all_elements_of_category)
startPoint = Curve.StartPoint(curve=perimeterCurves_3)
Z = Point.Z(point=startPoint)
flatten_16 = List.Flatten(list=Z)
uniqueItems_3 = List.UniqueItems(list=flatten_16)
eq_5 = elevation@@L1 == uniqueItems_3
code_block_33 = CodeBlock { false; }
eq_6 = _ == code_block_33  # unwired: x
trueForAll = List.TrueForAll(list=eq_5@L2, predicate=eq_6)
list_filterbyboolmask_corectly = List.FilterByBoolMask(list=all_elements_of_category, mask=trueForAll)  # "List.FilterByBoolMask-Corectly/Incorrectly named views"
byOutlineTypeAndLevel_3 = Floor.ByOutlineTypeAndLevel(outlineCurves=perimeterCurves_3, floorType=code_block_12.out3, level=list_filterbyboolmask_corectly.out)

# group: Usage
code_block_34 = CodeBlock { "Generate Main Groups"; }
acg_script_usage = Custom[ACG Script Usage](scriptName=code_block_34)  # Adds an entry to Excel document every time a script is run. The document is located in S:\Dynamo\05-UsageStats
