# Dynamo graph Generate Main Groups.dyn (Dynamo 2.6.1.8786)
# packages: bimorphNodes 3.0.3, LunchBox for Dynamo 2016.11.11, Data-Shapes 2021.2.92, WombatDynamo 2.3.0, archi-lab.net 2021.25.2521, Genius Loci 2021.2.3, Orchid 260.1.0.7729

# group: Input
# note: 1.Purge the model. Make sure the typical floor grous are the only model groups left.
# 2.Open the script and define inputs.
# 3.Run the "Generate group types" part of the script (Input group).
# 4.Use "Open Rescent" to re-open the same script. The script needs to be refreshed (save when asked).
# 5.Run the "Place group instances to levels" part of the script (Input group).
# note: The script needs to generate small .csv file with list of levels on which each typical floor group exists. That file can be deleted after running the second part of the script.

code_block = CodeBlock { catMG=Revit.Category.ByName("Model Groups"); ElementQueries.OfCategory(catMG); }
type = archilab.Revit.Elements.Elements.Type()  # unwired: element
groupByFunction = List.GroupByFunction(list=code_block.out1, func=type)
groupMembers = Custom[GroupMembers](group=groupByFunction)  # Get all memebers of a group instance
flatten = List.Flatten(list=groupMembers)
geometry = Element.Geometry(element=flatten)
# note: Extract the geometry from the unit families
string_from_object = FromObject(obj=geometry)
code_block_2 = CodeBlock { "Solid"; }
eq = string_from_object == code_block_2
filterByBoolMask = List.FilterByBoolMask(list=geometry, mask=eq)
count = List.Count(list=filterByBoolMask.in@@L2)
code_block_3 = CodeBlock { 3; }
eq_2 = count == code_block_3
filterByBoolMask_2 = List.FilterByBoolMask(list=filterByBoolMask.in, mask=eq_2)
area = Solid.Area()  # unwired: solid
sortByFunction = List.SortByFunction(list=filterByBoolMask_2.in@@L2, func=area)
code_block_4 = CodeBlock { [0]; }
# note: Exclude the balcony solids
removeItemAtIndex = List.RemoveItemAtIndex(list=sortByFunction@@L2, indices=code_block_4)
code_block_5 = CodeBlock { 1; }
flatten_2 = List.Flatten(list=removeItemAtIndex@L3, amt=code_block_5)
code_block_6 = CodeBlock { 3; }
flatten_3 = List.Flatten(list=filterByBoolMask_2.out@L3, amt=code_block_6)
list_create = List.Create(item0=flatten_2, item1=flatten_3)
flatten_4 = List.Flatten(list=list_create)
byUnion = Solid.ByUnion(solids=flatten_4)
bySolid = PolySurface.BySolid(solid=byUnion)
surfaces = PolySurface.Surfaces(polySurface=bySolid)
acg_surface_filterbyorientation = Custom[ACG Surface.FilterByOrientation](surfaces=surfaces)  # from Clockwork for Dynamo 2.x
area_2 = Surface.Area(surface=acg_surface_filterbyorientation.HorizontalUp)
code_block_7 = CodeBlock { 15000000; }
gt = area_2 > code_block_7
filterByBoolMask_3 = List.FilterByBoolMask(list=acg_surface_filterbyorientation.HorizontalUp, mask=gt)
perimeterCurves = Surface.PerimeterCurves(surface=filterByBoolMask_3.in)
file_path = Filename("..\ACG_logo.png")
file_from_path = FileObject(path=file_path)
readFromFile = Image.ReadFromFile(file=file_from_path)
code_block_8 = CodeBlock { "Cancel"; true; "Generate"; 600; 300; }
code_block_9 = CodeBlock { "Select external wall type"; "Select party wall type"; "Select internal floor type"; "Select external floor type"; }
code_block_10 = CodeBlock()
# ---------- code_block_10.designscript (5 lines) ----------
catWalls=Revit.Category.ByName("Walls");
ElementQueries.OfCategory(catWalls);

catFloors=Revit.Category.ByName("Floors");
ElementQueries.OfCategory(catFloors);
# ----------------------------------------

# group: collect all wall types
getType = WombatDynamo.Element.GetType(element=code_block_10.out1)
uniqueItems = List.UniqueItems(list=getType)
name = Element.Name(element=uniqueItems)
ui_dropdown_data = Custom[UI.DropDown Data](InputName=code_block_9.out0, Keys=name, Values=uniqueItems)  # package Data-Shapes; Create data for DropDown input in UI.MultiInputForm ++ . Check out www.data-shapes.net for more infos.
ui_dropdown_data_2 = Custom[UI.DropDown Data](InputName=code_block_9.out1, Keys=name, Values=uniqueItems)

# group: collect all floor types
getType_2 = WombatDynamo.Element.GetType(element=code_block_10.out3)
uniqueItems_2 = List.UniqueItems(list=getType_2)
name_2 = Element.Name(element=uniqueItems_2)
ui_dropdown_data_3 = Custom[UI.DropDown Data](InputName=code_block_9.out2, Keys=name_2, Values=uniqueItems_2)
ui_dropdown_data_4 = Custom[UI.DropDown Data](InputName=code_block_9.out3, Keys=name_2, Values=uniqueItems_2)

code_block_11 = CodeBlock { "Enter floor height"; 2700; 4500; 3075; 75; }
slider = Custom[UI.Slider](InputName=code_block_11.out0, Minimum=code_block_11.out1, Maximum=code_block_11.out2, Default_Value=code_block_11.out3, Step=code_block_11.out4)  # package Data-Shapes; Creates slider input for UI.MultipleInputForm ++ . Set the step to decimal value if you want a double slider, or to a integer value if you want an integer slider.
list_create_2 = List.Create(item0=ui_dropdown_data, item1=ui_dropdown_data_2, item2=ui_dropdown_data_3, item3=ui_dropdown_data_4, item4=slider)
flatten_5 = List.Flatten(list=list_create_2)
ui_multipleinputform = Custom[UI.MultipleInputForm ++](Logo_optional=readFromFile, ButtonText_optional=code_block_8.out2, Inputs=flatten_5, Toggle=code_block_8.out1, CancelButtonText_optional=code_block_8.out0, Width_optional=code_block_8.out3, LabelWidth_optional=code_block_8.out4)  # package Data-Shapes; Create a form with multiple inputs. see www.data-shapes.net for tutorials and infos!
code_block_12 = CodeBlock(extwall=ui_multipleinputform.User_Inputs, intwall=ui_multipleinputform.User_Inputs, extfloor=ui_multipleinputform.User_Inputs, intfloor=ui_multipleinputform.User_Inputs, height=ui_multipleinputform.User_Inputs) { extwall[0]; intwall[1]; extfloor[2]; intfloor[3]; height[4]; }
code_block_13 = CodeBlock { "Levels"; }
byName = Category.ByName(name=code_block_13)
all_elements_of_category = ElementsOfCategory(Category=byName)
elevation = Level.Elevation(level=all_elements_of_category)
startPoint = Curve.StartPoint(curve=perimeterCurves)
Z = Point.Z(point=startPoint)
flatten_6 = List.Flatten(list=Z)
uniqueItems_3 = List.UniqueItems(list=flatten_6)
eq_3 = elevation@@L1 == uniqueItems_3
code_block_14 = CodeBlock { false; }
eq_4 = _ == code_block_14  # unwired: x
trueForAll = List.TrueForAll(list=eq_3@L2, predicate=eq_4)
list_filterbyboolmask_corectly = List.FilterByBoolMask(list=all_elements_of_category, mask=trueForAll)  # "List.FilterByBoolMask-Corectly/Incorrectly named views"
# note: Generate interior floors
byOutlineTypeAndLevel = Floor.ByOutlineTypeAndLevel(outlineCurves=perimeterCurves, floorType=code_block_12.out3, level=list_filterbyboolmask_corectly.out)

# group: Usage
code_block_15 = CodeBlock { "Generate Main Groups"; }
acg_script_usage = Custom[ACG Script Usage](scriptName=code_block_15)  # Adds an entry to Excel document every time a script is run. The document is located in S:\Dynamo\05-UsageStats

code_block_16 = CodeBlock { 0; }
getItemAtIndex = List.GetItemAtIndex(list=groupByFunction@@L2, index=code_block_16)
# note: Collect model groups and their elements.
name_3 = Element.Name(element=getItemAtIndex)
code_block_17 = CodeBlock(groupname=name_3) { groupname+"_ExternalWalls"; groupname+"_PartyWalls"; }
string = StringInput("C:\Users\")
userName = Python()  # "System.UserName"; unwired: IN[0]
# ---------- userName.python (3 lines) ----------
import clr
from System import Environment
OUT = Environment.UserName
# ----------------------------------------
string_2 = StringInput("\Desktop\Capacity-GroupsToLevels_Ext.csv")
string_3 = StringInput("\Desktop\Capacity-GroupsToLevels_Int.csv")
code_block_18 = CodeBlock(part1=string, currentuser=userName, part2Ext=string_2, part2Int=string_3) { part1+currentuser+part2Ext; part1+currentuser+part2Int; }
code_block_19 = CodeBlock { "-4510-"; "-2510-Ext_"; "-2510-Int_"; }
replace = String.Replace(str=name_3, searchFor=code_block_19.out0, replaceWith=code_block_19.out2)
code_block_20 = CodeBlock { "Reference Level"; }
# note: Floors that will be generated
getParameterValueByName = Element.GetParameterValueByName(element=getItemAtIndex@@L1, parameterName=code_block_20)
code_block_21 = CodeBlock(groups=getParameterValueByName) { count=DSCore.List.Count(groups); "Group "+(1..count); "Group "+(count+(1..count)); }
removeItemAtIndex_2 = List.RemoveItemAtIndex(list=groupByFunction@@L2, indices=code_block_16)
# note: Floors that will be copied/pasted
getParameterValueByName_2 = Element.GetParameterValueByName(element=removeItemAtIndex_2, parameterName=code_block_20)
name_4 = Element.Name(element=getParameterValueByName_2)
addItemToFront = List.AddItemToFront(item=code_block_21.out2@@L1, list=name_4@L2)
addItemToEnd = List.AddItemToEnd(item=replace@@L1, list=addItemToFront@L2)
code_block_22 = CodeBlock { "0"; "zero"; }
replace_2 = String.Replace(str=addItemToEnd, searchFor=code_block_22.out0, replaceWith=code_block_22.out1)
# note: Write temporary .csv file with list of levels Internal
exportCSV = Data.ExportCSV(filePath=code_block_18.out1, data=replace_2)
groupMembers_2 = Custom[GroupMembers](group=getItemAtIndex@@L2)

# group: Filtering
getCategory = Element.GetCategory(element=groupMembers_2)
string_from_object_2 = FromObject(obj=getCategory)
code_block_23 = CodeBlock { "Generic Models"; }
# note: Filter just generic models
eq_5 = string_from_object_2 == code_block_23
filterByBoolMask_4 = List.FilterByBoolMask(list=groupMembers_2, mask=eq_5)

geometry_2 = Element.Geometry(element=filterByBoolMask_4.in)
string_from_object_3 = FromObject(obj=geometry_2)
code_block_24 = CodeBlock { "Solid"; }
eq_6 = string_from_object_3 == code_block_24
filterByBoolMask_5 = List.FilterByBoolMask(list=geometry_2, mask=eq_6)
flatten_7 = List.Flatten(list=filterByBoolMask_5.out@L3)
length = Curve.Length(curve=flatten_7)
sortByKey = List.SortByKey(list=flatten_7@L2, keys=length@@L2)
removeDuplicates = Curve.RemoveDuplicates(curves=sortByKey.sorted_list)
code_block_25 = CodeBlock { "Default Thickness"; }
getParameterValueByName_3 = Element.GetParameterValueByName(element=code_block_12.out3, parameterName=code_block_25)
code_block_26 = CodeBlock(height=code_block_12.out4, slabthickness=getParameterValueByName_3) { (height-slabthickness); }
watch = Watch(getParameterValueByName)
wall_location = WallLocation("WallCenterline")
code_block_27 = CodeBlock { false; }
# note: Generate party walls
wall_bycurveandlevel = Custom[Wall ByCurveAndLevel](curve=removeDuplicates.cleanedCurves@@L2, Height=code_block_26, level=watch, wallType=code_block_12.out1, WallLocation=wall_location, Flip=code_block_27, IsStructural=code_block_27, lacing=Longest)  # package Genius Loci; Creates a wall using the specified guiding curve and level.
count_2 = List.Count(list=filterByBoolMask_5.in@@L2)
code_block_28 = CodeBlock { 3; }
eq_7 = count_2 == code_block_28
filterByBoolMask_6 = List.FilterByBoolMask(list=filterByBoolMask_5.in, mask=eq_7)
area_3 = Solid.Area()  # unwired: solid
sortByFunction_2 = List.SortByFunction(list=filterByBoolMask_6.in@@L2, func=area_3)
code_block_29 = CodeBlock { [0]; }
removeItemAtIndex_3 = List.RemoveItemAtIndex(list=sortByFunction_2@@L2, indices=code_block_29)
code_block_30 = CodeBlock { 1; }
flatten_8 = List.Flatten(list=removeItemAtIndex_3@L3, amt=code_block_30)
# note: Split Residential/Non-Residential units
code_block_31 = CodeBlock { 3; }
flatten_9 = List.Flatten(list=filterByBoolMask_6.out@L3, amt=code_block_31)
list_create_3 = List.Create(item0=flatten_8, item1=flatten_9)
transpose = List.Transpose(lists=list_create_3)
code_block_32 = CodeBlock { 1; }
flatten_10 = List.Flatten(list=transpose@L3, amt=code_block_32)
removeNulls = Lists.Manage.RemoveNulls(Data=flatten_10)
byUnion_2 = Solid.ByUnion(solids=removeNulls.Cleaned)
bySolid_2 = PolySurface.BySolid(solid=byUnion_2)
surfaces_2 = PolySurface.Surfaces(polySurface=bySolid_2)
acg_surface_filterbyorientation_2 = Custom[ACG Surface.FilterByOrientation](surfaces=surfaces_2)
flatten_11 = List.Flatten(list=acg_surface_filterbyorientation_2.horizontalDown)
perimeterCurves_2 = Surface.PerimeterCurves(surface=flatten_11)
byOutlineTypeAndLevel_2 = Floor.ByOutlineTypeAndLevel(outlineCurves=perimeterCurves_2, floorType=code_block_12.out3, level=getParameterValueByName)
list_create_4 = List.Create(item0=byOutlineTypeAndLevel_2)
transpose_2 = List.Transpose(lists=list_create_4)
list_create_5 = List.Create(item0=wall_bycurveandlevel, item1=transpose_2)
transpose_3 = List.Transpose(lists=list_create_5)
code_block_33 = CodeBlock { 1; }
flatten_12 = List.Flatten(list=transpose_3@L3, amt=code_block_33)
code_block_34 = CodeBlock(height=code_block_12.out4) { height; true; false; "Location Line"; 2; }
wall_location_2 = WallLocation("FinishFaceInterior")
wall_bycurveandlevel_2 = Custom[Wall ByCurveAndLevel](curve=perimeterCurves_2@@L2, Height=code_block_34.height, level=getParameterValueByName, wallType=code_block_12.out0, WallLocation=wall_location_2, Flip=code_block_34.out1, IsStructural=code_block_34.out2, lacing=Longest)
# note: Generate external wals
setParameterByName = Element.SetParameterByName(element=wall_bycurveandlevel_2, parameterName=code_block_34.out3, value=code_block_34.out4)
getItemAtIndex_2 = List.GetItemAtIndex(list=sortByFunction_2@@L2, index=code_block_29)
code_block_35 = CodeBlock { 1; }
flatten_13 = List.Flatten(list=getItemAtIndex_2@L3, amt=code_block_35)
byUnion_3 = Solid.ByUnion(solids=flatten_13)
bySolid_3 = PolySurface.BySolid(solid=byUnion_3)
surfaces_3 = PolySurface.Surfaces(polySurface=bySolid_3)
acg_surface_filterbyorientation_3 = Custom[ACG Surface.FilterByOrientation](surfaces=surfaces_3)
perimeterCurves_3 = Surface.PerimeterCurves(surface=acg_surface_filterbyorientation_3.horizontalDown)
count_3 = List.Count(list=perimeterCurves_3@@L3)
ofRepeatedItem = List.OfRepeatedItem(item=getParameterValueByName@L1, amount=count_3@L1)
# note: Generate balcony floors
byOutlineTypeAndLevel_3 = Floor.ByOutlineTypeAndLevel(outlineCurves=perimeterCurves_3@@L2, floorType=code_block_12.out2, level=ofRepeatedItem@L1)
list_create_6 = List.Create(item0=setParameterByName, item1=byOutlineTypeAndLevel_3)
transpose_4 = List.Transpose(lists=list_create_6)
list_clean = Custom[List Clean](list=transpose_4)  # package Genius Loci; Removes all Null, Empty and Blank from a list or nested list of lists.
flatten_14 = List.Flatten()  # unwired: list
map = List.Map(list=list_clean, f_x=flatten_14)
replace_3 = String.Replace(str=name_3, searchFor=code_block_19.out0, replaceWith=code_block_19.out1)
# note: Group the newly generated elements (External)
fromElements = Custom[FromElements](elements=map@@L2, groupName=replace_3)  # Creates a model group from a list of elements
await_ = Orchid.Common.DataStream.Await(pass=flatten_12, waitFor=fromElements.group)
# note: Group the newly generated elements
fromElements_2 = Custom[FromElements](elements=await_@@L2, groupName=replace)
addItemToFront_2 = List.AddItemToFront(item=code_block_21.out1@@L1, list=name_4@L2)
addItemToEnd_2 = List.AddItemToEnd(item=replace_3@@L1, list=addItemToFront_2@L2)
code_block_36 = CodeBlock { "0"; "zero"; }
replace_4 = String.Replace(str=addItemToEnd_2, searchFor=code_block_36.out0, replaceWith=code_block_36.out1)
# note: Write temporary .csv file with list of levels External
exportCSV_2 = Data.ExportCSV(filePath=code_block_18.out0, data=replace_4)
code_block_37 = CodeBlock { "Level"; }
getParameterValueByName_4 = Element.GetParameterValueByName(element=byOutlineTypeAndLevel_3, parameterName=code_block_37)
list_create_7 = List.Create(item0=getParameterValueByName)
transpose_5 = List.Transpose(lists=list_create_7)
