# Dynamo graph Place Groups on Levels.dyn (Dynamo 2.6.1.8786)
# packages: BVN 1.6.1, WombatDynamo 2.3.0, LunchBox for Dynamo 2016.11.11, spring nodes 110.0.2, SteamNodes 1.2.3, Genius Loci 2021.2.3, archi-lab.net 2021.25.2521

# group: Usage
code_block = CodeBlock { "Place Groups on Levels"; }
acg_script_usage = Custom[ACG Script Usage](scriptName=code_block)  # Adds an entry to Excel document every time a script is run. The document is located in S:\Dynamo\05-UsageStats

string = StringInput("C:\Users\")
userName = Python()  # "System.UserName"; unwired: IN[0]
# ---------- userName.python (3 lines) ----------
import clr
from System import Environment
OUT = Environment.UserName
# ----------------------------------------
string_2 = StringInput("\Desktop\Capacity-GroupsToLevels_Ext.csv")
string_3 = StringInput("\Desktop\Capacity-GroupsToLevels_Int.csv")
code_block_2 = CodeBlock(part1=string, currentuser=userName, part2Ext=string_2, part2Int=string_3) { part1+currentuser+part2Ext; part1+currentuser+part2Int; true; }
importCSV = Data.ImportCSV(filePath=code_block_2.out1, transpose=code_block_2.out2)
removeNulls = Lists.Manage.RemoveNulls(Data=importCSV)
code_block_3 = CodeBlock { "zero"; "0"; }
# note: Interior data
replace = String.Replace(str=removeNulls.Cleaned, searchFor=code_block_3.out0, replaceWith=code_block_3.out1)

# group: Assing
dropFirstLast = Custom[Springs.List.DropFirstLast](list=replace@@L2)  # package spring nodes; Removes the first and last items from the list
# note: original group names
firstItem = List.FirstItem(list=dropFirstLast.F_L@@L2)
byName = WombatDynamo.Level.ByName(name=dropFirstLast.list)
# note: new group names
lastItem = List.LastItem(list=dropFirstLast.F_L@L2)

# group: Filtering
code_block_4 = CodeBlock { element; }  # unwired: element
code_block_5 = CodeBlock { level; }  # unwired: level
code_block_6 = CodeBlock { 0; }
code_block_7 = CodeBlock { 1; }

list_create = List.Create(item0=code_block_4)
flatten = List.Flatten(list=list_create)

# group (continued): Filtering
firstItem_2 = List.FirstItem(list=flatten)

element_level = Custom[Element Level](element=firstItem_2)  # package Genius Loci; Gets an element's level. Based on a Clockwork's node

# group (continued): Filtering
views = Custom[Level.Views](level=element_level)

byName_2 = WombatDynamo.Level.ByName(name=code_block_5)

# group (continued): Filtering
views_2 = Custom[Level.Views](level=byName_2)
python_script = Python(IN[0]=flatten, IN[1]=views.firstView, IN[2]=views_2.firstView)
# ---------- python_script.python (35 lines) ----------
import clr
from System.Collections.Generic import *
clr.AddReference('RevitAPI')
from Autodesk.Revit.DB import *
import Autodesk

clr.AddReference("RevitNodes")
import Revit
clr.ImportExtensions(Revit.Elements)

clr.AddReference("RevitServices")
import RevitServices
from RevitServices.Persistence import DocumentManager
from RevitServices.Transactions import TransactionManager

doc = DocumentManager.Instance.CurrentDBDocument
wrapped = IN[0]
items = UnwrapElement(wrapped)
source_view = UnwrapElement(IN[1])
target_view = UnwrapElement(IN[2])

ids = list()
for item in items:
	ids.append(item.Id)	
itemlist = List[ElementId](ids)

TransactionManager.Instance.EnsureInTransaction(doc)
newitems = ElementTransformUtils.CopyElements(source_view,itemlist,target_view, None, None)
TransactionManager.Instance.TransactionTaskDone()

elementlist = list()
for item in newitems:
	elementlist.append(doc.GetElement(item).ToDSType(False))

OUT = elementlist, wrapped
# ----------------------------------------
getItemAtIndex = List.GetItemAtIndex(list=python_script, index=code_block_6)
code_block_8 = CodeBlock(newElements=getItemAtIndex) { newElements; }
getItemAtIndex_2 = List.GetItemAtIndex(list=python_script, index=code_block_7)
eraser = Custom[Tool.Eraser](Elements=getItemAtIndex_2)  # package SteamNodes; Try to delete any element from project
code_block_9 = CodeBlock(cantDelete=eraser) { cantDelete; }

typeCollector = Custom[ModelGroup.TypeCollector]()  # package BVN; Returns all the types (not instances) from all model groups in the project
name = Element.Name(element=typeCollector)
code_block_10 = CodeBlock { "Group "; }
startsWith = String.StartsWith(str=name, searchFor=code_block_10)
filterByBoolMask = List.FilterByBoolMask(list=typeCollector, mask=startsWith)
name_2 = Element.Name(element=filterByBoolMask.in)
count = List.Count(list=name_2)
code_block_11 = CodeBlock(count=count) { count/2; }
split = Custom[Springs.List.Split](list=filterByBoolMask.in, amount=code_block_11)  # package spring nodes; Splits a list at the desired length
# note: Exterior
acg_grouptype_groups = Custom[ACG GroupType.Groups](groupType=split.list2)  # Collects all instances of a group type

# group: Processing
elementCopyToLevel = Custom[ElementCopyToLevel](element=acg_grouptype_groups@@L2, level=byName@L2)
type = archilab.Revit.Elements.Elements.Type(element=acg_grouptype_groups)
acg_element_setname = Custom[ACG Element.SetName](element=type@L2, name=lastItem@@L1)

importCSV_2 = Data.ImportCSV(filePath=code_block_2.out0, transpose=code_block_2.out2)
removeNulls_2 = Lists.Manage.RemoveNulls(Data=importCSV_2)
# note: Exterior data
replace_2 = String.Replace(str=removeNulls_2.Cleaned, searchFor=code_block_3.out0, replaceWith=code_block_3.out1)

# group: Assing
dropFirstLast_2 = Custom[Springs.List.DropFirstLast](list=replace_2@@L2)
# note: original group names
firstItem_3 = List.FirstItem(list=dropFirstLast_2.F_L@@L2)
byName_3 = WombatDynamo.Level.ByName(name=dropFirstLast_2.list)
# note: new group names
lastItem_2 = List.LastItem(list=dropFirstLast_2.F_L@L2)

# note: Interior
acg_grouptype_groups_2 = Custom[ACG GroupType.Groups](groupType=split.list1)

# group: Processing
elementCopyToLevel_2 = Custom[ElementCopyToLevel](element=acg_grouptype_groups_2@@L2, level=byName_3@L2)
type_2 = archilab.Revit.Elements.Elements.Type(element=acg_grouptype_groups_2)
acg_element_setname_2 = Custom[ACG Element.SetName](element=type_2@L2, name=lastItem_2@@L1)
