# Dynamo graph Schedule Mixed Use.dyn (Dynamo 2.12.0.5650)
# packages: archi-lab.net 2021.25.2521, Data-Shapes 2021.2.92, SteamNodes 1.2.3, Rhythm 2021.1.1, Orchid 260.1.0.7729

# group: THIS OR THAT
# note: THIS OR THAT

# group: THIS OR THAT
# note: THIS OR THAT

file_path = Filename("..\ACGLogo.jpg")
file_from_path = FileObject(path=file_path)
readFromFile = Image.ReadFromFile(file=file_from_path)
code_block = CodeBlock { "Select Schedule Element"; "Cancel"; 700; 350; }
code_block_2 = CodeBlock()
# ---------- code_block_2.designscript (3 lines) ----------
"Note:";

"Please fill in the required input, click Select Schedule Element button and make a selection in the active sheet.";
# ----------------------------------------
textnote_data = Custom[TextNote Data](Title=code_block_2.out0, TextNote=code_block_2.out1)  # package Data-Shapes; Create Data for TextNote input in UI.MultipleInputForm ++ . Check out www.data-shapes.net for more informations
code_block_3 = CodeBlock { "Select a Design Option"; }
get_design_options = Custom[Get Design Options]()  # package archi-lab.net; Queries all of the design options currently in the project.

# group: Processing
code_block_4 = CodeBlock { "Design Option Set Id"; }
# note: get design option's set
getParameterValueByName = Element.GetParameterValueByName(element=get_design_options.designOptions, parameterName=code_block_4)
name = Element.Name(element=getParameterValueByName)

code_block_5 = CodeBlock(designOption=get_design_options.designOptions, set=name, name=get_design_options.names) { designOption; DOname=set+" - "+name; }
ui_dropdown_data = Custom[UI.DropDown Data](InputName=code_block_3, Keys=code_block_5.DOname, Values=code_block_5.designOption)  # package Data-Shapes; Create data for DropDown input in UI.MultiInputForm ++ . Check out www.data-shapes.net for more infos.
code_block_6 = CodeBlock { "Common Property Lines for Design Options?"; true; }
ui_boolean_input = Custom[UI.Boolean input](InputName=code_block_6.out0, DefaultValue=code_block_6.out1)  # package Data-Shapes; Creates a boolean input for UI.MultipleInputForm ++ . Check out www.data-shapes.net for more infos!
code_block_7 = CodeBlock { "Calculate GIA from floors?"; false; }
ui_boolean_input_2 = Custom[UI.Boolean input](InputName=code_block_7.out0, DefaultValue=code_block_7.out1)
list_create = List.Create(item0=textnote_data, item1=ui_dropdown_data, item2=ui_boolean_input, item3=ui_boolean_input_2)
ui_multipleinputform = Custom[UI.MultipleInputForm ++](Logo_optional=readFromFile, ButtonText_optional=code_block.out0, Inputs=list_create, Toggle=code_block_6.out1, CancelButtonText_optional=code_block.out1, Width_optional=code_block.out2, LabelWidth_optional=code_block.out3)  # package Data-Shapes; Create a form with multiple inputs. see www.data-shapes.net for tutorials and infos!

# group: Processing
code_block_8 = CodeBlock { true; }
end = Revit.Transaction.Transaction.End(input=ui_multipleinputform.User_Inputs)
await_ = Orchid.Common.DataStream.Await(pass=code_block_8, waitFor=end)
ʳʰʸᵗʰᵐ_selection_pick = Rhythm.Revit.Selection.Selection.Pick(runIt=await_, singleSelection=await_)
end_2 = Revit.Transaction.Transaction.End(input=ʳʰʸᵗʰᵐ_selection_pick)

code_block_9 = CodeBlock(scheduleElement=end_2) { scheduleElement; }
watch = Watch(code_block_9)
code_block_10 = CodeBlock { Revit.Elements.Category.ByName("Generic Models"); Revit.Elements.Category.ByName("Parking"); }
# note: Collect all unit elements from Design option
byCategoryAndDesignOption = archilab.Revit.Selection.Select.ByCategoryAndDesignOption(category=code_block_10.out0, designOption=watch)
flatten = List.Flatten(list=byCategoryAndDesignOption)
watch_2 = Watch(flatten)
getFamily = FamilyInstance.GetFamily(familyInstance=watch_2)
string_from_object = FromObject(obj=getFamily)
code_block_11 = CodeBlock { "Family: ACG-4510-ResidentialUnit-"; }
# note: Filter only residential units
startsWith = String.StartsWith(string=string_from_object, searchFor=code_block_11)
filterByBoolMask = List.FilterByBoolMask(list=watch_2, mask=startsWith)
code_block_12 = CodeBlock { "Tenure"; }
getParameterValueByName_2 = Element.GetParameterValueByName(element=filterByBoolMask.out, parameterName=code_block_12)
# note: Make sure only Market & Affordable units are selected (only Circulation and Ancillary)
groupByKey = List.GroupByKey(list=filterByBoolMask.out, keys=getParameterValueByName_2)
code_block_13 = CodeBlock { "M"; "A"; "S"; }
startsWith_2 = String.StartsWith(string=groupByKey.uniqueKeys, searchFor=code_block_13.out0)
filterByBoolMask_2 = List.FilterByBoolMask(list=groupByKey.groups, mask=startsWith_2)
flatten_2 = List.Flatten(list=filterByBoolMask_2.in)
startsWith_3 = String.StartsWith(string=groupByKey.uniqueKeys, searchFor=code_block_13.out1)
filterByBoolMask_3 = List.FilterByBoolMask(list=groupByKey.groups, mask=startsWith_3)
flatten_3 = List.Flatten(list=filterByBoolMask_3.in)
startsWith_4 = String.StartsWith(string=groupByKey.uniqueKeys, searchFor=code_block_13.out2)
filterByBoolMask_4 = List.FilterByBoolMask(list=groupByKey.groups, mask=startsWith_4)
flatten_4 = List.Flatten(list=filterByBoolMask_4.in)
list_create_2 = List.Create(item0=flatten_2, item1=flatten_3, item2=flatten_4)
flatten_5 = List.Flatten(list=list_create_2)
code_block_14 = CodeBlock { "Unit Type"; }
get_type_parameter = Custom[Get Type Parameter](element=flatten_5, parameterName=code_block_14)  # package archi-lab.net; This node will retrieve a type parameter by its name.
# note: Group units by type
groupByKey_2 = List.GroupByKey(list=flatten_5, keys=get_type_parameter)
code_block_15 = CodeBlock { "GIArea"; }
getParameterValueByName_3 = Element.GetParameterValueByName(element=groupByKey_2.groups@@L2, parameterName=code_block_15)
sum = Math.Sum(values=getParameterValueByName_3)

# group: Processing
code_block_16 = CodeBlock { "Tenure"; }
getParameterValueByName_4 = Element.GetParameterValueByName(element=filterByBoolMask.in, parameterName=code_block_16)
code_block_17 = CodeBlock { "Mark"; "0Mark"; "Afford"; "1Afford"; "Share"; "2Share"; "Ret"; "3Ret"; }
replace = String.Replace(string=getParameterValueByName_4, searchFor=code_block_17.out0, replaceWith=code_block_17.out1, lacing=Longest)
replace_2 = String.Replace(string=replace, searchFor=code_block_17.out2, replaceWith=code_block_17.out3)
replace_3 = String.Replace(string=replace_2, searchFor=code_block_17.out4, replaceWith=code_block_17.out5)
replace_4 = String.Replace(string=replace_3, searchFor=code_block_17.out6, replaceWith=code_block_17.out7)

# group: Processing
sortByKey = List.SortByKey(list=filterByBoolMask.in, keys=replace_4)
# note: Group units by tenure:
# Marker
# Affordable
# Shared
# Retirement
# ....rest
groupByKey_3 = List.GroupByKey(list=sortByKey.sortedList, keys=sortByKey.sortedKeys)
code_block_18 = CodeBlock { 0; 1; }
remove = String.Remove(string=groupByKey_3.uniqueKeys, startIndex=code_block_18.out0, count=code_block_18.out1)

flatten_6 = List.Flatten(list=groupByKey_3.groups)
getParameterValueByName_5 = Element.GetParameterValueByName(element=flatten_6, parameterName=code_block_15)
sum_2 = Math.Sum(values=getParameterValueByName_5)
list_create_3 = List.Create(item0=sum, item1=sum_2)
# note: Usage schedule
flatten_7 = List.Flatten(list=list_create_3)
code_block_19 = CodeBlock { 0; }
round = Math.Round(number=flatten_7, digits=code_block_19)
sum_3 = Math.Sum(values=round)
list_create_4 = List.Create(item0=round, item1=sum_3)
flatten_8 = List.Flatten(list=list_create_4)
count = List.Count(list=flatten_8)
code_block_20 = CodeBlock(count=count)
# ---------- code_block_20.designscript (15 lines) ----------
number=1..count;

"Resi-UseNIA"+number;
"Resi-Use"+number;

visible=1..count;
notVisible=count+1..10;

"Resi no Rows Use";

"Usage Vis Row "+visible;
"Usage Vis Row "+notVisible;

1;
0;
# ----------------------------------------
# note: Usage schedule - number of rows
setParameterByName = Element.SetParameterByName(element=watch, parameterName=code_block_20.out5, value=count)
setParameterByName_2 = Element.SetParameterByName(element=watch, parameterName=code_block_20.out6, value=code_block_20.out8)
setParameterByName_3 = Element.SetParameterByName(element=watch, parameterName=code_block_20.out7, value=code_block_20.out9)
code_block_21 = CodeBlock { "Use"; }
# note: Group unit elements by Use
get_type_parameter_2 = Custom[Get Type Parameter](element=watch_2, parameterName=code_block_21)
code_block_22 = CodeBlock { null; }
eq = get_type_parameter_2 == code_block_22
filterByBoolMask_5 = List.FilterByBoolMask(list=watch_2, mask=eq)
get_type_parameter_3 = Custom[Get Type Parameter](element=filterByBoolMask_5.out, parameterName=code_block_21)
groupByKey_4 = List.GroupByKey(list=filterByBoolMask_5.out, keys=get_type_parameter_3)
code_block_23 = CodeBlock { "Commercial"; "Hotel"; }
python_script_get_index_of = Python(IN[0]=groupByKey_4.uniqueKeys, IN[1]=code_block_23.out1)  # IronPython2
# ---------- python_script_get_index_of.python (10 lines) ----------
input = IN[0]
testvalue = IN[1]
output = []
a = 0
for i in input:
	if i == testvalue:
		output.append(a)
	a = a+1		
#Assign your output to the OUT variable.
OUT = output
# ----------------------------------------
getItemAtIndex = List.GetItemAtIndex(list=groupByKey_4.groups, index=python_script_get_index_of)
# note: Get Hotel Units
flatten_9 = List.Flatten(list=getItemAtIndex)
code_block_24 = CodeBlock { "Unit Type"; }
get_type_parameter_4 = Custom[Get Type Parameter](element=flatten_9, parameterName=code_block_24)
groupByKey_5 = List.GroupByKey(list=flatten_9, keys=get_type_parameter_4)
code_block_25 = CodeBlock { "Room"; true; "true"; }
# note: Calculate number of each room type and percentages.
contains = String.Contains(string=groupByKey_5.uniqueKeys, searchFor=code_block_25.out0, ignoreCase=code_block_25.out1)
string_from_object_2 = FromObject(obj=contains)
python_script_get_index_of_2 = Python(IN[0]=string_from_object_2, IN[1]=code_block_25.out2)  # IronPython2; same code as python_script_get_index_of
flatten_10 = List.Flatten(list=python_script_get_index_of_2)
getItemAtIndex_2 = List.GetItemAtIndex(list=groupByKey_5.uniqueKeys, index=flatten_10)
list_count_types_of_rooms = List.Count(list=getItemAtIndex_2)
code_block_26 = CodeBlock(count=list_count_types_of_rooms)
# ---------- code_block_26.designscript (11 lines) ----------
"Hotel-No.Rows-UnitTypes";

noRowsUnitTypes=count+1;
lstVisible=1..count+1;
lstNotVisible=count+2..5;

"Hotel-VisRow"+lstVisible;
"Hotel-VisRow"+lstNotVisible;

1;
0;
# ----------------------------------------
# note: Build base schedule - number of rows
setparameterbyname = Custom[SetParameterByName(TypeOrInstance)](element=watch, parameterName=code_block_26.out0, value=code_block_26.noRowsUnitTypes)
setParameterByName_4 = Element.SetParameterByName(element=watch, parameterName=code_block_26.out5, value=code_block_26.out7)
setParameterByName_5 = Element.SetParameterByName(element=watch, parameterName=code_block_26.out4, value=code_block_26.out6)
# note: Unit types (rooms - names, numbers and %)
code_block_27 = CodeBlock(count=list_count_types_of_rooms) { count; lst=1..(count+1); "Hotel-UnitType"+lst; "Hotel no Units"+lst; "Hotel-Percent"+lst; }
getItemAtIndex_3 = List.GetItemAtIndex(list=groupByKey_5.groups, index=flatten_10)
list_count_no_of_rooms = List.Count(list=getItemAtIndex_3@@L2)
sum_4 = Math.Sum(values=list_count_no_of_rooms)
code_block_28 = CodeBlock(count=list_count_no_of_rooms, total=sum_4) { count/total*100; }
string_from_object_3 = FromObject(obj=code_block_28)
code_block_29 = CodeBlock { "."; }
split = String.Split(string=string_from_object_3, separator0=code_block_29)
transpose = List.Transpose(lists=split)
code_block_30 = CodeBlock(x=transpose) { x[0]; }
code_block_31 = CodeBlock { "Total:"; ""; }
list_create_5 = List.Create(item0=code_block_30, item1=code_block_31.out1)
flatten_11 = List.Flatten(list=list_create_5)
setParameterByName_6 = Element.SetParameterByName(element=watch, parameterName=code_block_27.out4, value=flatten_11)
list_create_6 = List.Create(item0=list_count_no_of_rooms, item1=sum_4)
flatten_12 = List.Flatten(list=list_create_6)
string_from_object_4 = FromObject(obj=flatten_12)
code_block_32 = CodeBlock { "."; }
split_2 = String.Split(string=string_from_object_4, separator0=code_block_32)
transpose_2 = List.Transpose(lists=split_2)
code_block_33 = CodeBlock(x=transpose_2) { x[0]; }
flatten_13 = List.Flatten(list=code_block_33)
setParameterByName_7 = Element.SetParameterByName(element=watch, parameterName=code_block_27.out3, value=flatten_13)
list_create_7 = List.Create(item0=getItemAtIndex_2, item1=code_block_31.out0)
flatten_14 = List.Flatten(list=list_create_7)
setParameterByName_8 = Element.SetParameterByName(element=watch, parameterName=code_block_27.out2, value=flatten_14)
string_from_object_5 = FromObject(obj=flatten_8)
code_block_34 = CodeBlock { "."; }
split_3 = String.Split(string=string_from_object_5, separator0=code_block_34)
transpose_3 = List.Transpose(lists=split_3)
code_block_35 = CodeBlock(x=transpose_3) { x[0]; }
setParameterByName_9 = Element.SetParameterByName(element=watch, parameterName=code_block_20.out1, value=code_block_35)
code_block_36 = CodeBlock { "Residential Units"; "Total:"; "Riser"; }
list_create_8 = List.Create(item0=code_block_36.out0, item1=groupByKey_2.uniqueKeys, item2=code_block_36.out1)
flatten_15 = List.Flatten(list=list_create_8)
setParameterByName_10 = Element.SetParameterByName(element=watch, parameterName=code_block_20.out2, value=flatten_15)
code_block_37 = CodeBlock { "Project Name"; }
categories = Categories("OST_BridgeFoundationTags")
all_elements_of_category = ElementsOfCategory(Category=categories)
getParameterValueByName_6 = Element.GetParameterValueByName(element=all_elements_of_category, parameterName=code_block_37)
# note: Fill in Project name
setParameterByName_11 = Element.SetParameterByName(element=watch, parameterName=code_block_37, value=getParameterValueByName_6)
code_block_38 = CodeBlock { "Number parking spaces"; "Parking-Achieved"; "No. Required Parking Spaces"; "."; "Parking-Required"; }
byCategoryAndDesignOption_2 = archilab.Revit.Selection.Select.ByCategoryAndDesignOption(category=code_block_10.out1, designOption=watch)

# group: Filtering
code_block_39 = CodeBlock(e=byCategoryAndDesignOption_2) { tp=e.Type; tp.Name; "Car"; "Bike"; }
contains_2 = String.Contains(string=code_block_39.out1, searchFor=code_block_39.out2)
filterByBoolMask_6 = List.FilterByBoolMask(list=byCategoryAndDesignOption_2, mask=contains_2)
contains_3 = String.Contains(string=code_block_39.out1, searchFor=code_block_39.out3)
filterByBoolMask_7 = List.FilterByBoolMask(list=byCategoryAndDesignOption_2, mask=contains_3)

getParameterValueByName_7 = Element.GetParameterValueByName(element=filterByBoolMask_6.in, parameterName=code_block_38.out0)
code_block_40 = CodeBlock { ""; }
eq_2 = getParameterValueByName_7 == code_block_40
filterByBoolMask_8 = List.FilterByBoolMask(list=getParameterValueByName_7, mask=eq_2)
sum_5 = Math.Sum(values=filterByBoolMask_8.out)
string_from_object_6 = FromObject(obj=sum_5)
split_4 = String.Split(string=string_from_object_6, separator0=code_block_38.out3)
transpose_4 = List.Transpose(lists=split_4)
code_block_41 = CodeBlock(x=transpose_4) { x[0]; }
setParameterByName_12 = Element.SetParameterByName(element=watch, parameterName=code_block_38.out1, value=code_block_41)
type = archilab.Revit.Elements.Elements.Type(element=watch_2)
getParameterValueByName_8 = Element.GetParameterValueByName(element=type, parameterName=code_block_38.out2)
code_block_42 = CodeBlock { ""; }
eq_3 = getParameterValueByName_8 == code_block_42
filterByBoolMask_9 = List.FilterByBoolMask(list=getParameterValueByName_8, mask=eq_3)
sum_6 = Math.Sum(values=filterByBoolMask_9.out)
string_from_object_7 = FromObject(obj=sum_6)
split_5 = String.Split(string=string_from_object_7, separator0=code_block_38.out3)
transpose_5 = List.Transpose(lists=split_5)
code_block_43 = CodeBlock(x=transpose_5) { x[0]; }
setParameterByName_13 = Element.SetParameterByName(element=watch, parameterName=code_block_38.out4, value=code_block_43)
code_block_44 = CodeBlock()
# ---------- code_block_44.designscript (12 lines) ----------
["Resi Tenure1 - NIA",
"Resi Tenure2 - NIA",
"Resi Tenure3 - NIA",
"Resi Tenure Total - NIA",
"Resi Tenure1 - Unit no.",
"Resi Tenure2 - Unit no.",
"Resi Tenure3 - Unit no.",
"Resi Tenure Total - Unit no.",
"Resi Tenure1 - Mix",
"Resi Tenure2 - Mix",
"Resi Tenure3 - Mix",
"Resi Net To Gross"];
# ----------------------------------------
code_block_45 = CodeBlock { "NIArea"; }
getParameterValueByName_9 = Element.GetParameterValueByName(element=groupByKey_3.groups@@L2, parameterName=code_block_45)
math_sum_all_tenures = Math.Sum(values=getParameterValueByName_9)
string_from_object_8 = FromObject(obj=math_sum_all_tenures)
code_block_46 = CodeBlock(x=string_from_object_8) { x=="null"; 0; }
if_ = If(test=code_block_46.out0, true=code_block_46.out1, false=math_sum_all_tenures)
round_2 = Math.Round(number=if_)
sum_7 = Math.Sum(values=round_2)
count_2 = List.Count(list=groupByKey_3.groups@L2)
sum_8 = Math.Sum(values=count_2)
# note: Tenure schedule
sum_9 = Math.Sum(values=if_)
code_block_47 = CodeBlock(numTenure=if_, numTotal=sum_9) { numTenure/numTotal*100; }
round_3 = Math.Round(number=code_block_47)
list_create_9 = List.Create(item0=round_2, item1=sum_7, item2=count_2, item3=sum_8, item4=round_3)
flatten_16 = List.Flatten(list=list_create_9)
string_from_object_9 = FromObject(obj=flatten_16)
code_block_48 = CodeBlock { "."; }
split_6 = String.Split(string=string_from_object_9, separator0=code_block_48)
transpose_6 = List.Transpose(lists=split_6)
code_block_49 = CodeBlock(x=transpose_6) { x[0]; }
sum_10 = Math.Sum(values=if_)
code_block_50 = CodeBlock(NIA=sum_10, GIA=sum_3) { NIA/GIA; }
code_block_efficiency = CodeBlock { 3; "00"; }
round_4 = Math.Round(number=code_block_50, digits=code_block_efficiency.out0)
string_from_object_10 = FromObject(obj=round_4)
split_7 = String.Split(string=string_from_object_10, separator0=code_block_efficiency.out1)
code_block_51 = CodeBlock(lst=split_7) { DSCore.List.Flatten(lst); }
code_block_52 = CodeBlock(x=code_block_51) { x[0]; }
list_create_10 = List.Create(item0=code_block_49, item1=code_block_52)
flatten_17 = List.Flatten(list=list_create_10)
setParameterByName_14 = Element.SetParameterByName(element=watch, parameterName=code_block_44, value=flatten_17)
flatten_18 = List.Flatten(list=groupByKey_3.groups)
code_block_53 = CodeBlock { "Unit Type"; }
get_type_parameter_5 = Custom[Get Type Parameter](element=flatten_18, parameterName=code_block_53)
sortByKey_2 = List.SortByKey(list=flatten_18, keys=get_type_parameter_5)
get_type_parameter_6 = Custom[Get Type Parameter](element=sortByKey_2.sortedList, parameterName=code_block_53)
groupByKey_6 = List.GroupByKey(list=sortByKey_2.sortedList, keys=get_type_parameter_6)
list_count_unittypes = List.Count(list=groupByKey_6.uniqueKeys)
# note: Unit Types Table - Number of Rows
code_block_54 = CodeBlock(count=list_count_unittypes)
# ---------- code_block_54.designscript (9 lines) ----------
visible=1..count+1;
1;
notVisible=count+2..10;
0;
count+1;

"Resi no Rows Unit Types";
"Vis Row "+visible;
"Vis Row "+notVisible;
# ----------------------------------------
setParameterByName_15 = Element.SetParameterByName(element=watch, parameterName=code_block_54.out7, value=code_block_54.out3)
setParameterByName_16 = Element.SetParameterByName(element=watch, parameterName=code_block_54.out6, value=code_block_54.out1)
setParameterByName_17 = Element.SetParameterByName(element=watch, parameterName=code_block_54.out5, value=code_block_54.out4)
code_block_55 = CodeBlock(count=list_count_unittypes)
# ---------- code_block_55.designscript (12 lines) ----------
numUnits=1..count+1..1;

"Resi Tenure1 Percent Row"+numUnits;
"Resi Tenure1 no Row"+numUnits;

"Resi Tenure2 Percent Row"+numUnits;
"Resi Tenure2 no Row"+numUnits;

"Resi Tenure3 Percent Row"+numUnits;
"Resi Tenure3 no Row"+numUnits;

"Resi Unit Type"+numUnits;
# ----------------------------------------
code_block_56 = CodeBlock { "Total:"; }
list_create_11 = List.Create(item0=groupByKey_6.uniqueKeys, item1=code_block_56)
flatten_19 = List.Flatten(list=list_create_11)
element_setparameterbyname = Element.SetParameterByName(element=watch, parameterName=code_block_55.out7, value=flatten_19)  # "Element.SetParameterByName(Market Total Count)"
code_block_57 = CodeBlock { "Tenure"; }
getParameterValueByName_10 = Element.GetParameterValueByName(element=groupByKey_6.groups@@L2, parameterName=code_block_57)

# group: Visualisation
code_block_58 = CodeBlock(x=remove) { x[0]; x[1]; x[2]; }

eq_4 = getParameterValueByName_10@@L2 == code_block_58.out2
# note: Unit type count Tenure3
list_counttrue_marketbytype = List.CountTrue(list=eq_4@@L2)
list_counttrue_market = List.CountTrue(list=eq_4)
percentagemarket = CodeBlock(count=list_counttrue_marketbytype, total=list_counttrue_market) { count/total*100; " "; }
round_5 = Math.Round(number=percentagemarket.out0)
list_create_12 = List.Create(item0=round_5, item1=percentagemarket.out1)
flatten_20 = List.Flatten(list=list_create_12)
string_from_object_11 = FromObject(obj=flatten_20)
code_block_59 = CodeBlock { "NaN"; "0.000"; "."; }
replace_5 = String.Replace(string=string_from_object_11, searchFor=code_block_59.out0, replaceWith=code_block_59.out1)
# note: Format the result - S/O
split_8 = String.Split(string=replace_5, separator0=code_block_59.out2)
transpose_7 = List.Transpose(lists=split_8)
code_block_60 = CodeBlock(x=transpose_7) { x[0]; }
element_setparameterbyname_2 = Element.SetParameterByName(element=watch, parameterName=code_block_55.out5, value=code_block_60)  # "Element.SetParameterByName(Market Percentage)"
list_create_13 = List.Create(item0=list_counttrue_marketbytype, item1=list_counttrue_market)
flatten_21 = List.Flatten(list=list_create_13)
string_from_object_12 = FromObject(obj=flatten_21)
code_block_61 = CodeBlock { "NaN"; "0.000"; "."; }
replace_6 = String.Replace(string=string_from_object_12, searchFor=code_block_61.out0, replaceWith=code_block_61.out1)
split_9 = String.Split(string=replace_6, separator0=code_block_61.out2)
transpose_8 = List.Transpose(lists=split_9)
code_block_62 = CodeBlock(x=transpose_8) { x[0]; }
element_setparameterbyname_3 = Element.SetParameterByName(element=watch, parameterName=code_block_55.out6, value=code_block_62)  # "Element.SetParameterByName(Market Total Count)"
eq_5 = getParameterValueByName_10@@L2 == code_block_58.out1
# note: Unit type count Tenure2
list_counttrue_marketbytype_2 = List.CountTrue(list=eq_5@@L2)
list_counttrue_market_2 = List.CountTrue(list=eq_5)
percentagemarket_2 = CodeBlock(count=list_counttrue_marketbytype_2, total=list_counttrue_market_2) { count/total*100; " "; }
round_6 = Math.Round(number=percentagemarket_2.out0)
list_create_14 = List.Create(item0=round_6, item1=percentagemarket_2.out1)
flatten_22 = List.Flatten(list=list_create_14)
string_from_object_13 = FromObject(obj=flatten_22)
code_block_63 = CodeBlock { "NaN"; "0.000"; "."; }
replace_7 = String.Replace(string=string_from_object_13, searchFor=code_block_63.out0, replaceWith=code_block_63.out1)
# note: Format the result - Affordable
split_10 = String.Split(string=replace_7, separator0=code_block_63.out2)
transpose_9 = List.Transpose(lists=split_10)
code_block_64 = CodeBlock(x=transpose_9) { x[0]; }
element_setparameterbyname_4 = Element.SetParameterByName(element=watch, parameterName=code_block_55.out3, value=code_block_64)  # "Element.SetParameterByName(Market Percentage)"
list_create_15 = List.Create(item0=list_counttrue_marketbytype_2, item1=list_counttrue_market_2)
flatten_23 = List.Flatten(list=list_create_15)
string_from_object_14 = FromObject(obj=flatten_23)
code_block_65 = CodeBlock { "NaN"; "0.000"; "."; }
replace_8 = String.Replace(string=string_from_object_14, searchFor=code_block_65.out0, replaceWith=code_block_65.out1)
split_11 = String.Split(string=replace_8, separator0=code_block_65.out2)
transpose_10 = List.Transpose(lists=split_11)
code_block_66 = CodeBlock(x=transpose_10) { x[0]; }
element_setparameterbyname_5 = Element.SetParameterByName(element=watch, parameterName=code_block_55.out4, value=code_block_66)  # "Element.SetParameterByName(Market Total Count)"
eq_6 = getParameterValueByName_10@@L2 == code_block_58.out0
# note: Unit type count Tenure1
list_counttrue_marketbytype_3 = List.CountTrue(list=eq_6@@L2)
list_counttrue_market_3 = List.CountTrue(list=eq_6)
list_create_16 = List.Create(item0=list_counttrue_marketbytype_3, item1=list_counttrue_market_3)
flatten_24 = List.Flatten(list=list_create_16)
string_from_object_15 = FromObject(obj=flatten_24)
code_block_67 = CodeBlock { "NaN"; "0.000"; "."; }
replace_9 = String.Replace(string=string_from_object_15, searchFor=code_block_67.out0, replaceWith=code_block_67.out1)
# note: Format the result - Market
split_12 = String.Split(string=replace_9, separator0=code_block_67.out2)
transpose_11 = List.Transpose(lists=split_12)
code_block_68 = CodeBlock(x=transpose_11) { x[0]; }
element_setparameterbyname_6 = Element.SetParameterByName(element=watch, parameterName=code_block_55.out2, value=code_block_68)  # "Element.SetParameterByName(Market Total Count)"
percentagemarket_3 = CodeBlock(count=list_counttrue_marketbytype_3, total=list_counttrue_market_3) { count/total*100; " "; }
round_7 = Math.Round(number=percentagemarket_3.out0)
list_create_17 = List.Create(item0=round_7, item1=percentagemarket_3.out1)
flatten_25 = List.Flatten(list=list_create_17)
string_from_object_16 = FromObject(obj=flatten_25)
code_block_69 = CodeBlock { "NaN"; "0.000"; "."; }
replace_10 = String.Replace(string=string_from_object_16, searchFor=code_block_69.out0, replaceWith=code_block_69.out1)
split_13 = String.Split(string=replace_10, separator0=code_block_69.out2)
transpose_12 = List.Transpose(lists=split_13)
code_block_70 = CodeBlock(x=transpose_12) { x[0]; }
element_setparameterbyname_7 = Element.SetParameterByName(element=watch, parameterName=code_block_55.out1, value=code_block_70)  # "Element.SetParameterByName(Market Percentage)"
code_block_71 = CodeBlock { " (primary)"; ""; n-1; "Design Option"; }  # unwired: n
code_block_72 = CodeBlock(x=ui_multipleinputform.User_Inputs) { designOption=x[0]; }
name_2 = Element.Name(element=code_block_72)
replace_11 = String.Replace(string=name_2, searchFor=code_block_71.out0, replaceWith=code_block_71.out1)
# note: Fill in Design option header
setParameterByName_18 = Element.SetParameterByName(element=watch, parameterName=code_block_71.out3, value=replace_11)
code_block_73 = CodeBlock { "."; "Units Per Ha"; }
code_block_74 = CodeBlock(x=ui_multipleinputform.User_Inputs) { commonPlotBoundary=x[1]; }
code_block_75 = CodeBlock { Revit.Elements.Category.ByName("Site - Property Lines"); "Area"; }
all_elements_of_category_2 = ElementsOfCategory(Category=code_block_75.out0)
getParameterValueByName_11 = Element.GetParameterValueByName(element=all_elements_of_category_2, parameterName=code_block_75.out1)
byCategoryAndDesignOption_3 = archilab.Revit.Selection.Select.ByCategoryAndDesignOption(category=code_block_75.out0, designOption=code_block_72)
getParameterValueByName_12 = Element.GetParameterValueByName(element=byCategoryAndDesignOption_3, parameterName=code_block_75.out1)
code_block_76 = CodeBlock(x=getParameterValueByName_11, y=getParameterValueByName_12) { x[0]; y[0]; }
if_2 = If(test=code_block_74, true=code_block_76.out0, false=code_block_76.out1)
code_block_77 = CodeBlock(numberunits=sum_8, plotsize=if_2) { numberunits/(plotsize/10000); }
string_from_object_17 = FromObject(obj=code_block_77)
split_14 = String.Split(string=string_from_object_17, separator0=code_block_73.out0)
# note: Calculate Units/Ha
transpose_13 = List.Transpose(lists=split_14)
code_block_78 = CodeBlock(x=transpose_13) { x[0]; }
setParameterByName_19 = Element.SetParameterByName(element=watch, parameterName=code_block_73.out1, value=code_block_78)
code_block_79 = CodeBlock(x=ui_multipleinputform.User_Inputs, scheduleElement=ui_multipleinputform.User_Inputs) { designOption=x[0]; commonPlotBoundary=x[1]; floorsGIA=x[2]; scheduleElement[3]; }
code_block_80 = CodeBlock(x=ui_multipleinputform.User_Inputs) { floorsGIA=x[2]; }
runMe = Custom[Tool.RunMe](Boolean=code_block_80, ThingToDo=watch)  # package SteamNodes; Use Boolean to perform an action
code_block_81 = CodeBlock { Revit.Elements.Category.ByName("Floors"); }
# note: Are floors executed?
runMe_2 = Custom[Tool.RunMe](Boolean=code_block_80, ThingToDo=code_block_81)
byCategoryAndDesignOption_4 = archilab.Revit.Selection.Select.ByCategoryAndDesignOption(category=runMe_2, designOption=code_block_72)
# note: Collect GIA floors
code_block_82 = CodeBlock(floors=byCategoryAndDesignOption_4) { DSCore.List.Flatten(floors); }
code_block_83 = CodeBlock { "Comments"; "GIA"; }
getParameterValueByName_13 = Element.GetParameterValueByName(element=code_block_82, parameterName=code_block_83.out0)
contains_4 = String.Contains(string=getParameterValueByName_13, searchFor=code_block_83.out1)
filterByBoolMask_10 = List.FilterByBoolMask(list=code_block_82, mask=contains_4)
code_block_84 = CodeBlock { "Use"; "Hotel"; }
getParameterValueByName_14 = Element.GetParameterValueByName(element=filterByBoolMask_10.in, parameterName=code_block_84.out0)
contains_5 = String.Contains(string=getParameterValueByName_14, searchFor=code_block_84.out1)
filterByBoolMask_11 = List.FilterByBoolMask(list=filterByBoolMask_10.in, mask=contains_5)
code_block_85 = CodeBlock { "Unit Type"; }
getParameterValueByName_15 = Element.GetParameterValueByName(element=filterByBoolMask_11.in, parameterName=code_block_85)
groupByKey_7 = List.GroupByKey(list=filterByBoolMask_11.in, keys=getParameterValueByName_15)
code_block_86 = CodeBlock { "Area"; }
# note: Group by unit type
getParameterValueByName_16 = Element.GetParameterValueByName(element=groupByKey_7.groups@@L2, parameterName=code_block_86)
sum_11 = Math.Sum(values=getParameterValueByName_16)
# note: Sort by area size
sortByKey_3 = List.SortByKey(list=groupByKey_7.uniqueKeys, keys=sum_11)
reverse = List.Reverse(list=sortByKey_3.sortedList)
code_block_87 = CodeBlock { "Total:"; }
list_create_18 = List.Create(item0=reverse, item1=code_block_87)
code_block_88 = CodeBlock(names=list_create_18) { DSCore.List.Flatten(names); }
reverse_2 = List.Reverse(list=sortByKey_3.sortedKeys)
code_block_89 = CodeBlock(areas=reverse_2) { DSCore.Math.Round(areas); }
sum_12 = Math.Sum(values=code_block_89)
list_create_19 = List.Create(item0=code_block_89, item1=sum_12)
code_block_90 = CodeBlock(names=code_block_88, areas=list_create_19) { DSCore.List.Flatten(names); DSCore.List.Flatten(areas); "."; DSCore.List.Count(names); }
code_block_91 = CodeBlock(count=code_block_90.out3)
# ---------- code_block_91.designscript (14 lines) ----------
lst=1..count;
lstInvisible=count+1..10;
count;

"Hotel-Use"+lst;
"Hotel-UseNIA"+lst;

"Hotel-No.Rows-Tenure";

"Hotel-VisRow-Tenure"+lst;
"Hotel-VisRow-Tenure"+lstInvisible;

visible=1;
invisible=0;
# ----------------------------------------
string_from_object_18 = FromObject(obj=code_block_90.out1)
split_15 = String.Split(string=string_from_object_18, separator0=code_block_90.out2)
transpose_14 = List.Transpose(lists=split_15)
code_block_92 = CodeBlock(areas=transpose_14) { areas[0]; }
setParameterByName_20 = Element.SetParameterByName(element=runMe, parameterName=code_block_91.out4, value=code_block_92)
# note: Values
setParameterByName_21 = Element.SetParameterByName(element=runMe, parameterName=code_block_91.out3, value=code_block_90.out0)
# note: Number of rows
setParameterByName_22 = Element.SetParameterByName(element=runMe, parameterName=code_block_91.out5, value=code_block_91.count)
# note: Whick rows are visible/invisible
setParameterByName_23 = Element.SetParameterByName(element=runMe, parameterName=code_block_91.out6, value=code_block_91.visible)
setParameterByName_24 = Element.SetParameterByName(element=runMe, parameterName=code_block_91.out7, value=code_block_91.invisible)
code_block_93 = CodeBlock { false; true; }
if_3 = If(test=code_block_80, true=code_block_93.out0, false=code_block_93.out1)
runMe_3 = Custom[Tool.RunMe](Boolean=if_3, ThingToDo=watch)
code_block_94 = CodeBlock { "Unit Type"; "Room"; }
get_type_parameter_7 = Custom[Get Type Parameter](element=flatten_9, parameterName=code_block_94.out0)
groupByKey_8 = List.GroupByKey(list=flatten_9, keys=get_type_parameter_7)
contains_6 = String.Contains(string=groupByKey_8.uniqueKeys, searchFor=code_block_94.out1)
string_from_object_19 = FromObject(obj=contains_6)
# note: Calculate GIA per each unit type (rooms/circulation/lobby)
code_block_95 = CodeBlock { "false"; "true"; }
python_script_get_index_of_3 = Python(IN[0]=string_from_object_19, IN[1]=code_block_95.out0)  # IronPython2; same code as python_script_get_index_of
flatten_26 = List.Flatten(list=python_script_get_index_of_3)
getItemAtIndex_4 = List.GetItemAtIndex(list=groupByKey_8.uniqueKeys, index=flatten_26)
code_block_96 = CodeBlock { "Rooms"; "Total:"; }
list_create_20 = List.Create(item0=getItemAtIndex_4, item1=code_block_96.out0)
python_script_get_index_of_4 = Python(IN[0]=string_from_object_19, IN[1]=code_block_95.out0)  # IronPython2; same code as python_script_get_index_of
python_script_get_index_of_5 = Python(IN[0]=string_from_object_19, IN[1]=code_block_95.out1)  # IronPython2; same code as python_script_get_index_of
code_block_97 = CodeBlock(other=python_script_get_index_of_4, rooms=python_script_get_index_of_5) { DSCore.List.Flatten(other); DSCore.List.Flatten(rooms); }
getItemAtIndex_5 = List.GetItemAtIndex(list=groupByKey_8.groups, index=code_block_97.out0)
code_block_98 = CodeBlock { "GIArea"; }
getParameterValueByName_17 = Element.GetParameterValueByName(element=getItemAtIndex_5@@L2, parameterName=code_block_98)
sum_13 = Math.Sum(values=getParameterValueByName_17)
getItemAtIndex_6 = List.GetItemAtIndex(list=groupByKey_8.groups, index=code_block_97.out1)
flatten_27 = List.Flatten(list=getItemAtIndex_6)
getParameterValueByName_18 = Element.GetParameterValueByName(element=flatten_27, parameterName=code_block_98)
sum_14 = Math.Sum(values=getParameterValueByName_18)
list_create_21 = List.Create(item0=sum_13, item1=sum_14)
count_3 = List.Count(list=getParameterValueByName_17@L2)
count_4 = List.Count(list=getParameterValueByName_18)
list_create_22 = List.Create(item0=count_3, item1=count_4)
code_block_99 = CodeBlock(names=list_create_20, areas=list_create_21, count=list_create_22) { DSCore.List.Flatten(names); DSCore.List.Flatten(areas); DSCore.List.Flatten(count); }
sortByKey_4 = List.SortByKey(list=code_block_99.out0, keys=code_block_99.out1)
reverse_3 = List.Reverse(list=sortByKey_4.sortedList)
code_block_100 = CodeBlock { "Total:"; }
list_create_23 = List.Create(item0=reverse_3, item1=code_block_100)
code_block_101 = CodeBlock(names=list_create_23) { DSCore.List.Flatten(names); }
reverse_4 = List.Reverse(list=sortByKey_4.sortedKeys)
code_block_102 = CodeBlock(areas=reverse_4) { DSCore.Math.Round(areas); }
sum_15 = Math.Sum(values=code_block_102)
list_create_24 = List.Create(item0=code_block_102, item1=sum_15)
code_block_103 = CodeBlock(names=code_block_101, areas=list_create_24) { DSCore.List.Flatten(names); DSCore.List.Flatten(areas); "."; DSCore.List.Count(names); }
code_block_104 = CodeBlock(count=code_block_103.out3)  # same code as code_block_91
string_from_object_20 = FromObject(obj=code_block_103.out1)
split_16 = String.Split(string=string_from_object_20, separator0=code_block_103.out2)
transpose_15 = List.Transpose(lists=split_16)
code_block_105 = CodeBlock(areas=transpose_15) { areas[0]; }
setParameterByName_25 = Element.SetParameterByName(element=runMe_3, parameterName=code_block_104.out4, value=code_block_105)
setParameterByName_26 = Element.SetParameterByName(element=runMe_3, parameterName=code_block_104.out3, value=code_block_103.out0)
setParameterByName_27 = Element.SetParameterByName(element=runMe_3, parameterName=code_block_104.out5, value=code_block_104.count)
setParameterByName_28 = Element.SetParameterByName(element=runMe_3, parameterName=code_block_104.out6, value=code_block_104.visible)
setParameterByName_29 = Element.SetParameterByName(element=runMe_3, parameterName=code_block_104.out7, value=code_block_104.invisible)
sortByKey_5 = List.SortByKey(list=code_block_99.out2, keys=code_block_99.out1)
reverse_5 = List.Reverse(list=sortByKey_5.sortedList)
code_block_106 = CodeBlock { " "; }
list_create_25 = List.Create(item0=reverse_5, item1=code_block_106)
code_block_107 = CodeBlock(count=list_create_25) { output=DSCore.List.Flatten(count); lst=DSCore.List.Count(output); array=1..lst; "Hotel-UseNo.Units"+array; "."; }
string_from_object_21 = FromObject(obj=code_block_107.output)
split_17 = String.Split(string=string_from_object_21, separator0=code_block_107.out4)
transpose_16 = List.Transpose(lists=split_17)
code_block_108 = CodeBlock(x=transpose_16) { x[0]; }
# note: Number of units per Use
setParameterByName_30 = Element.SetParameterByName(element=watch, parameterName=code_block_107.out3, value=code_block_108)
# note: Remove Hotel & Commercial
python_script_get_index_of_6 = Python(IN[0]=groupByKey_4.uniqueKeys, IN[1]=code_block_23.out0)  # IronPython2; same code as python_script_get_index_of
getItemAtIndex_7 = List.GetItemAtIndex(list=groupByKey_4.groups, index=python_script_get_index_of_6)
# note: Get Commercial Units
flatten_28 = List.Flatten(list=getItemAtIndex_7)
code_block_109 = CodeBlock { "Unit Type"; }
get_type_parameter_8 = Custom[Get Type Parameter](element=flatten_28, parameterName=code_block_109)
groupByKey_9 = List.GroupByKey(list=flatten_28, keys=get_type_parameter_8)
code_block_110 = CodeBlock { "GIArea"; }
getParameterValueByName_19 = Element.GetParameterValueByName(element=groupByKey_9.groups@@L2, parameterName=code_block_110)
sum_16 = Math.Sum(values=getParameterValueByName_19)
count_5 = List.Count(list=getParameterValueByName_19@L2)
code_block_111 = CodeBlock(names=groupByKey_9.uniqueKeys, areas=sum_16, count=count_5) { DSCore.List.Flatten(names); DSCore.List.Flatten(areas); DSCore.List.Flatten(count); }
sortByKey_6 = List.SortByKey(list=code_block_111.out2, keys=code_block_111.out1)
reverse_6 = List.Reverse(list=sortByKey_6.sortedList)
code_block_112 = CodeBlock { " "; }
list_create_26 = List.Create(item0=reverse_6, item1=code_block_112)
code_block_113 = CodeBlock(count=list_create_26) { output=DSCore.List.Flatten(count); lst=DSCore.List.Count(output); array=1..lst; "Comm no Units"+array; "."; }
string_from_object_22 = FromObject(obj=code_block_113.output)
split_18 = String.Split(string=string_from_object_22, separator0=code_block_113.out4)
transpose_17 = List.Transpose(lists=split_18)
code_block_114 = CodeBlock(nums=transpose_17) { DSCore.List.Flatten(nums); }
setParameterByName_31 = Element.SetParameterByName(element=watch, parameterName=code_block_113.out3, value=code_block_114)
runMe_4 = Custom[Tool.RunMe](Boolean=code_block_80, ThingToDo=watch)
code_block_115 = CodeBlock { Revit.Elements.Category.ByName("Floors"); }
runMe_5 = Custom[Tool.RunMe](Boolean=code_block_80, ThingToDo=code_block_115)
byCategoryAndDesignOption_5 = archilab.Revit.Selection.Select.ByCategoryAndDesignOption(category=runMe_5, designOption=code_block_72)
code_block_116 = CodeBlock(floors=byCategoryAndDesignOption_5) { DSCore.List.Flatten(floors); }
code_block_117 = CodeBlock { "Comments"; "GIA"; }
getParameterValueByName_20 = Element.GetParameterValueByName(element=code_block_116, parameterName=code_block_117.out0)
contains_7 = String.Contains(string=getParameterValueByName_20, searchFor=code_block_117.out1)
filterByBoolMask_12 = List.FilterByBoolMask(list=code_block_116, mask=contains_7)
code_block_118 = CodeBlock { "Use"; "Commercial"; }
getParameterValueByName_21 = Element.GetParameterValueByName(element=filterByBoolMask_12.in, parameterName=code_block_118.out0)
contains_8 = String.Contains(string=getParameterValueByName_21, searchFor=code_block_118.out1)
filterByBoolMask_13 = List.FilterByBoolMask(list=filterByBoolMask_12.in, mask=contains_8)
code_block_119 = CodeBlock { "Unit Type"; }
getParameterValueByName_22 = Element.GetParameterValueByName(element=filterByBoolMask_13.in, parameterName=code_block_119)
groupByKey_10 = List.GroupByKey(list=filterByBoolMask_13.in, keys=getParameterValueByName_22)
code_block_120 = CodeBlock { "Area"; }
getParameterValueByName_23 = Element.GetParameterValueByName(element=groupByKey_10.groups@@L2, parameterName=code_block_120)
sum_17 = Math.Sum(values=getParameterValueByName_23)
sortByKey_7 = List.SortByKey(list=groupByKey_10.uniqueKeys, keys=sum_17)
reverse_7 = List.Reverse(list=sortByKey_7.sortedList)
code_block_121 = CodeBlock { "Total:"; }
list_create_27 = List.Create(item0=reverse_7, item1=code_block_121)
code_block_122 = CodeBlock(names=list_create_27) { DSCore.List.Flatten(names); }
reverse_8 = List.Reverse(list=sortByKey_7.sortedKeys)
code_block_123 = CodeBlock(areas=reverse_8) { DSCore.Math.Round(areas); }
sum_18 = Math.Sum(values=code_block_123)
list_create_28 = List.Create(item0=code_block_123, item1=sum_18)
code_block_124 = CodeBlock(names=code_block_122, areas=list_create_28) { DSCore.List.Flatten(names); DSCore.List.Flatten(areas); "."; DSCore.List.Count(names); }
code_block_125 = CodeBlock(count=code_block_124.out3)
# ---------- code_block_125.designscript (14 lines) ----------
lst=1..count;
lstInvisible=count+1..5;
count;

"Comm Unit Type"+lst;
"Comm GIA"+lst;

"Comm no Rows";

"Comm Vis Row"+lst;
"Comm Vis Row"+lstInvisible;

visible=1;
invisible=0;
# ----------------------------------------
string_from_object_23 = FromObject(obj=code_block_124.out1)
split_19 = String.Split(string=string_from_object_23, separator0=code_block_124.out2)
transpose_18 = List.Transpose(lists=split_19)
code_block_126 = CodeBlock(areas=transpose_18) { areas[0]; }
setParameterByName_32 = Element.SetParameterByName(element=runMe_4, parameterName=code_block_125.out4, value=code_block_126)
setParameterByName_33 = Element.SetParameterByName(element=runMe_4, parameterName=code_block_125.out3, value=code_block_124.out0)
setParameterByName_34 = Element.SetParameterByName(element=runMe_4, parameterName=code_block_125.out5, value=code_block_125.count)
setParameterByName_35 = Element.SetParameterByName(element=runMe_4, parameterName=code_block_125.out6, value=code_block_125.visible)
code_block_127 = CodeBlock { false; true; }
if_4 = If(test=code_block_80, true=code_block_127.out0, false=code_block_127.out1)
runMe_6 = Custom[Tool.RunMe](Boolean=if_4, ThingToDo=watch)
sortByKey_8 = List.SortByKey(list=code_block_111.out0, keys=code_block_111.out1)
reverse_9 = List.Reverse(list=sortByKey_8.sortedList)
code_block_128 = CodeBlock { "Total:"; }
list_create_29 = List.Create(item0=reverse_9, item1=code_block_128)
code_block_129 = CodeBlock(names=list_create_29) { DSCore.List.Flatten(names); }
reverse_10 = List.Reverse(list=sortByKey_8.sortedKeys)
code_block_130 = CodeBlock(areas=reverse_10) { DSCore.Math.Round(areas); }
sum_19 = Math.Sum(values=code_block_130)
list_create_30 = List.Create(item0=code_block_130, item1=sum_19)
code_block_131 = CodeBlock(names=code_block_129, areas=list_create_30) { DSCore.List.Flatten(names); DSCore.List.Flatten(areas); "."; DSCore.List.Count(names); }
code_block_132 = CodeBlock(count=code_block_131.out3)  # same code as code_block_125
string_from_object_24 = FromObject(obj=code_block_131.out1)
split_20 = String.Split(string=string_from_object_24, separator0=code_block_131.out2)
transpose_19 = List.Transpose(lists=split_20)
code_block_133 = CodeBlock(areas=transpose_19) { areas[0]; }
setParameterByName_36 = Element.SetParameterByName(element=runMe_6, parameterName=code_block_132.out4, value=code_block_133)
setParameterByName_37 = Element.SetParameterByName(element=runMe_6, parameterName=code_block_132.out3, value=code_block_131.out0)
setParameterByName_38 = Element.SetParameterByName(element=runMe_6, parameterName=code_block_132.out5, value=code_block_132.count)
setParameterByName_39 = Element.SetParameterByName(element=runMe_6, parameterName=code_block_132.out6, value=code_block_132.visible)
setParameterByName_40 = Element.SetParameterByName(element=runMe_6, parameterName=code_block_132.out7, value=code_block_132.invisible)
setParameterByName_41 = Element.SetParameterByName(element=runMe_4, parameterName=code_block_125.out7, value=code_block_125.invisible)
watch_3 = Watch(code_block_27.out2)
watch_4 = Watch(code_block_27.out3)
watch_5 = Watch(code_block_27.out4)
watch_6 = Watch(code_block_107.out3)
watch_7 = Watch(flatten_14)
watch_8 = Watch(flatten_13)
watch_9 = Watch(flatten_11)
watch_10 = Watch(code_block_108)

# group: Usage
code_block_134 = CodeBlock { "Schedule Mixed Use"; }
acg_script_usage = Custom[ACG Script Usage](scriptName=code_block_134)  # Adds an entry to Excel document every time a script is run. The document is located in S:\Dynamo\05-UsageStats

code_block_135 = CodeBlock { "Select Accommodation Schedule element"; "Select"; Revit.Elements.Category.ByName("Generic Annotations"); true; }
selectmodelelements_data = Custom[SelectModelElements Data](InputName=code_block_135.out0, ButtonText=code_block_135.out1, CategoryFilter=code_block_135.out2, SelectSingleElement=code_block_135.out3)  # package Data-Shapes; Creates a Revit element selection input for UI.MultipleInputForm++ . Check out www.data-shapes.net for more infos!
code_block_136 = CodeBlock { "Number parking spaces"; "Bikes-Achieved"; "No. Required Bike Racks"; "."; "Bikes-Required"; }
getParameterValueByName_24 = Element.GetParameterValueByName(element=filterByBoolMask_7.in, parameterName=code_block_136.out0)
code_block_137 = CodeBlock { ""; }
eq_7 = getParameterValueByName_24 == code_block_137
filterByBoolMask_14 = List.FilterByBoolMask(list=getParameterValueByName_24, mask=eq_7)
sum_20 = Math.Sum(values=filterByBoolMask_14.out)
string_from_object_25 = FromObject(obj=sum_20)
split_21 = String.Split(string=string_from_object_25, separator0=code_block_136.out3)
transpose_20 = List.Transpose(lists=split_21)
code_block_138 = CodeBlock(x=transpose_20) { x[0]; }
setParameterByName_42 = Element.SetParameterByName(element=watch, parameterName=code_block_136.out1, value=code_block_138)
type_2 = archilab.Revit.Elements.Elements.Type()  # unwired: element
getParameterValueByName_25 = Element.GetParameterValueByName(element=type_2, parameterName=code_block_136.out2)
code_block_139 = CodeBlock { ""; }
eq_8 = getParameterValueByName_25 == code_block_139
filterByBoolMask_15 = List.FilterByBoolMask(list=getParameterValueByName_25, mask=eq_8)
sum_21 = Math.Sum(values=filterByBoolMask_15.out)
string_from_object_26 = FromObject(obj=sum_21)
split_22 = String.Split(string=string_from_object_26, separator0=code_block_136.out3)
transpose_21 = List.Transpose(lists=split_22)
code_block_140 = CodeBlock(x=transpose_21) { x[0]; }
setParameterByName_43 = Element.SetParameterByName(element=watch, parameterName=code_block_136.out4, value=code_block_140)

# group: Visualisation
code_block_141 = CodeBlock { numb=1..3; "Resi Tenure"+numb+" - Name"; }
# note: Assigh tenure names
element_setparameterbyname_8 = Element.SetParameterByName(element=watch, parameterName=code_block_141.out1, value=remove)  # "Element.SetParameterByName(Market Percentage)"
