# Dynamo graph Schedule Mixed Use_DontKnowAnymore.dyn "Schedule Mixed Use" (Dynamo 2.12.0.5650)
# packages: archi-lab.net 2020.22.7, Data-Shapes 2018.12.1, SteamNodes 1.2.3, Orchid 230.0.3.7501, Data-Shapes 2021.2.92, archi-lab.net 2021.25.2521, Rhythm 2021.1.1, Orchid 260.1.0.7729

# note: Pick Design Option and Schedule element
file_path = Filename("..\ACG_logo.png")
file_from_path = FileObject(path=file_path)
readFromFile = Image.ReadFromFile(file=file_from_path)
code_block = CodeBlock { "Select Schedule Element"; "Cancel"; 700; 350; }
code_block_2 = CodeBlock()
# ---------- code_block_2.designscript (3 lines) ----------
"Note:";

"Please fill in the required input, click Select Schedule Element button and make a selection in the active sheet.";
# ----------------------------------------
textnote_data = Custom[TextNote Data](Title=code_block_2.out0, TextNote=code_block_2.out1)  # package Data-Shapes; Create Data for TextNote input in UI.MultipleInputForm ++ . Check out www.data-shapes.net for more informations
code_block_3 = CodeBlock { "Select a Design Option"; }
get_design_options = Custom[Get Design Options]()  # package archi-lab.net; Queries all of the design options currently in the project.

# group: Processing
code_block_4 = CodeBlock { "Design Option Set Id"; }
# note: get design option's set
getParameterValueByName = Element.GetParameterValueByName(element=get_design_options.designOptions, parameterName=code_block_4)
name = Element.Name(element=getParameterValueByName)

code_block_5 = CodeBlock(designOption=get_design_options.designOptions, set=name, name=get_design_options.names) { designOption; DOname=set+" - "+name; }
ui_dropdown_data = Custom[UI.DropDown Data](InputName=code_block_3, Keys=code_block_5.DOname, Values=code_block_5.designOption)  # package Data-Shapes; Create data for DropDown input in UI.MultiInputForm ++ . Check out www.data-shapes.net for more infos.
code_block_6 = CodeBlock { "Common Property Lines for Design Options?"; true; }
ui_boolean_input = Custom[UI.Boolean input](InputName=code_block_6.out0, DefaultValue=code_block_6.out1)  # package Data-Shapes; Creates a boolean input for UI.MultipleInputForm ++ . Check out www.data-shapes.net for more infos!
code_block_7 = CodeBlock { "Calculate GIA from floors?"; false; }
ui_boolean_input_2 = Custom[UI.Boolean input](InputName=code_block_7.out0, DefaultValue=code_block_7.out1)
list_create = List.Create(item0=textnote_data, item1=ui_dropdown_data, item2=ui_boolean_input, item3=ui_boolean_input_2)
ui_multipleinputform = Custom[UI.MultipleInputForm ++](Logo_optional=readFromFile, ButtonText_optional=code_block.out0, Inputs=list_create, Toggle=code_block_6.out1, CancelButtonText_optional=code_block.out1, Width_optional=code_block.out2, LabelWidth_optional=code_block.out3)  # package Data-Shapes; Create a form with multiple inputs. see www.data-shapes.net for tutorials and infos!
code_block_8 = CodeBlock { "Select Accommodation Schedule element"; "Select"; Revit.Elements.Category.ByName("Generic Annotations"); true; }

# group: Input
code_block_9 = CodeBlock { true; }
end = Revit.Transaction.Transaction.End(input=ui_multipleinputform.User_Inputs)
await_ = Orchid.Common.DataStream.Await(pass=code_block_9, waitFor=end)
ʳʰʸᵗʰᵐ_selection_pick = Rhythm.Revit.Selection.Selection.Pick(runIt=await_, category=code_block_8.out2, singleSelection=await_)
end_2 = Revit.Transaction.Transaction.End(input=ʳʰʸᵗʰᵐ_selection_pick)

code_block_10 = CodeBlock(scheduleElement=end_2) { scheduleElement; }
watch = Watch(code_block_10)
code_block_11 = CodeBlock { catGM=Revit.Category.ByName("Generic Models"); catP=Revit.Category.ByName("Parking"); }
code_block_12 = CodeBlock(designOption=ui_multipleinputform.User_Inputs) { designOption[0]; }
byCategoryAndDesignOption = archilab.Revit.Selection.Select.ByCategoryAndDesignOption(category=code_block_11.catGM, designOption=code_block_12)
flatten = List.Flatten(list=byCategoryAndDesignOption)
type = archilab.Revit.Elements.Elements.Type(element=flatten)
code_block_13 = CodeBlock { "Unit Type"; "Garage"; true; }
getParameterValueByName_2 = Element.GetParameterValueByName(element=type, parameterName=code_block_13.out0)
# note: Filter Garages
string_from_object = FromObject(obj=getParameterValueByName_2)
contains = Orchid.Common.String.Contains(string=string_from_object, searchFor=code_block_13.out1, ignoreCase=code_block_13.out2)
filterByBoolMask = List.FilterByBoolMask(list=flatten, mask=contains)
code_block_14 = CodeBlock { "NIArea"; }
getParameterValueByName_3 = Element.GetParameterValueByName(element=filterByBoolMask.out, parameterName=code_block_14)
# note: Filter elements that have NIA
string_from_object_2 = FromObject(obj=getParameterValueByName_3)
code_block_15 = CodeBlock { ""; }
eq = string_from_object_2 == code_block_15
filterByBoolMask_2 = List.FilterByBoolMask(list=filterByBoolMask.out, mask=eq)
watch_2 = Watch(filterByBoolMask_2.out)
getFamily = FamilyInstance.GetFamily(familyInstance=watch_2)
string_from_object_3 = FromObject(obj=getFamily)
code_block_16 = CodeBlock { "Family: ACG-4510-ResidentialUnit-"; }
# note: Filter only residential units
startsWith = String.StartsWith(string=string_from_object_3, searchFor=code_block_16)
filterByBoolMask_3 = List.FilterByBoolMask(list=watch_2, mask=startsWith)

# group: Processing
code_block_17 = CodeBlock { "Tenure"; }
getParameterValueByName_4 = Element.GetParameterValueByName(element=filterByBoolMask_3.in, parameterName=code_block_17)
code_block_18 = CodeBlock { "Mark"; "0Mark"; "Afford"; "1Afford"; "Share"; "2Share"; "Ret"; "3Ret"; }
replace = String.Replace(string=getParameterValueByName_4, searchFor=code_block_18.out0, replaceWith=code_block_18.out1, lacing=Longest)
replace_2 = String.Replace(string=replace, searchFor=code_block_18.out2, replaceWith=code_block_18.out3)
replace_3 = String.Replace(string=replace_2, searchFor=code_block_18.out4, replaceWith=code_block_18.out5)
replace_4 = String.Replace(string=replace_3, searchFor=code_block_18.out6, replaceWith=code_block_18.out7)

# group: Processing
sortByKey = List.SortByKey(list=filterByBoolMask_3.in, keys=replace_4)
# note: Group units by tenure:
# Marker
# Affordable
# Shared
# Retirement
# ....rest
groupByKey = List.GroupByKey(list=sortByKey.sortedList, keys=sortByKey.sortedKeys)
code_block_19 = CodeBlock { 0; 1; }
remove = String.Remove(string=groupByKey.uniqueKeys, startIndex=code_block_19.out0, count=code_block_19.out1)

flatten_2 = List.Flatten(list=groupByKey.groups)
code_block_20 = CodeBlock { "Unit Type"; }
get_type_parameter = Custom[Get Type Parameter](element=flatten_2, parameterName=code_block_20)  # package archi-lab.net; This node will retrieve a type parameter by its name.
sortByKey_2 = List.SortByKey(list=flatten_2, keys=get_type_parameter)
# note: Group units by type
get_type_parameter_2 = Custom[Get Type Parameter](element=sortByKey_2.sortedList, parameterName=code_block_20)
groupByKey_2 = List.GroupByKey(list=sortByKey_2.sortedList, keys=get_type_parameter_2)
list_count_unittypes = List.Count(list=groupByKey_2.uniqueKeys)
code_block_21 = CodeBlock(count=list_count_unittypes)
# ---------- code_block_21.designscript (12 lines) ----------
numUnits=1..count+1..1;

"Tenure1 Percent Row "+numUnits;
"Tenure1 no. Row "+numUnits;

"Tenure2 Percent Row "+numUnits;
"Tenure2 no. Row "+numUnits;

"Tenure3 Percent Row "+numUnits;
"Tenure3 no. Row "+numUnits;

"Unit Type "+numUnits;
# ----------------------------------------
code_block_22 = CodeBlock { "Tenure"; }
getParameterValueByName_5 = Element.GetParameterValueByName(element=groupByKey_2.groups@@L2, parameterName=code_block_22)
code_block_23 = CodeBlock(x=remove) { x[0]; x[1]; x[2]; }
eq_2 = getParameterValueByName_5@@L2 == code_block_23.out0
list_counttrue_marketbytype = List.CountTrue(list=eq_2@@L2)
list_counttrue_market = List.CountTrue(list=eq_2)
percentagemarket = CodeBlock(count=list_counttrue_marketbytype, total=list_counttrue_market) { count/total*100; " "; }
round = Math.Round(number=percentagemarket.out0)
list_create_2 = List.Create(item0=round, item1=percentagemarket.out1)
flatten_3 = List.Flatten(list=list_create_2)
string_from_object_4 = FromObject(obj=flatten_3)
code_block_24 = CodeBlock { "NaN"; "0.000"; "."; }
replace_5 = String.Replace(string=string_from_object_4, searchFor=code_block_24.out0, replaceWith=code_block_24.out1)
# note: Format the result - Market
split = String.Split(string=replace_5, separator0=code_block_24.out2)
transpose = List.Transpose(lists=split)
code_block_25 = CodeBlock(x=transpose) { x[0]; }
element_setparameterbyname = Element.SetParameterByName(element=watch, parameterName=code_block_21.out1, value=code_block_25)  # "Element.SetParameterByName(Market Percentage)"
code_block_26 = CodeBlock(floorGIA=ui_multipleinputform.User_Inputs) { floorGIA[2]; }
code_block_27 = CodeBlock { false; true; }
if_ = If(test=code_block_26, true=code_block_27.out0, false=code_block_27.out1)
runMe = Custom[Tool.RunMe](Boolean=if_, ThingToDo=watch)  # package SteamNodes; Use Boolean to perform an action
code_block_28 = CodeBlock { "Use"; }
# note: Group unit elements by Use
get_type_parameter_3 = Custom[Get Type Parameter](element=watch_2, parameterName=code_block_28)
code_block_29 = CodeBlock { null; }
eq_3 = get_type_parameter_3 == code_block_29
filterByBoolMask_4 = List.FilterByBoolMask(list=watch_2, mask=eq_3)
get_type_parameter_4 = Custom[Get Type Parameter](element=filterByBoolMask_4.out, parameterName=code_block_28)
groupByKey_3 = List.GroupByKey(list=filterByBoolMask_4.out, keys=get_type_parameter_4)
code_block_30 = CodeBlock { "Total:"; }
list_create_3 = List.Create(item0=groupByKey_3.uniqueKeys, item1=code_block_30)
flatten_4 = List.Flatten(list=list_create_3)
list_count_countusages = List.Count(list=flatten_4)
code_block_31 = CodeBlock(count=list_count_countusages) { 1..count; 1; count+1..10; 0; count; }
code_block_32 = CodeBlock(number=code_block_31.out0) { "Usage NIA "+number; }
code_block_33 = CodeBlock { "GIArea"; }
getParameterValueByName_6 = Element.GetParameterValueByName(element=groupByKey_3.groups@@L2, parameterName=code_block_33)
code_block_34 = CodeBlock(value=getParameterValueByName_6) { value==""; }
filterByBoolMask_5 = List.FilterByBoolMask(list=getParameterValueByName_6, mask=code_block_34)
sum = Math.Sum(values=filterByBoolMask_5.out@@L2)
code_block_35 = CodeBlock { 0; }
# note: Usage schedule
round_2 = Math.Round(number=sum@@L2, digits=code_block_35)
sum_2 = Math.Sum(values=round_2)
list_create_4 = List.Create(item0=round_2, item1=sum_2)
flatten_5 = List.Flatten(list=list_create_4)
string_from_object_5 = FromObject(obj=flatten_5)
code_block_36 = CodeBlock { "."; }
split_2 = String.Split(string=string_from_object_5, separator0=code_block_36)
transpose_2 = List.Transpose(lists=split_2)
code_block_37 = CodeBlock(x=transpose_2) { x[0]; }
# note: Use GIA (false=by unit /true=by floor )
# note: Units
setParameterByName = Element.SetParameterByName(element=runMe, parameterName=code_block_32, value=code_block_37)
list_create_5 = List.Create(item0=list_counttrue_marketbytype, item1=list_counttrue_market)
flatten_6 = List.Flatten(list=list_create_5)
string_from_object_6 = FromObject(obj=flatten_6)
code_block_38 = CodeBlock { "NaN"; "0.000"; "."; }
replace_6 = String.Replace(string=string_from_object_6, searchFor=code_block_38.out0, replaceWith=code_block_38.out1)
split_3 = String.Split(string=replace_6, separator0=code_block_38.out2)
transpose_3 = List.Transpose(lists=split_3)
code_block_39 = CodeBlock(x=transpose_3) { x[0]; }
element_setparameterbyname_2 = Element.SetParameterByName(element=watch, parameterName=code_block_21.out2, value=code_block_39)  # "Element.SetParameterByName(Market Total Count)"
# note: Use Table - Number of Rows
code_block_40 = CodeBlock(count1=code_block_31.out0, count2=code_block_31.out2) { "Number of Rows - Usage"; "Usage Vis Row "+count1; "Usage Vis Row "+count2; }
setParameterByName_2 = Element.SetParameterByName(element=watch, parameterName=code_block_40.out0, value=code_block_31.count)
setParameterByName_3 = Element.SetParameterByName(element=watch, parameterName=code_block_40.out1, value=code_block_31.out1)
setParameterByName_4 = Element.SetParameterByName(element=watch, parameterName=code_block_40.out2, value=code_block_31.out3)
# note: Unit Types Table - Number of Rows
code_block_41 = CodeBlock(count=list_count_unittypes)
# ---------- code_block_41.designscript (9 lines) ----------
visible=1..count+1;
1;
notVisible=count+2..15;
0;
count+1;

"Number of Rows - Unit Types";
"Vis Row "+visible;
"Vis Row "+notVisible;
# ----------------------------------------
setParameterByName_5 = Element.SetParameterByName(element=watch, parameterName=code_block_41.out7, value=code_block_41.out3)
setParameterByName_6 = Element.SetParameterByName(element=watch, parameterName=code_block_41.out6, value=code_block_41.out1)
setParameterByName_7 = Element.SetParameterByName(element=watch, parameterName=code_block_41.out5, value=code_block_41.out4)
code_block_42 = CodeBlock(n=code_block_12) { " (primary)"; ""; n-1; "Design Option"; }
name_2 = Element.Name(element=code_block_12)
replace_7 = String.Replace(string=name_2, searchFor=code_block_42.out0, replaceWith=code_block_42.out1)
setParameterByName_8 = Element.SetParameterByName(element=watch, parameterName=code_block_42.out3, value=replace_7)
code_block_43 = CodeBlock { "."; "Units Per Ha"; }
count = List.Count(list=groupByKey.groups@L2)
sum_3 = Math.Sum(values=count)
code_block_44 = CodeBlock(propertyLine=ui_multipleinputform.User_Inputs) { propertyLine[1]; }
code_block_45 = CodeBlock { "Site - Property Lines"; }
byName = Category.ByName(name=code_block_45)
all_elements_of_category = ElementsOfCategory(Category=byName)
code_block_46 = CodeBlock { "Area"; }
getParameterValueByName_7 = Element.GetParameterValueByName(element=all_elements_of_category, parameterName=code_block_46)
code_block_47 = CodeBlock(x=getParameterValueByName_7) { x[0]; }
byCategoryAndDesignOption_2 = archilab.Revit.Selection.Select.ByCategoryAndDesignOption(category=byName, designOption=code_block_12)
getParameterValueByName_8 = Element.GetParameterValueByName(element=byCategoryAndDesignOption_2, parameterName=code_block_46)
code_block_48 = CodeBlock(x=getParameterValueByName_8) { x[0]; }
if_2 = If(test=code_block_44, true=code_block_47, false=code_block_48)
code_block_49 = CodeBlock(numberunits=sum_3, plotsize=if_2) { numberunits/(plotsize/10000); }
string_from_object_7 = FromObject(obj=code_block_49)
split_4 = String.Split(string=string_from_object_7, separator0=code_block_43.out0)
transpose_4 = List.Transpose(lists=split_4)
code_block_50 = CodeBlock(x=transpose_4) { x[0]; }
setParameterByName_9 = Element.SetParameterByName(element=watch, parameterName=code_block_43.out1, value=code_block_50)
code_block_51 = CodeBlock { "Number parking spaces"; "Parking-Achieved"; "No. Required Parking Spaces"; "."; "Parking-Required"; }
byCategoryAndDesignOption_3 = archilab.Revit.Selection.Select.ByCategoryAndDesignOption(category=code_block_11.catP, designOption=code_block_12)

# group: Filtering
code_block_52 = CodeBlock(e=byCategoryAndDesignOption_3) { tp=e.Type; tp.Name; "Car"; "Bike"; }
contains_2 = String.Contains(string=code_block_52.out1, searchFor=code_block_52.out2)
filterByBoolMask_6 = List.FilterByBoolMask(list=byCategoryAndDesignOption_3, mask=contains_2)
contains_3 = String.Contains(string=code_block_52.out1, searchFor=code_block_52.out3)
filterByBoolMask_7 = List.FilterByBoolMask(list=byCategoryAndDesignOption_3, mask=contains_3)

getParameterValueByName_9 = Element.GetParameterValueByName(element=filterByBoolMask_6.in, parameterName=code_block_51.out0)
code_block_53 = CodeBlock { ""; }
eq_4 = getParameterValueByName_9 == code_block_53
filterByBoolMask_8 = List.FilterByBoolMask(list=getParameterValueByName_9, mask=eq_4)
sum_4 = Math.Sum(values=filterByBoolMask_8.out)
string_from_object_8 = FromObject(obj=sum_4)
split_5 = String.Split(string=string_from_object_8, separator0=code_block_51.out3)
transpose_5 = List.Transpose(lists=split_5)
code_block_54 = CodeBlock(x=transpose_5) { x[0]; }
setParameterByName_10 = Element.SetParameterByName(element=watch, parameterName=code_block_51.out1, value=code_block_54)
type_2 = archilab.Revit.Elements.Elements.Type(element=watch_2)
getParameterValueByName_10 = Element.GetParameterValueByName(element=type_2, parameterName=code_block_51.out2)
code_block_55 = CodeBlock { ""; }
eq_5 = getParameterValueByName_10 == code_block_55
filterByBoolMask_9 = List.FilterByBoolMask(list=getParameterValueByName_10, mask=eq_5)
sum_5 = Math.Sum(values=filterByBoolMask_9.out)
string_from_object_9 = FromObject(obj=sum_5)
split_6 = String.Split(string=string_from_object_9, separator0=code_block_51.out3)
transpose_6 = List.Transpose(lists=split_6)
code_block_56 = CodeBlock(x=transpose_6) { x[0]; }
setParameterByName_11 = Element.SetParameterByName(element=watch, parameterName=code_block_51.out4, value=code_block_56)
code_block_57 = CodeBlock { Revit.Elements.Category.ByName("Floors"); }
byCategoryAndDesignOption_4 = archilab.Revit.Selection.Select.ByCategoryAndDesignOption(category=code_block_57, designOption=code_block_12)
code_block_58 = CodeBlock(lst=byCategoryAndDesignOption_4) { DSCore.List.Flatten(lst); }
code_block_59 = CodeBlock { "Comments"; }
getParameterValueByName_11 = Element.GetParameterValueByName(element=code_block_58, parameterName=code_block_59)
code_block_60 = CodeBlock { "GEA"; }
contains_4 = String.Contains(string=getParameterValueByName_11, searchFor=code_block_60)
filterByBoolMask_10 = List.FilterByBoolMask(list=code_block_58, mask=contains_4)
code_block_61 = CodeBlock { "Area"; }
getParameterValueByName_12 = Element.GetParameterValueByName(element=filterByBoolMask_10.in, parameterName=code_block_61)
sum_6 = Math.Sum(values=getParameterValueByName_12)
round_3 = Math.Round(number=sum_6)
string_from_object_10 = FromObject(obj=round_3)
code_block_62 = CodeBlock { "."; }
split_7 = String.Split(string=string_from_object_10, separator0=code_block_62)
transpose_7 = List.Transpose(lists=split_7)
code_block_63 = CodeBlock(x=transpose_7) { x[0]; }
code_block_64 = CodeBlock(number=code_block_31.out0) { "Usage "+number; }
# note: Use name (false=by unit /true=by floor )
setParameterByName_12 = Element.SetParameterByName(element=runMe, parameterName=code_block_64, value=flatten_4)
code_block_65 = CodeBlock()
# ---------- code_block_65.designscript (13 lines) ----------
[
"Tenure1 - NIA",
"Tenure2 - NIA",
"Tenure3 - NIA",
"Tenure Total - NIA",
"Tenure1 - Unit no.",
"Tenure2 - Unit no.",
"Tenure3 - Unit no.",
"Tenure Total - Unit no.",
"Tenure1 - Mix",
"Tenure2 - Mix",
"Tenure3 - Mix"
];
# ----------------------------------------
code_block_66 = CodeBlock { "NIArea"; }
getParameterValueByName_13 = Element.GetParameterValueByName(element=groupByKey.groups@@L2, parameterName=code_block_66)
math_sum_all_tenures = Math.Sum(values=getParameterValueByName_13)
string_from_object_11 = FromObject(obj=math_sum_all_tenures)
code_block_67 = CodeBlock(x=string_from_object_11) { x=="null"; 0; }
code_block_68 = CodeBlock(x=code_block_67.out0, a=code_block_67.out1, b=math_sum_all_tenures) { x?a:b; }
round_4 = Math.Round(number=code_block_68)
sum_7 = Math.Sum(values=round_4)
# note: Tenure schedule
sum_8 = Math.Sum(values=code_block_68)
code_block_69 = CodeBlock(numTenure=code_block_68, numTotal=sum_8) { numTenure/numTotal*100; }
round_5 = Math.Round(number=code_block_69)
list_create_6 = List.Create(item0=round_4, item1=sum_7, item2=count, item3=sum_3, item4=round_5)
flatten_7 = List.Flatten(list=list_create_6)
string_from_object_12 = FromObject(obj=flatten_7)
code_block_70 = CodeBlock { "."; }
split_8 = String.Split(string=string_from_object_12, separator0=code_block_70)
transpose_8 = List.Transpose(lists=split_8)
code_block_71 = CodeBlock(x=transpose_8) { x[0]; }
setParameterByName_13 = Element.SetParameterByName(element=watch, parameterName=code_block_65, value=code_block_71)
eq_6 = getParameterValueByName_5@@L2 == code_block_23.out1
list_counttrue_marketbytype_2 = List.CountTrue(list=eq_6@@L2)
list_counttrue_market_2 = List.CountTrue(list=eq_6)
percentagemarket_2 = CodeBlock(count=list_counttrue_marketbytype_2, total=list_counttrue_market_2) { count/total*100; " "; }
round_6 = Math.Round(number=percentagemarket_2.out0)
list_create_7 = List.Create(item0=round_6, item1=percentagemarket_2.out1)
flatten_8 = List.Flatten(list=list_create_7)
string_from_object_13 = FromObject(obj=flatten_8)
code_block_72 = CodeBlock { "NaN"; "0.000"; "."; }
replace_8 = String.Replace(string=string_from_object_13, searchFor=code_block_72.out0, replaceWith=code_block_72.out1)
# note: Format the result - Affordable
split_9 = String.Split(string=replace_8, separator0=code_block_72.out2)
transpose_9 = List.Transpose(lists=split_9)
code_block_73 = CodeBlock(x=transpose_9) { x[0]; }
element_setparameterbyname_3 = Element.SetParameterByName(element=watch, parameterName=code_block_21.out3, value=code_block_73)  # "Element.SetParameterByName(Market Percentage)"
list_create_8 = List.Create(item0=list_counttrue_marketbytype_2, item1=list_counttrue_market_2)
flatten_9 = List.Flatten(list=list_create_8)
string_from_object_14 = FromObject(obj=flatten_9)
code_block_74 = CodeBlock { "NaN"; "0.000"; "."; }
replace_9 = String.Replace(string=string_from_object_14, searchFor=code_block_74.out0, replaceWith=code_block_74.out1)
split_10 = String.Split(string=replace_9, separator0=code_block_74.out2)
transpose_10 = List.Transpose(lists=split_10)
code_block_75 = CodeBlock(x=transpose_10) { x[0]; }
element_setparameterbyname_4 = Element.SetParameterByName(element=watch, parameterName=code_block_21.out4, value=code_block_75)  # "Element.SetParameterByName(Market Total Count)"
eq_7 = getParameterValueByName_5@@L2 == code_block_23.out2
list_counttrue_marketbytype_3 = List.CountTrue(list=eq_7@@L2)
list_counttrue_market_3 = List.CountTrue(list=eq_7)
percentagemarket_3 = CodeBlock(count=list_counttrue_marketbytype_3, total=list_counttrue_market_3) { count/total*100; " "; }
round_7 = Math.Round(number=percentagemarket_3.out0)
list_create_9 = List.Create(item0=round_7, item1=percentagemarket_3.out1)
flatten_10 = List.Flatten(list=list_create_9)
string_from_object_15 = FromObject(obj=flatten_10)
code_block_76 = CodeBlock { "NaN"; "0.000"; "."; }
replace_10 = String.Replace(string=string_from_object_15, searchFor=code_block_76.out0, replaceWith=code_block_76.out1)
# note: Format the result - S/O
split_11 = String.Split(string=replace_10, separator0=code_block_76.out2)
transpose_11 = List.Transpose(lists=split_11)
code_block_77 = CodeBlock(x=transpose_11) { x[0]; }
element_setparameterbyname_5 = Element.SetParameterByName(element=watch, parameterName=code_block_21.out5, value=code_block_77)  # "Element.SetParameterByName(Market Percentage)"
list_create_10 = List.Create(item0=list_counttrue_marketbytype_3, item1=list_counttrue_market_3)
flatten_11 = List.Flatten(list=list_create_10)
string_from_object_16 = FromObject(obj=flatten_11)
code_block_78 = CodeBlock { "NaN"; "0.000"; "."; }
replace_11 = String.Replace(string=string_from_object_16, searchFor=code_block_78.out0, replaceWith=code_block_78.out1)
split_12 = String.Split(string=replace_11, separator0=code_block_78.out2)
transpose_12 = List.Transpose(lists=split_12)
code_block_79 = CodeBlock(x=transpose_12) { x[0]; }
element_setparameterbyname_6 = Element.SetParameterByName(element=watch, parameterName=code_block_21.out6, value=code_block_79)  # "Element.SetParameterByName(Market Total Count)"
code_block_80 = CodeBlock { "Total:"; }
list_create_11 = List.Create(item0=groupByKey_2.uniqueKeys, item1=code_block_80)
flatten_12 = List.Flatten(list=list_create_11)
element_setparameterbyname_7 = Element.SetParameterByName(element=watch, parameterName=code_block_21.out7, value=flatten_12)  # "Element.SetParameterByName(Market Total Count)"
code_block_81 = CodeBlock { Revit.Elements.Category.ByName("Project Information"); "Project Name"; }
all_elements_of_category_2 = ElementsOfCategory(Category=code_block_81.out0)
# note: Collect project name
getParameterValueByName_14 = Element.GetParameterValueByName(element=all_elements_of_category_2, parameterName=code_block_81.out1)
setParameterByName_14 = Element.SetParameterByName(element=watch, parameterName=code_block_81.out1, value=getParameterValueByName_14)
watch_3 = Watch(code_block_41.out6)
watch_4 = Watch(code_block_41.out7)
watch_5 = Watch(code_block_32)
watch_6 = Watch(code_block_37)
watch_7 = Watch()  # unwired: arg0
code_block_82 = CodeBlock { "GIA"; }
contains_5 = String.Contains(string=getParameterValueByName_11, searchFor=code_block_82)
filterByBoolMask_11 = List.FilterByBoolMask(list=code_block_58, mask=contains_5)
getParameterValueByName_15 = Element.GetParameterValueByName(element=filterByBoolMask_11.in, parameterName=code_block_59)
groupByKey_4 = List.GroupByKey(list=filterByBoolMask_11.in, keys=getParameterValueByName_15)
code_block_83 = CodeBlock { "Area"; }
getParameterValueByName_16 = Element.GetParameterValueByName(element=groupByKey_4.groups@@L2, parameterName=code_block_83)
sum_9 = Math.Sum(values=getParameterValueByName_16)
round_8 = Math.Round(number=sum_9)
sum_10 = Math.Sum(values=round_8)
list_create_12 = List.Create(item0=round_8, item1=sum_10)
code_block_84 = CodeBlock(lst=list_create_12) { DSCore.List.Flatten(lst); }
string_from_object_17 = FromObject(obj=code_block_84)
code_block_85 = CodeBlock { "."; }
split_13 = String.Split(string=string_from_object_17, separator0=code_block_85)
transpose_13 = List.Transpose(lists=split_13)
code_block_86 = CodeBlock(x=transpose_13) { x[0]; }
watch_8 = Watch(code_block_86)
runMe_2 = Custom[Tool.RunMe](Boolean=code_block_26, ThingToDo=watch)
# note: Floors
setParameterByName_15 = Element.SetParameterByName(element=runMe_2, parameterName=code_block_32, value=code_block_86)
code_block_87 = CodeBlock { " "; }
split_14 = String.Split(string=groupByKey_4.uniqueKeys, separator0=code_block_87)
transpose_14 = List.Transpose(lists=split_14)
code_block_88 = CodeBlock(x=transpose_14) { x[1]; "Total :"; }
list_create_13 = List.Create(item0=code_block_88.out0, item1=code_block_88.out1)
code_block_89 = CodeBlock(lst=list_create_13) { DSCore.List.Flatten(lst); }
setParameterByName_16 = Element.SetParameterByName(element=runMe_2, parameterName=code_block_64, value=code_block_89)

# group: Usage
code_block_90 = CodeBlock { "Schedule Residential"; }
acg_script_usage = Custom[ACG Script Usage](scriptName=code_block_90)  # Adds an entry to Excel document every time a script is run. The document is located in S:\Dynamo\05-UsageStats

selectmodelelements_data = Custom[SelectModelElements Data](InputName=code_block_8.out0, ButtonText=code_block_8.out1, CategoryFilter=code_block_8.out2, SelectSingleElement=code_block_8.out3)  # frozen; package Data-Shapes; Creates a Revit element selection input for UI.MultipleInputForm++ . Check out www.data-shapes.net for more infos!
code_block_91 = CodeBlock { "Number parking spaces"; "Bikes-Achieved"; "No. Required Bike Racks"; "."; "Bikes-Required"; }
getParameterValueByName_17 = Element.GetParameterValueByName(element=filterByBoolMask_7.in, parameterName=code_block_91.out0)
code_block_92 = CodeBlock { ""; }
eq_8 = getParameterValueByName_17 == code_block_92
filterByBoolMask_12 = List.FilterByBoolMask(list=getParameterValueByName_17, mask=eq_8)
sum_11 = Math.Sum(values=filterByBoolMask_12.out)
string_from_object_18 = FromObject(obj=sum_11)
split_15 = String.Split(string=string_from_object_18, separator0=code_block_91.out3)
transpose_15 = List.Transpose(lists=split_15)
code_block_93 = CodeBlock(x=transpose_15) { x[0]; }
setParameterByName_17 = Element.SetParameterByName(element=watch, parameterName=code_block_91.out1, value=code_block_93)
type_3 = archilab.Revit.Elements.Elements.Type(element=watch_2)
getParameterValueByName_18 = Element.GetParameterValueByName(element=type_3, parameterName=code_block_91.out2)
code_block_94 = CodeBlock { ""; }
eq_9 = getParameterValueByName_18 == code_block_94
filterByBoolMask_13 = List.FilterByBoolMask(list=getParameterValueByName_18, mask=eq_9)
sum_12 = Math.Sum(values=filterByBoolMask_13.out)
string_from_object_19 = FromObject(obj=sum_12)
split_16 = String.Split(string=string_from_object_19, separator0=code_block_91.out3)
transpose_16 = List.Transpose(lists=split_16)
code_block_95 = CodeBlock(x=transpose_16) { x[0]; }
setParameterByName_18 = Element.SetParameterByName(element=watch, parameterName=code_block_91.out4, value=code_block_95)

# group: Visualisation
code_block_96 = CodeBlock { numb=1..3; "Tenure"+numb+" - Name"; }
# note: Assigh tenure names
element_setparameterbyname_8 = Element.SetParameterByName(element=watch, parameterName=code_block_96.out1, value=remove)  # "Element.SetParameterByName(Market Percentage)"

sum_13 = Math.Sum(values=code_block_68)
# note: Combined GIA (false=by unit /true=by floor )
if_3 = If(test=code_block_26, true=sum_10, false=sum_2)
code_block_97 = CodeBlock(NIA=sum_13, GIA=if_3) { NIA/GIA; }
code_block_efficiency = CodeBlock { 3; "00"; }
round_9 = Math.Round(number=code_block_97, digits=code_block_efficiency.out0)
string_from_object_20 = FromObject(obj=round_9)
split_17 = String.Split(string=string_from_object_20, separator0=code_block_efficiency.out1)
code_block_98 = CodeBlock(lst=split_17) { DSCore.List.Flatten(lst); }
code_block_99 = CodeBlock(x=code_block_98) { "Net To Gross Ratio"; x[0]; }
setParameterByName_19 = Element.SetParameterByName(element=watch, parameterName=code_block_99.out0, value=code_block_99.out1)
