# Dynamo graph Place Groups on Levels-SS.dyn "Place Groups on Levels" (Dynamo 2.6.1.8786)
# packages: BVN 1.6.1, WombatDynamo 2.3.0, LunchBox for Dynamo 2016.11.11, spring nodes 110.0.2

typeCollector = Custom[ModelGroup.TypeCollector]()  # package BVN; Returns all the types (not instances) from all model groups in the project
name = Element.Name(element=typeCollector)
code_block = CodeBlock { "Group "; }
startsWith = String.StartsWith(str=name, searchFor=code_block)
filterByBoolMask = List.FilterByBoolMask(list=typeCollector, mask=startsWith)
name_2 = Element.Name(element=filterByBoolMask.in)
count = List.Count(list=name_2)
code_block_2 = CodeBlock(count=count) { count/2; }
split = Custom[Springs.List.Split](list=filterByBoolMask.in, amount=code_block_2)  # package spring nodes; Splits a list at the desired length
grouptype_groups_exterior = Custom[GroupType.Groups(Exterior)](groupType=split.list2)
string = StringInput("C:\Users\")
userName = Python()  # "System.UserName"; unwired: IN[0]
# ---------- userName.python (3 lines) ----------
import clr
from System import Environment
OUT = Environment.UserName
# ----------------------------------------
string_2 = StringInput("\Desktop\Capacity-GroupsToLevels.csv")
code_block_3 = CodeBlock(part1=string, currentuser=userName, part2=string_2) { part1+currentuser+part2; }
code_block_4 = CodeBlock { false; }
importCSV = Data.ImportCSV(filePath=code_block_3, transpose=code_block_4)
removeNulls = Lists.Manage.RemoveNulls(Data=importCSV)
code_block_5 = CodeBlock { "zero"; "0"; }
replace = String.Replace(str=removeNulls.Cleaned, searchFor=code_block_5.out0, replaceWith=code_block_5.out1)
byName = WombatDynamo.Level.ByName(name=replace)
copyToLevel = Custom[Element.CopyToLevel](element=grouptype_groups_exterior@@L2, level=byName@L2, lacing=Shortest)
grouptype_groups_interior = Custom[GroupType.Groups(Interior)](groupType=split.list1)
copyToLevel_2 = Custom[Element.CopyToLevel](element=grouptype_groups_interior@@L2, level=byName@L2, lacing=Shortest)
string_3 = StringInput("\")

# group: Usage
code_block_6 = CodeBlock { "Place Groups on Levels"; }
acg_script_usage = Custom[ACG Script Usage](scriptName=code_block_6)  # Adds an entry to Excel document every time a script is run. The document is located in S:\Dynamo\05-UsageStats
