# Dynamo graph Area to In-Place Models_py.dyn "Area to In-Place Models_py01" (Dynamo 2.12.1.8246)
# packages: Data-Shapes 2021.2.92, Rhythm 2021.1.1, Orchid 260.1.0.7729

# group: Input
file_path = Filename("..\..\ACG_logo.png")
file_from_path = FileObject(path=file_path)
readFromFile = Image.ReadFromFile(file=file_from_path)
code_block = CodeBlock { true; "Cancel"; "Run"; 600; 300; }
code_block_2 = CodeBlock()
# ---------- code_block_2.designscript (2 lines) ----------
"Note:";
"This tool will calculate the area of a given In-Place generic model(s) and write it as instance parameter. Please choose the area type, click Run and select the elements. ";
# ----------------------------------------
textnote_data = Custom[TextNote Data](Title=code_block_2.out0, TextNote=code_block_2.out1)  # package Data-Shapes; Create Data for TextNote input in UI.MultipleInputForm ++ . Check out www.data-shapes.net for more informations
code_block_3 = CodeBlock()
# ---------- code_block_3.designscript (8 lines) ----------
"Choose Area";
[
"NIA",
"GIA",
"GEA"
];

false;
# ----------------------------------------
ui_dropdown_data = Custom[UI.DropDown Data](InputName=code_block_3.out0, Keys=code_block_3.out1, Values=code_block_3.out1, Sorted_optional=code_block_3.out2)  # package Data-Shapes; Create data for DropDown input in UI.MultiInputForm ++ . Check out www.data-shapes.net for more infos.

list_create = List.Create(item0=textnote_data, item1=ui_dropdown_data)

# group (continued): Input
ui_multipleinputform = Custom[UI.MultipleInputForm ++](Logo_optional=readFromFile, ButtonText_optional=code_block.out2, Inputs=list_create, Toggle=code_block.out0, CancelButtonText_optional=code_block.out1, Width_optional=code_block.out3, LabelWidth_optional=code_block.out4)  # package Data-Shapes; Create a form with multiple inputs. see www.data-shapes.net for tutorials and infos!
code_block_4 = CodeBlock(x=ui_multipleinputform.User_Inputs) { area=x[0]+"rea"; }

# group: Input
code_block_5 = CodeBlock { true; Revit.Elements.Category.ByName("Generic Models"); }
await_ = Orchid.Common.DataStream.Await(pass=code_block_5.out1, waitFor=code_block_4)
isolated_pick_model_elements = Custom[Isolated Pick Model Elements](refresh=code_block_5.out0, category=await_)  # package Rhythm; This allows a multiple selection of elements of specified category.

# group: Visualisation
python_script = Python(IN[0]=ui_multipleinputform.Was_Cancelled, IN[1]=isolated_pick_model_elements, IN[2]=code_block_4)  # IronPython2
# ---------- python_script.python (82 lines) ----------
# Load the Python Standard and DesignScript Libraries
import clr
import sys
import os.path
from datetime import datetime
from System import Environment
sys.path.append('C:\Program Files (x86)\IronPython 2.7\Lib')
import System
from System import Array
from System.Collections.Generic import *
clr.AddReference('ProtoGeometry')
from Autodesk.DesignScript.Geometry import *
clr.AddReference("RevitNodes")
import Revit
clr.ImportExtensions(Revit.Elements)
clr.ImportExtensions(Revit.GeometryConversion)
clr.AddReference("RevitServices")
import RevitServices
from RevitServices.Persistence import DocumentManager 
from RevitServices.Transactions import TransactionManager 
clr.AddReference("RevitAPI")
clr.AddReference("RevitAPIUI")
import Autodesk 
from Autodesk.Revit.DB import *
from Autodesk.Revit.UI import *
import time

doc = DocumentManager.Instance.CurrentDBDocument
uiapp = DocumentManager.Instance.CurrentUIApplication 
app = uiapp.Application 
uidoc = uiapp.ActiveUIDocument

# THIS IS IMPORTANT !!!
opt = Autodesk.Revit.DB.Options()

cancelled = IN[0]
units = UnwrapElement(IN[1])
paramName = IN[2]

def getFloorArea(unit):
	floorArea = 0
	allFaces = []

	geometryInstance = unit.get_Geometry(opt)
	instGeom = [i.GetInstanceGeometry() for i in geometryInstance][0]
	listedFaces = [i.Faces for i in instGeom]
	# flatten faces
	for list in listedFaces:
		for face in list:
			allFaces.append(face)
	areas = [i.Area for i in allFaces]
	normals = [i.ComputeNormal(UV(0.5,0.5)) for i in allFaces]
	for normal, area in zip(normals, areas):
		if int(normal.Z) == (-1):
			floorArea += area
	return round(floorArea, 3)
	
if cancelled:
	OUT = 'Erroe : ', 'The script was cancelled.'
elif len(units) < 1:
	OUT = 'Erroe : ', 'There are no elements selected.'
else:
	countInPlace = 0
#	if len(inPlaceUnits) < 1:
#		OUT = 'Erroe : ', 'There are no in-place elements selected.'
#	else:
	TransactionManager.Instance.EnsureInTransaction(doc)
	for i in units:
		try:
			area = getFloorArea(i)
			i.LookupParameter(paramName).Set(area)
			countInPlace += 1
		except:
			continue
		TransactionManager.Instance.TransactionTaskDone()
	
	if countInPlace == 0:
		OUT = 'Erroe : ', 'There are no in-place elements selected.'
	elif countInPlace == 1:
		OUT = 'Success ! ', str(countInPlace) + ' unit was processed'
	elif countInPlace > 1:
		OUT = 'Success ! ', str(countInPlace) + ' units were processed'
# ----------------------------------------
code_block_6 = CodeBlock(x=python_script) { title = x[0]; text = x[1]; }

# group: Assing
code_block_7 = CodeBlock { "Ok"; true; }
textnote_data_2 = Custom[TextNote Data](Title=code_block_6.title, TextNote=code_block_6.text)
multipleinputform = Custom[MultipleInputForm ++](Logo_optional=readFromFile, ButtonText_optional=code_block_7.out0, Inputs=textnote_data_2, Toggle=code_block_7.out1)  # package Data-Shapes; Create a form with multiple inputs. see www.data-shapes.net for tutorials and infos!
