# Dynamo graph Show-Hide Orientation Symbols_py.dyn (Dynamo 2.12.1.8246)
# packages: Data-Shapes 2021.2.92

# group: Usage
code_block = CodeBlock { "Show Wall Orientation Symbol"; }
acg_script_usage = Custom[ACG Script Usage](scriptName=code_block)  # Adds an entry to Excel document every time a script is run. The document is located in S:\Dynamo\05-UsageStats

code_block_2 = CodeBlock { "Run"; "Cancel"; 600; 300; }
code_block_3 = CodeBlock { "Show orientation symbols"; true; }
# note: Pick Design Option and Schedule element
ui_boolean_input = Custom[UI.Boolean input](InputName=code_block_3.out0, DefaultValue=code_block_3.out1)  # package Data-Shapes; Creates a boolean input for UI.MultipleInputForm ++ . Check out www.data-shapes.net for more infos!
list_create = List.Create(item0=ui_boolean_input)
ui_multipleinputform = Custom[UI.MultipleInputForm ++](ButtonText_optional=code_block_2.out0, Inputs=list_create, Toggle=code_block_3.out1, CancelButtonText_optional=code_block_2.out1, Width_optional=code_block_2.out2, LabelWidth_optional=code_block_2.out3)  # package Data-Shapes; Create a form with multiple inputs. see www.data-shapes.net for tutorials and infos!
code_block_4 = CodeBlock(boolean=ui_multipleinputform.User_Inputs) { boolean[0]; }

# group: Visualisation
python_script = Python(IN[0]=ui_multipleinputform.Was_Cancelled, IN[1]=code_block_4)  # IronPython2
# ---------- python_script.python (57 lines) ----------
# Load the Python Standard and DesignScript Libraries
import clr
import sys
import os.path
from datetime import datetime
from System import Environment
sys.path.append('C:\Program Files (x86)\IronPython 2.7\Lib')
import System
from System import Array
from System.Collections.Generic import *
clr.AddReference('ProtoGeometry')
from Autodesk.DesignScript.Geometry import *
clr.AddReference("RevitNodes")
import Revit
clr.ImportExtensions(Revit.Elements)
clr.ImportExtensions(Revit.GeometryConversion)
clr.AddReference("RevitServices")
import RevitServices
from RevitServices.Persistence import DocumentManager 
from RevitServices.Transactions import TransactionManager 

clr.AddReference("RevitAPI")
clr.AddReference("RevitAPIUI")

import Autodesk 
from Autodesk.Revit.DB import *
from Autodesk.Revit.UI import *
import time

doc = DocumentManager.Instance.CurrentDBDocument
uiapp = DocumentManager.Instance.CurrentUIApplication 
app = uiapp.Application 
uidoc = uiapp.ActiveUIDocument

cancelled = IN[0]
tagsOn = IN[1]

if not cancelled:

	gModels = FilteredElementCollector(doc).OfCategory(BuiltInCategory.OST_GenericModel).WhereElementIsElementType().ToElements()
	
	if tagsOn:
		paramValue = 1
	else:
		paramValue = 0
	
	TransactionManager.Instance.EnsureInTransaction(doc)
	for i in gModels:
		try:
			i.LookupParameter('Show Wall Orientation').Set(paramValue)
		except:
			continue
#
#el.LookupParameter('External Balcony').Set(1)
	TransactionManager.Instance.TransactionTaskDone()

OUT = gModels	
# ----------------------------------------
