# Dynamo graph Units - Area Check_py.dyn "Area Check_py" (Dynamo 2.12.1.8246)
# packages: Data-Shapes 2021.2.92

code_block = CodeBlock { "Area Check"; }

# group: Usage
acg_script_usage = Custom[ACG Script Usage](scriptName=code_block)  # Adds an entry to Excel document every time a script is run. The document is located in S:\Dynamo\05-UsageStats

code_block_2 = CodeBlock { "Cancel"; true; "Run"; 600; }

# group: Input
code_block_3 = CodeBlock { "Note:"; }
string = StringInput("""Red   -   Achieved area is below the minimum requirement
Amber   -   Achieved area is above the set tolerance
Green   -   Achieved area is above the minimum required and below the set tolerance
White   -   Unit does not have minimum required NIA area""")
textnote_data = Custom[TextNote Data](Title=code_block_3, TextNote=string)  # package Data-Shapes; Create Data for TextNote input in UI.MultipleInputForm ++ . Check out www.data-shapes.net for more informations
code_block_4 = CodeBlock { "Define oversize tolerance."; 0; 100; 10; 5; }
# note: Set oversize tollerance
slider = Custom[UI.Slider](InputName=code_block_4.out0, Minimum=code_block_4.out1, Maximum=code_block_4.out2, Default_Value=code_block_4.out3, Step=code_block_4.out4)  # package Data-Shapes; Creates slider input for UI.MultipleInputForm ++ . Set the step to decimal value if you want a double slider, or to a integer value if you want an integer slider.
list_create = List.Create(item0=textnote_data, item1=slider)

ui_multipleinputform = Custom[UI.MultipleInputForm ++](ButtonText_optional=code_block_2.out2, Inputs=list_create, Toggle=code_block_2.out1, CancelButtonText_optional=code_block_2.out0, Width_optional=code_block_2.out3)  # package Data-Shapes; Create a form with multiple inputs. see www.data-shapes.net for tutorials and infos!
code_block_5 = CodeBlock(percent=ui_multipleinputform.User_Inputs) { percent[0]; }

# group: Visualisation
not_ = Not(x=ui_multipleinputform.Was_Cancelled)
python_script = Python(IN[0]=not_, IN[1]=code_block_5)  # IronPython2
# ---------- python_script.python (86 lines) ----------
# Load the Python Standard and DesignScript Libraries
import clr
import sys
import os.path
from datetime import datetime
from System import Environment
sys.path.append('C:\Program Files (x86)\IronPython 2.7\Lib')
import System
from System import Array
from System.Collections.Generic import *
clr.AddReference('ProtoGeometry')
from Autodesk.DesignScript.Geometry import *
clr.AddReference("RevitNodes")
import Revit
clr.ImportExtensions(Revit.Elements)
clr.ImportExtensions(Revit.GeometryConversion)
clr.AddReference("RevitServices")
import RevitServices
from RevitServices.Persistence import DocumentManager 
from RevitServices.Transactions import TransactionManager 

clr.AddReference("RevitAPI")
clr.AddReference("RevitAPIUI")

import Autodesk 
from Autodesk.Revit.DB import *
from Autodesk.Revit.UI import *
import time

doc = DocumentManager.Instance.CurrentDBDocument
uiapp = DocumentManager.Instance.CurrentUIApplication 
app = uiapp.Application 
uidoc = uiapp.ActiveUIDocument

runMe = IN[0]
tolerance = IN[1]


redList = []
amberList = []
greenList = []
whiteList = []

osg = OverrideGraphicSettings()
osg.SetSurfaceForegroundPatternColor(Color(50,60,80))
osg.SetSurfaceForegroundPatternId(ElementId(19))

gModels = FilteredElementCollector(doc, doc.ActiveView.Id).OfCategory(BuiltInCategory.OST_GenericModel).WhereElementIsNotElementType().ToElements()

white = Color(255,255,255)
red = Color(232,60,77)
green = Color(0,175,182)
amber = Color(252,192,32)

result = 'All seems ok'

for el in gModels:		
	try:
		TransactionManager.Instance.EnsureInTransaction(doc)
		type = doc.GetElement(el.GetTypeId())
		NIAmin = round(type.LookupParameter('NIA - Minimum').AsDouble() / 10.76391, 2)
		NIA = round(el.LookupParameter('NIArea').AsDouble() / 10.76391, 2)
		NIAtol = NIAmin + (NIAmin * tolerance /100)
		
		if NIAmin == 0 or NIAmin == None:
			doc.ActiveView.SetElementOverrides(el.Id, osg.SetSurfaceForegroundPatternColor(white))
			redList.append(el.Id)
		
		elif NIA < NIAmin:
			doc.ActiveView.SetElementOverrides(el.Id, osg.SetSurfaceForegroundPatternColor(red))
			redList.append(el.Id)
		
		elif NIA >= NIAmin and NIA <= NIAtol:
			doc.ActiveView.SetElementOverrides(el.Id, osg.SetSurfaceForegroundPatternColor(green))
			greenList.append(el.Id)
		
		elif NIA > NIAtol:
			doc.ActiveView.SetElementOverrides(el.Id, osg.SetSurfaceForegroundPatternColor(amber))
			amberList.append(el.Id)

		TransactionManager.Instance.TransactionTaskDone()
	except:
		result = 'nothing working'
	

OUT = result, greenList, NIAtol
# ----------------------------------------
