# Dynamo graph Schedule Residential_py.dyn (Dynamo 2.12.1.8246)
# packages: Data-Shapes 2018.12.1, Data-Shapes 2021.2.92, archi-lab.net 2022.210.2522, Rhythm 2021.1.1, Orchid 260.1.0.7729

# group: Input
file_path = Filename("..\ACG_logo.png")
# note: Pick Design Option and Schedule element
file_from_path = FileObject(path=file_path)
readFromFile = Image.ReadFromFile(file=file_from_path)

# group: Usage
code_block = CodeBlock { "Schedule Residential"; }
acg_script_usage = Custom[ACG Script Usage](scriptName=code_block)  # Adds an entry to Excel document every time a script is run. The document is located in S:\Dynamo\05-UsageStats

# group: Input
get_design_options = Custom[Get Design Options]()  # package archi-lab.net; Queries all of the design options currently in the project.
# note: get design option's set
code_block_2 = CodeBlock { "Design Option Set Id"; }
getParameterValueByName = Element.GetParameterValueByName(element=get_design_options.designOptions, parameterName=code_block_2)
code_block_3 = CodeBlock { "Select a Design Option"; }
name = Element.Name(element=getParameterValueByName)
code_block_4 = CodeBlock(designOption=get_design_options.designOptions, set=name, name=get_design_options.names) { designOption.Id; DOname=set+" - "+name; }

# group: Control
isEmpty = List.IsEmpty(list=getParameterValueByName)

# group: Input
code_block_5 = CodeBlock()
# ---------- code_block_5.designscript (3 lines) ----------
"Note:";

"Please fill in the required input, click Select Schedule Element button and make a selection in the active sheet. If there are no Design Options in the model, just leave the dropdown menu blank. The script will pick up all elements created in the New Construction phase. ";
# ----------------------------------------
textnote_data = Custom[TextNote Data](Title=code_block_5.out0, TextNote=code_block_5.out1)  # package Data-Shapes; Create Data for TextNote input in UI.MultipleInputForm ++ . Check out www.data-shapes.net for more informations
ui_dropdown_data = Custom[UI.DropDown Data](InputName=code_block_3, Keys=code_block_4.DOname, Values=code_block_4.out0)  # package Data-Shapes; Create data for DropDown input in UI.MultiInputForm ++ . Check out www.data-shapes.net for more infos.
code_block_6 = CodeBlock { "Common Property Lines for Design Options?"; true; }
ui_boolean_input = Custom[UI.Boolean input](InputName=code_block_6.out0, DefaultValue=code_block_6.out1)  # package Data-Shapes; Creates a boolean input for UI.MultipleInputForm ++ . Check out www.data-shapes.net for more infos!
code_block_7 = CodeBlock { "Calculate GIA from floors?"; false; }
ui_boolean_input_2 = Custom[UI.Boolean input](InputName=code_block_7.out0, DefaultValue=code_block_7.out1)
code_block_8 = CodeBlock { "Filter units by instance parameter (parameter name):"; "Unit Zone"; }
textbox_data = Custom[TextBox Data](InputName=code_block_8.out0, DefaultText=code_block_8.out1)  # package Data-Shapes; Create Data for TextBox input in UI.MultipleInputForm ++ . Check out www.data-shapes.net for more informations
code_block_9 = CodeBlock { "Parameter value equals:"; ""; }
textbox_data_2 = Custom[TextBox Data](InputName=code_block_9.out0, DefaultText=code_block_9.out1)

# group: Processing
code_block_10 = CodeBlock { DSCore.Types.FindTypeByNameInAssembly("Phase","RevitAPI"); }
all_elements_of_type = ElementsOfType(element_type=code_block_10)
code_block_11 = CodeBlock(ph=all_elements_of_type) { "Select unit phase created."; ph; ph.Name; ph.Id; }
dropdown_data = Custom[DropDown Data](InputName=code_block_11.out0, Keys=code_block_11.out2, Values=code_block_11.out3)  # package Data-Shapes; Create data for DropDown input in UI.MultiInputForm ++ . Check out www.data-shapes.net for more infos.

# group: Input
code_block_12 = CodeBlock { "Select Schedule Element"; "Cancel"; 700; 350; }
list_create = List.Create(item0=textnote_data, item1=ui_dropdown_data, item2=ui_boolean_input, item3=ui_boolean_input_2, item4=textbox_data, item5=textbox_data_2, item6=dropdown_data)
ui_multipleinputform = Custom[UI.MultipleInputForm ++](ButtonText_optional=code_block_12.out0, Inputs=list_create, Toggle=code_block_6.out1, CancelButtonText_optional=code_block_12.out1, Width_optional=code_block_12.out2, LabelWidth_optional=code_block_12.out3)  # package Data-Shapes; Create a form with multiple inputs. see www.data-shapes.net for tutorials and infos!

# group: Input
code_block_13 = CodeBlock { true; }
end = Revit.Transaction.Transaction.End(input=ui_multipleinputform.User_Inputs)
await_ = Orchid.Common.DataStream.Await(pass=code_block_13, waitFor=end)
code_block_14 = CodeBlock { Revit.Elements.Category.ByName("Generic Annotations"); }
# note: select schedule element
ʳʰʸᵗʰᵐ_selection_pick = Rhythm.Revit.Selection.Selection.Pick(runIt=await_, category=code_block_14, singleSelection=await_)
end_2 = Revit.Transaction.Transaction.End(input=ʳʰʸᵗʰᵐ_selection_pick)

# group: Visualisation
code_block_15 = CodeBlock(x=ui_multipleinputform.User_Inputs)
# ---------- code_block_15.designscript (6 lines) ----------
designOptionId = x[0];
phaseId = x[5];
filterParam = x[3];
filterValue = x[4];
commonPropertyLine =x[1];
processFloors = x[2];
# ----------------------------------------
python_script = Python(IN[0]=ui_multipleinputform.Was_Cancelled, IN[1]=code_block_15.designOptionId, IN[2]=code_block_15.phaseId, IN[3]=code_block_15.filterParam, IN[4]=code_block_15.filterValue, IN[5]=end_2, IN[6]=code_block_15.commonPropertyLine, IN[7]=code_block_15.processFloors)  # IronPython2
# ---------- python_script.python (419 lines) ----------
# Load the Python Standard and DesignScript Libraries
import clr
import sys
sys.path.append('C:\Program Files (x86)\IronPython 2.7\Lib')
import System
from System import Array
from System.Collections.Generic import *
clr.AddReference('ProtoGeometry')
from Autodesk.DesignScript.Geometry import *
clr.AddReference("RevitNodes")
import Revit
clr.ImportExtensions(Revit.Elements)
clr.ImportExtensions(Revit.GeometryConversion)
clr.AddReference("RevitServices")
import RevitServices
from RevitServices.Persistence import DocumentManager 
from RevitServices.Transactions import TransactionManager 

clr.AddReference("RevitAPI")
clr.AddReference("RevitAPIUI")

import Autodesk 
from Autodesk.Revit.DB import *
from Autodesk.Revit.UI import *

doc = DocumentManager.Instance.CurrentDBDocument
uiapp = DocumentManager.Instance.CurrentUIApplication 
app = uiapp.Application 
uidoc = uiapp.ActiveUIDocument

cancelled = IN[0]
dOptIdInput = IN[1]
phaseIdInput = IN[2]
filterParam = IN[3]
filterValue = IN[4]
schedule = UnwrapElement(IN[5])
commonPropertyLine = IN[6]
processFloors = IN[7]

mg_dOptFiltered, gm_PhFiltered, gm_Filtered, gm_ResiFiltered = [], [], [], []
fl_dOptFiltered, fl_PhFiltered, fl_Filtered = [], [], []
resiUnits = []
allMarket, allAfford, allSO = [], [], []
resiMarket, resiAfford, resiSO = [], [], []
NIAs = []
listTenures = []


# Get ALL generic models from a given DESIGN OPTION
gmCol = FilteredElementCollector(doc).OfCategory(BuiltInCategory.OST_GenericModel).WhereElementIsNotElementType().ToElements()
if dOptIdInput == None:
	for i in gmCol:
		if i.DesignOption == None:
			mg_dOptFiltered.append(i)
else:
	for i in gmCol:
		dOpt = i.DesignOption
		if dOpt != None:
			dOptId = dOpt.Id
			if dOptId == ElementId(dOptIdInput):
				mg_dOptFiltered.append(i)				
# Get ALL generic models from a given PHASE
for i in mg_dOptFiltered:
	if i.CreatedPhaseId == ElementId(phaseIdInput):
		gm_PhFiltered.append(i)
# Get ALL generic models from a FILTER
if filterValue == None:
	gm_Filtered = gm_PhFiltered
else:
	for i in gm_PhFiltered:
		if i.LookupParameter(filterParam).AsString():
			if filterValue in i.LookupParameter(filterParam).AsString():
				gm_Filtered.append(i) # All units to be PROCESSED			
# Get RESI generic models from a FILTER
for i in gm_Filtered:
	try:
		type = doc.GetElement(i.GetTypeId())
		if 'ACG-4510-Resi' in type.Family.Name:
			gm_ResiFiltered.append(i)
	except:
		continue
# start extracting AREAS			
# get the total GEA
GEA = sum([i.LookupParameter('GEArea').AsDouble()/10.7639 for i in gm_Filtered])
# TENURE groups for GIA & NIA
for i in gm_Filtered:
	try:
		if 'Market' in i.LookupParameter('Tenure').AsString():
			allMarket.append(i)
		elif 'Afford' in i.LookupParameter('Tenure').AsString():
			allAfford.append(i)
		elif 'Shared' in i.LookupParameter('Tenure').AsString():
			allSO.append(i)
	except:
		continue		
for i in gm_ResiFiltered:
	try:
		if 'Market' in i.LookupParameter('Tenure').AsString():
			resiMarket.append(i)
		elif 'Afford' in i.LookupParameter('Tenure').AsString():
			resiAfford.append(i)
		elif 'Shared' in i.LookupParameter('Tenure').AsString():
			resiSO.append(i)
	except:
		continue		

TransactionManager.Instance.EnsureInTransaction(doc)

# PARAGRAPH ZERO - HEADER !!!
prjInfo = FilteredElementCollector(doc).OfCategory(BuiltInCategory.OST_ProjectInformation).ToElements()[0]
schedule.LookupParameter('Project Name').Set(prjInfo.LookupParameter('Project Name').AsString())
inputOpt = doc.GetElement(ElementId(dOptIdInput))
inputOptName = inputOpt.Name
inputOptName.replace(' <primary>', '')
schedule.LookupParameter('Design Option').Set(inputOptName)



# PARAGRAPH ONE - USES !!!
# get USE from all units
uniqueUse = []
for i in gm_Filtered:
	type = doc.GetElement(i.GetTypeId())
	if type.LookupParameter('Use'):
		if type.LookupParameter('Use').AsString() not in uniqueUse:
			uniqueUse.append(type.LookupParameter('Use').AsString())
uniqueUse.sort()
uniqueUse.reverse()
useGIAs = []

# get GIA from the generic models !!!!

#get the GIA from the GENERIC MODELS
if processFloors == False:
	for use in uniqueUse:
		area = 0
		for i in gm_Filtered:
			type = doc.GetElement(i.GetTypeId())
			if type.LookupParameter('Use'):
				if type.LookupParameter('Use').AsString() == use:
					area += i.LookupParameter('GIArea').AsDouble()/10.7639
		useGIAs.append(str(round(area)))
		
#get the GIA from the FLOORS
else:
	flCol = FilteredElementCollector(doc).OfClass(Floor).WhereElementIsNotElementType().ToElements()
	if dOptIdInput == None:
		for i in flCol:
			if i.DesignOption == None:
				fl_dOptFiltered.append(i)
	else:
		for i in flCol:
			dOpt = i.DesignOption
			if dOpt != None:
				dOptId = dOpt.Id
				if dOptId == ElementId(dOptIdInput):
					fl_dOptFiltered.append(i)
	# Get ALL generic models from a given PHASE
	for i in fl_dOptFiltered:
		if i.CreatedPhaseId == ElementId(phaseIdInput):
			fl_Filtered.append(i)
	for use in uniqueUse:
		area = 0
		for floor in fl_Filtered:
			comment = floor.LookupParameter('Comments').AsString()
			if comment:
				if use in comment and 'GIA' in comment:
					area += floor.LookupParameter('Area').AsDouble()
		useGIAs.append(int(area/10.7639))
		
		
# extend the lists
def extendList(list, targetLen):
	return list.extend([''] * (targetLen-len(list)))
	
# assign the values to the schedule
if len(uniqueUse) > 1:
	schedule.LookupParameter('No. Rows - Use').Set(len(uniqueUse))
else:	
	schedule.LookupParameter('No. Rows - Use').Set(2)

extendList(uniqueUse, 5)
extendList(useGIAs, 5)

uniqueUseParam = ['Use 1', 'Use 2', 'Use 3', 'Use 4', 'Use 5']
for use, useParam in zip(uniqueUse, uniqueUseParam):
	schedule.LookupParameter(useParam).Set(use)
useGIAsParam = ['Use GIA 1', 'Use GIA 2', 'Use GIA 3', 'Use GIA 4', 'Use GIA 5']
for useGIA, useGIAparam in zip(useGIAs, useGIAsParam):
	schedule.LookupParameter(useGIAparam).Set(str(useGIA))



# PARAGRAPH TWO - TENURES !!!	
# get areas
def getGIA(unit):
	return (i.LookupParameter('GIArea').AsDouble()/10.7639)
def getNIA(unit):
	return (unit.LookupParameter('NIArea').AsDouble()/10.7639)

NIAmarket = sum([getNIA(i) for i in resiMarket])
NIAafford = sum([getNIA(i) for i in resiAfford])
NIAso = sum([getNIA(i) for i in resiSO])
tenureNIA = [str(round(NIAmarket)), str(round(NIAafford)), str(round(NIAso)), str(sum([round(NIAmarket), round(NIAafford), round(NIAso)]))]

tenureNIAparam = ['Tenure Market - NIA', 'Tenure Afford - NIA', 'Tenure SO - NIA', 'Tenure Total - NIA']
for NIA, tenParam in zip(tenureNIA, tenureNIAparam):
	schedule.LookupParameter(tenParam).Set(NIA)

tenureCount = [str(len(resiMarket)), str(len(resiAfford)), str(len(resiSO)), str(len(gm_ResiFiltered))]
tenureCountParam = ['Tenure Market - Unit No.', 'Tenure Afford - Unit No.', 'Tenure SO - Unit No.', 'Tenure Total - Unit No.']
for count, countParam in zip(tenureCount, tenureCountParam):
	schedule.LookupParameter(countParam).Set(count)

mixMarket = int(round (float(len(resiMarket)) / float(len(gm_ResiFiltered)) * 100))
mixAfford = int(round (float(len(resiAfford)) / float(len(gm_ResiFiltered)) * 100))
mixSO = int(round (float(len(resiSO)) / float(len(gm_ResiFiltered)) * 100))
tenureMix = [mixMarket, mixAfford, mixSO]
tenureMixParam = ['Tenure Market - Mix', 'Tenure Afford - Mix', 'Tenure SO - Mix']
for mix, mixParam in zip(tenureMix, tenureMixParam):
	schedule.LookupParameter(mixParam).Set(str(mix))

resiGIA = sum(getGIA(i) for i in gm_Filtered)
resiNIA = sum([round(NIAmarket), round(NIAafford), round(NIAso)])
ratio = round((float(resiNIA) / float(resiGIA)), 3)
schedule.LookupParameter('Net To Gross Ratio').Set(str(ratio))



# PARAGRAPH THREE - UNIT TYPES !!!!
# get ALL unit types 
unitTypes = []
for i in gm_ResiFiltered:
	typeId = i.GetTypeId()
	type = doc.GetElement(typeId)
	unitTypeValue = type.LookupParameter('Unit Type').AsString()
	if unitTypeValue not in unitTypes:
		unitTypes.append(unitTypeValue)	
unitTypes.sort()							# UNIT TYPES !!!		# UNIT TYPES !!!		# UNIT TYPES !!!

unitTypesExtended = []
for i in unitTypes:
	unitTypesExtended.append(i)
unitTypesExtended.append('Total')
extendList(unitTypesExtended, 15)

# assign uni type values
unitTypeParam = ['Unit Type 1', 'Unit Type 2', 'Unit Type 3', 'Unit Type 4', 'Unit Type 5', 'Unit Type 6', 'Unit Type 7', 'Unit Type 8', 'Unit Type 9', 'Unit Type 10', 'Unit Type 11', 'Unit Type 12']
for type, typeParam in zip(unitTypesExtended, unitTypeParam):
	schedule.LookupParameter(typeParam).Set(type)

# get unit type COUNTS
def typeCount(listTypes, listUnits):
	unitTypesCount = []
	for unitType in listTypes:
		count = 0
		for unit in listUnits:
			type = doc.GetElement(unit.GetTypeId())
			if type.LookupParameter('Unit Type').AsString() == unitType:
				count += 1
		unitTypesCount.append(count)
	return unitTypesCount
	

typesCountMarket = typeCount(unitTypes, resiMarket)
typesCountMarket.append(sum(typesCountMarket))
extendList(typesCountMarket, 15)

typesCountAfford = typeCount(unitTypes, resiAfford)
typesCountAfford.append(sum(typesCountAfford))
extendList(typesCountAfford, 15)

typesCountSO = typeCount(unitTypes, resiSO)
typesCountSO.append(sum(typesCountSO))
extendList(typesCountSO, 15)

typesCountAll = typeCount(unitTypes, gm_ResiFiltered)

# assign market type counts
marketTypesCountParam = ['Tenure1 no. Row 1', 'Tenure1 no. Row 2', 'Tenure1 no. Row 3', 'Tenure1 no. Row 4', 'Tenure1 no. Row 5', 'Tenure1 no. Row 6', 'Tenure1 no. Row 7', 'Tenure1 no. Row 8', 'Tenure1 no. Row 9', 'Tenure1 no. Row 10', 'Tenure1 no. Row 11', 'Tenure1 no. Row 12', 'Tenure1 no. Row 13', 'Tenure1 no. Row 14', 'Tenure1 no. Row 15']
for count, countParam in zip(typesCountMarket, marketTypesCountParam):
	if count != '0':
		schedule.LookupParameter(countParam).Set(str(count))
	else:
		schedule.LookupParameter(countParam).Set('')
		
affordTypesCountParam = ['Tenure2 no. Row 1', 'Tenure2 no. Row 2', 'Tenure2 no. Row 3', 'Tenure2 no. Row 4', 'Tenure2 no. Row 5', 'Tenure2 no. Row 6', 'Tenure2 no. Row 7', 'Tenure2 no. Row 8', 'Tenure2 no. Row 9', 'Tenure2 no. Row 10', 'Tenure2 no. Row 11', 'Tenure2 no. Row 12', 'Tenure2 no. Row 13', 'Tenure2 no. Row 14', 'Tenure2 no. Row 15']
for count, countParam in zip(typesCountAfford, affordTypesCountParam):
	if count != '0':
		schedule.LookupParameter(countParam).Set(str(count))
	else:
		schedule.LookupParameter(countParam).Set('')
		
soTypesCountParam = ['Tenure3 no. Row 1', 'Tenure3 no. Row 2', 'Tenure3 no. Row 3', 'Tenure3 no. Row 4', 'Tenure3 no. Row 5', 'Tenure3 no. Row 6', 'Tenure3 no. Row 7', 'Tenure3 no. Row 8', 'Tenure3 no. Row 9', 'Tenure3 no. Row 10', 'Tenure3 no. Row 11', 'Tenure3 no. Row 12', 'Tenure3 no. Row 13', 'Tenure3 no. Row 14', 'Tenure3 no. Row 15']
for count, countParam in zip(typesCountSO, soTypesCountParam):
	if count != '0':
		schedule.LookupParameter(countParam).Set(str(count))
	else:
		schedule.LookupParameter(countParam).Set('')

# get unit type MIXES
def typeMix(listTypes, listUnits):
	unitTypesMix = []
	for unitType in listTypes:
		count = 0
		countAll = 0
		for unit in listUnits:
			countAll += 1
			type = doc.GetElement(unit.GetTypeId())
			if type.LookupParameter('Unit Type').AsString() == unitType:
				count += 1
		if count == 0 or countAll == 0:
			unitTypesMix.append(0)
		else:
			unitTypesMix.append(int(round(float(count) / countAll * 100)))
	return unitTypesMix
	
marketMix = typeMix(unitTypes, resiMarket)
affordMix = typeMix(unitTypes, resiAfford)
soMix = typeMix(unitTypes, resiSO)

extendList(marketMix, 15)
extendList(affordMix, 15)
extendList(soMix, 15)

marketTypesMixParam = ['Tenure1 Percent Row 1', 'Tenure1 Percent Row 2', 'Tenure1 Percent Row 3', 'Tenure1 Percent Row 4', 'Tenure1 Percent Row 5', 'Tenure1 Percent Row 6', 'Tenure1 Percent Row 7', 'Tenure1 Percent Row 8', 'Tenure1 Percent Row 9', 'Tenure1 Percent Row 10', 'Tenure1 Percent Row 11', 'Tenure1 Percent Row 12', 'Tenure1 Percent Row 13', 'Tenure1 Percent Row 14', 'Tenure1 Percent Row 15']
for mix, mixParam in zip(marketMix, marketTypesMixParam):
	schedule.LookupParameter(mixParam).Set(str(mix))
	
affordTypesMixParam = ['Tenure2 Percent Row 1', 'Tenure2 Percent Row 2', 'Tenure2 Percent Row 3', 'Tenure2 Percent Row 4', 'Tenure2 Percent Row 5', 'Tenure2 Percent Row 6', 'Tenure2 Percent Row 7', 'Tenure2 Percent Row 8', 'Tenure2 Percent Row 9', 'Tenure2 Percent Row 10', 'Tenure2 Percent Row 11', 'Tenure2 Percent Row 12', 'Tenure2 Percent Row 13', 'Tenure2 Percent Row 14', 'Tenure2 Percent Row 15']
for mix, mixParam in zip(affordMix, affordTypesMixParam):
	schedule.LookupParameter(mixParam).Set(str(mix))

	
soTypesMixParam = ['Tenure3 Percent Row 1', 'Tenure3 Percent Row 2', 'Tenure3 Percent Row 3', 'Tenure3 Percent Row 4', 'Tenure3 Percent Row 5', 'Tenure3 Percent Row 6', 'Tenure3 Percent Row 7', 'Tenure3 Percent Row 8', 'Tenure3 Percent Row 9', 'Tenure3 Percent Row 10', 'Tenure3 Percent Row 11', 'Tenure3 Percent Row 12', 'Tenure3 Percent Row 13', 'Tenure3 Percent Row 14', 'Tenure3 Percent Row 15']
for mix, mixParam in zip(soMix, soTypesMixParam):
	schedule.LookupParameter(mixParam).Set(str(mix))


schedule.LookupParameter('No. Rows - Unit Types').Set(len(unitTypes) + 1)



# PARAGRAPH FOUR - UNITS PER HA !!!!
# Get ALL property lines from a givven DESIGN OPTION
plCol = FilteredElementCollector(doc).OfClass(PropertyLine).ToElements()
pl_dOptFiltered = []
if dOptIdInput == None or commonPropertyLine == True:
	for i in plCol:
		if i.DesignOption == None:
			pl_dOptFiltered.append(i)
elif dOptIdInput != None and commonPropertyLine == False:
	for i in plCol:
		dOpt = i.DesignOption
		if dOpt != None:
			dOptId = dOpt.Id
			if dOptId == ElementId(dOptIdInput):
				pl_dOptFiltered.append(i)
plotArea = 0
for i in pl_dOptFiltered:
	plotArea += i.LookupParameter('Area').AsDouble()/107639
unitPeHa = int(round(len(gm_ResiFiltered) / plotArea))
schedule.LookupParameter('Units Per Ha').Set(str(unitPeHa))



# PARAGRAPH FIVE - PARKING !!!!
reqiuredParkign = 0
requiredBikes = 0
for i in gm_Filtered:
	type = doc.GetElement(i.GetTypeId())
	reqiuredParkign += (type.LookupParameter('No. Required Parking Spaces').AsDouble())
	requiredBikes += (type.LookupParameter('No. Required Bike Racks').AsDouble())
schedule.LookupParameter('Parking-Required').Set(str(int(round(reqiuredParkign))))	
schedule.LookupParameter('Bikes-Required').Set(str(int(round(requiredBikes))))
# get all parking
parkCol = FilteredElementCollector(doc).OfCategory(BuiltInCategory.OST_Parking).WhereElementIsNotElementType().ToElements()
# Get ALL generic models from a givven DESIGN OPTION
park_dOptFiltered = []
if dOptIdInput == None:
	for i in parkCol:
		if i.DesignOption == None:
			park_dOptFiltered.append(i)
else:
	for i in parkCol:
		dOpt = i.DesignOption
		if dOpt != None:
			dOptId = dOpt.Id
			if dOptId == ElementId(dOptIdInput):
				park_dOptFiltered.append(i)	
# Get ALL parking elements from a given PHASE
park_PhFiltered = []
for i in park_dOptFiltered:
	if i.CreatedPhaseId == ElementId(phaseIdInput):
		park_PhFiltered.append(i)
# Get ALL parking elements from a FILTER
park_Filtered = []
if filterValue == None:
	park_Filtered = park_PhFiltered
else:
	for i in park_PhFiltered:
		if i.LookupParameter(filterParam).AsString():
			if filterValue in i.LookupParameter(filterParam).AsString():
				park_Filtered.append(i) 								# All parking elements to be PROCESSED !!!
				
achievedParking = 0
achievedBikes = 0
for i in park_Filtered:
	if 'CarParking' in i.Name:
		achievedParking += i.LookupParameter('Number parking spaces').AsInteger()
	elif 'BikeRacks' in i.Name:
		achievedBikes += i.LookupParameter('Number parking spaces').AsInteger()
schedule.LookupParameter('Parking-Achieved').Set(str(achievedParking))
schedule.LookupParameter('Bikes-Achieved').Set(str(achievedBikes))


TransactionManager.Instance.TransactionTaskDone()

OUT = marketMix, affordMix, soMix
# ----------------------------------------
