# Dynamo graph Export PDF & DWG(BeforeAddingPresets).dyn "Export PDF & DWG" (Dynamo 2.6.1.8786)
# packages: Data-Shapes 2021.2.92, Genius Loci 2021.2.3, Orchid 260.1.0.7729, archi-lab.net 2021.25.2521, SteamNodes 1.2.3

today = DateTime.Today()
string_from_object = FromObject(obj=today)
code_block = CodeBlock { " "; }
split = String.Split(str=string_from_object, separator0=code_block)
code_block_2 = CodeBlock(x=split) { x[0]; }
code_block_3 = CodeBlock { "C:\\Users\\"; "\\Documents\\02-ExportedDocuments"; }
userName = Python()  # "System.UserName"; unwired: IN[0]
# ---------- userName.python (3 lines) ----------
import clr
from System import Environment
OUT = Environment.UserName
# ----------------------------------------
code_block_4 = CodeBlock(part1=code_block_3.out0, currentuser=userName, part2=code_block_3.out1) { part1+currentuser+part2; }
file_path = Filename("..\ACG_logo.png")
file_from_path = FileObject(path=file_path)
readFromFile = Image.ReadFromFile(file=file_from_path)
code_block_5 = CodeBlock { "Cancel"; true; "Select Sheets"; "Export"; 700; 250; }
code_block_6 = CodeBlock { "Printing Sheet Set"; }
boolean_input = Custom[Boolean input](InputName=code_block_6)  # package Data-Shapes; Creates a boolean input for UI.MultipleInputForm ++ . Check out www.data-shapes.net for more infos!
code_block_7 = CodeBlock { "Select a Print Setting"; }
collector_of_printsettings = Custom[Collector of Printsettings]()  # package Genius Loci; Collects printsettings and their names in the active or given document. Inspired by an archilab node.
dropdown_data = Custom[DropDown Data](InputName=code_block_7, Keys=collector_of_printsettings.Printsetting_s_name, Values=collector_of_printsettings.Printsetting)  # package Data-Shapes; Create data for DropDown input in UI.MultiInputForm ++ . Check out www.data-shapes.net for more infos.
code_block_8 = CodeBlock { "Export DWG"; }
boolean_input_2 = Custom[Boolean input](InputName=code_block_8)
code_block_9 = CodeBlock { "Select a DWG Export Setup"; }
element_types = ElementTypes("ExportDWGSettings")
all_elements_of_type = ElementsOfType(element_type=element_types)
name = Element.Name(element=all_elements_of_type)
dropdown_data_2 = Custom[DropDown Data](InputName=code_block_9, Keys=name, Values=all_elements_of_type)
code_block_10 = CodeBlock { "Select Printer"; }
python_script = Python()  # unwired: IN[0]
# ---------- python_script.python (8 lines) ----------
import clr
clr.AddReference('System.Drawing')
import System
n = System.Drawing.Printing.PrinterSettings.InstalledPrinters.Count
prt = []
for i in range(n):
	prt.append(System.Drawing.Printing.PrinterSettings.InstalledPrinters[i])
OUT = prt
# ----------------------------------------
dropdown_data_3 = Custom[DropDown Data](InputName=code_block_10, Keys=python_script, Values=python_script)
all = Orchid.RevitProject.Common.Revision.All()
id = Element.Id()  # unwired: element
sortByFunction = List.SortByFunction(list=all, func=id)
code_block_11 = CodeBlock { "Revision Date"; "Revision Description"; }
getParameterValueByName = Element.GetParameterValueByName(element=sortByFunction, parameterName=code_block_11.out0)
getParameterValueByName_2 = Element.GetParameterValueByName(element=sortByFunction, parameterName=code_block_11.out1)
code_block_12 = CodeBlock(date=getParameterValueByName, description=getParameterValueByName_2) { "Select Revision"; date+" - "+description; false; }
dropdown_data_4 = Custom[DropDown Data](InputName=code_block_12.out0, Keys=code_block_12.out1, Values=sortByFunction, Sorted_optional=code_block_12.out2)
list_create = List.Create(item0=boolean_input, item1=dropdown_data, item2=boolean_input_2, item3=dropdown_data_2, item4=dropdown_data_3, item5=dropdown_data_4)
flatten = List.Flatten(list=list_create)
multipleinputform = Custom[MultipleInputForm ++](Logo_optional=readFromFile, ButtonText_optional=code_block_5.out2, Inputs=flatten, Toggle=code_block_5.out1, CancelButtonText_optional=code_block_5.out0, Width_optional=code_block_5.out4, LabelWidth_optional=code_block_5.out5)  # package Data-Shapes; Create a form with multiple inputs. see www.data-shapes.net for tutorials and infos!
code_block_13 = CodeBlock(printWhat=multipleinputform.User_Inputs, revision=multipleinputform.User_Inputs) { printWhat[0]; revision[5]; 700; 250; }
isNull = Object.IsNull(obj=code_block_13.out1)
code_block_14 = CodeBlock { "Select a Sheet Set"; }
all_2 = Orchid.RevitProject.Views.SheetSet.All()
name_2 = Element.Name(element=all_2)
dropdown_data_5 = Custom[DropDown Data](InputName=code_block_14, Keys=name_2, Values=all_2)
code_block_15 = CodeBlock { catSheets=Revit.Elements.Category.ByName("Sheets"); ElementQueries.OfCategory(catSheets); 700; false; }
sheetNumber = Sheet.SheetNumber(sheet=code_block_15.out1)
sheetName = Sheet.SheetName(sheet=code_block_15.out1)
code_block_16 = CodeBlock(number=sheetNumber, name=sheetName) { "Select Sheets"; number +" - "+name; }
listview_data = Custom[Listview Data](InputName=code_block_16.out0, Keys=code_block_16.out1, Values=code_block_15.out1, Height_optionnal=code_block_15.out2, ShowId_optionnal=code_block_15.out3)  # package Data-Shapes; Create data for ListView input in UI.MultiInputForm ++ . Check out www.data-shapes.net for more infos.
if_ = If(test=code_block_13.out0, true=dropdown_data_5, false=listview_data)
multipleinputform_2 = Custom[MultipleInputForm ++](Logo_optional=readFromFile, ButtonText_optional=code_block_5.out3, Inputs=if_, Toggle=code_block_5.out1, CancelButtonText_optional=code_block_5.out0, Width_optional=code_block_13.out2, LabelWidth_optional=code_block_13.out3)

# group: Control
code_block_17 = CodeBlock(x=multipleinputform_2.User_Inputs) { x[0]; }
get_views_from_view_set = Custom[Get Views from View Set](viewSet=code_block_17)  # package archi-lab.net; This node will take a name of a view set and return views/sheet elements contained in it.
# note: sheets or sheetsets
# output = sheets
if_2 = If(test=code_block_13.out0, true=get_views_from_view_set, false=code_block_17)

# note: sheets with revision or just sheets
# output=sheets
addToSheet = Orchid.RevitProject.Common.Revision.AddToSheet(sheet=if_2, revision=code_block_13.out1)
if_3 = If(test=isNull, true=if_2, false=addToSheet)
code_block_18 = CodeBlock(sheets=if_3, printsetting=multipleinputform.User_Inputs, combinefiles=multipleinputform.User_Inputs, exportdwg=multipleinputform.User_Inputs, dwgexportsettign=multipleinputform.User_Inputs, printer=multipleinputform.User_Inputs) { sheets; printsetting[1]; combinefiles[2]; exportdwg[2]; dwgexportsettign[3]; printer[4]; }
code_block_19 = CodeBlock { Revit.Elements.Category.ByName("Project Information"); }

# group: "correct" sheet name
all_elements_of_category = ElementsOfCategory(Category=code_block_19)
code_block_20 = CodeBlock { "Project Number"; }
getParameterValueByName_3 = Element.GetParameterValueByName(element=all_elements_of_category, parameterName=code_block_20)
code_block_21 = CodeBlock { "ACG_Volume"; }
getParameterValueByName_4 = Element.GetParameterValueByName(element=code_block_18.sheets, parameterName=code_block_21)
count = List.Count(list=getParameterValueByName_4)
ofRepeatedItem = List.OfRepeatedItem(item=getParameterValueByName_3, amount=count)
flatten_2 = List.Flatten(list=ofRepeatedItem)
code_block_22 = CodeBlock { "ACG_Level"; }
getParameterValueByName_5 = Element.GetParameterValueByName(element=code_block_18.sheets, parameterName=code_block_22)
code_block_23 = CodeBlock { "ACG_Type"; }
getParameterValueByName_6 = Element.GetParameterValueByName(element=code_block_18.sheets, parameterName=code_block_23)
code_block_24 = CodeBlock { "Sheet Number"; }
getParameterValueByName_7 = Element.GetParameterValueByName(element=code_block_18.sheets, parameterName=code_block_24)
code_block_25 = CodeBlock(prjno=flatten_2, volume=getParameterValueByName_4, level=getParameterValueByName_5, drtype=getParameterValueByName_6, sheetno=getParameterValueByName_7) { prjno+"-ACG-"+volume+"-"+level+"-"+drtype+"-A-"+sheetno; }

code_block_26 = CodeBlock(name=code_block_25) { name+".dwg"; }
watch = Watch(code_block_18.out4)
name_3 = Element.Name(element=watch)
list_create_2 = List.Create(item0=name_3)

# group: Export DWG - GeniusLoci
directoryPath = Watch(code_block_4)
views = Watch(code_block_18.sheets)
fileNames = Watch(code_block_26)
runIt = Watch(code_block_18.out3)
exportSetup = Watch(list_create_2)
export_dwg = Python(IN[0]=directoryPath, IN[1]=views, IN[2]=fileNames, IN[3]=runIt, IN[4]=exportSetup)
# ---------- export_dwg.python (81 lines) ----------
# Copyright(c) 2016, Konrad K Sobon
# @arch_laboratory, http://archi-lab.net

# Import Element wrapper extension methods
import clr
clr.AddReference("RevitNodes")
import Revit
clr.ImportExtensions(Revit.Elements)

# Import DocumentManager and TransactionManager
clr.AddReference("RevitServices")
import RevitServices
from RevitServices.Persistence import DocumentManager
doc = DocumentManager.Instance.CurrentDBDocument

# Import RevitAPI
clr.AddReference("RevitAPI")
import Autodesk
from Autodesk.Revit.DB import *

import System
from System.Collections.Generic import *

import sys
pyt_path = r'C:\Program Files (x86)\IronPython 2.7\Lib'
sys.path.append(pyt_path)

#The inputs to this node will be stored as a list in the IN variable.
dataEnteringNode = IN

def ProcessList(_func, _list):
    return map( lambda x: ProcessList(_func, x) if type(x)==list else _func(x), _list )

def ProcessParallelLists(_func, *lists):
	return map( lambda *xs: ProcessParallelLists(_func, *xs) if all(type(x) is list for x in xs) else _func(*xs), *lists )

def Unwrap(item):
	return UnwrapElement(item)

folderPath = IN[0]

if isinstance(IN[1], list):
	views = ProcessList(Unwrap, IN[1])
else:
	views = list(Unwrap(IN[1]))

if isinstance(IN[2], list):
	names = IN[2]
else:
	names = list(IN[2])

RunIt = IN[3]

Predef = IN[4]

def ExportDwg(name, view, folder = folderPath):
	options = DWGExportOptions()
	options = options.GetPredefinedOptions(doc, Predef[0])
	views = List[ElementId]()
	views.Add(view.Id)
	result = doc.Export(folder, name, views, options)
	return result

if RunIt:
	try:
		errorReport = None
		# run export
		ProcessParallelLists(ExportDwg, names, views)
		
	except:
		# if error accurs anywhere in the process catch it
		import traceback
		errorReport = traceback.format_exc()
else:
	errorReport = "Please set the RunIt to True!"

#Assign your output to the OUT variable
if errorReport == None:
	OUT = "Success"
else:
	OUT = errorReport
# ----------------------------------------

success = Watch(export_dwg)
string = StringInput("\")
code_block_27 = CodeBlock(folder=code_block_4, separator=string) { folder+separator+"NewNames.csv"; }
code_block_28 = CodeBlock { "/"; ""; }
replace = String.Replace(str=code_block_27, searchFor=code_block_28.out0, replaceWith=code_block_28.out1)
exportCSV = Data.ExportCSV(filePath=replace, data=code_block_25)
code_block_29 = CodeBlock(folder=code_block_4, separator=string) { folder+separator+"OldNames.csv"; }
code_block_30 = CodeBlock { "/"; ""; }
replace_2 = String.Replace(str=code_block_29, searchFor=code_block_30.out0, replaceWith=code_block_30.out1)
current = Document.Current()
filePath = Document.FilePath(document=current)
code_block_31 = CodeBlock { false; }
fileName = FileSystem.FileName(path=filePath, withExtension=code_block_31)
sheetNumber_2 = Sheet.SheetNumber(sheet=code_block_18.sheets)
sheetName_2 = Sheet.SheetName(sheet=code_block_18.sheets)

# group: "default" printed sheet names
code_block_32 = CodeBlock(filename=fileName, sheetnumber=sheetNumber_2, sheetname=sheetName_2) { filename+" - Sheet - "+sheetnumber+" - "+sheetname; sheetnumber+" - "+sheetname; }
watch_2 = Watch(code_block_32.out1)

exportCSV_2 = Data.ExportCSV(filePath=replace_2, data=watch_2)
code_block_33 = CodeBlock { "Combine files"; }  # frozen
boolean_input_3 = Custom[Boolean input](InputName=code_block_33)
watch_3 = Watch(if_)
watch_4 = Watch(multipleinputform.User_Inputs)
sheetNumber_3 = Sheet.SheetNumber(sheet=code_block_18.sheets)
name_4 = Element.Name(element=code_block_18.sheets)
code_block_34 = CodeBlock(numb=sheetNumber_3, name=name_4) { numb+" - "+name; }
# note: Print Sheets
code_block_filenametofilepaths = CodeBlock(Directorypath=code_block_4, Filename=code_block_34) { Directorypath+"\\"+Filename+".pdf"; }
watch_5 = Watch(code_block_18.sheets)
print_range = Range("Selected views/sheets")
code_block_35 = CodeBlock { true; false; }
print_pdf_multiple_formats = Custom[Print PDF (multiple formats)](FilePaths=code_block_filenametofilepaths, views=watch_5, PrintSetting=code_block_18.out1, PrinterName=code_block_18.out5, PrintRange=print_range, RunIt=code_block_35.out0)  # package Genius Loci; Initiate a printing routine from a set of views/sheets, filename, printer name, print settings with many formats and print range. Note: With identical names, existing PDF files will be overwritten. Based on an archilab node.

# group: Usage
# note: Custom Node: ACG_Scripts
code_block_36 = CodeBlock { "Export PDF & DWG"; }
acg_script_usage = Custom[ACG Script Usage](scriptName=code_block_36)  # Adds an entry to Excel document every time a script is run. The document is located in S:\Dynamo\05-UsageStats

# group: Assing
isNull_2 = Object.IsNull(obj=code_block_13.out1)
code_block_37 = CodeBlock { false; true; }
if_4 = If(test=isNull_2, true=code_block_37.out0, false=code_block_37.out1)
runMe = Custom[Tool.RunMe](Boolean=if_4, ThingToDo=code_block_18.sheets)  # package SteamNodes; Use Boolean to perform an action
code_block_38 = CodeBlock { "Sheet Phase"; "PRODUCTION"; }
setParameterByName = Element.SetParameterByName(element=runMe, parameterName=code_block_38.out0, value=code_block_38.out1)

watch_6 = Watch(multipleinputform.User_Inputs)
current_2 = Document.Current()
print_pdf_in_document_multiple = Custom[Print PDF in Document (multiple formats)](document=current_2, FilePaths=code_block_filenametofilepaths, views=watch_5, PrintSetting=code_block_18.out1, PrinterName=code_block_18.out5, PrintRange=print_range, RunIt=code_block_35.out0)  # package Genius Loci; Initiate a printing routine from a set of views/sheets, filename, printer name, print settings with many formats and print range from document. Note: With identical names, existing PDF files will be overwritten. Based on an archilab node.
