# Dynamo graph Rename PDF(renameToWIP).dyn "Rename PDF" (Dynamo 2.6.1.8786)
# packages: Orchid 260.1.0.7729, Data-Shapes 2021.2.92, SteamNodes 1.2.3

# group: Usage
# note: Custom Node: ACG_Scripts
code_block = CodeBlock { "Rename PDF"; }
acg_script_usage = Custom[ACG Script Usage](scriptName=code_block)  # Adds an entry to Excel document every time a script is run. The document is located in S:\Dynamo\05-UsageStats

string = StringInput("C:\Users\")
userName = Python()  # "System.UserName"; unwired: IN[0]
# ---------- userName.python (3 lines) ----------
import clr
from System import Environment
OUT = Environment.UserName
# ----------------------------------------
code_block_2 = CodeBlock { "\\Documents\\02-ExportedDocuments"; }
code_block_3 = CodeBlock(part1=string, currentuser=userName, part2=code_block_2) { part1+currentuser+part2; }
code_block_4 = CodeBlock { "pdf"; }
code_block_5 = CodeBlock(part1=string, currentuser=userName, part2=code_block_2) { part1+currentuser+part2; }
string_2 = StringInput("\")
code_block_6 = CodeBlock(directiry=code_block_5, symbol=string_2) { directiry+symbol+"OldNames.csv"; }
importCSV = Data.ImportCSV(filePath=code_block_6)
flatten = List.Flatten(list=importCSV)
code_block_7 = CodeBlock(directiry=code_block_5, symbol=string_2) { directiry+symbol+"NewNames.csv"; }
# note: Collect the names of the printed files
importCSV_2 = Data.ImportCSV(filePath=code_block_7)
flatten_2 = List.Flatten(list=importCSV_2)
rename = Orchid.Common.File.Rename(directory=code_block_3, extension=code_block_4, sourceName=flatten, targetName=flatten_2)
acg_meme_generator = Custom[ACG Meme Generator](Inputs=rename)  # unwired: ReportMessage
file_path = Filename("..\ACG_logo.png")
file_from_path = FileObject(path=file_path)
readFromFile = Image.ReadFromFile(file=file_from_path)
code_block_8 = CodeBlock { "Cancel"; true; "Rename"; "Export"; 700; 300; }
code_block_9 = CodeBlock { "Move to 02 Shared - Externally folder?"; }
ui_boolean_input = Custom[UI.Boolean input](InputName=code_block_9)  # package Data-Shapes; Creates a boolean input for UI.MultipleInputForm ++ . Check out www.data-shapes.net for more infos!
code_block_10 = CodeBlock { "Add description to folder (CamelCase)?"; }
textbox_data = Custom[TextBox Data](InputName=code_block_10)  # package Data-Shapes; Create Data for TextBox input in UI.MultipleInputForm ++ . Check out www.data-shapes.net for more informations
list_create = List.Create(item0=ui_boolean_input, item1=textbox_data)
flatten_3 = List.Flatten(list=list_create)
ui_multipleinputform = Custom[UI.MultipleInputForm ++](Logo_optional=readFromFile, ButtonText_optional=code_block_8.out2, Inputs=flatten_3, Toggle=code_block_8.out1, CancelButtonText_optional=code_block_8.out0, Width_optional=code_block_8.out4, LabelWidth_optional=code_block_8.out5)  # package Data-Shapes; Create a form with multiple inputs. see www.data-shapes.net for tutorials and infos!
code_block_11 = CodeBlock(x=ui_multipleinputform.User_Inputs) { moveFiles=x[0]; description=x[1]; }

# group: To Revit
code_block_12 = CodeBlock { catPI=Revit.Elements.Category.ByName("Project Information"); ElementQueries.OfCategory(catPI); "Project Directory"; }
# note: Get project directory
getParameterValueByName = Element.GetParameterValueByName(element=code_block_12.out1, parameterName=code_block_12.out2)

# group: To Revit
code_block_13 = CodeBlock { DSCore.DateTime.Now; "d"; "/"; }
format = DateTime.Format(dateTime=code_block_13.out0, format=code_block_13.out1)
split = String.Split(str=format, separator0=code_block_13.out2)
code_block_14 = CodeBlock(x=split) { year=x[2]; 0; 2; month=x[0]; day=x[1]; }
remove = String.Remove(str=code_block_14.year, startIndex=code_block_14.out1, count=code_block_14.out2)
# note: Get date
code_block_15 = CodeBlock(yy=remove, mm=code_block_14.month, dd=code_block_14.day) { yy+mm+dd; }

code_block_16 = CodeBlock(str=code_block_11.description) { str==""; ""; "-"+str; }
code_block_17 = CodeBlock(x=code_block_16.out0, a=code_block_16.out1, b=code_block_16.out2) { x?a:b; }

# group: Control
runMe = Custom[Tool.RunMe](Boolean=code_block_11.moveFiles, ThingToDo=getParameterValueByName)  # package SteamNodes; Use Boolean to perform an action
runMe_2 = Custom[Tool.RunMe](Boolean=code_block_11.moveFiles, ThingToDo=code_block_15)
runMe_3 = Custom[Tool.RunMe](Boolean=code_block_11.moveFiles, ThingToDo=code_block_17)

# group: To Revit
code_block_18 = CodeBlock(exportDir=code_block_5, fileName=flatten_2) { exportDir+"\\"+fileName+".pdf"; DSCore.List.Count(fileName); }
await_ = Orchid.Common.DataStream.Await(pass=code_block_18.out0, waitFor=rename)
file_from_path_2 = FileObject(path=await_)
code_block_19 = CodeBlock(prjDir=runMe, dateDir=runMe_2, description=runMe_3) { prjDir+"\\02 Shared - Externally\\Architect\\"+dateDir+description; }
ofRepeatedItem = List.OfRepeatedItem(item=code_block_19, amount=code_block_18.out1)
directory_from_path = DirectoryObject(path=code_block_19)
await_2 = Orchid.Common.DataStream.Await(pass=ofRepeatedItem, waitFor=directory_from_path)
# note: Assemble folder paths
code_block_20 = CodeBlock(sharedDir=await_2, fileName=flatten_2) { sharedDir+"\\"+fileName+".pdf"; true; }

copyFile = FileSystem.CopyFile(file=file_from_path_2, destinationPath=code_block_20.out0, overwrite=code_block_20.out1)
await_3 = Orchid.Common.DataStream.Await(pass=code_block_18.out0, waitFor=copyFile)
runMe_4 = Custom[Tool.RunMe](Boolean=code_block_11.moveFiles, ThingToDo=await_3)
deleteFile = FileSystem.DeleteFile(path=runMe_4)

# group: To Revit
code_block_21 = CodeBlock(exportDir=code_block_5, fileName=flatten_2) { exportDir+"\\"+fileName+".dwg"; DSCore.List.Count(fileName); }
await_4 = Orchid.Common.DataStream.Await(pass=code_block_21.out0, waitFor=rename)
file_from_path_3 = FileObject(path=await_4)
code_block_22 = CodeBlock(prjDir=runMe, dateDir=runMe_2, description=runMe_3) { prjDir+"\\02 Shared - Externally\\Architect\\"+dateDir+description; }
ofRepeatedItem_2 = List.OfRepeatedItem(item=code_block_22, amount=code_block_21.out1)
directory_from_path_2 = DirectoryObject(path=code_block_22)
await_5 = Orchid.Common.DataStream.Await(pass=ofRepeatedItem_2, waitFor=directory_from_path_2)
# note: Assemble folder paths
code_block_23 = CodeBlock(sharedDir=await_5, fileName=flatten_2) { sharedDir+"\\"+fileName+".dwg"; true; }

copyFile_2 = FileSystem.CopyFile(file=file_from_path_3, destinationPath=code_block_23.out0, overwrite=code_block_23.out1)
await_6 = Orchid.Common.DataStream.Await(pass=code_block_21.out0, waitFor=copyFile_2)
runMe_5 = Custom[Tool.RunMe](Boolean=code_block_11.moveFiles, ThingToDo=await_6)
deleteFile_2 = FileSystem.DeleteFile(path=runMe_5)
code_block_24 = CodeBlock {  }
