# Dynamo graph Export PDF & DWG_py.dyn (Dynamo 2.12.1.8246)
# packages: Data-Shapes 2021.2.92, Genius Loci 2021.2.3, Orchid 260.1.0.7729, BumbleBee 2021.25.3, archi-lab.net 2021.25.2521

code_block = CodeBlock { "Export PDF & DWG"; }
acg_script_usage = Custom[ACG Script Usage](scriptName=code_block)  # Adds an entry to Excel document every time a script is run. The document is located in S:\Dynamo\05-UsageStats
string = StringInput("R:\3600_IT\3605_BIM\3605_17_Dynamo\01-Scripts\_Dyno Scripts\Export\NamingPresets.xlsx")
file_path = Filename("..\ACG_logo.png")
file_from_path = FileObject(path=file_path)
readFromFile = Image.ReadFromFile(file=file_from_path)
code_block_2 = CodeBlock { "Cancel"; true; "Select Sheets"; "Export"; 700; 250; }
code_block_3 = CodeBlock { "Printing Sheet Set"; }
boolean_input = Custom[Boolean input](InputName=code_block_3)  # package Data-Shapes; Creates a boolean input for UI.MultipleInputForm ++ . Check out www.data-shapes.net for more infos!
code_block_4 = CodeBlock { "Select a Print Setting (mandatory):"; }
collector_of_printsettings = Custom[Collector of Printsettings]()  # package Genius Loci; Collects printsettings and their names in the active or given document. Inspired by an archilab node.
dropdown_data = Custom[DropDown Data](InputName=code_block_4, Keys=collector_of_printsettings.Printsetting_s_name, Values=collector_of_printsettings.Printsetting)  # package Data-Shapes; Create data for DropDown input in UI.MultiInputForm ++ . Check out www.data-shapes.net for more infos.
code_block_5 = CodeBlock { "Export DWG"; }
boolean_input_2 = Custom[Boolean input](InputName=code_block_5)
code_block_6 = CodeBlock { "Select a DWG Export Setup"; DSCore.Types.FindTypeByNameInAssembly("ExportDWGSettings","RevitAPI"); 0; }
all_elements_of_type = ElementsOfType(element_type=code_block_6.out1)
name = Element.Name(element=all_elements_of_type)
dropdown_data_2 = Custom[DropDown Data](InputName=code_block_6.out0, Keys=name, Values=all_elements_of_type, DefaultValueIndex=code_block_6.out2)
code_block_7 = CodeBlock { "Select Printer (mandatory):"; }
python_script = Python()  # IronPython2; unwired: IN[0]
# ---------- python_script.python (8 lines) ----------
import clr
clr.AddReference('System.Drawing')
import System
n = System.Drawing.Printing.PrinterSettings.InstalledPrinters.Count
prt = []
for i in range(n):
	prt.append(System.Drawing.Printing.PrinterSettings.InstalledPrinters[i])
OUT = prt
# ----------------------------------------
code_block_8 = CodeBlock { "PDFCreator"; }
indexOf = List.IndexOf(list=python_script, element=code_block_8)
dropdown_data_3 = Custom[DropDown Data](InputName=code_block_7, Keys=python_script, Values=python_script, DefaultValueIndex=indexOf)
all = Orchid.RevitProject.Common.Revision.All()
id = Element.Id()  # unwired: element
sortByFunction = List.SortByFunction(list=all, sortFunction=id)
code_block_9 = CodeBlock { "Revision Date"; "Revision Description"; }
getParameterValueByName = Element.GetParameterValueByName(element=sortByFunction, parameterName=code_block_9.out0)
getParameterValueByName_2 = Element.GetParameterValueByName(element=sortByFunction, parameterName=code_block_9.out1)
code_block_10 = CodeBlock(date=getParameterValueByName, description=getParameterValueByName_2) { "Select Revision"; date+" - "+description; false; }
dropdown_data_4 = Custom[DropDown Data](InputName=code_block_10.out0, Keys=code_block_10.out1, Values=sortByFunction, Sorted_optional=code_block_10.out2)
code_block_11 = CodeBlock { "Select Naming Convention"; 0; false; }
file_path_2 = Filename(".\NamingPresets.xlsx")
code_block_12 = CodeBlock { true; "NamingPresets"; true; "A2"; }
read_excel = Custom[Read Excel](filePath=file_path_2, runIt=code_block_12.out0, sheetName=code_block_12.out1, byColumn=code_block_12.out2, origin=code_block_12.out3)  # package BumbleBee; This node will read an excel file. You can read an entore sheet contents, read from specific origin cell, read only specific range, or do all of the former for multiple sheets at the same time.
clear_list = Custom[Clear List](input=read_excel)  # package archi-lab.net; This node will remove all Null and Empty Lists from any list.
code_block_13 = CodeBlock { presetNameCol=0; namingConventionCol=1; }
getItemAtIndex = List.GetItemAtIndex(list=clear_list, index=code_block_13.presetNameCol)
getItemAtIndex_2 = List.GetItemAtIndex(list=clear_list, index=code_block_13.namingConventionCol)
dropdown_data_5 = Custom[DropDown Data](InputName=code_block_11.out0, Keys=getItemAtIndex, Values=getItemAtIndex_2, DefaultValueIndex=code_block_11.out1, Sorted_optional=code_block_11.out2)
code_block_14 = CodeBlock { "Drawn By:"; "Checked By:"; "Approved By:"; }
textbox_data = Custom[TextBox Data](InputName=code_block_14.out0)  # package Data-Shapes; Create Data for TextBox input in UI.MultipleInputForm ++ . Check out www.data-shapes.net for more informations
textbox_data_2 = Custom[TextBox Data](InputName=code_block_14.out1)
textbox_data_3 = Custom[TextBox Data](InputName=code_block_14.out2)
code_block_15 = CodeBlock()
# ---------- code_block_15.designscript (24 lines) ----------
"Suitability Status (mandatory):";

[
"S0 - Initial Status",
"S1 - Suitable for Co-ordination",
"S2 - Suitable for Information",
"S3 - Suitable for Review & Comment",
"S4 - Suitable for Stage Approval",
"S6 - Suitable for PIM Authorization",
"S7 - Suitable for AIM Authorization",
"A1 - Authorized and Accepted",
"A2 - Authorized and Accepted",
"A3 - Authorized and Accepted",
"A4 - Authorized and Accepted",
"B1 - Partial Sign-off",
"B2 - Partial Sign-off",
"B3 - Partial Sign-off",
"B4 - Partial Sign-off",
"CR - As Constructed Record"
];

1;

false;
# ----------------------------------------
dropdown_data_6 = Custom[DropDown Data](InputName=code_block_15.out0, Keys=code_block_15.out1, Values=code_block_15.out1, DefaultValueIndex=code_block_15.out2, Sorted_optional=code_block_15.out3)
list_create = List.Create(item0=boolean_input, item1=dropdown_data, item2=boolean_input_2, item3=dropdown_data_2, item4=dropdown_data_3, item5=dropdown_data_4, item6=dropdown_data_5, item7=textbox_data, item8=textbox_data_2, item9=textbox_data_3, item10=dropdown_data_6)
flatten = List.Flatten(list=list_create)
multipleinputform = Custom[MultipleInputForm ++](Logo_optional=readFromFile, ButtonText_optional=code_block_2.out2, Inputs=flatten, Toggle=code_block_2.out1, CancelButtonText_optional=code_block_2.out0, Width_optional=code_block_2.out4, LabelWidth_optional=code_block_2.out5)  # package Data-Shapes; Create a form with multiple inputs. see www.data-shapes.net for tutorials and infos!
code_block_16 = CodeBlock(printWhat=multipleinputform.User_Inputs) { printWhat[0]; }
code_block_17 = CodeBlock { "Select a Sheet Set"; }
all_2 = Orchid.RevitProject.Views.SheetSet.All()
name_2 = Element.Name(element=all_2)
dropdown_data_7 = Custom[DropDown Data](InputName=code_block_17, Keys=name_2, Values=all_2)
code_block_18 = CodeBlock { catSheets=Revit.Elements.Category.ByName("Sheets"); ElementQueries.OfCategory(catSheets); 700; false; }
sheetNumber = Sheet.SheetNumber(sheet=code_block_18.out1)
sheetName = Sheet.SheetName(sheet=code_block_18.out1)
code_block_19 = CodeBlock(number=sheetNumber, name=sheetName) { "Select Sheets"; number +" - "+name; }
listview_data = Custom[Listview Data](InputName=code_block_19.out0, Keys=code_block_19.out1, Values=code_block_18.out1, Height_optionnal=code_block_18.out2, ShowId_optionnal=code_block_18.out3)  # package Data-Shapes; Create data for ListView input in UI.MultiInputForm ++ . Check out www.data-shapes.net for more infos.
code_block_20 = CodeBlock(x=code_block_16, a=dropdown_data_7, b=listview_data) { x?a:b; }
code_block_21 = CodeBlock { 700; 250; }
multipleinputform_2 = Custom[MultipleInputForm ++](Logo_optional=readFromFile, ButtonText_optional=code_block_2.out3, Inputs=code_block_20, Toggle=code_block_2.out1, CancelButtonText_optional=code_block_2.out0, Width_optional=code_block_21.out0, LabelWidth_optional=code_block_21.out1)
code_block_22 = CodeBlock(x=multipleinputform.User_Inputs, y=multipleinputform_2.User_Inputs)
# ---------- code_block_22.designscript (10 lines) ----------
Sheet_SetBollean = x[0];
Sheet_Set = y[0];
revision = x[5];
drawn = x[7];
checked = x[8];
approved = x[9];
status = x[10];
dwgExportSetting = x[3];
exportDWG = x[2];
namingPreset = x[6];
# ----------------------------------------
python_script_2 = Python(IN[0]=code_block_22.Sheet_SetBollean, IN[1]=code_block_22.Sheet_Set, IN[2]=code_block_22.revision, IN[3]=code_block_22.drawn, IN[4]=code_block_22.checked, IN[5]=code_block_22.approved, IN[6]=code_block_22.status, IN[7]=code_block_22.dwgExportSetting, IN[8]=code_block_22.exportDWG, IN[9]=code_block_22.namingPreset)  # IronPython2
# ---------- python_script_2.python (252 lines) ----------
# Load the Python Standard and DesignScript Libraries
import clr
import sys
import os.path
from System import Environment
sys.path.append('C:\Program Files (x86)\IronPython 2.7\Lib')
import System
from System import Array
from System.Collections.Generic import *
clr.AddReference('ProtoGeometry')
from Autodesk.DesignScript.Geometry import *
clr.AddReference("RevitNodes")
import Revit
clr.ImportExtensions(Revit.Elements)
clr.ImportExtensions(Revit.GeometryConversion)
clr.AddReference("RevitServices")
import RevitServices
from RevitServices.Persistence import DocumentManager 
from RevitServices.Transactions import TransactionManager 

clr.AddReference("RevitAPI")
clr.AddReference("RevitAPIUI")

import Autodesk 
from Autodesk.Revit.DB import *
from Autodesk.Revit.UI import *

doc = DocumentManager.Instance.CurrentDBDocument
uiapp = DocumentManager.Instance.CurrentUIApplication 
app = uiapp.Application 
uidoc = uiapp.ActiveUIDocument

bool = IN[0]
sheets = UnwrapElement(IN[1])
revision = UnwrapElement(IN[2])
drawn = IN[3]
checked =IN[4]
approved = IN[5]
status = IN[6]
DWGexportSetting = UnwrapElement(IN[7]).Name
runDWG = IN[8]
namingPreset = IN[9]
# split the status to code and description
statNo = status.split(' - ')[0]
statDesc = status.split(' - ')[1]

# collect project information
piCol = FilteredElementCollector(doc).OfCategory(BuiltInCategory.OST_ProjectInformation).ToElements()

# input = sheer or sheet set. boolSheetSet = true/false for sheet set
def processSheetSet(input, boolSheetSet):
	sheets = []
	# if the input it sheetset, extract the sheets
	if boolSheetSet:
		views = input.Views
		for s in views:
			i = s.Id
			el = doc.GetElement(i)
			sheets.append(el)
	# id the input is sheets, just pass them
	else:
		sheets = input
	return sheets

# apply revision to the sheet(s)
def addRevToSheets(sheets, rev):
	if rev:	
		for s in sheets:
			curRevIDs = s.GetAdditionalRevisionIds()
			if rev not in curRevIDs:
				curRevIDs.Add(rev.Id)
			else:
				continue
			TransactionManager.Instance.EnsureInTransaction(doc)
			s.SetAdditionalRevisionIds(curRevIDs)
			TransactionManager.Instance.TransactionTaskDone()	
		return rev
	else:
		rev = "No revision input"
		return rev
		
# set drawn, checked, approved parameters to the sheets
def setParameterByName(els, paramName, value):
	for e in els:
		if not value == '':
			TransactionManager.Instance.EnsureInTransaction(doc)
			e.LookupParameter(paramName).Set(value)
			TransactionManager.Instance.TransactionTaskDone
			
# function that assembles a single sheet name. takes Prject Info (as list) and a single sheet
def assembleSheetNumber(projInfo, sheet):
	pNum = projInfo[0].LookupParameter('ACG_Poject Code').AsValueString()
	orig = projInfo[0].LookupParameter('ACG_Originator').AsValueString()
	vol = sheet.LookupParameter('ACG_Volume').AsValueString()
	lvl = sheet.LookupParameter('ACG_Level').AsValueString()
	type = sheet.LookupParameter('ACG_Type').AsValueString()
	role = projInfo[0].LookupParameter('ACG_Role').AsValueString()
	numb = sheet.get_Parameter(BuiltInParameter.SHEET_NUMBER).AsString()
	fileName = pNum + '-' + orig + '-' + vol + '-' + lvl + '-' + type + '-' + role + '-' + numb
	
# function that assembles a single sheet name. takes Prject Info (as list) and a single sheet
def assembleSheetNumber(projInfo, sheets):
	fileNames = []
	for sheet in sheets:
		s = UnwrapElement(sheet)	
		pNum = projInfo[0].LookupParameter('ACG_Poject Code').AsValueString()
		orig = projInfo[0].LookupParameter('ACG_Originator').AsValueString()
		vol = s.LookupParameter('ACG_Volume').AsValueString()
		lvl = s.LookupParameter('ACG_Level').AsValueString()
		type = s.LookupParameter('ACG_Type').AsValueString()
		role = projInfo[0].LookupParameter('ACG_Role').AsValueString()
		numb = s.get_Parameter(BuiltInParameter.SHEET_NUMBER).AsString()
		fileName = pNum + '-' + orig + '-' + vol + '-' + lvl + '-' + type + '-' + role + '-' + numb
		fileNames.append(fileName)
	return fileNames

# function that assembles a single sheet name. takes Prject Info (as list) , a single sheet and a naming convention preset as dingle string
def assembleSheetNumberByPreset(projInfo, sheet, conv):
	s = sheet
	posCodes = ['PRJ','ORG','VOL','LVL','TYP','DIS','NUMB','NAME','REV','STAT']
	prj = projInfo[0].LookupParameter('ACG_Poject Code').AsString()
	org = projInfo[0].LookupParameter('ACG_Originator').AsString()
	vol = s.LookupParameter('ACG_Volume').AsString()
	lvl = s.LookupParameter('ACG_Level').AsString()
	typ = s.LookupParameter('ACG_Type').AsString()
	dis = projInfo[0].LookupParameter('ACG_Role').AsString()
	numb = s.get_Parameter(BuiltInParameter.SHEET_NUMBER).AsString()
	name = s.get_Parameter(BuiltInParameter.SHEET_NAME).AsString()
	stat = s.LookupParameter('Suitability No.').AsString()
	# get the revision number
	rev = 'Poo'
	revIDs = s.GetAdditionalRevisionIds()
	count = 0
	for i in revIDs:
		count += 1
		if count == 0:
			rev = 'Poo'
		elif count < 10:
			rev = 'P0' + str(count)
		else:
			rev = 'P' + str(count)
	sheetCodes = [prj, org, vol, lvl, typ, dis, numb, name, rev, stat]
	for sC, pC in zip(sheetCodes, posCodes):
		conv = conv.replace(pC, sC)	
	return conv

# function that assembles the default name of the exportrd file. takes a single sheet
def getDefaultExportName(sheets):
	fileNames =[]
	for sheet in sheets:
		s = UnwrapElement(sheet)
		numb = sheet.get_Parameter(BuiltInParameter.SHEET_NUMBER).AsString()
		name = sheet.get_Parameter(BuiltInParameter.SHEET_NAME).AsString()
		fileName = numb + ' - ' + name
		fileNames.append(fileName)
	return fileNames
	
def getRevisionNumber(sheets):
	revs = []
	for sheet in sheets:
		IDs = sheet.GetAdditionalRevisionIds()
		if IDs:
			count = 0
			for i in IDs:
				count += 1
				if count < 10:
					rev = 'P0' + str(count)
				else:
					rev = 'P' + str(count)
		else:
			rev = 'no revisions'
		revs.append(rev)
	return revs
	
def getDefaultPDFpaths(defNameList):
	defPaths = []
	userName = Environment.UserName
	for i in defNameList:
		defPDFpath = "C:\\Users\\" + userName + "\\Documents\\02-ExportedDocuments\\" + i + ".pdf"
		defPaths.append(defPDFpath)
	return defPaths	

def exportDWGs(fileNames, sheets, dirPath, DWGExpSet):
	result = []
	for sheet, name in zip(sheets, fileNames):

		setting = DWGExportOptions().GetPredefinedOptions(doc, DWGExpSet)
		# create empty list that holds Ids
		ID = List[ElementId]()
		# add the Id of the view to the empty list
		ID.Add(sheet.Id)
		doc.Export(dirPath, name, ID, setting)
		m = '%s exported as DWG!' % name
		result.append(m)
	return result


# !!!!! execute the functions
sortedSheets = processSheetSet(sheets, bool)
addRevision = addRevToSheets(sortedSheets, revision)
# update the sheet parameters
setParameterByName(sortedSheets, 'Drawn By', drawn)
setParameterByName(sortedSheets, 'Checked By', checked)	
setParameterByName(sortedSheets, 'Approved By', approved)
setParameterByName(sortedSheets, 'Suitability No.', statNo )	
setParameterByName(sortedSheets, 'Suitability Desc.', statDesc)
# get defaul and new names for the PDFs
newNames = []
for sheet in sortedSheets:
	fileName = assembleSheetNumberByPreset(piCol, sheet, namingPreset)
	newNames.append(fileName)



oldNames = getDefaultExportName(sortedSheets)
revNumbers = getRevisionNumber(sortedSheets)
# get the default PDF paths for each sheet (as number - name.pdf)
defPDFpaths = getDefaultPDFpaths(oldNames)

userName = Environment.UserName
dirPath = "C:\\Users\\" + userName + "\\Documents\\02-ExportedDocuments"
# export DWGs
if runDWG:
	expDWG = exportDWGs(newNames, sortedSheets, dirPath, DWGexportSetting)

# export txt file win default names, new names and revision numbers
# assemble path for old and new names

newNamesPath = dirPath + "\\New_Names_Python.txt"
oldNamesPath = dirPath + "\\Old_Names_Python.txt"
revisionsPath = dirPath + "\\Revisions_Python.txt"
# open file in write mode and write the new names
with open(newNamesPath, 'w') as fp:
    for item in newNames:
        # write each item on a new line
        fp.write("%s\n" % item)
# open file in write mode and write the old names
with open(oldNamesPath, 'w') as fp:
    for item in oldNames:
        # write each item on a new line
        fp.write("%s\n" % item)
# open file in write mode and write the sheet numbers and the revisions
with open(revisionsPath, 'w') as fp:
    for name, rev in zip(newNames, revNumbers):
        # write each item on a new line
        fp.write("%s , %s\n" % (name, rev))





OUT = [sortedSheets, addRevision, newNames, oldNames, revNumbers, defPDFpaths, dirPath]
# ----------------------------------------
end = Revit.Transaction.Transaction.End(input=python_script_2)
code_block_23 = CodeBlock(x=end) { sheets=x[0]; revision=x[1]; newNames=x[2]; defaultNames=x[3]; revisionNumbers=x[4]; defaultPDFpaths=x[5]; dirPath=x[6]; }
code_block_24 = CodeBlock(x=multipleinputform.User_Inputs) { printsetting=x[1]; printer=x[4]; }
print_range = Range("Selected views/sheets")
code_block_25 = CodeBlock { true; }
python_script_3 = Python(IN[0]=code_block_23.defaultPDFpaths, IN[1]=code_block_23.sheets, IN[2]=code_block_24.printsetting, IN[3]=code_block_24.printer, IN[4]=print_range, IN[5]=code_block_25)  # IronPython2
# ---------- python_script_3.python (115 lines) ----------
import clr
# Import DocumentManager and TransactionManager
clr.AddReference("RevitServices")
import RevitServices
from RevitServices.Persistence import DocumentManager
from RevitServices.Transactions import TransactionManager
doc = DocumentManager.Instance.CurrentDBDocument

# Import RevitAPI
clr.AddReference("RevitAPI")
import Autodesk
from Autodesk.Revit.DB import *

import System
import sys
sys.path.append(r"C:\Program Files (x86)\IronPython 2.7\Lib")
import os

# Define the inputs
filePath = IN[0]
sheets = UnwrapElement(IN[1])
printSettings = UnwrapElement(IN[2])
printerName = IN[3]
pRange = System.Enum.Parse(Autodesk.Revit.DB.PrintRange, IN[4])
runIt = IN[5]


TransactionManager.Instance.EnsureInTransaction(doc)

# Get the PRINT SETUP object. it could ne list or instance depending on the PRINTER NAME (could be list or instance)
printManager = doc.PrintManager		
printSetup = printManager.PrintSetup
printManager.SelectNewPrintDriver(printerName)
printManager.Apply()								# APPLY to PrintManager

TransactionManager.Instance.TransactionTaskDone()

# !!!!!Creare function that PRINTS !!!! It prints a SINGLE sheet!!!!
def PrintView(doc, sheet, pRange, printerName, filePath, printSetting):
	# create empty VIEW SET object and add the sheet to it
	viewSet = ViewSet()
	viewSet.Insert(sheet)
	# determine print range
	printManager = doc.PrintManager
	printManager.PrintRange = pRange
	printManager.Apply()							# APPLY to PrintManager
	# make new view set current
	viewSheetSetting = printManager.ViewSheetSetting
	viewSheetSetting.CurrentViewSheetSet.Views = viewSet
	# set printer
	printManager.SelectNewPrintDriver(printerName)
	printManager.Apply()							# APPLY to PrintManager
	# set combined and print to file
	printManager.CombinedFile = False
	printManager.Apply()							# APPLY to PrintManager
	printManager.PrintToFile = True
	printManager.Apply()							# APPLY to PrintManager
	# set file path
	printManager.PrintToFileName = filePath
	# delete file. will prevent prompt for override existing. Deletes a file with the same name in the same location. This meant the file will be overwriten
	if os.path.exists(filePath):
		os.remove(filePath)
	printManager.Apply()							# APPLY to PrintManager
	# apply print setting
	try:
		printSetup = printManager.PrintSetup
		printSetup.CurrentPrintSetting = printSetting
		printManager.Apply()
	except:
		pass
	# save settings and submit print
	TransactionManager.Instance.EnsureInTransaction(doc)
	# THIS ACTUALLY PRINTS
	viewSheetSetting.SaveAs("tempSetName")
	printManager.Apply()
	printManager.SubmitPrint()
	viewSheetSetting.Delete()
	
	TransactionManager.Instance.TransactionTaskDone()
	return True
# END OF FUNCTION !!!!



try:
	viewSets = FilteredElementCollector(doc).OfClass(ViewSheetSet)
	for i in viewSets:
		if i.Name == "tempSetName":
			TransactionManager.Instance.EnsureInTransaction(doc)
			doc.Delete(i.Id)
			TransactionManager.Instance.ForceCloseTransaction()
		else:
			continue

	errorReport = None
	message = "Success"
	# this bit executes the FUNCTION ans PRINT the input!!!!
	if runIt:
		for i, fp in zip(sheets, filePath):
			PrintView(doc, i, pRange, printerName, fp, printSettings)

	else:
		message = "Set RunIt to True"
		
# this bit runs only if something in the TRY fails
except:
	# if error accurs anywhere in the process catch it
	import traceback
	errorReport = traceback.format_exc()

# Assign your output to the OUT variable
if errorReport is None:
	OUT = message
else:
	OUT = errorReport
# ----------------------------------------
watch = Watch(multipleinputform.User_Inputs)
code_block_26 = CodeBlock(x=multipleinputform.User_Inputs) { x[1]; }
