# Dynamo graph Rename PDF_py.dyn (Dynamo 2.12.1.8246)
# packages: Data-Shapes 2021.2.92

# group: Usage
# note: Custom Node: ACG_Scripts
code_block = CodeBlock { "Rename PDF"; }
acg_script_usage = Custom[ACG Script Usage](scriptName=code_block)  # Adds an entry to Excel document every time a script is run. The document is located in S:\Dynamo\05-UsageStats

# group: Input
file_path = Filename("..\ACG_logo.png")
file_from_path = FileObject(path=file_path)
readFromFile = Image.ReadFromFile(file=file_from_path)
code_block_2 = CodeBlock { "Move to 01 WIP - Internal Work?"; false; }
ui_boolean_input = Custom[UI.Boolean input](InputName=code_block_2.out0, DefaultValue=code_block_2.out1)  # package Data-Shapes; Creates a boolean input for UI.MultipleInputForm ++ . Check out www.data-shapes.net for more infos!
code_block_3 = CodeBlock { "Add description to folder (CamelCase)?"; }
textbox_data = Custom[TextBox Data](InputName=code_block_3)  # package Data-Shapes; Create Data for TextBox input in UI.MultipleInputForm ++ . Check out www.data-shapes.net for more informations

# group: Input
code_block_4 = CodeBlock { "Cancel"; true; "Rename"; "Export"; 700; 300; }
list_create = List.Create(item0=ui_boolean_input, item1=textbox_data)
flatten = List.Flatten(list=list_create)
ui_multipleinputform = Custom[UI.MultipleInputForm ++](Logo_optional=readFromFile, ButtonText_optional=code_block_4.out2, Inputs=flatten, Toggle=code_block_4.out1, CancelButtonText_optional=code_block_4.out0, Width_optional=code_block_4.out4, LabelWidth_optional=code_block_4.out5)  # package Data-Shapes; Create a form with multiple inputs. see www.data-shapes.net for tutorials and infos!

# group: Visualisation
not_ = Not(x=ui_multipleinputform.Was_Cancelled)
code_block_5 = CodeBlock(x=ui_multipleinputform.User_Inputs) { moveFilesWIP=x[0]; description=x[1]; }
python_script = Python(IN[0]=not_, IN[1]=code_block_5.moveFilesWIP, IN[2]=code_block_5.description)  # IronPython2
# ---------- python_script.python (104 lines) ----------
import clr
clr.AddReference("RevitServices")
import RevitServices
from RevitServices.Persistence import DocumentManager
from RevitServices.Transactions import TransactionManager
doc = DocumentManager.Instance.CurrentDBDocument
clr.AddReference("RevitAPI")
import Autodesk
from Autodesk.Revit.DB import *
import System
import sys
sys.path.append(r"C:\Program Files (x86)\IronPython 2.7\Lib")
import os
import shutil
from datetime import datetime
from System import Environment


# The inputs to this node will be stored as a list in the IN variables.
RunIt = IN[0]
moveToWIP = IN[1]
description = IN[2]

userName = Environment.UserName

# assemple the local path to 02-ExportedDocument
dir = 'C:\\Users\\' + userName +'\\Documents\\02-ExportedDocuments'

oldNamesPath = '\\Old_Names_Python.txt'
newNamesPath = '\\New_Names_Python.txt'

# function
def readFileNames(dir, txtFileName):
	names = []
	path = dir + txtFileName
	f = open(path, 'r')
	lines =  f.readlines()
	for line in lines:
		newLine = line.replace("\n", ".pdf")
		names.append(newLine)
	return names

# function
def findFilesTorRename(dirPath, oldNames):
	files = os.listdir(dirPath)
	filesToRename = []
	for line in oldNames:
		for file in files:
			if file.endswith(line):
				filesToRename.append(file)
	return filesToRename
	
# function
def renameFiles(filesToRename, newNames, localDir):
	renamedPaths = []
	for file, newName in zip(filesToRename, newNames):
 		oldPath = localDir + '\\' + file
 		newPath = localDir + '\\' + newName
 		# check if the renamed file already exists
 		if os.path.exists(newPath):
 			os.remove(newPath)
		os.rename(oldPath, newPath)
		renamedPaths.append(newPath)
	return renamedPaths

# function
def copyFilesToWIP(localPaths, newNames, WIPdir):
	for localPath, newName in zip(localPaths, newNames):
		WIPpath =  WIPdir + '\\' + newName
		if os.path.exists(WIPpath):
			os.remove(WIPpath)
		copy = shutil.copyfile(localPath, WIPpath)
		WIPpaths.append(WIPpath)
	return WIPpaths



oldNames = readFileNames(dir, oldNamesPath)
newNames = readFileNames(dir, newNamesPath)

# find the files that need to renamed in the right order
if RunIt:
	filesToRename = findFilesTorRename(dir, oldNames)
	renamedPaths = renameFiles(filesToRename, newNames, dir)

# assemble the path to the folder where new files must go
if moveToWIP:
	WIPpaths = []
	# get the current date
	date = datetime.today().strftime('%y%m%d')
	# get the project directory path
	pi = FilteredElementCollector(doc).OfCategory(BuiltInCategory.OST_ProjectInformation).ToElements()
	prjDir = pi[0].LookupParameter('Project Directory').AsValueString()
	# grt the full pathi for the new location (01 - WIP)
	WIPdir = prjDir + '\\01 WIP - Internal Work\\' + date + '-' + description
	if not os.path.exists(WIPdir):
		os.mkdir(WIPdir)

	WIPpaths = copyFilesToWIP(renamedPaths, newNames, WIPdir)
else:
	WIPpaths = 'Files not moved to project WIP folder'


OUT = [newNames, renamedPaths, WIPpaths]
# ----------------------------------------
