# Dynamo graph About.dyn "About-Dynamo2.6" (Dynamo 2.6.1.8786)
# packages: Data-Shapes 2021.2.92

file_path = Filename("..\ACG_logo.png")
file_from_path = FileObject(path=file_path)
readFromFile = Image.ReadFromFile(file=file_from_path)
code_block = CodeBlock { "Cancel"; true; "Got it!"; }
code_block_2 = CodeBlock { "Kipple:"; }
string = StringInput("Kipple is useless objects, like junk mail or match folders after you use the last match or gum wrappers or yesterday's homeopape. When nobody's around, kipple reproduces itself.\n")
ui_textnote_data = Custom[UI.TextNote Data](Title=code_block_2, TextNote=string)  # package Data-Shapes; Create Data for TextNote input in UI.MultipleInputForm ++ . Check out www.data-shapes.net for more informations
ui_multipleinputform = Custom[UI.MultipleInputForm ++](Logo_optional=readFromFile, ButtonText_optional=code_block.out2, Inputs=ui_textnote_data, Toggle=code_block.out1)  # package Data-Shapes; Create a form with multiple inputs. see www.data-shapes.net for tutorials and infos!

# group: Usage
code_block_3 = CodeBlock { "About"; }
acg_script_usage = Custom[ACG Script Usage](scriptName=code_block_3)  # Adds an entry to Excel document every time a script is run. The document is located in S:\Dynamo\05-UsageStats
