# Dynamo graph Crop Region - By Room Selection.dyn (Dynamo 2.12.1.8246)
# packages: archi-lab.net 2021.25.2521, Data-Shapes 2021.2.92, Orchid 260.1.0.7729, Rhythm 2021.1.1

file_path = Filename("..\ACG_logo.png")
file_from_path = FileObject(path=file_path)
readFromFile = Image.ReadFromFile(file=file_from_path)

# group: Input
code_block = CodeBlock { "Note:"; }
string = StringInput("""This tool will apply Crop Region in the active view based on a single or multiple rooms selection.
Users have also the option to define offset from the room boundaries (in mm).
Please select the room(s) after pressing the Set Crop Region button.""")
textnote_data = Custom[TextNote Data](Title=code_block, TextNote=string)  # package Data-Shapes; Create Data for TextNote input in UI.MultipleInputForm ++ . Check out www.data-shapes.net for more informations

# group: Input
code_block_2 = CodeBlock { "Offset from room boundary:"; 160; 1000; 300; 10; }
slider = Custom[Slider](InputName=code_block_2.out0, Minimum=code_block_2.out1, Maximum=code_block_2.out2, Default_Value=code_block_2.out3, Step=code_block_2.out4)  # package Data-Shapes; Creates slider input for UI.MultipleInputForm ++ . Set the step to decimal value if you want a double slider, or to a integer value if you want an integer slider.

list_create = List.Create(item0=textnote_data, item1=slider)

# group: Input
code_block_3 = CodeBlock { true; "Set Crop Region"; "Cancel"; false; 600; 300; }
ui_multipleinputform = Custom[UI.MultipleInputForm ++](Logo_optional=readFromFile, ButtonText_optional=code_block_3.out1, Inputs=list_create, Toggle=code_block_3.out0, CancelButtonText_optional=code_block_3.out2, Width_optional=code_block_3.out4, LabelWidth_optional=code_block_3.out5)  # package Data-Shapes; Create a form with multiple inputs. see www.data-shapes.net for tutorials and infos!

# group: Control
end = Revit.Transaction.Transaction.End(input=ui_multipleinputform.User_Inputs)
start = Revit.Transaction.Transaction.Start(input=end)

# group: Input
code_block_4 = CodeBlock { false; Revit.Category.ByName("Rooms"); }
await_ = Orchid.Common.DataStream.Await(pass=code_block_4.out0, waitFor=start)
await_2 = Orchid.Common.DataStream.Await(pass=code_block_4.out1, waitFor=start)
ʳʰʸᵗʰᵐ_selection_pick = Rhythm.Revit.Selection.Selection.Pick(runIt=await_, category=await_2, singleSelection=await_)

code_block_5 = CodeBlock(x=ui_multipleinputform.User_Inputs) { roomSelection=x[0]; offset=x[0]; }

# group: Processing - Get the selected rooms outline with offset
geometry = Element.Geometry(element=ʳʰʸᵗʰᵐ_selection_pick)
bySolid = PolySurface.BySolid(solid=geometry)
surfaces = PolySurface.Surfaces(polySurface=bySolid)
acg_surface_filterbyorientation = Custom[ACG Surface.FilterByOrientation](surfaces=surfaces)  # from Clockwork for Dynamo 2.x
flatten = List.Flatten(list=acg_surface_filterbyorientation.horizontalDown)
perimeterCurves = Surface.PerimeterCurves(surface=flatten)
byJoinedCurves = PolyCurve.ByJoinedCurves(curves=perimeterCurves)
code_block_6 = CodeBlock { false; }
offset = PolyCurve.Offset(polyCurve=byJoinedCurves, signedDistance=code_block_5.offset, extendCircular=code_block_6)
byPatch = Surface.ByPatch(closedCurve=offset)
byUnion = Surface.ByUnion(surfaces=byPatch)
perimeterCurves_2 = Surface.PerimeterCurves(surface=byUnion)

# group: Assing
current = Document.Current()
activeView = Document.ActiveView(document=current)
setCropBoxByCurves = archilab.Revit.Views.Views.SetCropBoxByCurves(view=activeView, curves=perimeterCurves_2)

# group: Control
code_block_7 = CodeBlock { "Crop Region - By Room Selection"; }
acg_script_usage = Custom[ACG Script Usage](scriptName=code_block_7)  # Adds an entry to Excel document every time a script is run. The document is located in S:\Dynamo\05-UsageStats

watch = Watch(ʳʰʸᵗʰᵐ_selection_pick)
