# Dynamo graph Element - Isolate In Active View.dyn (Dynamo 2.12.1.8246)
# packages: archi-lab.net 2021.25.2521, Data-Shapes 2021.2.92

file_path = Filename("..\ACG_logo.png")
file_from_path = FileObject(path=file_path)
readFromFile = Image.ReadFromFile(file=file_from_path)
code_block = CodeBlock { true; "Isolate"; "Cancel"; false; 800; 400; }

# group: Input
code_block_2 = CodeBlock { "Note:"; }
string = StringInput("""This tool will search for families which names contain a user defined string and isolate them in the active view.
Use Reset Temporary Isolate/Hide to bring all elements back to the view.""")
textnote_data = Custom[TextNote Data](Title=code_block_2, TextNote=string)  # package Data-Shapes; Create Data for TextNote input in UI.MultipleInputForm ++ . Check out www.data-shapes.net for more informations

# group: Input
code_block_3 = CodeBlock { "Type part of the family name:"; }
textbox_data = Custom[TextBox Data](InputName=code_block_3)  # package Data-Shapes; Create Data for TextBox input in UI.MultipleInputForm ++ . Check out www.data-shapes.net for more informations

list_create = List.Create(item0=textnote_data, item1=textbox_data)
ui_multipleinputform = Custom[UI.MultipleInputForm ++](Logo_optional=readFromFile, ButtonText_optional=code_block.out1, Inputs=list_create, Toggle=code_block.out0, CancelButtonText_optional=code_block.out2, Width_optional=code_block.out4, LabelWidth_optional=code_block.out5)  # package Data-Shapes; Create a form with multiple inputs. see www.data-shapes.net for tutorials and infos!

# group: Input
code_block_4 = CodeBlock(x=ui_multipleinputform.User_Inputs) { strng=x[0]; }

# group: Processing
all_elements_in_active_view = ElementsInView()
getFamily = FamilyInstance.GetFamily(familyInstance=all_elements_in_active_view)
isNull = Object.IsNull(object=getFamily)
filterByBoolMask = List.FilterByBoolMask(list=all_elements_in_active_view, mask=isNull)
filterByBoolMask_2 = List.FilterByBoolMask(list=getFamily, mask=isNull)
code_block_5 = CodeBlock(fam=filterByBoolMask_2.out, str=code_block_4) { fam.Name; str; true; }
contains = String.Contains(string=code_block_5.out0, searchFor=code_block_5.str, ignoreCase=code_block_5.out2)
filterByBoolMask_3 = List.FilterByBoolMask(list=filterByBoolMask.out, mask=contains)
current = Document.Current()
activeView = Document.ActiveView(document=current)

isolate_in_view = Custom[Isolate in View](element=filterByBoolMask_3.in, view=activeView)  # package archi-lab.net; This node will take input of elements and a view to isolate selected elements in a view.

# group: Visualisation
code_block_6 = CodeBlock { 235; }
byARGB = Color.ByARGB(red=code_block_6, green=code_block_6, blue=code_block_6)  # frozen
byProperties = Revit.Filter.OverrideGraphicSettings.ByProperties(cutFillColor=byARGB, projectionFillColor=byARGB, cutLineColor=byARGB, projectionLineColor=byARGB)
overrideInView = Element.OverrideInView(element=filterByBoolMask_3.out, overrides=byProperties)

# group: Control
code_block_7 = CodeBlock { "Element - Isolate in Active View"; }
acg_script_usage = Custom[ACG Script Usage](scriptName=code_block_7)  # Adds an entry to Excel document every time a script is run. The document is located in S:\Dynamo\05-UsageStats
