# Dynamo graph Mass - From Rooms.dyn "Masses - From Rooms" (Dynamo 2.12.0.5650)
# packages: WombatDynamo 2.3.0, archi-lab.net 2021.25.2521, Orchid 260.1.0.7729, Data-Shapes 2021.2.92

# group: Input
code_block = CodeBlock { catR=Revit.Category.ByName("Rooms"); allR=ElementQueries.OfCategory(catR); "ACG-4510-RoomMass_"; }

# group: Filtering
code_block_2 = CodeBlock { catM=Revit.Category.ByName("Mass"); allM=ElementQueries.OfCategory(catM); }
# note: collect all room masses existing in the model
code_block_3 = CodeBlock(e=code_block_2.allM) { e.Name; }
startsWith = String.StartsWith(string=code_block_3, searchFor=code_block.out2)
# note: mass elements [IN]
filterByBoolMask = List.FilterByBoolMask(list=code_block_2.allM, mask=startsWith)

# group: Visualisation
delete = archilab.Revit.Elements.Elements.Delete(element=filterByBoolMask.in)

# group: Input
selectAll = WombatDynamo.Workset.SelectAll()
code_block_4 = CodeBlock(e=selectAll) { "A-Coordination"; "Select Workset."; e.Name; }
indexOf = List.IndexOf(list=code_block_4.out2, element=code_block_4.out0)
dropdown_data = Custom[DropDown Data](InputName=code_block_4.out1, Keys=code_block_4.out2, Values=code_block_4.out2, DefaultValueIndex=indexOf)  # package Data-Shapes; Create data for DropDown input in UI.MultiInputForm ++ . Check out www.data-shapes.net for more infos.

# group: Input
code_block_5 = CodeBlock { DSCore.Types.FindTypeByNameInAssembly("Phase","RevitAPI"); }
all_elements_of_type = ElementsOfType(element_type=code_block_5)
code_block_6 = CodeBlock(ph=all_elements_of_type) { "Select rooms' Phase."; ph.Name; }
dropdown_data_2 = Custom[DropDown Data](InputName=code_block_6.out0, Keys=code_block_6.out1, Values=code_block_6.out1)

# group: Input
file_path = Filename("..\ACG_logo.png")
file_from_path = FileObject(path=file_path)
readFromFile = Image.ReadFromFile(file=file_from_path)
code_block_7 = CodeBlock { "Generate"; "Cancel"; 600; 350; true; }
code_block_8 = CodeBlock { "Note:"; }
string = StringInput("""This tool will generate mass elements from rooms in the model. Users are able to specify minimal area for the rooms that will be used. Any room with area less than what is specified will be ignored.
All masses will be placed in A-Coordination workset. Please make sure this workset is created in the model before running the script. Number and name of each room will be transferred as Mark parameter value in the respective mass. ID of each room element will be transferred as Comments value. The script will delete previous masses each time it's run.
For more information please refer to the Revit Tutorials channel in MS Stream.
""")
# note: Custom Node: Data-Shapes v.2018.12.1
ui_textnote_data = Custom[UI.TextNote Data](Title=code_block_8, TextNote=string)  # package Data-Shapes; Create Data for TextNote input in UI.MultipleInputForm ++ . Check out www.data-shapes.net for more informations
code_block_9 = CodeBlock { "Minimal room area (m2)"; "1"; true; }

textbox_data = Custom[TextBox Data](InputName=code_block_9.out0, DefaultText=code_block_9.out1, IsNumberEntry=code_block_9.out2)  # package Data-Shapes; Create Data for TextBox input in UI.MultipleInputForm ++ . Check out www.data-shapes.net for more informations

# group (continued): Input
list_create = List.Create(item0=ui_textnote_data, item1=textbox_data, item2=dropdown_data, item3=dropdown_data_2)
ui_multipleinputform = Custom[UI.MultipleInputForm ++](Logo_optional=readFromFile, ButtonText_optional=code_block_7.out0, Inputs=list_create, Toggle=code_block_7.out4, CancelButtonText_optional=code_block_7.out1, Width_optional=code_block_7.out2, LabelWidth_optional=code_block_7.out3)  # package Data-Shapes; Create a form with multiple inputs. see www.data-shapes.net for tutorials and infos!

code_block_10 = CodeBlock(x=ui_multipleinputform.User_Inputs) { minArea=x[0]; worsetName=x[1]; phaseName=x[2]; }

# group: Control
await_ = Orchid.Common.DataStream.Await(pass=code_block.allR, waitFor=delete)
area = Room.Area(room=await_)
# note: filer rooms with valid area
code_block_11 = CodeBlock(area=area, minArea=code_block_10.minArea) { area>minArea; }
filterByBoolMask_2 = List.FilterByBoolMask(list=await_, mask=code_block_11)

# group: Control
code_block_12 = CodeBlock { "Phase"; }
getParameterValueByName = Element.GetParameterValueByName(element=filterByBoolMask_2.in, parameterName=code_block_12)
# note: filter rooms from selected phase
code_block_13 = CodeBlock(ph=getParameterValueByName, input=code_block_10.phaseName) { ph.Name==input; }
filterByBoolMask_3 = List.FilterByBoolMask(list=filterByBoolMask_2.in, mask=code_block_13)

# group: Processing
coreBoundary = Room.CoreBoundary(room=filterByBoolMask_3.in)
code_block_14 = CodeBlock { 0; }
getItemAtIndex = List.GetItemAtIndex(list=coreBoundary@@L3, index=code_block_14)
code_block_15 = CodeBlock { 1; }
byJoinedCurves = PolyCurve.ByJoinedCurves(curves=getItemAtIndex, joinTolerance=code_block_15)
code_block_16 = CodeBlock { "Limit Offset"; }
getParameterValueByName_2 = Element.GetParameterValueByName(element=filterByBoolMask_3.in, parameterName=code_block_16)
# note: get room geometry
extrudeAsSolid = Curve.ExtrudeAsSolid(curve=byJoinedCurves, distance=getParameterValueByName_2)

# group: Processing
code_block_17 = CodeBlock { "Number"; "Name"; }
getParameterValueByName_3 = Element.GetParameterValueByName(element=filterByBoolMask_3.in, parameterName=code_block_17.out0)
getParameterValueByName_4 = Element.GetParameterValueByName(element=filterByBoolMask_3.in, parameterName=code_block_17.out1)
code_block_18 = CodeBlock(prfix=code_block.out2, number=getParameterValueByName_3, name=getParameterValueByName_4) { prfix+number+"_"+name; }

# group: Processing
byName = WombatDynamo.Workset.ByName(name=code_block_10.worsetName)
code_block_19 = CodeBlock(e=byName) { worset=e.Id; "Workset"; "Comments"; "Mark"; "Phase Created"; }

# group: Processing
string_from_object = FromObject(obj=filterByBoolMask_3.in)
code_block_20 = CodeBlock { "."; }
# note: convert id to string
split = String.Split(string=string_from_object, separator0=code_block_20)
firstItem = List.FirstItem(list=split@@L2)

# group: Assing
code_block_21 = CodeBlock { catM=Revit.Category.ByName("Mass"); }
byGeometry = DirectShape.ByGeometry(geometry=extrudeAsSolid, category=code_block_21, name=code_block_18)
setParameterByName = Element.SetParameterByName(element=byGeometry, parameterName=code_block_19.out1, value=code_block_19.worset)
setParameterByName_2 = Element.SetParameterByName(element=byGeometry, parameterName=code_block_19.out2, value=firstItem)
setParameterByName_3 = Element.SetParameterByName(element=byGeometry, parameterName=code_block_19.out3, value=code_block_18)
phaseByName = Orchid.RevitProject.Elements.Element.PhaseByName(name=code_block_10.phaseName)
setParameterByName_4 = Element.SetParameterByName(element=byGeometry, parameterName=code_block_19.out4, value=phaseByName)

# group: Usage
code_block_22 = CodeBlock { "Mass - From Rooms"; }
acg_script_usage = Custom[ACG Script Usage](scriptName=code_block_22)  # Adds an entry to Excel document every time a script is run. The document is located in S:\Dynamo\05-UsageStats

watch = Watch(ui_multipleinputform.User_Inputs)
