# Dynamo graph Mass - Heat Loss Form Coef.dyn (Dynamo 2.6.1.8786)
# packages: Bakery 2019.5.8, Data-Shapes 2021.2.92, archi-lab.net 2021.25.2521

# group: CHANGE LOG
# note: Version:
# <1.x: Description of change>

# group: DESIGNER'S GUIDELINES
# note: Designer's guidelines:
# 1. Divide Dynamo script into groups: "Input", "Processing" and "Output".
# 2. Colour code groups according to the template.
# 3. Script should be broken up into small groups of nodes.
# 4. Groups of "Processing" nodes should always have Input/Output
# 5. Rename Input/Output groups depending on their function.
# 6. Fill out script information for users.

# group: <PROJECT NUMBER> <PROJECT NAME>
# note: Created by: Ivo Petrov
# Created: 01/07/2020
# Version: 1.0
# Last edited: 01/07/2020
# Dynamo version: Dynamo 2.0.3
# Packages:
# <Packages>
# Notes:
# N/A

# group: INPUT
# note: INPUT
# Use:
# For the incomming references: file paths, geometries.

# group: PROCESSING
# note: DESIGN
# Use:
# For the back-end fuctionality.

# group: WIP
# note: WIP
# Use:
# For in-progress not tested nodes.

# group: MONITOR
# note: MONITOR
# Use:
# For important watch nodes.

# group: FILTERING DATA
# note: FILTERING DATA
# Use:
# For filtering list data: filter by bool mask, sort groups by key.

# group: OUTPUT
# note: OUTPUT
# Use:
# For final output.

# group: DYNAMO GRAPHIC STANDARD
# note: AYRE CHAMBERLAIN GAUNT
# Creted by: Ivo Petrov
# Created: 01/06/2020
# Varsion: 1.0
# Last undated: 01/06/2020
# Dynamo version: 2.0.3
# Notes:
# All scripts to follow graphic standards for ease of use by other members on the design team.

# group: CONTROL
# note: CONTROL
# Use:
# For user input: sliders, numbers, selecting levels, etc.

# group: Collect all Areas
code_block = CodeBlock { Revit.Category.ByName("Areas"); }
all_elements_of_category = ElementsOfCategory(Category=code_block)

# group: Collect all Area schemes
code_block_2 = CodeBlock { "Area Scheme Id"; "Area Use"; }
getParameterValueByName = Element.GetParameterValueByName(element=all_elements_of_category, parameterName=code_block_2.out0)
uniqueItems = List.UniqueItems(list=getParameterValueByName)
name = Element.Name(element=uniqueItems)

file_path = Filename("..\ACG_logo.png")
file_from_path = FileObject(path=file_path)
readFromFile = Image.ReadFromFile(file=file_from_path)
code_block_3 = CodeBlock { "Cancel"; true; "Run"; 500; 200; }
code_block_4 = CodeBlock { "Use Area elements"; true; }
ui_boolean_input = Custom[UI.Boolean input](InputName=code_block_4.out0, DefaultValue=code_block_4.out1)  # package Data-Shapes; Creates a boolean input for UI.MultipleInputForm ++ . Check out www.data-shapes.net for more infos!
code_block_5 = CodeBlock { "Select GIA Area Scheme"; "Select Mass(es)"; "Select"; Revit.Category.ByName("Mass"); false; }
ui_dropdown_data = Custom[UI.DropDown Data](InputName=code_block_5.out0, Keys=name, Values=name)  # package Data-Shapes; Create data for DropDown input in UI.MultiInputForm ++ . Check out www.data-shapes.net for more infos.
ui_selectmodelelements_data = Custom[UI.SelectModelElements Data](InputName=code_block_5.out1, ButtonText=code_block_5.out2, CategoryFilter=code_block_5.out3, SelectSingleElement=code_block_5.out4)  # package Data-Shapes; Creates a Revit element selection input for UI.MultipleInputForm++ . Check out www.data-shapes.net for more infos!
list_create = List.Create(item0=ui_boolean_input, item1=ui_dropdown_data, item2=ui_selectmodelelements_data)
ui_multipleinputform = Custom[UI.MultipleInputForm ++](Logo_optional=readFromFile, ButtonText_optional=code_block_3.out2, Inputs=list_create, Toggle=code_block_3.out1, CancelButtonText_optional=code_block_3.out0, Width_optional=code_block_3.out3, LabelWidth_optional=code_block_3.out4)  # package Data-Shapes; Create a form with multiple inputs. see www.data-shapes.net for tutorials and infos!
code_block_6 = CodeBlock(areasOrRooms=ui_multipleinputform.User_Inputs, areaScheme=ui_multipleinputform.User_Inputs, masses=ui_multipleinputform.User_Inputs) { areasOrRooms[0]; areaScheme[1]; masses[2]; }

# group: Calculate Total GIA
name_2 = Element.Name(element=getParameterValueByName)
eq = name_2 == code_block_6.out1
filterByBoolMask = List.FilterByBoolMask(list=all_elements_of_category, mask=eq)
boundaries = Custom[Room.Boundaries](room=filterByBoolMask.in)  # package archi-lab.net; This node returns all Room bounding curves and elements that generated them (walls, separation lines etc).
startPoint = Curve.StartPoint(curve=boundaries.curve)
Z = Point.Z(point=startPoint)
uniqueItems_2 = List.UniqueItems(list=Z@L2)
flatten = List.Flatten(list=uniqueItems_2)
code_block_7 = CodeBlock { 0; }
ge = flatten >= code_block_7
filterByBoolMask_2 = List.FilterByBoolMask(mask=ge)  # unwired: list
code_block_8 = CodeBlock { "Area"; }
getParameterValueByName_2 = Element.GetParameterValueByName(element=filterByBoolMask.in, parameterName=code_block_8)
remove_empty_strings_from_list = Custom[Remove Empty Strings from List](listOfStrings=getParameterValueByName_2)  # package Bakery
sum = Math.Sum(values=remove_empty_strings_from_list)

# group: Collect all Rooms
code_block_9 = CodeBlock { Revit.Category.ByName("Rooms"); }
all_elements_of_category_2 = ElementsOfCategory(Category=code_block_9)

# group: Calculate Total NIA
boundaries_2 = Custom[Room.Boundaries](room=all_elements_of_category_2)
startPoint_2 = Curve.StartPoint(curve=boundaries_2.curve)
Z_2 = Point.Z(point=startPoint_2)
uniqueItems_3 = List.UniqueItems(list=Z_2@L2)
flatten_2 = List.Flatten(list=uniqueItems_3)
code_block_10 = CodeBlock { 0; }
ge_2 = flatten_2 >= code_block_10
filterByBoolMask_3 = List.FilterByBoolMask(mask=ge_2)  # unwired: list
code_block_11 = CodeBlock { "Area"; }
getParameterValueByName_3 = Element.GetParameterValueByName(element=all_elements_of_category_2, parameterName=code_block_11)
remove_empty_strings_from_list_2 = Custom[Remove Empty Strings from List](listOfStrings=getParameterValueByName_3)
sum_2 = Math.Sum(values=remove_empty_strings_from_list_2)

geometry = Element.Geometry(element=code_block_6.out2)
flatten_3 = List.Flatten(list=geometry)
byUnion = Solid.ByUnion(solids=flatten_3)
bySolid = PolySurface.BySolid(solid=byUnion)
surfaces = PolySurface.Surfaces(polySurface=bySolid)
acg_surface_filterbyorientation = Custom[ACG Surface.FilterByOrientation](surfaces=surfaces)  # from Clockwork for Dynamo 2.x
area = Surface.Area(surface=acg_surface_filterbyorientation.Vertical)
sum_3 = Math.Sum(values=area)
code_block_12 = CodeBlock(area=sum_3) { area/1000000; }
area_2 = Surface.Area(surface=acg_surface_filterbyorientation.HorizontalUp)
sum_4 = Math.Sum(values=area_2)
code_block_13 = CodeBlock(area=sum_4) { area/1000000; }
perimeterCurves = Surface.PerimeterCurves(surface=acg_surface_filterbyorientation.horizontalDown)
startPoint_3 = Curve.StartPoint(curve=perimeterCurves)
Z_3 = Point.Z(point=startPoint_3)
uniqueItems_4 = List.UniqueItems(list=Z_3@@L2)
flatten_4 = List.Flatten(list=uniqueItems_4)
sortIndexByValue = List.SortIndexByValue(list=flatten_4)
code_block_14 = CodeBlock(x=sortIndexByValue) { x[0]; }
removeItemAtIndex = List.RemoveItemAtIndex(list=acg_surface_filterbyorientation.horizontalDown, indices=code_block_14)
area_3 = Surface.Area(surface=removeItemAtIndex)
code_block_15 = CodeBlock { -1; }
dropItems = List.DropItems(list=area_3, amount=code_block_15)
sum_5 = Math.Sum(values=dropItems)
code_block_16 = CodeBlock(area=sum_5) { area/1000000; }
code_block_17 = CodeBlock(verticap=code_block_12, horizontalup=code_block_13, horizontaldown=code_block_16) { verticap+horizontalup+horizontaldown; }
round = Math.Round(number=code_block_17)
code_block_18 = CodeBlock(result=round) { result+"m2"; }

# group: Usage
code_block_19 = CodeBlock { "Mass - Heat Loss Form Coef"; }
acg_script_usage = Custom[ACG Script Usage](scriptName=code_block_19)  # Adds an entry to Excel document every time a script is run. The document is located in S:\Dynamo\05-UsageStats

round_2 = Math.Round(number=sum)
round_3 = Math.Round(number=sum_2)
if_ = If(test=code_block_6.out0, true=round_2, false=round_3)
code_block_20 = CodeBlock(envelopeArea=round, NetFloorArea=round_2) { envelopeArea/NetFloorArea; }
code_block_21 = CodeBlock(envelopeArea=round, NetFloorArea=round_3) { envelopeArea/NetFloorArea; }
if_2 = If(test=code_block_6.out0, true=code_block_20, false=code_block_21)
code_block_22 = CodeBlock(resultarea=if_, resultenvelope=round, resultcoef=if_2) { "Internal Floor Area: "+resultarea; "Envelope Area: "+resultenvelope; "Heat Loss Form Coefficient: "+resultcoef; }
code_block_23 = CodeBlock { "\n"; }
concat = String.Concat(string0=code_block_22.out1, string1=code_block_23, string2=code_block_22.out0, string3=code_block_23, string4=code_block_22.out2)

# group: Input
file_path_2 = Filename("..\ACG_logo.png")
file_from_path_2 = FileObject(path=file_path_2)
readFromFile_2 = Image.ReadFromFile(file=file_from_path_2)
code_block_24 = CodeBlock { "Result:"; true; "Got it!"; 500; 200; }
textnote_data = Custom[TextNote Data](TextNote=concat)  # package Data-Shapes; Create Data for TextNote input in UI.MultipleInputForm ++ . Check out www.data-shapes.net for more informations
multipleinputform = Custom[MultipleInputForm ++](Logo_optional=readFromFile_2, ButtonText_optional=code_block_24.out2, Inputs=textnote_data, Toggle=code_block_24.out1, Width_optional=code_block_24.out3, LabelWidth_optional=code_block_24.out4)  # package Data-Shapes; Create a form with multiple inputs. see www.data-shapes.net for tutorials and infos!

watch = Watch(code_block_6.out2)
