# Dynamo graph Materials - Write Keynote Value To Parameter_py.dyn "Materials - Write Keynote Value To Parameter" (Dynamo 2.12.1.8246)
# packages: Data-Shapes 2021.2.92

code_block = CodeBlock { catM=Revit.Category.ByName("Materials"); allM=ElementQueries.OfCategory(catM); "Keynote"; }  # frozen
getParameterValueByName = Element.GetParameterValueByName(element=code_block.allM, parameterName=code_block.out2)
code_block_2 = CodeBlock(value=getParameterValueByName) { value==""; value; "OM Namah Narayana"; }

# group: Input
code_block_3 = CodeBlock { "Navigate to the project's Keynote file:"; }
filepath_data = Custom[FilePath Data](InputName=code_block_3)  # package Data-Shapes; Create filepath input for UI.MultipleInputForm ++ . Check out www.data-shapes.net for more infos !
code_block_4 = CodeBlock { "Enter parameter name:"; "Model"; }
textbox_data = Custom[TextBox Data](InputName=code_block_4.out0, DefaultText=code_block_4.out1)  # package Data-Shapes; Create Data for TextBox input in UI.MultipleInputForm ++ . Check out www.data-shapes.net for more informations

# group: Input
file_path = Filename("..\ACG_logo.png")
file_from_path = FileObject(path=file_path)
readFromFile = Image.ReadFromFile(file=file_from_path)
code_block_5 = CodeBlock { "Select Category"; true; "Apply"; "Cancel"; false; 800; 350; }
code_block_6 = CodeBlock { "Note:"; }
string = StringInput("""This tool will read the keynote values of all materials in the model and white them and the keynote description into a given material parameter. The parameter can be default or custom, and it needs to be text parameter (recommended to use Model).
Please make sure this parameter is not used for any other purpose.""")
textnote_data = Custom[TextNote Data](Title=code_block_6, TextNote=string)  # package Data-Shapes; Create Data for TextNote input in UI.MultipleInputForm ++ . Check out www.data-shapes.net for more informations
list_create = List.Create(item0=textnote_data, item1=filepath_data, item2=textbox_data)
ui_multipleinputform = Custom[UI.MultipleInputForm ++](Logo_optional=readFromFile, ButtonText_optional=code_block_5.out2, Inputs=list_create, Toggle=code_block_5.out1, CancelButtonText_optional=code_block_5.out3, Width_optional=code_block_5.out5, LabelWidth_optional=code_block_5.out6)  # package Data-Shapes; Create a form with multiple inputs. see www.data-shapes.net for tutorials and infos!

code_block_7 = CodeBlock(x=ui_multipleinputform.User_Inputs) { filePath=x[0]; paramName=x[1]; }
file_from_path_2 = FileObject(path=code_block_7.filePath)  # frozen
readText = FileSystem.ReadText(file=file_from_path_2)
code_block_8 = CodeBlock { "\n"; }
split = String.Split(string=readText, separator0=code_block_8)
code_block_9 = CodeBlock(lines=split) { lng=DSCore.String.Length(lines); lng>4; }
filterByBoolMask = List.FilterByBoolMask(list=split, mask=code_block_9.out1)
addItemToFront = List.AddItemToFront(item=code_block_2.out2, list=filterByBoolMask.in)
if_ = If(test=code_block_2.out0, true=code_block_2.out2, false=code_block_2.value)
contains = String.Contains(string=addItemToFront, searchFor=if_@@L1)
code_block_10 = CodeBlock { true; }
indexOf = List.IndexOf(list=contains@L2, element=code_block_10)
code_block_11 = CodeBlock(index=indexOf) { index+1; }
getItemAtIndex = List.GetItemAtIndex(list=addItemToFront, index=code_block_11)
code_block_12 = CodeBlock(result=getItemAtIndex) { result==null; ""; result; }
if_2 = If(test=code_block_12.out0, true=code_block_12.out1, false=code_block_12.result)

# group: Assing
code_block_13 = CodeBlock { "Model"; }
setParameterByName = Element.SetParameterByName(element=code_block.allM, parameterName=code_block_13, value=if_2)

# group: Control
code_block_14 = CodeBlock { "Materials - Write Keynote Values To Parameter"; }
acg_script_usage = Custom[ACG Script Usage](scriptName=code_block_14)  # Adds an entry to Excel document every time a script is run. The document is located in S:\Dynamo\05-UsageStats

watch = Watch(ui_multipleinputform.User_Inputs)
code_block_15 = CodeBlock { " "; }

# group: Visualisation
python_script = Python(IN[0]=code_block_7.filePath, IN[1]=code_block_7.paramName)  # IronPython2
# ---------- python_script.python (101 lines) ----------
"""
This script will read a txt Keynote file and create a list with all the elements

i[0] = CODE
i[1] = DESCRIPTION
....
i[2] = BIM CODE
i[3] = CAWS SECTION
"""

# Load the Python Standard and DesignScript Libraries
import clr
# Load the Python Standard and DesignScript Libraries
import clr
import sys
sys.path.append('C:\Program Files (x86)\IronPython 2.7\Lib')
import System
from System import Array
from System.Collections.Generic import *
clr.AddReference('ProtoGeometry')
from Autodesk.DesignScript.Geometry import *
clr.AddReference("RevitNodes")
import Revit
clr.ImportExtensions(Revit.Elements)
clr.ImportExtensions(Revit.GeometryConversion)
clr.AddReference("RevitServices")
import RevitServices
from RevitServices.Persistence import DocumentManager 
from RevitServices.Transactions import TransactionManager 


clr.AddReference("RevitAPI")
clr.AddReference("RevitAPIUI")

import Autodesk 
from Autodesk.Revit.DB import *
from Autodesk.Revit.UI import *

doc = DocumentManager.Instance.CurrentDBDocument
uiapp = DocumentManager.Instance.CurrentUIApplication 
app = uiapp.Application 
uidoc = uiapp.ActiveUIDocument
import re

# The inputs to this node will be stored as a list in the IN variables.
filePath = IN[0]
paramName = IN[1]

matCol = FilteredElementCollector(doc).OfCategory(BuiltInCategory.OST_Materials).WhereElementIsNotElementType().ToElements()

def dataFromKeynote(path):
# Read a keynote txt file and format the data as (a nested) list
	with open(path, "r") as file:
		# go through each line and append it to a list
		lines = []
		for line in file:
			lines.append(line)
		# break each line into a list
		entryList = []
		for i in lines:
			entry = re.split(r'\t+', i)
			if entry[0] != '':
				entryList.append(entry)
		return entryList
		
		
def createCodeDescrList(keynoteList):
# read the keynote nested list and export a single "code + description" list
	cdList = []
	for line in keynoteList:
		codeDescription = line[0]+'_'+line[1]
		cdList.append(codeDescription)
	return cdList
	
	
def setParamByCodeList(codeDescriptList, elements, paramName):
# collect the Keynote parameter value, check it against a list and write the code+description value to a given parameter (must be text)
	report = []
	TransactionManager.Instance.EnsureInTransaction(doc)	
	for m in elements:
		keynoteValue = m.get_Parameter(BuiltInParameter.KEYNOTE_PARAM).AsValueString()
		# ignore if there is no Keynote value
		if not keynoteValue:
			continue
		# match with input list if there is input value
		else:
			for line in codeDescriptList:
				if keynoteValue in line:
					keynoteValue = line
			m.LookupParameter(paramName).Set(str(keynoteValue))
		report.append(keynoteValue)
	TransactionManager.Instance.TransactionTaskDone()
		
# Run the functions!!
keynoteList = dataFromKeynote(filePath)
c_dList = createCodeDescrList(keynoteList)
task = setParamByCodeList(c_dList, matCol, paramName )


# Assign your output to the OUT variable.
OUT = c_dList
# ----------------------------------------
