# Dynamo graph Railings - Update Escape Distance_py.dyn "Railings - Update Escape Distance" (Dynamo 2.12.1.8246)
# packages: archi-lab.net 2021.25.2521, Data-Shapes 2021.2.92, SteamNodes 1.2.3

file_path = Filename("..\ACG_logo.png")
file_from_path = FileObject(path=file_path)
readFromFile = Image.ReadFromFile(file=file_from_path)

# group: Input
code_block = CodeBlock { true; "Run"; "Cancel"; false; 700; 350; }
code_block_2 = CodeBlock { "Note:"; }
string = StringInput("""This tool will update the value of the ACG_Escape Distance parameter to all railing elements in the model containing "Escape" in their Type Name.
For more detailed information on how to prepare escape route drawings, please refer to the Revit Tutorials channel on MS Stream.""")
textnote_data = Custom[TextNote Data](Title=code_block_2, TextNote=string)  # package Data-Shapes; Create Data for TextNote input in UI.MultipleInputForm ++ . Check out www.data-shapes.net for more informations

ui_multipleinputform = Custom[UI.MultipleInputForm ++](Logo_optional=readFromFile, ButtonText_optional=code_block.out1, Inputs=textnote_data, Toggle=code_block.out0, CancelButtonText_optional=code_block.out2, Width_optional=code_block.out4, LabelWidth_optional=code_block.out5)  # package Data-Shapes; Create a form with multiple inputs. see www.data-shapes.net for tutorials and infos!

# group: Processing
not_ = Not(x=ui_multipleinputform.Was_Cancelled)
code_block_3 = CodeBlock { c=Revit.Category.ByName("Railings"); ElementQueries.OfCategory(c); }  # frozen
runMe = Custom[Tool.RunMe](Boolean=not_, ThingToDo=code_block_3.out1)  # package SteamNodes; Use Boolean to perform an action
type = archilab.Revit.Elements.Elements.Type(element=runMe)
code_block_4 = CodeBlock(tp=type) { "Escape"; tp.Name; }
contains = String.Contains(string=code_block_4.out1, searchFor=code_block_4.out0)
filterByBoolMask = List.FilterByBoolMask(list=runMe, mask=contains)

# group: Visualisation
code_block_5 = CodeBlock { "Length"; "ACG_Escape Distance"; }
getParameterValueByName = Element.GetParameterValueByName(element=filterByBoolMask.in, parameterName=code_block_5.out0)
setParameterByName = Element.SetParameterByName(element=filterByBoolMask.in, parameterName=code_block_5.out1, value=getParameterValueByName)

# group: Control
code_block_6 = CodeBlock { "Railings - Update Escape Distance"; }
acg_script_usage = Custom[ACG Script Usage](scriptName=code_block_6)  # Adds an entry to Excel document every time a script is run. The document is located in S:\Dynamo\05-UsageStats

# group: Visualisation
not_2 = Not(x=ui_multipleinputform.Was_Cancelled)
python_script = Python(IN[0]=not_2)  # IronPython2
# ---------- python_script.python (61 lines) ----------
# Load the Python Standard and DesignScript Libraries
import clr
import sys
sys.path.append('C:\Program Files (x86)\IronPython 2.7\Lib')
import System
from System import Array
from System.Collections.Generic import *
clr.AddReference('ProtoGeometry')
from Autodesk.DesignScript.Geometry import *
clr.AddReference("RevitNodes")
import Revit
clr.ImportExtensions(Revit.Elements)
clr.ImportExtensions(Revit.GeometryConversion)
clr.AddReference("RevitServices")
import RevitServices
from RevitServices.Persistence import DocumentManager 
from RevitServices.Transactions import TransactionManager 

clr.AddReference("RevitAPI")
clr.AddReference("RevitAPIUI")

import Autodesk 
from Autodesk.Revit.DB import *
from Autodesk.Revit.UI import *

doc = DocumentManager.Instance.CurrentDBDocument
uiapp = DocumentManager.Instance.CurrentUIApplication 
app = uiapp.Application 
uidoc = uiapp.ActiveUIDocument

typeIDs = []
escapeRailings = []
temp = []

runMe = IN[0]

if runMe:
# collect all railing in the model
	rTypeCol = FilteredElementCollector(doc).OfCategory(BuiltInCategory.OST_StairsRailing).WhereElementIsElementType().ToElements()

# collect the names of all "Escape" railing types
	for r in rTypeCol:
		if 'Escape' in r.get_Parameter(BuiltInParameter.SYMBOL_NAME_PARAM).AsValueString():
			typeIDs.append(str(r.Id))
		
	

# collect all instaces of "Escape" types and push the value to the ACG_Escape Distance parameter
	rCol = FilteredElementCollector(doc).OfCategory(BuiltInCategory.OST_StairsRailing).WhereElementIsNotElementType().ToElements()

	TransactionManager.Instance.EnsureInTransaction(doc)
	for r in rCol:
		rTypeID = r.GetTypeId()
		if str(rTypeID) in typeIDs:
			lng = r.LookupParameter('Length').AsValueString()
			r.LookupParameter('ACG_Escape Distance').Set(float(lng)/304.8)
			temp.append(lng)
	TransactionManager.Instance.TransactionTaskDone()

	
	OUT = temp
# ----------------------------------------
