# Dynamo graph Schedule - Export Embodied CO2 to Excel.dyn (Dynamo 2.12.1.8246)
# packages: Orchid 260.1.0.7729, Data-Shapes 2021.2.92, bimorphNodes 3.0.3

# group: Usage
code_block = CodeBlock { "Schedule - Export Embodied CO2 to Excel"; }  # frozen
acg_script_usage = Custom[ACG Script Usage](scriptName=code_block)  # Adds an entry to Excel document every time a script is run. The document is located in S:\Dynamo\05-UsageStats

code_block_2 = CodeBlock { "Export complete"; }
list_create = List.Create()  # unwired: item0, item1
await_ = Orchid.Common.DataStream.Await(pass=code_block_2, waitFor=list_create)

# group: Input
file_path = Filename("..\ACG_logo.png")
file_from_path = FileObject(path=file_path)
readFromFile = Image.ReadFromFile(file=file_from_path)
code_block_3 = CodeBlock { "Result:"; true; "Got it!"; }
textnote_data = Custom[TextNote Data](Title=code_block_3.out0, TextNote=await_)  # package Data-Shapes; Create Data for TextNote input in UI.MultipleInputForm ++ . Check out www.data-shapes.net for more informations
multipleinputform = Custom[MultipleInputForm ++](Logo_optional=readFromFile, ButtonText_optional=code_block_3.out2, Inputs=textnote_data)  # package Data-Shapes; Create a form with multiple inputs. see www.data-shapes.net for tutorials and infos!

file_path_2 = Filename("..\ACG_logo.png")  # frozen
file_from_path_2 = FileObject(path=file_path_2)
readFromFile_2 = Image.ReadFromFile(file=file_from_path_2)
code_block_4 = CodeBlock { "Cancel"; true; "Export"; 500; 200; }
code_block_5 = CodeBlock()
# ---------- code_block_5.designscript (9 lines) ----------
"Enter sheet name";
"Sheet1";
false;

"Overwride old data";
true;
"Navigate to Excel file";

"Select Schedules to export";
# ----------------------------------------
all = Orchid.RevitProject.Schedules.Schedule.All()  # frozen
name = Element.Name(element=all)
code_block_6 = CodeBlock { "<Revision"; }
contains = String.Contains(string=name, searchFor=code_block_6)
filterByBoolMask = List.FilterByBoolMask(list=all, mask=contains)
name_2 = Element.Name(element=filterByBoolMask.out)
ui_listview_data = Custom[UI.Listview Data](InputName=code_block_5.out6, Keys=name_2, Values=filterByBoolMask.out, ShowId_optionnal=code_block_5.out2)  # package Data-Shapes; Create data for ListView input in UI.MultiInputForm ++ . Check out www.data-shapes.net for more infos.
ui_filepath_data = Custom[UI.FilePath Data](InputName=code_block_5.out5)  # package Data-Shapes; Create filepath input for UI.MultipleInputForm ++ . Check out www.data-shapes.net for more infos !
ui_textbox_data = Custom[UI.TextBox Data](InputName=code_block_5.out0, DefaultText=code_block_5.out1, IsNumberEntry=code_block_5.out2)  # package Data-Shapes; Create Data for TextBox input in UI.MultipleInputForm ++ . Check out www.data-shapes.net for more informations
ui_boolean_input = Custom[UI.Boolean input](InputName=code_block_5.out3, DefaultValue=code_block_5.out4)  # package Data-Shapes; Creates a boolean input for UI.MultipleInputForm ++ . Check out www.data-shapes.net for more infos!
list_create_2 = List.Create(item0=ui_listview_data, item1=ui_filepath_data, item2=ui_textbox_data, item3=ui_boolean_input)
ui_multipleinputform = Custom[UI.MultipleInputForm ++](Logo_optional=readFromFile_2, ButtonText_optional=code_block_4.out2, Inputs=list_create_2, Toggle=code_block_4.out1, CancelButtonText_optional=code_block_4.out0, Width_optional=code_block_4.out3, LabelWidth_optional=code_block_4.out4)  # package Data-Shapes; Create a form with multiple inputs. see www.data-shapes.net for tutorials and infos!
code_block_7 = CodeBlock(schedule=ui_multipleinputform.User_Inputs, filePath=ui_multipleinputform.User_Inputs, sheetName=ui_multipleinputform.User_Inputs, override=ui_multipleinputform.User_Inputs) { schedule[0]; filePath[1]; true; sheetName[2]; override[3]; }
getData = Revit.Schedule.GetData(scheduleView=code_block_7.out0, removeHeading=code_block_7.out2)
code_block_8 = CodeBlock { 1; }
flatten = List.Flatten(list=getData, amount=code_block_8)
clean = List.Clean(list=flatten)
count = List.Count(list=clean@@L2)
code_block_9 = CodeBlock(count=count) { count==1; }
filterByBoolMask_2 = List.FilterByBoolMask(list=clean, mask=code_block_9)
code_block_10 = CodeBlock { 0; "Grand total:"; }
getItemAtIndex = List.GetItemAtIndex(list=filterByBoolMask_2.out@@L2, index=code_block_10.out0)
groupByKey = List.GroupByKey(list=filterByBoolMask_2.out, keys=getItemAtIndex)
code_block_11 = CodeBlock { 0; ""; }
insert = List.Insert(list=groupByKey.uniqueKeys, element=code_block_11.out1, index=code_block_11.out0)
code_block_12 = CodeBlock(types=insert) { rows=DSCore.List.Count(types); offset=rows+5; 0; 1; }
exportExcel = Data.ExportExcel(filePath=code_block_7.out1, sheetName=code_block_7.out3, startRow=code_block_12.offset, startColumn=code_block_12.out2, data=flatten, overWrite=code_block_7.out4)
code_block_13 = CodeBlock { 1; 4; }
getItemAtIndex_2 = List.GetItemAtIndex(list=groupByKey.groups@@L2, index=code_block_13.out0)
code_block_14 = CodeBlock(lst=getItemAtIndex_2) { materials=DSCore.List.Flatten(lst); DSCore.List.UniqueItems(materials); }
getItemAtIndex_3 = List.GetItemAtIndex(list=groupByKey.groups@@L2, index=code_block_13.out1)
ACGGGGG = Custom[ACGGGGG](seq=code_block_14.out1, keys=getItemAtIndex_2@L2, values=getItemAtIndex_3@@L2)
isNull = Object.IsNull(object=ACGGGGG@L2)
code_block_15 = CodeBlock { 0; }
if_ = If(test=isNull, true=code_block_15, false=ACGGGGG)
insert_2 = List.Insert(list=if_, element=code_block_14.out1, index=code_block_11.out0)
transpose = List.Transpose(lists=insert_2)
insert_3 = List.Insert(list=transpose, element=insert, index=code_block_11.out0)
transpose_2 = List.Transpose(lists=insert_3)
exportExcel_2 = Data.ExportExcel(filePath=code_block_7.out1, sheetName=code_block_7.out3, startRow=code_block_12.out3, startColumn=code_block_12.out2, data=transpose_2, overWrite=code_block_7.out4)
list_create_3 = List.Create(item0=exportExcel, item1=exportExcel_2)
flatten_2 = List.Flatten(list=list_create_3)
acg_meme_generator = Custom[ACG Meme Generator](Inputs=flatten_2)  # unwired: ReportMessage

# group: Processing
code_block_16 = CodeBlock { schedule: Revit.Elements.Views.ScheduleView; }  # unwired: schedule
python_script = Python(IN[0]=code_block_16)  # IronPython2
# ---------- python_script.python (38 lines) ----------
# Made by Gavin Crump
# Free for use
# BIM Guru, www.bimguru.com.au

# Boilerplate text
import clr

clr.AddReference("RevitServices")
import RevitServices
from RevitServices.Persistence import DocumentManager 

clr.AddReference("RevitAPI")
from Autodesk.Revit.DB import *

# Current doc/app/ui
doc = DocumentManager.Instance.CurrentDBDocument

# Preparing input from dynamo to revit
sched = UnwrapElement(IN[0])

# Retrieve data from the schedule
tableData = sched.GetTableData()
sectionData = tableData.GetSectionData(SectionType.Body)
numbRows = sectionData.NumberOfRows
numbCols = sectionData.NumberOfColumns

# Create list with schedule data with rows as second level lists
data = []

for i in range(numbRows):
    rows = []
    for j in range(numbCols):
        content = sched.GetCellText(SectionType.Body, i, j)
        rows.append(content)
    data.append(rows)

# Preparing output to Dynamo
OUT = data
# ----------------------------------------
code_block_17 = CodeBlock(scheduleText=python_script) { scheduleText; }
