# Dynamo graph Tags - Remove By Value_py.dyn "Tags - Remove By Value" (Dynamo 2.12.1.8246)
# packages: Data-Shapes 2021.2.92

# note: collects all the tag type in the active view

# group: Control
code_block = CodeBlock { "Tags - Remove By Value"; }
acg_script_usage = Custom[ACG Script Usage](scriptName=code_block)  # Adds an entry to Excel document every time a script is run. The document is located in S:\Dynamo\05-UsageStats

file_path = Filename("..\ACG_logo.png")
file_from_path = FileObject(path=file_path)
readFromFile = Image.ReadFromFile(file=file_from_path)

# group: Input
code_block_2 = CodeBlock { "Note:"; }
string = StringInput("This tool will remove all tags in the active view by of a given type and a given value of the host element.")
textnote_data = Custom[TextNote Data](Title=code_block_2, TextNote=string)  # package Data-Shapes; Create Data for TextNote input in UI.MultipleInputForm ++ . Check out www.data-shapes.net for more informations

# group: Input
code_block_3 = CodeBlock { "Parameter values:"; ""; }
textbox_data = Custom[TextBox Data](InputName=code_block_3.out0, DefaultText=code_block_3.out1)  # package Data-Shapes; Create Data for TextBox input in UI.MultipleInputForm ++ . Check out www.data-shapes.net for more informations
python_script = Python()  # IronPython2
# ---------- python_script.python (56 lines) ----------
# Load the Python Standard and DesignScript Libraries
import clr
import sys
import os.path
from datetime import datetime
from System import Environment
sys.path.append('C:\Program Files (x86)\IronPython 2.7\Lib')
import System
from System import Array
from System.Collections.Generic import *
clr.AddReference('ProtoGeometry')
from Autodesk.DesignScript.Geometry import *
clr.AddReference("RevitNodes")
import Revit
clr.ImportExtensions(Revit.Elements)
clr.ImportExtensions(Revit.GeometryConversion)
clr.AddReference("RevitServices")
import RevitServices
from RevitServices.Persistence import DocumentManager 
from RevitServices.Transactions import TransactionManager 

clr.AddReference("RevitAPI")
clr.AddReference("RevitAPIUI")

import Autodesk 
from Autodesk.Revit.DB import *
from Autodesk.Revit.UI import *
import time

doc = DocumentManager.Instance.CurrentDBDocument
uiapp = DocumentManager.Instance.CurrentUIApplication 
app = uiapp.Application 
uidoc = uiapp.ActiveUIDocument

typeIds = []
typeNames = []

# collect all tags in the Active view
activeView = doc.ActiveView
tags = FilteredElementCollector(doc, activeView.Id).OfClass(IndependentTag).ToElements()

# get the tag type Ids and the names for the users to chose
for t in tags:
	typeId = t.GetTypeId()
	type = doc.GetElement(typeId)
	famName = type.FamilyName
 	typeName = t.Name
	if typeId not in typeIds:
		typeIds.append(typeId)
		typeNames.append(famName + ' : ' + typeName)

# add ALL/0 to the from of the lists
typeIds.insert(0, 0)
typeNames.insert(0, ' All')

OUT = typeIds, typeNames
# ----------------------------------------
code_block_4 = CodeBlock(x=python_script) { "Select a tag type:"; ids = x[0]; typeNames = x[1]; 0; }
dropdown_data = Custom[DropDown Data](InputName=code_block_4.out0, Keys=code_block_4.typeNames, Values=code_block_4.ids, DefaultValueIndex=code_block_4.out3)  # package Data-Shapes; Create data for DropDown input in UI.MultiInputForm ++ . Check out www.data-shapes.net for more infos.

# group: Input
code_block_5 = CodeBlock { true; "Run"; "Cancel"; false; 800; 400; }
list_create = List.Create(item0=textnote_data, item1=textbox_data, item2=dropdown_data)
ui_multipleinputform = Custom[UI.MultipleInputForm ++](Logo_optional=readFromFile, ButtonText_optional=code_block_5.out1, Inputs=list_create, Toggle=code_block_5.out0, CancelButtonText_optional=code_block_5.out2, Width_optional=code_block_5.out4, LabelWidth_optional=code_block_5.out5)  # package Data-Shapes; Create a form with multiple inputs. see www.data-shapes.net for tutorials and infos!
code_block_6 = CodeBlock(x=ui_multipleinputform.User_Inputs) { typeId = x[1]; valeus = x[0]; }

# group: Visualisation
not_ = Not(x=ui_multipleinputform.Was_Cancelled)
python_script_2 = Python(IN[0]=code_block_6.typeId, IN[1]=code_block_6.valeus, IN[2]=not_)  # IronPython2
# ---------- python_script_2.python (66 lines) ----------
# Load the Python Standard and DesignScript Libraries
import clr
import sys
import os.path
from datetime import datetime
from System import Environment
sys.path.append('C:\Program Files (x86)\IronPython 2.7\Lib')
import System
from System import Array
from System.Collections.Generic import *
clr.AddReference('ProtoGeometry')
from Autodesk.DesignScript.Geometry import *
clr.AddReference("RevitNodes")
import Revit
clr.ImportExtensions(Revit.Elements)
clr.ImportExtensions(Revit.GeometryConversion)
clr.AddReference("RevitServices")
import RevitServices
from RevitServices.Persistence import DocumentManager 
from RevitServices.Transactions import TransactionManager 

clr.AddReference("RevitAPI")
clr.AddReference("RevitAPIUI")

import Autodesk 
from Autodesk.Revit.DB import *
from Autodesk.Revit.UI import *
import time

doc = DocumentManager.Instance.CurrentDBDocument
uiapp = DocumentManager.Instance.CurrentUIApplication 
app = uiapp.Application 
uidoc = uiapp.ActiveUIDocument

typeId = IN[0]
paramValue = IN[1]
runMe = IN[2]
tags = []
taggedEls = []
deleteTags = List[ElementId]()

if runMe:
	view = doc.ActiveView
	tagsInView = FilteredElementCollector(doc, view.Id).OfClass(IndependentTag).ToElements()

	# define which tags to be processed
	if typeId != 0:
		for t in tagsInView:
			if t.GetTypeId() == typeId:
				tags.append(t)
	else:
		tags = tagsInView

	# filter the tags with the input value
	count = 0
	for i in tags:
		if i.TagText == paramValue:
 			count += 1
 			deleteTags.Add(i.Id)

	# DELETE the tags 
	TransactionManager.Instance.EnsureInTransaction(doc)
	doc.Delete(deleteTags)
	TransactionManager.Instance.TransactionTaskDone()
	
OUT = str(count) + ' tags were deleted from the active view'
# ----------------------------------------

# group: Input
code_block_7 = CodeBlock { "Result:"; "OK"; }
textnote_data_2 = Custom[TextNote Data](Title=code_block_7.out0, TextNote=python_script_2)
ui_multipleinputform_2 = Custom[UI.MultipleInputForm ++](Logo_optional=readFromFile, ButtonText_optional=code_block_7.out1, Inputs=textnote_data_2, Toggle=not_)
