# Dynamo graph Text - Replace Font_py.dyn "Text - Convert Gotham to Arial" (Dynamo 2.12.1.8246)
# packages: archi-lab.net 2021.25.2521, Data-Shapes 2021.2.92, SteamNodes 1.2.3

file_path = Filename("..\ACG_logo.png")
file_from_path = FileObject(path=file_path)
readFromFile = Image.ReadFromFile(file=file_from_path)

# group: Input
code_block = CodeBlock { "Select font to be changed :"; }
python_script = Python()  # IronPython2
# ---------- python_script.python (75 lines) ----------
# Load the Python Standard and DesignScript Libraries
import clr
import sys
sys.path.append('C:\Program Files (x86)\IronPython 2.7\Lib')
import System
from System import Array
from System.Collections.Generic import *
clr.AddReference('ProtoGeometry')
from Autodesk.DesignScript.Geometry import *
clr.AddReference("RevitNodes")
import Revit
clr.ImportExtensions(Revit.Elements)
clr.ImportExtensions(Revit.GeometryConversion)
clr.AddReference("RevitServices")
import RevitServices
from RevitServices.Persistence import DocumentManager 
from RevitServices.Transactions import TransactionManager 

clr.AddReference("RevitAPI")
clr.AddReference("RevitAPIUI")

import Autodesk 
from Autodesk.Revit.DB import *
from Autodesk.Revit.UI import *

doc = DocumentManager.Instance.CurrentDBDocument
uiapp = DocumentManager.Instance.CurrentUIApplication 
app = uiapp.Application 
uidoc = uiapp.ActiveUIDocument

# define empty lists here:

txtTypeNames = []
uniqueTxtTypeNames = []
uniqueTxtTypes = []
txtFonts =[]

dimTypeNames = []
uniqueDimTypeNames = []
uniqueDimTypes = []
dimFonts =[]

# collect all text note types, type names and type fonts in the model
textCol = FilteredElementCollector(doc).OfCategory(BuiltInCategory.OST_TextNotes).WhereElementIsNotElementType().ToElements()
for i in textCol:
	txtType = i.TextNoteType
	txtTypeName = txtType.get_Parameter(BuiltInParameter.SYMBOL_NAME_PARAM).AsValueString()
	txtTypeFont = txtType.get_Parameter(BuiltInParameter.TEXT_FONT).AsValueString()
	txtTypeNames.append(txtTypeName)
	if txtTypeName not in uniqueTxtTypeNames:
		uniqueTxtTypeNames.append(txtTypeName)
		txtFonts.append(txtTypeFont)
		uniqueTxtTypes.append(i)

# collect all dimension types, type names and type fonts in the model
dimCol = FilteredElementCollector(doc).OfCategory(BuiltInCategory.OST_Dimensions).WhereElementIsNotElementType().ToElements()
for i in dimCol:
	dimType = i.DimensionType
	dimTypeName = dimType.get_Parameter(BuiltInParameter.SYMBOL_NAME_PARAM).AsValueString()
	dimTypeFont = dimType.get_Parameter(BuiltInParameter.TEXT_FONT).AsValueString()
	dimTypeNames.append(dimTypeName)
	if dimTypeName not in uniqueDimTypeNames:
		uniqueDimTypeNames.append(dimTypeName)
		dimFonts.append(dimTypeFont)
		uniqueDimTypes.append(i)


# create a list of all dimension and text note fonts (unique)
uniqueFonts = []
allFonts = txtFonts + dimFonts
for f in allFonts:
	if f not in uniqueFonts:
		uniqueFonts.append(f)

OUT = [[uniqueTxtTypes],[uniqueTxtTypeNames],[txtFonts],[uniqueDimTypes],[uniqueDimTypeNames],[dimFonts],[uniqueFonts]]
# ----------------------------------------
# note: collect all types / type names / fonts
code_block_2 = CodeBlock(textNoteTypes=python_script, textNoteTypeNames=python_script, textNoteFonts=python_script, dimNoteTypes=python_script, dimNoteTypeNames=python_script, dimNoteFonts=python_script, uniqueFonts=python_script)
# ---------- code_block_2.designscript (7 lines) ----------
textNoteTypes[0];
textNoteTypeNames[1];
textNoteFonts[2];
dimNoteTypes[3];
dimNoteTypeNames[4];
dimNoteFonts[5];
uniqueFonts[6];
# ----------------------------------------
dropdown_data = Custom[DropDown Data](InputName=code_block, Keys=code_block_2.out6, Values=code_block_2.out6)  # package Data-Shapes; Create data for DropDown input in UI.MultiInputForm ++ . Check out www.data-shapes.net for more infos.

# group: Input
code_block_3 = CodeBlock { "Type name of new font :"; "Arial"; }
textbox_data = Custom[TextBox Data](InputName=code_block_3.out0, DefaultText=code_block_3.out1)  # package Data-Shapes; Create Data for TextBox input in UI.MultipleInputForm ++ . Check out www.data-shapes.net for more informations

# group: Input
code_block_4 = CodeBlock { true; "Replace"; "Cancel"; 300; 700; }
code_block_5 = CodeBlock { "Note:"; }
string = StringInput("This tool will replace the current font with a given font in all Text Note and/or Dimension types. It can be run in models and families.")
textnote_data = Custom[TextNote Data](Title=code_block_5, TextNote=string)  # package Data-Shapes; Create Data for TextNote input in UI.MultipleInputForm ++ . Check out www.data-shapes.net for more informations
code_block_6 = CodeBlock { "Change text notes font :"; "Change dimensions font :"; true; }
boolean_input = Custom[Boolean input](InputName=code_block_6.out0, DefaultValue=code_block_6.out2)  # package Data-Shapes; Creates a boolean input for UI.MultipleInputForm ++ . Check out www.data-shapes.net for more infos!
boolean_input_2 = Custom[Boolean input](InputName=code_block_6.out1, DefaultValue=code_block_6.out2)
list_create = List.Create(item0=textnote_data, item1=boolean_input, item2=boolean_input_2, item3=dropdown_data, item4=textbox_data)
flatten = List.Flatten(list=list_create)
multipleinputform = Custom[MultipleInputForm ++](Logo_optional=readFromFile, ButtonText_optional=code_block_4.out1, Inputs=flatten, Toggle=code_block_4.out0, CancelButtonText_optional=code_block_4.out2, Width_optional=code_block_4.out4, LabelWidth_optional=code_block_4.out3)  # package Data-Shapes; Create a form with multiple inputs. see www.data-shapes.net for tutorials and infos!

# group: Processing
code_block_7 = CodeBlock { catTN=Revit.Category.ByName("Text Notes"); allTN=ElementQueries.OfCategory(catTN); }  # frozen
type = archilab.Revit.Elements.Elements.Type(element=code_block_7.allTN)
code_block_8 = CodeBlock { catD=Revit.Category.ByName("Dimensions"); allD=ElementQueries.OfCategory(catD); }  # frozen
type_2 = archilab.Revit.Elements.Elements.Type(element=code_block_8.allD)
code_block_9 = CodeBlock(inputTN=type, inputD=type_2) { DSCore.List.UniqueItems(inputTN); DSCore.List.UniqueItems(inputD); }
list_create_2 = List.Create(item0=code_block_9.out0, item1=code_block_9.out1)
flatten_2 = List.Flatten(list=list_create_2)
isNull = Object.IsNull(object=flatten_2)
filterByBoolMask = List.FilterByBoolMask(list=flatten_2, mask=isNull)
runMe = Custom[Tool.RunMe](Boolean=multipleinputform.Was_Run, ThingToDo=filterByBoolMask.out)  # package SteamNodes; Use Boolean to perform an action
code_block_10 = CodeBlock { "Text Font"; }
getParameterValueByName = Element.GetParameterValueByName(element=runMe, parameterName=code_block_10)
code_block_11 = CodeBlock(value=getParameterValueByName) { value=="Gotham"; value==""; "Arial"; }
filterByBoolMask_2 = List.FilterByBoolMask(list=runMe, mask=code_block_11.out0)
setParameterByName = Element.SetParameterByName(element=filterByBoolMask_2.in, parameterName=code_block_10, value=code_block_11.out2)
filterByBoolMask_3 = List.FilterByBoolMask(list=runMe, mask=code_block_11.out1)
setParameterByName_2 = Element.SetParameterByName(element=filterByBoolMask_3.in, parameterName=code_block_10, value=code_block_11.out2)

# group: Usage
code_block_12 = CodeBlock { "Text - Change Font"; }
acg_script_usage = Custom[ACG Script Usage](scriptName=code_block_12)  # Adds an entry to Excel document every time a script is run. The document is located in S:\Dynamo\05-UsageStats

code_block_13 = CodeBlock(x=multipleinputform.User_Inputs) { boolTxt=x[0]; boolDim=x[1]; oldFont=x[2]; newFont=x[3]; }

# group: Visualisation
# note: change the fonts to all text note types
python_script_2 = Python(IN[0]=code_block_13.boolTxt, IN[1]=code_block_13.boolDim, IN[2]=code_block_13.oldFont, IN[3]=code_block_13.newFont)  # IronPython2
# ---------- python_script_2.python (77 lines) ----------
# Load the Python Standard and DesignScript Libraries
import clr
import sys
sys.path.append('C:\Program Files (x86)\IronPython 2.7\Lib')
import System
from System import Array
from System.Collections.Generic import *
clr.AddReference('ProtoGeometry')
from Autodesk.DesignScript.Geometry import *
clr.AddReference("RevitNodes")
import Revit
clr.ImportExtensions(Revit.Elements)
clr.ImportExtensions(Revit.GeometryConversion)
clr.AddReference("RevitServices")
import RevitServices
from RevitServices.Persistence import DocumentManager 
from RevitServices.Transactions import TransactionManager 

clr.AddReference("RevitAPI")
clr.AddReference("RevitAPIUI")

import Autodesk 
from Autodesk.Revit.DB import *
from Autodesk.Revit.UI import *

doc = DocumentManager.Instance.CurrentDBDocument
uiapp = DocumentManager.Instance.CurrentUIApplication 
app = uiapp.Application 
uidoc = uiapp.ActiveUIDocument


runMeTxt = IN[0]
runMeDim = IN[1]
inputFont = IN[2]
targetFont = IN[3]

# define empty lists here:

uniqueTxtTypeNames = []
uniqueTxtTypes = []
uniqueDimTypeNames = []
uniqueDimTypes = []


if runMeTxt:
# collect all text note types
	textCol = FilteredElementCollector(doc).OfCategory(BuiltInCategory.OST_TextNotes).WhereElementIsNotElementType().ToElements()
	for i in textCol:
		txtType = i.TextNoteType
		txtTypeName = txtType.get_Parameter(BuiltInParameter.SYMBOL_NAME_PARAM).AsValueString()
		if txtTypeName not in uniqueTxtTypeNames:
			uniqueTxtTypeNames.append(txtTypeName)
			uniqueTxtTypes.append(txtType)

	TransactionManager.Instance.EnsureInTransaction(doc)
	for type in uniqueTxtTypes:
		currentFont = type.get_Parameter(BuiltInParameter.TEXT_FONT).AsValueString()
		if currentFont == inputFont:
			type.get_Parameter(BuiltInParameter.TEXT_FONT).Set(targetFont)
	TransactionManager.Instance.TransactionTaskDone()
	
if runMeDim:
# collect all dimension types
	dimCol = FilteredElementCollector(doc).OfCategory(BuiltInCategory.OST_Dimensions).WhereElementIsNotElementType().ToElements()
	for i in dimCol:
		dimType = i.DimensionType
		dimTypeName = dimType.get_Parameter(BuiltInParameter.SYMBOL_NAME_PARAM).AsValueString()
		if dimTypeName not in uniqueDimTypeNames:
			uniqueDimTypeNames.append(dimTypeName)
			uniqueDimTypes.append(dimType)

	TransactionManager.Instance.EnsureInTransaction(doc)
	for type in uniqueDimTypes:
		currentFont = type.get_Parameter(BuiltInParameter.TEXT_FONT).AsValueString()
		if currentFont == inputFont:
			type.get_Parameter(BuiltInParameter.TEXT_FONT).Set(targetFont)
	TransactionManager.Instance.TransactionTaskDone()
# ----------------------------------------
