# Dynamo graph Walls - Convert Room Bounding_py.dyn "Walls - Convert Room Bounding" (Dynamo 2.12.1.8246)
# packages: Data-Shapes 2021.2.92, Orchid 260.1.0.7729

# group: Visualisation
code_block = CodeBlock { "Room Bounding"; }  # frozen
code_block_2 = CodeBlock { x?1:0; }  # unwired: x
setParameterByName = Element.SetParameterByName(parameterName=code_block, value=code_block_2)  # unwired: element

# group: Usage
code_block_3 = CodeBlock { "Walls - Convert Room Bounding"; }
acg_script_usage = Custom[ACG Script Usage](scriptName=code_block_3)  # Adds an entry to Excel document every time a script is run. The document is located in S:\Dynamo\05-UsageStats

file_path = Filename("..\ACG_logo.png")
file_from_path = FileObject(path=file_path)
readFromFile = Image.ReadFromFile(file=file_from_path)
code_block_4 = CodeBlock { "Cancel"; true; "Generate Views"; 700; 350; }
code_block_5 = CodeBlock { "Note:"; }
string = StringInput("""This tool will turn on/off the room bounding property to all walls from a given wall type and a given phase created.

For more information, please refer to the Revit Tutorials channel in MS Stream.""")
ui_textnote_data = Custom[UI.TextNote Data](Title=code_block_5, TextNote=string)  # package Data-Shapes; Create Data for TextNote input in UI.MultipleInputForm ++ . Check out www.data-shapes.net for more informations

# group: Input
# note: collect all wall type names and their IDs
python_script = Python()  # IronPython2
# ---------- python_script.python (46 lines) ----------
# Load the Python Standard and DesignScript Libraries
import clr
import sys
sys.path.append('C:\Program Files (x86)\IronPython 2.7\Lib')
import System
from System import Array
from System.Collections.Generic import *
clr.AddReference('ProtoGeometry')
from Autodesk.DesignScript.Geometry import *
clr.AddReference("RevitNodes")
import Revit
clr.ImportExtensions(Revit.Elements)
clr.ImportExtensions(Revit.GeometryConversion)
clr.AddReference("RevitServices")
import RevitServices
from RevitServices.Persistence import DocumentManager 
from RevitServices.Transactions import TransactionManager 

clr.AddReference("RevitAPI")
clr.AddReference("RevitAPIUI")

import Autodesk 
from Autodesk.Revit.DB import *
from Autodesk.Revit.UI import *

doc = DocumentManager.Instance.CurrentDBDocument
uiapp = DocumentManager.Instance.CurrentUIApplication 
app = uiapp.Application 
uidoc = uiapp.ActiveUIDocument

wallTypeNames = []
wallTypeIDs = []

# collect all wall types
wallCol=FilteredElementCollector(doc).OfCategory(BuiltInCategory.OST_Walls).WhereElementIsElementType().ToElements()

for wallType in wallCol:
	typeID = wallType.Id
	wallTypeIDs.append(typeID)
	
	typeName=wallType.get_Parameter(BuiltInParameter.SYMBOL_NAME_PARAM).AsValueString()
	wallTypeNames.append(typeName)
	
output=wallTypeIDs+wallTypeNames
		
OUT = [wallTypeNames, wallTypeIDs,]
# ----------------------------------------
code_block_6 = CodeBlock(typeNames=python_script, IDs=python_script) { "Select wall types."; typeNames[0]; IDs[1]; }

# group: Input
code_block_7 = CodeBlock { false; 400; }
listview_data = Custom[Listview Data](InputName=code_block_6.out0, Keys=code_block_6.out1, Values=code_block_6.out2, Height_optionnal=code_block_7.out1, ShowId_optionnal=code_block_7.out0)  # package Data-Shapes; Create data for ListView input in UI.MultiInputForm ++ . Check out www.data-shapes.net for more infos.

# group: Processing
code_block_8 = CodeBlock { "Select phase created"; }
python_script_2 = Python()  # IronPython2
# ---------- python_script_2.python (40 lines) ----------
# Load the Python Standard and DesignScript Libraries
import clr
import sys
sys.path.append('C:\Program Files (x86)\IronPython 2.7\Lib')
import System
from System import Array
from System.Collections.Generic import *
clr.AddReference('ProtoGeometry')
from Autodesk.DesignScript.Geometry import *
clr.AddReference("RevitNodes")
import Revit
clr.ImportExtensions(Revit.Elements)
clr.ImportExtensions(Revit.GeometryConversion)
clr.AddReference("RevitServices")
import RevitServices
from RevitServices.Persistence import DocumentManager 
from RevitServices.Transactions import TransactionManager 

clr.AddReference("RevitAPI")
clr.AddReference("RevitAPIUI")

import Autodesk 
from Autodesk.Revit.DB import *
from Autodesk.Revit.UI import *

doc = DocumentManager.Instance.CurrentDBDocument
uiapp = DocumentManager.Instance.CurrentUIApplication 
app = uiapp.Application 
uidoc = uiapp.ActiveUIDocument

phaseNames = []

# collect all wall types
phaseCol=FilteredElementCollector(doc).OfCategory(BuiltInCategory.OST_Phases).WhereElementIsNotElementType().ToElements()

for phase in phaseCol:
	phaseNames.append(phase.Name)
	
	
OUT = phaseNames
# ----------------------------------------
dropdown_data = Custom[DropDown Data](InputName=code_block_8, Keys=python_script_2, Values=python_script_2)  # package Data-Shapes; Create data for DropDown input in UI.MultiInputForm ++ . Check out www.data-shapes.net for more infos.

# group: Input
code_block_9 = CodeBlock { "Turn room bounding ON"; true; }
boolean_input = Custom[Boolean input](InputName=code_block_9.out0, DefaultValue=code_block_9.out1)  # package Data-Shapes; Creates a boolean input for UI.MultipleInputForm ++ . Check out www.data-shapes.net for more infos!

list_create = List.Create(item0=ui_textnote_data, item1=listview_data, item2=dropdown_data, item3=boolean_input)
flatten = List.Flatten(list=list_create)
ui_multipleinputform = Custom[UI.MultipleInputForm ++](Logo_optional=readFromFile, ButtonText_optional=code_block_4.out2, Inputs=flatten, Toggle=code_block_4.out1, CancelButtonText_optional=code_block_4.out0, Width_optional=code_block_4.out3, LabelWidth_optional=code_block_4.out4)  # package Data-Shapes; Create a form with multiple inputs. see www.data-shapes.net for tutorials and infos!
code_block_10 = CodeBlock(x=ui_multipleinputform.User_Inputs) { wallTypeIDs=x[0]; phCreatedName=x[1]; onOff=x[2]; }

# group: Processing
# note: collects all instances of walls from a given type ID and a given phase name. Sets the roombounding parameter to a given value
python_script_3 = Python(IN[0]=code_block_10.wallTypeIDs, IN[1]=code_block_10.phCreatedName, IN[2]=code_block_10.onOff)  # IronPython2
# ---------- python_script_3.python (84 lines) ----------
# Load the Python Standard and DesignScript Libraries
import clr
import sys
sys.path.append('C:\Program Files (x86)\IronPython 2.7\Lib')
import System
from System import Array
from System.Collections.Generic import *
clr.AddReference('ProtoGeometry')
from Autodesk.DesignScript.Geometry import *
clr.AddReference("RevitNodes")
import Revit
clr.ImportExtensions(Revit.Elements)
clr.ImportExtensions(Revit.GeometryConversion)
clr.AddReference("RevitServices")
import RevitServices
from RevitServices.Persistence import DocumentManager 
from RevitServices.Transactions import TransactionManager 

clr.AddReference("RevitAPI")
clr.AddReference("RevitAPIUI")

import Autodesk 
from Autodesk.Revit.DB import *
from Autodesk.Revit.UI import *

doc = DocumentManager.Instance.CurrentDBDocument
uiapp = DocumentManager.Instance.CurrentUIApplication 
app = uiapp.Application 
uidoc = uiapp.ActiveUIDocument

# input
inputTypeID = IN[0]
inputPhase = IN[1]
booleanInput = IN[2]


wallsInInputPhase = []
convertedIDs = []
outputWalls = []
inputTypes =[]
boundingValue = 0
temp=[]

for i in inputTypeID:
	inputType=doc.GetElement(i)
	inputTypes.append(inputType)
for inputType in inputTypes:
	value=inputType.Id
	convertedIDs.append(value)

# define value for the room bounding parameter
if booleanInput :
	boundingValue = 1
	checkValue = "Yes"
else:
	checkValue ="No"

# collect all wall instances in input phase
wallCol=FilteredElementCollector(doc).OfCategory(BuiltInCategory.OST_Walls).WhereElementIsNotElementType().ToElements()
for wall in wallCol:
	wallPhaseCreated=wall.get_Parameter(BuiltInParameter.PHASE_CREATED).AsValueString()
	if wallPhaseCreated == inputPhase:
		wallsInInputPhase.append(wall)

# collect the unique type IDs of the walls in the input phase
for wall in wallsInInputPhase:
	if wall.WallType.Id in convertedIDs:
		outputWalls.append(wall)
		
# set the room bounding parameter !!!OUTPUT!!!
TransactionManager.Instance.EnsureInTransaction(doc)
for wall in outputWalls:
	wall.get_Parameter(BuiltInParameter.WALL_ATTR_ROOM_BOUNDING).Set(boundingValue)
TransactionManager.Instance.TransactionTaskDone()
		
# generate report message
for wall in outputWalls:
	currentValue = wall.get_Parameter(BuiltInParameter.WALL_ATTR_ROOM_BOUNDING).AsValueString()
	temp.append(currentValue)
	if currentValue != checkValue:
		OUT = "Failed to set parameter. Please review."
	else:
		OUT = "Success!"
	
# ----------------------------------------

# group: Filtering
code_block_11 = CodeBlock { catW=Revit.Category.ByName("Walls"); allW=ElementQueries.OfCategory(catW); }  # frozen
elementTypes = Custom[ElementTypes+](element=code_block_11.allW)  # Gets types from linked elements too. From Clockworks
code_block_12 = CodeBlock(t=elementTypes) { t.Name; }
# note: collect walls from specific wall type
eq = code_block_12 == _  # unwired: y; lacing=CrossProduct
anyTrue = Orchid.Common.List.AnyTrue(list=eq@L2)
filterByBoolMask = List.FilterByBoolMask(list=code_block_11.allW, mask=anyTrue)

# group: Filtering
code_block_13 = CodeBlock { "Phase Created"; }
# note: collect the name of phase created of filtered walls
getParameterValueByName = Element.GetParameterValueByName(element=filterByBoolMask.in, parameterName=code_block_13)
code_block_14 = CodeBlock(ph=getParameterValueByName) { ph.Name; }
eq_2 = code_block_14 == _  # unwired: y; lacing=CrossProduct
filterByBoolMask_2 = List.FilterByBoolMask(list=filterByBoolMask.in, mask=eq_2)

# group: Processing
code_block_15 = CodeBlock { DSCore.Types.FindTypeByNameInAssembly("Phase","RevitAPI"); }  # frozen
all_elements_of_type = ElementsOfType(element_type=code_block_15)
code_block_16 = CodeBlock(ph=all_elements_of_type) { "Select phase created"; ph; ph.Name; }
