# Dynamo graph Walls - Remove Or Reinstate Wrapping at Ends_py.dyn "Walls - Remove Or Reinstate Wrapping at Ends" (Dynamo 2.12.1.8246)
# packages: archi-lab.net 2021.25.2521, SteamNodes 1.2.3, Data-Shapes 2021.2.92

# group: Processing
all_elements_in_active_view = ElementsInView()  # frozen
getCategory = Element.GetCategory(element=all_elements_in_active_view)
code_block = CodeBlock(e=getCategory) { e.Name=="Walls"; }
filterByBoolMask = List.FilterByBoolMask(list=all_elements_in_active_view, mask=code_block)
type = archilab.Revit.Elements.Elements.Type(element=filterByBoolMask.in)

file_path = Filename("..\ACG_logo.png")
file_from_path = FileObject(path=file_path)
readFromFile = Image.ReadFromFile(file=file_from_path)
code_block_2 = CodeBlock { true; "Run"; "Cancel"; false; 800; 400; }

# group: Input
code_block_3 = CodeBlock { "Note:"; }
string = StringInput("""This tool is designed to work as an addition to the Views - Generate Spec View - Walls tool.
It will collect all types of walls placed in the active view and remove any wrapping at the ends. While doing this the tool will also record the original conditions of the types and write them in the Type Comments parameter by adding suffix "_wrapping<int>".
The tool has also the option to convert the wall types in the active view back to their original convition. It will bo do this by reading the "_wrapping<int>" suffux, reinstate the original wrapping at ends condition and delete the suffix.
Please be carefull when using the tool. Ideally you would generate the wall spec elements, run the tool to remove any wrapping, export the sheets and run the tool again to reinstate any wrapping.
The tool is only as good as the data you are inputing!
For more information on how this tool works, plese refer to the Revit Tutorials channel in MS Teams.""")
textnote_data = Custom[TextNote Data](Title=code_block_3, TextNote=string)  # package Data-Shapes; Create Data for TextNote input in UI.MultipleInputForm ++ . Check out www.data-shapes.net for more informations

# group: Input
code_block_4 = CodeBlock { "Remove wrapping at ends?"; }
boolean_input = Custom[Boolean input](InputName=code_block_4)  # package Data-Shapes; Creates a boolean input for UI.MultipleInputForm ++ . Check out www.data-shapes.net for more infos!

list_create = List.Create(item0=textnote_data, item1=boolean_input)
ui_multipleinputform = Custom[UI.MultipleInputForm ++](Logo_optional=readFromFile, ButtonText_optional=code_block_2.out1, Inputs=list_create, Toggle=code_block_2.out0, CancelButtonText_optional=code_block_2.out2, Width_optional=code_block_2.out4, LabelWidth_optional=code_block_2.out5)  # package Data-Shapes; Create a form with multiple inputs. see www.data-shapes.net for tutorials and infos!

# group: Control
code_block_5 = CodeBlock(x=ui_multipleinputform.User_Inputs) { x[0]; }
not_ = Not(x=code_block_5)

# group: Control
runMe = Custom[Tool.RunMe](Boolean=code_block_5, ThingToDo=type)  # package SteamNodes; Use Boolean to perform an action
runMe_2 = Custom[Tool.RunMe](Boolean=not_, ThingToDo=type)

# group: Processing
code_block_6 = CodeBlock { "Type Comments"; "Wrapping at Ends"; }  # frozen
getParameterValueByName = Element.GetParameterValueByName(element=runMe, parameterName=code_block_6.out0)
code_block_7 = CodeBlock { "_wrapping"; }
getParameterValueByName_2 = Element.GetParameterValueByName(element=runMe, parameterName=code_block_6.out1)
code_block_8 = CodeBlock(tComments=getParameterValueByName, code=code_block_7, wrapValue=getParameterValueByName_2) { tComments+code+wrapValue; }

# group: Control
contains = String.Contains(string=getParameterValueByName, searchFor=code_block_7)
# note: wall types that dont have _wrapping in their type comments - OUT
filterByBoolMask_2 = List.FilterByBoolMask(list=type, mask=contains)

# group: Assing
setParameterByName = Element.SetParameterByName(element=filterByBoolMask_2.out, parameterName=code_block_6.out0, value=code_block_8)
code_block_9 = CodeBlock { 0; }
setParameterByName_2 = Element.SetParameterByName(element=setParameterByName, parameterName=code_block_6.out1, value=code_block_9)

# group: Processing
code_block_10 = CodeBlock { "Type Comments"; "_wrapping"; }  # frozen
getParameterValueByName_3 = Element.GetParameterValueByName(element=runMe_2, parameterName=code_block_10.out0)

# group: Control
contains_2 = String.Contains(string=getParameterValueByName_3, searchFor=code_block_10.out1)
# note: wall types that have _wrapping in their type comments - IN
filterByBoolMask_3 = List.FilterByBoolMask(list=runMe_2, mask=contains_2)

# group: Processing
code_block_11 = CodeBlock { "Type Comments"; "_wrapping"; }
getParameterValueByName_4 = Element.GetParameterValueByName(element=filterByBoolMask_3.in, parameterName=code_block_11.out0)
split = String.Split(string=getParameterValueByName_4, separator0=code_block_11.out1)
lastItem = List.LastItem(list=split@L2)

# group: Control
length = String.Length(string=lastItem)
code_block_12 = CodeBlock(lng=length) { lng==1; 1; lng-1; }
remove = String.Remove(string=lastItem, startIndex=code_block_12.out1, count=code_block_12.out2)
if_ = If(test=code_block_12.out0, true=lastItem, false=remove)
toNumber = String.ToNumber(string=if_)

# group: Processing
code_block_13 = CodeBlock { "_wrapping0"; "_wrapping1"; "_wrapping2"; ""; }
replace = String.Replace(string=getParameterValueByName_4, searchFor=code_block_13.out0, replaceWith=code_block_13.out3)
replace_2 = String.Replace(string=replace, searchFor=code_block_13.out1, replaceWith=code_block_13.out3)
replace_3 = String.Replace(string=replace_2, searchFor=code_block_13.out2, replaceWith=code_block_13.out3)

# group: Assing
code_block_14 = CodeBlock { "Type Comments"; "Wrapping at Ends"; }
setParameterByName_3 = Element.SetParameterByName(element=filterByBoolMask_3.in, parameterName=code_block_14.out1, value=toNumber)
setParameterByName_4 = Element.SetParameterByName(element=setParameterByName_3, parameterName=code_block_14.out0, value=replace_3)

# group: Control
code_block_15 = CodeBlock { "Walls - Remove Or Reinstate Wrapping at Ends"; }
acg_script_usage = Custom[ACG Script Usage](scriptName=code_block_15)  # Adds an entry to Excel document every time a script is run. The document is located in S:\Dynamo\05-UsageStats

# group: Visualisation
# note: collect wall types in active view that vahe wrapping at ends
python_script = Python(IN[0]=code_block_5)  # IronPython2
# ---------- python_script.python (77 lines) ----------
# Load the Python Standard and DesignScript Libraries
import clr
import sys
sys.path.append('C:\Program Files (x86)\IronPython 2.7\Lib')
import System
from System import Array
from System.Collections.Generic import *
clr.AddReference('ProtoGeometry')
from Autodesk.DesignScript.Geometry import *
clr.AddReference("RevitNodes")
import Revit
clr.ImportExtensions(Revit.Elements)
clr.ImportExtensions(Revit.GeometryConversion)
clr.AddReference("RevitServices")
import RevitServices
from RevitServices.Persistence import DocumentManager 
from RevitServices.Transactions import TransactionManager 

clr.AddReference("RevitAPI")
clr.AddReference("RevitAPIUI")

import Autodesk 
from Autodesk.Revit.DB import *
from Autodesk.Revit.UI import *

doc = DocumentManager.Instance.CurrentDBDocument
uiapp = DocumentManager.Instance.CurrentUIApplication 
app = uiapp.Application 
uidoc = uiapp.ActiveUIDocument

types = []
typeIDs = []
uniqueIDs =[]
uniqueTypes = []
wrappedTypes = []
temp = []

runMe = IN[0]

if runMe:
# collect all wall types in the active view
	wallCol=FilteredElementCollector(doc, doc.ActiveView.Id).OfCategory(BuiltInCategory.OST_Walls).WhereElementIsNotElementType().ToElements()

# get the IDs of the wall types in the active view
	for wall in wallCol:
		typeID = wall.WallType.Id
		strTypeID = str(typeID)
		typeIDs.append(strTypeID)
	for ID in typeIDs:
		if ID not in uniqueIDs:
			uniqueIDs.append(ID)
		
	for ID in uniqueIDs:
		type = doc.GetElement(ElementId((int(ID))))
		uniqueTypes.append(type)
	
# filter only wall types that have wrapping at ends	
	for type in uniqueTypes:
		value = type.LookupParameter("Wrapping at Ends").AsValueString()
		if value != 'None':
			wrappedTypes.append(type)
		
# convert the wrapping at ends patameter to NONE !!! and add to type comments
	TransactionManager.Instance.EnsureInTransaction(doc)
	for type in wrappedTypes:
		currentTypeComment = type.LookupParameter("Type Comments").AsValueString() 
		currentWrapping = type.LookupParameter("Wrapping at Ends").AsValueString() 
		newTypeComment = currentTypeComment + "_wrapping_" + currentWrapping
	
		type.LookupParameter("Type Comments").Set(newTypeComment)
		type.LookupParameter("Wrapping at Ends").Set(0)		
	TransactionManager.Instance.TransactionTaskDone()



	
OUT = wrappedTypes
# ----------------------------------------

# group: Visualisation
# note: return the wrapping at end values based on type comments. removes the marker from the type comments as well
python_script_2 = Python(IN[0]=not_)  # IronPython2
# ---------- python_script_2.python (76 lines) ----------
# Load the Python Standard and DesignScript Libraries
import clr
import sys
sys.path.append('C:\Program Files (x86)\IronPython 2.7\Lib')
import System
from System import Array
from System.Collections.Generic import *
clr.AddReference('ProtoGeometry')
from Autodesk.DesignScript.Geometry import *
clr.AddReference("RevitNodes")
import Revit
clr.ImportExtensions(Revit.Elements)
clr.ImportExtensions(Revit.GeometryConversion)
clr.AddReference("RevitServices")
import RevitServices
from RevitServices.Persistence import DocumentManager 
from RevitServices.Transactions import TransactionManager 

clr.AddReference("RevitAPI")
clr.AddReference("RevitAPIUI")

import Autodesk 
from Autodesk.Revit.DB import *
from Autodesk.Revit.UI import *

doc = DocumentManager.Instance.CurrentDBDocument
uiapp = DocumentManager.Instance.CurrentUIApplication 
app = uiapp.Application 
uidoc = uiapp.ActiveUIDocument

runMe = IN[0]

typeIDs = []
uniqueIDs =[]
uniqueTypes = []
interiorW = []
exteriorW = []

if runMe:

# collect all wall types in the active view
	wallCol=FilteredElementCollector(doc, doc.ActiveView.Id).OfCategory(BuiltInCategory.OST_Walls).WhereElementIsNotElementType().ToElements()

# get the IDs of the wall types in the active view
	for wall in wallCol:
		typeID = wall.WallType.Id
		strTypeID = str(typeID)
		typeIDs.append(strTypeID)
	for ID in typeIDs:
		if ID not in uniqueIDs:
			uniqueIDs.append(ID)
		
	for ID in uniqueIDs:
		type = doc.GetElement(ElementId((int(ID))))
		uniqueTypes.append(type)
	
# filter only wall types that have wrapping at ends	
	TransactionManager.Instance.EnsureInTransaction(doc)
	for type in uniqueTypes:
		typeComment = type.LookupParameter('Type Comments').AsValueString()
	
		if "_wrapping_Exterior" in typeComment:
			newTypeComment = typeComment.Replace("_wrapping_Exterior", "")
			type.LookupParameter('Type Comments').Set(newTypeComment)
			exteriorW.append(newTypeComment)
			type.LookupParameter('Wrapping at Ends').Set(1)
		
		elif "_wrapping_Interior" in typeComment:
			newTypeComment = typeComment.replace("_wrapping_Interior", "")
			type.LookupParameter('Type Comments').Set(newTypeComment)
			interiorW.append(newTypeComment)
			type.LookupParameter('Wrapping at Ends').Set(2)
		
		else:
			continue
	TransactionManager.Instance.TransactionTaskDone()
# ----------------------------------------
