# Dynamo graph Archive Model_py.dyn (Dynamo 2.12.1.8246)
# packages: Data-Shapes 2021.2.92

# group: Usage
code_block = CodeBlock { "Archive Model"; }
acg_script_usage = Custom[ACG Script Usage](scriptName=code_block)  # Adds an entry to Excel document every time a script is run. The document is located in S:\Dynamo\05-UsageStats

# group: Input
file_path = Filename("..\ACG_logo.png")
file_from_path = FileObject(path=file_path)
readFromFile = Image.ReadFromFile(file=file_from_path)
code_block_2 = CodeBlock { "Cancel"; true; "Archive"; }
code_block_3 = CodeBlock { "Note:"; }
string = StringInput("This tool will synchronize the active cloud model and save a copy to the project's 04 Archive folder on P:\\Projects drive. The archive copy will be saved with prefix \"ARCHIVE_<YYMMDD>_\". Please close the model after the script has run.\n")
ui_textnote_data = Custom[UI.TextNote Data](Title=code_block_3, TextNote=string)  # package Data-Shapes; Create Data for TextNote input in UI.MultipleInputForm ++ . Check out www.data-shapes.net for more informations
ui_multipleinputform = Custom[UI.MultipleInputForm ++](Logo_optional=readFromFile, ButtonText_optional=code_block_2.out2, Inputs=ui_textnote_data, Toggle=code_block_2.out1, CancelButtonText_optional=code_block_2.out0)  # package Data-Shapes; Create a form with multiple inputs. see www.data-shapes.net for tutorials and infos!

not_ = Not(x=ui_multipleinputform.Was_Cancelled)
end = Revit.Transaction.Transaction.End(input=not_)

# group: Visualisation
python_script = Python(IN[0]=end)  # IronPython2
# ---------- python_script.python (65 lines) ----------
import clr
clr.AddReference("RevitServices")
import RevitServices
from RevitServices.Persistence import DocumentManager
from RevitServices.Transactions import TransactionManager
doc = DocumentManager.Instance.CurrentDBDocument
clr.AddReference("RevitAPI")
import Autodesk
from Autodesk.Revit.DB import *
import System
import sys
sys.path.append(r"C:\Program Files (x86)\IronPython 2.7\Lib")
import os
from datetime import datetime

RunIt = IN[0]
TransactionManager.Instance.TransactionTaskDone()
piCol = FilteredElementCollector(doc).OfCategory(BuiltInCategory.OST_ProjectInformation).ToElements()
pi = piCol[0]

date = datetime.today().strftime('%y%m%d')

modelName = doc.Title

# collect the project info element in RVT 2022 or RVT 2021
prjDir = pi.LookupParameter('Project Directory').AsString()

# assemble the Archived directory path
archiveDir = prjDir + '\\04 Archived\\' + date
if not os.path.exists(archiveDir):
	os.mkdir(archiveDir)
	
# assemble the path for the archived model
filePath = archiveDir + '\\ARCHIVED_' + date + '_' + modelName + '.rvt'


if RunIt:
	tOptions = TransactWithCentralOptions()
	rOptions = RelinquishOptions(False)
	rOptions.StandardWorksets = True
	rOptions.ViewWorksets = True
	rOptions.FamilyWorksets = True
	rOptions.UserWorksets = True
	rOptions.CheckedOutElements = True
	sOptions = SynchronizeWithCentralOptions()
	sOptions.SetRelinquishOptions(rOptions)
	sOptions.Compact = False
	sOptions.SaveLocalBefore = True
	sOptions.SaveLocalAfter = True
	doc.SynchronizeWithCentral(tOptions, sOptions)

	worksharingOptions = WorksharingSaveAsOptions()
	worksharingOptions.SaveAsCentral = True
	SaveOptions = SaveAsOptions()
	SaveOptions.MaximumBackups = 3
	SaveOptions.SetWorksharingOptions(worksharingOptions)
	SaveOptions.OverwriteExistingFile = True
	SaveOptions.Compact = True
	doc.SaveAs(filePath, SaveOptions)

	OUT = 'Model has been archived. Please close it.'
	
else:
	OUT = 'Error! The model has NOT been archived!'
		
# ----------------------------------------

end_2 = Revit.Transaction.Transaction.End(input=python_script)

# group: Input
code_block_4 = CodeBlock { "Result:"; "Got it."; }
ui_textnote_data_2 = Custom[UI.TextNote Data](Title=code_block_4.out0, TextNote=end_2)
ui_multipleinputform_2 = Custom[UI.MultipleInputForm ++](Logo_optional=readFromFile, ButtonText_optional=code_block_4.out1, Inputs=ui_textnote_data_2, Toggle=code_block_2.out1)
