# Dynamo graph Issue Model.dyn (Dynamo 2.12.1.8246)
# packages: archi-lab.net 2021.25.2521, Data-Shapes 2021.2.92, Genius Loci 2021.2.3, Orchid 260.1.0.7729, SteamNodes 1.2.3, archi-lab.net 2022.210.2522, BumbleBee 2021.25.3

# group: Select Splash page
code_block = CodeBlock { "Sheets"; }
byName = Category.ByName(name=code_block)
all_elements_of_category = ElementsOfCategory(Category=byName)
sheetNumber = Sheet.SheetNumber(sheet=all_elements_of_category)
code_block_2 = CodeBlock { "Project Information"; }
contains = String.Contains(string=sheetNumber, searchFor=code_block_2)
filterByBoolMask = List.FilterByBoolMask(list=all_elements_of_category, mask=contains)

file_path = Filename("..\ACG_logo.png")
file_from_path = FileObject(path=file_path)
readFromFile = Image.ReadFromFile(file=file_from_path)

# group: Input
code_block_3 = CodeBlock { true; "Cancel"; "Run"; 700; 350; }
code_block_4 = CodeBlock()
# ---------- code_block_4.designscript (2 lines) ----------
"Note:";
"This script will: \n1. Assign new revision to the model and syncronise with Central.\n2. Save a detached copy of the model in the project's 01 WIP - Internal Work folder (or 02 Shared - Externally) and remove all sheets and views.\n3. Remove all linked files (optional).\n4. Export NWC and IFC files (optional).\n\nPlease make sure all users have relinquished all elements before running the script. If there are Design Options in the model, please accept primary after the script has run";
# ----------------------------------------
textnote_data = Custom[TextNote Data](Title=code_block_4.out0, TextNote=code_block_4.out1)  # package Data-Shapes; Create Data for TextNote input in UI.MultipleInputForm ++ . Check out www.data-shapes.net for more informations
code_block_5 = CodeBlock { "Save model in 01 WIP - Internal Work?"; true; }
boolean_input = Custom[Boolean input](InputName=code_block_5.out0, DefaultValue=code_block_5.out1)  # package Data-Shapes; Creates a boolean input for UI.MultipleInputForm ++ . Check out www.data-shapes.net for more infos!
code_block_6 = CodeBlock { "Issued to:"; "Issued by:"; "Approved by:"; "Revision description"; }
code_block_7 = CodeBlock { "DT"; ""; "Issued for co-ordination"; }
ui_textbox_data = Custom[UI.TextBox Data](InputName=code_block_6.out0, DefaultText=code_block_7.out0)  # package Data-Shapes; Create Data for TextBox input in UI.MultipleInputForm ++ . Check out www.data-shapes.net for more informations
ui_textbox_data_2 = Custom[UI.TextBox Data](InputName=code_block_6.out1, DefaultText=code_block_7.out1)
ui_textbox_data_3 = Custom[UI.TextBox Data](InputName=code_block_6.out2, DefaultText=code_block_7.out1)
ui_textbox_data_4 = Custom[UI.TextBox Data](InputName=code_block_6.out3, DefaultText=code_block_7.out2)
code_block_8 = CodeBlock { "Suitability :"; }
code_block_9 = CodeBlock()
# ---------- code_block_9.designscript (21 lines) ----------
[
"S1 - Suitable for Co-ordination",
"S2 - Suitable for Information",
"S3 - Suitable for Review & Comment",
"S4 - Suitable for Stage Approval",
"S6 - Suitable for PIM Authorization",
"S7 - Suitable for AIM Authorization",
"A1 - Authorized and Accepted",
"A2 - Authorized and Accepted",
"A3 - Authorized and Accepted",
"A4 - Authorized and Accepted",
"B1 - Partial Sign-off",
"B2 - Partial Sign-off",
"B3 - Partial Sign-off",
"B4 - Partial Sign-off",
"CR - As Constructed Record"
];

"S1 - Suitable for Co-ordination";

false;
# ----------------------------------------
# note: Custom Node: Data-Shapes v.2018.12.1
ui_dropdown_data = Custom[UI.DropDown Data](InputName=code_block_8, Keys=code_block_9.out0, Values=code_block_9.out0, Sorted_optional=code_block_9.out2)  # package Data-Shapes; Create data for DropDown input in UI.MultiInputForm ++ . Check out www.data-shapes.net for more infos.
code_block_10 = CodeBlock { "Remove all .rvt links?"; true; }
ui_boolean_input = Custom[UI.Boolean input](InputName=code_block_10.out0, DefaultValue=code_block_10.out1)  # package Data-Shapes; Creates a boolean input for UI.MultipleInputForm ++ . Check out www.data-shapes.net for more infos!
code_block_11 = CodeBlock { "Remove all .dwg links?"; true; }
ui_boolean_input_2 = Custom[UI.Boolean input](InputName=code_block_11.out0, DefaultValue=code_block_11.out1)
code_block_12 = CodeBlock { "Export .nwc?"; "Export IFC?"; "Remove elements in Library phase?"; "Ungroup all Model Groups"; true; }
boolean_input_2 = Custom[Boolean input](InputName=code_block_12.out0)
boolean_input_3 = Custom[Boolean input](InputName=code_block_12.out1)
boolean_input_4 = Custom[Boolean input](InputName=code_block_12.out2, DefaultValue=code_block_12.out4)
boolean_input_5 = Custom[Boolean input](InputName=code_block_12.out3, DefaultValue=code_block_12.out4)
list_create = List.Create(item0=textnote_data, item1=boolean_input, item2=ui_textbox_data, item3=ui_textbox_data_2, item4=ui_textbox_data_3, item5=ui_textbox_data_4, item6=ui_dropdown_data, item7=ui_boolean_input, item8=ui_boolean_input_2, item9=boolean_input_2, item10=boolean_input_3, item11=boolean_input_4, item12=boolean_input_5)
ui_multipleinputform = Custom[UI.MultipleInputForm ++](Logo_optional=readFromFile, ButtonText_optional=code_block_3.out2, Inputs=list_create, Toggle=code_block_3.out0, CancelButtonText_optional=code_block_3.out1, Width_optional=code_block_3.out3, LabelWidth_optional=code_block_3.out4)  # package Data-Shapes; Create a form with multiple inputs. see www.data-shapes.net for tutorials and infos!
code_block_13 = CodeBlock { " - "; }

# group: Control
# note: Do not run the script if the Cancel button is pressed
not_ = Not(x=ui_multipleinputform.Was_Cancelled)
runMe = Custom[Tool.RunMe](Boolean=not_, ThingToDo=ui_multipleinputform.User_Inputs)  # package SteamNodes; Use Boolean to perform an action

code_block_14 = CodeBlock(x=runMe) { issuedTo=x[1]; x[2]; x[3]; issueDescr=x[4]; saveWIP=x[0]; }

# group: Assing
# note: Assign Drawn and Apporved to splash screen
code_block_15 = CodeBlock { "Drawn By"; "Approved By"; }
setParameterByName = Element.SetParameterByName(element=filterByBoolMask.in, parameterName=code_block_15.out0, value=code_block_14.out1)
setParameterByName_2 = Element.SetParameterByName(element=filterByBoolMask.in, parameterName=code_block_15.out1, value=code_block_14.out2)

# group: Usage
code_block_16 = CodeBlock { "Issue Model"; }
acg_script_usage = Custom[ACG Script Usage](scriptName=code_block_16)  # Adds an entry to Excel document every time a script is run. The document is located in S:\Dynamo\05-UsageStats

# group: Control
code_block_17 = CodeBlock { "\\01 WIP - Internal Work\\"; "\\02 Shared - Externally\\Architect\\"; }
code_block_18 = CodeBlock(wip=code_block_14.saveWIP, a=code_block_17.out0, b=code_block_17.out1) { wip==true?a:b; }

# group: Processing
# note: Current document name
# Custom Node: Node-Mode v.2016.11.10
python_script = Python()  # IronPython2
# ---------- python_script.python (15 lines) ----------
#Copyright (c) mostafa el ayoubi
#Node-mode 2016 elayoub.mostafa@gmail.com

import clr
clr.AddReference('RevitAPI')
from Autodesk.Revit.DB import*
clr.AddReference('RevitServices')
from RevitServices.Persistence import DocumentManager

doc = DocumentManager.Instance.CurrentDBDocument
path = doc.PathName
docname = path.encode('string-escape')


OUT = docname.split("\\")[-1] , path
# ----------------------------------------
code_block_19 = CodeBlock(docName=python_script, filePath=python_script) { docName[0]; filePath[1]; }

# group: Control
# note: Do not run the script if the Cancel button is pressed
not_2 = Not(x=ui_multipleinputform.Was_Cancelled)
code_block_20 = CodeBlock { true; }
runMe_2 = Custom[Tool.RunMe](Boolean=not_2, ThingToDo=code_block_20)

# group: Processing
code_block_21 = CodeBlock { ""; "ACG"; "None"; "Numeric"; false; }
ACGCurrentDate = Custom[ACGCurrentDate]()  # Generates today's date YY MM DD or DD.MM.YY
byName_2 = Revision.ByName(name=code_block_21.out0, revDate=ACGCurrentDate.DD_MM_YY, description=code_block_14.issuedTo, issued=code_block_21.out4, issuedBy=code_block_21.out1, issuedTo=code_block_14.issueDescr, visibility=code_block_21.out2, numberType=code_block_21.out3)

# group: Assing
# note: Assign revision to splash screen
code_block_22 = CodeBlock { true; }
add_revisions_to_sheet = Custom[Add Revisions to Sheet](sheet=filterByBoolMask.in, revision=byName_2, runIt=code_block_22)  # package archi-lab.net; This node will add specified revisions to a sheet.

# group: Visualisation
# note: Sync current model
await_ = Orchid.Common.DataStream.Await(pass=runMe_2, waitFor=add_revisions_to_sheet)
current = Orchid.RevitProject.Common.Document.Current()
synchronizewithcentral_in = Custom[SynchronizeWithCentral in Document](relinquishProjectStandardWorksets=await_, relinquishViewWorksets=await_, relinquishFamilyWorksets=await_, relinquishUserCreatedWorksets=await_, relinquishBorrowedElements=await_, compactCentralModel=await_, saveLocalFileBeforeSync=await_, saveLocalFileAfterSync=await_, runMe=await_, document=current)  # package Genius Loci; Synchronizes a workshared model with the central model with the choice of the Revit document. Based on a Clockwork node

# group: Control
end = Revit.Transaction.Transaction.End(input=synchronizewithcentral_in.success)
end_2 = Revit.Transaction.Transaction.End(input=synchronizewithcentral_in.Document)

# group: Visualisation
list_create_2 = List.Create(item0=end, item1=end_2)
await_2 = Orchid.Common.DataStream.Await(pass=code_block_19.out0, waitFor=list_create_2)

# group: Get new model name
code_block_23 = CodeBlock { "/"; }
split = String.Split(string=await_2, separator0=code_block_23)
lastItem = List.LastItem(list=split)
code_block_24 = CodeBlock { "_"; }
split_2 = String.Split(string=lastItem, separator0=code_block_24)
firstItem = List.FirstItem(list=split_2)
code_block_25 = CodeBlock { ".rvt"; ""; }
replace = String.Replace(string=firstItem, searchFor=code_block_25.out0, replaceWith=code_block_25.out1)
code_block_26 = CodeBlock { "_.rvt"; ".rvt"; }
replace_2 = String.Replace(string=lastItem, searchFor=code_block_26.out0, replaceWith=code_block_26.out1)

current_2 = Orchid.RevitProject.Common.Document.Current()

# group: Control
code_block_27 = CodeBlock { "\\01 WIP - Internal Work\\"; "\\02 Shared - Externally\\Architect\\"; }
code_block_28 = CodeBlock(wip=code_block_14.saveWIP, a=code_block_27.out0, b=code_block_27.out1) { wip==true?a:b; }

# group: Processing
code_block_29 = CodeBlock { "Project Information"; "Project Directory"; }
byName_3 = Category.ByName(name=code_block_29.out0)
all_elements_of_category_2 = ElementsOfCategory(Category=byName_3)
getParameterValueByName = Element.GetParameterValueByName(element=all_elements_of_category_2, parameterName=code_block_29.out1)
ACGCurrentDate_2 = Custom[ACGCurrentDate]()
code_block_30 = CodeBlock(dir=getParameterValueByName, saveFolder=code_block_28, date=ACGCurrentDate_2.YYMMDD, file=firstItem) { dir+saveFolder+date; dir+saveFolder+date+"\\"+file; }

# group: Control
# note: Do not run the script if the Cancel button is pressed
not_3 = Not(x=ui_multipleinputform.Was_Cancelled)
runMe_3 = Custom[Tool.RunMe](Boolean=not_3, ThingToDo=code_block_30.out0)

# group: Visualisation
directory_from_path = DirectoryObject(path=runMe_3)
# note: Create directory in the 02-Shared folder
await_3 = Orchid.Common.DataStream.Await(pass=code_block_30.out1, waitFor=directory_from_path)

# group: Control
# note: Do not run the script if the Cancel button is pressed
not_4 = Not(x=ui_multipleinputform.Was_Cancelled)
code_block_31 = CodeBlock { true; }
runMe_4 = Custom[Tool.RunMe](Boolean=not_4, ThingToDo=code_block_31)

document_saveas = Custom[Document SaveAs](filePath=await_3, compactFile=runMe_4, saveAsCentral=runMe_4, isWorkshared=runMe_4)  # package Genius Loci; Saves the given Revit document under the given name. Based on a Clockwork node

# group: Visualisation
await_4 = Orchid.Common.DataStream.Await(pass=runMe, waitFor=document_saveas.Success)
code_block_32 = CodeBlock(suitability=await_4, rvtLinks=await_4, dwgLinks=await_4, exportNWC=await_4, exportIFC=await_4, deleteLibrary=await_4, ungpruop=await_4) { suitability[5]; rvtLinks[6]; dwgLinks[7]; exportNWC[8]; exportIFC[9]; deleteLibrary[10]; ungpruop[11]; }

# group: Processing
code_block_33 = CodeBlock { true; }
# note: Document.LinksAndImports
# Custom Node: Clockwork v.2.1.0
python_script_2 = Python(IN[0]=code_block_33)  # IronPython2
# ---------- python_script_2.python (21 lines) ----------
import clr
clr.AddReference('RevitAPI')
from Autodesk.Revit.DB import *
import Autodesk

clr.AddReference("RevitServices")
import RevitServices
from RevitServices.Persistence import DocumentManager

doc = DocumentManager.Instance.CurrentDBDocument
# need to learn how to implement LINQ here...
collector = FilteredElementCollector(doc)
impinst = collector.OfClass(ImportInstance).ToElements()
linkedlist = list()
importlist = list()
for item in impinst:
	if item.IsLinked:
		linkedlist.append(item)
	else:
		importlist.append(item)
OUT = (linkedlist,importlist)
# ----------------------------------------
code_block_34 = CodeBlock { c=Revit.Elements.Category.ByName("RVT Links"); ElementQueries.OfCategory(c); }
all_elements_of_category_3 = ElementsOfCategory(Category=code_block_34.out1)
runMe_5 = Custom[Tool.RunMe](Boolean=code_block_32.out1, ThingToDo=all_elements_of_category_3)
delete = archilab.Revit.Elements.Elements.Delete(element=runMe_5)

code_block_35 = CodeBlock(links=python_script_2, imports=python_script_2) { links[0]; imports[1]; }

# group (continued): Processing
create = List.Create(item0=code_block_35.out0, item1=code_block_35.out1)
# note: Remove Links
flatten = List.Flatten(list=create)
runMe_6 = Custom[Tool.RunMe](Boolean=code_block_32.out2, ThingToDo=flatten)
delete_2 = archilab.Revit.Elements.Elements.Delete(element=runMe_6)

# group: Processing
code_block_36 = CodeBlock { c=Revit.Elements.Category.ByName("Sheets"); ElementQueries.OfCategory(c); "Project Information"; }
sheetNumber_2 = Sheet.SheetNumber(sheet=code_block_36.out1)
# note: collect all sheets but splash page
eq = sheetNumber_2 == code_block_36.out2
filterByBoolMask_2 = List.FilterByBoolMask(list=code_block_36.out1, mask=eq)

# group: Processing
get_all_views = Custom[Get all views]()  # package Genius Loci; Collects all views in the active or given document.
list_create_3 = List.Create(item0=get_all_views.Schedule, item1=get_all_views.Legend)
# note: Collect all shedules and legends
flatten_2 = List.Flatten(list=list_create_3)

# group: Processing
# note: Collect all view templates (except 3D)
collectallviewtemplates_python = Python()  # "CollectAllViewTemplates - Python Script"; IronPython2; unwired: IN[0]
# ---------- collectallviewtemplates_python.python (19 lines) ----------
# https://forum.dynamobim.com/t/get-all-view-templates-with-python/24527/3

import clr
clr.AddReference('RevitAPI')
from Autodesk.Revit.DB import*

clr.AddReference('RevitServices')
from RevitServices.Persistence import DocumentManager
from RevitServices.Transactions import TransactionManager

clr.AddReference('ProtoGeometry')
from Autodesk.DesignScript.Geometry import *

doc = DocumentManager.Instance.CurrentDBDocument

viewswithoutnull = [t for t in FilteredElementCollector(doc).OfClass
(View).ToElements() if t.IsTemplate and t.ViewType < ViewType.ThreeD]

OUT = viewswithoutnull
# ----------------------------------------

# group: Processing
code_block_37 = CodeBlock { c=Revit.Elements.Category.ByName("Views"); ElementQueries.OfCategory(c); ["Navisworks","IFC Export"]; }
clear_list = Custom[Clear List](input=code_block_37.out1)  # package archi-lab.net; This node will remove all Null and Empty Lists from any list.
name = Element.Name(element=clear_list)
# note: collect all view and put to [IN] IFC_Export & Navisworks
eq_2 = name == code_block_37.out2@@L2  # lacing=Longest
anyTrue = Orchid.Common.List.AnyTrue(list=eq_2)
filterByBoolMask_3 = List.FilterByBoolMask(list=clear_list, mask=anyTrue)

# group: Processing
code_block_38 = CodeBlock { "View Folder 1 (View type)"; "COORDINATION"; true; }
getParameterValueByName_2 = Element.GetParameterValueByName(element=filterByBoolMask_3.out, parameterName=code_block_38.out0)
contains_2 = String.Contains(string=getParameterValueByName_2, searchFor=code_block_38.out1, ignoreCase=code_block_38.out2)
filterByBoolMask_4 = List.FilterByBoolMask(list=filterByBoolMask_3.out, mask=contains_2)

# group: Delete all collected elements
create_2 = List.Create(item0=filterByBoolMask_2.out, item1=flatten_2, item2=collectallviewtemplates_python, item3=filterByBoolMask_4.out)
flatten_3 = List.Flatten(list=create_2)
await_5 = Orchid.Common.DataStream.Await(pass=flatten_3, waitFor=delete_2)

# group: Control
# note: Do not run the script if the Cancel button is pressed
not_5 = Not(x=ui_multipleinputform.Was_Cancelled)
runMe_7 = Custom[Tool.RunMe](Boolean=not_5, ThingToDo=await_5)

# group: Visualisation
delete_3 = archilab.Revit.Elements.Elements.Delete(element=runMe_7)

# group: Processing
code_block_39 = CodeBlock { c=Revit.Elements.Category.ByName("Model Groups"); ElementQueries.OfCategory(c); }
runMe_8 = Custom[Tool.RunMe](Boolean=code_block_32.out6, ThingToDo=code_block_39.out1)
# note: Ungroup all Model Groups
ungroupElements = Group.UngroupElements(group=runMe_8)

create_3 = List.Create(item0=delete_2, item1=delete, item2=delete_3, item3=ungroupElements)

# group: Assing
code_block_40 = CodeBlock { "ACG_Suitability"; catPI=Revit.Elements.Category.ByName("Project Information"); ElementQueries.OfCategory(catPI); }
# note: Change suitability status
setParameterByName_3 = Element.SetParameterByName(element=code_block_40.out2, parameterName=code_block_40.out0, value=code_block_32.out0)

await_6 = Orchid.Common.DataStream.Await(pass=create_3, waitFor=setParameterByName_3)
await_7 = Orchid.Common.DataStream.Await(pass=current_2, waitFor=await_6)
code_block_41 = CodeBlock { true; }
# note: Custom Node: Orchid v. 204.1.4.7501
purge = Orchid.RevitProject.Common.Document.Purge(document=await_7, completely=code_block_41)

# group: Assing
code_block_42 = CodeBlock { catSheets=Revit.Elements.Category.ByName("Sheets"); ElementQueries.OfCategory(catSheets); "Project Information"; }
sheetNumber_3 = Sheet.SheetNumber(sheet=code_block_42.out1)
eq_3 = sheetNumber_3 == code_block_42.out2
filterByBoolMask_5 = List.FilterByBoolMask(list=code_block_42.out1, mask=eq_3)
split_3 = String.Split(string=code_block_32.out0, separator0=code_block_13)
flatten_4 = List.Flatten(list=split_3)
code_block_43 = CodeBlock(x=flatten_4) { x[0]; x[1]; "Suitability No."; "Suitability Desc."; }
setParameterByName_4 = Element.SetParameterByName(element=filterByBoolMask_5.in, parameterName=code_block_43.out2, value=code_block_43.out0)
setParameterByName_5 = Element.SetParameterByName(element=filterByBoolMask_5.in, parameterName=code_block_43.out3, value=code_block_43.out1)

# group: Control
# note: Should library elements be deleted
code_block_44 = CodeBlock { DSCore.Types.FindTypeByNameInAssembly("Phase","RevitAPI"); }
runMe_9 = Custom[Tool.RunMe](Boolean=code_block_32.out5, ThingToDo=code_block_44)

# group: Filtering
all_elements_of_type = ElementsOfType(element_type=runMe_9)
code_block_45 = CodeBlock(phase=all_elements_of_type) { phase.Name; "Library"; "Existing"; }
contains_3 = String.Contains(string=code_block_45.out0, searchFor=code_block_45.out1)
filterByBoolMask_6 = List.FilterByBoolMask(list=all_elements_of_type, mask=contains_3)
contains_4 = String.Contains(string=code_block_45.out0, searchFor=code_block_45.out2)
filterByBoolMask_7 = List.FilterByBoolMask(list=all_elements_of_type, mask=contains_4)

# group: Visualisation
# note: All Elemenents at Phase
# from GeniusLoci
python_script_3 = Python(IN[0]=filterByBoolMask_6.in)  # IronPython2
# ---------- python_script_3.python (19 lines) ----------
#Alban de Chasteigner 2020
#twitter : @geniusloci_bim
#geniusloci.bim@gmail.com

import clr
clr.AddReference('RevitAPI')
import Autodesk
from Autodesk.Revit.DB import *

phases = UnwrapElement(IN[0]) if isinstance(IN[0],list) else [UnwrapElement(IN[0])]
phaseList = []

for phase in phases :
	doc=phase.Document
	filter=ElementParameterFilter(ParameterFilterRuleFactory.CreateEqualsRule(ElementId(BuiltInParameter.PHASE_CREATED), phase.Id))
	phaseList.append(FilteredElementCollector(doc).WherePasses(filter).WhereElementIsNotElementType().ToElements())
	
if isinstance(IN[0], list): OUT = phaseList
else: OUT = phaseList[0]
# ----------------------------------------

# group: Processing
code_block_46 = CodeBlock { "Phase Demolished"; }
getParameterValueByName_3 = Element.GetParameterValueByName(element=python_script_3, parameterName=code_block_46)
# note: collect only elements deleted in Existing phase
code_block_47 = CodeBlock(phase=getParameterValueByName_3) { phase.Name; "Existing"; }
contains_5 = String.Contains(string=code_block_47.out0, searchFor=code_block_47.out1)
code_block_48 = CodeBlock(value=contains_5, b=contains_5) { value==null?false:b; }
filterByBoolMask_8 = List.FilterByBoolMask(list=python_script_3, mask=code_block_48)

# group: Visualisation
# note: Delete selected elements
delete_4 = archilab.Revit.Elements.Elements.Delete(element=filterByBoolMask_8.in)

list_create_4 = List.Create(item0=purge, item1=setParameterByName_4, item2=setParameterByName_5, item3=delete_4)

# group: Get new model name
await_8 = Orchid.Common.DataStream.Await(pass=replace, waitFor=list_create_4)
code_block_49 = CodeBlock(x=await_8) { x+".rvt"; x+".ifc"; x; }

# group: Visualisation
code_block_50 = CodeBlock(dir=getParameterValueByName, saveFolder=code_block_18, date=ACGCurrentDate_2.YYMMDD, file=code_block_49.out0) { dir+saveFolder+date; dir+saveFolder+date+"\\"+file; }
code_block_51 = CodeBlock(x=code_block_50.out0) { x[0]; }
directory_from_path_2 = DirectoryObject(path=code_block_50.out0)
await_9 = Orchid.Common.DataStream.Await(pass=code_block_50.out1, waitFor=directory_from_path_2)

# group: Control
# note: Do not run the script if the Cancel button is pressed
not_6 = Not(x=ui_multipleinputform.Was_Cancelled)
runMe_10 = Custom[Tool.RunMe](Boolean=not_6, ThingToDo=await_9)
code_block_52 = CodeBlock { true; }
runMe_11 = Custom[Tool.RunMe](Boolean=not_6, ThingToDo=code_block_52)

document_saveas_2 = Custom[Document SaveAs](filePath=runMe_10, compactFile=runMe_11, saveAsCentral=runMe_11, isWorkshared=runMe_11)

# group: Export and rename .nwc
code_block_53 = CodeBlock { ""; "nwc"; }
code_block_54 = CodeBlock(x=filterByBoolMask_3.in) { exportNavis=x[1]; exportIFC=x[0]; }
runMe_12 = Custom[Tool.RunMe](Boolean=code_block_32.out3, ThingToDo=code_block_54.exportNavis)
await_10 = Orchid.Common.DataStream.Await(pass=runMe_12, waitFor=document_saveas_2.Success)
code_block_55 = CodeBlock(e=await_10) { e.Name; }
export_views_to_navisworks = Python(IN[0]=await_10, IN[1]=code_block_51, IN[2]=code_block_53.out0)  # "Export Views to NavisWorks - DataShapes"; IronPython2
# ---------- export_views_to_navisworks.python (22 lines) ----------
import clr
clr.AddReference('RevitAPI')
from Autodesk.Revit.DB import*

clr.AddReference('RevitServices')
from RevitServices.Persistence import DocumentManager

doc = DocumentManager.Instance.CurrentDBDocument

if isinstance(IN[0],list):
	views = UnwrapElement(IN[0])
else: 
	views = [UnwrapElement(IN[0])]

prefix = IN[2]
for v in views:
	nop = NavisworksExportOptions()
	nop.ExportScope = NavisworksExportScope.View
	nop.ViewId = v.Id
	doc.Export(IN[1],prefix + v.Name,nop)

OUT = "Success"
# ----------------------------------------
await_11 = Orchid.Common.DataStream.Await(pass=code_block_55, waitFor=export_views_to_navisworks)
rename = Orchid.Common.File.Rename(directory=code_block_51, extension=code_block_53.out1, sourceName=await_11, targetName=code_block_49.x)

# group: Export IFC
runMe_13 = Custom[Tool.RunMe](Boolean=code_block_32.out4, ThingToDo=code_block_54.exportIFC)
await_12 = Orchid.Common.DataStream.Await(pass=runMe_13, waitFor=rename)
code_block_56 = CodeBlock { "0"; false; }
export_ifc = Custom[Export IFC](DirectoryPath=code_block_51, view=await_12, Filename=code_block_49.x, ProjectOrigin=code_block_56.out0, RevitInternalPset=code_block_56.out1)  # package Genius Loci; Export View to IFC file. For use with the Select Phase node. Some other IFC options are embedded inside the python script.

list_create_5 = List.Create(item0=rename, item1=export_ifc, item2=document_saveas_2.Success)
code_block_57 = CodeBlock { "Exported!"; }

# group: Control
# note: Do not run the script if the Cancel button is pressed
not_7 = Not(x=ui_multipleinputform.Was_Cancelled)
runMe_14 = Custom[Tool.RunMe](Boolean=not_7, ThingToDo=list_create_5)
runMe_15 = Custom[Tool.RunMe](Boolean=not_7, ThingToDo=code_block_57)

# group: Visualisation
flatten_5 = List.Flatten(list=runMe_14)
# note: Meme!!!
acg_meme_generator = Custom[ACG Meme Generator](Inputs=flatten_5, ReportMessage=runMe_15)

# group: Control
code_block_58 = CodeBlock { "\\01 WIP - Internal Work\\"; "\\02 Shared - Externally\\Architect\\"; }
code_block_59 = CodeBlock(wip=code_block_14.saveWIP, a=code_block_58.out0, b=code_block_58.out1) { wip==true?a:b; }

ACGCurrentDate_3 = Custom[ACGCurrentDate]()

# group: Input
code_block_60 = CodeBlock { catPI=Revit.Category.ByName("Project Information"); allPI=ElementQueries.OfCategory(catPI); }
code_block_61 = CodeBlock { "Project Directory"; "ACG_Poject Code"; }
getParameterValueByName_4 = Element.GetParameterValueByName(element=code_block_60.allPI, parameterName=code_block_61.out0)
# note: New file path
code_block_62 = CodeBlock(prjDir=getParameterValueByName_4, saveFolder=code_block_59, date=ACGCurrentDate_3.YYMMDD) { prjDir[0]+saveFolder+date; }
string_from_object = FromObject(object=code_block_62)
directory_from_path_3 = DirectoryObject(path=string_from_object)
string_from_object_2 = FromObject(object=directory_from_path_3)
end_3 = Revit.Transaction.Transaction.End(input=string_from_object_2)
getParameterValueByName_5 = Element.GetParameterValueByName(element=code_block_60.allPI, parameterName=code_block_61.out1)

# group: Visualisation
code_block_63 = CodeBlock(dir=end_3, prjCode=getParameterValueByName_5) { dir+"\\"+prjCode[0]+"-ACG-XX-XX-SP-A-2009(ModelValidationChecklist).xlsx"; }
# note: create new xlsx file. write data here!
string_from_object_3 = FromObject(object=code_block_63)
code_block_64 = CodeBlock { "P:\\00_Blank job_DO NOT MOVE_alt drag to copy\\XXX_Production\\XXX_BIM Sharing\\02 Shared - Externally\\Architect\\XXX-ACG-XX-XX-SP-A-2009(ModelValidationChecklist).xlsx"; }
file_from_path_2 = FileObject(path=code_block_64)
code_block_65 = CodeBlock { false; }
copyFile = FileSystem.CopyFile(file=file_from_path_2, destinationPath=string_from_object_3, overwrite=code_block_65)
end_4 = Revit.Transaction.Transaction.End(input=copyFile)

# group: Processing
code_block_66 = CodeBlock { "ACG_Model Number"; }
getParameterValueByName_6 = Element.GetParameterValueByName(element=code_block_60.allPI, parameterName=code_block_66)
# note: get model number / spreadsheet number
code_block_67 = CodeBlock(x=getParameterValueByName_6) { x[0]; }

# group: Processing
current_3 = Document.Current()
filePath = Document.FilePath(document=current_3)
code_block_68 = CodeBlock { false; }
# note: model name
fileName = FileSystem.FileName(path=filePath, withExtension=code_block_68)
code_block_69 = CodeBlock { "_.rvt"; ".rvt"; }
replace_3 = String.Replace(string=fileName, searchFor=code_block_69.out0, replaceWith=code_block_69.out1)

# group: Control
code_block_70 = CodeBlock { catS=Revit.Category.ByName("Sheets"); allS=ElementQueries.OfCategory(catS); }
await_13 = Orchid.Common.DataStream.Await(pass=code_block_70.allS, waitFor=list_create_2)

# group: Input
code_block_71 = CodeBlock { "Sheet Number"; "Project Information"; }
getParameterValueByName_7 = Element.GetParameterValueByName(element=await_13, parameterName=code_block_71.out0)
code_block_72 = CodeBlock(value=getParameterValueByName_7, input=code_block_71.out1) { value==input; }
filterByBoolMask_9 = List.FilterByBoolMask(list=await_13, mask=code_block_72)
code_block_73 = CodeBlock()
# ---------- code_block_73.designscript (4 lines) ----------
[
"Drawn By",
"Approved By"
];
# ----------------------------------------
getParameterValueByName_8 = Element.GetParameterValueByName(element=filterByBoolMask_9.in@L1, parameterName=code_block_73@L2)

# group: Processing
revisions = archilab.Revit.Views.Sheets.Revisions(sheet=filterByBoolMask_9.in)
flatten_6 = List.Flatten(list=revisions)
count = List.Count(list=flatten_6)
code_block_74 = CodeBlock(num=count) { num; "P"+num; "P0"+num; }
# note: revision
code_block_75 = CodeBlock(numb=code_block_74.num, a=code_block_74.out2, b=code_block_74.out1) { numb<10?a:b; }

# group: Assing
list_create_6 = List.Create(item0=replace_3, item1=ACGCurrentDate_3.DD_MM_YY, item2=code_block_75, item3=getParameterValueByName_8)
flatten_7 = List.Flatten(list=list_create_6)

# group: Processing
acg_quick_family_naming_check = Custom[ACG Quick Family Naming Check]()
code_block_76 = CodeBlock(result=acg_quick_family_naming_check.Results_Naming) { 100-result; }
string_from_object_4 = FromObject(object=code_block_76)
code_block_77 = CodeBlock { "."; }
split_4 = String.Split(string=string_from_object_4, separator0=code_block_77)
# note: Family name compliance percentage
code_block_78 = CodeBlock(result=split_4) { "CHECKED - "+result[0]+"%"; }

# group: Assing
code_block_79 = CodeBlock { "YES"; }
list_create_7 = List.Create(item0=code_block_79, item1=code_block_79, item2=code_block_79, item3=code_block_78, item4=code_block_79, item5=code_block_79, item6=code_block_79, item7=code_block_79, item8=code_block_79)

# group: Processing
code_block_80 = CodeBlock { "YES"; "NO"; }
code_block_81 = CodeBlock(a=code_block_80.out0, b=code_block_80.out1) { removeLinks==true?a:b; removeLibrary==true?a:b; }  # unwired: removeLinks, removeLibrary

# group: Processing
code_block_82 = CodeBlock { "IFC"; ""; "NWC"; }
code_block_83 = CodeBlock(a=code_block_82.out0, b=code_block_82.out1, c=code_block_82.out2) { expIFC==true?a:b; expNWC==true?c:b; }  # unwired: expIFC, expNWC
code_block_84 = CodeBlock(ifc=code_block_83.out0, nwc=code_block_83.out1) { ifc+" "+nwc; "NO"; }
code_block_85 = CodeBlock(str=code_block_84.out0, a=code_block_84.out1, b=code_block_84.out0) { str; str==" "?a:b; }

# group: Assing
code_block_86 = CodeBlock { "YES"; }
list_create_8 = List.Create(item0=code_block_86, item1=code_block_86, item2=code_block_81.out0, item3=code_block_86, item4=code_block_86, item5=code_block_81.out1, item6=code_block_86, item7=code_block_85.out1, item8=code_block_86)

# group: Processing
code_block_87 = CodeBlock { "D10"; "E19"; "E32"; }
bb_data = Custom[BB Data](sheetName=code_block_67, origin=code_block_87.out0, data=flatten_7)  # package BumbleBee; This node is a building block for different modes of writing to Excel files. You can combines this node into a list to write to multiple sheets or use just one to write to a single sheet.
bb_data_2 = Custom[BB Data](sheetName=code_block_67, origin=code_block_87.out1, data=list_create_7)
bb_data_3 = Custom[BB Data](sheetName=code_block_67, origin=code_block_87.out2, data=list_create_8)
list_create_9 = List.Create(item0=bb_data, item1=bb_data_2, item2=bb_data_3)
flatten_8 = List.Flatten(list=list_create_9)

# group: Processing
await_14 = Orchid.Common.DataStream.Await(pass=string_from_object_3, waitFor=end_4)
code_block_88 = CodeBlock { 30; }
python_script_4 = Python(IN[0]=await_14, IN[1]=code_block_88)  # IronPython2
# ---------- python_script_4.python (7 lines) ----------
import time
dostuff =IN[0]
delaysec = IN[1]

time.sleep(delaysec)

OUT = dostuff
# ----------------------------------------
python_script_5 = Python(IN[0]=flatten_8, IN[1]=code_block_88)  # IronPython2; same code as python_script_4
python_script_6 = Python(IN[0]=end_4, IN[1]=code_block_88)  # IronPython2; same code as python_script_4

# group: Visualisation
code_block_89 = CodeBlock { true; }
write_excel = Custom[Write Excel](filePath=python_script_4, runIt=code_block_89, byColumn=code_block_89, BBData=python_script_5)  # package BumbleBee; This node will write data to Excel file and based on how your BBData nodes are structured it will either override the exsting file, create a new one and write a single worksheet or write multiple worksheets.
