# Dynamo graph Issue Model_py.dyn (Dynamo 2.12.1.8246)
# packages: Data-Shapes 2021.2.92, SteamNodes 1.2.3, Orchid 260.1.0.7729

# group: Usage
code_block = CodeBlock { "Issue Model"; }
acg_script_usage = Custom[ACG Script Usage](scriptName=code_block)  # Adds an entry to Excel document every time a script is run. The document is located in S:\Dynamo\05-UsageStats

file_path = Filename("..\ACG_logo.png")
file_from_path = FileObject(path=file_path)
readFromFile = Image.ReadFromFile(file=file_from_path)
code_block_2 = CodeBlock { "Remove all .pdf & image links?"; true; }
ui_boolean_input = Custom[UI.Boolean input](InputName=code_block_2.out0, DefaultValue=code_block_2.out1)  # package Data-Shapes; Creates a boolean input for UI.MultipleInputForm ++ . Check out www.data-shapes.net for more infos!
code_block_3 = CodeBlock { "Ungroup all Model Groups"; }
code_block_4 = CodeBlock { "Remove all views by Coordination"; true; }
ui_boolean_input_2 = Custom[UI.Boolean input](InputName=code_block_4.out0, DefaultValue=code_block_4.out1)
code_block_5 = CodeBlock { "Remove elements in Library phase?"; true; }

# group: Input
code_block_6 = CodeBlock { true; "Cancel"; "Run"; 700; 350; }
code_block_7 = CodeBlock()
# ---------- code_block_7.designscript (2 lines) ----------
"Note:";
"This script will: \n1. Assign new revision to the model and syncronise with Central.\n2. Save a detached copy of the model in the project's 01 WIP - Internal Work folder (or 02 Shared - Externally) and remove all sheets and views.\n3. Remove all linked files (optional).\n4. Export NWC and IFC files (optional).\n\nPlease make sure all users have relinquished all elements before running the script. If there are Design Options in the model, please accept primary after the script has run";
# ----------------------------------------
textnote_data = Custom[TextNote Data](Title=code_block_7.out0, TextNote=code_block_7.out1)  # package Data-Shapes; Create Data for TextNote input in UI.MultipleInputForm ++ . Check out www.data-shapes.net for more informations
code_block_8 = CodeBlock { "Issued to:"; "Issued by:"; "Approved by:"; "Revision description"; }
code_block_9 = CodeBlock { "DT"; ""; "Issued for co-ordination"; }
ui_textbox_data = Custom[UI.TextBox Data](InputName=code_block_8.out0, DefaultText=code_block_9.out0)  # package Data-Shapes; Create Data for TextBox input in UI.MultipleInputForm ++ . Check out www.data-shapes.net for more informations
ui_textbox_data_2 = Custom[UI.TextBox Data](InputName=code_block_8.out1, DefaultText=code_block_9.out1)
ui_textbox_data_3 = Custom[UI.TextBox Data](InputName=code_block_8.out2, DefaultText=code_block_9.out1)
ui_textbox_data_4 = Custom[UI.TextBox Data](InputName=code_block_8.out3, DefaultText=code_block_9.out2)
code_block_10 = CodeBlock { "Suitability :"; }
code_block_11 = CodeBlock()
# ---------- code_block_11.designscript (21 lines) ----------
[
"S1 - Suitable for Co-ordination",
"S2 - Suitable for Information",
"S3 - Suitable for Review & Comment",
"S4 - Suitable for Stage Approval",
"S6 - Suitable for PIM Authorization",
"S7 - Suitable for AIM Authorization",
"A1 - Authorized and Accepted",
"A2 - Authorized and Accepted",
"A3 - Authorized and Accepted",
"A4 - Authorized and Accepted",
"B1 - Partial Sign-off",
"B2 - Partial Sign-off",
"B3 - Partial Sign-off",
"B4 - Partial Sign-off",
"CR - As Constructed Record"
];

"S1 - Suitable for Co-ordination";

false;
# ----------------------------------------
ui_dropdown_data = Custom[UI.DropDown Data](InputName=code_block_10, Keys=code_block_11.out0, Values=code_block_11.out0, Sorted_optional=code_block_11.out2)  # package Data-Shapes; Create data for DropDown input in UI.MultiInputForm ++ . Check out www.data-shapes.net for more infos.
code_block_12 = CodeBlock { "Remove all .rvt links?"; true; }
ui_boolean_input_3 = Custom[UI.Boolean input](InputName=code_block_12.out0, DefaultValue=code_block_12.out1)
code_block_13 = CodeBlock { "Remove all .dwg links?"; true; }
ui_boolean_input_4 = Custom[UI.Boolean input](InputName=code_block_13.out0, DefaultValue=code_block_13.out1)
boolean_input = Custom[Boolean input](InputName=code_block_3)  # package Data-Shapes; Creates a boolean input for UI.MultipleInputForm ++ . Check out www.data-shapes.net for more infos!
boolean_input_2 = Custom[Boolean input](InputName=code_block_5.out0, DefaultValue=code_block_5.out1)
code_block_14 = CodeBlock { "Export NWC?"; "Export IFC?"; }
boolean_input_3 = Custom[Boolean input](InputName=code_block_14.out0)
boolean_input_4 = Custom[Boolean input](InputName=code_block_14.out1)
list_create = List.Create(item0=textnote_data, item1=ui_textbox_data, item2=ui_textbox_data_2, item3=ui_textbox_data_3, item4=ui_textbox_data_4, item5=ui_dropdown_data, item6=ui_boolean_input_3, item7=ui_boolean_input_4, item8=ui_boolean_input, item9=boolean_input, item10=ui_boolean_input_2, item11=boolean_input_2, item12=boolean_input_3, item13=boolean_input_4)
ui_multipleinputform = Custom[UI.MultipleInputForm ++](Logo_optional=readFromFile, ButtonText_optional=code_block_6.out2, Inputs=list_create, Toggle=code_block_6.out0, CancelButtonText_optional=code_block_6.out1, Width_optional=code_block_6.out3, LabelWidth_optional=code_block_6.out4)  # package Data-Shapes; Create a form with multiple inputs. see www.data-shapes.net for tutorials and infos!

# group: Control
# note: Do not run the script if the Cancel button is pressed
not_ = Not(x=ui_multipleinputform.Was_Cancelled)
runMe = Custom[Tool.RunMe](Boolean=not_, ThingToDo=ui_multipleinputform.User_Inputs)  # package SteamNodes; Use Boolean to perform an action

code_block_15 = CodeBlock(x=runMe)
# ---------- code_block_15.designscript (15 lines) ----------
issuedTo = x[0];
issuedBy = x[1];
approvedBy = x[2];
revDescr = x[3];
status = x[4];

removeRVT = x[5];
removeCAD = x[6];
removePDF = x[7];
ungroup = x[8];
removeViews = x[9];
removeLib = x[10];

exportNWC = x[11];
exportIFC = x[12];
# ----------------------------------------

# group: Visualisation
# note: create revision, apply to splash screen and push the rest of the parameters
python_script = Python(IN[0]=code_block_15.issuedTo, IN[1]=code_block_15.issuedBy, IN[2]=code_block_15.approvedBy, IN[3]=code_block_15.revDescr, IN[4]=code_block_15.status)  # IronPython2
# ---------- python_script.python (135 lines) ----------
# Load the Python Standard and DesignScript Libraries
import clr
import sys
import os.path
from datetime import datetime
from System import Environment
sys.path.append('C:\Program Files (x86)\IronPython 2.7\Lib')
import System
from System import Array
from System.Collections.Generic import *
clr.AddReference('ProtoGeometry')
from Autodesk.DesignScript.Geometry import *
clr.AddReference("RevitNodes")
import Revit
clr.ImportExtensions(Revit.Elements)
clr.ImportExtensions(Revit.GeometryConversion)
clr.AddReference("RevitServices")
import RevitServices
from RevitServices.Persistence import DocumentManager 
from RevitServices.Transactions import TransactionManager 

clr.AddReference("RevitAPI")
clr.AddReference("RevitAPIUI")

import Autodesk 
from Autodesk.Revit.DB import *
from Autodesk.Revit.UI import *
import time

doc = DocumentManager.Instance.CurrentDBDocument
uiapp = DocumentManager.Instance.CurrentUIApplication 
app = uiapp.Application 
uidoc = uiapp.ActiveUIDocument

issuedT = IN[0]
issuedB = IN[1]
approved = IN[2]
revDescr = IN[3]
status = IN[4]

# THIS PART UPDATES THE PARAMETERS ON THE SPLASH SCREEN
# parameterValueProvider (the id of the parameter object) & the filterRuleStringEvaluator
PVProvider = ParameterValueProvider(ElementId(BuiltInParameter.SHEET_NUMBER))
FSREvaluator = FilterStringEquals()
# the RULE
rule = FilterStringRule(PVProvider, FSREvaluator, 'Project Information')
# get the splash screen
splashScrn = FilteredElementCollector(doc).OfCategory(BuiltInCategory.OST_Sheets) \
.WherePasses(ElementParameterFilter(rule)) \
.ToElements()[0]
		
		
# create a revision and assign it to the splash screen
def createAssignRevision(sheet, issuedTo, issuedBy, description):
	# create the revision element
	TransactionManager.Instance.EnsureInTransaction(doc)		
	newRev = Revision.Create(doc)
	revId = []
	revId.append(newRev.Id)
	TransactionManager.Instance.TransactionTaskDone()	
	# set the metadata of the revision
	TransactionManager.Instance.EnsureInTransaction(doc)
	newRev.IssuedTo = issuedTo
	newRev.IssuedBy = issuedBy
	newRev.Description = description
	newRev.RevisionDate = datetime.today().strftime('%d.%m.%y')
	TransactionManager.Instance.TransactionTaskDone()
	# assign the new revision to the splash screen
	curRevs = sheet.GetAdditionalRevisionIds()
	curRevs.Add(newRev.Id)
	TransactionManager.Instance.EnsureInTransaction(doc)
	sheet.SetAdditionalRevisionIds(curRevs)
	TransactionManager.Instance.TransactionTaskDone()	
	
# assign parameters to the splash screen
def assignParamSplashScreen(sheet, issuedBy, approvedBy, status):
	TransactionManager.Instance.EnsureInTransaction(doc)
	sheet.LookupParameter('Drawn By').Set(issuedBy)
	sheet.LookupParameter('Approved By').Set(approvedBy)
	stats = status.split(' - ')
	sheet.LookupParameter('Suitability No.').Set(stats[0])
	sheet.LookupParameter('Suitability Desc.').Set(stats[1])
	TransactionManager.Instance.TransactionTaskDone()

createAssignRevision(splashScrn, issuedT, issuedB, revDescr)		
assignParamSplashScreen(splashScrn, issuedB, approved, status)


# THIS PARTS SYNSCH THE MODEL AND SAVEN NEW CENTRAL IN THE WIP FOLDER
pi = FilteredElementCollector(doc).OfCategory(BuiltInCategory.OST_ProjectInformation).ToElements()[0]
date = datetime.today().strftime('%y%m%d')
curModelName = doc.Title
curModelName = curModelName.split('_')
modelName = curModelName[0]

TransactionManager.Instance.ForceCloseTransaction()

# collect the project info element in RVT 2022 or RVT 2021
prjDir = pi.LookupParameter('Project Directory').AsString()

# assemble the Archived directory path
saveDir = prjDir + '\\01 WIP - Internal Work\\' + date
if not os.path.exists(saveDir):
	os.mkdir(saveDir)
	
# assemble the path for the archived model
filePath = saveDir + '\\' + modelName + '.rvt'


tOptions = TransactWithCentralOptions()
rOptions = RelinquishOptions(False)
rOptions.StandardWorksets = True
rOptions.ViewWorksets = True
rOptions.FamilyWorksets = True
rOptions.UserWorksets = True
rOptions.CheckedOutElements = True
sOptions = SynchronizeWithCentralOptions()
sOptions.SetRelinquishOptions(rOptions)
sOptions.Compact = False
sOptions.SaveLocalBefore = True
sOptions.SaveLocalAfter = True
doc.SynchronizeWithCentral(tOptions, sOptions)

worksharingOptions = WorksharingSaveAsOptions()
worksharingOptions.SaveAsCentral = True
SaveOptions = SaveAsOptions()
SaveOptions.MaximumBackups = 3
SaveOptions.SetWorksharingOptions(worksharingOptions)
SaveOptions.OverwriteExistingFile = True
SaveOptions.Compact = True
doc.SaveAs(filePath, SaveOptions)

saveMessage = 'The model is saved in %s' %saveDir

OUT = [True, saveMessage, saveDir]
# ----------------------------------------

# group: Control
await_ = Orchid.Common.DataStream.Await(pass=code_block_15.removeRVT, waitFor=python_script)

# group: Visualisation
# note: delete RVT links, CAD links, image & PDF links, views and sheets
# note: delete elements from library phase
python_script_2 = Python(IN[0]=await_, IN[1]=code_block_15.removeCAD, IN[2]=code_block_15.removePDF, IN[3]=code_block_15.ungroup, IN[4]=code_block_15.removeViews, IN[5]=code_block_15.removeLib)  # IronPython2
# ---------- python_script_2.python (216 lines) ----------
# Load the Python Standard and DesignScript Libraries
import clr
import sys
import os.path
from datetime import datetime
from System import Environment
sys.path.append('C:\Program Files (x86)\IronPython 2.7\Lib')
import System
from System import Array
from System.Collections.Generic import *
clr.AddReference('ProtoGeometry')
from Autodesk.DesignScript.Geometry import *
clr.AddReference("RevitNodes")
import Revit
clr.ImportExtensions(Revit.Elements)
clr.ImportExtensions(Revit.GeometryConversion)
clr.AddReference("RevitServices")
import RevitServices
from RevitServices.Persistence import DocumentManager 
from RevitServices.Transactions import TransactionManager 

clr.AddReference("RevitAPI")
clr.AddReference("RevitAPIUI")

import Autodesk 
from Autodesk.Revit.DB import *
from Autodesk.Revit.UI import *
import traceback

doc = DocumentManager.Instance.CurrentDBDocument
uiapp = DocumentManager.Instance.CurrentUIApplication 
app = uiapp.Application 
uidoc = uiapp.ActiveUIDocument

removeRVT = 	IN[0]
removeCAD = 	IN[1]
removeImage = 	IN[2]
ungroup = 		IN[3]
removeViews = 	IN[4]
removeLib = 	IN[5]
#purge = IN[6]
phase = 'Library'

def deleteElements(lst):
	count = 0
	for i in lst:
		ID = i.Id
		try:
			TransactionManager.Instance.EnsureInTransaction(doc)
			doc.Delete(ID)
			TransactionManager.Instance.TransactionTaskDone()
			count += 1
		except:
			continue
	return count
			
def purge():
	try:
		commandID = RevitCommandId.LookupCommandId('ID_PURGE_UNUSED')
		uiapp.PostCommand(commandID)
		CmId = CmndID.Id
		errorReport = 'Success'
	except:
		errorReport = 'Model not purged'

def delElementsFromPhase(phaseName):
	phase = None
	# collect the Library phase
	for p in FilteredElementCollector(doc).OfClass(Phase).ToElements():
		if p.Name == phaseName:
			phase = p
	if phase != None:
		# from geniousloci_bim		
		filter = ElementParameterFilter(ParameterFilterRuleFactory.CreateEqualsRule(ElementId(BuiltInParameter.PHASE_CREATED), phase.Id))		
		elements = FilteredElementCollector(doc).WherePasses(filter).WhereElementIsNotElementType().ToElementIds()	
		# delete the element in the Library phase
		count = 0
		TransactionManager.Instance.EnsureInTransaction(doc)
		for e in elements:
			try:
				doc.Delete(e)
				count +=1
			except:
				continue
		return '%s library elements deleted!' % count
		TransactionManager.Instance.TransactionTaskDone()		
	else:
		return 'Thre is no Library phase in the model!'

		
# make sure all transactions are closed
TransactionManager.Instance.ForceCloseTransaction()

# get all the RVT links in the model
if removeRVT:
	RVTlinks = FilteredElementCollector(doc).OfClass(RevitLinkType).ToElements()
	RVTremoved = deleteElements(RVTlinks)

# get all the CAD links in the model
if removeCAD:
	CADlinks = FilteredElementCollector(doc).OfClass(ImportInstance).WhereElementIsNotElementType().ToElements()
	CADremoved = deleteElements(CADlinks)

# get all the Image & PDF links in the model
if removeImage:
	imageLinks = FilteredElementCollector(doc).OfClass(ImageType).ToElements()
	imageRemoved = deleteElements(imageLinks)

# ungroup all model & detail groups
groupsUngrouped = 'Groups are still present in the model.'
if ungroup:
	try:
		groups = FilteredElementCollector(doc).OfClass(Group).WhereElementIsNotElementType().ToElements()
		countGroups = 0
		TransactionManager.Instance.EnsureInTransaction(doc)
		for g in groups:
			g.UngroupMembers()
			countGroups += 1
		TransactionManager.Instance.TransactionTaskDone()
		groupsUngrouped = '%s groups were ungrouped' % countGroups
	except:
		groupsUngrouped = traceback.format_exc()
		
	
# collect all views apart from 04 - COORDINATION including legends & schedules
views = FilteredElementCollector(doc).OfClass(View).WhereElementIsNotElementType().ToElements()
delViews = []
tempViews = []
for v in views:
	if v.LookupParameter('View Folder 1 (View type)'):
		if v.LookupParameter('View Folder 1 (View type)').AsString() != '04 - COORDINATION':
			delViews.append(v.Id)
			tempViews.append(v)
for v in tempViews:
	if v.Name == 'IFC Export' or v.Name == 'Navisworks':
		delViews.remove(v.Id)
				
# collect all views apart from 04 - COORDINATION & splash page
sheets = FilteredElementCollector(doc).OfClass(ViewSheet).WhereElementIsNotElementType().ToElements()
delSheets = []
for s in sheets:
	sPhase = s.LookupParameter('Sheet Phase').AsString()
	if sPhase:
		if s.SheetNumber != 'Project Information' or 'COORD' not in sPhase:
			delSheets.append(s.Id)
		else:
			continue
	else:
		delSheets.append(s.Id)

#delete the sheets and views
if removeViews:
	TransactionManager.Instance.EnsureInTransaction(doc)
	countViews = 0	
	for v in delViews:
		try:
			doc.Delete(v)
			countViews += 1
		except:
			continue
	viewsRemoved = '%s views were deleted' % countViews
	
	countSheets = 0
	for s in delSheets:
		try:
			doc.Delete(s)
			countSheets += 1
		except:
			continue
	sheetsRemoved = '%s sheets were deleted' % countSheets
	TransactionManager.Instance.TransactionTaskDone()
else:
	viewsRemoved = 'All views are still present in the model.'
	sheetsRemoved = 'All sheets are still present in the model.'
	
# remove all elements from Library phase
if removeLib:
	phaseResults = delElementsFromPhase(phase)
else:
	phaseResults = 'Library pahse elements are still present in the model.'	




# THIS SAVED THE CLEAN MODEL
TransactionManager.Instance.ForceCloseTransaction()
try:
	tOptions = TransactWithCentralOptions()
	rOptions = RelinquishOptions(False)
	rOptions.StandardWorksets = True
	rOptions.ViewWorksets = True
	rOptions.FamilyWorksets = True
	rOptions.UserWorksets = True
	rOptions.CheckedOutElements = True
	sOptions = SynchronizeWithCentralOptions()
	sOptions.SetRelinquishOptions(rOptions)
	sOptions.Compact = False
	sOptions.SaveLocalBefore = True
	sOptions.SaveLocalAfter = True
	doc.SynchronizeWithCentral(tOptions, sOptions)
	finalSave = 'The clean model has been saved. Please close it.'
except:
	finalSave = 'Error! The model has NOT been saved!'


OUT = [
True,
'%s RVT files were removed' % RVTremoved,
'%s CAD files were removed' % CADremoved,
'%s PDF and image files were removed' % imageRemoved,
groupsUngrouped,
viewsRemoved,
sheetsRemoved,
phaseResults,
finalSave
]
# ----------------------------------------

# group: Control
code_block_16 = CodeBlock(x=python_script) { saveDir = x[2]; }
await_2 = Orchid.Common.DataStream.Await(pass=code_block_16, waitFor=python_script_2)

# group: Visualisation
export_nwc_ifc = Python(IN[0]=code_block_15.exportNWC, IN[1]=code_block_15.exportIFC, IN[2]=await_2)  # IronPython2
# ---------- export_nwc_ifc.python (110 lines) ----------
#Alban de Chasteigner 2018
#twitter : @geniusloci_bim
#geniusloci.bim@gmail.com
import clr
clr.AddReference("RevitServices")
import RevitServices
from RevitServices.Persistence import DocumentManager
clr.AddReference("RevitAPI")
import Autodesk
from Autodesk.Revit.DB import *
import sys
import traceback
pyt_path = r'C:\Program Files (x86)\IronPython 2.7\Lib'
sys.path.append(pyt_path)

runNWC = IN[0]
runIFC = IN[1]
saveDir = IN[2]

doc = DocumentManager.Instance.CurrentDBDocument
# get the model Name
name = doc.Title

# EXPORT NWC !!!!
if runNWC:
	# get the Naviswork Export view
	paramId = ElementId(BuiltInParameter.VIEW_NAME)
	filter = ElementParameterFilter(FilterStringRule(ParameterValueProvider(paramId), FilterStringEquals(), 'Navisworks'))
	NWCview = FilteredElementCollector(doc).OfClass(View).WherePasses(filter).ToElements()[0]
	errorReportNWC = None
	try:
		# run export
		options = NavisworksExportOptions()
		options.ViewId = NWCview.Id
		options.ExportLinks = False
		options.Coordinates = 0 # O - Shared Coordinates
		options.ExportParts = False
		options.ExportElementIds = True
		options.ConvertElementProperties = True
		options.ExportRoomAsAttribute = True
		options.ExportRoomGeometry = False
		options.ExportUrls  = True
		options.DivideFileIntoLevels = False
		options.FindMissingMaterials = True
		result = doc.Export(saveDir, name, options)
	except:
		errorReportNWC = traceback.format_exc()

#Assign your output to the OUT variable
if runNWC == True and errorReportNWC == None:
	resultNWC = "NWC file has been exported to the WIP folder."
elif runNWC == False and errorReportNWC == None:
	resultNWC = "NWC file has not been exported."
else:
	resultNWC = errorReportNWC
	
# EXPORT IFC !!!
if runIFC:
	# get the ICF Export view
	paramId = ElementId(BuiltInParameter.VIEW_NAME)
	filter = ElementParameterFilter(FilterStringRule(ParameterValueProvider(paramId), FilterStringEquals(), 'IFC Export'))
	IFCview = FilteredElementCollector(doc).OfClass(View).WherePasses(filter).ToElements()[0]
	errorReportIFC = None
	try:
		# start transaction
		TransactionManager.Instance.EnsureInTransaction(doc)
		result = []
		options = IFCExportOptions()
		
		options.FileVersion = IFCVersion.IFC2x3
		options.WallAndColumnSplitting = False
		options.ExportBaseQuantities = False
		options.FilterViewId = IFCview.Id
	
		options.AddOption("ExportInternalRevitPropertySets", 'false')
		options.AddOption("ExportIFCCommonPropertySets",'true')	
		options.AddOption("ExportAnnotations ",'true')
		options.AddOption("SpaceBoundaries ", '0')
		options.AddOption("ExportRoomsInView", 'true')	
		options.AddOption("Use2DRoomBoundaryForVolume ", 'true')
		options.AddOption("UseFamilyAndTypeNameForReference ", 'true')
		options.AddOption("Export2DElements", 'false')
		options.AddOption("ExportPartsAsBuildingElements", 'false')
		options.AddOption("ExportBoundingBox", 'false')
		options.AddOption("ExportSolidModelRep", 'true')
		options.AddOption("ExportSchedulesAsPsets", 'false')
		options.AddOption("ExportSpecificSchedules", 'false')
		#True doesn't work. It would be necessary to use OpenInBackground method.
		options.AddOption("ExportLinkedFiles", 'false')
		options.AddOption("IncludeSiteElevation",'true')
		options.AddOption("StoreIFCGUID", 'true')
		options.AddOption("VisibleElementsOfCurrentView ", 'true')
		options.AddOption("UseActiveViewGeometry", 'true')
		options.AddOption("TessellationLevelOfDetail", "0,5")
		options.AddOption("ExportUserDefinedPsets", 'false')
		options.AddOption("SitePlacement", '0')	# 0 = SharedCoordinates

		c = doc.Export(saveDir, modelName, options)
		TransactionManager.Instance.TransactionTaskDone()
	except:
		errorReportIFC = traceback.format_exc()

if runIFC == True and errorReportIFC:
	resultIFC = "IFC file has been exported to the WIP folder."
elif runIFC == False and errorReportIFC:
	resultIFC = "IFC file has not been exported."
else:
	resultIFC = errorReportIFC
	
OUT = resultNWC, resultIFC
# ----------------------------------------

# group: Assing
code_block_17 = CodeBlock { "OK"; "Report:"; "\n"; }
code_block_18 = CodeBlock(y=python_script, x=python_script_2, z=export_nwc_ifc)
# ---------- code_block_18.designscript (13 lines) ----------
savemessage = y[1];

RVTreport = x[1];
CADreport = x[2];
PDFreport = x[3];
groupReport = x[4];
viewsReport = x[5];
sheetsReport = x[6];
libraryReport = x[7];
cleanSave = x[8];

NWCreport = z[0];
IFCreport = z[1];
# ----------------------------------------
list_create_2 = List.Create(item0=code_block_18.savemessage, item1=code_block_18.RVTreport, item2=code_block_18.CADreport, item3=code_block_18.PDFreport, item4=code_block_18.groupReport, item5=code_block_18.viewsReport, item6=code_block_18.sheetsReport, item7=code_block_18.libraryReport, item8=code_block_18.cleanSave, item9=code_block_18.NWCreport, item10=code_block_18.IFCreport)
join = String.Join(separator=code_block_17.out2, string0=list_create_2@L2)
textnote_data_2 = Custom[TextNote Data](Title=code_block_17.out1, TextNote=join)
await_3 = Orchid.Common.DataStream.Await(pass=code_block_6.out0, waitFor=export_nwc_ifc)
ui_multipleinputform_2 = Custom[UI.MultipleInputForm ++](Logo_optional=readFromFile, ButtonText_optional=code_block_17.out0, Inputs=textnote_data_2, Toggle=await_3)

# group: Control
current = Document.Current()
code_block_19 = CodeBlock { true; }
await_4 = Orchid.Common.DataStream.Await(pass=code_block_19, waitFor=python_script_2)
purgeUnused = Document.PurgeUnused(document=current, fullPurge=await_4)
