# Dynamo graph Areas - Move All To Workset_py.dyn (Dynamo 2.12.1.8246)
# packages: Data-Shapes 2021.2.92, Orchid 260.1.0.7729

# group: Usage
code_block = CodeBlock { "Area - Move All To Workset"; }
scriptUsage = Custom[Data.ScriptUsage](scriptName=code_block)  # Adds an entry to Excel document every time a script is run. The document is located in S:\Dynamo\05-UsageStats

file_path = Filename("..\ACG_logo.png")
file_from_path = FileObject(path=file_path)
readFromFile = Image.ReadFromFile(file=file_from_path)

# group: Input
code_block_2 = CodeBlock { true; "Run"; "Cancel"; 250; 700; }
python_script = Python()  # IronPython2
# ---------- python_script.python (46 lines) ----------
# Load the Python Standard and DesignScript Libraries
import clr
import sys
import os.path
from System import Environment
sys.path.append('C:\Program Files (x86)\IronPython 2.7\Lib')
import System
from System import Array
from System.Collections.Generic import *
clr.AddReference('ProtoGeometry')
from Autodesk.DesignScript.Geometry import (Geometry, Point as pt)
clr.AddReference("RevitNodes")
import Revit
clr.ImportExtensions(Revit.Elements)
clr.ImportExtensions(Revit.GeometryConversion)
clr.AddReference("RevitServices")
import RevitServices
from RevitServices.Persistence import DocumentManager 
from RevitServices.Transactions import TransactionManager 
clr.AddReference("RevitAPI")
clr.AddReference("RevitAPIUI")
import Autodesk 
from Autodesk.Revit.DB import *
from Autodesk.Revit.UI import *

doc = DocumentManager.Instance.CurrentDBDocument
uiapp = DocumentManager.Instance.CurrentUIApplication 
app = uiapp.Application 
uidoc = uiapp.ActiveUIDocument

worksets = FilteredWorksetCollector(doc).OfKind(WorksetKind.UserWorkset).ToWorksets()
wNames = [w.Name for w in worksets]
wIds = [str(w.Id) for w in worksets]

index = 0
for name in wNames:
	if 'Area' in name:
		break
	else:
		index += 1

if index >= len(wNames):
	index = 0
	

OUT = wNames, wIds, index
# ----------------------------------------
code_block_3 = CodeBlock(x=python_script) { "Select workset:"; keys = x[0]; values = x[1]; index = x[2]; }
dropdown_data = Custom[DropDown Data](InputName=code_block_3.out0, Keys=code_block_3.keys, Values=code_block_3.values, DefaultValueIndex=code_block_3.index)  # package Data-Shapes; Create data for DropDown input in UI.MultiInputForm ++ . Check out www.data-shapes.net for more infos.
list_create = List.Create(item0=dropdown_data)
multipleinputform = Custom[MultipleInputForm ++](Logo_optional=readFromFile, ButtonText_optional=code_block_2.out1, Inputs=list_create, Toggle=code_block_2.out0, CancelButtonText_optional=code_block_2.out2, Width_optional=code_block_2.out4, LabelWidth_optional=code_block_2.out3)  # package Data-Shapes; Create a form with multiple inputs. see www.data-shapes.net for tutorials and infos!
code_block_4 = CodeBlock(x=multipleinputform.User_Inputs) { wId = x[0]; }

# group: Visualisation
python_script_2 = Python(IN[0]=multipleinputform.Was_Cancelled, IN[1]=code_block_4)  # IronPython2
# ---------- python_script_2.python (61 lines) ----------
# Load the Python Standard and DesignScript Libraries
import clr
import sys
import os.path
from System import Environment
sys.path.append('C:\Program Files (x86)\IronPython 2.7\Lib')
import System
from System import Array
from System.Collections.Generic import *
clr.AddReference('ProtoGeometry')
from Autodesk.DesignScript.Geometry import (Geometry, Point as pt)
clr.AddReference("RevitNodes")
import Revit
clr.ImportExtensions(Revit.Elements)
clr.ImportExtensions(Revit.GeometryConversion)
clr.AddReference("RevitServices")
import RevitServices
from RevitServices.Persistence import DocumentManager 
from RevitServices.Transactions import TransactionManager 
clr.AddReference("RevitAPI")
clr.AddReference("RevitAPIUI")
import Autodesk 
from Autodesk.Revit.DB import *
from Autodesk.Revit.UI import *

doc = DocumentManager.Instance.CurrentDBDocument
uiapp = DocumentManager.Instance.CurrentUIApplication 
app = uiapp.Application 
uidoc = uiapp.ActiveUIDocument

cancelled =	IN[0]
worksetId =	int(IN[1])


opt = SpatialElementBoundaryOptions()
countPass, countFail = 0, 0


if cancelled == True:
	OUT = 'Error : ', 'The script was cancelled.'
else:
	TransactionManager.Instance.EnsureInTransaction(doc)
	
	catList = [BuiltInCategory.OST_Areas, BuiltInCategory.OST_AreaSchemeLines]
	typedList = List[BuiltInCategory](catList)
	elements = FilteredElementCollector(doc).WherePasses(ElementMulticategoryFilter(typedList)).ToElements()
#	elements = FilteredElementCollector(doc).OfCategory(BuiltInCategory.OST_Areas).ToElements()
	
	for el in elements:
		el.get_Parameter(BuiltInParameter.ELEM_PARTITION_PARAM).Set(worksetId)
		countPass += 1


	TransactionManager.Instance.TransactionTaskDone()
	
	if countPass == 0:
		OUT = 'Error : ', 'No areas or area boundary lines were moved to the selected workset.'
	elif countPass > 0 and countFail > 0:
		OUT = 'Success ! ', str(countPass) + ' areas and area boundary lines are now in the selected workset.\n' + str(countFail) + ' could not be moved.'
	else:
		OUT = 'Success ! ', str(countPass) + ' areas and area boundary lines are now in the selected workset.'
# ----------------------------------------
code_block_5 = CodeBlock(x=python_script_2) { true; title = x[0]; text = x[1]; "Okay"; }

await_ = Orchid.Common.DataStream.Await(pass=code_block_5.out0, waitFor=python_script_2)

# group: Assing
ui_textnote_data = Custom[UI.TextNote Data](Title=code_block_5.title, TextNote=code_block_5.text)  # package Data-Shapes; Create Data for TextNote input in UI.MultipleInputForm ++ . Check out www.data-shapes.net for more informations
ui_multipleinputform = Custom[UI.MultipleInputForm ++](Logo_optional=readFromFile, ButtonText_optional=code_block_5.out3, Inputs=ui_textnote_data, Toggle=await_)  # package Data-Shapes; Create a form with multiple inputs. see www.data-shapes.net for tutorials and infos!
