# Dynamo graph NDSS Room Schedule - By Rooms & Furniture.dyn (Dynamo 2.12.1.8246)
# packages: Orchid 260.1.0.7729, Data-Shapes 2021.2.92, SteamNodes 1.2.3, WombatDynamo 2.3.0

code_block = CodeBlock { catR=Revit.Category.ByName("Rooms"); allR=ElementQueries.OfCategory(catR); "Department"; "Phase"; }

# group: Input
code_block_2 = CodeBlock { catR=Revit.Category.ByName("Rooms"); allR=ElementQueries.OfCategory(catR); "Department"; }
getParameterValueByName = Element.GetParameterValueByName(element=code_block_2.allR, parameterName=code_block_2.out2)
code_block_3 = CodeBlock(deps=getParameterValueByName) { "Filter room elements by Department."; DSCore.List.UniqueItems(deps); false; }
code_block_4 = CodeBlock(value=code_block_3.out1) { value; value==""; "none"; }
code_block_5 = CodeBlock(x=code_block_4.out1, a=code_block_4.out2, b=code_block_4.value) { x?a:b; }
dropdown_data = Custom[DropDown Data](InputName=code_block_3.out0, Keys=code_block_5, Values=code_block_5, Sorted_optional=code_block_3.out2)  # package Data-Shapes; Create data for DropDown input in UI.MultiInputForm ++ . Check out www.data-shapes.net for more infos.

# group: Processing
code_block_6 = CodeBlock { DSCore.Types.FindTypeByNameInAssembly("Phase","RevitAPI"); }
all_elements_of_type = ElementsOfType(element_type=code_block_6)
code_block_7 = CodeBlock(ph=all_elements_of_type) { "Select unit GIA phase."; ph; ph.Name; }
dropdown_data_2 = Custom[DropDown Data](InputName=code_block_7.out0, Keys=code_block_7.out2, Values=code_block_7.out2)

# group: Input
code_block_8 = CodeBlock()
# ---------- code_block_8.designscript (9 lines) ----------
"Assign custom level parameter.";
"Assign custom room number parameter.";
"Assign unit type parameter.";
"Assign custom unit GI area parameter.";
"Assign storage area parameter.";
"Assign minimum NDSS unit area.";
"Assign minimum NDSS storage area.";
true;
"Assign unit count.";
# ----------------------------------------
ui_boolean_input = Custom[UI.Boolean input](InputName=code_block_8.out0, DefaultValue=code_block_8.out7)  # package Data-Shapes; Creates a boolean input for UI.MultipleInputForm ++ . Check out www.data-shapes.net for more infos!
ui_boolean_input_2 = Custom[UI.Boolean input](InputName=code_block_8.out1, DefaultValue=code_block_8.out7)
ui_boolean_input_3 = Custom[UI.Boolean input](InputName=code_block_8.out2, DefaultValue=code_block_8.out7)
ui_boolean_input_4 = Custom[UI.Boolean input](InputName=code_block_8.out3, DefaultValue=code_block_8.out7)
ui_boolean_input_5 = Custom[UI.Boolean input](InputName=code_block_8.out4, DefaultValue=code_block_8.out7)
ui_boolean_input_6 = Custom[UI.Boolean input](InputName=code_block_8.out5, DefaultValue=code_block_8.out7)
ui_boolean_input_7 = Custom[UI.Boolean input](InputName=code_block_8.out6, DefaultValue=code_block_8.out7)
ui_boolean_input_8 = Custom[UI.Boolean input](InputName=code_block_8.out8, DefaultValue=code_block_8.out7)
code_block_9 = CodeBlock { "Assign M category parameter"; true; "Validate unit types"; }
ui_boolean_input_9 = Custom[UI.Boolean input](InputName=code_block_9.out0, DefaultValue=code_block_9.out1)
ui_boolean_input_10 = Custom[UI.Boolean input](InputName=code_block_9.out2, DefaultValue=code_block_9.out1)

# group: Input
code_block_10 = CodeBlock()
# ---------- code_block_10.designscript (9 lines) ----------
"Increase NDSS required area from tenure (1).";
"Increase NDSS required area from tenure (2).";
"Increase NDSS required area from tenure (3).";
"Anount of area increase (in percents).";
true;
"0";

"Increase NDSS required area from tenure (4).";
"Increase NDSS required area from tenure (5).";
# ----------------------------------------
code_block_11 = CodeBlock { "ACG_Unit Tenure"; }
getParameterValueByName_2 = Element.GetParameterValueByName(element=code_block_2.allR, parameterName=code_block_11)
code_block_12 = CodeBlock(input=getParameterValueByName_2) { tenure=DSCore.List.UniqueItems(input); tenure==""; tenure; "No tenure assigned to rooms!"; false; }
code_block_13 = CodeBlock(x=code_block_12.out1, a=code_block_12.out3, b=code_block_12.out2) { x?a:b; }
dropdown_data_3 = Custom[DropDown Data](InputName=code_block_10.out0, Keys=code_block_13, Values=code_block_13)
textbox_data = Custom[TextBox Data](InputName=code_block_10.out3, DefaultText=code_block_10.out5, IsNumberEntry=code_block_10.out4)  # package Data-Shapes; Create Data for TextBox input in UI.MultipleInputForm ++ . Check out www.data-shapes.net for more informations
dropdown_data_4 = Custom[DropDown Data](InputName=code_block_10.out1, Keys=code_block_13, Values=code_block_13)
textbox_data_2 = Custom[TextBox Data](InputName=code_block_10.out3, DefaultText=code_block_10.out5, IsNumberEntry=code_block_10.out4)
dropdown_data_5 = Custom[DropDown Data](InputName=code_block_10.out2, Keys=code_block_13, Values=code_block_13)
textbox_data_3 = Custom[TextBox Data](InputName=code_block_10.out3, DefaultText=code_block_10.out5, IsNumberEntry=code_block_10.out4)
dropdown_data_6 = Custom[DropDown Data](InputName=code_block_10.out6, Keys=code_block_13, Values=code_block_13)
textbox_data_4 = Custom[TextBox Data](InputName=code_block_10.out3, DefaultText=code_block_10.out5, IsNumberEntry=code_block_10.out4)
dropdown_data_7 = Custom[DropDown Data](InputName=code_block_10.out7, Keys=code_block_13, Values=code_block_13)
textbox_data_5 = Custom[TextBox Data](InputName=code_block_10.out3, DefaultText=code_block_10.out5, IsNumberEntry=code_block_10.out4)

# group: Input
file_path = Filename("..\ACG_logo.png")
file_from_path = FileObject(path=file_path)
readFromFile = Image.ReadFromFile(file=file_from_path)
code_block_14 = CodeBlock { "Update accomodation schedule"; true; "Run"; "Cancel"; 700; 400; }
list_create = List.Create(item0=dropdown_data, item1=dropdown_data_2, item2=ui_boolean_input, item3=ui_boolean_input_2, item4=ui_boolean_input_3, item5=ui_boolean_input_4, item6=ui_boolean_input_5, item7=ui_boolean_input_6, item8=ui_boolean_input_7, item9=ui_boolean_input_8, item10=ui_boolean_input_9, item11=ui_boolean_input_10, item12=dropdown_data_3, item13=textbox_data, item14=dropdown_data_4, item15=textbox_data_2, item16=dropdown_data_5, item17=textbox_data_3, item18=dropdown_data_6, item19=textbox_data_4, item20=dropdown_data_7, item21=textbox_data_5)
ui_multipleinputform = Custom[UI.MultipleInputForm ++](Logo_optional=readFromFile, ButtonText_optional=code_block_14.out2, Inputs=list_create, Toggle=code_block_14.out1, CancelButtonText_optional=code_block_14.out3, Width_optional=code_block_14.out4, LabelWidth_optional=code_block_14.out5)  # package Data-Shapes; Create a form with multiple inputs. see www.data-shapes.net for tutorials and infos!

code_block_15 = CodeBlock(department=ui_multipleinputform.User_Inputs, lvl=ui_multipleinputform.User_Inputs, number=ui_multipleinputform.User_Inputs, unitType=ui_multipleinputform.User_Inputs, unitArea=ui_multipleinputform.User_Inputs, storageArea=ui_multipleinputform.User_Inputs, NDSSunitArea=ui_multipleinputform.User_Inputs, NDSSstorageArea=ui_multipleinputform.User_Inputs, unitCount=ui_multipleinputform.User_Inputs, phase=ui_multipleinputform.User_Inputs, mCategory=ui_multipleinputform.User_Inputs, validate=ui_multipleinputform.User_Inputs)
# ---------- code_block_15.designscript (12 lines) ----------
department[0];
lvl[2];
number[3];
unitType[4];
unitArea[5];
storageArea[6];
NDSSunitArea[7];
NDSSstorageArea[8];
unitCount[9];
phase[1];
mCategory[10];
validate[11];
# ----------------------------------------

# group: Input
# note: collect all rooms in the model and the name of their phase
getParameterValueByName_3 = Element.GetParameterValueByName(element=code_block.allR, parameterName=code_block.out3)
code_block_16 = CodeBlock(ph=getParameterValueByName_3) { ph.Name; }
code_block_17 = CodeBlock(phase=code_block_15.out9, input=code_block_16) { phase==input; }
filterByBoolMask = List.FilterByBoolMask(list=code_block.allR, mask=code_block_17)

# group: Input
getParameterValueByName_4 = Element.GetParameterValueByName(element=filterByBoolMask.in, parameterName=code_block.out2)
code_block_18 = CodeBlock(dept=getParameterValueByName_4, input=code_block_15.out0) { dept==input; }
filterByBoolMask_2 = List.FilterByBoolMask(list=filterByBoolMask.in, mask=code_block_18)

# group: Filtering
area = Room.Area(room=filterByBoolMask_2.in)
# note: filter out redundant rooms
code_block_19 = CodeBlock(area=area) { area>0; }
filterByBoolMask_3 = List.FilterByBoolMask(list=filterByBoolMask_2.in, mask=code_block_19)

# group: Control
code_block_20 = CodeBlock { "ACG_Unit Type"; " "; }
# note: Erase ACG_Unit Type values from all rooms that are going to be processed.
setParameterByName = Element.SetParameterByName(element=filterByBoolMask_3.in, parameterName=code_block_20.out0, value=code_block_20.out1)

# group: Visualisation
# note: Rooms that are going to be processed !!!!!
code_block_21 = CodeBlock(selectedRooms=setParameterByName) { selectedRooms; }

# group: Processing
code_block_22 = CodeBlock { "Number"; " "; }
getParameterValueByName_5 = Element.GetParameterValueByName(element=code_block_21, parameterName=code_block_22.out0)
split = String.Split(string=getParameterValueByName_5, separator0=code_block_22.out1)
firstItem = List.FirstItem(list=split@L2)

# group: Visualisation
# note: Rooms grouped by number
groupByKey = List.GroupByKey(list=code_block_21, keys=firstItem)

# group: Processing
code_block_23 = CodeBlock { catF=Revit.Category.ByName("Furniture"); allF=ElementQueries.OfCategory(catF); "BedSingle"; "BedDouble"; }
familyName = Orchid.RevitProject.Elements.Element.FamilyName(element=code_block_23.allF)
contains = String.Contains(string=familyName, searchFor=code_block_23.out2)
# note: single beds
filterByBoolMask_4 = List.FilterByBoolMask(list=code_block_23.allF, mask=contains)
contains_2 = String.Contains(string=familyName, searchFor=code_block_23.out3)
# note: double beds
filterByBoolMask_5 = List.FilterByBoolMask(list=code_block_23.allF, mask=contains_2)

# group: Processing
getLocation = Element.GetLocation(element=filterByBoolMask_4.in)
isInsideRoom = Room.IsInsideRoom(room=code_block_21, point=getLocation, lacing=CrossProduct)
countTrue = List.CountTrue(list=isInsideRoom@L2)
getLocation_2 = Element.GetLocation(element=filterByBoolMask_5.in)
isInsideRoom_2 = Room.IsInsideRoom(room=code_block_21, point=getLocation_2, lacing=CrossProduct)
countTrue_2 = List.CountTrue(list=isInsideRoom_2@L2)
# note: bedroom & occupancu coeficient for each Room element
code_block_24 = CodeBlock(sBeds=countTrue, dBeds=countTrue_2) { bedrooms=sBeds+dBeds; occupancy=sBeds+(dBeds*2); }

# group: Visualisation
# note: Rooms grouped by number
# note: TYPES
groupByKey_2 = List.GroupByKey(list=code_block_24.bedrooms, keys=firstItem)
groupByKey_3 = List.GroupByKey(list=code_block_24.occupancy, keys=firstItem)

# group: Processing
sum = Math.Sum(values=groupByKey_2.groups@L2)
string_from_object = FromObject(object=sum)
code_block_25 = CodeBlock { "."; }
split_2 = String.Split(string=string_from_object, separator0=code_block_25)
firstItem_2 = List.FirstItem(list=split_2@L2)
sum_2 = Math.Sum(values=groupByKey_3.groups@L2)
string_from_object_2 = FromObject(object=sum_2)
split_3 = String.Split(string=string_from_object_2, separator0=code_block_25)
firstItem_3 = List.FirstItem(list=split_3@L2)
code_block_26 = CodeBlock(bedrooms=firstItem_2, occupancy=firstItem_3) { ""; bedrooms+"B"+occupancy+"P"; }
code_block_27 = CodeBlock(unitTyep=code_block_26.out1, a=code_block_26.out0, b=code_block_26.out1) { unitTyep=="0B0P"?a:b; }

# group: Visualisation
code_block_28 = CodeBlock { "ACG_Unit Type"; }
# note: assign unit type value
setParameterByName_2 = Element.SetParameterByName(element=groupByKey.groups, parameterName=code_block_28, value=code_block_27)

# group: Processing
await_ = Orchid.Common.DataStream.Await(pass=code_block_20.out0, waitFor=setParameterByName_2)
getParameterValueByName_6 = Element.GetParameterValueByName(element=groupByKey.groups, parameterName=await_)
length = String.Length()  # unwired: string
sortByFunction = List.SortByFunction(list=getParameterValueByName_6@L2, sortFunction=length)
lastItem = List.LastItem(list=sortByFunction@L2)

# group: Visualisation
# note: assign unit type value
setParameterByName_3 = Element.SetParameterByName(element=groupByKey.groups, parameterName=code_block_28, value=lastItem)

# group: Control
# note: do not process units that have not beds inside
code_block_29 = CodeBlock(unitType=lastItem) { unitType==""; }
filterByBoolMask_6 = List.FilterByBoolMask(list=setParameterByName_3, mask=code_block_29)

# group: Processing
code_block_30 = CodeBlock { "Number"; " "; }
getParameterValueByName_7 = Element.GetParameterValueByName(element=filterByBoolMask_6.out, parameterName=code_block_30.out0)
split_4 = String.Split(string=getParameterValueByName_7, separator0=code_block_30.out1)
firstItem_4 = List.FirstItem(list=split_4@@L2)

# group: Processing
code_block_31 = CodeBlock { "___3"; " (Triplex)"; "ACG_Unit Number"; }
count = List.Count(list=filterByBoolMask_6.out@L2)
code_block_32 = CodeBlock(apNumbers=firstItem_4, noStories=count) { apNumbers+"___"+noStories; }
code_block_33 = CodeBlock { "___1"; ""; }
replace = String.Replace(string=code_block_32, searchFor=code_block_33.out0, replaceWith=code_block_33.out1)
code_block_34 = CodeBlock { "___2"; " (Duplex)"; }
replace_2 = String.Replace(string=replace, searchFor=code_block_34.out0, replaceWith=code_block_34.out1)
replace_3 = String.Replace(string=replace_2, searchFor=code_block_31.out0, replaceWith=code_block_31.out1)

# group: Visualisation
# note: ROOMS GROUPED BY NUMBER
# (to be used for the rest of the shared parameters)
setParameterByName_4 = Element.SetParameterByName(element=filterByBoolMask_6.out, parameterName=code_block_31.out2, value=replace_3)

# group: Control
code_block_35 = CodeBlock()
# ---------- code_block_35.designscript (5 lines) ----------
[
"Furniture",
"Casework",
"Generic Models"
];
# ----------------------------------------
await_2 = Orchid.Common.DataStream.Await(pass=code_block_35, waitFor=setParameterByName_4)

# group: Processing
byName = Category.ByName(name=await_2)
all_elements_of_category = ElementsOfCategory(Category=byName)
familyName_2 = Orchid.RevitProject.Elements.Element.FamilyName(element=all_elements_of_category)
code_block_36 = CodeBlock { "NDSSStorage"; }
contains_3 = String.Contains(string=familyName_2, searchFor=code_block_36)
filterByBoolMask_7 = List.FilterByBoolMask(list=all_elements_of_category, mask=contains_3)
flatten = List.Flatten(list=filterByBoolMask_7.in)

# group: Processing
getLocation_3 = Element.GetLocation(element=flatten)
isInsideRoom_3 = Room.IsInsideRoom(room=code_block_21, point=getLocation_3, lacing=CrossProduct)
code_block_37 = CodeBlock { true; }
indexOf = Orchid.Common.List.IndexOf(list=isInsideRoom_3@L2, item=code_block_37)
flatten_2 = List.Flatten()  # unwired: list
map = List.Map(list=indexOf, function=flatten_2)
isEmpty = List.IsEmpty(list=map@L2)
# note: rooms withOUT NDSS Storage [IN]
filterByBoolMask_8 = List.FilterByBoolMask(list=code_block_21, mask=isEmpty)
code_block_38 = CodeBlock(rms=filterByBoolMask_8.in) { 0; count=DSCore.List.Count(rms); }
ofRepeatedItem = List.OfRepeatedItem(item=code_block_38.out0, amount=code_block_38.count)
# note: rooms with NDSS Storage [OUT]
filterByBoolMask_9 = List.FilterByBoolMask(list=map, mask=isEmpty)
getItemAtIndex = List.GetItemAtIndex(list=flatten, index=filterByBoolMask_9.out@@L2)

# group: Processing
geometry = Element.Geometry(element=getItemAtIndex)
string_from_object_3 = FromObject(object=geometry)
code_block_39 = CodeBlock(str=string_from_object_3) { str=="Solid"; }
filterByBoolMask_10 = List.FilterByBoolMask(list=geometry, mask=code_block_39)
bySolid = PolySurface.BySolid(solid=filterByBoolMask_10.in)
surfaces = PolySurface.Surfaces(polySurface=bySolid)
acg_surface_filterbyorientation = Custom[ACG Surface.FilterByOrientation](surfaces=surfaces)  # from Clockwork for Dynamo 2.x
code_block_40 = CodeBlock { 2; }
flatten_3 = List.Flatten(amount=code_block_40)  # unwired: list
map_2 = List.Map(list=acg_surface_filterbyorientation.horizontalDown, function=flatten_3)
area_2 = Surface.Area(surface=map_2)
sum_3 = Math.Sum(values=area_2@L2)
# note: list storage areas
code_block_41 = CodeBlock(area=sum_3) { area/1000000; }

# group: Processing
list_create_2 = List.Create(item0=filterByBoolMask_8.in, item1=filterByBoolMask_8.out)
# note: list Room elements
flatten_4 = List.Flatten(list=list_create_2)
list_create_3 = List.Create(item0=ofRepeatedItem, item1=code_block_41)
# note: list storage areas
flatten_5 = List.Flatten(list=list_create_3)

# group: Processing
code_block_42 = CodeBlock { "Number"; }
getParameterValueByName_8 = Element.GetParameterValueByName(element=flatten_4, parameterName=code_block_42)
groupByKey_4 = List.GroupByKey(list=flatten_4, keys=getParameterValueByName_8)
groupByKey_5 = List.GroupByKey(list=flatten_5, keys=getParameterValueByName_8)
sum_4 = Math.Sum(values=groupByKey_5.groups@L2)

# group: Visualisation
code_block_43 = CodeBlock { "ACG_Storage Area"; }
runMe = Custom[Tool.RunMe](Boolean=code_block_15.out5, ThingToDo=sum_4)  # package SteamNodes; Use Boolean to perform an action
# note: STORAGE AREA
setParameterByName_5 = Element.SetParameterByName(element=groupByKey_4.groups, parameterName=code_block_43, value=runMe)

# group: Processing
area_3 = Room.Area(room=setParameterByName_4)
# note: total unit area (calculation for duplexes)
sum_5 = Math.Sum(values=area_3@L2)
code_block_44 = CodeBlock(apArea=sum_5) { "ACG_Unit GI Area"; apArea; }

# group: Visualisation
runMe_2 = Custom[Tool.RunMe](Boolean=code_block_15.out4, ThingToDo=setParameterByName_4)
# note: COMBINED AREA
setParameterByName_6 = Element.SetParameterByName(element=runMe_2, parameterName=code_block_44.out0, value=code_block_44.apArea)

# group: Processing
code_block_45 = CodeBlock { "Level"; }
getParameterValueByName_9 = Element.GetParameterValueByName(element=setParameterByName_4, parameterName=code_block_45)

byName_2 = WombatDynamo.Level.ByName(name=getParameterValueByName_9)

# group (continued): Processing
elevation = Level.Elevation(level=byName_2)
sortByKey = List.SortByKey(list=getParameterValueByName_9@L2, keys=elevation@L2)
# note: only first floor for duplexes
firstItem_5 = List.FirstItem(list=sortByKey.sortedList@L2)
code_block_46 = CodeBlock(apLevels=firstItem_5) { "ACG_Unit Level"; apLevels; }

# group: Visualisation
# note: BASE LEVEL
# (if duplex or triplex all rooms will be assigned same level)
runMe_3 = Custom[Tool.RunMe](Boolean=code_block_15.out1, ThingToDo=setParameterByName_4)
setParameterByName_7 = Element.SetParameterByName(element=runMe_3, parameterName=code_block_46.out0, value=code_block_46.apLevels)

# group: Processing
code_block_47 = CodeBlock { "ACG_Unit Type"; }
await_3 = Orchid.Common.DataStream.Await(pass=code_block_47, waitFor=filterByBoolMask_6.out)
getParameterValueByName_10 = Element.GetParameterValueByName(element=setParameterByName_4, parameterName=await_3)
length_2 = String.Length()  # unwired: string
groupByFunction = List.GroupByFunction(list=getParameterValueByName_10, groupFunction=length_2)
lastItem_2 = List.LastItem(list=groupByFunction@L2)

# group: Processing
count_2 = List.Count(list=setParameterByName_4@L2)
code_block_48 = CodeBlock(unitType=lastItem_2, count=count_2) { unitType+"___"+count; }
code_block_49 = CodeBlock { "___1"; ""; }
replace_4 = String.Replace(string=code_block_48, searchFor=code_block_49.out0, replaceWith=code_block_49.out1)
code_block_50 = CodeBlock { "___2"; " (Duplex)"; }
replace_5 = String.Replace(string=replace_4, searchFor=code_block_50.out0, replaceWith=code_block_50.out1)
code_block_51 = CodeBlock { "___3"; " (Triplex)"; "ACG_Unit Number"; }
replace_6 = String.Replace(string=replace_5, searchFor=code_block_51.out0, replaceWith=code_block_51.out1)

# group: Visualisation
runMe_4 = Custom[Tool.RunMe](Boolean=code_block_15.out3, ThingToDo=setParameterByName_4)
# note: UNIT TYPES
setParameterByName_8 = Element.SetParameterByName(element=runMe_4, parameterName=code_block_47, value=replace_6)

flatten_6 = List.Flatten(list=setParameterByName_8)

# group: Input
code_block_52 = CodeBlock()
# ---------- code_block_52.designscript (47 lines) ----------
[
"1B1P",
"1B2P",
"2B3P",
"2B4P",
"3B4P",
"3B5P",
"3B6P",
"4B5P",
"4B6P",
"4B7P",
"4B8P",
"5B6P",
"5B7P",
"5B8P",
"6B7P",
"6B8P",

"1B2P (Duplex)",
"2B3P (Duplex)",
"2B4P (Duplex)",
"3B4P (Duplex)",
"3B5P (Duplex)",
"3B6P (Duplex)",
"4B5P (Duplex)",
"4B6P (Duplex)",
"4B7P (Duplex)",
"4B8P (Duplex)",
"5B6P (Duplex)",
"5B7P (Duplex)",
"5B8P (Duplex)",
"6B7P (Duplex)",
"6B8P (Duplex)",

"3B4P (Triplex)",
"3B5P (Triplex)",
"3B6P (Triplex)",
"4B5P (Triplex)",
"4B6P (Triplex)",
"4B7P (Triplex)",
"4B8P (Triplex)",
"5B6P (Triplex)",
"5B7P (Triplex)",
"5B8P (Triplex)",
"6B7P (Triplex)",
"6B8P (Triplex)"
];
# ----------------------------------------
code_block_53 = CodeBlock()
# ---------- code_block_53.designscript (47 lines) ----------
[
39,
50,
61,
70,
74,
86,
95,
90,
99,
108,
117,
103,
112,
121,
116,
125,

58,
70,
79,
84,
93,
102,
97,
106,
115,
124,
110,
119,
128,
123,
132,

90,
99,
108,
103,
112,
121,
130,
116,
125,
134,
129,
138
];
# ----------------------------------------
code_block_54 = CodeBlock()
# ---------- code_block_54.designscript (47 lines) ----------
[
1,
1.5,
2,
2,
2.5,
2.5,
2.5,
3,
3,
3,
3,
3.5,
3.5,
3.5,
4,
4,

1.5,
2,
2,
2.5,
2.5,
2.5,
3,
3,
3,
3,
3.5,
3.5,
3.5,
4,
4,

2.5,
2.5,
2.5,
3,
3,
3,
3,
3.5,
3.5,
3.5,
4,
4
];
# ----------------------------------------
list_create_4 = List.Create(item0=code_block_53, item1=code_block_54)
transpose = List.Transpose(lists=list_create_4)
byKeysValues = DesignScript.Builtin.Dictionary.ByKeysValues(keys=code_block_52, values=transpose)

# group: Processing
code_block_55 = CodeBlock { "ACG_Unit Type"; }
getParameterValueByName_11 = Element.GetParameterValueByName(element=flatten_6, parameterName=code_block_55)

# group: Processing
code_block_56 = CodeBlock { "NDSS_Min Unit Area"; "NDSS_Min Storage Area"; }
valueAtKey = DesignScript.Builtin.Dictionary.ValueAtKey(dictionary=byKeysValues, key=getParameterValueByName_11)
lastItem_3 = List.LastItem(list=valueAtKey@L2)
firstItem_6 = List.FirstItem(list=valueAtKey@@L2)

# group: Visualisation
setParameterByName_9 = Element.SetParameterByName(element=flatten_6, parameterName=code_block_56.out1, value=lastItem_3)
runMe_5 = Custom[Tool.RunMe](Boolean=code_block_15.out6, ThingToDo=setParameterByName_8)
runMe_6 = Custom[Tool.RunMe](Boolean=code_block_15.out7, ThingToDo=setParameterByName_8)
setParameterByName_10 = Element.SetParameterByName(element=flatten_6, parameterName=code_block_56.out0, value=firstItem_6)

# group: Usage
code_block_57 = CodeBlock { "NDSS Room Schedule - By Rooms & Furniture"; }
acg_script_usage = Custom[ACG Script Usage](scriptName=code_block_57)  # Adds an entry to Excel document every time a script is run. The document is located in S:\Dynamo\05-UsageStats

watch = Watch(code_block_15.out0)
watch_2 = Watch(ui_multipleinputform.User_Inputs)

# group: Processing
list_create_5 = List.Create(item0=filterByBoolMask_4.in, item1=filterByBoolMask_5.in)
code_block_58 = CodeBlock(beds=list_create_5) { DSCore.List.Flatten(beds); }
familyName_3 = Orchid.RevitProject.Elements.Element.FamilyName(element=code_block_58)
code_block_59 = CodeBlock { "Accessible"; "Adaptable"; }
contains_4 = String.Contains(string=familyName_3, searchFor=code_block_59.out0)
filterByBoolMask_11 = List.FilterByBoolMask(list=code_block_58, mask=contains_4)
contains_5 = String.Contains(string=familyName_3, searchFor=code_block_59.out1)
filterByBoolMask_12 = List.FilterByBoolMask(list=code_block_58, mask=contains_5)

# group: Processing
getLocation_4 = Element.GetLocation(element=filterByBoolMask_11.in)
isInsideRoom_4 = Room.IsInsideRoom(room=code_block_21, point=getLocation_4, lacing=CrossProduct)
anyTrue = Orchid.Common.List.AnyTrue(list=isInsideRoom_4@L2)
code_block_60 = CodeBlock { " M4(3)(2)(b)"; "  "; " M4(3)(2)(a)"; }
getLocation_5 = Element.GetLocation(element=filterByBoolMask_12.in)
isInsideRoom_5 = Room.IsInsideRoom(room=code_block_21, point=getLocation_5, lacing=CrossProduct)
anyTrue_2 = Orchid.Common.List.AnyTrue(list=isInsideRoom_5@L2)
code_block_61 = CodeBlock(acces=anyTrue, a=code_block_60.out0, n=code_block_60.out1, adapt=anyTrue_2, b=code_block_60.out2) { acces==true?a:n; adapt==true?b:n; }
code_block_62 = CodeBlock(cat1=code_block_61.out0, cat2=code_block_61.out1) { cat1+cat2; }
code_block_63 = CodeBlock { "    "; "M4(2)"; }
replace_7 = String.Replace(string=code_block_62, searchFor=code_block_63.out0, replaceWith=code_block_63.out1)

# group: Visualisation
# note: Rooms grouped by number
# note: M CATEGORY
groupByKey_6 = List.GroupByKey(list=code_block_21, keys=firstItem)
groupByKey_7 = List.GroupByKey(list=replace_7, keys=firstItem)

# group: Visualisation
code_block_64 = CodeBlock { "ACG_M Category"; }
runMe_7 = Custom[Tool.RunMe](Boolean=code_block_15.out10, ThingToDo=code_block_64)
length_3 = String.Length()  # unwired: string
sortByFunction_2 = List.SortByFunction(list=groupByKey_7.groups@L2, sortFunction=length_3)
lastItem_4 = List.LastItem(list=sortByFunction_2@L2)
# note: ACG_M Category
setParameterByName_11 = Element.SetParameterByName(element=groupByKey_6.groups, parameterName=runMe_7, value=lastItem_4)

# group: Processing
# note: unit count coef for duplexes and triplexes
code_block_65 = CodeBlock { "ACG_Unit Count"; }
count_3 = List.Count(list=setParameterByName_4@@L1)
count_4 = List.Count(list=setParameterByName_4@L2)
div = count_3 / count_4

# group: Visualisation
runMe_8 = Custom[Tool.RunMe](Boolean=code_block_15.out8, ThingToDo=setParameterByName_4)
# note: UNIT COUNT
setParameterByName_12 = Element.SetParameterByName(element=runMe_8, parameterName=code_block_65, value=div)

# group: Processing
getLocation_6 = Element.GetLocation(element=filterByBoolMask_4.in)
isInsideRoom_6 = Room.IsInsideRoom(room=groupByKey.groups, point=getLocation_6, lacing=CrossProduct)
countTrue_3 = List.CountTrue(list=isInsideRoom_6@L2)
getLocation_7 = Element.GetLocation(element=filterByBoolMask_5.in)
isInsideRoom_7 = Room.IsInsideRoom(room=groupByKey.groups, point=getLocation_7, lacing=CrossProduct)
countTrue_4 = List.CountTrue(list=isInsideRoom_7@L2)
code_block_66 = CodeBlock(sBeds=countTrue_3, dBeds=countTrue_4) { bedrooms=sBeds+dBeds; occupancy=sBeds+(dBeds*2); ""; bedrooms+"B"+occupancy+"P"; }
code_block_67 = CodeBlock(unitTyep=code_block_66.out3, a=code_block_66.out2, b=code_block_66.out3) { unitTyep=="0B0P"?a:b; }

code_block_68 = CodeBlock { "List of Unit Types not matching the requirement:"; }

# group: Visualisation
flatten_7 = List.Flatten(list=setParameterByName_8)
code_block_69 = CodeBlock(rooms=flatten_7) { rooms; }

# group: Processing
code_block_70 = CodeBlock { "Number"; }
getParameterValueByName_12 = Element.GetParameterValueByName(element=code_block_69, parameterName=code_block_70)

# group: Processing
code_block_71 = CodeBlock { "ACG_Unit Type"; "ACG_M Category"; }
getParameterValueByName_13 = Element.GetParameterValueByName(element=code_block_69, parameterName=code_block_71.out0)
getParameterValueByName_14 = Element.GetParameterValueByName(element=code_block_69, parameterName=code_block_71.out1)

code_block_72 = CodeBlock(tp=getParameterValueByName_13, cat=getParameterValueByName_14) { tp+" "+cat; }

# group: Processing
code_block_73 = CodeBlock { "ACG_Unit Type Required"; }
getParameterValueByName_15 = Element.GetParameterValueByName(element=code_block_69, parameterName=code_block_73)

# group: Visualisation
code_block_74 = CodeBlock(achieved=code_block_72, required=getParameterValueByName_15) { achieved==required; }
filterByBoolMask_13 = List.FilterByBoolMask(list=getParameterValueByName_12, mask=code_block_74)
# note: OUT
code_block_75 = CodeBlock(rooms=filterByBoolMask_13.out) { DSCore.List.UniqueItems(rooms); }
sort = List.Sort(list=code_block_75)

# group: Processing
code_block_76 = CodeBlock { "None"; }
code_block_77 = CodeBlock { " \n"; }
join = String.Join(separator=code_block_77, string0=sort)
code_block_78 = CodeBlock(lst=sort, a=code_block_76, b=join) { count=DSCore.List.Count(lst); count==0?a:b; }

# group: Input
file_path_2 = Filename("..\ACG_logo.png")
file_from_path_2 = FileObject(path=file_path_2)
readFromFile_2 = Image.ReadFromFile(file=file_from_path_2)
code_block_79 = CodeBlock { "Okay..."; }
textnote_data = Custom[TextNote Data](Title=code_block_68, TextNote=code_block_78.out1)  # package Data-Shapes; Create Data for TextNote input in UI.MultipleInputForm ++ . Check out www.data-shapes.net for more informations
code_block_80 = CodeBlock { 700; 400; }
ui_multipleinputform_2 = Custom[UI.MultipleInputForm ++](Logo_optional=readFromFile_2, ButtonText_optional=code_block_79, Inputs=textnote_data, Toggle=code_block_15.out11, Width_optional=code_block_80.out0, LabelWidth_optional=code_block_80.out1)

code_block_81 = CodeBlock(rooms=setParameterByName_10) { rooms; }
code_block_82 = CodeBlock { "ACG_Unit Tenure"; }
code_block_83 = CodeBlock(x=ui_multipleinputform.User_Inputs)
# ---------- code_block_83.designscript (10 lines) ----------
tenToIncrease1=x[12];
increaseAmount1=x[13];
tenToIncrease2=x[14];
increaseAmount2=x[15];
tenToIncrease3=x[16];
increaseAmount3=x[17];
tenToIncrease4=x[18];
increaseAmount4=x[19];
tenToIncrease5=x[20];
increaseAmount5=x[21];
# ----------------------------------------
code_block_84 = CodeBlock { "NDSS_Min Unit Area"; "NDSS_Area Tolerance Required"; }

# group: Processing
getParameterValueByName_16 = Element.GetParameterValueByName(element=code_block_81, parameterName=code_block_82)
code_block_85 = CodeBlock(tnre=getParameterValueByName_16, input1=code_block_83.tenToIncrease1) { tnre==input1; }
filterByBoolMask_14 = List.FilterByBoolMask(list=code_block_81, mask=code_block_85)
getParameterValueByName_17 = Element.GetParameterValueByName(element=filterByBoolMask_14.in, parameterName=code_block_84.out0)
code_block_86 = CodeBlock(value=getParameterValueByName_17, increase=code_block_83.increaseAmount1) { value*increase/100; }
setParameterByName_13 = Element.SetParameterByName(element=filterByBoolMask_14.in, parameterName=code_block_84.out1, value=code_block_86)

# group: Processing
getParameterValueByName_18 = Element.GetParameterValueByName(element=code_block_81, parameterName=code_block_82)
code_block_87 = CodeBlock(tnre=getParameterValueByName_18, input1=code_block_83.tenToIncrease2) { tnre==input1; }
filterByBoolMask_15 = List.FilterByBoolMask(list=code_block_81, mask=code_block_87)
getParameterValueByName_19 = Element.GetParameterValueByName(element=filterByBoolMask_15.in, parameterName=code_block_84.out0)
code_block_88 = CodeBlock(value=getParameterValueByName_19, increase=code_block_83.increaseAmount2) { value*increase/100; }
setParameterByName_14 = Element.SetParameterByName(element=filterByBoolMask_15.in, parameterName=code_block_84.out1, value=code_block_88)

# group: Processing
getParameterValueByName_20 = Element.GetParameterValueByName(element=code_block_81, parameterName=code_block_82)
code_block_89 = CodeBlock(tnre=getParameterValueByName_20, input1=code_block_83.tenToIncrease3) { tnre==input1; }
filterByBoolMask_16 = List.FilterByBoolMask(list=code_block_81, mask=code_block_89)
getParameterValueByName_21 = Element.GetParameterValueByName(element=filterByBoolMask_16.in, parameterName=code_block_84.out0)
code_block_90 = CodeBlock(value=getParameterValueByName_21, increase=code_block_83.increaseAmount3) { value*increase/100; }
setParameterByName_15 = Element.SetParameterByName(element=filterByBoolMask_16.in, parameterName=code_block_84.out1, value=code_block_90)

# group: Processing
getParameterValueByName_22 = Element.GetParameterValueByName(element=code_block_81, parameterName=code_block_82)
code_block_91 = CodeBlock(tnre=getParameterValueByName_22, input1=code_block_83.tenToIncrease4) { tnre==input1; }
filterByBoolMask_17 = List.FilterByBoolMask(list=code_block_81, mask=code_block_91)
getParameterValueByName_23 = Element.GetParameterValueByName(element=filterByBoolMask_17.in, parameterName=code_block_84.out0)
code_block_92 = CodeBlock(value=getParameterValueByName_23, increase=code_block_83.increaseAmount4) { value*increase/100; }
setParameterByName_16 = Element.SetParameterByName(element=filterByBoolMask_17.in, parameterName=code_block_84.out1, value=code_block_92)

# group: Processing
getParameterValueByName_24 = Element.GetParameterValueByName(element=code_block_81, parameterName=code_block_82)
code_block_93 = CodeBlock(tnre=getParameterValueByName_24, input1=code_block_83.tenToIncrease5) { tnre==input1; }
filterByBoolMask_18 = List.FilterByBoolMask(list=code_block_81, mask=code_block_93)
getParameterValueByName_25 = Element.GetParameterValueByName(element=filterByBoolMask_18.in, parameterName=code_block_84.out0)
code_block_94 = CodeBlock(value=getParameterValueByName_25, increase=code_block_83.increaseAmount5) { value*increase/100; }
setParameterByName_17 = Element.SetParameterByName(element=filterByBoolMask_18.in, parameterName=code_block_84.out1, value=code_block_94)

# group: Assing
list_create_6 = List.Create(item0=setParameterByName_13, item1=setParameterByName_14, item2=setParameterByName_15, item3=setParameterByName_16, item4=setParameterByName_17)
flatten_8 = List.Flatten(list=list_create_6)
setDifference = List.SetDifference(list1=code_block_81, list2=flatten_8)
# note: assign 0 tollerance values to non processed rooms
code_block_95 = CodeBlock { 0; }
setParameterByName_18 = Element.SetParameterByName(element=setDifference, parameterName=code_block_84.out1, value=code_block_95)

# group: Processing - compliant units
code_block_96 = CodeBlock { "ACG_Unit GI Area"; "NDSS_Min Unit Area"; "NDSS_Area Tolerance Required"; }
getParameterValueByName_26 = Element.GetParameterValueByName(element=setParameterByName_18, parameterName=code_block_96.out0)
getParameterValueByName_27 = Element.GetParameterValueByName(element=setParameterByName_18, parameterName=code_block_96.out1)
getParameterValueByName_28 = Element.GetParameterValueByName(element=setParameterByName_18, parameterName=code_block_96.out2)
code_block_97 = CodeBlock(GIA=getParameterValueByName_26, minArea=getParameterValueByName_27, reqTlrnc=getParameterValueByName_28) { "NDSS_Unit Area Compliant"; ((GIA-minArea)-reqTlrnc)<0?"✕":"✓"; }

# group: Visualisation
setParameterByName_19 = Element.SetParameterByName(element=setParameterByName_18, parameterName=code_block_97.out0, value=code_block_97.out1)

# group: Processing - compliant units
code_block_98 = CodeBlock { "ACG_Storage Area"; "NDSS_Min Storage Area"; }
getParameterValueByName_29 = Element.GetParameterValueByName(element=setParameterByName_18, parameterName=code_block_98.out0)
code_block_99 = CodeBlock { 2; }
round = Math.Round(number=getParameterValueByName_29, digits=code_block_99)
getParameterValueByName_30 = Element.GetParameterValueByName(element=setParameterByName_18, parameterName=code_block_98.out1)
code_block_100 = CodeBlock(achStrg=round, reqStrg=getParameterValueByName_30) { "NDSS_Storage Area Compliant"; (achStrg-reqStrg)<(-0.01)?"✕":"✓"; }

# group: Visualisation
setParameterByName_20 = Element.SetParameterByName(element=setParameterByName_18, parameterName=code_block_100.out0, value=code_block_100.out1)
