# Dynamo graph Rooms - Centre Rooms & Tags_py.dyn (Dynamo 2.12.1.8246)
# packages: Data-Shapes 2021.2.92

# group: Input
file_path = Filename("..\ACG_logo.png")
file_from_path = FileObject(path=file_path)
readFromFile = Image.ReadFromFile(file=file_from_path)
code_block = CodeBlock { "Cancel"; true; "Run"; 600; 300; }
code_block_2 = CodeBlock { "Note:"; "This script will center all Rooms or/and Room Tags in the whole model or only in the active view."; }
textnote_data = Custom[TextNote Data](Title=code_block_2.out0, TextNote=code_block_2.out1)  # package Data-Shapes; Create Data for TextNote input in UI.MultipleInputForm ++ . Check out www.data-shapes.net for more informations
code_block_3 = CodeBlock { "Center rooms"; "Center tags"; "Center rooms / tags in active view only"; true; }
ui_boolean_input = Custom[UI.Boolean input](InputName=code_block_3.out0, DefaultValue=code_block_3.out3)  # package Data-Shapes; Creates a boolean input for UI.MultipleInputForm ++ . Check out www.data-shapes.net for more infos!
ui_boolean_input_2 = Custom[UI.Boolean input](InputName=code_block_3.out1, DefaultValue=code_block_3.out3)
ui_boolean_input_3 = Custom[UI.Boolean input](InputName=code_block_3.out2, DefaultValue=code_block_3.out3)
list_create = List.Create(item0=textnote_data, item1=ui_boolean_input, item2=ui_boolean_input_2, item3=ui_boolean_input_3)
ui_multipleinputform = Custom[UI.MultipleInputForm ++](Logo_optional=readFromFile, ButtonText_optional=code_block.out2, Inputs=list_create, Toggle=code_block.out1, CancelButtonText_optional=code_block.out0, Width_optional=code_block.out3, LabelWidth_optional=code_block.out4)  # package Data-Shapes; Create a form with multiple inputs. see www.data-shapes.net for tutorials and infos!
code_block_4 = CodeBlock(x=ui_multipleinputform.User_Inputs) { canrerRooms = x[0]; centerTags = x[1]; activeView = x[2]; }

# group: Visualisation
python_script = Python(IN[0]=ui_multipleinputform.Was_Cancelled, IN[1]=code_block_4.canrerRooms, IN[2]=code_block_4.centerTags, IN[3]=code_block_4.activeView)  # IronPython2
# ---------- python_script.python (94 lines) ----------
# Load the Python Standard and DesignScript Libraries
import clr
import sys
import os.path
from System import Environment
sys.path.append('C:\Program Files (x86)\IronPython 2.7\Lib')
import System
from System import Array
from System.Collections.Generic import *
clr.AddReference('ProtoGeometry')
from Autodesk.DesignScript.Geometry import (Geometry, Point as pt)
clr.AddReference("RevitNodes")
import Revit
clr.ImportExtensions(Revit.Elements)
clr.ImportExtensions(Revit.GeometryConversion)
clr.AddReference("RevitServices")
import RevitServices
from RevitServices.Persistence import DocumentManager 
from RevitServices.Transactions import TransactionManager 
clr.AddReference("RevitAPI")
clr.AddReference("RevitAPIUI")
import Autodesk 
from Autodesk.Revit.DB import *
from Autodesk.Revit.UI import *

doc = DocumentManager.Instance.CurrentDBDocument
uiapp = DocumentManager.Instance.CurrentUIApplication 
app = uiapp.Application 
uidoc = uiapp.ActiveUIDocument

cancelled =			IN[0]
roomsBool =			IN[1]
tagsBool =			IN[2]
acitveViewBool =	IN[3]


view =	doc.ActiveView
count = 0


if cancelled == True:
	OUT = 'Error : ', 'The script was cancelled.'
else:
	if acitveViewBool == True:
		rooms = FilteredElementCollector(doc, view.Id).OfCategory(BuiltInCategory.OST_Rooms).ToElements()
		tags = FilteredElementCollector(doc, view.Id).OfCategory(BuiltInCategory.OST_RoomTags).ToElements()
	else:
		rooms = FilteredElementCollector(doc).OfCategory(BuiltInCategory.OST_Rooms).ToElements()
		tags = FilteredElementCollector(doc).OfCategory(BuiltInCategory.OST_RoomTags).ToElements()
	TransactionManager.Instance.EnsureInTransaction(doc)
	
	# CENTER THE ROOMS
	if roomsBool == True:
		for room in rooms:
			count += 1
			# level elevation - unit millimeter 
			elevation = room.Level.Elevation * 304.8
			# get enumerator to loop geo-objects
			geoobj = room.GetGeometryObjectFromReference(Reference(room)).GetEnumerator()
			# loop geo-object
			for obj in geoobj:
				# convert to dynamo type
				room_geometry = obj.ToProtoType()
				point = room_geometry.Centroid()
				center = point.ByCoordinates(point.X,point.Y,elevation) # create location point with level elevation
				current = room.Location.Point # get current element location
				# MOVE THE ROOM TO THE NEW LOCATION
				room.Location.Move(center.ToXyz() - current)		

	# CENTER THE TAGS
	if tagsBool == True:
		for room in rooms:
			# same as above.....
			elevation = room.Level.Elevation * 304.8
			geoobj = room.GetGeometryObjectFromReference(Reference(room)).GetEnumerator()
			for obj in geoobj:
				room_geometry = obj.ToProtoType()
				point = room_geometry.Centroid()
				center = pointt.ByCoordinates(point.X,point.Y,elevation) # create location point with level elevation
				# GO THROUGH THE TAGS....
				roomId = room.Id
				for tag in tags:
					if roomId == tag.Room.Id:
						count += 1
						currentTagLocation = tag.Location.Point
						roomLocation = room.Location.Point
						tag.Location.Move(roomLocation - currentTagLocation)	
		
	TransactionManager.Instance.TransactionTaskDone()
	
	if count == 0:
		OUT = 'Error : ', 'No rooms or tags were moved.'
	else:
		OUT = 'Success ! ', str(count) + ' elements we moved.'
# ----------------------------------------
code_block_5 = CodeBlock(x=python_script) { true; title = x[0]; text = x[1]; "Okay"; }

# group: Assing
ui_textnote_data = Custom[UI.TextNote Data](Title=code_block_5.title, TextNote=code_block_5.text)  # package Data-Shapes; Create Data for TextNote input in UI.MultipleInputForm ++ . Check out www.data-shapes.net for more informations
ui_multipleinputform_2 = Custom[UI.MultipleInputForm ++](ButtonText_optional=code_block_5.out3, Inputs=ui_textnote_data, Toggle=code_block_5.out0)
