# Dynamo graph Create from TIDP_py.dyn (Dynamo 2.12.1.8246)
# packages: Data-Shapes 2021.2.92, archi-lab.net 2021.25.2521, BumbleBee 2021.25.3, Orchid 260.1.0.7729

# group: Usage
code_block = CodeBlock { "Create From TIDP"; }
acg_script_usage = Custom[ACG Script Usage](scriptName=code_block)  # Adds an entry to Excel document every time a script is run. The document is located in S:\Dynamo\05-UsageStats

# note: collect title block types
python_script = Python()  # IronPython2
# ---------- python_script.python (46 lines) ----------
# Load the Python Standard and DesignScript Libraries
import clr
import sys
import os.path
from datetime import datetime
from System import Environment
sys.path.append('C:\Program Files (x86)\IronPython 2.7\Lib')
import System
from System import Array
from System.Collections.Generic import *
clr.AddReference('ProtoGeometry')
from Autodesk.DesignScript.Geometry import *
clr.AddReference("RevitNodes")
import Revit
clr.ImportExtensions(Revit.Elements)
clr.ImportExtensions(Revit.GeometryConversion)
clr.AddReference("RevitServices")
import RevitServices
from RevitServices.Persistence import DocumentManager 
from RevitServices.Transactions import TransactionManager 

clr.AddReference("RevitAPI")
clr.AddReference("RevitAPIUI")

import Autodesk 
from Autodesk.Revit.DB import *
from Autodesk.Revit.UI import *
import time

doc = DocumentManager.Instance.CurrentDBDocument
uiapp = DocumentManager.Instance.CurrentUIApplication 
app = uiapp.Application 
uidoc = uiapp.ActiveUIDocument

keys = []
values = []

tBlocks = FilteredElementCollector(doc).OfCategory(BuiltInCategory.OST_TitleBlocks).WhereElementIsElementType().ToElements()

for i in tBlocks:
	famName = i.FamilyName
	typeName = i.get_Parameter(BuiltInParameter.SYMBOL_NAME_PARAM).AsString()
	keys.append(famName + ' : ' + typeName)
	values.append(i.Id)

OUT = keys, values
# ----------------------------------------
code_block_2 = CodeBlock(x=python_script) { x[1][0]; }
file_path = Filename("..\ACG_logo.png")
file_from_path = FileObject(path=file_path)
readFromFile = Image.ReadFromFile(file=file_from_path)
code_block_3 = CodeBlock { "Cancel"; true; "Create Sheets"; 700; 250; }

# group: Input
code_block_4 = CodeBlock { "Warning:"; true; }
string = StringInput("""Before running the script make sure the TIDP is closed, headers are removed and the table is formated as follows:

Column A - Project number
Column B - Originator
Column C - Volume
Column D - Level
Column E - Type
Column F - Role
Column G - Sheet number
Column H - Sheet name
Column I - Sheet Size
Column J - Drawing Scale

The script will not run if there are duplicate sheet numbers within the TIDP. If sheets from the TIDP are already existing in the model, they can be ignored (not created) or creted again with a "_New" suffix to the sheet number. """)
ui_textnote_data = Custom[UI.TextNote Data](Title=code_block_4.out0, TextNote=string)  # package Data-Shapes; Create Data for TextNote input in UI.MultipleInputForm ++ . Check out www.data-shapes.net for more informations

code_block_5 = CodeBlock { "Select TIDP file (.xlxs):"; }
ui_filepath_data = Custom[UI.FilePath Data](InputName=code_block_5)  # package Data-Shapes; Create filepath input for UI.MultipleInputForm ++ . Check out www.data-shapes.net for more infos !
code_block_6 = CodeBlock { "Type worksheet name:"; "Sheet1"; }
textbox_data = Custom[TextBox Data](InputName=code_block_6.out0, DefaultText=code_block_6.out1)  # package Data-Shapes; Create Data for TextBox input in UI.MultipleInputForm ++ . Check out www.data-shapes.net for more informations
code_block_7 = CodeBlock { "Ignore already existing sheets?"; true; }
boolean_input = Custom[Boolean input](InputName=code_block_7.out0, DefaultValue=code_block_7.out1)  # package Data-Shapes; Creates a boolean input for UI.MultipleInputForm ++ . Check out www.data-shapes.net for more infos!
code_block_8 = CodeBlock(x=python_script) { "Select a default titleblock:"; keys = x[0]; values = x[1]; }
ui_dropdown_data = Custom[UI.DropDown Data](InputName=code_block_8.out0, Keys=code_block_8.keys, Values=code_block_8.values)  # package Data-Shapes; Create data for DropDown input in UI.MultiInputForm ++ . Check out www.data-shapes.net for more infos.
code_block_9 = CodeBlock { "Populate with Floor Plans?"; }
boolean_input_2 = Custom[Boolean input](InputName=code_block_9)
python_script_2 = Python()  # IronPython2
# ---------- python_script_2.python (44 lines) ----------
# Load the Python Standard and DesignScript Libraries
import clr
import sys
import os.path
from datetime import datetime
from System import Environment
sys.path.append('C:\Program Files (x86)\IronPython 2.7\Lib')
import System
from System import Array
from System.Collections.Generic import *
clr.AddReference('ProtoGeometry')
from Autodesk.DesignScript.Geometry import *
clr.AddReference("RevitNodes")
import Revit
clr.ImportExtensions(Revit.Elements)
clr.ImportExtensions(Revit.GeometryConversion)
clr.AddReference("RevitServices")
import RevitServices
from RevitServices.Persistence import DocumentManager 
from RevitServices.Transactions import TransactionManager 

clr.AddReference("RevitAPI")
clr.AddReference("RevitAPIUI")

import Autodesk 
from Autodesk.Revit.DB import *
from Autodesk.Revit.UI import *
import time

doc = DocumentManager.Instance.CurrentDBDocument
uiapp = DocumentManager.Instance.CurrentUIApplication 
app = uiapp.Application 
uidoc = uiapp.ActiveUIDocument

keys = []
values = []

sBoxes = FilteredElementCollector(doc).OfCategory(BuiltInCategory.OST_VolumeOfInterest).ToElements()

for i in sBoxes:
	keys.append(i.Name)
	values.append(i.Id)

OUT = keys, values
# ----------------------------------------
code_block_10 = CodeBlock(x=python_script_2) { "Select a default scope box:"; keysNames = x[0]; valuesIds = x[1]; }
ui_dropdown_data_2 = Custom[UI.DropDown Data](InputName=code_block_10.out0, Keys=code_block_10.keysNames, Values=code_block_10.valuesIds)
list_create = List.Create(item0=ui_textnote_data, item1=ui_filepath_data, item2=textbox_data, item3=boolean_input, item4=ui_dropdown_data, item5=boolean_input_2, item6=ui_dropdown_data_2)
flatten = List.Flatten(list=list_create)
ui_multipleinputform = Custom[UI.MultipleInputForm ++](Logo_optional=readFromFile, ButtonText_optional=code_block_3.out2, Inputs=flatten, Toggle=code_block_3.out1, CancelButtonText_optional=code_block_3.out0, Width_optional=code_block_3.out3, LabelWidth_optional=code_block_3.out4)  # package Data-Shapes; Create a form with multiple inputs. see www.data-shapes.net for tutorials and infos!
code_block_11 = CodeBlock(x=ui_multipleinputform.User_Inputs) { TIDPpath = x[0]; worksheet = x[1]; ignoreExisting = x[2]; titleblock = x[3]; generateViews = x[4]; scopeBox = x[5]; }

# group: Input
code_block_12 = CodeBlock { true; false; "A1"; }
read_excel = Custom[Read Excel](filePath=code_block_11.TIDPpath, runIt=code_block_12.out0, sheetName=code_block_11.worksheet, byColumn=code_block_12.out1, origin=code_block_12.out2)  # package BumbleBee; This node will read an excel file. You can read an entore sheet contents, read from specific origin cell, read only specific range, or do all of the former for multiple sheets at the same time.
transpose = List.Transpose(lists=read_excel)
clear_list = Custom[Clear List](input=transpose)  # package archi-lab.net; This node will remove all Null and Empty Lists from any list.
code_block_13 = CodeBlock(sheetNumber=clear_list, sheetNames=clear_list, volumeCodes=clear_list, levelCodes=clear_list, projectCode=clear_list, drawingType=clear_list, scale=clear_list) { sheetNumber[6]; sheetNames[7]; volumeCodes[2]; levelCodes[3]; projectCode[0]; drawingType[4]; scale[9]; }

# group: Control
string_from_object = FromObject(object=code_block_13.out0)
code_block_14 = CodeBlock { "."; }
# note: Comvert numbers to string
split = String.Split(string=string_from_object, separator0=code_block_14)
firstItem = List.FirstItem(list=split@L2)

code_block_15 = CodeBlock()
# ---------- code_block_15.designscript (49 lines) ----------
[
"0000 - Existing Plans",
"0100 - Existing Elevations",
"0200 - Existing Sections",
"1000 - Location Plans",
"1100 - Existing Survey inc Drainage",
"1200 - Constraints Plan",
"1300 - Viability",
"1400 - Feasibility",
"1500 - Compound and Phasing",
"1600 - Graphic Presentation",
"1800 - Reports",
"1900 - Conveyance Drawings",
"2000 - GA Plans",
"2100 - Demolition Plans",
"2200 - GA Construction Plan",
"2300 - Wall Types Plan",
"2400 - Reflected Ceiling Plans",
"2500 - FF&E Plans",
"2600 - Floor Finishes",
"2700 - Fire Strategy",
"2800 - Acoustic Strategy",
"2900 - Public Health Strategy",
"3000 - GA Sections",
"3500 - Section Construction",
"4000 - GA Elevations",
"4500 - Elevation Construction",
"4600 - Internal Room Elevations",
"5000 - Stair Assembly",
"5200 - Lift Design",
"5400 - Wet Areas and Sanitary Design",
"5500 - Joinery Assembly",
"6000 - Section Details",
"6400 - Plan Details",
"6600 - Internal Threshold Details",
"6800 - Joinery Details",
"7000 - Landscape GA",
"7100 - Landscape Sections",
"7200 - Site Clearance and Tree Protection",
"7300 - Landscape Details",
"9000 - Internal Door Schedules",
"9100 - External Win & Door Schedules",
"9200 - Rooflights Schedules",
"9300 - Room Area Schedules",
"9400 - Vent Schedules",
"9500 - Shutter Schedules",
"9700 - Specifications",
"9800 - Sketches"
];
# ----------------------------------------

# group: Visualisation
# note: Create blanc Sheets
python_script_3 = Python(IN[0]=code_block_11.titleblock, IN[1]=firstItem, IN[2]=code_block_13.out1, IN[3]=code_block_13.out2, IN[4]=code_block_13.out3, IN[5]=code_block_13.out5, IN[6]=code_block_13.out6, IN[7]=code_block_15, IN[8]=ui_multipleinputform.Was_Cancelled, IN[9]=code_block_11.generateViews, IN[10]=code_block_11.scopeBox)  # IronPython2
# ---------- python_script_3.python (135 lines) ----------
# Load the Python Standard and DesignScript Libraries
import clr
import sys
import os.path
from datetime import datetime
from System import Environment
sys.path.append('C:\Program Files (x86)\IronPython 2.7\Lib')
import System
from System import Array
from System.Collections.Generic import *
clr.AddReference('ProtoGeometry')
from Autodesk.DesignScript.Geometry import *
clr.AddReference("RevitNodes")
import Revit
clr.ImportExtensions(Revit.Elements)
clr.ImportExtensions(Revit.GeometryConversion)
clr.AddReference("RevitServices")
import RevitServices
from RevitServices.Persistence import DocumentManager 
from RevitServices.Transactions import TransactionManager 

clr.AddReference("RevitAPI")
clr.AddReference("RevitAPIUI")

import Autodesk 
from Autodesk.Revit.DB import *
from Autodesk.Revit.UI import *
import time

doc = DocumentManager.Instance.CurrentDBDocument
uiapp = DocumentManager.Instance.CurrentUIApplication 
app = uiapp.Application 
uidoc = uiapp.ActiveUIDocument

tBlockId = IN[0]
numbers = IN[1]
names = IN[2]
volumes = IN[3]
levels = IN[4]
types = IN[5]
scales = IN[6]
packList = IN[7]
cancelled = IN[8]
createViews = IN[9]
scopeBoxId = IN[10]

sheets = []


# check duplicate sheets in the TIPD and cancel the script if there are any
uniqieSheetNumbers  = []
duplicateSheetNumbers = ''

for number, name in zip(numbers, names):
	if number not in uniqieSheetNumbers:
		uniqieSheetNumbers.append(number)
	else:
		duplicateSheetNumbers += number + '\n' # list of DUPLICATE sheet numbers in the TIDP


# collect the numbers of any EXISTING SHEETS
exSheets = FilteredElementCollector(doc).OfClass(ViewSheet).ToElements()
exSheetNumbers = [sheet.SheetNumber for sheet in exSheets]
# check for existing sheets and change the NUMBER value of the new ones that already exist
checkedExNumbers = []
notCreatedNumbers = ''
for n in numbers:
	if n not in exSheetNumbers:
		checkedExNumbers.append(n)
	else:
		continue


# funtion for assigning PACKAGES
def assignPackage(sheetNumber, packagesList):
	packV = ''
	for p in packagesList:
		if p.startswith(sheetNumber[:2]): 
			packV = p
	return packV

# CREATE SHEETS !!!
if cancelled == True:
	OUT = ['Error: '], ['The script was cancelled.']

elif cancelled == False and len(duplicateSheetNumbers) > 0:
	OUT = ['List of duplicate sheets in the TIDP: '], duplicateSheetNumbers

elif cancelled == False and len(duplicateSheetNumbers) == 0:
	TransactionManager.Instance.EnsureInTransaction(doc)
	count = 0
	for numb, name, vol, lvl, type, scale in zip(numbers, names, volumes, levels, types, scales):
		if numb in checkedExNumbers:
			# create the sheet
			sheet = ViewSheet.Create(doc, tBlockId)
			packV = assignPackage(numb, packList)
			sheet.SheetNumber = str(numb)
			sheet.Name = name
			sheet.LookupParameter('ACG_Volume').Set(vol)
			sheet.LookupParameter('ACG_Level').Set(lvl)
			sheet.LookupParameter('ACG_Type').Set(type)
			sheet.LookupParameter('ACG_Scale').Set(scale)
			sheet.LookupParameter('Sheet Phase').Set('WIP')
			sheet.LookupParameter('Sheet Package').Set(packV)
		
			sheets.append(sheet)
			count += 1
		else:
			notCreatedNumbers += str(numb) + ' - ' + name + '\n'

	if len(notCreatedNumbers) == 0:
		OUT = ['Success! '], [str(count) + ' sheets were created.']
	else:
		OUT = 'Result: ', [str(count) + ' sheets were created.'], True, 'List of sheets already existing in the model:', notCreatedNumbers


	# CREATE VIEWS AND PLACE ON THE NEW SHEETS !!!
	if createViews == True:
		lvlCol = FilteredElementCollector(doc).OfClass(Level).WhereElementIsNotElementType().ToElements()
		viewFamType = FilteredElementCollector(doc).OfClass(ViewFamilyType).ToElements()[0]
		point = XYZ(0, 0, 0)
		for number, name, lvl, sheet in zip(checkedExNumbers, names, levels, sheets):
			if lvl == 'ZZ' or lvl == 'XX':
				continue
			else:
				# find the level element from the level name input
				for l in lvlCol:
					if lvl in l.Name:
						lvlEl = l
				view = ViewPlan.Create(doc, viewFamType.Id, lvlEl.Id)
				view.Name = str(numb) + '-' + lvl + '-' + name
				if scopeBoxId:
					view.get_Parameter(BuiltInParameter.VIEWER_VOLUME_OF_INTEREST_CROP).Set(ElementId(scopeBoxId))
				Viewport.Create(doc, sheet.Id, view.Id, point)
	TransactionManager.Instance.TransactionTaskDone()
# ----------------------------------------
code_block_16 = CodeBlock(x=python_script_3) { true; title = x[0]; text = x[1]; boolVal = x[2]; title2 = x[3]; text2 = x[4]; }

# group: Assing
code_block_17 = CodeBlock { "Okay"; 600; }
ui_textnote_data_2 = Custom[UI.TextNote Data](Title=code_block_16.title2, TextNote=code_block_16.text2)
ui_textnote_data_3 = Custom[UI.TextNote Data](Title=code_block_16.title, TextNote=code_block_16.text)
ui_multipleinputform_2 = Custom[UI.MultipleInputForm ++](Logo_optional=readFromFile, ButtonText_optional=code_block_17.out0, Inputs=ui_textnote_data_3, Toggle=code_block_16.out0, Width_optional=code_block_17.out1)

await_ = Orchid.Common.DataStream.Await(pass=code_block_16.boolVal, waitFor=ui_multipleinputform_2.Was_Run)

# group (continued): Assing
ui_multipleinputform_3 = Custom[UI.MultipleInputForm ++](Logo_optional=readFromFile, ButtonText_optional=code_block_17.out0, Inputs=ui_textnote_data_2, Toggle=await_, Width_optional=code_block_17.out1)
