# Dynamo graph Duplicate Sheets_py.dyn (Dynamo 2.6.2.15705)
# packages: bimorphNodes 3.0.3, Data-Shapes 2021.2.92

file_path = Filename("..\ACG_logo.png")
file_from_path = FileObject(path=file_path)
readFromFile = Image.ReadFromFile(file=file_from_path)
code_block = CodeBlock { true; "Duplicate"; "Cancel"; 250; 700; }
string = StringInput("""This tool will duplicate a given list of sheets multiple times. All metadata, apart from revision history, will be transferred to the new sheets. The name of the new sheets will remail the same but the number will have a suffix "_n", where n is the consecutive copy number.
Users can also copy the views placed on the parent sheets as duplicate or dependent. Please note that schedules will not be copied.
Please rename all new sheets and views logically ASAP.""")
textnote_data = Custom[TextNote Data](TextNote=string)  # package Data-Shapes; Create Data for TextNote input in UI.MultipleInputForm ++ . Check out www.data-shapes.net for more informations
python_script = Python()
# ---------- python_script.python (39 lines) ----------
# Load the Python Standard and DesignScript Libraries
import clr
import sys
import os.path
from datetime import datetime
from System import Environment
sys.path.append('C:\Program Files (x86)\IronPython 2.7\Lib')
import System
from System import Array
from System.Collections.Generic import *
clr.AddReference('ProtoGeometry')
from Autodesk.DesignScript.Geometry import *
clr.AddReference("RevitNodes")
import Revit
clr.ImportExtensions(Revit.Elements)
clr.ImportExtensions(Revit.GeometryConversion)
clr.AddReference("RevitServices")
import RevitServices
from RevitServices.Persistence import DocumentManager 
from RevitServices.Transactions import TransactionManager 
clr.AddReference("RevitAPI")
clr.AddReference("RevitAPIUI")
import Autodesk 
from Autodesk.Revit.DB import *
from Autodesk.Revit.UI import *
import time

doc = DocumentManager.Instance.CurrentDBDocument
uiapp = DocumentManager.Instance.CurrentUIApplication 
app = uiapp.Application 
uidoc = uiapp.ActiveUIDocument

sheets = FilteredElementCollector(doc).OfClass(ViewSheet).ToElements()
keys = []
for sheet in sheets:
	number = sheet.get_Parameter(BuiltInParameter.SHEET_NUMBER).AsString()
	name = sheet.get_Parameter(BuiltInParameter.SHEET_NAME).AsString()
	keys.append(number + '-' + name)
OUT = keys, sheets
# ----------------------------------------
code_block_2 = CodeBlock(x=python_script) { false; "Select sheets to duplicate"; 400; keys = x[0]; sheets = x[1]; }
listview_data = Custom[Listview Data](InputName=code_block_2.out1, Keys=code_block_2.keys, Values=code_block_2.sheets, Height_optionnal=code_block_2.out2, ShowId_optionnal=code_block_2.out0)  # package Data-Shapes; Create data for ListView input in UI.MultiInputForm ++ . Check out www.data-shapes.net for more infos.
code_block_3 = CodeBlock { "Diplicate with Views"; true; "Number of copies"; "1"; true; }
boolean_input = Custom[Boolean input](InputName=code_block_3.out0, DefaultValue=code_block_3.out1)  # package Data-Shapes; Creates a boolean input for UI.MultipleInputForm ++ . Check out www.data-shapes.net for more infos!
code_block_4 = CodeBlock { "Select view diplicate option:"; }
code_block_5 = CodeBlock()
# ---------- code_block_5.designscript (4 lines) ----------
[
"Duplicate",
"Duplicate with Detailing"
];
# ----------------------------------------
code_block_6 = CodeBlock()
# ---------- code_block_6.designscript (4 lines) ----------
[
0,
1
];
# ----------------------------------------
code_block_7 = CodeBlock { false; }
dropdown_data = Custom[DropDown Data](InputName=code_block_4, Keys=code_block_5, Values=code_block_6, Sorted_optional=code_block_7)  # package Data-Shapes; Create data for DropDown input in UI.MultiInputForm ++ . Check out www.data-shapes.net for more infos.
textbox_data = Custom[TextBox Data](InputName=code_block_3.out2, DefaultText=code_block_3.out3, IsNumberEntry=code_block_3.out4)  # package Data-Shapes; Create Data for TextBox input in UI.MultipleInputForm ++ . Check out www.data-shapes.net for more informations
list_create = List.Create(item0=textnote_data, item1=listview_data, item2=boolean_input, item3=dropdown_data, item4=textbox_data)
flatten = List.Flatten(list=list_create)
multipleinputform = Custom[MultipleInputForm ++](Logo_optional=readFromFile, ButtonText_optional=code_block.out1, Inputs=flatten, Toggle=code_block.out0, CancelButtonText_optional=code_block.out2, Width_optional=code_block.out4, LabelWidth_optional=code_block.out3)  # package Data-Shapes; Create a form with multiple inputs. see www.data-shapes.net for tutorials and infos!
code_block_8 = CodeBlock(x=multipleinputform.User_Inputs) { sheets = x[0]; withViews = x[1]; duplicateOption = x[2]; numberCopies = x[3]; }
code_block_9 = CodeBlock { 1; 0; }
if_ = If(test=code_block_8.duplicateOption, true=code_block_9.out0, false=code_block_9.out1)
ofRepeatedItem = List.OfRepeatedItem(item=code_block_8.sheets, amount=code_block_8.numberCopies)
code_block_10 = CodeBlock { true; }
code_block_11 = CodeBlock(numberCopies=code_block_8.numberCopies) { n=1..numberCopies; "_"+n; "."; }
split = String.Split(str=code_block_11.out1, separator0=code_block_11.out2)
firstItem = List.FirstItem(list=split@@L2)
list_create_2 = List.Create(item0=firstItem)
transpose = List.Transpose(lists=list_create_2)
duplicate = Revit.Sheet.Duplicate(sheets=ofRepeatedItem@@L2, run=code_block_10, duplicateWithViews=code_block_8.withViews, duplicateOption=code_block_8.duplicateOption, suffix=transpose@L2)
file_path_2 = Filename("..\ACG_logo.png")
file_from_path_2 = FileObject(path=file_path_2)
readFromFile_2 = Image.ReadFromFile(file=file_from_path_2)

# group: Usage
code_block_12 = CodeBlock { "Duplicate Sheets"; }
acg_script_usage = Custom[ACG Script Usage](scriptName=code_block_12)  # Adds an entry to Excel document every time a script is run. The document is located in S:\Dynamo\05-UsageStats

code_block_13 = CodeBlock { 1; }
flatten_2 = List.Flatten(list=duplicate.Sheet, amt=code_block_13)
code_block_14 = CodeBlock { "ACG_Level"; "ACG_Type"; "ACG_Volume"; }
getParameterValueByName = Element.GetParameterValueByName(element=ofRepeatedItem, parameterName=code_block_14.out2)
getParameterValueByName_2 = Element.GetParameterValueByName(element=ofRepeatedItem, parameterName=code_block_14.out1)
getParameterValueByName_3 = Element.GetParameterValueByName(element=ofRepeatedItem, parameterName=code_block_14.out0)

# group: Assing
code_block_15 = CodeBlock { "Sheet Phase"; "WIP"; }
setParameterByName = Element.SetParameterByName(element=duplicate.Sheet, parameterName=code_block_15.out0, value=code_block_15.out1)
setParameterByName_2 = Element.SetParameterByName(element=flatten_2, parameterName=code_block_14.out2, value=getParameterValueByName)
setParameterByName_3 = Element.SetParameterByName(element=flatten_2, parameterName=code_block_14.out1, value=getParameterValueByName_2)
setParameterByName_4 = Element.SetParameterByName(element=flatten_2, parameterName=code_block_14.out0, value=getParameterValueByName_3)

watch = Watch(duplicate.Sheet)
watch_2 = Watch(code_block_8.withViews)
watch_3 = Watch(code_block_8.duplicateOption)
file_path_3 = Filename("..\ACG_logo.png")  # frozen
file_from_path_3 = FileObject(path=file_path_3)
readFromFile_3 = Image.ReadFromFile(file=file_from_path_3)

# group: Processing
path_to_success_memes = StringInput("R:\3600_IT\3605_BIM\3605_17_Dynamo\01-Scripts\_Dyno Scripts\_Memes\Success")  # frozen
directory_from_path = DirectoryObject(path=path_to_success_memes)
getDirectoryContents = FileSystem.GetDirectoryContents(directory=directory_from_path)
shuffle = List.Shuffle(list=getDirectoryContents.files)
code_block_16 = CodeBlock(lst=getDirectoryContents.files) { numb=DSCore.List.Count(lst); sequence=1..numb; }
code_block_17 = CodeBlock(x=code_block_16.sequence) { x[0]; }
getItemAtIndex = List.GetItemAtIndex(list=shuffle, index=code_block_17)
path_to_success_memes_2 = StringInput("R:\3600_IT\3605_BIM\3605_17_Dynamo\01-Scripts\_Dyno Scripts\_Memes\Fail")  # frozen
directory_from_path_2 = DirectoryObject(path=path_to_success_memes_2)
getDirectoryContents_2 = FileSystem.GetDirectoryContents(directory=directory_from_path_2)
shuffle_2 = List.Shuffle(list=getDirectoryContents_2.files)
code_block_18 = CodeBlock(lst=getDirectoryContents_2.files) { numb=DSCore.List.Count(lst); sequence=1..numb; }
code_block_19 = CodeBlock(x=code_block_18.sequence) { x[0]; }
getItemAtIndex_2 = List.GetItemAtIndex(list=shuffle_2, index=code_block_19)

# group: Processing
code_block_20 = CodeBlock(report=duplicate.report) { report=="Duplication process successful"; ". "; }  # frozen
join = String.Join(separator=code_block_20.out1, string0=duplicate.report, lacing=Shortest)
code_block_21 = CodeBlock(lst=code_block_20.out0, reportFail=join) { errors=DSCore.List.Flatten(lst); errors[0]; "Yay! Duplication process successful!"; "Error: "+reportFail; }
if_2 = If(test=code_block_21.out1, true=getItemAtIndex, false=getItemAtIndex_2)
if_3 = If(test=code_block_20.out0, true=code_block_21.out2, false=code_block_21.out3)

# group: Processing
# note: UI.ImageData
# Custom Node: Data-Shapes v.2018.12.1
code_block_22 = CodeBlock { ""; true; }
python_script_2 = Python(IN[0]=code_block_22.out0, IN[1]=if_2, IN[2]=code_block_22.out1)
# ---------- python_script_2.python (17 lines) ----------
#Copyright (c) mostafa el ayoubi ,  2017
#Data-Shapes www.data-shapes.net , elayoubi.mostafa@gmail.com

class uiimage():

    def __init__(self,inputname,image,showborder):
        self.inputname = inputname    
        self.image = image
        self.showborder = showborder

    def __repr__(self):
        return 'UI.Image input'
        
x = uiimage(IN[0],IN[1],IN[2])


OUT = x
# ----------------------------------------

# group: Processing
code_block_23 = CodeBlock(lst=if_3) { DSCore.List.Flatten(lst); }
textnote_data_2 = Custom[TextNote Data](TextNote=code_block_23)
list_create_3 = List.Create(item0=python_script_2, item1=textnote_data_2)
code_block_24 = CodeBlock(lst=list_create_3) { DSCore.List.Flatten(lst); "...okay"; true; 500; }
multipleinputform_2 = Custom[MultipleInputForm ++](Logo_optional=readFromFile_3, ButtonText_optional=code_block_24.out1, Inputs=code_block_24.out0, Toggle=code_block_24.out2, LabelWidth_optional=code_block_24.out3)
