# Dynamo graph Export to PHPP-new.dyn (Dynamo 2.6.1.8786)
# packages: Ampersand 2017.2.2, archi-lab.net 2021.25.2521, BumbleBee 2021.25.3, Orchid 260.1.0.7729, Genius Loci 2021.2.3, Data-Shapes 2021.2.92, WombatDynamo 2.3.0

# group: Control
# note: HOW TO FILTER THESE? ARE WE USING ALL?

# group: Control
# note: BALCONIES & GROUND PLANE (SUB FOR TOPOSURFACE) MUST BE UNCATEGORISED

# group: Control
# note: SHOULD WE FILTER FOORMS LESS THAN 0.3m M2 ? SHAFTS ETC?
# note: THIS CAN ALSO BE DONE JUST WITH SCHEDULE

# group: Control
# note: THIS CAN BE DONE WITH AREAS AS WELL

# group: Control
# note: SHOULD THIS BE ALWAYS "1"?

# group: AREAS (TFA)
# note: SECTION ON THE SCRIPT

# group: WINDOWS (CURTAIN WALLS)
# note: SECTION ON THE SCRIPT

# group: Control
# note: ASSUMING THE CURTAIN WALLS ARE VERTICAL AND PARALEL TO THE BASIC WALLS. ALSO THE CURTAIN PANELS ARE STRAIGHT

# group: Control
# note: DO WE NEED QUANTITY?

# group: SHADING (INSERTS & CURTAIN WALLS)
# note: SECTION ON THE SCRIPT

# group: WINDOWS (INSERTS)
# note: SECTION ON THE SCRIPT

# group: U VALUES
# note: SECTION ON THE SCRIPT

# group: FOOTPRINT AREAS
# note: SECTION ON THE SCRIPT

# group: Control
# note: WHERE DOES THAT GO IN THE PHPP SPREADSHEET?

# group: AREAS - WALLS / FLOORS / ROOFS
# note: SECTION ON THE SCRIPT

# group: AREAS (WALLS)
# note: SECTION ON THE SCRIPT

# group: AREAS (ROOFS)
# note: SECTION ON THE SCRIPT

# group: AREAS (FLOORS)
# note: SECTION ON THE SCRIPT

# group: FROM WALLS
# note: SECTION ON THE SCRIPT

# group: FROM ROOFS
# note: SECTION ON THE SCRIPT

file_path = Filename("..\ACG_logo.png")
file_from_path = FileObject(path=file_path)
readFromFile = Image.ReadFromFile(file=file_from_path)

# group: Processing
get_design_options = Custom[Get Design Options]()  # package archi-lab.net; Queries all of the design options currently in the project.
code_block = CodeBlock { "Design Option Set Id"; }
# note: get design option's set
getParameterValueByName = Element.GetParameterValueByName(element=get_design_options.designOptions, parameterName=code_block)
name = Element.Name(element=getParameterValueByName)

# group: Filtering
code_block_2 = CodeBlock()
# ---------- code_block_2.designscript (19 lines) ----------
catW=Revit.Category.ByName("Walls");
ElementQueries.OfCategory(catW);

catF=Revit.Category.ByName("Floors");
ElementQueries.OfCategory(catF);

catR=Revit.Category.ByName("Roofs");
ElementQueries.OfCategory(catR);

catA=Revit.Category.ByName("Areas");
ElementQueries.OfCategory(catA);

catRooms=Revit.Category.ByName("Rooms");
ElementQueries.OfCategory(catRooms);

"Department";
"Comments";
"not in PHPP";
true;
# ----------------------------------------
getParameterValueByName_2 = Element.GetParameterValueByName(element=code_block_2.out9, parameterName=code_block_2.out11)
contains = String.Contains(str=getParameterValueByName_2, searchFor=code_block_2.out12, ignoreCase=code_block_2.out13)
filterByBoolMask = List.FilterByBoolMask(list=code_block_2.out9, mask=contains)
getParameterValueByName_3 = Element.GetParameterValueByName(element=code_block_2.out3, parameterName=code_block_2.out11)
contains_2 = String.Contains(str=getParameterValueByName_3, searchFor=code_block_2.out12, ignoreCase=code_block_2.out13)
filterByBoolMask_2 = List.FilterByBoolMask(list=code_block_2.out3, mask=contains_2)
allStackedWall = Orchid.RevitProject.Elements.Wall.AllStackedWall()
code_block_3 = CodeBlock { "Comments"; "not in PHPP"; true; }
getParameterValueByName_4 = Element.GetParameterValueByName(element=allStackedWall, parameterName=code_block_3.out0)
contains_3 = String.Contains(str=getParameterValueByName_4, searchFor=code_block_3.out1, ignoreCase=code_block_3.out2)
filterByBoolMask_3 = List.FilterByBoolMask(list=allStackedWall, mask=contains_3)
getParameterValueByName_5 = Element.GetParameterValueByName(element=code_block_2.out1, parameterName=code_block_2.out11)
contains_4 = String.Contains(str=getParameterValueByName_5, searchFor=code_block_2.out12, ignoreCase=code_block_2.out13)
filterByBoolMask_4 = List.FilterByBoolMask(list=code_block_2.out1, mask=contains_4)
getParameterValueByName_6 = Element.GetParameterValueByName(element=code_block_2.out5, parameterName=code_block_2.out11)
contains_5 = String.Contains(str=getParameterValueByName_6, searchFor=code_block_2.out12, ignoreCase=code_block_2.out13)
filterByBoolMask_5 = List.FilterByBoolMask(list=code_block_2.out5, mask=contains_5)
code_block_4 = CodeBlock()
# ---------- code_block_4.designscript (4 lines) ----------
catW=Revit.Category.ByName("Windows");
allW=ElementQueries.OfCategory(catW);
catD=Revit.Category.ByName("Doors");
allD=ElementQueries.OfCategory(catD);
# ----------------------------------------
getParameterValueByName_7 = Element.GetParameterValueByName(element=code_block_4.allW, parameterName=code_block_2.out11)
contains_6 = String.Contains(str=getParameterValueByName_7, searchFor=code_block_2.out12, ignoreCase=code_block_2.out13)
filterByBoolMask_6 = List.FilterByBoolMask(list=code_block_4.allW, mask=contains_6)
getParameterValueByName_8 = Element.GetParameterValueByName(element=code_block_4.allD, parameterName=code_block_2.out11)
contains_7 = String.Contains(str=getParameterValueByName_8, searchFor=code_block_2.out12, ignoreCase=code_block_2.out13)
filterByBoolMask_7 = List.FilterByBoolMask(list=code_block_4.allD, mask=contains_7)
getParameterValueByName_9 = Element.GetParameterValueByName(element=code_block_2.out7, parameterName=code_block_2.out11)
contains_8 = String.Contains(str=getParameterValueByName_9, searchFor=code_block_2.out12, ignoreCase=code_block_2.out13)
filterByBoolMask_8 = List.FilterByBoolMask(list=code_block_2.out7, mask=contains_8)

# group: Input
code_block_5 = CodeBlock { true; 200; 500; "Cancel"; "Run"; }
code_block_6 = CodeBlock { "Select .xlsx file"; }
file_path_2 = Filename(".\WIP-PHPP-ExportData.xlsx")
filepath_data = Custom[FilePath Data](InputName=code_block_6, DefaulPath=file_path_2)  # package Data-Shapes; Create filepath input for UI.MultipleInputForm ++ . Check out www.data-shapes.net for more infos !
code_block_7 = CodeBlock(designOption=get_design_options.designOptions, set=name, name=get_design_options.names) { designOption; DOname=set+" - "+name; "Select a Design Option"; }
# note: Pick Design Option and Schedule element
ui_dropdown_data = Custom[UI.DropDown Data](InputName=code_block_7.out2, Keys=code_block_7.DOname, Values=code_block_7.designOption)  # package Data-Shapes; Create data for DropDown input in UI.MultiInputForm ++ . Check out www.data-shapes.net for more infos.
code_block_8 = CodeBlock { "Department"; }
getParameterValueByName_10 = Element.GetParameterValueByName(element=filterByBoolMask.out, parameterName=code_block_8)
code_block_9 = CodeBlock(departments=getParameterValueByName_10) { dep=DSCore.List.UniqueItems(departments); dep==""; "Not Assigned"; "Select technical departments"; }
if_ = If(test=code_block_9.out1, true=code_block_9.out2, false=code_block_9.dep)
listview_data = Custom[Listview Data](InputName=code_block_9.out3, Keys=if_, Values=if_)  # package Data-Shapes; Create data for ListView input in UI.MultiInputForm ++ . Check out www.data-shapes.net for more infos.
code_block_10 = CodeBlock { DSCore.Types.FindTypeByNameInAssembly("AreaScheme","RevitAPI"); }
all_elements_of_type = ElementsOfType(element_type=code_block_10)
code_block_11 = CodeBlock(scheme=all_elements_of_type) { scheme.Name; "Select Area Scheme for footprint calculation"; }
dropdown_data = Custom[DropDown Data](InputName=code_block_11.out1, Keys=code_block_11.out0, Values=code_block_11.out0)  # package Data-Shapes; Create data for DropDown input in UI.MultiInputForm ++ . Check out www.data-shapes.net for more infos.
list_create = List.Create(item0=filepath_data, item1=ui_dropdown_data, item2=listview_data, item3=dropdown_data)
multipleinputform = Custom[MultipleInputForm ++](Logo_optional=readFromFile, ButtonText_optional=code_block_5.out4, Inputs=list_create, Toggle=code_block_5.out0, CancelButtonText_optional=code_block_5.out3, Width_optional=code_block_5.out2, LabelWidth_optional=code_block_5.out1)  # package Data-Shapes; Create a form with multiple inputs. see www.data-shapes.net for tutorials and infos!
code_block_12 = CodeBlock(x=multipleinputform.User_Inputs) { file=x[0]; technicalDeps=x[2]; footprintAreaSchemeName=x[3]; designOption=x[1]; }

# group: Filtering
code_block_13 = CodeBlock(designOption=code_block_12.designOption, elements=filterByBoolMask_2.out) { designOption; elements; }
code_block_14 = CodeBlock { "Design Option"; }
# note: Select elements from Main Model + selected Design Option
getParameterValueByName_11 = Element.GetParameterValueByName(element=code_block_13.elements, parameterName=code_block_14)
id = Element.Id(element=getParameterValueByName_11)
id_2 = Element.Id(element=code_block_13.designOption)
eq = id == id_2
# note: Elements in the selected Design Option [IN]
filterByBoolMask_9 = List.FilterByBoolMask(list=code_block_13.elements, mask=eq)
isNull = Object.IsNull(obj=id)
# note: Elements in the main model [IN]
filterByBoolMask_10 = List.FilterByBoolMask(list=code_block_13.elements, mask=isNull)
list_create_2 = List.Create(item0=filterByBoolMask_9.in, item1=filterByBoolMask_10.in)
clear_list = Custom[Clear List](input=list_create_2)  # package archi-lab.net; This node will remove all Null and Empty Lists from any list.
flatten = List.Flatten(list=clear_list)

# group: Filtering
# note: Select all floor types
type = archilab.Revit.Elements.Elements.Type(element=flatten)
uniqueItems = List.UniqueItems(list=type)

# group: Filtering
code_block_15 = CodeBlock { "Function"; ""; }
getParameterValueByName_12 = Element.GetParameterValueByName(element=type, parameterName=code_block_15.out0)
eq_2 = getParameterValueByName_12 == code_block_15.out1
# note: Filter only external + internal floor instances
filterByBoolMask_11 = List.FilterByBoolMask(list=flatten, mask=eq_2)

# group: Filtering
code_block_16 = CodeBlock(designOption=code_block_12.designOption, elements=filterByBoolMask_3.out) { designOption; elements; }
code_block_17 = CodeBlock { "Design Option"; }
# note: Select elements from Main Model + selected Design Option
getParameterValueByName_13 = Element.GetParameterValueByName(element=code_block_16.elements, parameterName=code_block_17)
id_3 = Element.Id(element=getParameterValueByName_13)
id_4 = Element.Id(element=code_block_16.designOption)
eq_3 = id_3 == id_4
# note: Elements in the selected Design Option [IN]
filterByBoolMask_12 = List.FilterByBoolMask(list=code_block_16.elements, mask=eq_3)
isNull_2 = Object.IsNull(obj=id_3)
# note: Elements in the main model [IN]
filterByBoolMask_13 = List.FilterByBoolMask(list=code_block_16.elements, mask=isNull_2)
list_create_3 = List.Create(item0=filterByBoolMask_12.in, item1=filterByBoolMask_13.in)
clear_list_2 = Custom[Clear List](input=list_create_3)
flatten_2 = List.Flatten(list=clear_list_2)

# group: Filtering
code_block_18 = CodeBlock(designOption=code_block_12.designOption, elements=filterByBoolMask_4.out) { designOption; elements; }
code_block_19 = CodeBlock { "Design Option"; }
# note: Select elements from Main Model + selected Design Option
getParameterValueByName_14 = Element.GetParameterValueByName(element=code_block_18.elements, parameterName=code_block_19)
id_5 = Element.Id(element=getParameterValueByName_14)
id_6 = Element.Id(element=code_block_18.designOption)
eq_4 = id_5 == id_6
# note: Elements in the selected Design Option [IN]
filterByBoolMask_14 = List.FilterByBoolMask(list=code_block_18.elements, mask=eq_4)
isNull_3 = Object.IsNull(obj=id_5)
# note: Elements in the main model [IN]
filterByBoolMask_15 = List.FilterByBoolMask(list=code_block_18.elements, mask=isNull_3)
list_create_4 = List.Create(item0=filterByBoolMask_14.in, item1=filterByBoolMask_15.in)
clear_list_3 = Custom[Clear List](input=list_create_4)
flatten_3 = List.Flatten(list=clear_list_3)

# group: Filtering
type_2 = archilab.Revit.Elements.Elements.Type(element=flatten_2)
function = Orchid.RevitProject.Elements.WallType.Function(wallType=type_2)
code_block_20 = CodeBlock { ["Exterior","Retaining"]; }
eq_5 = function == code_block_20  # lacing=CrossProduct
# note: Filter only external & retaining wall instances
anyTrue = Orchid.Common.List.AnyTrue(list=eq_5)
# note: Collect all exterior/retaining stacked walls
filterByBoolMask_16 = List.FilterByBoolMask(list=flatten_2, mask=anyTrue)
# note: Collect all stacked walls
get_wall_member = Custom[Get Wall Member](wall=filterByBoolMask_16.in)  # package Genius Loci; Returns the wall type, the sub walls of the stacked wall and the wall panel of the curtain wall.
type_3 = archilab.Revit.Elements.Elements.Type(element=flatten_3)
kind = WallType.Kind(wallType=type_3)
code_block_21 = CodeBlock(kind=kind) { kind=="Curtain"; kind=="Basic"; }
# note: Basic walls
filterByBoolMask_17 = List.FilterByBoolMask(list=flatten_3, mask=code_block_21.out1)
type_4 = archilab.Revit.Elements.Elements.Type(element=filterByBoolMask_17.in)
function_2 = Orchid.RevitProject.Elements.WallType.Function(wallType=type_4)
code_block_22 = CodeBlock { ["Exterior","Retaining"]; }
eq_6 = function_2 == code_block_22  # lacing=CrossProduct
anyTrue_2 = Orchid.Common.List.AnyTrue(list=eq_6)
filterByBoolMask_18 = List.FilterByBoolMask(list=filterByBoolMask_17.in, mask=anyTrue_2)
setDifference = List.SetDifference(list1=filterByBoolMask_18.in, list2=get_wall_member.Walls)
isNull_4 = Object.IsNull(obj=setDifference)
if_2 = If(test=isNull_4, true=filterByBoolMask_18.in, false=setDifference)
list_create_5 = List.Create(item0=if_2, item1=filterByBoolMask_16.in)
# note: Basic walls + stacked walls
flatten_4 = List.Flatten(list=list_create_5)
# note: Curtain walls
filterByBoolMask_19 = List.FilterByBoolMask(list=flatten_3, mask=code_block_21.out0)

clear_list_4 = Custom[Clear List](input=flatten_4)

# group: Visualisation
# note: Basic walls + stacked walls + members of stacked walls
list_create_6 = List.Create(item0=get_wall_member.Walls, item1=clear_list_4, item2=filterByBoolMask_16.in)
flatten_5 = List.Flatten(list=list_create_6)

# group: Control
orientation = Orchid.RevitProject.Elements.Wall.Orientation(wall=clear_list_4)
ZAxis = Vector.ZAxis()
code_block_23 = CodeBlock { catPBS=Revit.Category.ByName("Site - Project Base Point"); ElementQueries.OfCategory(catPBS); "Angle to True North"; }
all_elements_of_category = ElementsOfCategory(Category=code_block_23.catPBS)
# note: rotate wall normals so they are relarive to True North
getParameterValueByName_15 = Element.GetParameterValueByName(element=all_elements_of_category, parameterName=code_block_23.out2)
code_block_24 = CodeBlock(angle=getParameterValueByName_15) { 360-angle[0]; }
rotate = Vector.Rotate(vector=orientation, axis=ZAxis, degrees=code_block_24)

# group: Processing
# note: True North Vector
YAxis = Vector.YAxis()
ZAxis_2 = Vector.ZAxis()
angleAboutAxis = Vector.AngleAboutAxis(vector=rotate, otherVector=YAxis, rotationAxis=ZAxis_2)
code_block_25 = CodeBlock(vectors=angleAboutAxis) { DSCore.Math.Round(vectors); }

# group: Processing
# note: Group all wall instances by orientation
groupByKey = List.GroupByKey(list=clear_list_4, keys=code_block_25)
# note: Group all wall instances by orientation and then by type
type_5 = archilab.Revit.Elements.Elements.Type(element=groupByKey.groups@@L2)
groupByKey_2 = List.GroupByKey(list=groupByKey.groups@@L2, keys=type_5@L2)

watch = Watch(groupByKey.groups)

# group: Visualisation
# note: Hide / isolate elements in dedicated views
code_block_26 = CodeBlock { "PHPP-ZZ-Areas(Walls)-IN"; "PHPP-ZZ-Areas(Walls)-OUT"; }
byName = Orchid.RevitProject.Views.View.ByName(name=code_block_26.out0)
isolate_in_view = Custom[Isolate in View](element=flatten_5, view=byName)  # package archi-lab.net; This node will take input of elements and a view to isolate selected elements in a view.
byName_2 = Orchid.RevitProject.Views.View.ByName(name=code_block_26.out1)
hide_in_view = Python(IN[0]=flatten_5, IN[1]=byName_2)
# ---------- hide_in_view.python (95 lines) ----------
# Copyright(c) 2016, Konrad K Sobon
# @arch_laboratory, http://archi-lab.net

# Import Element wrapper extension methods
import clr
clr.AddReference("RevitNodes")
import Revit
clr.ImportExtensions(Revit.Elements)

# Import DocumentManager and TransactionManager
clr.AddReference("RevitServices")
import RevitServices
from RevitServices.Persistence import DocumentManager
from RevitServices.Transactions import TransactionManager
doc = DocumentManager.Instance.CurrentDBDocument

# Import RevitAPI
clr.AddReference("RevitAPI")
import Autodesk
from Autodesk.Revit.DB import *

import System
from System import Array
from System.Collections.Generic import *

import sys
pyt_path = r'C:\Program Files (x86)\IronPython 2.7\Lib'
sys.path.append(pyt_path)

#The inputs to this node will be stored as a list in the IN variable.
dataEnteringNode = IN

view = UnwrapElement(IN[1])

def ProcessList(_func, _list):
    return map( lambda x: ProcessList(_func, x) if type(x)==list else _func(x), _list )

def Unwrap(item):
	try:
		e = doc.GetElement(ElementId(int(item.Id)))
		return e
	except:
		return None

def ClearList(_list):
    out = []
    for _list1 in _list:
        if _list1 is None:
            continue
        if not _list1:
        	continue
        if isinstance(_list1, list):
             _list1 = ClearList(_list1)
             if not _list1:
                 continue
        out.append(_list1)
    return out

if isinstance(IN[0], list):
	lmnts = ProcessList(Unwrap, IN[0])
	lmnts = ClearList(lmnts)
else:
	lmnts = [Unwrap(elem)]
	lmnts = ClearList(lmnts)

try:
	errorReport = None
	elemSet = ElementSet()
	for i in lmnts:
		elemSet.Insert(i)
	
	excludes = List[ElementId]()
	elemIter = elemSet.ForwardIterator()
	elemIter.Reset()
	while elemIter.MoveNext():
		curElem = elemIter.Current
		excludes.Add(curElem.Id)
	
	filter = ExclusionFilter(excludes)
	
	new_collector = FilteredElementCollector(doc, view.Id).WhereElementIsNotElementType().WherePasses(filter).ToElementIds()
	TransactionManager.Instance.EnsureInTransaction(doc)
	view.IsolateElementsTemporary(new_collector)
	TransactionManager.Instance.TransactionTaskDone()

except:
	# if error accurs anywhere in the process catch it
	import traceback
	errorReport = traceback.format_exc()	

#Assign your output to the OUT variable
if errorReport == None:
	OUT = lmnts
else:
	OUT = errorReport
# ----------------------------------------
code_block_27 = CodeBlock(element=hide_in_view) { _element; }
code_block_28 = CodeBlock { DSCore.Types.FindTypeByNameInAssembly("FillPatternElement","RevitAPI"); }
all_elements_of_type_2 = ElementsOfType(element_type=code_block_28)
code_block_29 = CodeBlock(pat=all_elements_of_type_2) { patName=pat.Name; patName=="<Solid fill>"; }
filterByBoolMask_20 = List.FilterByBoolMask(list=all_elements_of_type_2, mask=code_block_29.out1)
code_block_30 = CodeBlock { 0..225; }
shuffle = List.Shuffle(list=code_block_30)
count = List.Count(list=watch)
code_block_31 = CodeBlock(x=shuffle, count=count) { x[1..count]; }
shuffle_2 = List.Shuffle(list=code_block_30)
shuffle_3 = List.Shuffle(list=shuffle_2)
code_block_32 = CodeBlock(x=shuffle_3, count=count) { x[1..count]; }
shuffle_4 = List.Shuffle(list=code_block_30)
shuffle_5 = List.Shuffle(list=shuffle_4)
shuffle_6 = List.Shuffle(list=shuffle_5)
code_block_33 = CodeBlock(x=shuffle_6, count=count) { x[1..count]; }
byARGB = Color.ByARGB(r=code_block_31, g=code_block_32, b=code_block_33)
create_overridegraphicsettings = Custom[Create OverrideGraphicSettings](SurfaceForegroundPattern=filterByBoolMask_20.in, SurfaceForegroundPatternColor=byARGB@L1, SurfaceBackgroundPattern=filterByBoolMask_20.in, SurfaceBackgroundColor=byARGB@@L1)  # package Genius Loci; Create a OverrideGraphicSettings (All graphic inputs are optional). Unlike the OOTB OverrideGraphicSettings.ByProperties node, the Foreground and background patterns are available. Note : Prior to Revit 2019, the materials have only one surface pattern and one cut pattern.
view_setelementoverrides = Custom[View SetElementOverrides](view=byName, elements=watch@L2, overrides=create_overridegraphicsettings@@L1)  # package Genius Loci; Overrides element graphics settings in the given view. For use with the Create OverrideGraphicSettings node. Can also be used to hide or unhide elements.

# group: Filtering
code_block_34 = CodeBlock(designOption=code_block_12.designOption, elements=filterByBoolMask_5.out) { designOption; elements; }
code_block_35 = CodeBlock { "Design Option"; }
# note: Select elements from Main Model + selected Design Option
getParameterValueByName_16 = Element.GetParameterValueByName(element=code_block_34.elements, parameterName=code_block_35)
id_7 = Element.Id(element=getParameterValueByName_16)
id_8 = Element.Id(element=code_block_34.designOption)
eq_7 = id_7 == id_8
# note: Elements in the selected Design Option [IN]
filterByBoolMask_21 = List.FilterByBoolMask(list=code_block_34.elements, mask=eq_7)
isNull_5 = Object.IsNull(obj=id_7)
# note: Elements in the main model [IN]
filterByBoolMask_22 = List.FilterByBoolMask(list=code_block_34.elements, mask=isNull_5)
list_create_7 = List.Create(item0=filterByBoolMask_21.in, item1=filterByBoolMask_22.in)
clear_list_5 = Custom[Clear List](input=list_create_7)
flatten_6 = List.Flatten(list=clear_list_5)

code_block_36 = CodeBlock(allRoofs=flatten_6) { allRoofs; }

# group: Filtering
faces = Element.Faces(element=code_block_36)
byJoinedSurfaces = PolySurface.ByJoinedSurfaces(surfaces=faces)
ZAxis_3 = Vector.ZAxis()
reverse = Vector.Reverse(vector=ZAxis_3)
code_block_37 = CodeBlock { 0.01; }
translate = Geometry.Translate(geometry=byJoinedSurfaces, direction=reverse, distance=code_block_37)
# note: Collect roof's top faces & areas
doesIntersect = Geometry.DoesIntersect(geometry=faces, other=translate)
filterByBoolMask_23 = List.FilterByBoolMask(list=faces, mask=doesIntersect)
code_block_38 = CodeBlock(topFaces=filterByBoolMask_23.out) { topFaces; }

# group: Filtering
area = Surface.Area(surface=code_block_38)
# note: Ignore faces that are less than 1 sq.m.
code_block_39 = CodeBlock(input=area) { area=input/100000; area>1; }
filterByBoolMask_24 = List.FilterByBoolMask(list=code_block_38, mask=code_block_39.out1)
code_block_40 = CodeBlock(surfaces=filterByBoolMask_24.in) { DSCore.List.Flatten(surfaces); }

# group: Filtering
allFalse = List.AllFalse(list=code_block_39.out1@@L2)
filterByBoolMask_25 = List.FilterByBoolMask(list=code_block_36, mask=allFalse)
type_6 = archilab.Revit.Elements.Elements.Type(element=code_block_36)
# note: Filter very small roof elements [OUT]
filterByBoolMask_26 = List.FilterByBoolMask(list=type_6, mask=allFalse)
count_2 = List.Count(list=filterByBoolMask_24.in@@L2)
ofRepeatedItem = List.OfRepeatedItem(item=filterByBoolMask_26.out@@L1, amount=count_2@L1)
code_block_41 = CodeBlock(t=ofRepeatedItem) { roofType=t.Name; DSCore.List.Flatten(roofType); }

# group: Processing
get_worksheet_names = Custom[Get Worksheet Names](filePath=code_block_12.file, runIt=code_block_5.out0)  # package BumbleBee; This node will query an Excel file and return a list of sheet names that it contains.
code_block_42 = CodeBlock { "A2:Z300"; }
# note: Clean the Excel file before writting new data
clear_contents = Custom[Clear Contents](filePath=code_block_12.file, RunIt=code_block_5.out0, SheetName=get_worksheet_names, ClearContent=code_block_5.out0, CellRange=code_block_42)  # package BumbleBee; This node will clear contents or formatting from a range within Excel sheet or an entire sheet.
await_ = Orchid.Common.DataStream.Await(pass=code_block_12.file, waitFor=clear_contents)

# group: Filtering
code_block_43 = CodeBlock(compliantWalls=if_2) { compliantWalls; }
type_7 = archilab.Revit.Elements.Elements.Type(element=code_block_43)
# note: External & etaining wall types
uniqueItems_2 = List.UniqueItems(list=type_7)
type_8 = archilab.Revit.Elements.Elements.Type(element=flatten_2)
function_3 = Orchid.RevitProject.Elements.WallType.Function(wallType=type_8)
code_block_44 = CodeBlock { ["Exterior","Retaining"]; }
eq_8 = function_3 == code_block_44  # lacing=CrossProduct
# note: Filter only external & retaining wall instances
anyTrue_3 = Orchid.Common.List.AnyTrue(list=eq_8)
# note: Collect all exterior/retaining stacked walls
filterByBoolMask_27 = List.FilterByBoolMask(list=flatten_2, mask=anyTrue_3)
# note: Collect all stacked walls
type_9 = archilab.Revit.Elements.Elements.Type(element=filterByBoolMask_27.in)
groupByKey_3 = List.GroupByKey(list=filterByBoolMask_27.in, keys=type_9)
# note: all wall types (basic + stacked) to extract type names
list_create_8 = List.Create(item0=uniqueItems_2, item1=groupByKey_3.unique_keys)
flatten_7 = List.Flatten(list=list_create_8)
clear_list_6 = Custom[Clear List](input=flatten_7)
lastItem = List.LastItem(list=groupByKey_3.groups@@L2)
get_wall_member_2 = Custom[Get Wall Member](wall=lastItem@@L1)
code_block_45 = CodeBlock { "Volume"; }
getParameterValueByName_17 = Element.GetParameterValueByName(element=get_wall_member_2.Walls, parameterName=code_block_45)
sortByKey = List.SortByKey(list=get_wall_member_2.Walls@L2, keys=getParameterValueByName_17@@L2)
lastItem_2 = List.LastItem(list=sortByKey.sorted_list@@L2)
# note: main member of each stack wall
type_10 = archilab.Revit.Elements.Elements.Type(element=lastItem_2)
# note: all wall types (basic + stacked) to extract components
list_create_9 = List.Create(item0=uniqueItems_2, item1=type_10)
flatten_8 = List.Flatten(list=list_create_9)
clear_list_7 = Custom[Clear List](input=flatten_8)

# group: Filtering
code_block_46 = CodeBlock { "Function"; 1; }
getParameterValueByName_18 = Element.GetParameterValueByName(element=uniqueItems, parameterName=code_block_46.out0)
# note: Filter only external floor types
eq_9 = getParameterValueByName_18 == code_block_46.out1
filterByBoolMask_28 = List.FilterByBoolMask(list=uniqueItems, mask=eq_9)

code_block_47 = CodeBlock(allRoofs=flatten_6) { allRoofs; }

# group: Filtering
# note: Select all roof types
type_11 = archilab.Revit.Elements.Elements.Type(element=code_block_47)
uniqueItems_3 = List.UniqueItems(list=type_11)

# group: Processing
code_block_48 = CodeBlock(floorTypes=filterByBoolMask_28.in, roofTypes=uniqueItems_3, wallTypes=clear_list_6)
# ---------- code_block_48.designscript (17 lines) ----------
countFloors=DSCore.List.Count(floorTypes);
numbFloors=1..countFloors;
numbFloors<10;
"0"+numbFloors;



countRoofs=DSCore.List.Count(roofTypes);
numRoofs=(countFloors+1)..(countFloors+countRoofs);
numRoofs<10;
"0"+numRoofs;


countWalls=DSCore.List.Count(wallTypes);
numWalls=(countFloors+countRoofs+1)..(countFloors+countRoofs+countWalls);
numWalls<10;
"0"+numWalls;
# ----------------------------------------
if_3 = If(test=code_block_48.out10, true=code_block_48.out11, false=code_block_48.numWalls)
# note: ud Walls
code_block_49 = CodeBlock(numb=if_3) { assemblyNo=numb+"ud"; }
# note: Get "ud" codes
if_4 = If(test=code_block_48.out2, true=code_block_48.out3, false=code_block_48.numbFloors)
# note: ud Floors
code_block_50 = CodeBlock(numb=if_4) { assemblyNo=numb+"ud"; }
if_5 = If(test=code_block_48.out6, true=code_block_48.out7, false=code_block_48.numRoofs)
# note: ud Roofs
code_block_51 = CodeBlock(numb=if_5) { assemblyNo=numb+"ud"; }

# group: Processing
code_block_52 = CodeBlock(wallTypes=clear_list_6) { "Thermal Conductivity"; wallTypes.Name; " "; }
get_compoundstructurelayers = Custom[Get CompoundStructureLayers](ElementOrFamilyType=clear_list_7)  # package Genius Loci; Retrieves the properties of the compound layers of wall, floor, roof or ceiling Type.
name_2 = Element.Name(element=get_compoundstructurelayers.Material)
assets = archilab.Revit.Elements.Materials.Assets(material=get_compoundstructurelayers.Material@@L2)
getParameterValueByName_19 = Element.GetParameterValueByName(element=assets.thermalAsset, parameterName=code_block_52.out0)
code_block_53 = CodeBlock(name=name_2, thermalC=getParameterValueByName_19, thicknes=get_compoundstructurelayers.Thickness) { name==null; thermalC==null; thicknes==null; "N//A"; }
# note: Materials
if_6 = If(test=code_block_53.out0, true=code_block_53.out3, false=name_2)
# note: AssemblyNo + Materials
addItemToFront = List.AddItemToFront(item=code_block_49@@L1, list=if_6@L2)
# note: l [W/(mK)]
if_7 = If(test=code_block_53.out1, true=code_block_53.out3, false=getParameterValueByName_19)
# note: Element type + l [W/(mK)]
addItemToFront_2 = List.AddItemToFront(item=code_block_52.out1@@L1, list=if_7@L2)
code_block_54 = CodeBlock { ""; }
# note: Thickness
if_8 = If(test=code_block_53.out2, true=code_block_53.out3, false=get_compoundstructurelayers.Thickness)
addItemToFront_3 = List.AddItemToFront(item=code_block_54, list=if_8@L2)
list_create_10 = List.Create(item0=addItemToFront, item1=addItemToFront_2, item2=addItemToFront_3)
flatten_9 = List.Flatten()  # unwired: list

addItemToFront_4 = List.AddItemToFront(item=code_block_52.out2, list=list_create_10@@L2)

# group (continued): Processing
map = List.Map(list=addItemToFront_4, f_x=flatten_9)

# group: Processing
get_compoundstructurelayers_2 = Custom[Get CompoundStructureLayers](ElementOrFamilyType=filterByBoolMask_28.in)
name_3 = Element.Name(element=get_compoundstructurelayers_2.Material)
assets_2 = archilab.Revit.Elements.Materials.Assets(material=get_compoundstructurelayers_2.Material@@L2)
code_block_55 = CodeBlock(floorTypes=filterByBoolMask_28.in) { "Thermal Conductivity"; floorTypes.Name; }
getParameterValueByName_20 = Element.GetParameterValueByName(element=assets_2.thermalAsset, parameterName=code_block_55.out0)
code_block_56 = CodeBlock(name=name_3, thermalC=getParameterValueByName_20, thicknes=get_compoundstructurelayers_2.Thickness) { name==null; thermalC==null; thicknes==null; "N//A"; }
if_9 = If(test=code_block_56.out0, true=code_block_56.out3, false=name_3)
addItemToFront_5 = List.AddItemToFront(item=code_block_50@@L1, list=if_9@L2)
if_10 = If(test=code_block_56.out1, true=code_block_56.out3, false=getParameterValueByName_20)
addItemToFront_6 = List.AddItemToFront(item=code_block_55.out1@@L1, list=if_10@L2)
code_block_57 = CodeBlock { ""; }
if_11 = If(test=code_block_56.out2, true=code_block_56.out3, false=get_compoundstructurelayers_2.Thickness)
addItemToFront_7 = List.AddItemToFront(item=code_block_57, list=if_11@L2)
list_create_11 = List.Create(item0=addItemToFront_5, item1=addItemToFront_6, item2=addItemToFront_7)
addItemToFront_8 = List.AddItemToFront(item=code_block_52.out2, list=list_create_11@@L2)
flatten_10 = List.Flatten()  # unwired: list
map_2 = List.Map(list=addItemToFront_8, f_x=flatten_10)

# group: Processing
get_compoundstructurelayers_3 = Custom[Get CompoundStructureLayers](ElementOrFamilyType=uniqueItems_3)
name_4 = Element.Name(element=get_compoundstructurelayers_3.Material)
assets_3 = archilab.Revit.Elements.Materials.Assets(material=get_compoundstructurelayers_3.Material@@L2)
code_block_58 = CodeBlock(roofTypes=uniqueItems_3) { "Thermal Conductivity"; roofTypes.Name; }
getParameterValueByName_21 = Element.GetParameterValueByName(element=assets_3.thermalAsset, parameterName=code_block_58.out0)
code_block_59 = CodeBlock(name=name_4, thermalC=getParameterValueByName_21, thicknes=get_compoundstructurelayers_3.Thickness) { name==null; thermalC==null; thicknes==null; "N//A"; }
if_12 = If(test=code_block_59.out0, true=code_block_59.out3, false=name_4)
addItemToFront_9 = List.AddItemToFront(item=code_block_51@@L1, list=if_12@L2)
if_13 = If(test=code_block_59.out1, true=code_block_59.out3, false=getParameterValueByName_21)
addItemToFront_10 = List.AddItemToFront(item=code_block_58.out1@@L1, list=if_13@L2)
code_block_60 = CodeBlock { ""; }
if_14 = If(test=code_block_59.out2, true=code_block_59.out3, false=get_compoundstructurelayers_3.Thickness)
addItemToFront_11 = List.AddItemToFront(item=code_block_60, list=if_14@L2)
list_create_12 = List.Create(item0=addItemToFront_9, item1=addItemToFront_10, item2=addItemToFront_11)
addItemToFront_12 = List.AddItemToFront(item=code_block_52.out2, list=list_create_12@@L2)
flatten_11 = List.Flatten()  # unwired: list
map_3 = List.Map(list=addItemToFront_12, f_x=flatten_11)

# group: Assing
code_block_61 = CodeBlock { "UValues(Walls)"; "UValues(Floors)"; "UValues(Roofs)"; "A2"; true; }
bb_data = Custom[BB Data](sheetName=code_block_61.out0, origin=code_block_61.out3, data=map)  # package BumbleBee; This node is a building block for different modes of writing to Excel files. You can combines this node into a list to write to multiple sheets or use just one to write to a single sheet.
bb_data_2 = Custom[BB Data](sheetName=code_block_61.out1, origin=code_block_61.out3, data=map_2)
bb_data_3 = Custom[BB Data](sheetName=code_block_61.out2, origin=code_block_61.out3, data=map_3)
list_create_13 = List.Create(item0=bb_data, item1=bb_data_2, item2=bb_data_3)
write_excel = Custom[Write Excel](filePath=await_, runIt=code_block_5.out0, byColumn=code_block_61.out4, BBData=list_create_13)  # package BumbleBee; This node will write data to Excel file and based on how your BBData nodes are structured it will either override the exsting file, create a new one and write a single worksheet or write multiple worksheets.

# group: Processing
# note: Get quantity for walls
count_3 = List.Count(list=groupByKey_2.groups@@L2)

# group: Processing
# note: Generate angle from horizontal
code_block_62 = CodeBlock(group=count_3) { group==99; "error"; "90"; }
if_15 = If(test=code_block_62.out0, true=code_block_62.out1, false=code_block_62.out2)

code_block_63 = CodeBlock(angleFromHorizontal=if_15) { DSCore.List.Flatten(angleFromHorizontal); }

# group: Processing
function_4 = Orchid.RevitProject.Elements.WallType.Function(wallType=groupByKey_2.unique_keys)
# note: Get function - generate group number
code_block_64 = CodeBlock(func=function_4) { func=="Exterior"; "8"; "9"; }
if_16 = If(test=code_block_64.out0, true=code_block_64.out1, false=code_block_64.out2)

code_block_65 = CodeBlock(groupNo=if_16) { DSCore.List.Flatten(groupNo); }

# group: Processing
code_block_66 = CodeBlock { "Area"; }
# note: Get Areas
getParameterValueByName_22 = Element.GetParameterValueByName(element=groupByKey_2.groups, parameterName=code_block_66)
sum = Math.Sum(values=getParameterValueByName_22@L2)

code_block_67 = CodeBlock(area=sum) { DSCore.List.Flatten(area); }

# group: Processing
groupByKey_4 = List.GroupByKey(list=code_block_25, keys=code_block_25)
groupByKey_5 = List.GroupByKey(list=groupByKey_4.groups@@L2, keys=type_5@L2)
# note: Group wall orientations
firstItem = List.FirstItem(list=groupByKey_5.groups@@L2)

code_block_68 = CodeBlock(devNorth=firstItem) { DSCore.List.Flatten(devNorth); }

# group: Processing
name_5 = Element.Name(element=groupByKey_2.unique_keys)
code_block_69 = CodeBlock(name=name_5, devFromNotrh=firstItem) { name+"//"+devFromNotrh; ".000000"; ""; }
replace = String.Replace(str=code_block_69.out0, searchFor=code_block_69.out1, replaceWith=code_block_69.out2)

# group: Assing
code_block_70 = CodeBlock { true; "Areas(Walls)"; }
code_block_71 = CodeBlock { "Angle from horizontal"; "U2"; }
bb_data_4 = Custom[BB Data](sheetName=code_block_70.out1, origin=code_block_71.out1, data=code_block_63)
code_block_72 = CodeBlock { "Quantity"; "E2"; }
flatten_12 = List.Flatten(list=count_3)
bb_data_5 = Custom[BB Data](sheetName=code_block_70.out1, origin=code_block_72.out1, data=flatten_12)
code_block_73 = CodeBlock { "To groun no."; "C2"; }
bb_data_6 = Custom[BB Data](sheetName=code_block_70.out1, origin=code_block_73.out1, data=code_block_65)
code_block_74 = CodeBlock { "Area"; "K2"; }
bb_data_7 = Custom[BB Data](sheetName=code_block_70.out1, origin=code_block_74.out1, data=code_block_67)
code_block_75 = CodeBlock { "Deviation from North"; "T2"; }
bb_data_8 = Custom[BB Data](sheetName=code_block_70.out1, origin=code_block_75.out1, data=code_block_68)
code_block_76 = CodeBlock { "Building assembly description"; "B2"; }
flatten_13 = List.Flatten(list=replace)
bb_data_9 = Custom[BB Data](sheetName=code_block_70.out1, origin=code_block_76.out1, data=flatten_13)
list_create_14 = List.Create(item0=bb_data_4, item1=bb_data_5, item2=bb_data_6, item3=bb_data_7, item4=bb_data_8, item5=bb_data_9)
write_excel_2 = Custom[Write Excel](filePath=await_, runIt=code_block_70.out0, byColumn=code_block_70.out0, BBData=list_create_14)

# group: Filtering
code_block_77 = CodeBlock(designOption=code_block_12.designOption, elements=filterByBoolMask_6.out) { designOption; elements; }
code_block_78 = CodeBlock { "Design Option"; }
# note: Select elements from Main Model + selected Design Option
getParameterValueByName_23 = Element.GetParameterValueByName(element=code_block_77.elements, parameterName=code_block_78)
id_9 = Element.Id(element=getParameterValueByName_23)
id_10 = Element.Id(element=code_block_77.designOption)
eq_10 = id_9 == id_10
# note: Elements in the selected Design Option [IN]
filterByBoolMask_29 = List.FilterByBoolMask(list=code_block_77.elements, mask=eq_10)
isNull_6 = Object.IsNull(obj=id_9)
# note: Elements in the main model [IN]
filterByBoolMask_30 = List.FilterByBoolMask(list=code_block_77.elements, mask=isNull_6)
list_create_15 = List.Create(item0=filterByBoolMask_29.in, item1=filterByBoolMask_30.in)
clear_list_8 = Custom[Clear List](input=list_create_15)
flatten_14 = List.Flatten(list=clear_list_8)

# group: Filtering
code_block_79 = CodeBlock(designOption=code_block_12.designOption, elements=filterByBoolMask_7.out) { designOption; elements; }
code_block_80 = CodeBlock { "Design Option"; }
# note: Select elements from Main Model + selected Design Option
getParameterValueByName_24 = Element.GetParameterValueByName(element=code_block_79.elements, parameterName=code_block_80)
id_11 = Element.Id(element=getParameterValueByName_24)
id_12 = Element.Id(element=code_block_79.designOption)
eq_11 = id_11 == id_12
# note: Elements in the selected Design Option [IN]
filterByBoolMask_31 = List.FilterByBoolMask(list=code_block_79.elements, mask=eq_11)
isNull_7 = Object.IsNull(obj=id_11)
# note: Elements in the main model [IN]
filterByBoolMask_32 = List.FilterByBoolMask(list=code_block_79.elements, mask=isNull_7)
list_create_16 = List.Create(item0=filterByBoolMask_31.in, item1=filterByBoolMask_32.in)
clear_list_9 = Custom[Clear List](input=list_create_16)
flatten_15 = List.Flatten(list=clear_list_9)

# group: Processing
list_create_17 = List.Create(item0=flatten_14, item1=flatten_15)
code_block_81 = CodeBlock(lst=list_create_17) { DSCore.List.Flatten(lst); }
getHost = FamilyInstance.GetHost(familyInstance=code_block_81)
# note: get all valid elements that host windows/doors [OUT]
isNull_8 = Object.IsNull(obj=getHost)
# note: get all windows/doors hosted in valid elements [OUT]
filterByBoolMask_33 = List.FilterByBoolMask(list=code_block_81, mask=isNull_8)
filterByBoolMask_34 = List.FilterByBoolMask(list=getHost, mask=isNull_8)

# group: Filtering
getCategory = Element.GetCategory(element=filterByBoolMask_34.out)
string_from_object = FromObject(obj=getCategory)
code_block_82 = CodeBlock(value=string_from_object) { value=="Walls"; value=="Roofs"; }
# note: get all windows/doors hosted in walls [IN]
filterByBoolMask_35 = List.FilterByBoolMask(list=filterByBoolMask_33.out, mask=code_block_82.out0)
filterByBoolMask_36 = List.FilterByBoolMask(list=filterByBoolMask_34.out, mask=code_block_82.out0)
# note: get all walls that host windows/doors [IN]
code_block_83 = CodeBlock(w=filterByBoolMask_36.in) { w.Id; }
element_by_id = ElementById(Id=code_block_83)
# note: get all windows/doors hosted in roofs [IN]
filterByBoolMask_37 = List.FilterByBoolMask(list=filterByBoolMask_33.out, mask=code_block_82.out1)
filterByBoolMask_38 = List.FilterByBoolMask(list=filterByBoolMask_34.out, mask=code_block_82.out1)
# note: get all roofs that host windows/doors [IN]
code_block_84 = CodeBlock(w=filterByBoolMask_38.in) { w.Id; }
element_by_id_2 = ElementById(Id=code_block_84)

# group: Filtering
type_12 = archilab.Revit.Elements.Elements.Type(element=element_by_id)
kind_2 = WallType.Kind(wallType=type_12)
code_block_85 = CodeBlock(kind=kind_2) { kind=="Basic"; }
filterByBoolMask_39 = List.FilterByBoolMask(list=filterByBoolMask_35.in, mask=code_block_85)
# note: Basic walls
filterByBoolMask_40 = List.FilterByBoolMask(list=element_by_id, mask=code_block_85)

# group: Filtering
type_13 = archilab.Revit.Elements.Elements.Type(element=filterByBoolMask_40.in)
function_5 = Orchid.RevitProject.Elements.WallType.Function(wallType=type_13)
code_block_86 = CodeBlock { ["Exterior","Retaining"]; }
eq_12 = function_5 == code_block_86  # lacing=CrossProduct
# note: Filter only external & retaining wall instances
anyTrue_4 = Orchid.Common.List.AnyTrue(list=eq_12)
filterByBoolMask_41 = List.FilterByBoolMask(list=filterByBoolMask_39.in, mask=anyTrue_4)
filterByBoolMask_42 = List.FilterByBoolMask(list=filterByBoolMask_40.in, mask=anyTrue_4)

# group: Control
orientation_2 = Orchid.RevitProject.Elements.Wall.Orientation(wall=filterByBoolMask_42.in)
ZAxis_4 = Vector.ZAxis()
code_block_87 = CodeBlock { carPBS=Revit.Category.ByName("Site - Project Base Point"); ElementQueries.OfCategory(catPBS); "Angle to True North"; }  # unwired: catPBS
all_elements_of_category_2 = ElementsOfCategory(Category=code_block_87.carPBS)
# note: rotate wall normals so they are relarive to True North
getParameterValueByName_25 = Element.GetParameterValueByName(element=all_elements_of_category_2, parameterName=code_block_87.out2)
code_block_88 = CodeBlock(angle=getParameterValueByName_25) { 360-angle[0]; }
rotate_2 = Vector.Rotate(vector=orientation_2, axis=ZAxis_4, degrees=code_block_88)

# group: Processing
# note: True North Vector
YAxis_2 = Vector.YAxis()
ZAxis_5 = Vector.ZAxis()
angleAboutAxis_2 = Vector.AngleAboutAxis(vector=rotate_2, otherVector=YAxis_2, rotationAxis=ZAxis_5)
# note: Collect insert orientations
code_block_89 = CodeBlock(vectors=angleAboutAxis_2) { DSCore.Math.Round(vectors); }

# group: Processing
# note: groupt insert instances by
# 1. orientation
groupByKey_6 = List.GroupByKey(list=filterByBoolMask_41.in, keys=code_block_89)
type_14 = archilab.Revit.Elements.Elements.Type(element=groupByKey_6.groups)
# note: groupt insert instances by
# 1. orientation
# 2. type
groupByKey_7 = List.GroupByKey(list=groupByKey_6.groups@@L2, keys=type_14@L2)
firstItem_2 = List.FirstItem(list=groupByKey_7.groups@@L2)
familyName = Orchid.RevitProject.Elements.Element.FamilyName(element=firstItem_2)
type_15 = archilab.Revit.Elements.Elements.Type(element=firstItem_2)
name_6 = Element.Name(element=type_15)
# note: Description Output
code_block_90 = CodeBlock(familyName=familyName, typeName=name_6) { description=familyName+" // "+typeName; }

# group: Processing
# note: Quantity Output
count_4 = List.Count(list=groupByKey_7.groups@@L2)

# group: Filtering
# note: Get inserts from all roofs
elementInserts = Custom[ElementInserts](element=code_block_36)  # Collects all interted elements (doors, windows) from a host. From Clockworks
flatten_16 = List.Flatten(list=elementInserts)
code_block_91 = CodeBlock { "Comments"; "not in PHPP"; true; }
getParameterValueByName_26 = Element.GetParameterValueByName(element=flatten_16, parameterName=code_block_91.out0)
contains_9 = String.Contains(str=getParameterValueByName_26, searchFor=code_block_91.out1, ignoreCase=code_block_91.out2)
filterByBoolMask_43 = List.FilterByBoolMask(list=flatten_16, mask=contains_9)

# group: Filtering
getCategory_2 = Element.GetCategory(element=filterByBoolMask_43.out)
# note: Filter only Windows
string_from_object_2 = FromObject(obj=getCategory_2)
code_block_92 = CodeBlock(cat=string_from_object_2) { cat=="Windows"; }
filterByBoolMask_44 = List.FilterByBoolMask(list=filterByBoolMask_43.out, mask=code_block_92)
get_host_element = Custom[Get Host Element](hostedElement=filterByBoolMask_44.in)  # package archi-lab.net; This node will retrieve a host element from hosted element. Ex. feed in door, get wall.

# group: Control
# note: Group surface by:
# 1.roof type
groupByKey_8 = List.GroupByKey(list=code_block_40, keys=code_block_41.out1)

# group: Processing
perimeterCurves = Surface.PerimeterCurves(surface=groupByKey_8.groups)
group_curves = Custom[Group Curves](curves=perimeterCurves@@L2)  # package archi-lab.net; This node will take any input of flat list of curves and group them into sublists containing "joinable" curves that is continous curves. They might form closed curves or open curves. Use PolyCurve.ByJoinedCurves to convert output groups of curves into single PolyCurves
# note: Get perimeter curves and group them to remove insert openings
byJoinedCurves = PolyCurve.ByJoinedCurves(curves=group_curves)
length = Curve.Length()  # unwired: curve
sortByFunction = List.SortByFunction(list=byJoinedCurves@@L2, func=length)
# note: List of filtered top surfaces. Grouped by:
# 1. roof type
lastItem_3 = List.LastItem(list=sortByFunction@@L2)
byPatch = Surface.ByPatch(closedCurve=lastItem_3)
code_block_93 = CodeBlock { 0.5; }
normalAtParameter = Surface.NormalAtParameter(surface=byPatch, u=code_block_93, v=code_block_93)

# group: Processing
# note: Vector for deviation from North
asPoint = Vector.AsPoint(vector=normalAtParameter)
X = Point.X(point=asPoint)
Y = Point.Y(point=asPoint)
code_block_94 = CodeBlock { 0; }
byCoordinates = Vector.ByCoordinates(x=X, y=Y, z=code_block_94)
YAxis_3 = Vector.YAxis()
ZAxis_6 = Vector.ZAxis()

# group: Control
ZAxis_7 = Vector.ZAxis()
code_block_95 = CodeBlock { carPBS=Revit.Category.ByName("Site - Project Base Point"); ElementQueries.OfCategory(catPBS); "Angle to True North"; }  # unwired: catPBS
# note: rotate wall normals so they are relarive to True North
all_elements_of_category_3 = ElementsOfCategory(Category=code_block_95.carPBS)
getParameterValueByName_27 = Element.GetParameterValueByName(element=all_elements_of_category_3, parameterName=code_block_95.out2)
code_block_96 = CodeBlock(angle=getParameterValueByName_27) { 360-angle[0]; }
rotate_3 = Vector.Rotate(vector=byCoordinates, axis=ZAxis_7, degrees=code_block_96)

# group: Processing
angleAboutAxis_3 = Vector.AngleAboutAxis(vector=rotate_3, otherVector=YAxis_3, rotationAxis=ZAxis_7)
code_block_97 = CodeBlock(vectors=angleAboutAxis_3) { roundAngle=DSCore.Math.Round(vectors); roundAngle==360; 0; }
# note: Deviation from North (clockwise).
if_17 = If(test=code_block_97.out1, true=code_block_97.out2, false=code_block_97.roundAngle)

# group: Processing
string_from_object_3 = FromObject(obj=if_17)
code_block_98 = CodeBlock { "."; }
split = String.Split(str=string_from_object_3, separator0=code_block_98)
firstItem_3 = List.FirstItem(list=split@@L2)

# group: Control
# note: Group surface by:
# 1.roof type
# 2.dev from North
groupByKey_9 = List.GroupByKey(list=byPatch@@L2, keys=firstItem_3@L2)

# group: Processing
code_block_99 = CodeBlock { 0.5; }
normalAtParameter_2 = Surface.NormalAtParameter(surface=groupByKey_9.groups, u=code_block_99, v=code_block_99)
# note: Vector for deviation from North
asPoint_2 = Vector.AsPoint(vector=normalAtParameter_2)
X_2 = Point.X(point=asPoint_2)
Y_2 = Point.Y(point=asPoint_2)
code_block_100 = CodeBlock { 0; }
byCoordinates_2 = Vector.ByCoordinates(x=X_2, y=Y_2, z=code_block_100)
ZAxis_8 = Vector.ZAxis()

# group: Processing
angleAboutAxis_4 = Vector.AngleAboutAxis(vector=normalAtParameter_2@L2, otherVector=byCoordinates_2@@L2, rotationAxis=ZAxis_8)
code_block_101 = CodeBlock(vectors=angleAboutAxis_4) { roundAngle=DSCore.Math.Round(vectors); roundAngle<=180; 90-roundAngle; roundAngle-270; }
# note: Angle of inclination from the horizontal
if_18 = If(test=code_block_101.out1, true=code_block_101.out2, false=code_block_101.out3)
code_block_102 = CodeBlock(angle=if_18) { angle==90; 0; }
if_19 = If(test=code_block_102.out0, true=code_block_102.out1, false=if_18)

# group: Control
# note: Group surface by:
# 1.roof type
# 2.dev from North
# 3.angle from horizontal
groupByKey_10 = List.GroupByKey(list=groupByKey_9.groups@@L2, keys=if_19@L2)

# group: Control
# note: Group roof type names by:
# 1.roof type
groupByKey_11 = List.GroupByKey(list=code_block_41.out1, keys=code_block_41.out1)

# group: Control
# note: Group description by:
# 1.roof type
# 2.dev from North
code_block_103 = CodeBlock(typeName=groupByKey_11.groups, devNorth=firstItem_3) { typeName+"//"+devNorth; }
groupByKey_12 = List.GroupByKey(list=code_block_103@@L2, keys=firstItem_3@L2)

# group: Control
# note: Group description by:
# 1.roof type
# 2.dev from North
# 3. angle from horiz
code_block_104 = CodeBlock(descr=groupByKey_12.groups, angleHoriz=if_19) { descr+"//"+angleHoriz; ".000000"; ""; }
groupByKey_13 = List.GroupByKey(list=code_block_104.out0@@L2, keys=if_19@L2)
replace_2 = String.Replace(str=groupByKey_13.groups, searchFor=code_block_104.out1, replaceWith=code_block_104.out2)
# note: Description output
firstItem_4 = List.FirstItem(list=replace_2@@L2)

# group: Processing
code_block_105 = CodeBlock { -1000; false; }
thicken = Surface.Thicken(surface=groupByKey_10.groups, thickness=code_block_105.out0, both_sides=code_block_105.out1)
code_block_106 = CodeBlock { 2; }
flatten_17 = List.Flatten(list=thicken, amt=code_block_106)
boundingBox = Geometry.BoundingBox(geometry=flatten_17)
getLocation = Element.GetLocation(element=filterByBoolMask_44.in)
contains_10 = BoundingBox.Contains(boundingBox=boundingBox, point=getLocation, lacing=CrossProduct)
anyTrue_5 = Orchid.Common.List.AnyTrue(list=contains_10)
# note: Group inserts by their host surface
filterByBoolMask_45 = List.FilterByBoolMask(list=filterByBoolMask_44.in, mask=anyTrue_5@@L2)
# note: host descrition flatten to match insert structure
flatten_18 = List.Flatten(list=replace_2, amt=code_block_106)
firstItem_5 = List.FirstItem(list=flatten_18@@L2)

# group: Processing
isEmpty = List.IsEmpty(list=filterByBoolMask_45.in@L2)
filterByBoolMask_46 = List.FilterByBoolMask(list=filterByBoolMask_45.in, mask=isEmpty)
code_block_107 = CodeBlock(e=filterByBoolMask_46.out) { elType=e.Type; }
groupByKey_14 = List.GroupByKey(list=filterByBoolMask_46.out@L2, keys=code_block_107@@L2)
family = FamilyType.Family(familyType=groupByKey_14.unique_keys)
# note: Description
code_block_108 = CodeBlock(t=groupByKey_14.unique_keys, f=family) { typeName=t.Name; famName=f.Name; famName+" : "+typeName; }
isEmpty_2 = List.IsEmpty(list=filterByBoolMask_45.in@L2)
filterByBoolMask_47 = List.FilterByBoolMask(list=firstItem_5, mask=isEmpty_2)
count_5 = List.Count(list=groupByKey_14.unique_keys@L2)
# note: Get dev from North & angle from horizontal from here
ofRepeatedItem_2 = List.OfRepeatedItem(item=filterByBoolMask_47.out@@L1, amount=count_5@L1)
code_block_109 = CodeBlock(partDescription=code_block_108.out2, partHost=ofRepeatedItem_2) { DSCore.List.Flatten(partDescription); DSCore.List.Flatten(partHost); "//"; 1; 2; }
split_2 = String.Split(str=code_block_109.out1, separator0=code_block_109.out2)
getItemAtIndex = List.GetItemAtIndex(list=split_2@L2, index=code_block_109.out3)
getItemAtIndex_2 = List.GetItemAtIndex(list=split_2@L2, index=code_block_109.out4)
# note: Quantity
count_6 = List.Count(list=groupByKey_14.groups@@L2)
code_block_110 = CodeBlock { "Width"; "Height"; }
getParameterValueByName_28 = Element.GetParameterValueByName(element=groupByKey_14.unique_keys, parameterName=code_block_110.out0)
getParameterValueByName_29 = Element.GetParameterValueByName(element=groupByKey_14.unique_keys, parameterName=code_block_110.out1)
code_block_111 = CodeBlock(width=getParameterValueByName_28, height=getParameterValueByName_29) { width/1000; height/1000; }
code_block_112 = CodeBlock(pDescriotion=code_block_109.out0, dev=getItemAtIndex, angle=getItemAtIndex_2, quantity=count_6, width=code_block_111.out0, height=code_block_111.out1, host=ofRepeatedItem_2)
# ---------- code_block_112.designscript (5 lines) ----------
description=pDescriotion+"//"+dev+"//"+angle;
DSCore.List.Flatten(quantity);
DSCore.List.Flatten(width);
DSCore.List.Flatten(height);
DSCore.List.Flatten(host);
# ----------------------------------------

# group: Processing
code_block_113 = CodeBlock { "Width"; "Height"; }
getParameterValueByName_30 = Element.GetParameterValueByName(element=type_15, parameterName=code_block_113.out0)
getParameterValueByName_31 = Element.GetParameterValueByName(element=type_15, parameterName=code_block_113.out1)
# note: Width & Height Output
code_block_114 = CodeBlock(w=getParameterValueByName_30, h=getParameterValueByName_31) { w/1000; h/1000; }

# group: Processing
code_block_115 = CodeBlock { "Department"; }
getParameterValueByName_32 = Element.GetParameterValueByName(element=filterByBoolMask.out, parameterName=code_block_115)
eq_13 = getParameterValueByName_32 == code_block_12.technicalDeps  # lacing=CrossProduct
anyTrue_6 = Orchid.Common.List.AnyTrue(list=eq_13)
# note: Technical rooms
filterByBoolMask_48 = List.FilterByBoolMask(list=filterByBoolMask.out, mask=anyTrue_6)
# note: Non-technical rooms
code_block_116 = CodeBlock { "Unbounded Height"; "Area"; }
getParameterValueByName_33 = Element.GetParameterValueByName(element=filterByBoolMask_48.out, parameterName=code_block_116.out1)
getParameterValueByName_34 = Element.GetParameterValueByName(element=filterByBoolMask_48.out, parameterName=code_block_116.out0)
code_block_117 = CodeBlock(height=getParameterValueByName_34) { height<1000; 0; }
if_20 = If(test=code_block_117.out0, true=code_block_117.out1, false=getParameterValueByName_34)
code_block_118 = CodeBlock(height=if_20) { height>=2000; 1; 0.5; }
# note: Generate multipliers for the area
if_21 = If(test=code_block_118.out0, true=code_block_118.out1, false=code_block_118.out2)
code_block_119 = CodeBlock(area=getParameterValueByName_33, coef=if_21) { result=area*coef; result==null; 0; }
if_22 = If(test=code_block_119.out1, true=code_block_119.out2, false=code_block_119.result)
# note: Calculated areas for non-technical rooms
code_block_120 = CodeBlock(areas=if_22) { sum=DSCore.Math.Sum(areas); 2; "Non-techical spaces (calculated area)"; }
code_block_121 = CodeBlock { "Area"; }
getParameterValueByName_35 = Element.GetParameterValueByName(element=filterByBoolMask_48.in, parameterName=code_block_121)
code_block_122 = CodeBlock(value=getParameterValueByName_35) { value==""; 0; value; }
if_23 = If(test=code_block_122.out0, true=code_block_122.out1, false=code_block_122.value)
code_block_123 = CodeBlock(area=if_23) { devFromNorth=1; AngleFronHorz=2; areas=area*0.6; sum=DSCore.Math.Sum(areas); 2; "Technical spaces (calculated area)"; }
list_create_18 = List.Create(item0=code_block_120.out2, item1=code_block_123.out5)
code_block_124 = CodeBlock(departments=list_create_18) { DSCore.List.Flatten(departments); }
code_block_125 = CodeBlock { [1,1]; ["",""]; }
round = Math.Round(number=code_block_120.sum, digits=code_block_120.out1)
# note: Calculated areas for technical rooms
round_2 = Math.Round(number=code_block_123.sum, digits=code_block_123.devFromNorth)
list_create_19 = List.Create(item0=round, item1=round_2)
code_block_126 = CodeBlock(areas=list_create_19) { DSCore.List.Flatten(areas); }

code_block_127 = CodeBlock(allFloors=flatten) { allFloors; }

# group: Filter external floors
type_16 = archilab.Revit.Elements.Elements.Type(element=code_block_127)
code_block_128 = CodeBlock { "Function"; }
getParameterValueByName_36 = Element.GetParameterValueByName(element=type_16, parameterName=code_block_128)
code_block_129 = CodeBlock(func=getParameterValueByName_36) { func==1; }
filterByBoolMask_49 = List.FilterByBoolMask(list=code_block_127, mask=code_block_129)

# group: Processing
type_17 = archilab.Revit.Elements.Elements.Type(element=filterByBoolMask_49.in)
groupByKey_15 = List.GroupByKey(list=filterByBoolMask_49.in, keys=type_17)
name_7 = Element.Name(element=groupByKey_15.unique_keys)
code_block_130 = CodeBlock(roofs=groupByKey_15.unique_keys) { DSCore.List.Count(roofs); "11"; "0"; "180"; }
ofRepeatedItem_3 = List.OfRepeatedItem(item=code_block_130.out1, amount=code_block_130.out0)
code_block_131 = CodeBlock { "Area"; }
getParameterValueByName_37 = Element.GetParameterValueByName(element=groupByKey_15.groups, parameterName=code_block_131)
sum_2 = Math.Sum(values=getParameterValueByName_37@@L2)
ofRepeatedItem_4 = List.OfRepeatedItem(item=code_block_130.out2, amount=code_block_130.out0)
ofRepeatedItem_5 = List.OfRepeatedItem(item=code_block_130.out3, amount=code_block_130.out0)
count_7 = List.Count(list=groupByKey_15.groups@L2)

code_block_132 = CodeBlock(floors=name_7) { DSCore.List.Flatten(floors); }

# group: Processing
area_2 = Surface.Area(surface=groupByKey_10.groups)
# note: Area output
sum_3 = Math.Sum(values=area_2@@L4)
code_block_133 = CodeBlock(area=sum_3) { area/1000000; }

# group: Processing
code_block_134 = CodeBlock { "//"; devFromNorth=1; AngleFromHorz=2; roofType=0; }
split_3 = String.Split(str=firstItem_4, separator0=code_block_134.out0)
getItemAtIndex_3 = List.GetItemAtIndex(list=split_3@@L2, index=code_block_134.devFromNorth)
getItemAtIndex_4 = List.GetItemAtIndex(list=split_3@@L2, index=code_block_134.AngleFromHorz)
getItemAtIndex_5 = List.GetItemAtIndex(list=split_3@@L2, index=code_block_134.roofType)
code_block_135 = CodeBlock(description=firstItem_4, devNorth=getItemAtIndex_3, AngleHorz=getItemAtIndex_4, area=code_block_133, partDescription=getItemAtIndex_5)
# ---------- code_block_135.designscript (8 lines) ----------
des=DSCore.List.Flatten(description);
DSCore.List.Flatten(devNorth);
DSCore.List.Flatten(AngleHorz);
count=DSCore.List.Count(des);
quantity=DSCore.List.OfRepeatedItem("1",count);
groupNo=DSCore.List.OfRepeatedItem("10",count);
DSCore.List.Flatten(area);
partDescription;
# ----------------------------------------

# group: Assing
code_block_136 = CodeBlock { true; "Areas(Roofs)"; }
code_block_137 = CodeBlock { "Angle from horizontal"; "U2"; }
bb_data_10 = Custom[BB Data](sheetName=code_block_136.out1, origin=code_block_137.out1, data=code_block_135.out2)
code_block_138 = CodeBlock { "Quantity"; "E2"; }
bb_data_11 = Custom[BB Data](sheetName=code_block_136.out1, origin=code_block_138.out1, data=code_block_135.quantity)
code_block_139 = CodeBlock { "To groun no."; "C2"; }
bb_data_12 = Custom[BB Data](sheetName=code_block_136.out1, origin=code_block_139.out1, data=code_block_135.groupNo)
code_block_140 = CodeBlock { "Area"; "K2"; }
bb_data_13 = Custom[BB Data](sheetName=code_block_136.out1, origin=code_block_140.out1, data=code_block_135.out6)
code_block_141 = CodeBlock { "Deviation from North"; "T2"; }
bb_data_14 = Custom[BB Data](sheetName=code_block_136.out1, origin=code_block_141.out1, data=code_block_135.out1)
code_block_142 = CodeBlock { "Building assembly description"; "B2"; }
bb_data_15 = Custom[BB Data](sheetName=code_block_136.out1, origin=code_block_142.out1, data=code_block_135.des)
list_create_20 = List.Create(item0=bb_data_10, item1=bb_data_11, item2=bb_data_12, item3=bb_data_13, item4=bb_data_14, item5=bb_data_15)
write_excel_3 = Custom[Write Excel](filePath=await_, runIt=code_block_136.out0, byColumn=code_block_136.out0, BBData=list_create_20)

# group: Visualisation
# note: Hide / isolate elements in dedicated views
code_block_143 = CodeBlock(excelSheetName=code_block_136.out1) { "PHPP-ZZ-"+excelSheetName+"-IN"; "PHPP-ZZ-"+excelSheetName+"-OUT"; }
byName_3 = Orchid.RevitProject.Views.View.ByName(name=code_block_143.out0)
isolate_in_view_2 = Custom[Isolate in View](element=filterByBoolMask_25.out, view=byName_3)
byName_4 = Orchid.RevitProject.Views.View.ByName(name=code_block_143.out1)
hide_in_view_2 = Python(IN[0]=filterByBoolMask_25.out, IN[1]=byName_4)  # same code as hide_in_view
code_block_144 = CodeBlock(element=hide_in_view_2) { _element; }

code_block_145 = CodeBlock(walls=replace) { DSCore.List.Flatten(walls); }
code_block_146 = CodeBlock(groupNo=ofRepeatedItem_3) { DSCore.List.Flatten(groupNo); }
code_block_147 = CodeBlock(area=sum_2) { DSCore.List.Flatten(area); }

# group: Processing
name_8 = Element.Name(element=filterByBoolMask_28.in)
name_9 = Element.Name(element=uniqueItems_3)
name_10 = Element.Name(element=clear_list_6)
list_create_21 = List.Create(item0=name_8, item1=name_9, item2=name_10)
list_create_22 = List.Create(item0=code_block_50, item1=code_block_51, item2=code_block_49)
code_block_148 = CodeBlock(types=list_create_21, codes=list_create_22) { typeNames=DSCore.List.Flatten(types); udCodes=DSCore.List.Flatten(codes); fullcodes=udCodes+"-"+typeNames; }
byKeysValues = DesignScript.Builtin.Dictionary.ByKeysValues(keys=code_block_148.typeNames, values=code_block_148.fullcodes)

code_block_149 = CodeBlock(walls=name_5) { DSCore.List.Flatten(walls); }
code_block_150 = CodeBlock(devNorth=ofRepeatedItem_4) { DSCore.List.Flatten(devNorth); }
code_block_151 = CodeBlock(angleHoriz=ofRepeatedItem_5) { DSCore.List.Flatten(angleHoriz); }

# group: Processing
list_create_23 = List.Create(item0=code_block_124, item1=code_block_132, item2=code_block_135.des, item3=code_block_145)
# note: Building assembly description
# 1.TFA
# 2.Floors
# 3.Roofs
# 4.Walls
list_create_24 = List.Create(item0=code_block_125.out0, item1=code_block_146, item2=code_block_135.groupNo, item3=code_block_65)
# note: To group no.
# 1.TFA
# 2.Floors
# 3.Roofs
# 4.Walls
list_create_25 = List.Create(item0=code_block_126, item1=code_block_147, item2=code_block_135.out6, item3=code_block_67)
list_create_26 = List.Create(item0=code_block_125.out1, item1=code_block_132, item2=code_block_135.partDescription, item3=code_block_149)
# note: User deternimed area
# 1.TFA
# 2.Floors
# 3.Roofs
# 4.Walls
# note: Building system
# 1.TFA
# 2.Floors
# 3.Roofs
# 4.Walls
flatten_19 = List.Flatten(list=list_create_26)
valueAtKey = DesignScript.Builtin.Dictionary.ValueAtKey(dictionary=byKeysValues, key=flatten_19)
code_block_152 = CodeBlock(value=valueAtKey) { value==null; ""; }
if_24 = If(test=code_block_152.out0, true=code_block_152.out1, false=valueAtKey)
# note: Deviation from North
# 1.TFA
# 2.Floors
# 3.Roofs
# 4.Walls
list_create_27 = List.Create(item0=code_block_125.out1, item1=code_block_150, item2=code_block_135.out1, item3=code_block_68)
# note: Angle from Horizontal
# 1.TFA
# 2.Floors
# 3.Roofs
# 4.Walls
list_create_28 = List.Create(item0=code_block_125.out1, item1=code_block_151, item2=code_block_135.out2, item3=code_block_63)
code_block_153 = CodeBlock(assemblyDescription=list_create_23, toGroupNo=list_create_24, userDefinedAera=list_create_25, buildingSystem=if_24, devFromNorth=list_create_27, AngleFromHorizontal=list_create_28)
# ---------- code_block_153.designscript (13 lines) ----------
assemblies=DSCore.List.Flatten(assemblyDescription);
DSCore.List.Flatten(toGroupNo);
DSCore.List.Flatten(userDefinedAera);
DSCore.List.Flatten(buildingSystem);
DSCore.List.Flatten(devFromNorth);
DSCore.List.Flatten(AngleFromHorizontal);



count=DSCore.List.Count(assemblies);
quantity=DSCore.List.OfRepeatedItem(1,count);

1..count;
# ----------------------------------------

# group: Processing
code_block_154 = CodeBlock(areaNo=code_block_153.out8, assebblyDescription=code_block_153.assemblies) { areaNo+"-"+assebblyDescription; }
byKeysValues_2 = DesignScript.Builtin.Dictionary.ByKeysValues(keys=code_block_153.assemblies, values=code_block_154)

# group: Processing
type_18 = archilab.Revit.Elements.Elements.Type(element=filterByBoolMask_42.in)
name_11 = Element.Name(element=type_18)
code_block_155 = CodeBlock(name=name_11, devFromNotrh=code_block_89) { name+"//"+devFromNotrh; ".000000"; ""; }
# note: Collect "installed in" for each insert
replace_3 = String.Replace(str=code_block_155.out0, searchFor=code_block_155.out1, replaceWith=code_block_155.out2)

# group: Processing
# note: groupt hosts (names only) instances by
# 1. orientation
groupByKey_16 = List.GroupByKey(list=replace_3, keys=code_block_89)
# note: groupt host (names only) instances by
# 1. orientation
# 2. type
groupByKey_17 = List.GroupByKey(list=groupByKey_16.groups@@L2, keys=type_14@L2)
# note: Installed In Output
firstItem_6 = List.FirstItem(list=groupByKey_17.groups@@L2)
code_block_156 = CodeBlock(installedIn=firstItem_6) { DSCore.List.Flatten(installedIn); }
valueAtKey_2 = DesignScript.Builtin.Dictionary.ValueAtKey(dictionary=byKeysValues_2, key=code_block_156)
code_block_157 = CodeBlock(value=valueAtKey_2) { value==null; "Please check!"; }
if_25 = If(test=code_block_157.out0, true=code_block_157.out1, false=valueAtKey_2)

# group: Processing
# note: Collect "installed in" for each insert.
# "Areas" component
valueAtKey_3 = DesignScript.Builtin.Dictionary.ValueAtKey(dictionary=byKeysValues_2, key=code_block_112.out4)
code_block_158 = CodeBlock(value=valueAtKey_3) { value==null; "Please check!"; }
if_26 = If(test=code_block_158.out0, true=code_block_158.out1, false=valueAtKey_3)

# group: Processing
list_create_29 = List.Create(item0=count_4, item1=code_block_112.out1)
list_create_30 = List.Create(item0=code_block_90, item1=code_block_112.description)
list_create_31 = List.Create(item0=code_block_114.out0, item1=code_block_112.out2)
list_create_32 = List.Create(item0=code_block_114.out1, item1=code_block_112.out3)
list_create_33 = List.Create(item0=if_25, item1=if_26)
code_block_159 = CodeBlock(quantity=list_create_29, description=list_create_30, width=list_create_31, height=list_create_32, installedIn=list_create_33)
# ---------- code_block_159.designscript (5 lines) ----------
DSCore.List.Flatten(quantity);
DSCore.List.Flatten(description);
DSCore.List.Flatten(width);
DSCore.List.Flatten(height);
DSCore.List.Flatten(installedIn);
# ----------------------------------------

# group: Control
isNull_9 = Object.IsNull(obj=code_block_159.out1)
filterByBoolMask_50 = List.FilterByBoolMask(list=code_block_159.out0, mask=isNull_9)
filterByBoolMask_51 = List.FilterByBoolMask(list=code_block_159.out1, mask=isNull_9)
filterByBoolMask_52 = List.FilterByBoolMask(list=code_block_159.out2, mask=isNull_9)
filterByBoolMask_53 = List.FilterByBoolMask(list=code_block_159.out3, mask=isNull_9)
filterByBoolMask_54 = List.FilterByBoolMask(list=code_block_159.out4, mask=isNull_9)

# group: Assing
code_block_160 = CodeBlock()
# ---------- code_block_160.designscript (17 lines) ----------
true;
"Windows(Inserts)";

"Quantity";
"A2";

"Description";
"B2";

"Width";
"F2";

"Height";
"G2";

"Insatlled In / From Areas worksheet";
"H2";
# ----------------------------------------
bb_data_16 = Custom[BB Data](sheetName=code_block_160.out1, origin=code_block_160.out3, data=filterByBoolMask_50.out)
bb_data_17 = Custom[BB Data](sheetName=code_block_160.out1, origin=code_block_160.out5, data=filterByBoolMask_51.out)
bb_data_18 = Custom[BB Data](sheetName=code_block_160.out1, origin=code_block_160.out7, data=filterByBoolMask_52.out)
bb_data_19 = Custom[BB Data](sheetName=code_block_160.out1, origin=code_block_160.out9, data=filterByBoolMask_53.out)
bb_data_20 = Custom[BB Data](sheetName=code_block_160.out1, origin=code_block_160.out11, data=filterByBoolMask_54.out)
list_create_34 = List.Create(item0=bb_data_16, item1=bb_data_17, item2=bb_data_18, item3=bb_data_19, item4=bb_data_20)
write_excel_4 = Custom[Write Excel](filePath=await_, runIt=code_block_160.out0, byColumn=code_block_160.out0, BBData=list_create_34)

# group: Processing
watch_2 = Watch(filterByBoolMask_19.in)
# note: Basic walls
boundingBox_2 = Element.BoundingBox(element=clear_list_4)
# note: Curtain walls
getLocation_2 = Element.GetLocation(element=watch_2)
code_block_161 = CodeBlock { 100; }
translate_2 = Geometry.Translate(geometry=getLocation_2, zTranslation=code_block_161)
startPoint = Curve.StartPoint(curve=translate_2)
# note: Check if Curtain wall's lication line is fully inside a Basic wall's boundingbox
contains_11 = BoundingBox.Contains(boundingBox=boundingBox_2, point=startPoint, lacing=CrossProduct)
anyTrue_7 = Orchid.Common.List.AnyTrue(list=contains_11)
endPoint = Curve.EndPoint(curve=translate_2)
contains_12 = BoundingBox.Contains(boundingBox=boundingBox_2, point=endPoint, lacing=CrossProduct)
anyTrue_8 = Orchid.Common.List.AnyTrue(list=contains_12)
list_create_35 = List.Create(item0=anyTrue_7, item1=anyTrue_8)
transpose = List.Transpose(lists=list_create_35)
allTrue = Orchid.Common.List.AllTrue(list=transpose)
# note: Basic walls whick host the curtain walls (IN)
filterByBoolMask_55 = List.FilterByBoolMask(list=clear_list_4, mask=allTrue)
boundingBox_3 = Element.BoundingBox(element=filterByBoolMask_55.in)
code_block_162 = CodeBlock { [0,1]; }
pointAtParameter = Curve.PointAtParameter(curve=translate_2@L1, param=code_block_162)
contains_13 = BoundingBox.Contains(boundingBox=boundingBox_3@@L1, point=pointAtParameter, lacing=CrossProduct)
allTrue_2 = List.AllTrue(list=contains_13@@L2)
code_block_163 = CodeBlock { true; }
allIndicesOf = List.AllIndicesOf(list=allTrue_2@@L2, item=code_block_163)
# note: Embedded curtain walls grouped by their host
getItemAtIndex_6 = List.GetItemAtIndex(list=watch_2, index=allIndicesOf)

# group: Control
isEmpty_3 = List.IsEmpty(list=getItemAtIndex_6@@L2)
# note: cleared basic walls
filterByBoolMask_56 = List.FilterByBoolMask(list=getItemAtIndex_6, mask=isEmpty_3)
# note: cleared curtain walls
filterByBoolMask_57 = List.FilterByBoolMask(list=filterByBoolMask_55.in, mask=isEmpty_3)

# group: Processing
type_19 = archilab.Revit.Elements.Elements.Type(element=filterByBoolMask_56.out)
name_12 = Element.Name(element=type_19)
# note: Description Output
flatten_20 = List.Flatten(list=name_12)

# group: Processing
code_block_164 = CodeBlock { 1; }
count_8 = List.Count(list=flatten_20)
# note: Quantity Output
ofRepeatedItem_6 = List.OfRepeatedItem(item=code_block_164, amount=count_8)

# group: Processing
code_block_165 = CodeBlock { "Length"; "Unconnected Height"; }
getParameterValueByName_38 = Element.GetParameterValueByName(element=filterByBoolMask_56.out, parameterName=code_block_165.out0)
getParameterValueByName_39 = Element.GetParameterValueByName(element=filterByBoolMask_56.out, parameterName=code_block_165.out1)
code_block_166 = CodeBlock(lngth=getParameterValueByName_38, hgth=getParameterValueByName_39) { lngth/1000; hgth/1000; 2; }
round_3 = Math.Round(number=code_block_166.out0, digits=code_block_166.out2)
# note: Collect width & height
flatten_21 = List.Flatten(list=round_3)
round_4 = Math.Round(number=code_block_166.out1, digits=code_block_166.out2)
flatten_22 = List.Flatten(list=round_4)

# group: Control
orientation_3 = Orchid.RevitProject.Elements.Wall.Orientation(wall=filterByBoolMask_56.out)
ZAxis_9 = Vector.ZAxis()
code_block_167 = CodeBlock { carPBS=Revit.Category.ByName("Site - Project Base Point"); ElementQueries.OfCategory(catPBS); "Angle to True North"; }  # unwired: catPBS
all_elements_of_category_4 = ElementsOfCategory(Category=code_block_167.carPBS)
# note: rotate wall normals so they are relarive to True North
getParameterValueByName_40 = Element.GetParameterValueByName(element=all_elements_of_category_4, parameterName=code_block_167.out2)
code_block_168 = CodeBlock(angle=getParameterValueByName_40) { 360-angle[0]; }
rotate_4 = Vector.Rotate(vector=orientation_3, axis=ZAxis_9, degrees=code_block_168)

# group: Processing
# note: True North Vector
YAxis_4 = Vector.YAxis()
ZAxis_10 = Vector.ZAxis()
angleAboutAxis_5 = Vector.AngleAboutAxis(vector=rotate_4, otherVector=YAxis_4, rotationAxis=ZAxis_10)
# note: Collect orientations for all embedded curtain walls
code_block_169 = CodeBlock(vectors=angleAboutAxis_5) { orient=DSCore.Math.Round(vectors); DSCore.List.Flatten(orient); }

# group: Processing
count_9 = List.Count(list=filterByBoolMask_56.out@@L2)
ofRepeatedItem_7 = List.OfRepeatedItem(item=filterByBoolMask_57.out@L1, amount=count_9@@L2)
type_20 = archilab.Revit.Elements.Elements.Type(element=ofRepeatedItem_7)
name_13 = Element.Name(element=type_20)
code_block_170 = CodeBlock(hostTypes=name_13, devFromNotrh=code_block_169.out1) { name=DSCore.List.Flatten(hostTypes); name+"//"+devFromNotrh; ".000000"; ""; }
# note: Collect "installed in" for each curtain wall
replace_4 = String.Replace(str=code_block_170.out1, searchFor=code_block_170.out2, replaceWith=code_block_170.out3)

# group: Processing
code_block_171 = CodeBlock(installedIn=replace_4) { DSCore.List.Flatten(installedIn); }
valueAtKey_4 = DesignScript.Builtin.Dictionary.ValueAtKey(dictionary=byKeysValues_2, key=code_block_171)
code_block_172 = CodeBlock(value=valueAtKey_4) { value==null; "Please check!"; }
if_27 = If(test=code_block_172.out0, true=code_block_172.out1, false=valueAtKey_4)

# group: Assing
code_block_173 = CodeBlock { true; "Windows(CurtainWalls)"; }
code_block_174 = CodeBlock { "A2"; }
bb_data_21 = Custom[BB Data](sheetName=code_block_173.out1, origin=code_block_174, data=ofRepeatedItem_6)
code_block_175 = CodeBlock { "B2"; }
bb_data_22 = Custom[BB Data](sheetName=code_block_173.out1, origin=code_block_175, data=flatten_20)
code_block_176 = CodeBlock { "F2"; }
bb_data_23 = Custom[BB Data](sheetName=code_block_173.out1, origin=code_block_176, data=flatten_21)
code_block_177 = CodeBlock { "G2"; }
bb_data_24 = Custom[BB Data](sheetName=code_block_173.out1, origin=code_block_177, data=flatten_22)
code_block_178 = CodeBlock { "H2"; }
bb_data_25 = Custom[BB Data](sheetName=code_block_173.out1, origin=code_block_178, data=if_27)
list_create_36 = List.Create(item0=bb_data_21, item1=bb_data_22, item2=bb_data_23, item3=bb_data_24, item4=bb_data_25)
write_excel_5 = Custom[Write Excel](filePath=await_, runIt=code_block_173.out0, byColumn=code_block_173.out0, BBData=list_create_36)

# group: Processing
code_block_179 = CodeBlock { "Inset"; }
# note: collect Inset values
getParameterValueByName_41 = Element.GetParameterValueByName(element=type_15, parameterName=code_block_179)
code_block_180 = CodeBlock(inset=getParameterValueByName_41) { insetMM=DSCore.Math.Round(inset); insetM=insetMM/1000; insetM==null; "No inset value"; }
if_28 = If(test=code_block_180.out2, true=code_block_180.out3, false=code_block_180.insetM)

flatten_23 = List.Flatten(list=count_4)

# group: Processing
code_block_181 = CodeBlock(walls=filterByBoolMask_57.out) { walls; }
getLocation_3 = Element.GetLocation(element=code_block_181)
exteriorDirection = Custom[Wall.ExteriorDirection](wall=code_block_181)  # package archi-lab.net; This node returns exterior direction of the wall as a vector.
elementTypes = Custom[ElementTypes+](element=code_block_181)  # Gets types from linked elements too. From Clockworks
# note: Archilab
get_compoundstructurelayers_4 = Custom[Get CompoundStructureLayers](ElementOrFamilyType=elementTypes)
code_block_182 = CodeBlock(wallcurves=getLocation_3, direction=exteriorDirection, walltypes=elementTypes, Widths=get_compoundstructurelayers_4.Thickness, cores=get_compoundstructurelayers_4.IsCoreLayer)
# ---------- code_block_182.designscript (8 lines) ----------
[wallcurves,direction,walltypes,Widths,cores];
/* get the distance from wall location (centerline) to the
exterior face of wall*/
distance =
	walltypes.GetParameterValueByName("Width")/2;
//get the curves at the exterior face
ExtFaceCurves =
	wallcurves.Translate(direction,distance);
# ----------------------------------------
# note: Collect exterior lines of Basic Walls
code_block_183 = CodeBlock(ExteriorOfWall=code_block_182.ExtFaceCurves) { ExteriorOfWall; }

# group: Processing
byElement = CurtainPanel.ByElement(hostingElement=filterByBoolMask_56.out)
firstItem_7 = List.FirstItem(list=byElement@@L2)
geometry = Element.Geometry(element=firstItem_7)
bySolid = PolySurface.BySolid(solid=geometry)
surfaces = PolySurface.Surfaces(polySurface=bySolid)
acg_surface_filterbyorientation = Custom[ACG Surface.FilterByOrientation](surfaces=surfaces)  # from Clockwork for Dynamo 2.x
flatten_24 = List.Flatten()  # unwired: list
# note: Collect the footprint curves of the first panel of each curtain wall
map_4 = List.Map(list=acg_surface_filterbyorientation.horizontalDown, f_x=flatten_24)
perimeterCurves_2 = Surface.PerimeterCurves(surface=map_4)

# group: Processing
# note: Align the footprint of the curtain panels to the plan of the basic wall's locations line
XY = Plane.XY()
startPoint_2 = Curve.StartPoint(curve=getLocation_3)
Z = Point.Z(point=startPoint_2)
translate_3 = Geometry.Translate(geometry=XY, zTranslation=Z)
pullOntoPlane = Curve.PullOntoPlane(curve=perimeterCurves_2, plane=translate_3)

# group: Processing
distanceTo = Geometry.DistanceTo(geometry=code_block_183, other=pullOntoPlane)
sort = List.Sort(list=distanceTo)
firstItem_8 = List.FirstItem(list=sort@@L2)
code_block_184 = CodeBlock(inset=firstItem_8) { insetMM=DSCore.Math.Round(inset); insetM=insetMM/1000; }

# group: Assing
code_block_185 = CodeBlock()
# ---------- code_block_185.designscript (12 lines) ----------
true;
"Shading(Inserts)";
"Shading(CurtainWalls)";

//Reveal depth;
"K2";

//Quantity;
"A2";

//description
"B2";
# ----------------------------------------
flatten_25 = List.Flatten(list=if_28)
bb_data_26 = Custom[BB Data](sheetName=code_block_185.out1, origin=code_block_185.out3, data=flatten_25)
bb_data_27 = Custom[BB Data](sheetName=code_block_185.out1, origin=code_block_185.out4, data=flatten_23)
flatten_26 = List.Flatten(list=code_block_90)
bb_data_28 = Custom[BB Data](sheetName=code_block_185.out1, origin=code_block_185.out5, data=flatten_26)
bb_data_29 = Custom[BB Data](sheetName=code_block_185.out2, origin=code_block_185.out3, data=code_block_184.insetM)
bb_data_30 = Custom[BB Data](sheetName=code_block_185.out2, origin=code_block_185.out4, data=ofRepeatedItem_6)
bb_data_31 = Custom[BB Data](sheetName=code_block_185.out2, origin=code_block_185.out5, data=flatten_20)
list_create_37 = List.Create(item0=bb_data_26, item1=bb_data_27, item2=bb_data_28, item3=bb_data_29, item4=bb_data_30, item5=bb_data_31)
write_excel_6 = Custom[Write Excel](filePath=await_, runIt=code_block_185.out0, byColumn=code_block_185.out0, BBData=list_create_37)

# group: Assing
code_block_186 = CodeBlock { true; "Areas(Floors)"; }
code_block_187 = CodeBlock { "Angle from horizontal"; "U2"; }
bb_data_32 = Custom[BB Data](sheetName=code_block_186.out1, origin=code_block_187.out1, data=code_block_151)
code_block_188 = CodeBlock { "Quantity"; "E2"; }
bb_data_33 = Custom[BB Data](sheetName=code_block_186.out1, origin=code_block_188.out1, data=count_7)
code_block_189 = CodeBlock { "To groun no."; "C2"; }
bb_data_34 = Custom[BB Data](sheetName=code_block_186.out1, origin=code_block_189.out1, data=code_block_146)
code_block_190 = CodeBlock { "Area"; "K2"; }
bb_data_35 = Custom[BB Data](sheetName=code_block_186.out1, origin=code_block_190.out1, data=code_block_147)
code_block_191 = CodeBlock { "Deviation from North"; "T2"; }
bb_data_36 = Custom[BB Data](sheetName=code_block_186.out1, origin=code_block_191.out1, data=code_block_150)
code_block_192 = CodeBlock { "Building assembly description"; "B2"; }
bb_data_37 = Custom[BB Data](sheetName=code_block_186.out1, origin=code_block_192.out1, data=code_block_132)
list_create_38 = List.Create(item0=bb_data_32, item1=bb_data_33, item2=bb_data_34, item3=bb_data_35, item4=bb_data_36, item5=bb_data_37)
write_excel_7 = Custom[Write Excel](filePath=await_, runIt=code_block_186.out0, byColumn=code_block_186.out0, BBData=list_create_38)

# group: Processing
geometry_2 = Element.Geometry(element=filterByBoolMask_11.out)
bySolid_2 = PolySurface.BySolid(solid=geometry_2)
surfaces_2 = PolySurface.Surfaces(polySurface=bySolid_2)
acg_surface_filterbyorientation_2 = Custom[ACG Surface.FilterByOrientation](surfaces=surfaces_2)
perimeterCurves_3 = Surface.PerimeterCurves(surface=acg_surface_filterbyorientation_2.HorizontalUp)
XY_2 = Plane.XY()
pullOntoPlane_2 = Curve.PullOntoPlane(curve=perimeterCurves_3, plane=XY_2)
polycurve_bycurves = Custom[[&] PolyCurve.ByCurves](curves=pullOntoPlane_2)  # package Ampersand; Create polycurves from an unordered list of curves.
patch = Curve.Patch(curve=polycurve_bycurves)
code_block_193 = CodeBlock { 1000; }
thicken_2 = Surface.Thicken(surface=patch, thickness=code_block_193)
# note: Extract geometry from all Floors with function parameter and flatten to a single plane. Extract area value
code_block_194 = CodeBlock(x=thicken_2) { DSCore.List.Flatten(x,-1); }
byUnion = Solid.ByUnion(solids=code_block_194)
bySolid_3 = PolySurface.BySolid(solid=byUnion)
surfaces_3 = PolySurface.Surfaces(polySurface=bySolid_3)
acg_surface_filterbyorientation_3 = Custom[ACG Surface.FilterByOrientation](surfaces=surfaces_3)
area_3 = Surface.Area(surface=acg_surface_filterbyorientation_3.HorizontalUp)
sum_4 = Math.Sum(values=area_3)
round_5 = Math.Round(number=sum_4)

# group: Filtering
code_block_195 = CodeBlock { "Area Scheme Id"; }
getParameterValueByName_42 = Element.GetParameterValueByName(element=filterByBoolMask_8.out, parameterName=code_block_195)
code_block_196 = CodeBlock(e=getParameterValueByName_42, input=code_block_12.footprintAreaSchemeName) { areaName=e.Name; areaName==input; }
filterByBoolMask_58 = List.FilterByBoolMask(list=filterByBoolMask_8.out, mask=code_block_196.out1)

# group: Processing
boundaries = Area.Boundaries(area=filterByBoolMask_58.in)
XY_3 = Plane.XY()
pullOntoPlane_3 = Curve.PullOntoPlane(curve=boundaries, plane=XY_3)
polycurve_bycurves_2 = Custom[[&] PolyCurve.ByCurves](curves=pullOntoPlane_3)
patch_2 = Curve.Patch(curve=polycurve_bycurves_2)
code_block_197 = CodeBlock { 1000; }
thicken_3 = Surface.Thicken(surface=patch_2, thickness=code_block_197)
# note: Extract geometry from all Areas and fatten to a single plane. Extract area value
code_block_198 = CodeBlock(x=thicken_3) { DSCore.List.Flatten(x,-1); }
byUnion_2 = Solid.ByUnion(solids=code_block_198)
bySolid_4 = PolySurface.BySolid(solid=byUnion_2)
surfaces_4 = PolySurface.Surfaces(polySurface=bySolid_4)
acg_surface_filterbyorientation_4 = Custom[ACG Surface.FilterByOrientation](surfaces=surfaces_4)
area_4 = Surface.Area(surface=acg_surface_filterbyorientation_4.HorizontalUp)
sum_5 = Math.Sum(values=area_4)
round_6 = Math.Round(number=sum_5)

# group: Filtering
code_block_199 = CodeBlock { "Level"; ["00","GF"]; }
getParameterValueByName_43 = Element.GetParameterValueByName(element=filterByBoolMask_11.out, parameterName=code_block_199.out0)
code_block_200 = CodeBlock(lvl=getParameterValueByName_43) { lvl.Name; }
contains_14 = String.Contains(str=code_block_200, searchFor=code_block_199.out1, lacing=CrossProduct)
# note: Collect internal and external floorf from level GF/00 [IN]
anyTrue_9 = Orchid.Common.List.AnyTrue(list=contains_14)
filterByBoolMask_59 = List.FilterByBoolMask(list=filterByBoolMask_11.out, mask=anyTrue_9)

# group: Processing
geometry_3 = Element.Geometry(element=filterByBoolMask_59.in)
bySolid_5 = PolySurface.BySolid(solid=geometry_3)
surfaces_5 = PolySurface.Surfaces(polySurface=bySolid_5)
acg_surface_filterbyorientation_5 = Custom[ACG Surface.FilterByOrientation](surfaces=surfaces_5)
perimeterCurves_4 = Surface.PerimeterCurves(surface=acg_surface_filterbyorientation_5.HorizontalUp)
XY_4 = Plane.XY()
pullOntoPlane_4 = Curve.PullOntoPlane(curve=perimeterCurves_4, plane=XY_4)
polycurve_bycurves_3 = Custom[[&] PolyCurve.ByCurves](curves=pullOntoPlane_4)
patch_3 = Curve.Patch(curve=polycurve_bycurves_3)
code_block_201 = CodeBlock { 1000; }
thicken_4 = Surface.Thicken(surface=patch_3, thickness=code_block_201)
# note: Extract geometry from GF/00 with function parameter and flatten to a single plane. Extract area value
code_block_202 = CodeBlock(x=thicken_4) { DSCore.List.Flatten(x,-1); }
byUnion_3 = Solid.ByUnion(solids=code_block_202)
bySolid_6 = PolySurface.BySolid(solid=byUnion_3)
surfaces_6 = PolySurface.Surfaces(polySurface=bySolid_6)
acg_surface_filterbyorientation_6 = Custom[ACG Surface.FilterByOrientation](surfaces=surfaces_6)
area_5 = Surface.Area(surface=acg_surface_filterbyorientation_6.HorizontalUp)
sum_6 = Math.Sum(values=area_5)
round_7 = Math.Round(number=sum_6)

# group: Filtering
code_block_203 = CodeBlock { "Level"; ["00","GF"]; }
getParameterValueByName_44 = Element.GetParameterValueByName(element=filterByBoolMask_58.in, parameterName=code_block_203.out0)
contains_15 = String.Contains(str=getParameterValueByName_44, searchFor=code_block_203.out1, lacing=CrossProduct)
# note: Collect areas from level GF/00 [IN]
anyTrue_10 = Orchid.Common.List.AnyTrue(list=contains_15)
filterByBoolMask_60 = List.FilterByBoolMask(list=filterByBoolMask_58.in, mask=anyTrue_10)

# group: Processing
boundaries_2 = Area.Boundaries(area=filterByBoolMask_60.in)
XY_5 = Plane.XY()
pullOntoPlane_5 = Curve.PullOntoPlane(curve=boundaries_2, plane=XY_5)
polycurve_bycurves_4 = Custom[[&] PolyCurve.ByCurves](curves=pullOntoPlane_5)
patch_4 = Curve.Patch(curve=polycurve_bycurves_4)
code_block_204 = CodeBlock { 1000; }
thicken_5 = Surface.Thicken(surface=patch_4, thickness=code_block_204)
# note: Extract geometry from all Areas and fatten to a single plane. Extract area value
code_block_205 = CodeBlock(x=thicken_5) { DSCore.List.Flatten(x,-1); }
byUnion_4 = Solid.ByUnion(solids=code_block_205)
bySolid_7 = PolySurface.BySolid(solid=byUnion_4)
surfaces_7 = PolySurface.Surfaces(polySurface=bySolid_7)
acg_surface_filterbyorientation_7 = Custom[ACG Surface.FilterByOrientation](surfaces=surfaces_7)
area_6 = Surface.Area(surface=acg_surface_filterbyorientation_7.HorizontalUp)
sum_7 = Math.Sum(values=area_6)
round_8 = Math.Round(number=sum_7)

# group: Assing
code_block_206 = CodeBlock { "FootprintArea"; true; }
code_block_207 = CodeBlock(area=round_5) { "Footprint area as per Floors"; area/1000000; "A1"; }
list_create_39 = List.Create(item0=code_block_207.out0, item1=code_block_207.out1)
bb_data_38 = Custom[BB Data](sheetName=code_block_206.out0, origin=code_block_207.out2, data=list_create_39)
code_block_208 = CodeBlock(area=round_6) { "Footprint area as per Areas"; area/1000000; "A3"; }
list_create_40 = List.Create(item0=code_block_208.out0, item1=code_block_208.out1)
bb_data_39 = Custom[BB Data](sheetName=code_block_206.out0, origin=code_block_208.out2, data=list_create_40)
code_block_209 = CodeBlock(area=round_7) { "GF footprint area as per Floors"; area/1000000; "A5"; }
list_create_41 = List.Create(item0=code_block_209.out0, item1=code_block_209.out1)
bb_data_40 = Custom[BB Data](sheetName=code_block_206.out0, origin=code_block_209.out2, data=list_create_41)
code_block_210 = CodeBlock(area=round_8) { "GF footprint area as per Areas"; area/1000000; "A7"; }
list_create_42 = List.Create(item0=code_block_210.out0, item1=code_block_210.out1)
bb_data_41 = Custom[BB Data](sheetName=code_block_206.out0, origin=code_block_210.out2, data=list_create_42)
list_create_43 = List.Create(item0=bb_data_38, item1=bb_data_39, item2=bb_data_40, item3=bb_data_41)
write_excel_8 = Custom[Write Excel](filePath=await_, runIt=code_block_206.out1, BBData=list_create_43)

# group: Assing
# note: Hide / isolate elements in dedicated views
code_block_211 = CodeBlock(excelSheetName=code_block_206.out0) { "PHPP-"+excelSheetName+"-IN"; "PHPP-"+excelSheetName+"-OUT"; }
byName_5 = Orchid.RevitProject.Views.View.ByName(name=code_block_211.out0)
isolate_in_view_3 = Custom[Isolate in View](element=filterByBoolMask_11.out, view=byName_5)
byName_6 = Orchid.RevitProject.Views.View.ByName(name=code_block_211.out1)
hide_in_view_3 = Python(IN[0]=filterByBoolMask_11.out, IN[1]=byName_6)  # same code as hide_in_view
code_block_212 = CodeBlock(element=hide_in_view_3) { _element; }

# group: Assing
code_block_213 = CodeBlock { true; "Areas(TFA)"; }
code_block_214 = CodeBlock { "Quantity"; "E2"; }
bb_data_42 = Custom[BB Data](sheetName=code_block_213.out1, origin=code_block_214.out1, data=code_block_125.out0)
code_block_215 = CodeBlock { "To groun no."; "C2"; }
bb_data_43 = Custom[BB Data](sheetName=code_block_213.out1, origin=code_block_215.out1, data=code_block_125.out0)
code_block_216 = CodeBlock { "Area"; "K2"; }
flatten_27 = List.Flatten(list=code_block_126)
bb_data_44 = Custom[BB Data](sheetName=code_block_213.out1, origin=code_block_216.out1, data=flatten_27)
code_block_217 = CodeBlock { "Building assembly description"; "B2"; }
flatten_28 = List.Flatten(list=code_block_124)
bb_data_45 = Custom[BB Data](sheetName=code_block_213.out1, origin=code_block_217.out1, data=flatten_28)
list_create_44 = List.Create(item0=bb_data_42, item1=bb_data_43, item2=bb_data_44, item3=bb_data_45)
write_excel_9 = Custom[Write Excel](filePath=await_, runIt=code_block_213.out0, byColumn=code_block_213.out0, BBData=list_create_44)

# group: Visualisation
# note: Hide / isolate elements in dedicated views
code_block_218 = CodeBlock(excelSheetName=code_block_186.out1) { "PHPP-ZZ-"+excelSheetName+"-IN"; "PHPP-ZZ-"+excelSheetName+"-OUT"; }
byName_7 = Orchid.RevitProject.Views.View.ByName(name=code_block_218.out0)
isolate_in_view_4 = Custom[Isolate in View](element=filterByBoolMask_49.in, view=byName_7)
byName_8 = Orchid.RevitProject.Views.View.ByName(name=code_block_218.out1)
hide_in_view_4 = Python(IN[0]=filterByBoolMask_49.in, IN[1]=byName_8)  # same code as hide_in_view
code_block_219 = CodeBlock(element=hide_in_view_4) { _element; }

# group: Visualisation
list_create_45 = List.Create(item0=code_block_43, item1=get_wall_member_2.Walls, item2=filterByBoolMask_27.in)
flatten_29 = List.Flatten(list=list_create_45)

# group: Visualisation
# note: Hide / isolate elements in dedicated views
code_block_220 = CodeBlock(excelSheetName=code_block_61.out0) { "PHPP-ZZ-"+excelSheetName+"-IN"; "PHPP-ZZ-"+excelSheetName+"-OUT"; }
byName_9 = Orchid.RevitProject.Views.View.ByName(name=code_block_220.out0)
isolate_in_view_5 = Custom[Isolate in View](element=flatten_29, view=byName_9)
byName_10 = Orchid.RevitProject.Views.View.ByName(name=code_block_220.out1)
hide_in_view_5 = Python(IN[0]=flatten_29, IN[1]=byName_10)  # same code as hide_in_view
code_block_221 = CodeBlock(element=hide_in_view_5) { _element; }

# group: Filtering
code_block_222 = CodeBlock { "Function"; 1; }
# note: Filter only external floor instances
getParameterValueByName_45 = Element.GetParameterValueByName(element=type, parameterName=code_block_222.out0)
eq_14 = getParameterValueByName_45 == code_block_222.out1
filterByBoolMask_61 = List.FilterByBoolMask(list=flatten, mask=eq_14)

# group: Visualisation
# note: Hide / isolate elements in dedicated views
code_block_223 = CodeBlock(excelSheetName=code_block_61.out1) { "PHPP-ZZ-"+excelSheetName+"-IN"; "PHPP-ZZ-"+excelSheetName+"-OUT"; }
byName_11 = Orchid.RevitProject.Views.View.ByName(name=code_block_223.out0)
isolate_in_view_6 = Custom[Isolate in View](element=filterByBoolMask_61.in, view=byName_11)
byName_12 = Orchid.RevitProject.Views.View.ByName(name=code_block_223.out1)
hide_in_view_6 = Python(IN[0]=filterByBoolMask_61.in, IN[1]=byName_12)  # same code as hide_in_view
code_block_224 = CodeBlock(element=hide_in_view_6) { _element; }

# group: Visualisation
# note: Hide / isolate elements in dedicated views
code_block_225 = CodeBlock(excelSheetName=code_block_61.out2) { "PHPP-ZZ-"+excelSheetName+"-IN"; "PHPP-ZZ-"+excelSheetName+"-OUT"; }
byName_13 = Orchid.RevitProject.Views.View.ByName(name=code_block_225.out0)
isolate_in_view_7 = Custom[Isolate in View](element=code_block_47, view=byName_13)
byName_14 = Orchid.RevitProject.Views.View.ByName(name=code_block_225.out1)
hide_in_view_7 = Python(IN[0]=code_block_47, IN[1]=byName_14)  # same code as hide_in_view
code_block_226 = CodeBlock(element=hide_in_view_7) { _element; }

# group: Visualisation
# note: Hide / isolate elements in dedicated views
code_block_227 = CodeBlock(excelSheetName=code_block_206.out0) { "PHPP-ZZ-"+excelSheetName+"-IN"; "PHPP-ZZ-"+excelSheetName+"-OUT"; }
byName_15 = Orchid.RevitProject.Views.View.ByName(name=code_block_227.out0)
isolate_in_view_8 = Custom[Isolate in View](element=filterByBoolMask_11.out, view=byName_15)
byName_16 = Orchid.RevitProject.Views.View.ByName(name=code_block_227.out1)
hide_in_view_8 = Python(IN[0]=filterByBoolMask_11.out, IN[1]=byName_16)  # same code as hide_in_view
code_block_228 = CodeBlock(element=hide_in_view_8) { _element; }

# group: Visualisation
list_create_46 = List.Create(item0=filterByBoolMask_41.in, item1=filterByBoolMask_42.in, item2=filterByBoolMask_44.in, item3=get_host_element)
# note: Collect all inserts and their hosts
# 1. wall inserts
# 2. wall hosts
# 3. roof insets
# 4. roofs
flatten_30 = List.Flatten(list=list_create_46)
clear_list_10 = Custom[Clear List](input=flatten_30)

# group: Visualisation
# note: Hide / isolate elements in dedicated views
code_block_229 = CodeBlock(excelSheetName=code_block_160.out1) { "PHPP-ZZ-"+excelSheetName+"-IN"; "PHPP-ZZ-"+excelSheetName+"-OUT"; }
byName_17 = Orchid.RevitProject.Views.View.ByName(name=code_block_229.out0)
isolate_in_view_9 = Custom[Isolate in View](element=clear_list_10, view=byName_17)
byName_18 = Orchid.RevitProject.Views.View.ByName(name=code_block_229.out1)
hide_in_view_9 = Python(IN[0]=clear_list_10, IN[1]=byName_18)  # same code as hide_in_view
code_block_230 = CodeBlock(element=hide_in_view_9) { _element; }

# group: Visualisation
flatten_31 = List.Flatten(list=filterByBoolMask_56.out)
# note: Collect all inserts and their hosts
byWall = WombatDynamo.CurtainGrid.ByWall(wall=flatten_31)
getPanels = WombatDynamo.CurtainGrid.GetPanels(grid=byWall)
list_create_47 = List.Create(item0=filterByBoolMask_57.out, item1=flatten_31, item2=getPanels)
flatten_32 = List.Flatten(list=list_create_47)

# group: Visualisation
# note: Hide / isolate elements in dedicated views
code_block_231 = CodeBlock(excelSheetName=code_block_173.out1) { "PHPP-ZZ-"+excelSheetName+"-IN"; "PHPP-ZZ-"+excelSheetName+"-OUT"; }
byName_19 = Orchid.RevitProject.Views.View.ByName(name=code_block_231.out0)
isolate_in_view_10 = Custom[Isolate in View](element=flatten_32, view=byName_19@L1)
byName_20 = Orchid.RevitProject.Views.View.ByName(name=code_block_231.out1)
hide_in_view_10 = Python(IN[0]=flatten_32, IN[1]=byName_20)  # same code as hide_in_view
code_block_232 = CodeBlock(element=hide_in_view_10) { _element; }

# group: Visualisation
# note: Hide / isolate elements in dedicated views
code_block_233 = CodeBlock(excelSheetName=code_block_185.out1) { "PHPP-ZZ-"+excelSheetName+"-IN"; "PHPP-ZZ-"+excelSheetName+"-OUT"; }
byName_21 = Orchid.RevitProject.Views.View.ByName(name=code_block_233.out0)
isolate_in_view_11 = Custom[Isolate in View](element=filterByBoolMask_42.in, view=byName_21)
byName_22 = Orchid.RevitProject.Views.View.ByName(name=code_block_233.out1)
hide_in_view_11 = Python(IN[0]=filterByBoolMask_42.in, IN[1]=byName_22)  # same code as hide_in_view
code_block_234 = CodeBlock(element=hide_in_view_11) { _element; }

flatten_33 = List.Flatten(list=byElement)

# group: Visualisation
# note: Hide / isolate elements in dedicated views
code_block_235 = CodeBlock(excelSheetName=code_block_185.out2) { "PHPP-ZZ-"+excelSheetName+"-IN"; "PHPP-ZZ-"+excelSheetName+"-OUT"; }
byName_23 = Orchid.RevitProject.Views.View.ByName(name=code_block_235.out0)
isolate_in_view_12 = Custom[Isolate in View](element=flatten_33, view=byName_23)
byName_24 = Orchid.RevitProject.Views.View.ByName(name=code_block_235.out1)
hide_in_view_12 = Python(IN[0]=flatten_33, IN[1]=byName_24)  # same code as hide_in_view
code_block_236 = CodeBlock(element=hide_in_view_12) { _element; }

# group: Assing
code_block_237 = CodeBlock()
# ---------- code_block_237.designscript (26 lines) ----------
true;
"Areas";

"Angle from horizontal";
"U2";

"Quantity";
"E2";

"To groun no.";
"C2";

"Area";
"K2";

"Deviation from North";
"T2";

"Building assembly description";
"B2";

"Building assembly system";
"R2";

"Area No";
"A2";
# ----------------------------------------
bb_data_46 = Custom[BB Data](sheetName=code_block_237.out1, origin=code_block_237.out13, data=code_block_153.assemblies)
bb_data_47 = Custom[BB Data](sheetName=code_block_237.out1, origin=code_block_237.out5, data=code_block_153.quantity)
bb_data_48 = Custom[BB Data](sheetName=code_block_237.out1, origin=code_block_237.out7, data=code_block_153.out1)
bb_data_49 = Custom[BB Data](sheetName=code_block_237.out1, origin=code_block_237.out9, data=code_block_153.out2)
bb_data_50 = Custom[BB Data](sheetName=code_block_237.out1, origin=code_block_237.out15, data=code_block_153.out3)
bb_data_51 = Custom[BB Data](sheetName=code_block_237.out1, origin=code_block_237.out11, data=code_block_153.out4)
bb_data_52 = Custom[BB Data](sheetName=code_block_237.out1, origin=code_block_237.out3, data=code_block_153.out5)
bb_data_53 = Custom[BB Data](sheetName=code_block_237.out1, origin=code_block_237.out17, data=code_block_153.out8)
list_create_48 = List.Create(item0=bb_data_46, item1=bb_data_47, item2=bb_data_48, item3=bb_data_49, item4=bb_data_50, item5=bb_data_51, item6=bb_data_52, item7=bb_data_53)
write_excel_10 = Custom[Write Excel](filePath=await_, runIt=code_block_237.out0, byColumn=code_block_237.out0, BBData=list_create_48)

# group: Usage
code_block_238 = CodeBlock { "Export to PHPP"; }
acg_script_usage = Custom[ACG Script Usage](scriptName=code_block_238)  # Adds an entry to Excel document every time a script is run. The document is located in S:\Dynamo\05-UsageStats

# group: Visualisation
# note: 0. flooors (areas)
# 1. roofs (areas)
# 2. walls (areas)
# 3. flooors (uvalues)
# 4. roofs (uvalues)
# 5. walls (uvalues)
# 6. inserts
# 7. curtain walls
list_create_49 = List.Create(item0=filterByBoolMask_49.in, item1=filterByBoolMask_25.out, item2=watch, item3=filterByBoolMask_61.in, item4=code_block_47, item5=flatten_29, item6=clear_list_10, item7=flatten_32)
flatten_34 = List.Flatten(list=list_create_49)
uniqueItems_4 = List.UniqueItems(list=flatten_34)

# group: Visualisation
# note: Hide / isolate elements in dedicated views
code_block_239 = CodeBlock { "PHPP-ZZ-All-IN"; "PHPP-ZZ-All-OUT"; }
byName_25 = Orchid.RevitProject.Views.View.ByName(name=code_block_239.out0)
isolate_in_view_13 = Custom[Isolate in View](element=uniqueItems_4, view=byName_25@L1)
byName_26 = Orchid.RevitProject.Views.View.ByName(name=code_block_239.out1)
hide_in_view_13 = Python(IN[0]=uniqueItems_4, IN[1]=byName_26)  # same code as hide_in_view
code_block_240 = CodeBlock(element=hide_in_view_13) { _element; }
