# Dynamo graph Callouts - Get Parent View.dyn (Dynamo 2.12.1.8246)
# packages: RIE 2020.12.2, Data-Shapes 2021.2.92

# group: Input
code_block = CodeBlock { "Note:"; }
string = StringInput("This tool will report the parent view of the active callout.")
textnote_data = Custom[TextNote Data](Title=code_block, TextNote=string)  # package Data-Shapes; Create Data for TextNote input in UI.MultipleInputForm ++ . Check out www.data-shapes.net for more informations

# group: Input
file_path = Filename("..\ACG_logo.png")
file_from_path = FileObject(path=file_path)
readFromFile = Image.ReadFromFile(file=file_from_path)
code_block_2 = CodeBlock { true; "Run"; "Cancel"; 350; }
ui_multipleinputform = Custom[UI.MultipleInputForm ++](Logo_optional=readFromFile, ButtonText_optional=code_block_2.out1, Inputs=textnote_data, Toggle=code_block_2.out0, Width_optional=code_block_2.out3)  # package Data-Shapes; Create a form with multiple inputs. see www.data-shapes.net for tutorials and infos!

end = Revit.Transaction.Transaction.End(input=ui_multipleinputform.Was_Run)
RIE_ActiveView = Custom[RIE_ActiveView](Refresh=end)  # package RIE; Returns active view in current document.
code_block_3 = CodeBlock { "Parent View"; }
getParameterValueByName = Element.GetParameterValueByName(element=RIE_ActiveView, parameterName=code_block_3)
code_block_4 = CodeBlock(v=getParameterValueByName) { v.Name; }
code_block_5 = CodeBlock { "Sheet Number"; }
getParameterValueByName_2 = Element.GetParameterValueByName(element=getParameterValueByName, parameterName=code_block_5)
code_block_6 = CodeBlock(pView=code_block_4, sNumber=getParameterValueByName_2) { "Result"; "Parent view: \n"+pView+"\n\n"+"Placed on Sheet number: \n"+sNumber; }
code_block_7 = CodeBlock(input=code_block_4, b=code_block_6.out1) { input==null?"Active view has no parent. Please open a Callout view.":b; }

# group: Visualisation
file_path_2 = Filename("..\ACG_logo.png")
file_from_path_2 = FileObject(path=file_path_2)
readFromFile_2 = Image.ReadFromFile(file=file_from_path_2)
code_block_8 = CodeBlock { "Okay. Thanks."; true; }
textnote_data_2 = Custom[TextNote Data](Title=code_block_6.out0, TextNote=code_block_7)
code_block_9 = CodeBlock { 350; }
ui_multipleinputform_2 = Custom[UI.MultipleInputForm ++](Logo_optional=readFromFile_2, ButtonText_optional=code_block_8.out0, Inputs=textnote_data_2, Toggle=code_block_8.out1, Width_optional=code_block_9)

# group: Usage
code_block_10 = CodeBlock { "Callouts - Get Parent View"; }
acg_script_usage = Custom[ACG Script Usage](scriptName=code_block_10)  # Adds an entry to Excel document every time a script is run. The document is located in S:\Dynamo\05-UsageStats
