# Dynamo graph Views - Delete Revision Clouds_py.dyn (Dynamo 2.12.1.8246)
# packages: Data-Shapes 2021.2.92

# group: Usage
code_block = CodeBlock { "Views - Delete Revision Clouds"; }
acg_script_usage = Custom[ACG Script Usage](scriptName=code_block)  # Adds an entry to Excel document every time a script is run. The document is located in S:\Dynamo\05-UsageStats

file_path = Filename("..\ACG_logo.png")
file_from_path = FileObject(path=file_path)
readFromFile = Image.ReadFromFile(file=file_from_path)

# group: Visualisation
python_script = Python()  # IronPython2
# ---------- python_script.python (48 lines) ----------
# Load the Python Standard and DesignScript Libraries
import clr
import sys
import os.path
from datetime import datetime
from System import Environment
sys.path.append('C:\Program Files (x86)\IronPython 2.7\Lib')
import System
from System import Array
from System.Collections.Generic import *
clr.AddReference('ProtoGeometry')
from Autodesk.DesignScript.Geometry import *
clr.AddReference("RevitNodes")
import Revit
clr.ImportExtensions(Revit.Elements)
clr.ImportExtensions(Revit.GeometryConversion)
clr.AddReference("RevitServices")
import RevitServices
from RevitServices.Persistence import DocumentManager 
from RevitServices.Transactions import TransactionManager 

clr.AddReference("RevitAPI")
clr.AddReference("RevitAPIUI")

import Autodesk 
from Autodesk.Revit.DB import *
from Autodesk.Revit.UI import *
import time

doc = DocumentManager.Instance.CurrentDBDocument
uiapp = DocumentManager.Instance.CurrentUIApplication 
app = uiapp.Application 
uidoc = uiapp.ActiveUIDocument

sheets = FilteredElementCollector(doc).OfClass(ViewSheet).ToElements()

viewsOnSheets = []
vosNames = []

for sheet in sheets:
	for vId in sheet.GetAllPlacedViews():
		if vId not in viewsOnSheets:
			view = doc.GetElement(vId)
			strId = str(view.Id)
			viewsOnSheets.append(int(strId))
			vosNames.append(view.Name)

OUT = vosNames, viewsOnSheets
# ----------------------------------------
# note: get all view names
code_block_2 = CodeBlock(x=python_script) { name = x[0]; view = x[1]; }

# group: Input
code_block_3 = CodeBlock { "Select Views (placed on Sheet)"; true; "Delete Revision Clouds"; "Cancel"; 300; 700; }
code_block_4 = CodeBlock()
# ---------- code_block_4.designscript (2 lines) ----------
"Note:";
"This tool will delete all Revision Clouds placed on the selected views. Only views placed on a Sheet will be eligible for selection.";
# ----------------------------------------
textnote_data = Custom[TextNote Data](Title=code_block_4.out0, TextNote=code_block_4.out1)  # package Data-Shapes; Create Data for TextNote input in UI.MultipleInputForm ++ . Check out www.data-shapes.net for more informations
code_block_5 = CodeBlock { "Select Views (placed on Sheet)"; false; 600; }
listview_data = Custom[Listview Data](InputName=code_block_5.out0, Keys=code_block_2.name, Values=code_block_2.view, Height_optionnal=code_block_5.out2, ShowId_optionnal=code_block_5.out1)  # package Data-Shapes; Create data for ListView input in UI.MultiInputForm ++ . Check out www.data-shapes.net for more infos.
list_create = List.Create(item0=textnote_data, item1=listview_data)
multipleinputform = Custom[MultipleInputForm ++](Logo_optional=readFromFile, ButtonText_optional=code_block_3.out2, Inputs=list_create, Toggle=code_block_3.out1, CancelButtonText_optional=code_block_3.out3, Width_optional=code_block_3.out5, LabelWidth_optional=code_block_3.out4)  # package Data-Shapes; Create a form with multiple inputs. see www.data-shapes.net for tutorials and infos!

# group: Visualisation
python_script_2 = Python(IN[0]=multipleinputform.User_Inputs, IN[1]=multipleinputform.Was_Cancelled)  # IronPython2
# ---------- python_script_2.python (60 lines) ----------
# Load the Python Standard and DesignScript Libraries
import clr
import sys
import os.path
from datetime import datetime
from System import Environment
sys.path.append('C:\Program Files (x86)\IronPython 2.7\Lib')
import System
from System import Array
from System.Collections.Generic import *
clr.AddReference('ProtoGeometry')
from Autodesk.DesignScript.Geometry import *
clr.AddReference("RevitNodes")
import Revit
clr.ImportExtensions(Revit.Elements)
clr.ImportExtensions(Revit.GeometryConversion)
clr.AddReference("RevitServices")
import RevitServices
from RevitServices.Persistence import DocumentManager 
from RevitServices.Transactions import TransactionManager 

clr.AddReference("RevitAPI")
clr.AddReference("RevitAPIUI")

import Autodesk 
from Autodesk.Revit.DB import *
from Autodesk.Revit.UI import *
import time

doc = DocumentManager.Instance.CurrentDBDocument
uiapp = DocumentManager.Instance.CurrentUIApplication 
app = uiapp.Application 
uidoc = uiapp.ActiveUIDocument

strIDs = IN[0][0]
cancelled = IN[1]
report = []
views = []

for id in strIDs:
	viewId = ElementId(id)
	view = doc.GetElement(viewId)
	views.append(view)

if not cancelled:
	count = 0
	for view in views:
		try:
			revCs = FilteredElementCollector(doc, view.Id).OfCategory(BuiltInCategory.OST_RevisionClouds).WhereElementIsNotElementType().ToElements()

			TransactionManager.Instance.EnsureInTransaction(doc)
			for r in revCs:
				count +=1
				doc.Delete(r.Id)
			TransactionManager.Instance.TransactionTaskDone()

		except:
			continue
			
	OUT = 'Report :', str(count) + ' revision clouds were deleted from the selected views.', True
# ----------------------------------------

# group: Input
code_block_6 = CodeBlock(x=python_script_2) { "Ok"; title = x[0]; text = x[1]; run = x[2]; }
textnote_data_2 = Custom[TextNote Data](Title=code_block_6.title, TextNote=code_block_6.text)
multipleinputform_2 = Custom[MultipleInputForm ++](Logo_optional=readFromFile, ButtonText_optional=code_block_6.out0, Inputs=textnote_data_2, Toggle=code_block_6.run)
