# Dynamo graph Isolate All_py.dyn (Dynamo 2.12.1.8246)

# group: Usage
code_block = CodeBlock { "Isolate All"; }
acg_script_usage = Custom[ACG Script Usage](scriptName=code_block)  # Adds an entry to Excel document every time a script is run. The document is located in S:\Dynamo\05-UsageStats

# group: Isoate warning element in active view
code_block_2 = CodeBlock { true; }
python_script = Python(IN[0]=code_block_2)  # IronPython2
# ---------- python_script.python (48 lines) ----------
# Load the Python Standard and DesignScript Libraries
import clr
import sys
import os.path
from datetime import datetime
from System import Environment
sys.path.append('C:\Program Files (x86)\IronPython 2.7\Lib')
import System
from System import Array
from System.Collections.Generic import *
clr.AddReference('ProtoGeometry')
from Autodesk.DesignScript.Geometry import *
clr.AddReference("RevitNodes")
import Revit
clr.ImportExtensions(Revit.Elements)
clr.ImportExtensions(Revit.GeometryConversion)
clr.AddReference("RevitServices")
import RevitServices
from RevitServices.Persistence import DocumentManager 
from RevitServices.Transactions import TransactionManager 

clr.AddReference("RevitAPI")
clr.AddReference("RevitAPIUI")

import Autodesk 
from Autodesk.Revit.DB import *
from Autodesk.Revit.UI import *
import time

doc = DocumentManager.Instance.CurrentDBDocument
uiapp = DocumentManager.Instance.CurrentUIApplication 
app = uiapp.Application 
uidoc = uiapp.ActiveUIDocument

runMe = IN[0]

if runMe:
	warnings = doc.GetWarnings()
	idsToIsolate = List[ElementId]()
	
	for w in warnings:
		ids = w.GetFailingElements()
		for i in ids:
			idsToIsolate.Add(i)
			
	TransactionManager.Instance.EnsureInTransaction(doc)
	doc.ActiveView.	IsolateElementsTemporary(idsToIsolate)
	TransactionManager.Instance.TransactionTaskDone()
# ----------------------------------------
